# Grasshopper definition 01_Numerical.gh (Grasshopper 1.0.7)
# plug-ins: LunchBoxML, LunchBox, eleFront Rhino 6 Legacy

# ---- group: Click on checks to select
select_analytical_categories = ValueList({"Completion year": 0, "Last refurbishment": 1, "Footprint area": 2, "Auditorium area": 3, "Stage area": 4, "Auditorium capacity": 5, "Stage capacity": 6, "Roof": 7, "Cost": 8, "Radial/Hybrid/Ortho": 9, "Seating inclination": 10, "Seat spacing": 11, "Row depth": 12, "Stage location": 13, "Expandability": 14, "Circulation direct/interupted": 15, "Escape distance": 16, "Backstage": 17, "Seating continuity": 18, "Sound direction": 19, "Ceremonial movement": 20, "Group / individual experience": 21}, selected=["Footprint area", "Row depth", "Stage location", "Expandability", "Circulation direct/interupted", "Backstage", "Group / individual experience"])

# ---- group: Bake icons
button = Button()

# ---- group: Data input
data = Data("C:\Users\yakim\Desktop\PhD\210715 Year 2\200804 comparative table\200902 comparative table.xlsx")
excelread = ExcelReader(ReadExcelData=Toggle(True), WorkbookPath=data, WorksheetName="Sheet1")  # -> Exceptions, ExcelData
panel = Panel(excelread.ExcelData)
tstat = TreeStatistics(Tree=excelread.ExcelData)  # -> Paths, Length, Count
split = SplitList(List=tstat.Paths, Index=Slider(2, range=0..10))  # -> ListA, ListB
branch = TreeBranch(Tree=excelread.ExcelData, Path=split.ListB, MaintainPaths=True)
split_2 = SplitList(List=branch, Index=Slider(1, range=0..1))  # -> ListA, ListB
tstat_2 = TreeStatistics(Tree=split_2.ListB)  # -> Paths, Length, Count

# ----
repeat_data = RepeatData(Data="0", Length="22")
replace_items = ReplaceItems(List=repeat_data, Item="1", Indices=select_analytical_categories, Wrap=False)
flatten = FlattenTree(Tree=split_2.ListA, Path="{0}")

# ---- group: Text and groups
lng = ListLength(List=flatten)
series = Series(Start=0, Step=1, Count=lng)
dispatch = Dispatch(List=flatten(series), DispatchPattern=replace_items)  # -> ListA, ListB
replace = ReplaceItems(List=flatten(flatten), Indices=dispatch.ListB, Wrap=False)
replace_2 = ReplaceItems(List=flatten(flatten), Indices=dispatch.ListA, Wrap=False)
pt = ConstructPoint(XCoordinate=Slider(-50, range=-200..100), YCoordinate=0, ZCoordinate=0)
join = TextJoin(Text=replace_2)
pt_2 = ConstructPoint(XCoordinate=Slider(-50, range=-200..100), YCoordinate=0, ZCoordinate=0)
join_2 = TextJoin(Text=replace)
tag = TextTag3D(Location=pt, Text=join, Size=Slider(5, range=0..100), Colour=ColourSwatch(SwatchColor=RGB(79, 79, 79)), Justification=7)
tag_2 = TextTag3D(
    Location=pt_2,
    Text=join_2,
    Size=Slider(5, range=0..100),
    Colour=ColourSwatch(SwatchColor=RGB(201, 0, 144)),
    Justification=7)

# ----
dispatch_2 = Dispatch(List=tstat_2.Paths, DispatchPattern=replace_items)  # -> ListA, ListB
branch_2 = TreeBranch(Tree=split_2.ListB, Path=dispatch_2.ListA, MaintainPaths=True)
flip = FlipMatrix(Data=branch_2)

# ---- group: K-means clustering
k_means = KMeansClustering(TrainingInputs=flip, OfClusters=Slider(4, range=0..10), RandomSeed=5)  # -> Result, Likelihood, Centroids

# ---- group: Position icons
listblockd = ListBlockDocument()
pt_3 = ConstructPoint(XCoordinate=Slider(50, range=0..100), YCoordinate=Slider(45, range=0..100), ZCoordinate=0)
pt_4 = ConstructPoint(XCoordinate=Slider(50, range=0..100), YCoordinate=Slider(-455, range=-1000..100), ZCoordinate=0)
pt_5 = ConstructPoint(XCoordinate=Slider(50, range=0..100), YCoordinate=Slider(-240, range=-1000..100), ZCoordinate=0)
pt_6 = ConstructPoint(XCoordinate=Slider(50, range=0..100), YCoordinate=Slider(-385, range=-1000..100), ZCoordinate=0)
equals = Equality(FirstNumber=k_means.Result, SecondNumber="0")  # -> Equality, Inequality
equals_2 = Equality(FirstNumber=k_means.Result, SecondNumber="1")  # -> Equality, Inequality
equals_3 = Equality(FirstNumber=k_means.Result, SecondNumber="2")  # -> Equality, Inequality
equals_4 = Equality(FirstNumber=k_means.Result, SecondNumber="3")  # -> Equality, Inequality
recgrid = Rectangular(
    Plane=pt_3,
    SizeX=Slider(70, range=0..100),
    SizeY=expr("x*-1", Slider(70, range=0..100)),
    ExtentX=10,
    ExtentY=Slider(4, range=0..10))  # -> Cells, Points
recgrid_2 = Rectangular(
    Plane=pt_4,
    SizeX=Slider(70, range=0..100),
    SizeY=expr("x*-1", Slider(70, range=0..100)),
    ExtentX=10,
    ExtentY=Slider(1, range=0..10))  # -> Cells, Points
recgrid_3 = Rectangular(
    Plane=pt_5,
    SizeX=Slider(70, range=0..100),
    SizeY=expr("x*-1", Slider(70, range=0..100)),
    ExtentX=10,
    ExtentY=Slider(2, range=0..10))  # -> Cells, Points
recgrid_4 = Rectangular(
    Plane=pt_6,
    SizeX=Slider(70, range=0..100),
    SizeY=expr("x*-1", Slider(70, range=0..100)),
    ExtentX=10,
    ExtentY=Slider(1, range=0..10))  # -> Cells, Points
dispatch_3 = Dispatch(List=listblockd, DispatchPattern=equals_3.Equality)  # -> ListA, ListB
dispatch_4 = Dispatch(List=listblockd, DispatchPattern=equals.Equality)  # -> ListA, ListB
dispatch_5 = Dispatch(List=listblockd, DispatchPattern=equals_2.Equality)  # -> ListA, ListB
dispatch_6 = Dispatch(List=listblockd, DispatchPattern=equals_4.Equality)  # -> ListA, ListB
area = Area(Geometry=recgrid.Cells)  # -> Area, Centroid
area_2 = Area(Geometry=recgrid_2.Cells)  # -> Area, Centroid
area_3 = Area(Geometry=recgrid_3.Cells)  # -> Area, Centroid
area_4 = Area(Geometry=recgrid_4.Cells)  # -> Area, Centroid
flip_2 = FlipMatrix(Data=area.Centroid)
flip_3 = FlipMatrix(Data=area_2.Centroid)
flip_4 = FlipMatrix(Data=area_3.Centroid)
flip_5 = FlipMatrix(Data=area_4.Centroid)
lng_2 = ListLength(List=dispatch_4.ListA)
lng_3 = ListLength(List=dispatch_5.ListA)
lng_4 = ListLength(List=dispatch_3.ListA)
lng_5 = ListLength(List=dispatch_6.ListA)
entwine = Entwine(Branch00=lng_2, Branch01=lng_3, Branch02=lng_4, Branch03=lng_5, FlattenInputs=True)
entwine_2 = Entwine(
    Branch00=dispatch_4.ListA,
    Branch01=dispatch_5.ListA,
    Branch02=dispatch_3.ListA,
    Branch03=dispatch_6.ListA,
    FlattenInputs=True)
tstat_3 = TreeStatistics(Tree=entwine_2)  # -> Paths, Length, Count
sort = SortList(Keys=flatten(entwine), ValuesA=tstat_3.Paths)  # -> Keys, ValuesA
branch_3 = TreeBranch(Tree=entwine_2, Path=reverse(sort.ValuesA), MaintainPaths=False)
entwine_3 = Entwine(
    Branch00=flatten(flip_2),
    Branch01=flatten(flip_4),
    Branch02=flatten(flip_5),
    Branch03=flatten(flip_3),
    FlattenInputs=True)
lng_6 = ListLength(List=branch_3)
split_3 = SplitList(List=entwine_3, Index=lng_6)  # -> ListA, ListB
inblock = InsertBlock(BlockName=branch_3, SourcePlane=split_3.ListA)
bbox = BoundingBox(Content=inblock, Plane=PlaneXY(0, 0, 0), UnionBox=True)  # -> Box, Box_2
debrep = DeconstructBrep(Brep=bbox.Box)  # -> Faces, Edges, Vertices
item = ListItem(List=debrep.Faces, Index=0, Wrap=True)
debrep_2 = DeconstructBrep(Brep=item)  # -> Faces, Edges, Vertices
join_3 = JoinCurves(Curves=debrep_2.Edges, Preserve=False)
offset = OffsetCurve(Curve=join_3, Distance=Slider(5, range=0..10), Plane=PlaneXY(0, 0, 0), Corners=1)
object_bake = ObjectBake(
    BakeToggle=button,
    GeometryObjects=[inblock, offset],
    Layer="GH_Bake",
    ObjectName="GH_Obj",
    ObjectColor=RGB(255, 255, 255),
    LayerColor=RGB(255, 255, 255))
preview = CustomPreview(Geometry=offset, Material=ColourSwatch(SwatchColor=RGB(79, 79, 79)))
