# Grasshopper definition 02_Spatial Numerical Machine Learning Model.gh (Grasshopper 1.0.7)
# plug-ins: Human, LunchBox, LunchBoxML, eleFront Rhino 6 Legacy

# ----
# Polyline data input
crv = Curve([<curve referenced from the Rhino model> x197])
crv_2 = Curve([<curve referenced from the Rhino model> x411])
crv_3 = Curve([<curve referenced from the Rhino model> x361])
crv_4 = Curve([<curve referenced from the Rhino model> x140])
crv_5 = Curve([<curve referenced from the Rhino model> x49])

crv_6 = Curve([<curve referenced from the Rhino model> x145])
crv_7 = Curve([<curve referenced from the Rhino model> x33])
crv_8 = Curve([<curve referenced from the Rhino model> x154])
crv_9 = Curve([<curve referenced from the Rhino model> x63])
crv_10 = Curve([<curve referenced from the Rhino model> x101])
crv_11 = Curve([<curve referenced from the Rhino model> x225])
crv_12 = Curve([<curve referenced from the Rhino model> x130])
crv_13 = Curve([<curve referenced from the Rhino model> x127])

crv_14 = Curve([<curve referenced from the Rhino model> x88])
crv_15 = Curve([<curve referenced from the Rhino model> x221])
crv_16 = Curve([<curve referenced from the Rhino model> x87])
crv_17 = Curve([<curve referenced from the Rhino model> x73])

crv_18 = Curve([<curve referenced from the Rhino model> x265])
crv_19 = Curve([<curve referenced from the Rhino model> x159])
crv_20 = Curve([<curve referenced from the Rhino model> x129])
crv_21 = Curve([<curve referenced from the Rhino model> x31])
crv_22 = Curve([<curve referenced from the Rhino model> x36])
crv_23 = Curve([<curve referenced from the Rhino model> x206])
crv_24 = Curve([<curve referenced from the Rhino model> x199])

crv_25 = Curve([<curve referenced from the Rhino model> x118])
crv_26 = Curve([<curve referenced from the Rhino model> x92])
crv_27 = Curve([<curve referenced from the Rhino model> x56])
crv_28 = Curve([<curve referenced from the Rhino model> x129])
crv_29 = Curve([<curve referenced from the Rhino model> x86])
crv_30 = Curve([<curve referenced from the Rhino model> x63])

crv_31 = Curve([<curve referenced from the Rhino model> x194])
crv_32 = Curve([<curve referenced from the Rhino model> x19])

crv_33 = Curve([<curve referenced from the Rhino model> x12])
crv_34 = Curve([<curve referenced from the Rhino model> x80])
crv_35 = Curve([<curve referenced from the Rhino model> x40])
crv_36 = Curve([<curve referenced from the Rhino model> x36])
crv_37 = Curve([<curve referenced from the Rhino model> x19])

crv_38 = Curve([<curve referenced from the Rhino model> x74])
crv_39 = Curve([<curve referenced from the Rhino model> x45])
crv_40 = Curve([<curve referenced from the Rhino model> x15])

crv_41 = Curve([<curve referenced from the Rhino model> x46])
crv_42 = Curve([<curve referenced from the Rhino model> x53])
crv_43 = Curve([<curve referenced from the Rhino model> x36])
crv_44 = Curve([<curve referenced from the Rhino model> x29])
crv_45 = Curve([<curve referenced from the Rhino model> x179])

crv_46 = Curve([<curve referenced from the Rhino model> x37])
crv_47 = Curve([<curve referenced from the Rhino model> x74])
crv_48 = Curve([<curve referenced from the Rhino model> x64])
crv_49 = Curve([<curve referenced from the Rhino model> x64])
crv_50 = Curve([<curve referenced from the Rhino model> x11])
crv_51 = Curve([<curve referenced from the Rhino model> x2])

crv_52 = Curve([<curve referenced from the Rhino model> x26])
crv_53 = Curve([<curve referenced from the Rhino model> x84])
crv_54 = Curve([<curve referenced from the Rhino model> x67])
crv_55 = Curve([<curve referenced from the Rhino model> x30])
crv_56 = Curve([<curve referenced from the Rhino model> x12])

crv_57 = Curve([<curve referenced from the Rhino model> x37])
crv_58 = Curve([<curve referenced from the Rhino model> x29])
crv_59 = Curve([<curve referenced from the Rhino model> x28])
crv_60 = Curve([<curve referenced from the Rhino model> x29])

crv_61 = Curve([<curve referenced from the Rhino model> x39])
crv_62 = Curve([<curve referenced from the Rhino model> x4])

crv_63 = Curve([<curve referenced from the Rhino model> x51])
crv_64 = Curve([<curve referenced from the Rhino model> x75])
crv_65 = Curve([<curve referenced from the Rhino model> x40])
crv_66 = Curve([<curve referenced from the Rhino model> x32])
crv_67 = Curve([<curve referenced from the Rhino model> x26])
crv_68 = Curve([<curve referenced from the Rhino model> x16])

crv_69 = Curve([<curve referenced from the Rhino model> x8])
crv_70 = Curve([<curve referenced from the Rhino model> x13])

crv_71 = Curve([<curve referenced from the Rhino model> x19])
crv_72 = Curve([<curve referenced from the Rhino model> x22])
crv_73 = Curve([<curve referenced from the Rhino model> x10])
crv_74 = Curve([<curve referenced from the Rhino model> x6])

crv_75 = Curve([<curve referenced from the Rhino model> x24])

crv_76 = Curve([<curve referenced from the Rhino model> x16])
crv_77 = Curve([<curve referenced from the Rhino model> x13])

crv_78 = Curve([<curve referenced from the Rhino model> x20])

crv_79 = Curve([<curve referenced from the Rhino model> x29])
crv_80 = Curve([<curve referenced from the Rhino model> x16])
crv_81 = Curve([<curve referenced from the Rhino model> x11])
crv_82 = Curve([<curve referenced from the Rhino model> x23])

crv_83 = Curve([<curve referenced from the Rhino model> x69])
crv_84 = Curve([<curve referenced from the Rhino model> x12])
crv_85 = Curve([<curve referenced from the Rhino model> x12])
crv_86 = Curve([<curve referenced from the Rhino model> x26])
crv_87 = Curve([<curve referenced from the Rhino model> x10])
crv_88 = Curve([<curve referenced from the Rhino model> x10])

crv_89 = Curve([<curve referenced from the Rhino model> x23])
crv_90 = Curve([<curve referenced from the Rhino model> x33])
crv_91 = Curve([<curve referenced from the Rhino model> x56])
crv_92 = Curve([<curve referenced from the Rhino model> x30])
crv_93 = Curve([<curve referenced from the Rhino model> x30])

crv_94 = Curve([<curve referenced from the Rhino model> x18])
crv_95 = Curve([<curve referenced from the Rhino model> x11])
crv_96 = Curve([<curve referenced from the Rhino model> x17])
crv_97 = Curve([<curve referenced from the Rhino model> x20])
crv_98 = Curve([<curve referenced from the Rhino model> x8])
crv_99 = Curve([<curve referenced from the Rhino model> x22])
crv_100 = Curve([<curve referenced from the Rhino model> x9])
crv_101 = Curve([<curve referenced from the Rhino model> x5])
crv_102 = Curve([<curve referenced from the Rhino model> x7])
crv_103 = Curve([<curve referenced from the Rhino model> x73])
crv_104 = Curve([<curve referenced from the Rhino model> x728])
crv_105 = Curve([<curve referenced from the Rhino model> x913])
crv_106 = Curve([<curve referenced from the Rhino model> x377])
crv_107 = Curve([<curve referenced from the Rhino model> x72])

crv_108 = Curve([<curve referenced from the Rhino model> x31])
crv_109 = Curve([<curve referenced from the Rhino model> x35])

crv_110 = Curve([<curve referenced from the Rhino model> x393])
crv_111 = Curve([<curve referenced from the Rhino model> x63])
crv_112 = Curve([<curve referenced from the Rhino model> x63])
crv_113 = Curve([<curve referenced from the Rhino model> x76])
crv_114 = Curve([<curve referenced from the Rhino model> x76])

crv_115 = Curve([<curve referenced from the Rhino model> x562])
crv_116 = Curve([<curve referenced from the Rhino model> x59])

crv_117 = Curve([<curve referenced from the Rhino model> x57])
crv_118 = Curve([<curve referenced from the Rhino model> x44])

crv_119 = Curve([<curve referenced from the Rhino model> x33])
crv_120 = Curve([<curve referenced from the Rhino model> x14])
crv_121 = Curve([<curve referenced from the Rhino model> x7])
crv_122 = Curve([<curve referenced from the Rhino model> x7])
crv_123 = Curve([<curve referenced from the Rhino model> x7])
crv_124 = Curve([<curve referenced from the Rhino model> x7])

crv_125 = Curve([<curve referenced from the Rhino model> x71])
crv_126 = Curve([<curve referenced from the Rhino model> x16])
crv_127 = Curve([<curve referenced from the Rhino model> x42])
crv_128 = Curve([<curve referenced from the Rhino model> x19])

entwine_stadiums = Entwine(
    Branch00=crv,
    Branch01=crv_2,
    Branch02=crv_3,
    Branch03=crv_4,
    Branch04=crv_5,
    Branch05=crv_6,
    Branch06=crv_7,
    Branch07=crv_8,
    Branch08=crv_9,
    Branch09=crv_10,
    Branch010=crv_11,
    Branch011=crv_12,
    Branch012=crv_13,
    Branch013=crv_14,
    Branch014=crv_15,
    Branch015=crv_16,
    Branch016=crv_17,
    Branch017=crv_18,
    Branch018=crv_19,
    Branch019=crv_20,
    Branch020=crv_21,
    Branch021=crv_22,
    Branch022=crv_23,
    Branch023=crv_24,
    Branch024=crv_25,
    Branch025=crv_26,
    Branch026=crv_27,
    Branch027=crv_28,
    Branch028=crv_29,
    Branch029=crv_30,
    Branch030=crv_31,
    Branch031=crv_32,
    Branch032=crv_33,
    Branch033=crv_34,
    Branch034=crv_35,
    Branch035=crv_36,
    Branch036=crv_37,
    Branch037=crv_38,
    Branch038=crv_39,
    Branch039=crv_40,
    Branch040=crv_41,
    Branch041=crv_42,
    Branch042=crv_43,
    Branch043=crv_44,
    Branch044=crv_45,
    Branch045=crv_46,
    Branch046=crv_47,
    Branch047=crv_51,
    Branch048=crv_48,
    Branch049=crv_49,
    Branch050=crv_50,
    Branch051=crv_52,
    Branch052=crv_53,
    Branch053=crv_54,
    Branch054=crv_55,
    Branch055=crv_56,
    Branch056=crv_57,
    Branch057=crv_58,
    Branch058=crv_59,
    Branch059=crv_60,
    Branch060=crv_61,
    Branch061=crv_62,
    Branch062=crv_63,
    Branch063=crv_64,
    Branch064=crv_65,
    Branch065=crv_66,
    Branch066=crv_67,
    Branch067=crv_68,
    Branch068=crv_69,
    Branch069=crv_70,
    Branch070=crv_71,
    Branch071=crv_72,
    Branch072=crv_73,
    Branch073=crv_74,
    Branch074=crv_75,
    Branch075=crv_76,
    Branch076=crv_77,
    Branch077=crv_78,
    Branch078=crv_79,
    Branch079=crv_80,
    Branch080=crv_81,
    Branch081=crv_82,
    Branch082=crv_83,
    Branch083=crv_84,
    Branch084=crv_85,
    Branch085=crv_86,
    Branch086=crv_87,
    Branch087=crv_88,
    Branch088=crv_89,
    Branch089=crv_90,
    Branch090=crv_91,
    Branch091=crv_92,
    Branch092=crv_93,
    Branch093=crv_94,
    Branch094=crv_95,
    Branch095=crv_96,
    Branch096=crv_97,
    Branch097=crv_98,
    Branch098=crv_99,
    Branch099=crv_100,
    Branch0100=crv_101,
    Branch0101=crv_102,
    Branch0102=crv_103,
    Branch0103=crv_104,
    Branch0104=crv_105,
    Branch0105=crv_106,
    Branch0106=crv_107,
    Branch0107=crv_108,
    Branch0108=crv_109,
    Branch0109=crv_110,
    Branch0110=crv_111,
    Branch0111=crv_112,
    Branch0112=crv_113,
    Branch0113=crv_114,
    Branch0114=crv_115,
    Branch0115=crv_116,
    Branch0116=crv_117,
    Branch0117=crv_118,
    Branch0118=crv_119,
    Branch0119=crv_120,
    Branch0120=crv_121,
    Branch0121=crv_122,
    Branch0122=crv_123,
    Branch0123=crv_124,
    Branch0124=crv_125,
    Branch0125=crv_126,
    Branch0126=crv_127,
    Branch0127=crv_128,
    FlattenInputs=True)
merge = Merge(Data1=entwine_stadiums)
crv_129 = Curve(merge)
objatts = ObjectAttributes(ObjectOrAttributes=crv_129)  # -> Name, LayerName, LayerFullPath, Color, MaterialName, LinetypeName, GroupIndices, PlotWeight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
split = TextSplit(Text=objatts.LayerFullPath, Separators=":")
len = TextLength(Text=split)
item = ListItem(List=len, Index="1", Wrap=True)
tstat = TreeStatistics(Tree=split)  # -> Paths, Length, Count
equals = Equality(FirstNumber=item, SecondNumber="0")  # -> Equality, Inequality
dispatch = Dispatch(List=tstat.Paths, DispatchPattern=flatten(equals.Equality))  # -> ListA, ListB
branch = TreeBranch(Tree=split, Path=dispatch.ListA, MaintainPaths=True)
lng = ListLength(List=branch)
tstat_2 = TreeStatistics(Tree=branch)  # -> Paths, Length, Count

branch_2 = TreeBranch(Tree=graft(crv_129), Path=dispatch.ListB, MaintainPaths=True)
branch_3 = TreeBranch(Tree=split, Path=dispatch.ListB, MaintainPaths=True)

tmatch = MatchText(Text=branch_3, Pattern="Footprint", Case=True)
equals_2 = Equality(FirstNumber=lng, SecondNumber=Slider(3, range=0..10))  # -> Equality, Inequality
dispatch_2 = Dispatch(List=tstat_2.Paths, DispatchPattern=flatten(equals_2.Equality))  # -> ListA, ListB
tstat_3 = TreeStatistics(Tree=branch_2)  # -> Paths, Length, Count
dispatch_3 = Dispatch(List=tstat_3.Paths, DispatchPattern=flatten(tmatch))  # -> ListA, ListB
branch_4 = TreeBranch(Tree=branch_2, Path=dispatch_3.ListA, MaintainPaths=True)
trim = TrimTree(Tree=branch_4, Depth=1)
area = Area(Geometry=trim)  # -> Area, Centroid
pdecon = Deconstruct(Point=area.Centroid)  # -> XComponent, YComponent, ZComponent
equals_3 = Equality(FirstNumber=pdecon.ZComponent, SecondNumber=Slider(0, range=0..100))  # -> Equality, Inequality
dispatch_4 = Dispatch(List=trim, DispatchPattern=equals_3.Equality)  # -> ListA, ListB

branch_5 = TreeBranch(Tree=branch, Path=dispatch_2.ListA, MaintainPaths=True)
item_2 = ListItem(List=branch_5, Index=Slider(5, range=0..10), Wrap=True)
sort_val = SortDuplicateValues(ValueList=flatten(item_2))  # -> UniqueValues, Indices
panel = Panel(sort_val.UniqueValues)
item_3 = ListItem(List=sort_val.UniqueValues, Index=Slider(1, range=0..20), Wrap=True)
tstat_4 = TreeStatistics(Tree=branch_5)  # -> Paths, Length, Count
tmatch_2 = MatchText(Text=item_2, Pattern=item_3, Case=True)
panel_2 = Panel(item_3)
dispatch_5 = Dispatch(List=tstat_4.Paths, DispatchPattern=flatten(tmatch_2))  # -> ListA, ListB
branch_6 = TreeBranch(Tree=graft(crv_129), Path=dispatch_5.ListA, MaintainPaths=True)
trim_2 = TrimTree(Tree=branch_6, Depth=1)
group = Group(Objects=trim_2)

branch_7 = TreeBranch(Tree=branch, Path=dispatch_2.ListA, MaintainPaths=True)
item_4 = ListItem(List=branch_7, Index=Slider(2, range=0..10), Wrap=True)
sort_val_2 = SortDuplicateValues(ValueList=flatten(item_4))  # -> UniqueValues, Indices
panel_3 = Panel(sort_val_2.UniqueValues)
item_5 = ListItem(List=sort_val_2.UniqueValues, Index="2", Wrap=True)
tstat_5 = TreeStatistics(Tree=branch_7)  # -> Paths, Length, Count
tmatch_3 = MatchText(Text=item_4, Pattern=item_5, Case=True)
panel_4 = Panel(item_5)
dispatch_6 = Dispatch(List=tstat_5.Paths, DispatchPattern=flatten(tmatch_3))  # -> ListA, ListB
branch_8 = TreeBranch(Tree=graft(crv_129), Path=dispatch_6.ListA, MaintainPaths=True)
trim_3 = TrimTree(Tree=branch_8, Depth=1)
group_2 = Group(Objects=trim_3)

branch_9 = TreeBranch(Tree=branch, Path=dispatch_2.ListA, MaintainPaths=True)
item_6 = ListItem(List=branch_9, Index=Slider(2, range=0..10), Wrap=True)
sort_val_3 = SortDuplicateValues(ValueList=flatten(item_6))  # -> UniqueValues, Indices
panel_5 = Panel(sort_val_3.UniqueValues)
item_7 = ListItem(List=sort_val_3.UniqueValues, Index="3", Wrap=True)
tstat_6 = TreeStatistics(Tree=branch_9)  # -> Paths, Length, Count
tmatch_4 = MatchText(Text=item_6, Pattern=item_7, Case=True)
panel_6 = Panel(item_7)
dispatch_7 = Dispatch(List=tstat_6.Paths, DispatchPattern=flatten(tmatch_4))  # -> ListA, ListB
branch_10 = TreeBranch(Tree=graft(crv_129), Path=dispatch_7.ListA, MaintainPaths=True)
trim_4 = TrimTree(Tree=branch_10, Depth=1)
group_3 = Group(Objects=trim_4)

branch_11 = TreeBranch(Tree=branch, Path=dispatch_2.ListA, MaintainPaths=True)
item_8 = ListItem(List=branch_11, Index=Slider(2, range=0..10), Wrap=True)
sort_val_4 = SortDuplicateValues(ValueList=flatten(item_8))  # -> UniqueValues, Indices
panel_7 = Panel(sort_val_4.UniqueValues)
item_9 = ListItem(List=sort_val_4.UniqueValues, Index="4", Wrap=True)
tstat_7 = TreeStatistics(Tree=branch_11)  # -> Paths, Length, Count
tmatch_5 = MatchText(Text=item_8, Pattern=item_9, Case=True)
panel_8 = Panel(item_9)
dispatch_8 = Dispatch(List=tstat_7.Paths, DispatchPattern=flatten(tmatch_5))  # -> ListA, ListB
branch_12 = TreeBranch(Tree=graft(crv_129), Path=dispatch_8.ListA, MaintainPaths=True)
trim_5 = TrimTree(Tree=branch_12, Depth=1)
group_4 = Group(Objects=trim_5)

branch_13 = TreeBranch(Tree=branch, Path=dispatch_2.ListA, MaintainPaths=True)
item_10 = ListItem(List=branch_13, Index=Slider(2, range=0..10), Wrap=True)
sort_val_5 = SortDuplicateValues(ValueList=flatten(item_10))  # -> UniqueValues, Indices
panel_9 = Panel(sort_val_5.UniqueValues)
item_11 = ListItem(List=sort_val_5.UniqueValues, Index="5", Wrap=True)
tstat_8 = TreeStatistics(Tree=branch_13)  # -> Paths, Length, Count
tmatch_6 = MatchText(Text=item_10, Pattern=item_11, Case=True)
panel_10 = Panel(item_11)
dispatch_9 = Dispatch(List=tstat_8.Paths, DispatchPattern=flatten(tmatch_6))  # -> ListA, ListB
branch_14 = TreeBranch(Tree=graft(crv_129), Path=dispatch_9.ListA, MaintainPaths=True)
trim_6 = TrimTree(Tree=branch_14, Depth=1)
group_5 = Group(Objects=trim_6)

branch_15 = TreeBranch(Tree=branch, Path=dispatch_2.ListA, MaintainPaths=True)
item_12 = ListItem(List=branch_15, Index=Slider(2, range=0..10), Wrap=True)
sort_val_6 = SortDuplicateValues(ValueList=flatten(item_12))  # -> UniqueValues, Indices
panel_11 = Panel(sort_val_6.UniqueValues)
item_13 = ListItem(List=sort_val_6.UniqueValues, Index="7", Wrap=True)
tstat_9 = TreeStatistics(Tree=branch_15)  # -> Paths, Length, Count
tmatch_7 = MatchText(Text=item_12, Pattern=item_13, Case=True)
panel_12 = Panel(item_13)
dispatch_10 = Dispatch(List=tstat_9.Paths, DispatchPattern=flatten(tmatch_7))  # -> ListA, ListB
branch_16 = TreeBranch(Tree=graft(crv_129), Path=dispatch_10.ListA, MaintainPaths=True)
trim_7 = TrimTree(Tree=branch_16, Depth=1)
group_6 = Group(Objects=trim_7)

branch_17 = TreeBranch(Tree=branch, Path=dispatch_2.ListA, MaintainPaths=True)
item_14 = ListItem(List=branch_17, Index=Slider(2, range=0..10), Wrap=True)
sort_val_7 = SortDuplicateValues(ValueList=flatten(item_14))  # -> UniqueValues, Indices
panel_13 = Panel(sort_val_7.UniqueValues)
item_15 = ListItem(List=sort_val_7.UniqueValues, Index="6", Wrap=True)
tstat_10 = TreeStatistics(Tree=branch_17)  # -> Paths, Length, Count
tmatch_8 = MatchText(Text=item_14, Pattern=item_15, Case=True)
panel_14 = Panel(item_15)
dispatch_11 = Dispatch(List=tstat_10.Paths, DispatchPattern=flatten(tmatch_8))  # -> ListA, ListB
branch_18 = TreeBranch(Tree=graft(crv_129), Path=dispatch_11.ListA, MaintainPaths=True)
trim_8 = TrimTree(Tree=branch_18, Depth=1)
group_7 = Group(Objects=trim_8)

branch_19 = TreeBranch(Tree=branch, Path=dispatch_2.ListA, MaintainPaths=True)
item_16 = ListItem(List=branch_19, Index=Slider(2, range=0..10), Wrap=True)
sort_val_8 = SortDuplicateValues(ValueList=flatten(item_16))  # -> UniqueValues, Indices
panel_15 = Panel(sort_val_8.UniqueValues)
item_17 = ListItem(List=sort_val_8.UniqueValues, Index="8", Wrap=True)
tstat_11 = TreeStatistics(Tree=branch_19)  # -> Paths, Length, Count
tmatch_9 = MatchText(Text=item_16, Pattern=item_17, Case=True)
panel_16 = Panel(item_17)
dispatch_12 = Dispatch(List=tstat_11.Paths, DispatchPattern=flatten(tmatch_9))  # -> ListA, ListB
branch_20 = TreeBranch(Tree=graft(crv_129), Path=dispatch_12.ListA, MaintainPaths=True)
trim_9 = TrimTree(Tree=branch_20, Depth=1)
group_8 = Group(Objects=trim_9)

tmatch_10 = MatchText(Text=branch_3, Pattern="Stage", Case=True)
dispatch_13 = Dispatch(List=tstat_3.Paths, DispatchPattern=flatten(tmatch_10))  # -> ListA, ListB

branch_21 = TreeBranch(Tree=graft(crv_129), Path=dispatch_2.ListB, MaintainPaths=True)
trim_10 = TrimTree(Tree=branch_21, Depth=1)
group_9 = Group(Objects=trim_10)

branch_22 = TreeBranch(Tree=branch_2, Path=dispatch_13.ListA, MaintainPaths=True)

branch_23 = TreeBranch(Tree=branch, Path=dispatch_2.ListA, MaintainPaths=True)
item_18 = ListItem(List=branch_23, Index=Slider(2, range=0..10), Wrap=True)
sort_val_9 = SortDuplicateValues(ValueList=flatten(item_18))  # -> UniqueValues, Indices
panel_17 = Panel(sort_val_9.UniqueValues)
item_19 = ListItem(List=sort_val_9.UniqueValues, Index="0", Wrap=True)
tstat_12 = TreeStatistics(Tree=branch_23)  # -> Paths, Length, Count
tmatch_11 = MatchText(Text=item_18, Pattern=item_19, Case=True)
panel_18 = Panel(item_19)
dispatch_14 = Dispatch(List=tstat_12.Paths, DispatchPattern=flatten(tmatch_11))  # -> ListA, ListB
branch_24 = TreeBranch(Tree=graft(crv_129), Path=dispatch_14.ListA, MaintainPaths=True)
trim_11 = TrimTree(Tree=branch_24, Depth=1)
group_10 = Group(Objects=trim_11)

trim_12 = TrimTree(Tree=branch_22, Depth=1)
area_2 = Area(Geometry=trim_12)  # -> Area, Centroid
pdecon_2 = Deconstruct(Point=area_2.Centroid)  # -> XComponent, YComponent, ZComponent
equals_4 = Equality(FirstNumber=pdecon_2.ZComponent, SecondNumber=Slider(0, range=0..100))  # -> Equality, Inequality
dispatch_15 = Dispatch(List=trim_12, DispatchPattern=equals_4.Equality)  # -> ListA, ListB
panel_19 = Panel("""37
20
25
15
8
5
21""")
merge_2 = Merge(
    Data1=ColourSwatch(SwatchColor=RGB(107, 153, 101)),
    Data2=ColourSwatch(SwatchColor=RGB(124, 175, 247)),
    Data3=ColourSwatch(SwatchColor=RGB(247, 170, 131)),
    Data4=ColourSwatch(SwatchColor=RGB(86, 115, 156)),
    Data5=ColourSwatch(SwatchColor=RGB(214, 133, 255)),
    Data6=ColourSwatch(SwatchColor=RGB(255, 120, 120)),
    Data7=ColourSwatch(SwatchColor=RGB(150, 117, 84)))
srf = Surface(dispatch_15.ListA)
repeat = RepeatData(Data=graft(merge_2), Length=graft(panel_19))  # -> flatten(Data)
panel_20 = Panel(repeat)
preview = CustomPreview(Geometry=srf, Material=graft(repeat))

tmatch_12 = MatchText(Text=branch_3, Pattern="Auditorium", Case=True)

tmatch_13 = MatchText(Text=branch_3, Pattern="Blocks GF", Case=True)
tstat_13 = TreeStatistics(Tree=branch_2)  # -> Paths, Length, Count
dispatch_16 = Dispatch(List=tstat_13.Paths, DispatchPattern=flatten(tmatch_13))  # -> ListA, ListB
branch_25 = TreeBranch(Tree=branch_2, Path=dispatch_16.ListA, MaintainPaths=True)
trim_13 = TrimTree(Tree=branch_25, Depth=1)
panel_21 = Panel(trim_13)

dispatch_17 = Dispatch(List=tstat_3.Paths, DispatchPattern=flatten(tmatch_12))  # -> ListA, ListB
branch_26 = TreeBranch(Tree=branch_2, Path=dispatch_17.ListA, MaintainPaths=True)
tmatch_14 = MatchText(Text=branch_3, Pattern="Stage", Case=True)
trim_14 = TrimTree(Tree=branch_26, Depth=1)
dispatch_18 = Dispatch(List=tstat_3.Paths, DispatchPattern=flatten(tmatch_14))  # -> ListA, ListB
area_3 = Area(Geometry=trim_3)  # -> Area, Centroid

ts_from_footprint = TreeStatistics(Tree=trim)  # -> Paths, Length, Count
tstat_14 = TreeStatistics(Tree=trim_3)  # -> Paths, Length, Count
dpath = DeconstructPath(Branch=tstat_14.Paths)
item_20 = ListItem(List=dpath, Index=1, Wrap=True)
replace = ReplaceItems(List=ts_from_footprint.Paths, Indices=flatten(item_20), Wrap=False)
clean = CleanTree(RemoveNulls=True, RemoveInvalid=True, RemoveEmpty=False, Tree=replace)
lng_2 = ListLength(List=clean)
repeat_2 = RepeatData(Data="0", Length=lng_2)
tree = CreateTree(Data=repeat_2, Path=clean)
merge_3 = Merge(Data1=tree, Data2=area_3.Area)

area_4 = Area(Geometry=trim_4)  # -> Area, Centroid

ts_from_footprint_2 = TreeStatistics(Tree=trim)  # -> Paths, Length, Count
tstat_15 = TreeStatistics(Tree=trim_4)  # -> Paths, Length, Count
dpath_2 = DeconstructPath(Branch=tstat_15.Paths)
item_21 = ListItem(List=dpath_2, Index=1, Wrap=True)
replace_2 = ReplaceItems(List=ts_from_footprint_2.Paths, Indices=flatten(item_21), Wrap=False)
clean_2 = CleanTree(RemoveNulls=True, RemoveInvalid=True, RemoveEmpty=False, Tree=replace_2)
lng_3 = ListLength(List=clean_2)
repeat_3 = RepeatData(Data="0", Length=lng_3)
tree_2 = CreateTree(Data=repeat_3, Path=clean_2)
merge_4 = Merge(Data1=tree_2, Data2=area_4.Area)

ts_from_footprint_3 = TreeStatistics(Tree=trim)  # -> Paths, Length, Count
tstat_16 = TreeStatistics(Tree=trim_7)  # -> Paths, Length, Count
area_5 = Area(Geometry=trim_7)  # -> Area, Centroid
dpath_3 = DeconstructPath(Branch=tstat_16.Paths)
item_22 = ListItem(List=dpath_3, Index=1, Wrap=True)
replace_3 = ReplaceItems(List=ts_from_footprint_3.Paths, Indices=flatten(item_22), Wrap=False)
clean_3 = CleanTree(RemoveNulls=True, RemoveInvalid=True, RemoveEmpty=False, Tree=replace_3)
lng_4 = ListLength(List=clean_3)
# Extraction of specific elements from dataset
repeat_4 = RepeatData(Data="0", Length=lng_4)
tree_3 = CreateTree(Data=repeat_4, Path=clean_3)
merge_5 = Merge(Data1=tree_3, Data2=area_5.Area)

area_6 = Area(Geometry=trim_6)  # -> Area, Centroid

ts_from_footprint_4 = TreeStatistics(Tree=trim)  # -> Paths, Length, Count
tstat_17 = TreeStatistics(Tree=trim_6)  # -> Paths, Length, Count
dpath_4 = DeconstructPath(Branch=tstat_17.Paths)
item_23 = ListItem(List=dpath_4, Index=1, Wrap=True)
replace_4 = ReplaceItems(List=ts_from_footprint_4.Paths, Indices=flatten(item_23), Wrap=False)
clean_4 = CleanTree(RemoveNulls=True, RemoveInvalid=True, RemoveEmpty=False, Tree=replace_4)
lng_5 = ListLength(List=clean_4)
repeat_5 = RepeatData(Data="0", Length=lng_5)
tree_4 = CreateTree(Data=repeat_5, Path=clean_4)
merge_6 = Merge(Data1=tree_4, Data2=area_6.Area)

area_7 = Area(Geometry=trim_5)  # -> Area, Centroid

ts_from_footprint_5 = TreeStatistics(Tree=trim)  # -> Paths, Length, Count
tstat_18 = TreeStatistics(Tree=trim_5)  # -> Paths, Length, Count
dpath_5 = DeconstructPath(Branch=tstat_18.Paths)
item_24 = ListItem(List=dpath_5, Index=1, Wrap=True)
replace_5 = ReplaceItems(List=ts_from_footprint_5.Paths, Indices=flatten(item_24), Wrap=False)
clean_5 = CleanTree(RemoveNulls=True, RemoveInvalid=True, RemoveEmpty=False, Tree=replace_5)
lng_6 = ListLength(List=clean_5)
repeat_6 = RepeatData(Data="0", Length=lng_6)
tree_5 = CreateTree(Data=repeat_6, Path=clean_5)
merge_7 = Merge(Data1=tree_5, Data2=area_7.Area)

area_8 = Area(Geometry=trim_14)  # -> Area, Centroid
branch_27 = TreeBranch(Tree=branch_2, Path=dispatch_18.ListA, MaintainPaths=True)
bbox = BoundingBox(Content=dispatch_4.ListA, Plane=PlaneXY(0, 0, 0), UnionBox=True)  # -> Box, Box_2
panel_22 = Panel("""Stadium9Radial
Stadium9Radial
Stadium9Radial
Stadium9Radial
Stadium9Radial
Stadium9Tangent Arc
Stadium9Tangent Arc
Stadium9Tangent Arc
Stadium9Tangent Arc
Stadium9Tangent Arc
Stadium9Tangent Arc
Stadium9Tangent Arc
Stadium9Tangent Arc
Stadium9Hippodrome
Stadium9Hippodrome
Stadium9Hippodrome
Stadium9Hippodrome
Stadium9Fillet Corners
Stadium9Fillet Corners
Stadium9Fillet Corners
Stadium9Fillet Corners
Stadium9Fillet Corners
Stadium9Fillet Corners
Stadium9Fillet Corners
Stadium9Chamfer Corners
Stadium9Chamfer Corners
Stadium9Chamfer Corners
Stadium9Chamfer Corners
Stadium9Chamfer Corners
Stadium9Chamfer Corners
Stadium9Independent Stands
Stadium9Independent Stands
Stadium9Baseball
Stadium9Baseball
Stadium9Baseball
Stadium9Baseball
Stadium9Baseball
Arena9Radial
Arena9Radial
Arena9Radial
Arena9Chamfer Corners
Arena9Chamfer Corners
Arena9Chamfer Corners
Arena9Chamfer Corners
Arena9Chamfer Corners
Arena9Fillet Corners
Arena9Fillet Corners
Arena9Fillet Corners
Arena9Fillet Corners
Arena9Fillet Corners
Arena9Fillet Corners
Arena9Hippodrome
Arena9Hippodrome
Arena9Hippodrome
Arena9Hippodrome
Arena9Hippodrome
Theatre9Procenium
Theatre9Procenium
Theatre9Procenium
Theatre9Procenium
Theatre9End Stage
Theatre9End Stage
Theatre9Corner Stage
Theatre9Corner Stage
Theatre9Corner Stage
Theatre9Corner Stage
Theatre9Corner Stage
Theatre9Corner Stage
Theatre9Wide Fan
Theatre9Wide Fan
Theatre9Thrust Stage
Theatre9Thrust Stage
Theatre9Thrust Stage
Theatre9Thrust Stage
Theatre9In-the-round
Theatre9Courtyard
Theatre9Courtyard
Theatre9Transformable
Theatre9Reuse
Theatre9Reuse
Theatre9Reuse
Theatre9Reuse
Concert Hall9Vineyard
Concert Hall9Vineyard
Concert Hall9Vineyard
Concert Hall9Vineyard
Concert Hall9Vineyard
Concert Hall9Vineyard
Concert Hall9Shoebox
Concert Hall9Shoebox
Concert Hall9Shoebox
Concert Hall9Shoebox
Concert Hall9Shoebox
Concert Hall9Recital
Sacred9Church Axial
Sacred9Church Centralised
Sacred9Church Large Span
Sacred9Mosque
Sacred9Synagogue
Sacred9Buddhist Temple
Sacred9Buddhist Temple
Sacred9Hindu Temple
Parliament9Opposition
Paliament9Amphitheatre
Parliament9Horseshoe
Parliament9Circle
Parliament9Block
Education9Auditorium
Education9Auditorium
Education9Small Groups
Education9Small Groups
Education9Small Groups
Education9Small Groups
Education9Small Groups
Education9Large Groups
Education9Large Groups
Education9Collaborative
Education9Collaborative
Education9One-on-one
Education9One-on-one
Education9One-on-one
Education9One-on-one
Education9One-on-one
Education9One-on-one
Education9Individual Learning
Education9Individual Learning
Education9Individual Learning
Education9Individual Learning""")
pdecon_3 = Deconstruct(Point=area_8.Centroid)  # -> XComponent, YComponent, ZComponent
trim_15 = TrimTree(Tree=branch_27, Depth=1)
area_9 = Area(Geometry=bbox.Box)  # -> Area, Centroid
equals_5 = Equality(FirstNumber=pdecon_3.ZComponent, SecondNumber=Slider(0, range=0..100))  # -> Equality, Inequality
area_10 = Area(Geometry=trim_15)  # -> Area, Centroid
pdecon_4 = Deconstruct(Point=area_10.Centroid)  # -> XComponent, YComponent, ZComponent
# Combining data for machine learning algorithm
dispatch_19 = Dispatch(List=trim_14, DispatchPattern=equals_5.Equality)  # -> ListA, ListB
X = UnitX(Factor=expr("x*-1", Slider(211.8, range=0..500)))
Y = UnitY(Factor=expr("x*-1", Slider(423.2, range=0..500)))
rep = ReplaceText(Text=panel_22, Find="9", RecursiveReplace=False)
equals_6 = Equality(FirstNumber=pdecon_4.ZComponent, SecondNumber=Slider(0, range=0..100))  # -> Equality, Inequality
ma = MassAddition(Input=merge_3)  # -> Result, PartialResults
addition = Addition(A=X, B=Y)
list = ValueList({"Default", "Typologies"}, selected="Typologies")
move = Move(Geometry=area_9.Centroid, Motion=addition)  # -> Geometry, Transform
ma_2 = MassAddition(Input=merge_7)  # -> Result, PartialResults
dispatch_20 = Dispatch(List=trim_15, DispatchPattern=equals_6.Equality)  # -> ListA, ListB
ma_3 = MassAddition(Input=merge_4)  # -> Result, PartialResults
ma_4 = MassAddition(Input=merge_5)  # -> Result, PartialResults
text = DefineTextObject(Text=graft(rep), Plane=graft(move.Geometry), DimensionStyle=list, OutputType="Text")
trim_16 = TrimTree(Tree=text, Depth=1)
auditorium = Group(Objects=dispatch_19.ListA)
footprint = Group(Objects=dispatch_4.ListA)
stage = Group(Objects=dispatch_20.ListA)
panel_23 = Panel(text)
split_2 = TextSplit(Text=repeat, Separators=",")
item_25 = ListItem(List=split_2, Index=0, Wrap=True)  # -> Item, Item1, Item2
pt = ConstructPoint(XCoordinate=item_25.Item, YCoordinate=item_25.Item1, ZCoordinate=item_25.Item2)

ma_5 = MassAddition(Input=merge_6)  # -> Result, PartialResults
division = Division(A=ma_5.Result, B=area.Area)
division_2 = Division(A=ma_2.Result, B=area.Area)
division_3 = Division(A=ma_3.Result, B=area.Area)
division_4 = Division(A=ma.Result, B=area.Area)
division_5 = Division(A=ma_4.Result, B=area.Area)
weave = Weave(
    Pattern=[0, 1, 2, 3, 4],
    Stream0=division_5,
    Stream1=division,
    Stream2=division_2,
    Stream3=division_3,
    Stream4=division_4,
    NullGaps=False)

# ----
# Machine learning algorithm
# (yes, that's the only machine learning component)
number_slider = Slider(4, range=0..10)
k_means = KMeansClustering(TrainingInputs=weave, OfClusters=number_slider, RandomSeed=Slider(11, range=0..100))  # -> Result, Likelihood, Centroids

equals_7 = Equality(FirstNumber=k_means.Result, SecondNumber="0")  # -> Equality, Inequality
tstat_19 = TreeStatistics(Tree=trim)  # -> Paths, Length, Count
dispatch_21 = Dispatch(List=flatten(tstat_19.Paths), DispatchPattern=equals_7.Equality)  # -> ListA, ListB
branch_28 = TreeBranch(Tree=footprint, Path=dispatch_21.ListA, MaintainPaths=True)
branch_29 = TreeBranch(Tree=pt, Path=dispatch_21.ListA, MaintainPaths=True)
branch_30 = TreeBranch(Tree=auditorium, Path=dispatch_21.ListA, MaintainPaths=True)
branch_31 = TreeBranch(Tree=footprint, Path=dispatch_21.ListA, MaintainPaths=True)
branch_32 = TreeBranch(Tree=trim_16, Path=dispatch_21.ListA, MaintainPaths=True)
branch_33 = TreeBranch(Tree=stage, Path=dispatch_21.ListA, MaintainPaths=True)
branch_34 = TreeBranch(Tree=group_8, Path=dispatch_21.ListA, MaintainPaths=True)
branch_35 = TreeBranch(Tree=group_6, Path=dispatch_21.ListA, MaintainPaths=True)
branch_36 = TreeBranch(Tree=group_7, Path=dispatch_21.ListA, MaintainPaths=True)
branch_37 = TreeBranch(Tree=group_5, Path=dispatch_21.ListA, MaintainPaths=True)
branch_38 = TreeBranch(Tree=group_4, Path=dispatch_21.ListA, MaintainPaths=True)
branch_39 = TreeBranch(Tree=group_3, Path=dispatch_21.ListA, MaintainPaths=True)
branch_40 = TreeBranch(Tree=group_2, Path=dispatch_21.ListA, MaintainPaths=True)
branch_41 = TreeBranch(Tree=group, Path=dispatch_21.ListA, MaintainPaths=True)
branch_42 = TreeBranch(Tree=group_9, Path=dispatch_21.ListA, MaintainPaths=True)
branch_43 = TreeBranch(Tree=group_10, Path=dispatch_21.ListA, MaintainPaths=True)
weave_2 = Weave(Pattern=[0, 1], Stream0=graft(branch_43), Stream1=graft(branch_33), NullGaps=False)
ungroup = Ungroup(Group=branch_28)
ungroup_2 = Ungroup(Group=branch_33)
ungroup_3 = Ungroup(Group=branch_30)
ungroup_4 = Ungroup(Group=branch_31)
ungroup_5 = Ungroup(Group=branch_29)
ungroup_6 = Ungroup(Group=branch_43)
ungroup_7 = Ungroup(Group=branch_34)
ungroup_8 = Ungroup(Group=branch_35)
ungroup_9 = Ungroup(Group=branch_36)
ungroup_10 = Ungroup(Group=branch_37)
ungroup_11 = Ungroup(Group=branch_38)
ungroup_12 = Ungroup(Group=branch_39)
ungroup_13 = Ungroup(Group=branch_40)
ungroup_14 = Ungroup(Group=branch_41)
ungroup_15 = Ungroup(Group=branch_42)
bbox_2 = BoundingBox(Content=weave_2, Plane=PlaneXY(0, 0, 0), UnionBox=True)  # -> Box, Box_2
boundary = BoundarySurfaces(Edges=ungroup_7)
boundary_2 = BoundarySurfaces(Edges=ungroup_8)
boundary_3 = BoundarySurfaces(Edges=ungroup_9)
boundary_4 = BoundarySurfaces(Edges=ungroup_10)
boundary_5 = BoundarySurfaces(Edges=ungroup_11)
boundary_6 = BoundarySurfaces(Edges=ungroup_12)
boundary_7 = BoundarySurfaces(Edges=ungroup_13)
boundary_8 = BoundarySurfaces(Edges=ungroup_14)
boundary_9 = BoundarySurfaces(Edges=ungroup_15)
boundary_10 = BoundarySurfaces(Edges=ungroup_6)
area_11 = Area(Geometry=bbox_2.Box)  # -> Area, Centroid
panel_24 = Panel(ungroup)
area_12 = Area(Geometry=ungroup)  # -> Area, Centroid
panel_25 = Panel(area_11.Centroid)
lng_7 = ListLength(List=flatten(branch_32))
pt_2 = ConstructPoint(XCoordinate="8400", YCoordinate="4200", ZCoordinate=0)
division_6 = Division(A=lng_7, B=Slider(10, range=0..10))
round = Round(Number=division_6)  # -> Nearest, Floor, Ceiling
number_slider_2 = Slider(750, range=0..1000)
recgrid = Rectangular(Plane=pt_2, SizeX=Slider(743, range=0..1000), SizeY=expr("x*-1", number_slider_2), ExtentX=20, ExtentY=round.Ceiling)  # -> Cells, Points
multiplication = Multiplication(A=round.Ceiling, B=number_slider_2)
flip = FlipMatrix(Data=recgrid.Cells)
area_13 = Area(Geometry=flatten(flip))  # -> Area, Centroid
split_3 = SplitList(List=area_13.Centroid, Index=lng_7)  # -> ListA, ListB
vec2pt = Vector2Pt(PointA=area_12.Centroid, PointB=graft(split_3.ListA), Unitize=False)  # -> Vector, Length
split_4 = TextSplit(Text=ungroup_5, Separators=",")
rep_2 = ReplaceText(Text=split_4, Find="{", RecursiveReplace=False)
label = Move(Geometry=branch_32, Motion=vec2pt.Vector)  # -> Geometry, Transform
move_2 = Move(Geometry=boundary_10, Motion=vec2pt.Vector)  # -> Geometry, Transform
move_3 = Move(Geometry=ungroup_2, Motion=vec2pt.Vector)  # -> Geometry, Transform
move_4 = Move(Geometry=ungroup_3, Motion=vec2pt.Vector)  # -> Geometry, Transform
rep_3 = ReplaceText(Text=rep_2, Find="}", RecursiveReplace=False)
trim_17 = TextTrim(Text=rep_3, Start=True, End=True)
move_5 = Move(Geometry=boundary, Motion=vec2pt.Vector)  # -> Geometry, Transform
move_6 = Move(Geometry=boundary_2, Motion=vec2pt.Vector)  # -> Geometry, Transform
move_7 = Move(Geometry=boundary_3, Motion=vec2pt.Vector)  # -> Geometry, Transform
move_8 = Move(Geometry=boundary_4, Motion=vec2pt.Vector)  # -> Geometry, Transform
move_9 = Move(Geometry=boundary_5, Motion=vec2pt.Vector)  # -> Geometry, Transform
move_10 = Move(Geometry=boundary_6, Motion=vec2pt.Vector)  # -> Geometry, Transform
move_11 = Move(Geometry=boundary_7, Motion=vec2pt.Vector)  # -> Geometry, Transform
move_12 = Move(Geometry=boundary_8, Motion=vec2pt.Vector)  # -> Geometry, Transform
move_13 = Move(Geometry=boundary_9, Motion=vec2pt.Vector)  # -> Geometry, Transform
item_26 = ListItem(List=trim_17, Index=0, Wrap=True)  # -> Item, Item1, Item2
move_14 = Move(Geometry=ungroup, Motion=vec2pt.Vector)  # -> Geometry, Transform
rgb = ColourRGB(Alpha=255, Red=item_26.Item, Green=item_26.Item1, Blue=item_26.Item2)
srf_2 = Surface(move_3.Geometry)
bbox_3 = BoundingBox(Content=move_14.Geometry, Plane=PlaneXY(0, 0, 0), UnionBox=True)  # -> Box, Box_2
panel_26 = Panel(move_14.Geometry)
preview_2 = CustomPreview(
    Geometry=move_14.Geometry,
    Material={diffuse=RGB(221, 160, 221), emission=RGB(66, 48, 66), shine=0.5, specular=RGB(255, 255, 255), transparency=0})
debrep = DeconstructBrep(Brep=bbox_3.Box)  # -> Faces, Edges, Vertices
preview_3 = CustomPreview(
    Geometry=move_14.Geometry,
    Material={diffuse=RGB(221, 160, 221), emission=RGB(66, 48, 66), shine=0.5, specular=RGB(255, 255, 255), transparency=0})
item_27 = ListItem(List=debrep.Faces, Index=Slider(4, range=0..10), Wrap=True)
debrep_2 = DeconstructBrep(Brep=item_27)  # -> Faces, Edges, Vertices
area_14 = Area(Geometry=item_27)  # -> Area, Centroid
len_2 = Length(Curve=debrep_2.Edges)
sort = SortList(Keys=len_2, ValuesA=debrep_2.Edges)  # -> Keys, ValuesA
item_28 = ListItem(List=reverse(sort.ValuesA), Index=0, Wrap=True)  # -> Item, Item1
panel_27 = Panel(sort.ValuesA)
end = EndPoints(Curve=item_28.Item)  # -> Start, End
pdecon_5 = Deconstruct(Point=end.Start)  # -> XComponent, YComponent, ZComponent
pdecon_6 = Deconstruct(Point=end.End)  # -> XComponent, YComponent, ZComponent
number_slider_3 = Slider(475, range=0..1000)
subtraction = Subtraction(A=pdecon_5.YComponent, B=pdecon_6.YComponent)
subtraction_2 = Subtraction(A=pdecon_5.XComponent, B=pdecon_6.XComponent)
division_7 = Division(A=number_slider_3, B=subtraction_2)
division_8 = Division(A=number_slider_3, B=subtraction)
panel_29 = Panel(division_7)
weave_3 = Weave(Pattern=[0, 1], Stream0=panel_29, Stream1=division_8, NullGaps=False)
rep_4 = ReplaceText(Text=weave_3, Find="-", RecursiveReplace=False)
preview_4 = CustomPreview(Geometry=label.Geometry, Material=ColourSwatch(SwatchColor=RGB(0, 0, 0)))
clean_6 = CleanTree(RemoveNulls=True, RemoveInvalid=True, RemoveEmpty=False, Tree=rep_4)
scale = Scale(Geometry=move_14.Geometry, Center=area_14.Centroid, Factor=clean_6)  # -> Geometry, Transform
panel_30 = Panel(scale.Geometry)
move_15 = Move(Geometry=scale.Geometry, Motion=Vector(0, 0, 10))  # -> Geometry, Transform
preview_5 = CustomPreview(Geometry=move_15.Geometry, Material=ColourSwatch(SwatchColor=RGB(0, 0, 0)))
scale_2 = Scale(Geometry=move_5.Geometry, Center=area_14.Centroid, Factor=clean_6)  # -> Geometry, Transform
scale_3 = Scale(Geometry=move_6.Geometry, Center=area_14.Centroid, Factor=clean_6)  # -> Geometry, Transform
scale_4 = Scale(Geometry=move_7.Geometry, Center=area_14.Centroid, Factor=clean_6)  # -> Geometry, Transform
scale_5 = Scale(Geometry=move_8.Geometry, Center=area_14.Centroid, Factor=clean_6)  # -> Geometry, Transform
scale_6 = Scale(Geometry=move_9.Geometry, Center=area_14.Centroid, Factor=clean_6)  # -> Geometry, Transform
scale_7 = Scale(Geometry=move_10.Geometry, Center=area_14.Centroid, Factor=clean_6)  # -> Geometry, Transform
scale_8 = Scale(Geometry=move_11.Geometry, Center=area_14.Centroid, Factor=clean_6)  # -> Geometry, Transform
scale_9 = Scale(Geometry=move_12.Geometry, Center=area_14.Centroid, Factor=clean_6)  # -> Geometry, Transform
scale_10 = Scale(Geometry=move_13.Geometry, Center=area_14.Centroid, Factor=clean_6)  # -> Geometry, Transform
scale_11 = Scale(Geometry=move_2.Geometry, Center=area_14.Centroid, Factor=clean_6)  # -> Geometry, Transform
scale_12 = Scale(Geometry=move_4.Geometry, Center=area_14.Centroid, Factor=clean_6)  # -> Geometry, Transform
panel_31 = Panel(rep_4)
scale_13 = Scale(Geometry=srf_2, Center=area_14.Centroid, Factor=clean_6)  # -> Geometry, Transform
move_16 = Move(Geometry=scale_2.Geometry, Motion=Vector(0, 0, 10))  # -> Geometry, Transform
move_17 = Move(Geometry=scale_3.Geometry, Motion=Vector(0, 0, 10))  # -> Geometry, Transform
move_18 = Move(Geometry=scale_4.Geometry, Motion=Vector(0, 0, 10))  # -> Geometry, Transform
move_19 = Move(Geometry=scale_5.Geometry, Motion=Vector(0, 0, 10))  # -> Geometry, Transform
move_20 = Move(Geometry=scale_6.Geometry, Motion=Vector(0, 0, 10))  # -> Geometry, Transform
move_21 = Move(Geometry=scale_8.Geometry, Motion=Vector(0, 0, 10))  # -> Geometry, Transform
move_22 = Move(Geometry=scale_9.Geometry, Motion=Vector(0, 0, 10))  # -> Geometry, Transform
move_23 = Move(Geometry=scale_10.Geometry, Motion=Vector(0, 0, 10))  # -> Geometry, Transform
scale_14 = Scale(Geometry=move_14.Geometry, Center=area_14.Centroid, Factor=clean_6)  # -> Geometry, Transform
panel_32 = Panel(clean_6)
move_24 = Move(Geometry=scale_12.Geometry, Motion=Vector(0, 0, 10))  # -> Geometry, Transform
move_25 = Move(Geometry=scale_13.Geometry, Motion=Vector(0, 0, 10))  # -> Geometry, Transform
preview_6 = CustomPreview(Geometry=move_25.Geometry, Material=rgb)
preview_7 = CustomPreview(Geometry=move_24.Geometry, Material=ColourSwatch(SwatchColor=RGB(0, 0, 0)))
geo = Geometry([scale_14.Geometry, label.Geometry, move_24.Geometry, move_23.Geometry, move_22.Geometry])
bbox_4 = BoundingBox(Content=flatten(geo), Plane=PlaneXY(0, 0, 0), UnionBox=True)  # -> Box, Box_2
debrep_3 = DeconstructBrep(Brep=bbox_4.Box)  # -> Faces, Edges, Vertices
item_29 = ListItem(List=debrep_3.Faces, Index=Slider(4, range=0..10), Wrap=True)
debrep_4 = DeconstructBrep(Brep=item_29)  # -> Faces, Edges, Vertices
area_15 = Area(Geometry=item_29)  # -> Area, Centroid
join = JoinCurves(Curves=debrep_4.Edges, Preserve=False)
scale_15 = Scale(Geometry=join, Center=area_15.Centroid, Factor=Slider(1.12, range=0..10))  # -> Geometry, Transform

panel_33 = Panel(k_means.Result)
branch_44 = TreeBranch(Tree=trim_13, Path=dispatch_21.ListA, MaintainPaths=True)
branch_45 = TreeBranch(Path=dispatch_21.ListA, MaintainPaths=True)
branch_46 = TreeBranch(Path=dispatch_21.ListA, MaintainPaths=True)
branch_47 = TreeBranch(Path=dispatch_21.ListA, MaintainPaths=True)
addition_2 = Addition(A=multiplication, B="-2800")
subtraction_3 = Subtraction(A="4200", B=addition_2)
pt_3 = ConstructPoint(XCoordinate="8400", YCoordinate=subtraction_3, ZCoordinate=0)
number_slider_4 = Slider(220, range=0..1000)

equals_8 = Equality(FirstNumber=k_means.Result, SecondNumber="1")  # -> Equality, Inequality
tstat_20 = TreeStatistics(Tree=trim)  # -> Paths, Length, Count
dispatch_22 = Dispatch(List=flatten(tstat_20.Paths), DispatchPattern=equals_8.Equality)  # -> ListA, ListB
branch_48 = TreeBranch(Tree=footprint, Path=dispatch_22.ListA, MaintainPaths=True)
branch_49 = TreeBranch(Tree=pt, Path=dispatch_22.ListA, MaintainPaths=True)
branch_50 = TreeBranch(Tree=auditorium, Path=dispatch_22.ListA, MaintainPaths=True)
branch_51 = TreeBranch(Tree=footprint, Path=dispatch_22.ListA, MaintainPaths=True)
branch_52 = TreeBranch(Tree=trim_16, Path=dispatch_22.ListA, MaintainPaths=True)
branch_53 = TreeBranch(Tree=stage, Path=dispatch_22.ListA, MaintainPaths=True)
branch_54 = TreeBranch(Tree=group_8, Path=dispatch_22.ListA, MaintainPaths=True)
branch_55 = TreeBranch(Tree=group_6, Path=dispatch_22.ListA, MaintainPaths=True)
branch_56 = TreeBranch(Tree=group_7, Path=dispatch_22.ListA, MaintainPaths=True)
branch_57 = TreeBranch(Tree=group_5, Path=dispatch_22.ListA, MaintainPaths=True)
branch_58 = TreeBranch(Tree=group_4, Path=dispatch_22.ListA, MaintainPaths=True)
branch_59 = TreeBranch(Tree=group_3, Path=dispatch_22.ListA, MaintainPaths=True)
branch_60 = TreeBranch(Tree=group_2, Path=dispatch_22.ListA, MaintainPaths=True)
branch_61 = TreeBranch(Tree=group, Path=dispatch_22.ListA, MaintainPaths=True)
branch_62 = TreeBranch(Tree=group_9, Path=dispatch_22.ListA, MaintainPaths=True)
branch_63 = TreeBranch(Tree=group_10, Path=dispatch_22.ListA, MaintainPaths=True)
weave_4 = Weave(Pattern=[0, 1], Stream0=graft(branch_63), Stream1=graft(branch_53), NullGaps=False)
ungroup_16 = Ungroup(Group=branch_48)
ungroup_17 = Ungroup(Group=branch_53)
ungroup_18 = Ungroup(Group=branch_50)
ungroup_19 = Ungroup(Group=branch_51)
ungroup_20 = Ungroup(Group=branch_49)
bbox_5 = BoundingBox(Content=weave_4, Plane=PlaneXY(0, 0, 0), UnionBox=True)  # -> Box, Box_2
area_16 = Area(Geometry=ungroup_16)  # -> Area, Centroid
ungroup_21 = Ungroup(Group=branch_54)
ungroup_22 = Ungroup(Group=branch_55)
ungroup_23 = Ungroup(Group=branch_56)
ungroup_24 = Ungroup(Group=branch_57)
ungroup_25 = Ungroup(Group=branch_58)
ungroup_26 = Ungroup(Group=branch_59)
ungroup_27 = Ungroup(Group=branch_60)
ungroup_28 = Ungroup(Group=branch_61)
ungroup_29 = Ungroup(Group=branch_62)
ungroup_30 = Ungroup(Group=branch_63)
area_17 = Area(Geometry=bbox_5.Box)  # -> Area, Centroid
boundary_11 = BoundarySurfaces(Edges=ungroup_21)
boundary_12 = BoundarySurfaces(Edges=ungroup_22)
boundary_13 = BoundarySurfaces(Edges=ungroup_23)
boundary_14 = BoundarySurfaces(Edges=ungroup_24)
boundary_15 = BoundarySurfaces(Edges=ungroup_25)
boundary_16 = BoundarySurfaces(Edges=ungroup_26)
boundary_17 = BoundarySurfaces(Edges=ungroup_27)
boundary_18 = BoundarySurfaces(Edges=ungroup_28)
boundary_19 = BoundarySurfaces(Edges=ungroup_29)
boundary_20 = BoundarySurfaces(Edges=ungroup_30)
lng_8 = ListLength(List=flatten(branch_52))
pt_4 = ConstructPoint(XCoordinate="8400", YCoordinate="4200", ZCoordinate=0)
division_9 = Division(A=lng_8, B=Slider(10, range=0..10))
round_2 = Round(Number=division_9)  # -> Nearest, Floor, Ceiling
number_slider_5 = Slider(750, range=0..1000)
recgrid_2 = Rectangular(Plane=pt_3, SizeX=Slider(700, range=0..1000), SizeY=expr("x*-1", number_slider_5), ExtentX=20, ExtentY=round_2.Ceiling)  # -> Cells, Points
multiplication_2 = Multiplication(A=round_2.Ceiling, B=number_slider_5)
flip_2 = FlipMatrix(Data=recgrid_2.Cells)
area_18 = Area(Geometry=flatten(flip_2))  # -> Area, Centroid
split_5 = SplitList(List=area_18.Centroid, Index=lng_8)  # -> ListA, ListB
vec2pt_2 = Vector2Pt(PointA=area_16.Centroid, PointB=graft(split_5.ListA), Unitize=False)  # -> Vector, Length
split_6 = TextSplit(Text=ungroup_20, Separators=",")
rep_5 = ReplaceText(Text=split_6, Find="{", RecursiveReplace=False)
label_2 = Move(Geometry=branch_52, Motion=vec2pt_2.Vector)  # -> Geometry, Transform
move_26 = Move(Geometry=boundary_20, Motion=vec2pt_2.Vector)  # -> Geometry, Transform
move_27 = Move(Geometry=ungroup_17, Motion=vec2pt_2.Vector)  # -> Geometry, Transform
move_28 = Move(Geometry=ungroup_18, Motion=vec2pt_2.Vector)  # -> Geometry, Transform
rep_6 = ReplaceText(Text=rep_5, Find="}", RecursiveReplace=False)
move_29 = Move(Geometry=ungroup_16, Motion=vec2pt_2.Vector)  # -> Geometry, Transform
trim_18 = TextTrim(Text=rep_6, Start=True, End=True)
item_30 = ListItem(List=trim_18, Index=0, Wrap=True)  # -> Item, Item1, Item2
move_30 = Move(Geometry=boundary_11, Motion=vec2pt_2.Vector)  # -> Geometry, Transform
move_31 = Move(Geometry=boundary_12, Motion=vec2pt_2.Vector)  # -> Geometry, Transform
move_32 = Move(Geometry=boundary_13, Motion=vec2pt_2.Vector)  # -> Geometry, Transform
move_33 = Move(Geometry=boundary_14, Motion=vec2pt_2.Vector)  # -> Geometry, Transform
move_34 = Move(Geometry=boundary_15, Motion=vec2pt_2.Vector)  # -> Geometry, Transform
move_35 = Move(Geometry=boundary_16, Motion=vec2pt_2.Vector)  # -> Geometry, Transform
move_36 = Move(Geometry=boundary_17, Motion=vec2pt_2.Vector)  # -> Geometry, Transform
move_37 = Move(Geometry=boundary_18, Motion=vec2pt_2.Vector)  # -> Geometry, Transform
move_38 = Move(Geometry=boundary_19, Motion=vec2pt_2.Vector)  # -> Geometry, Transform
rgb_2 = ColourRGB(Alpha=255, Red=item_30.Item, Green=item_30.Item1, Blue=item_30.Item2)
srf_3 = Surface(move_27.Geometry)
bbox_6 = BoundingBox(Content=move_29.Geometry, Plane=PlaneXY(0, 0, 0), UnionBox=True)  # -> Box, Box_2
debrep_5 = DeconstructBrep(Brep=bbox_6.Box)  # -> Faces, Edges, Vertices
item_31 = ListItem(List=debrep_5.Faces, Index=Slider(4, range=0..10), Wrap=True)
debrep_6 = DeconstructBrep(Brep=item_31)  # -> Faces, Edges, Vertices
area_19 = Area(Geometry=item_31)  # -> Area, Centroid
len_3 = Length(Curve=debrep_6.Edges)
sort_2 = SortList(Keys=len_3, ValuesA=debrep_6.Edges)  # -> Keys, ValuesA
item_32 = ListItem(List=reverse(sort_2.ValuesA), Index=0, Wrap=True)  # -> Item, Item1
panel_34 = Panel(sort_2.ValuesA)
end_2 = EndPoints(Curve=item_32.Item)  # -> Start, End
pdecon_7 = Deconstruct(Point=end_2.Start)  # -> XComponent, YComponent, ZComponent
pdecon_8 = Deconstruct(Point=end_2.End)  # -> XComponent, YComponent, ZComponent
number_slider_6 = Slider(475, range=0..1000)
subtraction_4 = Subtraction(A=pdecon_7.YComponent, B=pdecon_8.YComponent)
subtraction_5 = Subtraction(A=pdecon_7.XComponent, B=pdecon_8.XComponent)
division_10 = Division(A=number_slider_6, B=subtraction_5)
division_11 = Division(A=number_slider_6, B=subtraction_4)
panel_35 = Panel(division_10)
weave_5 = Weave(Pattern=[0, 1], Stream0=panel_35, Stream1=division_11, NullGaps=False)
rep_7 = ReplaceText(Text=weave_5, Find="-", RecursiveReplace=False)
clean_7 = CleanTree(RemoveNulls=True, RemoveInvalid=True, RemoveEmpty=False, Tree=rep_7)
scale_16 = Scale(Geometry=move_28.Geometry, Center=area_19.Centroid, Factor=clean_7)  # -> Geometry, Transform
panel_36 = Panel(rep_7)
scale_17 = Scale(Geometry=srf_3, Center=area_19.Centroid, Factor=clean_7)  # -> Geometry, Transform
move_39 = Move(Geometry=scale_16.Geometry, Motion=Vector(0, 0, 10))  # -> Geometry, Transform
scale_18 = Scale(Geometry=move_29.Geometry, Center=area_19.Centroid, Factor=clean_7)  # -> Geometry, Transform
panel_37 = Panel(scale_18.Geometry)
scale_19 = Scale(Geometry=move_29.Geometry, Center=area_19.Centroid, Factor=clean_7)  # -> Geometry, Transform
move_40 = Move(Geometry=scale_17.Geometry, Motion=Vector(0, 0, 10))  # -> Geometry, Transform
preview_8 = CustomPreview(Geometry=move_40.Geometry, Material=rgb_2)
preview_9 = CustomPreview(Geometry=move_39.Geometry, Material=ColourSwatch(SwatchColor=RGB(0, 0, 0)))
move_41 = Move(Geometry=scale_18.Geometry, Motion=Vector(0, 0, 10))  # -> Geometry, Transform
preview_10 = CustomPreview(Geometry=move_41.Geometry, Material=ColourSwatch(SwatchColor=RGB(0, 0, 0)))
preview_11 = CustomPreview(Geometry=label_2.Geometry, Material=ColourSwatch(SwatchColor=RGB(0, 0, 0)))
branch_64 = TreeBranch(Tree=trim_13, Path=dispatch_22.ListA, MaintainPaths=True)
scale_20 = Scale(Geometry=move_30.Geometry, Center=area_19.Centroid, Factor=clean_7)  # -> Geometry, Transform
scale_21 = Scale(Geometry=move_31.Geometry, Center=area_19.Centroid, Factor=clean_7)  # -> Geometry, Transform
scale_22 = Scale(Geometry=move_32.Geometry, Center=area_19.Centroid, Factor=clean_7)  # -> Geometry, Transform
scale_23 = Scale(Geometry=move_33.Geometry, Center=area_19.Centroid, Factor=clean_7)  # -> Geometry, Transform
scale_24 = Scale(Geometry=move_34.Geometry, Center=area_19.Centroid, Factor=clean_7)  # -> Geometry, Transform
scale_25 = Scale(Geometry=move_35.Geometry, Center=area_19.Centroid, Factor=clean_7)  # -> Geometry, Transform
scale_26 = Scale(Geometry=move_36.Geometry, Center=area_19.Centroid, Factor=clean_7)  # -> Geometry, Transform
scale_27 = Scale(Geometry=move_37.Geometry, Center=area_19.Centroid, Factor=clean_7)  # -> Geometry, Transform
scale_28 = Scale(Geometry=move_38.Geometry, Center=area_19.Centroid, Factor=clean_7)  # -> Geometry, Transform
scale_29 = Scale(Geometry=move_26.Geometry, Center=area_19.Centroid, Factor=clean_7)  # -> Geometry, Transform
move_42 = Move(Geometry=scale_20.Geometry, Motion=Vector(0, 0, 10))  # -> Geometry, Transform
move_43 = Move(Geometry=scale_21.Geometry, Motion=Vector(0, 0, 10))  # -> Geometry, Transform
move_44 = Move(Geometry=scale_22.Geometry, Motion=Vector(0, 0, 10))  # -> Geometry, Transform
move_45 = Move(Geometry=scale_23.Geometry, Motion=Vector(0, 0, 10))  # -> Geometry, Transform
move_46 = Move(Geometry=scale_24.Geometry, Motion=Vector(0, 0, 10))  # -> Geometry, Transform
move_47 = Move(Geometry=scale_26.Geometry, Motion=Vector(0, 0, 10))  # -> Geometry, Transform
move_48 = Move(Geometry=scale_27.Geometry, Motion=Vector(0, 0, 10))  # -> Geometry, Transform
move_49 = Move(Geometry=scale_28.Geometry, Motion=Vector(0, 0, 10))  # -> Geometry, Transform
move_50 = Move(Geometry=branch_64, Motion=vec2pt_2.Vector)  # -> Geometry, Transform
geo_2 = Geometry([scale_19.Geometry, label_2.Geometry, move_39.Geometry, move_49.Geometry, move_48.Geometry])
bbox_7 = BoundingBox(Content=flatten(geo_2), Plane=PlaneXY(0, 0, 0), UnionBox=True)  # -> Box, Box_2
debrep_7 = DeconstructBrep(Brep=bbox_7.Box)  # -> Faces, Edges, Vertices
item_33 = ListItem(List=debrep_7.Faces, Index=Slider(4, range=0..10), Wrap=True)
debrep_8 = DeconstructBrep(Brep=item_33)  # -> Faces, Edges, Vertices
area_20 = Area(Geometry=item_33)  # -> Area, Centroid
join_2 = JoinCurves(Curves=debrep_8.Edges, Preserve=False)
scale_30 = Scale(Geometry=join_2, Center=area_20.Centroid, Factor=Slider(1.12, range=0..10))  # -> Geometry, Transform

addition_3 = Addition(A=multiplication_2, B="-000")
subtraction_6 = Subtraction(A=subtraction_3, B=addition_3)
pt_5 = ConstructPoint(XCoordinate="8400", YCoordinate=subtraction_6, ZCoordinate=0)

equals_9 = Equality(FirstNumber=k_means.Result, SecondNumber="2")  # -> Equality, Inequality
tstat_21 = TreeStatistics(Tree=trim)  # -> Paths, Length, Count
dispatch_23 = Dispatch(List=flatten(tstat_21.Paths), DispatchPattern=equals_9.Equality)  # -> ListA, ListB
branch_65 = TreeBranch(Tree=footprint, Path=dispatch_23.ListA, MaintainPaths=True)
branch_66 = TreeBranch(Tree=pt, Path=dispatch_23.ListA, MaintainPaths=True)
branch_67 = TreeBranch(Tree=auditorium, Path=dispatch_23.ListA, MaintainPaths=True)
branch_68 = TreeBranch(Tree=footprint, Path=dispatch_23.ListA, MaintainPaths=True)
branch_69 = TreeBranch(Tree=trim_16, Path=dispatch_23.ListA, MaintainPaths=True)
branch_70 = TreeBranch(Tree=stage, Path=dispatch_23.ListA, MaintainPaths=True)
ungroup_31 = Ungroup(Group=branch_65)
ungroup_32 = Ungroup(Group=branch_70)
ungroup_33 = Ungroup(Group=branch_67)
ungroup_34 = Ungroup(Group=branch_68)
ungroup_35 = Ungroup(Group=branch_66)
area_21 = Area(Geometry=ungroup_31)  # -> Area, Centroid
branch_71 = TreeBranch(Tree=group_8, Path=dispatch_23.ListA, MaintainPaths=True)
branch_72 = TreeBranch(Tree=group_6, Path=dispatch_23.ListA, MaintainPaths=True)
branch_73 = TreeBranch(Tree=group_7, Path=dispatch_23.ListA, MaintainPaths=True)
branch_74 = TreeBranch(Tree=group_5, Path=dispatch_23.ListA, MaintainPaths=True)
branch_75 = TreeBranch(Tree=group_4, Path=dispatch_23.ListA, MaintainPaths=True)
branch_76 = TreeBranch(Tree=group_3, Path=dispatch_23.ListA, MaintainPaths=True)
branch_77 = TreeBranch(Tree=group_2, Path=dispatch_23.ListA, MaintainPaths=True)
branch_78 = TreeBranch(Tree=group, Path=dispatch_23.ListA, MaintainPaths=True)
branch_79 = TreeBranch(Tree=group_9, Path=dispatch_23.ListA, MaintainPaths=True)
branch_80 = TreeBranch(Tree=group_10, Path=dispatch_23.ListA, MaintainPaths=True)
weave_6 = Weave(Pattern=[0, 1], Stream0=graft(branch_80), Stream1=graft(branch_70), NullGaps=False)
bbox_8 = BoundingBox(Content=weave_6, Plane=PlaneXY(0, 0, 0), UnionBox=True)  # -> Box, Box_2
area_22 = Area(Geometry=bbox_8.Box)  # -> Area, Centroid
lng_9 = ListLength(List=flatten(branch_69))
pt_6 = ConstructPoint(XCoordinate="8400", YCoordinate="4200", ZCoordinate=0)
ungroup_36 = Ungroup(Group=branch_71)
ungroup_37 = Ungroup(Group=branch_72)
ungroup_38 = Ungroup(Group=branch_73)
ungroup_39 = Ungroup(Group=branch_74)
ungroup_40 = Ungroup(Group=branch_75)
ungroup_41 = Ungroup(Group=branch_76)
ungroup_42 = Ungroup(Group=branch_77)
ungroup_43 = Ungroup(Group=branch_78)
ungroup_44 = Ungroup(Group=branch_79)
ungroup_45 = Ungroup(Group=branch_80)
division_12 = Division(A=lng_9, B=Slider(10, range=0..10))
boundary_21 = BoundarySurfaces(Edges=ungroup_36)
boundary_22 = BoundarySurfaces(Edges=ungroup_37)
boundary_23 = BoundarySurfaces(Edges=ungroup_38)
boundary_24 = BoundarySurfaces(Edges=ungroup_39)
boundary_25 = BoundarySurfaces(Edges=ungroup_40)
boundary_26 = BoundarySurfaces(Edges=ungroup_41)
boundary_27 = BoundarySurfaces(Edges=ungroup_42)
boundary_28 = BoundarySurfaces(Edges=ungroup_43)
boundary_29 = BoundarySurfaces(Edges=ungroup_44)
boundary_30 = BoundarySurfaces(Edges=ungroup_45)
round_3 = Round(Number=division_12)  # -> Nearest, Floor, Ceiling
number_slider_7 = Slider(750, range=0..1000)
recgrid_3 = Rectangular(Plane=pt_5, SizeX=Slider(700, range=0..1000), SizeY=expr("x*-1", number_slider_7), ExtentX=20, ExtentY=round_3.Ceiling)  # -> Cells, Points
multiplication_3 = Multiplication(A=round_3.Ceiling, B=number_slider_7)
flip_3 = FlipMatrix(Data=recgrid_3.Cells)
area_23 = Area(Geometry=flatten(flip_3))  # -> Area, Centroid
split_7 = SplitList(List=area_23.Centroid, Index=lng_9)  # -> ListA, ListB
vec2pt_3 = Vector2Pt(PointA=area_21.Centroid, PointB=graft(split_7.ListA), Unitize=False)  # -> Vector, Length
split_8 = TextSplit(Text=ungroup_35, Separators=",")
rep_8 = ReplaceText(Text=split_8, Find="{", RecursiveReplace=False)
label_3 = Move(Geometry=branch_69, Motion=vec2pt_3.Vector)  # -> Geometry, Transform
move_51 = Move(Geometry=boundary_30, Motion=vec2pt_3.Vector)  # -> Geometry, Transform
move_52 = Move(Geometry=ungroup_32, Motion=vec2pt_3.Vector)  # -> Geometry, Transform
move_53 = Move(Geometry=ungroup_33, Motion=vec2pt_3.Vector)  # -> Geometry, Transform
rep_9 = ReplaceText(Text=rep_8, Find="}", RecursiveReplace=False)
move_54 = Move(Geometry=ungroup_31, Motion=vec2pt_3.Vector)  # -> Geometry, Transform
trim_19 = TextTrim(Text=rep_9, Start=True, End=True)
item_34 = ListItem(List=trim_19, Index=0, Wrap=True)  # -> Item, Item1, Item2
rgb_3 = ColourRGB(Alpha=255, Red=item_34.Item, Green=item_34.Item1, Blue=item_34.Item2)
move_55 = Move(Geometry=boundary_21, Motion=vec2pt_3.Vector)  # -> Geometry, Transform
move_56 = Move(Geometry=boundary_22, Motion=vec2pt_3.Vector)  # -> Geometry, Transform
move_57 = Move(Geometry=boundary_23, Motion=vec2pt_3.Vector)  # -> Geometry, Transform
move_58 = Move(Geometry=boundary_24, Motion=vec2pt_3.Vector)  # -> Geometry, Transform
move_59 = Move(Geometry=boundary_25, Motion=vec2pt_3.Vector)  # -> Geometry, Transform
move_60 = Move(Geometry=boundary_26, Motion=vec2pt_3.Vector)  # -> Geometry, Transform
move_61 = Move(Geometry=boundary_27, Motion=vec2pt_3.Vector)  # -> Geometry, Transform
move_62 = Move(Geometry=boundary_28, Motion=vec2pt_3.Vector)  # -> Geometry, Transform
move_63 = Move(Geometry=boundary_29, Motion=vec2pt_3.Vector)  # -> Geometry, Transform
srf_4 = Surface(move_52.Geometry)
bbox_9 = BoundingBox(Content=move_54.Geometry, Plane=PlaneXY(0, 0, 0), UnionBox=True)  # -> Box, Box_2
debrep_9 = DeconstructBrep(Brep=bbox_9.Box)  # -> Faces, Edges, Vertices
item_35 = ListItem(List=debrep_9.Faces, Index=Slider(4, range=0..10), Wrap=True)
debrep_10 = DeconstructBrep(Brep=item_35)  # -> Faces, Edges, Vertices
area_24 = Area(Geometry=item_35)  # -> Area, Centroid
len_4 = Length(Curve=debrep_10.Edges)
sort_3 = SortList(Keys=len_4, ValuesA=debrep_10.Edges)  # -> Keys, ValuesA
item_36 = ListItem(List=reverse(sort_3.ValuesA), Index=0, Wrap=True)  # -> Item, Item1
panel_38 = Panel(sort_3.ValuesA)
end_3 = EndPoints(Curve=item_36.Item)  # -> Start, End
pdecon_9 = Deconstruct(Point=end_3.Start)  # -> XComponent, YComponent, ZComponent
pdecon_10 = Deconstruct(Point=end_3.End)  # -> XComponent, YComponent, ZComponent
number_slider_8 = Slider(475, range=0..1000)
subtraction_7 = Subtraction(A=pdecon_9.YComponent, B=pdecon_10.YComponent)
subtraction_8 = Subtraction(A=pdecon_9.XComponent, B=pdecon_10.XComponent)
division_13 = Division(A=number_slider_8, B=subtraction_8)
division_14 = Division(A=number_slider_8, B=subtraction_7)
panel_39 = Panel(division_13)
weave_7 = Weave(Pattern=[0, 1], Stream0=panel_39, Stream1=division_14, NullGaps=False)
rep_10 = ReplaceText(Text=weave_7, Find="-", RecursiveReplace=False)
clean_8 = CleanTree(RemoveNulls=True, RemoveInvalid=True, RemoveEmpty=False, Tree=rep_10)
scale_31 = Scale(Geometry=move_55.Geometry, Center=area_24.Centroid, Factor=clean_8)  # -> Geometry, Transform
scale_32 = Scale(Geometry=move_56.Geometry, Center=area_24.Centroid, Factor=clean_8)  # -> Geometry, Transform
scale_33 = Scale(Geometry=move_57.Geometry, Center=area_24.Centroid, Factor=clean_8)  # -> Geometry, Transform
scale_34 = Scale(Geometry=move_58.Geometry, Center=area_24.Centroid, Factor=clean_8)  # -> Geometry, Transform
scale_35 = Scale(Geometry=move_59.Geometry, Center=area_24.Centroid, Factor=clean_8)  # -> Geometry, Transform
scale_36 = Scale(Geometry=move_60.Geometry, Center=area_24.Centroid, Factor=clean_8)  # -> Geometry, Transform
scale_37 = Scale(Geometry=move_61.Geometry, Center=area_24.Centroid, Factor=clean_8)  # -> Geometry, Transform
scale_38 = Scale(Geometry=move_62.Geometry, Center=area_24.Centroid, Factor=clean_8)  # -> Geometry, Transform
scale_39 = Scale(Geometry=move_63.Geometry, Center=area_24.Centroid, Factor=clean_8)  # -> Geometry, Transform
scale_40 = Scale(Geometry=move_51.Geometry, Center=area_24.Centroid, Factor=clean_8)  # -> Geometry, Transform
scale_41 = Scale(Geometry=move_54.Geometry, Center=area_24.Centroid, Factor=clean_8)  # -> Geometry, Transform
panel_40 = Panel(scale_41.Geometry)
scale_42 = Scale(Geometry=move_53.Geometry, Center=area_24.Centroid, Factor=clean_8)  # -> Geometry, Transform
move_64 = Move(Geometry=scale_31.Geometry, Motion=Vector(0, 0, 10))  # -> Geometry, Transform
move_65 = Move(Geometry=scale_32.Geometry, Motion=Vector(0, 0, 10))  # -> Geometry, Transform
move_66 = Move(Geometry=scale_33.Geometry, Motion=Vector(0, 0, 10))  # -> Geometry, Transform
move_67 = Move(Geometry=scale_34.Geometry, Motion=Vector(0, 0, 10))  # -> Geometry, Transform
move_68 = Move(Geometry=scale_35.Geometry, Motion=Vector(0, 0, 10))  # -> Geometry, Transform
move_69 = Move(Geometry=scale_37.Geometry, Motion=Vector(0, 0, 10))  # -> Geometry, Transform
move_70 = Move(Geometry=scale_38.Geometry, Motion=Vector(0, 0, 10))  # -> Geometry, Transform
move_71 = Move(Geometry=scale_39.Geometry, Motion=Vector(0, 0, 10))  # -> Geometry, Transform
panel_41 = Panel(clean_8)
scale_43 = Scale(Geometry=srf_4, Center=area_24.Centroid, Factor=clean_8)  # -> Geometry, Transform
move_72 = Move(Geometry=scale_42.Geometry, Motion=Vector(0, 0, 10))  # -> Geometry, Transform
scale_44 = Scale(Geometry=move_54.Geometry, Center=area_24.Centroid, Factor=clean_8)  # -> Geometry, Transform
panel_42 = Panel(rep_10)
move_73 = Move(Geometry=scale_41.Geometry, Motion=Vector(0, 0, 10))  # -> Geometry, Transform
move_74 = Move(Geometry=scale_43.Geometry, Motion=Vector(0, 0, 10))  # -> Geometry, Transform
preview_12 = CustomPreview(Geometry=move_72.Geometry, Material=ColourSwatch(SwatchColor=RGB(0, 0, 0)))
preview_13 = CustomPreview(Geometry=move_73.Geometry, Material=ColourSwatch(SwatchColor=RGB(0, 0, 0)))
preview_14 = CustomPreview(Geometry=label_3.Geometry, Material=ColourSwatch(SwatchColor=RGB(0, 0, 0)))
preview_15 = CustomPreview(Geometry=move_74.Geometry, Material=rgb_3)
geo_3 = Geometry([scale_44.Geometry, label_3.Geometry, move_72.Geometry, move_71.Geometry, move_70.Geometry])
bbox_10 = BoundingBox(Content=flatten(geo_3), Plane=PlaneXY(0, 0, 0), UnionBox=True)  # -> Box, Box_2
debrep_11 = DeconstructBrep(Brep=bbox_10.Box)  # -> Faces, Edges, Vertices
item_37 = ListItem(List=debrep_11.Faces, Index=Slider(4, range=0..10), Wrap=True)
debrep_12 = DeconstructBrep(Brep=item_37)  # -> Faces, Edges, Vertices
area_25 = Area(Geometry=item_37)  # -> Area, Centroid
join_3 = JoinCurves(Curves=debrep_12.Edges, Preserve=False)
scale_45 = Scale(Geometry=join_3, Center=area_25.Centroid, Factor=Slider(1.12, range=0..10))  # -> Geometry, Transform

addition_4 = Addition(A=multiplication_3, B="-00")
subtraction_9 = Subtraction(A=subtraction_6, B=addition_4)
pt_7 = ConstructPoint(XCoordinate="8400", YCoordinate=subtraction_9, ZCoordinate=0)
# Sorting results and rescaling geometry for visualisation
move_75 = Move(Geometry=branch_44, Motion=vec2pt.Vector)  # -> Geometry, Transform
move_76 = Move(Geometry=branch_45, Motion=vec2pt.Vector)  # -> Geometry, Transform
move_77 = Move(Geometry=branch_46, Motion=vec2pt.Vector)  # -> Geometry, Transform
move_78 = Move(Geometry=branch_47, Motion=vec2pt.Vector)  # -> Geometry, Transform

equals_10 = Equality(FirstNumber=k_means.Result, SecondNumber="3")  # -> Equality, Inequality
tstat_22 = TreeStatistics(Tree=trim)  # -> Paths, Length, Count
dispatch_24 = Dispatch(List=flatten(tstat_22.Paths), DispatchPattern=equals_10.Equality)  # -> ListA, ListB
branch_81 = TreeBranch(Tree=group_10, Path=dispatch_24.ListA, MaintainPaths=True)
branch_82 = TreeBranch(Tree=group_8, Path=dispatch_24.ListA, MaintainPaths=True)
branch_83 = TreeBranch(Tree=group_6, Path=dispatch_24.ListA, MaintainPaths=True)
branch_84 = TreeBranch(Tree=group_7, Path=dispatch_24.ListA, MaintainPaths=True)
branch_85 = TreeBranch(Tree=group_5, Path=dispatch_24.ListA, MaintainPaths=True)
branch_86 = TreeBranch(Tree=group_4, Path=dispatch_24.ListA, MaintainPaths=True)
branch_87 = TreeBranch(Tree=group_3, Path=dispatch_24.ListA, MaintainPaths=True)
branch_88 = TreeBranch(Tree=group_2, Path=dispatch_24.ListA, MaintainPaths=True)
branch_89 = TreeBranch(Tree=group, Path=dispatch_24.ListA, MaintainPaths=True)
branch_90 = TreeBranch(Tree=group_9, Path=dispatch_24.ListA, MaintainPaths=True)
branch_91 = TreeBranch(Tree=footprint, Path=dispatch_24.ListA, MaintainPaths=True)
branch_92 = TreeBranch(Tree=pt, Path=dispatch_24.ListA, MaintainPaths=True)
branch_93 = TreeBranch(Tree=auditorium, Path=dispatch_24.ListA, MaintainPaths=True)
branch_94 = TreeBranch(Tree=footprint, Path=dispatch_24.ListA, MaintainPaths=True)
branch_95 = TreeBranch(Tree=trim_16, Path=dispatch_24.ListA, MaintainPaths=True)
branch_96 = TreeBranch(Tree=stage, Path=dispatch_24.ListA, MaintainPaths=True)
ungroup_46 = Ungroup(Group=branch_81)
ungroup_47 = Ungroup(Group=branch_82)
ungroup_48 = Ungroup(Group=branch_83)
ungroup_49 = Ungroup(Group=branch_84)
ungroup_50 = Ungroup(Group=branch_85)
ungroup_51 = Ungroup(Group=branch_86)
ungroup_52 = Ungroup(Group=branch_87)
ungroup_53 = Ungroup(Group=branch_88)
ungroup_54 = Ungroup(Group=branch_89)
ungroup_55 = Ungroup(Group=branch_90)
weave_8 = Weave(Pattern=[0, 1], Stream0=graft(branch_81), Stream1=graft(branch_96), NullGaps=False)
boundary_31 = BoundarySurfaces(Edges=ungroup_46)
boundary_32 = BoundarySurfaces(Edges=ungroup_47)
boundary_33 = BoundarySurfaces(Edges=ungroup_48)
boundary_34 = BoundarySurfaces(Edges=ungroup_49)
boundary_35 = BoundarySurfaces(Edges=ungroup_50)
boundary_36 = BoundarySurfaces(Edges=ungroup_51)
boundary_37 = BoundarySurfaces(Edges=ungroup_52)
boundary_38 = BoundarySurfaces(Edges=ungroup_53)
boundary_39 = BoundarySurfaces(Edges=ungroup_54)
boundary_40 = BoundarySurfaces(Edges=ungroup_55)
ungroup_56 = Ungroup(Group=branch_91)
ungroup_57 = Ungroup(Group=branch_96)
ungroup_58 = Ungroup(Group=branch_93)
ungroup_59 = Ungroup(Group=branch_94)
ungroup_60 = Ungroup(Group=branch_92)
area_26 = Area(Geometry=ungroup_56)  # -> Area, Centroid
bbox_11 = BoundingBox(Content=weave_8, Plane=PlaneXY(0, 0, 0), UnionBox=True)  # -> Box, Box_2
area_27 = Area(Geometry=bbox_11.Box)  # -> Area, Centroid
lng_10 = ListLength(List=flatten(branch_95))
pt_8 = ConstructPoint(XCoordinate="8400", YCoordinate="4200", ZCoordinate=0)
division_15 = Division(A=lng_10, B=Slider(10, range=0..10))
round_4 = Round(Number=division_15)  # -> Nearest, Floor, Ceiling
recgrid_4 = Rectangular(
    Plane=pt_7,
    SizeX=Slider(700, range=0..1000),
    SizeY=expr("x*-1", Slider(750, range=0..1000)),
    ExtentX=20,
    ExtentY=round_4.Ceiling)  # -> Cells, Points
flip_4 = FlipMatrix(Data=recgrid_4.Cells)
area_28 = Area(Geometry=flatten(flip_4))  # -> Area, Centroid
split_9 = SplitList(List=area_28.Centroid, Index=lng_10)  # -> ListA, ListB
vec2pt_4 = Vector2Pt(PointA=area_26.Centroid, PointB=graft(split_9.ListA), Unitize=False)  # -> Vector, Length
split_10 = TextSplit(Text=ungroup_60, Separators=",")
rep_11 = ReplaceText(Text=split_10, Find="{", RecursiveReplace=False)
label_4 = Move(Geometry=branch_95, Motion=vec2pt_4.Vector)  # -> Geometry, Transform
move_79 = Move(Geometry=boundary_31, Motion=vec2pt_4.Vector)  # -> Geometry, Transform
move_80 = Move(Geometry=ungroup_57, Motion=vec2pt_4.Vector)  # -> Geometry, Transform
move_81 = Move(Geometry=ungroup_58, Motion=vec2pt_4.Vector)  # -> Geometry, Transform
rep_12 = ReplaceText(Text=rep_11, Find="}", RecursiveReplace=False)
move_82 = Move(Geometry=boundary_32, Motion=vec2pt_4.Vector)  # -> Geometry, Transform
move_83 = Move(Geometry=boundary_33, Motion=vec2pt_4.Vector)  # -> Geometry, Transform
move_84 = Move(Geometry=boundary_34, Motion=vec2pt_4.Vector)  # -> Geometry, Transform
move_85 = Move(Geometry=boundary_35, Motion=vec2pt_4.Vector)  # -> Geometry, Transform
move_86 = Move(Geometry=boundary_36, Motion=vec2pt_4.Vector)  # -> Geometry, Transform
move_87 = Move(Geometry=boundary_37, Motion=vec2pt_4.Vector)  # -> Geometry, Transform
move_88 = Move(Geometry=boundary_38, Motion=vec2pt_4.Vector)  # -> Geometry, Transform
move_89 = Move(Geometry=boundary_39, Motion=vec2pt_4.Vector)  # -> Geometry, Transform
move_90 = Move(Geometry=boundary_40, Motion=vec2pt_4.Vector)  # -> Geometry, Transform
move_91 = Move(Geometry=ungroup_56, Motion=vec2pt_4.Vector)  # -> Geometry, Transform
trim_20 = TextTrim(Text=rep_12, Start=True, End=True)
item_38 = ListItem(List=trim_20, Index=0, Wrap=True)  # -> Item, Item1, Item2
rgb_4 = ColourRGB(Alpha=255, Red=item_38.Item, Green=item_38.Item1, Blue=item_38.Item2)
bbox_12 = BoundingBox(Content=move_91.Geometry, Plane=PlaneXY(0, 0, 0), UnionBox=True)  # -> Box, Box_2
debrep_13 = DeconstructBrep(Brep=bbox_12.Box)  # -> Faces, Edges, Vertices
srf_5 = Surface(move_80.Geometry)
item_39 = ListItem(List=debrep_13.Faces, Index=Slider(4, range=0..10), Wrap=True)
debrep_14 = DeconstructBrep(Brep=item_39)  # -> Faces, Edges, Vertices
area_29 = Area(Geometry=item_39)  # -> Area, Centroid
len_5 = Length(Curve=debrep_14.Edges)
sort_4 = SortList(Keys=len_5, ValuesA=debrep_14.Edges)  # -> Keys, ValuesA
item_40 = ListItem(List=reverse(sort_4.ValuesA), Index=0, Wrap=True)  # -> Item, Item1
panel_43 = Panel(sort_4.ValuesA)
branch_97 = TreeBranch(Path=dispatch_23.ListA, MaintainPaths=True)
branch_98 = TreeBranch(Tree=trim_13, Path=dispatch_23.ListA, MaintainPaths=True)
branch_99 = TreeBranch(Path=dispatch_23.ListA, MaintainPaths=True)
branch_100 = TreeBranch(Path=dispatch_23.ListA, MaintainPaths=True)
end_4 = EndPoints(Curve=item_40.Item)  # -> Start, End
pdecon_11 = Deconstruct(Point=end_4.Start)  # -> XComponent, YComponent, ZComponent
pdecon_12 = Deconstruct(Point=end_4.End)  # -> XComponent, YComponent, ZComponent
number_slider_9 = Slider(475, range=0..1000)
subtraction_10 = Subtraction(A=pdecon_11.YComponent, B=pdecon_12.YComponent)
subtraction_11 = Subtraction(A=pdecon_11.XComponent, B=pdecon_12.XComponent)
division_16 = Division(A=number_slider_9, B=subtraction_11)
division_17 = Division(A=number_slider_9, B=subtraction_10)
panel_44 = Panel(division_16)
weave_9 = Weave(Pattern=[0, 1], Stream0=panel_44, Stream1=division_17, NullGaps=False)
rep_13 = ReplaceText(Text=weave_9, Find="-", RecursiveReplace=False)
clean_9 = CleanTree(RemoveNulls=True, RemoveInvalid=True, RemoveEmpty=False, Tree=rep_13)
scale_46 = Scale(Geometry=move_82.Geometry, Center=area_29.Centroid, Factor=clean_9)  # -> Geometry, Transform
scale_47 = Scale(Geometry=move_83.Geometry, Center=area_29.Centroid, Factor=clean_9)  # -> Geometry, Transform
scale_48 = Scale(Geometry=move_84.Geometry, Center=area_29.Centroid, Factor=clean_9)  # -> Geometry, Transform
scale_49 = Scale(Geometry=move_85.Geometry, Center=area_29.Centroid, Factor=clean_9)  # -> Geometry, Transform
scale_50 = Scale(Geometry=move_86.Geometry, Center=area_29.Centroid, Factor=clean_9)  # -> Geometry, Transform
scale_51 = Scale(Geometry=move_87.Geometry, Center=area_29.Centroid, Factor=clean_9)  # -> Geometry, Transform
scale_52 = Scale(Geometry=move_88.Geometry, Center=area_29.Centroid, Factor=clean_9)  # -> Geometry, Transform
scale_53 = Scale(Geometry=move_89.Geometry, Center=area_29.Centroid, Factor=clean_9)  # -> Geometry, Transform
scale_54 = Scale(Geometry=move_90.Geometry, Center=area_29.Centroid, Factor=clean_9)  # -> Geometry, Transform
scale_55 = Scale(Geometry=move_79.Geometry, Center=area_29.Centroid, Factor=clean_9)  # -> Geometry, Transform
scale_56 = Scale(Geometry=move_91.Geometry, Center=area_29.Centroid, Factor=clean_9)  # -> Geometry, Transform
move_92 = Move(Geometry=scale_46.Geometry, Motion=Vector(0, 0, 10))  # -> Geometry, Transform
move_93 = Move(Geometry=scale_47.Geometry, Motion=Vector(0, 0, 10))  # -> Geometry, Transform
move_94 = Move(Geometry=scale_48.Geometry, Motion=Vector(0, 0, 10))  # -> Geometry, Transform
move_95 = Move(Geometry=scale_49.Geometry, Motion=Vector(0, 0, 10))  # -> Geometry, Transform
move_96 = Move(Geometry=scale_50.Geometry, Motion=Vector(0, 0, 10))  # -> Geometry, Transform
move_97 = Move(Geometry=scale_52.Geometry, Motion=Vector(0, 0, 10))  # -> Geometry, Transform
move_98 = Move(Geometry=scale_53.Geometry, Motion=Vector(0, 0, 10))  # -> Geometry, Transform
move_99 = Move(Geometry=scale_54.Geometry, Motion=Vector(0, 0, 10))  # -> Geometry, Transform
panel_45 = Panel(scale_56.Geometry)
scale_57 = Scale(Geometry=move_81.Geometry, Center=area_29.Centroid, Factor=clean_9)  # -> Geometry, Transform
panel_46 = Panel(rep_13)
panel_47 = Panel(clean_9)
scale_58 = Scale(Geometry=srf_5, Center=area_29.Centroid, Factor=clean_9)  # -> Geometry, Transform
move_100 = Move(Geometry=scale_57.Geometry, Motion=Vector(0, 0, 10))  # -> Geometry, Transform
move_101 = Move(Geometry=scale_56.Geometry, Motion=Vector(0, 0, 10))  # -> Geometry, Transform
scale_59 = Scale(Geometry=move_91.Geometry, Center=area_29.Centroid, Factor=clean_9)  # -> Geometry, Transform
move_102 = Move(Geometry=scale_58.Geometry, Motion=Vector(0, 0, 10))  # -> Geometry, Transform
preview_16 = CustomPreview(Geometry=move_102.Geometry, Material=rgb_4)
preview_17 = CustomPreview(Geometry=move_100.Geometry, Material=ColourSwatch(SwatchColor=RGB(0, 0, 0)))
preview_18 = CustomPreview(Geometry=move_101.Geometry, Material=ColourSwatch(SwatchColor=RGB(0, 0, 0)))
preview_19 = CustomPreview(Geometry=label_4.Geometry, Material=ColourSwatch(SwatchColor=RGB(0, 0, 0)))
move_103 = Move(Geometry=branch_97, Motion=vec2pt_3.Vector)  # -> Geometry, Transform
move_104 = Move(Geometry=branch_98, Motion=vec2pt_3.Vector)  # -> Geometry, Transform
move_105 = Move(Geometry=branch_99, Motion=vec2pt_3.Vector)  # -> Geometry, Transform
move_106 = Move(Geometry=branch_100, Motion=vec2pt_3.Vector)  # -> Geometry, Transform
geo_4 = Geometry([scale_59.Geometry, label_4.Geometry, move_100.Geometry, move_99.Geometry, move_98.Geometry])
bbox_13 = BoundingBox(Content=flatten(geo_4), Plane=PlaneXY(0, 0, 0), UnionBox=True)  # -> Box, Box_2
debrep_15 = DeconstructBrep(Brep=bbox_13.Box)  # -> Faces, Edges, Vertices
item_41 = ListItem(List=debrep_15.Faces, Index=Slider(4, range=0..10), Wrap=True)
debrep_16 = DeconstructBrep(Brep=item_41)  # -> Faces, Edges, Vertices
area_30 = Area(Geometry=item_41)  # -> Area, Centroid
join_4 = JoinCurves(Curves=debrep_16.Edges, Preserve=False)
scale_60 = Scale(Geometry=join_4, Center=area_30.Centroid, Factor=Slider(1.12, range=0..10))  # -> Geometry, Transform
scale_61 = Scale(Geometry=move_106.Geometry, Center=area_24.Centroid, Factor=clean_8)  # -> Geometry, Transform
scale_62 = Scale(Geometry=move_104.Geometry, Center=area_24.Centroid, Factor=clean_8)  # -> Geometry, Transform
scale_63 = Scale(Geometry=move_105.Geometry, Center=area_24.Centroid, Factor=clean_8)  # -> Geometry, Transform
scale_64 = Scale(Geometry=move_103.Geometry, Center=area_24.Centroid, Factor=clean_8)  # -> Geometry, Transform
move_107 = Move(Geometry=scale_61.Geometry, Motion=Vector(0, 0, 10))  # -> Geometry, Transform
move_108 = Move(Geometry=scale_62.Geometry, Motion=Vector(0, 0, 10))  # -> Geometry, Transform
move_109 = Move(Geometry=scale_63.Geometry, Motion=Vector(0, 0, 10))  # -> Geometry, Transform
move_110 = Move(Geometry=scale_64.Geometry, Motion=Vector(0, 0, 10))  # -> Geometry, Transform

scale_65 = Scale(Geometry=move_75.Geometry, Center=area_14.Centroid, Factor=clean_6)  # -> Geometry, Transform
scale_66 = Scale(Geometry=move_76.Geometry, Center=area_14.Centroid, Factor=clean_6)  # -> Geometry, Transform
scale_67 = Scale(Geometry=move_77.Geometry, Center=area_14.Centroid, Factor=clean_6)  # -> Geometry, Transform
scale_68 = Scale(Geometry=move_78.Geometry, Center=area_14.Centroid, Factor=clean_6)  # -> Geometry, Transform
move_111 = Move(Geometry=scale_65.Geometry, Motion=Vector(0, 0, 10))  # -> Geometry, Transform
move_112 = Move(Geometry=scale_66.Geometry, Motion=Vector(0, 0, 10))  # -> Geometry, Transform
move_113 = Move(Geometry=scale_67.Geometry, Motion=Vector(0, 0, 10))  # -> Geometry, Transform
move_114 = Move(Geometry=scale_68.Geometry, Motion=Vector(0, 0, 10))  # -> Geometry, Transform
swatch = ColourSwatch(SwatchColor=RGB(255, 89, 0))
S = ColourSwatch(SwatchColor=RGB(91, 95, 181))
swatch_2 = ColourSwatch(SwatchColor=RGB(0, 255, 238))
swatch_3 = ColourSwatch(SwatchColor=RGB(201, 176, 139))
swatch_4 = ColourSwatch(SwatchColor=RGB(7, 127, 143))
swatch_5 = ColourSwatch(SwatchColor=RGB(166, 0, 255))
swatch_6 = ColourSwatch(SwatchColor=RGB(255, 0, 166))
swatch_7 = ColourSwatch(SwatchColor=RGB(0, 38, 255))
swatch_8 = ColourSwatch(SwatchColor=RGB(255, 0, 0))
swatch_9 = ColourSwatch(SwatchColor=RGB(135, 122, 101))

# ---- group: Seating blocks
swatch_10 = ColourSwatch(SwatchColor=RGB(212, 109, 72))
scale_69 = Scale(Geometry=move_50.Geometry, Center=area_19.Centroid, Factor=clean_7)  # -> Geometry, Transform
move_115 = Move(Geometry=scale_69.Geometry, Motion=Vector(0, 0, 10))  # -> Geometry, Transform
preview_20 = CustomPreview(Geometry=move_111.Geometry, Material=swatch_10)
preview_21 = CustomPreview(Geometry=move_108.Geometry, Material=swatch_10)
preview_22 = CustomPreview(Geometry=move_115.Geometry, Material=swatch_10)

# ----
wc = CustomPreview(Geometry=[move_42.Geometry, move_64.Geometry, move_92.Geometry, move_16.Geometry], Material=swatch_2)
preview_23 = CustomPreview(Geometry=[move_43.Geometry, move_65.Geometry, move_93.Geometry, move_17.Geometry], Material=S)
preview_24 = CustomPreview(Geometry=[move_44.Geometry, move_66.Geometry, move_94.Geometry, move_18.Geometry], Material=swatch_3)
preview1 = CustomPreview(Geometry=[move_45.Geometry, move_67.Geometry, move_95.Geometry, move_19.Geometry], Material=swatch_4)
preview_25 = CustomPreview(Geometry=[move_46.Geometry, move_68.Geometry, move_96.Geometry, move_20.Geometry], Material=swatch_9)
preview_26 = CustomPreview(Geometry=[scale_25.Geometry, scale_36.Geometry, scale_51.Geometry, scale_7.Geometry], Material=swatch_5)
preview_27 = CustomPreview(Geometry=[move_47.Geometry, move_69.Geometry, move_97.Geometry, move_21.Geometry], Material=swatch_6)
preview_28 = CustomPreview(Geometry=[move_22.Geometry, move_48.Geometry, move_70.Geometry, move_98.Geometry], Material=swatch_7)
preview_29 = CustomPreview(Geometry=[move_23.Geometry, move_49.Geometry, move_71.Geometry, move_99.Geometry], Material=swatch)
preview_30 = CustomPreview(Geometry=[scale_11.Geometry, scale_29.Geometry, scale_40.Geometry, scale_55.Geometry], Material=swatch_8)
merge_8 = Merge(
    Data1=swatch_2,
    Data2=S,
    Data3=swatch_3,
    Data4=swatch_4,
    Data5=swatch_9,
    Data6=swatch_5,
    Data7=swatch_6,
    Data8=swatch_7,
    Data9=swatch,
    Data10=swatch_8)  # -> reverse(Result)
# Output visualisation
panel_48 = Panel("6800")
panel_49 = Panel("""Toilets
Service
Podium
Performers
Parking
Media
Hospitality
GA Concourse
Circulation
Commercial""")
panel_50 = Panel("""Toilets
Service
Podium
Performers
Parking
Media
Hospitality
GA Concourse
Circulation
Commercial""")
pt_9 = ConstructPoint(XCoordinate=panel_48, YCoordinate="-150", ZCoordinate=0)
lng_11 = ListLength(List=panel_50)
preview_31 = CustomPreview(
    Geometry=[scale_30.Geometry, scale_45.Geometry, scale_60.Geometry, scale_15.Geometry],
    Material=ColourSwatch(SwatchColor=RGB(0, 0, 0)))
rectangle = Rectangle(Plane=pt_9, XSize="-30 To 30", YSize="0 To 60", Radius=0)  # -> Rectangle, Length
series = Series(Start=0, Step=Slider(100, range=0..1000), Count=lng_11)
srf_6 = Surface(rectangle.Rectangle)
Y_2 = UnitY(Factor=expr("x*-1", series))
move_116 = Move(Geometry=srf_6, Motion=Y_2)  # -> Geometry, Transform
panel_51 = Panel("""Building Scale : 
Floor footprint
Footprint to auditorium to stage 
proportions""")
panel_52 = Panel("""Commercial
Circulation
GA Concourse
Hospitality
Media
Parking
Performers` spaces
Podium
Service
Toilets""")
X_2 = UnitX(Factor=Slider(100, range=0..1000))
move_117 = Move(Geometry=pt_9, Motion=X_2)  # -> Geometry, Transform
pt_10 = ConstructPoint(XCoordinate="6800", YCoordinate="3900", ZCoordinate=0)
preview_32 = CustomPreview(Geometry=graft(move_116.Geometry), Material=graft(merge_8))
tag = TextTag3D(
    Location=pt_10,
    Text=panel_51,
    Size=Slider(79, range=0..1000),
    Colour=ColourSwatch(SwatchColor=RGB(0, 0, 0)),
    Justification=7)
tag_2 = TextTag3D(
    Location=move_117.Geometry,
    Text=panel_52,
    Size=Slider(52, range=0..100),
    Colour=ColourSwatch(SwatchColor=RGB(0, 0, 0)),
    Justification=7)
