# Grasshopper definition 03_Parametric model.gh (Grasshopper 1.0.7)
# plug-ins: Human, MeshEdit Components

# ---- group: Manual parametric inputs, connect to parameter inputs / Programme
panel = Panel("""9
1
4
4
9
1
9
9
9
9
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""")
panel_2 = Panel("""9
9
9
9
9
9
9
9
9
9
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""")
panel_3 = Panel("""4
4
4
4
4
4
4
4
4
4
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""")
panel_4 = Panel("""9
1
4
4
9
1
9
9
9
9
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""")
panel_5 = Panel("""9
9
9
9
9
9
9
9
9
9
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""")
panel_6 = Panel("""4
4
4
4
4
4
4
4
4
4
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""")
panel_7 = Panel("""11
2
11
11
11
2
11
11
11
11
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""")
panel_8 = Panel("""11.1
1.1
2.1
2.1
11.1
1.1
11.1
3.1
3.1
11.1
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""")
panel_9 = Panel("""11
1
2
2
11
1
11
3
3
11
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""")
panel_10 = Panel("""6
1
6
6
6
1
6
6
6
6
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""")
entwine = Entwine(
    Branch00="10",
    Branch01=panel_6,
    Branch02=panel_6,
    Branch03=panel_5,
    Branch04=panel_4,
    Branch05="10",
    Branch06="10",
    Branch07="10",
    Branch08="10",
    Branch09="10",
    Branch010="10",
    Branch011="10",
    Branch012="10",
    Branch013="10",
    FlattenInputs=True)
panel_11 = Panel("""11
1
1
11
11
11
2
2
2
2
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""")
entwine_2 = Entwine(
    Branch00=panel_8,
    Branch01="10",
    Branch02="10",
    Branch03="10",
    Branch04="10",
    Branch05="10",
    Branch06="10",
    Branch07="10",
    Branch08="10",
    Branch09="10",
    Branch010="10",
    Branch011="10",
    Branch012="10",
    FlattenInputs=True)
entwine_3 = Entwine(
    Branch00=panel_11,
    Branch01="11",
    Branch02="10",
    Branch03="10",
    Branch04="10",
    Branch05="10",
    Branch06="10",
    FlattenInputs=True)
entwine_4 = Entwine(
    Branch00="11",
    Branch01=panel_9,
    Branch02="11",
    Branch03="11",
    Branch04="10",
    Branch05="10",
    Branch06="10",
    Branch07="10",
    Branch08="10",
    Branch09="10",
    Branch010="10",
    Branch011="10",
    Branch012="10",
    FlattenInputs=True)
entwine_5 = Entwine(
    Branch00=panel_10,
    Branch01=panel_7,
    Branch02="10",
    Branch03="10",
    Branch04="10",
    Branch05="10",
    Branch06="10",
    Branch07="10",
    Branch08="10",
    Branch09="10",
    Branch010="10",
    Branch011="10",
    Branch012="10",
    FlattenInputs=True)
entwine_6 = Entwine(
    Branch00=panel_3,
    Branch01=panel_2,
    Branch02=panel,
    Branch03="10",
    Branch04="10",
    Branch05="10",
    Branch06="10",
    Branch07="10",
    Branch08="10",
    Branch09="10",
    Branch010="10",
    Branch011="10",
    FlattenInputs=True)

# ---- group: Manual parametric inputs, connect to parameter inputs
gangway_1_bays = Panel("""0
2
4
6
9
12
15
17
19
21
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""")
tunnels_pattern = Panel("""0
1
1
0
0
0
0
0
0
0
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""")
gangway_1_bays_2 = Panel("""0
4
6
9
12
15
17
21
24
26
29
36
39
41
44
48
50
53
56
59
61
65
68
70
73
80
83
85""")
number_slider = Slider(8, range=0..10)
division = Division(A="1", B=number_slider)
series = Series(Start=0, Step=division, Count=number_slider)
vomitories_bays_numbers = Panel(gangway_1_bays_2)
vomitory_height_in_rows = Panel("8")
vomitory_width_in_meters = Panel("5")
gangway_width_in_meters = Panel("1.8")
gangway_location_left_middle_right = Panel("0")
vomitories_pattern = Panel("""0
1
0
1""")
vomitory_row_start = Panel("35")
vomitories_pattern_2 = Panel("""1
1
1
1""")
gangway_1_lenght = Panel("39")
gangway_2_lenght = Panel("56")
gangway_1_start = Panel("0")
gangway_1_type = Panel("1")
gangway_2_start = Panel("40")
gangway_2_type = Panel("1")
stadium_entry_points = Panel(series)
gangway_1_bays_3 = Panel(gangway_1_bays)
masterplan_entry_points = Panel(""".375
.625
.875
.125""")
moving_elements_area_and_number = Panel("""0
0""")
stadium_entry_points_2 = Panel("8")
moving_elements_area_and_number_2 = Panel("4")
tunnel_height_in_rows = Panel("6")
landings = Panel(""".8
3.5
1.2
1
2.5""")
floor_heights = Panel("""0
5.4
12.204
15.6
22""")
landings_2 = Panel("""4.2
4.2
4.2
2
0.1
0.1
0.1
0.1
0.1""")
landings_3 = Panel("""3.5
1.2
1
2.5""")
landings_4 = Panel("""3
2""")
gangway_2_bays = Panel(gangway_1_bays)
module_pattern = Panel("""0
0
0
0
0
0
0
0
0
0
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""")
podium_height = Panel("12.204")
percentage_roof = Panel(".75")
percentage_facade = Panel(".75")
module_seats_pattern = Panel("1")
podium_width = Panel("10")
materplan_line = Panel("0")
grid_depth = Panel("7.5")
grid_width = Panel("4.8")
entry_points_on_outter_line = Panel(""".01
.12
.23
.34
.45
.56
.67
.78
.89""")
viewing_distance_trim_140 = Panel("100")
building_outline = Panel(Slider(3, range=0..10))
fop_type = Panel("0")
auditorium_outline = Panel(Slider(3, range=0..10))
auditorium_building_outline_tween_number = Panel("0")  # "Auditorium Building outline tween number of rings"
cantelivers = Panel("""0.01
3.5
3.5
0.01
0.01""")
ss_moving_elements = Panel("0")
auditorium_number_of_offsets = Panel("13")
c_value = Panel(""".06
.105
.105
.08""")
c_value_2 = Panel(""".06
.06
.105
.105
.08""")
c_value_3 = Panel(""".23
.23
.23
.23
.23
.23""")
c_value_4 = Panel(""".23
.23""")
cantelivers_2 = Panel(""".1
0.1
0.1
0.8
0.1
0.1
0.1
0.1
0.1""")
number_of_corner_divisions = Panel("4")
cantelivers_3 = Panel("""3.5
3.5
0.01
0.01""")
building_outline_offset = Panel("-7.55")
building_outline_number_of_offsets = Panel("1")
number_of_feasable_events = Panel("4")
masterplan_outline_elipse_x = Panel("250")
masterplan_outline_elipse_y = Panel("300")
viewing_seat_spacing = Panel(".8")
cvalue_fop_type = Panel("0")
floor_height = Panel("""1.8
3.5
3.5
.5""")
cantelivers_4 = Panel("""2.1
2""")
floor_height_2 = Panel("""1.8
.43
3.5
3.5
.5""")
floor_height_3 = Panel("""0.5
2.5
2.5
3.5
2.5
2.5
2.5""")
floor_height_4 = Panel("""0.5
2.8""")
row_depth = Panel(""".8
1.2
.8
.8""")
row_depth_2 = Panel(""".8
.8
1.2
.8
.8""")
row_depth_3 = Panel(""".6
.6
.6
.6
.6
.6""")
row_depth_4 = Panel(""".6
.6""")
rows_per_tier = Panel("""29
2
4
18""")
rows_per_tier_2 = Panel("""5
5
5
5
32""")
rows_per_tier_3 = Panel("""41
32""")
rows_per_tier_4 = Panel("""8
20
2
4
18""")
subtraction = Subtraction(A="1", B=tunnels_pattern)
entwine_7 = Entwine(Branch00=module_pattern, Branch01=module_seats_pattern, FlattenInputs=True)
entwine_8 = Entwine(Branch00=tunnel_height_in_rows, Branch01=subtraction, FlattenInputs=True)
entwine_9 = Entwine(Branch00=landings_3, Branch01=landings, Branch02=landings_2, Branch03=landings_4, FlattenInputs=True)
entwine_10 = Entwine(
    Branch00=podium_width,
    Branch01=podium_height,
    Branch02=percentage_roof,
    Branch03=percentage_facade,
    Branch04="7",
    Branch05="2",
    FlattenInputs=True)
entwine_11 = Entwine(Branch00=rows_per_tier, Branch01=rows_per_tier_4, Branch02=rows_per_tier_2, Branch03=rows_per_tier_3, FlattenInputs=True)
entwine_12 = Entwine(Branch00=row_depth, Branch01=row_depth_2, Branch02=row_depth_3, Branch03=row_depth_4, FlattenInputs=True)
entwine_13 = Entwine(Branch00=floor_height, Branch01=floor_height_2, Branch02=floor_height_3, Branch03=floor_height_4, FlattenInputs=True)
entwine_14 = Entwine(Branch00=cantelivers_3, Branch01=cantelivers, Branch02=cantelivers_2, Branch03=cantelivers_4, FlattenInputs=True)
entwine_15 = Entwine(Branch00=materplan_line, Branch01=entry_points_on_outter_line, FlattenInputs=True)
entwine_16 = Entwine(Branch00=c_value, Branch01=c_value_2, Branch02=c_value_3, Branch03=c_value_4, FlattenInputs=True)
entwine_17 = Entwine(Branch00=grid_depth, Branch01=grid_width, FlattenInputs=True)
entwine_18 = Entwine(
    Branch00=vomitory_row_start,
    Branch01=vomitory_height_in_rows,
    Branch02=vomitory_width_in_meters,
    Branch03=gangway_width_in_meters,
    Branch04=gangway_location_left_middle_right,
    FlattenInputs=True)
entwine_19 = Entwine(Branch00=viewing_seat_spacing, FlattenInputs=True)
pt = ConstructPoint(XCoordinate="75", YCoordinate=0, ZCoordinate="35")
pt_2 = ConstructPoint(XCoordinate="-75", YCoordinate=0, ZCoordinate="35")
entwine_20 = Entwine(Branch00=vomitories_bays_numbers, Branch01=vomitories_pattern, Branch02=vomitories_pattern_2, FlattenInputs=True)
entwine_21 = Entwine(Branch00=floor_heights, FlattenInputs=True)
entwine_22 = Entwine(
    Branch00=fop_type,
    Branch01=auditorium_outline,
    Branch02=building_outline,
    Branch03=ss_moving_elements,
    Branch04=auditorium_number_of_offsets,
    Branch05=number_of_corner_divisions,
    Branch06=auditorium_building_outline_tween_number,
    Branch07=building_outline_offset,
    Branch08=building_outline_number_of_offsets,
    Branch09=number_of_feasable_events,
    Branch010=masterplan_outline_elipse_x,
    Branch011=masterplan_outline_elipse_y,
    Branch012=cvalue_fop_type,
    FlattenInputs=True)  # -> flatten(Result)
entwine_23 = Entwine(Branch00=pt, Branch01=pt_2, FlattenInputs=True)
entwine_24 = Entwine(
    Branch00=masterplan_entry_points,
    Branch01=stadium_entry_points,
    Branch02=moving_elements_area_and_number,
    Branch03=moving_elements_area_and_number_2,
    Branch04=stadium_entry_points_2,
    FlattenInputs=True)
entwine_25 = Entwine(
    Branch00=gangway_1_start,
    Branch01=gangway_1_lenght,
    Branch02=gangway_1_type,
    Branch03=gangway_1_bays_3,
    Branch04=gangway_2_start,
    Branch05=gangway_2_lenght,
    Branch06=gangway_2_type,
    Branch07=gangway_2_bays,
    FlattenInputs=True)
entwine_26 = Entwine(
    Branch0X=entwine,
    Branch1X=entwine_6,
    Branch2X=entwine_4,
    Branch3X=entwine_5,
    Branch4X=entwine_2,
    Branch5X=entwine_3,
    FlattenInputs=False)
entwine_27 = Entwine(
    Branch0X=entwine_22,
    Branch1X=entwine_11,
    Branch2X=entwine_12,
    Branch3X=entwine_13,
    Branch4X=entwine_16,
    Branch5X=entwine_14,
    Branch6X=entwine_21,
    Branch7X=entwine_7,
    Branch8X=entwine_20,
    Branch9X=entwine_17,
    Branch10X=entwine_15,
    Branch11X=entwine_8,
    Branch12X=entwine_18,
    Branch13X=entwine_26,
    Branch14X=entwine_10,
    Branch15X=viewing_distance_trim_140,
    Branch16X=entwine_19,
    Branch17X=entwine_9,
    Branch18X=entwine_25,
    Branch19X=entwine_24,
    Branch20X=entwine_23,
    FlattenInputs=False)

# ---- group: ellipse
division_2 = Division(A="1", B="8")
division_3 = Division(A="1", B="8")
series_2 = Series(Start=0, Step=division_2, Count="8")
series_3 = Series(Start=0, Step=division_3, Count="8")
addition = Addition(A=series_3, B="0.0625")
panel_12 = Panel("""0
1""")
dispatch = Dispatch(List=addition, DispatchPattern=panel_12)  # -> ListA, ListB
ellipse = Ellipse(Plane=PlaneXY(0, 0, 0), Radius1=Slider(135, range=0..1000), Radius2=Slider(176, range=0..1000))  # -> Ellipse, Focus1, Focus2
addition_2 = Addition(A=dispatch.ListB, B=".08")
subtraction_2 = Subtraction(A=dispatch.ListA, B=".08")
sort = SortList(Keys=flatten([addition_2, subtraction_2]))  # -> Keys, ValuesA
shatter = Shatter(Curve=reparameterize(ellipse.Ellipse), Parameters=sort.Keys)
panel_13 = Panel("""1
3
5
7""")
item = ListItem(List=shatter, Index=panel_13, Wrap=True)
end = EndPoints(Curve=item)  # -> Start, End
curvepoint = PointOnCurve(item, parameter=0.5)
panel_14 = Panel("""0
23
0
0""")
pt_3 = ConstructPoint(XCoordinate=0, YCoordinate=0, ZCoordinate=0)
vec2pt = Vector2Pt(PointA=pt_3, PointB=curvepoint, Unitize=False)  # -> Vector, Length
amp = Amplitude(Vector=vec2pt.Vector, Amplitude=panel_14)
move = Move(Geometry=curvepoint, Motion=amp)  # -> Geometry, Transform
arc = Arc3Pt(PointA=end.Start, PointB=move.Geometry, PointC=end.End)  # -> Arc, Plane, Radius
replace = ReplaceItems(List=shatter, Item=arc.Arc, Indices=panel_13, Wrap=False)
join = JoinCurves(Curves=replace, Preserve=False)
number_slider_2 = Slider(3, range=0..10)
fillet = Fillet(Curve=join, Radius="150")
panel_15 = Panel("""0
1
2
4
5
6
8
9
10
12
13
14""")
explode = Explode(Curve=fillet, Recursive=True)  # -> Segments, Vertices
item_2 = ListItem(List=explode.Segments, Index=panel_15, Wrap=True)
replace_2 = ReplaceItems(List=explode.Segments, Indices=panel_15, Wrap=False)
join_2 = JoinCurves(Curves=item_2, Preserve=False)
clean = CleanTree(RemoveNulls=True, RemoveInvalid=True, RemoveEmpty=False, Tree=replace_2)
reb = RebuildCurve(Curve=join_2, Count=10, Tangents=False)
shift = ShiftList(List=reb, Shift=-1, Wrap=True)
weave = Weave(Pattern=[0, 1], Stream0=shift, Stream1=clean, NullGaps=False)
item_3 = ListItem(List=reb, Index=0, Wrap=True)
join_3 = JoinCurves(Curves=weave, Preserve=False)

# ----
type_of_sport_for_c_value_analysis = ValueList({"Football": 0, "Baseball": 1, "Tennis": 2, "Boxing": 3, "Concert": 4, "Athletics": 5}, selected="Football")
case_study = ValueList({"Olympiastadion, Berlin": 0, "Mane Garrincha, Brasilia": 1, "Arena da Amazônia, Manaus": 2, "Allianz Riviera, Nice": 3, "Kyiv Olympic Stadium, Kyiv": 4, "London Stadium, London": 5, "Craven Cottage, London": 6, "Allianz Arena, Munich": 7, "Merkur Spiel-Arena, Dusseldorf": 8, "Tokyo Olympic Stadium": 9, "RheinEnergieStadio, Cologne": 10}, selected="Olympiastadion, Berlin")
panel_16 = Panel(case_study)

# ---- group: Case studies input parameters
berlin = Data(Tree({0;0}: ["0", "7", "7", "0", "15", "8", "0", "-11", "1", "6", "300", "250", "0"], {1;0;0}: ["27", "14", "32"], {1;0;1}: ["41"], {1;0;2}: ["5", "5", "5", "8", "32"], {1;0;3}: ["41", "32"], {2;0;0}: [".76", ".76", ".76"]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))
brasilia = Data(Tree({0;0}: ["0", "3", "0", "0", "6", "8", "0", "-11", "5", "5", "300", "250", "0"], {1;0;0}: ["29", "4", "3", "39"], {1;0;1}: ["0"], {1;0;2}: [], {1;0;3}: [], {2;0;0}: [".8", ".8", ".8", ".8"]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))
amazonia = Data(Tree({0;0}: ["0", "3", "3", "0", "13", "4", "0", "-7.55", "1", "4", "250", "300", "0"], {1;0;0}: ["29", "2", "4", "18"], {1;0;1}: ["8", "20", "2", "4", "18"], {1;0;2}: ["5", "5", "5", "5", "32"], {1;0;3}: ["41", "32"], {2;0;0}: [".8", "1.2", ".8", ".8"]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))
nice = Data(Tree({0;0}: ["0", "4", "3", "0", "7", "4", "0", "-7.55", "7", "4", "250", "300", "0"], {1;0;0}: ["29", "2", "4", "18"], {1;0;1}: ["8", "20", "2", "4", "18"], {1;0;2}: ["5", "5", "5", "5", "32"], {1;0;3}: ["41", "32"], {2;0;0}: [".8", "1.2", ".8", ".8"]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))
london = Data(Tree({0;0}: ["0", "7", "7", "0", "9", "4", "0", "-7.55", "1", "5", "250", "300", "0"], {1;0;0}: ["24", "45"], {1;0;1}: ["24", "5", "27"], {1;0;2}: ["24", "27"], {1;0;3}: ["41", "32"], {2;0;0}: [".795", ".8", ".8", ".8"]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))
fulham = Data(Tree({0;0}: ["0", "4", "4", "0", "21", "4", "0", "-7.55", "2", "5", "250", "300", "0"], {1;0;0}: ["50"], {1;0;1}: ["0"], {1;0;2}: ["0"], {1;0;3}: ["41", "32"], {2;0;0}: [".795", ".8", ".8", ".8"]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))
kiev = Data(Tree({0;0}: ["0", "8", "8", "0", "11", "4", "0", "-7.55", "2", "5", "250", "300", "0"], {1;0;0}: ["45", "29"], {1;0;1}: ["21", "3", "29"], {1;0;2}: ["5", "5", "5", "5", "32"], {1;0;3}: ["41", "32"], {2;0;0}: [".66", ".7", ".9", ".8"]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))
allianz_v2 = Data(Tree({0;0}: ["0", "4", "4", "0", "11", "4", "0", "-7.55", "1", "4", "250", "300", "0"], {1;0;0}: ["26", "26", "20"], {1;0;1}: ["26", "18", "3", "20"], {1;0;2}: ["5", "5", "5", "5", "32"], {1;0;3}: ["41", "32"], {2;0;0}: [".78", ".78", ".78", ".8"]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))
dusseldorf = Data(Tree({0;0}: ["0", "4", "4", "0", "11", "4", "0", "-7.55", "1", "4", "250", "300", "0"], {1;0;0}: ["8", "25", "2", "30"], {1;0;1}: ["37", "30"], {1;0;2}: ["5", "5", "5", "5", "32"], {1;0;3}: ["41", "32"], {2;0;0}: [".78", ".78", ".78", ".78"]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))
cologne = Data(Tree({0;0}: ["0", "6", "6", "0", "9", "8", "0", "-7.55", "1", "4", "250", "300", "0"], {1;0;0}: ["24", "33"], {1;0;1}: ["24"], {1;0;2}: ["24", "3", "33"], {1;0;3}: ["41", "32"], {2;0;0}: [".8", ".8", ".8", ".8"]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))
tokyo = Data(Tree({0;0}: ["0", "7", "7", "0", "8", "4", "0", "-11.35", "2", "5", "250", "300", "0"], {1;0;0}: ["5", "19", "12", "3", "22"], {1;0;1}: ["37", "30"], {1;0;2}: ["5", "5", "5", "5", "32"], {1;0;3}: ["41", "32"], {2;0;0}: [".85", ".78", ".78", ".78", ".78", ".78", ".78"]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))
clean_tree = CleanTree(RemoveNulls=True, RemoveInvalid=True, RemoveEmpty=True, Tree=berlin)
clean_tree_2 = CleanTree(RemoveNulls=True, RemoveInvalid=True, RemoveEmpty=True, Tree=brasilia)
clean_tree_3 = CleanTree(RemoveNulls=True, RemoveInvalid=True, RemoveEmpty=True, Tree=amazonia)
clean_tree_4 = CleanTree(RemoveNulls=True, RemoveInvalid=True, RemoveEmpty=True, Tree=nice)
clean_tree_5 = CleanTree(RemoveNulls=True, RemoveInvalid=True, RemoveEmpty=True, Tree=kiev)
clean_tree_6 = CleanTree(RemoveNulls=True, RemoveInvalid=True, RemoveEmpty=True, Tree=dusseldorf)
clean_tree_7 = CleanTree(RemoveNulls=True, RemoveInvalid=True, RemoveEmpty=True, Tree=tokyo)
clean_tree_8 = CleanTree(RemoveNulls=True, RemoveInvalid=True, RemoveEmpty=True, Tree=cologne)
clean_tree_9 = CleanTree(RemoveNulls=True, RemoveInvalid=True, RemoveEmpty=True, Tree=london)
clean_tree_10 = CleanTree(RemoveNulls=True, RemoveInvalid=True, RemoveEmpty=True, Tree=allianz_v2)
text_join = TextJoin(Text=clean_tree, Join="b")
clean_tree_11 = CleanTree(RemoveNulls=True, RemoveInvalid=True, RemoveEmpty=True, Tree=fulham)
tree_statistics = TreeStatistics(Tree=clean_tree)  # -> Paths, Length, Count
text_join_2 = TextJoin(Text=clean_tree_2, Join="b")
text_join_3 = TextJoin(Text=clean_tree_3, Join="b")
tree_statistics_2 = TreeStatistics(Tree=clean_tree_2)  # -> Paths, Length, Count
text_join_4 = TextJoin(Text=clean_tree_4, Join="b")
tree_statistics_3 = TreeStatistics(Tree=clean_tree_3)  # -> Paths, Length, Count
text_join_5 = TextJoin(Text=flatten(text_join), Join="a")
text_join_6 = TextJoin(Text=clean_tree_5, Join="b")
text_join_7 = TextJoin(Text=clean_tree_6, Join="b")
text_join_8 = TextJoin(Text=flatten(tree_statistics.Paths), Join="a")
text_join_9 = TextJoin(Text=clean_tree_7, Join="b")
text_join_10 = TextJoin(Text=clean_tree_8, Join="b")
text_join_11 = TextJoin(Text=clean_tree_9, Join="b")
tree_statistics_4 = TreeStatistics(Tree=clean_tree_4)  # -> Paths, Length, Count
text_join_12 = TextJoin(Text=clean_tree_10, Join="b")
tree_statistics_5 = TreeStatistics(Tree=clean_tree_5)  # -> Paths, Length, Count
text_join_13 = TextJoin(Text=clean_tree_11, Join="b")
tree_statistics_6 = TreeStatistics(Tree=clean_tree_6)  # -> Paths, Length, Count
tree_statistics_7 = TreeStatistics(Tree=clean_tree_7)  # -> Paths, Length, Count
text_join_14 = TextJoin(Text=flatten(text_join_2), Join="a")
tree_statistics_8 = TreeStatistics(Tree=clean_tree_8)  # -> Paths, Length, Count
tree_statistics_9 = TreeStatistics(Tree=clean_tree_9)  # -> Paths, Length, Count
tree_statistics_10 = TreeStatistics(Tree=clean_tree_10)  # -> Paths, Length, Count
text_join_15 = TextJoin(Text=flatten(tree_statistics_2.Paths), Join="a")
text_join_16 = TextJoin(Text=flatten(text_join_3), Join="a")
tree_statistics_11 = TreeStatistics(Tree=clean_tree_11)  # -> Paths, Length, Count
text_join_17 = TextJoin(Text=flatten(tree_statistics_3.Paths), Join="a")
text_join_18 = TextJoin(Text=flatten(text_join_4), Join="a")
text_join_19 = TextJoin(Text=flatten(text_join_6), Join="a")
text_join_20 = TextJoin(Text=flatten(tree_statistics_4.Paths), Join="a")
text_join_21 = TextJoin(Text=flatten(text_join_7), Join="a")
text_join_22 = TextJoin(Text=flatten(tree_statistics_5.Paths), Join="a")
text_join_23 = TextJoin(Text=flatten(text_join_9), Join="a")
text_join_24 = TextJoin(Text=flatten(text_join_10), Join="a")
text_join_25 = TextJoin(Text=flatten(text_join_11), Join="a")
text_join_26 = TextJoin(Text=flatten(tree_statistics_6.Paths), Join="a")
text_join_27 = TextJoin(Text=flatten(text_join_12), Join="a")
text_join_28 = TextJoin(Text=flatten(tree_statistics_7.Paths), Join="a")
text_join_29 = TextJoin(Text=flatten(tree_statistics_8.Paths), Join="a")
text_join_30 = TextJoin(Text=flatten(tree_statistics_9.Paths), Join="a")
text_join_31 = TextJoin(Text=flatten(text_join_13), Join="a")
text_join_32 = TextJoin(Text=flatten(tree_statistics_10.Paths), Join="a")
text_join_33 = TextJoin(Text=flatten(tree_statistics_11.Paths), Join="a")
entwine_28 = Entwine(
    Branch00=text_join_8,
    Branch01=text_join_15,
    Branch02=text_join_17,
    Branch03=text_join_20,
    Branch04=text_join_22,
    Branch05=text_join_30,
    Branch06=text_join_33,
    Branch07=text_join_32,
    Branch08=text_join_26,
    Branch09=text_join_28,
    Branch010=text_join_29,
    FlattenInputs=True)
entwine_29 = Entwine(
    Branch00=text_join_5,
    Branch01=text_join_14,
    Branch02=text_join_16,
    Branch03=text_join_18,
    Branch04=text_join_19,
    Branch05=text_join_25,
    Branch06=text_join_31,
    Branch07=text_join_27,
    Branch08=text_join_21,
    Branch09=text_join_23,
    Branch010=text_join_24,
    FlattenInputs=True)
list_item = ListItem(List=flatten(entwine_28), Index=panel_16, Wrap=True)
list_item_2 = ListItem(List=flatten(entwine_29), Index=panel_16, Wrap=True)
text_split = TextSplit(Text=list_item_2, Separators="a")
text_split_2 = TextSplit(Text=list_item, Separators="a")
text_split_3 = TextSplit(Text=text_split, Separators="b")
tree_statistics_12 = TreeStatistics(Tree=text_split_3)  # -> Paths, Length, Count
replace_paths = ReplacePaths(Data=text_split_3, Search=tree_statistics_12.Paths, Replace=text_split_2)

# ----
# Parameter inputs
panel_17 = Panel("{10;?;?}")
split = SplitTree(Data=replace_paths, Masks=flatten("{11;?;?}"))  # -> Positive, Negative
split_2 = SplitTree(Data=replace_paths, Masks=flatten("{12;?;?}"))  # -> Positive, Negative
split_3 = SplitTree(Data=replace_paths, Masks=flatten(panel_17))  # -> Positive, Negative
split_4 = SplitTree(Data=replace_paths, Masks=flatten("{4;?;?}"))  # -> Positive, Negative
split_5 = SplitTree(Data=replace_paths, Masks=flatten("{5;?;?}"))  # -> Positive, Negative
split_6 = SplitTree(Data=replace_paths, Masks=flatten("{9;?;?}"))  # -> Positive, Negative
split_7 = SplitTree(Data=replace_paths, Masks=flatten("{3;?;?}"))  # -> Positive, Negative
split_8 = SplitTree(Data=replace_paths, Masks=flatten("{7;?;?}"))  # -> Positive, Negative
split_9 = SplitTree(Data=replace_paths, Masks=flatten("{8;?;?}"))  # -> Positive, Negative
split_10 = SplitTree(Data=replace_paths, Masks=flatten("{6;?;?}"))  # -> Positive, Negative
split_11 = SplitTree(Data=replace_paths, Masks=flatten("{2;?;?}"))  # -> Positive, Negative
split_12 = SplitTree(Data=replace_paths, Masks=flatten("{1;?;?}"))  # -> Positive, Negative
split_13 = SplitTree(Data=replace_paths, Masks=flatten("{0;?}"))  # -> Positive, Negative
split_14 = SplitTree(Data=replace_paths, Masks=flatten("{13;?;?;?}"))  # -> Positive, Negative
split_15 = SplitTree(Data=replace_paths, Masks=flatten("{14;?;?}"))  # -> Positive, Negative
split_16 = SplitTree(Data=replace_paths, Masks=flatten("{15;?}"))  # -> Positive, Negative
bang = ExplodeTree(Data=split_3.Positive)  # -> Branch0, Branch1
bang_2 = ExplodeTree(Data=split.Positive)  # -> Branch0, Branch1
split_17 = SplitTree(Data=replace_paths, Masks=flatten("{20;?;?}"))  # -> Positive, Negative
split_18 = SplitTree(Data=replace_paths, Masks=flatten("{18;?;?}"))  # -> Positive, Negative
bang_3 = ExplodeTree(Data=split_10.Positive)  # -> Branch0, Branch1, Branch2, Branch3
split_19 = SplitTree(Data=replace_paths, Masks=flatten("{16;?;?}"))  # -> Positive, Negative
bang_4 = ExplodeTree(Data=split_12.Positive)  # -> Branch0, Branch1, Branch2, Branch3
bang_5 = ExplodeTree(Data=split_11.Positive)  # -> Branch0, Branch1, Branch2, Branch3
bang_6 = ExplodeTree(Data=split_7.Positive)  # -> Branch0, Branch1, Branch2, Branch3
bang_7 = ExplodeTree(Data=split_4.Positive)  # -> Branch0, Branch1, Branch2, Branch3
bang_8 = ExplodeTree(Data=split_5.Positive)  # -> Branch0, Branch1, Branch2, Branch3
bang_9 = ExplodeTree(Data=split_6.Positive)  # -> Branch0, Branch1
bang_10 = ExplodeTree(Data=split_2.Positive)  # -> Branch0, Branch1, Branch2, Branch3, Branch4, Branch5, Branch6
bang_11 = ExplodeTree(Data=split_8.Positive)  # -> Branch0, Branch1
split_20 = SplitTree(Data=replace_paths, Masks=flatten("{17;?;?}"))  # -> Positive, Negative
bang_12 = ExplodeTree(Data=split_9.Positive)  # -> Branch0, Branch1, Branch2
split_21 = SplitTree(Data=replace_paths, Masks=flatten("{19;0;?}"))  # -> Positive, Negative
item_4 = ListItem(List=split_13.Positive, Index=0, Wrap=True)  # -> Item, Item1, Item2, Item3, Item4, Item5, Item6, Item7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
tree_statistics_13 = TreeStatistics(Tree=split_14.Positive)  # -> Paths, Length, Count
bang_13 = ExplodeTree(Data=split_15.Positive)  # -> Branch0, Branch1, Branch2, Branch3, Branch4, Branch5
bang_14 = ExplodeTree(Data=split_17.Positive)  # -> Branch0, Branch1, Branch2
bang_15 = ExplodeTree(Data=split_19.Positive)  # -> Branch0, Branch1, Branch2
bang_16 = ExplodeTree(Data=split_20.Positive)  # -> Branch0, Branch1, Branch2, Branch3
bang_17 = ExplodeTree(Data=split_21.Positive)  # -> Branch0, Branch1, Branch2, Branch3, Branch4
panel_18 = Panel(tree_statistics_13.Paths)
crv = Curve([<curve referenced from the Rhino model> x6])
item_5 = ListItem(List=crv, Index=type_of_sport_for_c_value_analysis, Wrap=True)
panel_19 = Panel(bang_4.Branch0)
boundary = BoundarySurfaces(Edges=item_5)

preview = CustomPreview(Geometry=boundary, Material=ColourSwatch(SwatchColor=RGB(18, 110, 0)))

offset_auditorium_outline = Curve([<curve referenced from the Rhino model> x9])
auditorium_outline_2 = Curve([<curve referenced from the Rhino model> x9])
building_outline_2 = Curve([<curve referenced from the Rhino model> x9])
merge = Merge(Data1=building_outline_2, Data2=join_3)  # -> flatten(Result)
crv_2 = Curve(<curve referenced from the Rhino model>)
item_6 = ListItem(List=offset_auditorium_outline, Index=item_4.Item1, Wrap=True)
item_7 = ListItem(List=merge, Index=item_4.Item2, Wrap=True)
item_8 = ListItem(List=auditorium_outline_2, Index=item_4.Item1, Wrap=True)
xz = XZPlane(Origin=Point(0, 0, 0))
pcx = CurvePlane(Curve=item_8, Plane=xz)  # -> Points, ParamsC, ParamsP
item_9 = ListItem(List=pcx.Points, Index=0, Wrap=True)  # -> Item, Item1
pull = PullPoint(Point=item_9.Item, Geometry=crv_2, ClosestOnly=True)  # -> ClosestPoint, Distance
Z = UnitZ(Factor="25")
Z_2 = UnitZ(Factor="25")
Z_3 = UnitZ(Factor="25")
panel_20 = Panel(bang_9.Branch1)
explode_2 = Explode(Curve=item_8, Recursive=True)  # -> Segments, Vertices
len = Length(Curve=explode_2.Segments)
division_4 = Division(A=len, B=panel_20)
int = Integer(division_4)

# ---- group: even number of sector divisions
lng = ListLength(List=int)
smaller = SmallerThan(FirstNumber=division_4, SecondNumber=Slider(4, range=0..10))  # -> SmallerThan, OrEqualTo
series_4 = Series(Start=0, Step=1, Count=lng)
dispatch_2 = Dispatch(List=series_4, DispatchPattern=smaller.SmallerThan)  # -> ListA, ListB
replace_3 = ReplaceItems(List=int, Item="4", Indices=dispatch_2.ListA, Wrap=False)
int_2 = Integer(replace_3)
division_5 = Division(A=int_2, B="2")
split_22 = TextSplit(Text=division_5, Separators=".")
item_10 = ListItem(List=split_22, Index=0, Wrap=True)
multiplication = Multiplication(A=item_10, B=2)  # -> flatten(Result)

# ----
panel_21 = Panel(item_4.Item8)
series_5 = Series(Start=0, Step=item_4.Item7, Count=panel_21)
offset = OffsetCurve(Curve=item_7, Distance=series_5, Corners=1)
item_11 = ListItem(List=flatten(offset), Index=0, Wrap=True)
explode_3 = Explode(Curve=item_11, Recursive=True)  # -> Segments, Vertices
panel_22 = Panel("""0
2
4
6""")
end_2 = EndPoints(Curve=item_8)  # -> Start, End
end_3 = EndPoints(Curve=item_7)  # -> Start, End
rev = ReverseList(List=flatten(offset))  # -> graft(List)
replace_4 = ReplaceItems(List=multiplication, Item=item_4.Item5, Indices=panel_22, Wrap=False)
divide = DivideCurve(Curve=graft(explode_3.Segments), Count=graft(replace_4), Kinks=False)  # -> Points, Tangents, Parameters
divide_2 = DivideCurve(Curve=graft(explode_2.Segments), Count=graft(replace_4), Kinks=False)  # -> Points, Tangents, Parameters
ln = Line(StartPoint=divide_2.Points, EndPoint=divide.Points)
dist = Distance(PointA=end_2.Start, PointB=end_3.Start)

# ---- group: module 4
bowl_section = BB_BowlSection(
    touchline=crv_2,
    outline=item_8,
    setDistance=pull.Distance,
    rows=bang_4.Branch3,
    stepDepths=bang_5.Branch3,
    landingDepths=bang_16.Branch3,
    floorHeights=bang_6.Branch3,
    cantilevers=bang_8.Branch3,
    cValues=bang_7.Branch3)  # -> section, sightlines, sectionInfo; inputs touchline: Curve, outline: list of Curve, rows: list of Int32, stepDepths: list, landingDepths: list, floorHeights: list, cantilevers: list, seatOffsets: list, cValues: list, stepHeights: list; plug-in component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
end_4 = EndPoints(Curve=bowl_section.sightlines)  # -> Start, End
end_5 = EndPoints(Curve=bowl_section.section)  # -> Start, End
Z_4 = UnitZ(Factor="-25")
move_2 = Move(Geometry=end_5.Start, Motion=Z_4)  # -> Geometry, Transform
ln_2 = Line(StartPoint=end_5.Start, EndPoint=move_2.Geometry)
join_4 = JoinCurves(Curves=[ln_2, bowl_section.section], Preserve=False)
pt_4 = ConstructPoint(XCoordinate=0, YCoordinate=0, ZCoordinate=bang_3.Branch0)
crv_3 = Curve(bowl_section.section)
xy = XYPlane(Origin=pt_4)
end_6 = EndPoints(Curve=bowl_section.section)  # -> Start, End
Y = UnitY(Factor="7.5")
panel_23 = Panel(bang_9.Branch0)
move_3 = Move(Geometry=crv_3, Motion=Y)  # -> Geometry, Transform
move_4 = Move(Geometry=end_4.Start, Motion=Y)  # -> Geometry, Transform
bbox = BoundingBox(Content=[crv_3, move_3.Geometry], Plane=PlaneXY(0, 0, 0), UnionBox=True)  # -> Box, Box_2
panel_24 = Panel(dist)
debrep = DeconstructBrep(Brep=bbox.Box)  # -> Faces, Edges, Vertices
division_6 = Division(A=panel_24, B=panel_23)
Z_5 = UnitZ(Factor="25")
item_12 = ListItem(List=debrep.Faces, Index=5, Wrap=True)
split_23 = TextSplit(Text=division_6, Separators=".")
move_5 = Move(Geometry=item_12, Motion=Z_5)  # -> Geometry, Transform
item_13 = ListItem(List=split_23, Index=0, Wrap=True)
ln_3 = Line(StartPoint=end_4.Start, EndPoint=move_4.Geometry)
series_6 = Series(Start=0, Step=panel_23, Count=item_13)
mesh = MeshBrep(
    Brep=move_5.Geometry,
    Settings={GridMaxCount=0, GridMinCount=16, JaggedSeams=False, MaxEdgeLength=0, MinEdgeLength=0.0001, MinTolerance=0, Refine=True, RefineAngle=0, RelativeTolerance=0.65, SimplePlanes=True, Tolerance=0})
X = UnitX(Factor=panel_24)
X_2 = UnitX(Factor=series_6)
pcx_2 = CurvePlane(Curve=join_4, Plane=xy)  # -> flatten(Points), ParamsC, ParamsP
mcol = MeshColours(Mesh=mesh, Colours=ColourSwatch(SwatchColor=RGB(0, 25, 87)))
move_6 = Move(Geometry=end_6.Start, Motion=X_2)  # -> Geometry, Transform
move_7 = Move(Geometry=end_6.Start, Motion=X)  # -> Geometry, Transform
group = Group(Objects=ln_3)
pdecon = Deconstruct(Point=move_6.Geometry)  # -> XComponent, YComponent, ZComponent
pdecon_2 = Deconstruct(Point=pcx_2.Points)  # -> XComponent, YComponent, ZComponent
ln_4 = Line(StartPoint=end_6.Start, EndPoint=move_7.Geometry)
move_8 = Move(Geometry=ln_4, Motion=Y)  # -> Geometry, Transform
larger = LargerThan(FirstNumber=graft(pdecon_2.XComponent), SecondNumber=pdecon.XComponent)  # -> LargerThan, OrEqualTo
group_2 = Group(Objects=[crv_3, move_3.Geometry])
loft = Loft(
    Curves=[ln_4, move_8.Geometry],
    Options={Adjust=False, Closed=False, LoftEnds=0, LoftSimp=0, LoftType=0, Rebuild=10, Refit=0.01})
dispatch_3 = Dispatch(List=pdecon.XComponent, DispatchPattern=larger.LargerThan)  # -> ListA, ListB
pt_5 = ConstructPoint(XCoordinate=dispatch_3.ListB, YCoordinate=0, ZCoordinate=graft(pdecon_2.ZComponent))
srf_cp = SurfaceClosestPoint(Point=end_6.Start, Surface=loft)  # -> Point, UVPoint, Distance
replace_5 = ReplaceItems(List=pt_5, Item=graft(pcx_2.Points), Indices=0, Wrap=False)
cullpt = CullDuplicates(Points=replace_5, Tolerance="1", CullMode=3)  # -> Points, Indices, Valence
pline = PolyLine(Vertices=cullpt.Points, Closed=False)
explode_4 = Explode(Curve=pline, Recursive=True)  # -> Segments, Vertices
move_9 = Move(Geometry=explode_4.Segments, Motion=Y)  # -> Geometry, Transform
weave_2 = Weave(Pattern=[0, 1], Stream0=graft(move_9.Geometry), Stream1=graft(explode_4.Segments), NullGaps=False)
loft_2 = Loft(Curves=weave_2, Options={Adjust=False, Closed=False, LoftEnds=0, LoftSimp=0, LoftType=0, Rebuild=10, Refit=0.01})
debrep_2 = DeconstructBrep(Brep=loft_2)  # -> Faces, Edges, Vertices
end_7 = EndPoints(Curve=debrep_2.Edges)  # -> Start, End
pline_2 = PolyLine(Vertices=end_7.Start, Closed=True)
join_5 = JoinCurves(Curves=pline_2, Preserve=False)
trim = TrimTree(Tree=join_5, Depth=3)
split_24 = SplitList(List=reverse(trim), Index=1)  # -> ListA, reverse(ListB)
group_3 = Group(Objects=split_24.ListB)
group_4 = Group(Objects=flatten(group_3))
entwine_30 = Entwine(Branch00=group, Branch01=group_2, Branch02=group_4, Branch03=mcol, FlattenInputs=True)
group_5 = Group(Objects=flatten(entwine_30))

# ----
addition_3 = Addition(A=dist, B="14")
panel_25 = Panel(replace_4)
series_7 = Series(Start=0, Step=bang_9.Branch0, Count=item_4.Item4)
offset_l = OffsetCurveLoose(Curve=item_6, Distance=expr("x+.1", series_7))
ccx = CurveCurve(CurveA=graft(rev), CurveB=flatten(ln))  # -> Points, ParamsA, ParamsB
ccx_2 = CurveCurve(CurveA=graft(offset_l), CurveB=flatten(ln))  # -> Points, ParamsA, ParamsB
trim_2 = TrimTree(Tree=ccx.Points, Depth=1)
trim_3 = TrimTree(Tree=ccx_2.Points, Depth=1)
cullpt_2 = CullDuplicates(Points=trim_2, Tolerance=0.1, CullMode=3)  # -> Points, Indices, Valence
cullpt_3 = CullDuplicates(Points=trim_3, Tolerance=0.1, CullMode=3)  # -> Points, Indices, Valence
pline_3 = PolyLine(Vertices=cullpt_2.Points, Closed=True)  # -> flatten(Polyline)
pline_4 = PolyLine(Vertices=cullpt_3.Points, Closed=True)
flatten = FlattenTree(Tree=pline_4, Path="{0}")
item_14 = ListItem(List=reverse(flatten), Index=0, Wrap=True)
item_15 = ListItem(List=reverse(pline_3), Index=0, Wrap=True)
item_16 = ListItem(List=pline_3, Index=bang_13.Branch5, Wrap=True)
explode_5 = Explode(Curve=item_14, Recursive=True)  # -> Segments, Vertices
explode_6 = Explode(Curve=item_15, Recursive=True)  # -> Segments, Vertices
division_7 = Division(A="1", B=item_4.Item6)
explode_7 = Explode(Curve=pline_3, Recursive=True)  # -> Segments, Vertices
explode_8 = Explode(Curve=flatten, Recursive=True)  # -> Segments, Vertices
series_8 = Series(Start=division_7, Step=division_7, Count=expr("x-1", item_4.Item6))
flip = FlipMatrix(Data=explode_7.Segments)  # -> simplify(Data)
flip_2 = FlipMatrix(Data=explode_8.Segments)  # -> simplify(Data)
tweencrv = TweenCurve(CurveA=graft(explode_5.Segments), CurveB=graft(explode_6.Segments), Factor=series_8, BlendType=0)  # -> simplify(Tween)
merge_2 = Merge(Data1=flip_2, Data2=tweencrv, Data3=flip)
loft_opt = LoftOptions(Closed=False, Adjust=False, Rebuild=0, Refit=1, Type=Slider(1, range=0..10))
loft_3 = Loft(Curves=merge_2, Options=loft_opt)  # -> flatten(Loft)
shift_2 = ShiftList(List=loft_3, Shift=-1, Wrap=True)
debrep_3 = DeconstructBrep(Brep=shift_2)  # -> Faces, Edges, Vertices
item_17 = ListItem(List=debrep_3.Vertices, Index=Slider(0, range=0..10), Wrap=True)  # -> flatten(Item)
lng_2 = ListLength(List=shift_2)
srf_cp_2 = SurfaceClosestPoint(Point=item_17, Surface=shift_2)  # -> Point, UVPoint, Distance
repeat = RepeatData(Data=bang_11.Branch0, Length=lng_2)
sift = SiftPattern(List=shift_2, SiftPattern=repeat)  # -> Output0, Output1, Output2, Output3
sift_2 = SiftPattern(List=srf_cp_2.UVPoint, SiftPattern=repeat)  # -> Output0, Output1, Output2, Output3
clean_2 = CleanTree(RemoveNulls=True, RemoveInvalid=True, RemoveEmpty=False, Tree=sift.Output0)
clean_3 = CleanTree(RemoveNulls=True, RemoveInvalid=True, RemoveEmpty=False, Tree=sift.Output1)
clean_4 = CleanTree(RemoveNulls=True, RemoveInvalid=True, RemoveEmpty=False, Tree=sift.Output2)
clean_5 = CleanTree(RemoveNulls=True, RemoveInvalid=True, RemoveEmpty=False, Tree=sift.Output3)
clean_6 = CleanTree(RemoveNulls=True, RemoveInvalid=True, RemoveEmpty=False, Tree=sift_2.Output0)
clean_7 = CleanTree(RemoveNulls=True, RemoveInvalid=True, RemoveEmpty=False, Tree=sift_2.Output1)
clean_8 = CleanTree(RemoveNulls=True, RemoveInvalid=True, RemoveEmpty=False, Tree=sift_2.Output2)
clean_9 = CleanTree(RemoveNulls=True, RemoveInvalid=True, RemoveEmpty=False, Tree=sift_2.Output3)
panel_26 = Panel(bang_2.Branch0)
panel_27 = Panel(bang_10.Branch4)
bang_18 = ExplodeTree(Data=split_18.Positive)  # -> Branch0, Branch1, Branch2, Branch3, Branch4, Branch5, Branch6, Branch7
panel_28 = Panel(bang_18.Branch7)
addition_4 = Addition(A=bang_18.Branch5, B="46")
series_9 = Series(Start="0", Step=1, Count="11")
repeat_data = RepeatData(Data=graft(series_9), Length="6")  # -> flatten(Data)
list_item_3 = ListItem(List=repeat_data, Index=panel_16, Wrap=True)

# ---- group: module 3
bowl_section_2 = BB_BowlSection(
    touchline=crv_2,
    outline=item_8,
    setDistance=pull.Distance,
    rows=bang_4.Branch2,
    stepDepths=bang_5.Branch2,
    landingDepths=bang_16.Branch2,
    floorHeights=bang_6.Branch2,
    cantilevers=bang_8.Branch2,
    cValues=bang_7.Branch2)  # -> section, sightlines, sectionInfo; inputs touchline: Curve, outline: list of Curve, rows: list of Int32, stepDepths: list, landingDepths: list, floorHeights: list, cantilevers: list, seatOffsets: list, cValues: list, stepHeights: list; plug-in component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
end_8 = EndPoints(Curve=bowl_section_2.sightlines)  # -> Start, End
end_9 = EndPoints(Curve=bowl_section_2.section)  # -> Start, End
Z_6 = UnitZ(Factor="-25")
move_10 = Move(Geometry=end_9.Start, Motion=Z_6)  # -> Geometry, Transform
ln_5 = Line(StartPoint=end_9.Start, EndPoint=move_10.Geometry)
join_6 = JoinCurves(Curves=[ln_5, bowl_section_2.section], Preserve=False)
pt_6 = ConstructPoint(XCoordinate=0, YCoordinate=0, ZCoordinate=bang_3.Branch0)
crv_4 = Curve(bowl_section_2.section)
xy_2 = XYPlane(Origin=pt_6)
end_10 = EndPoints(Curve=bowl_section_2.section)  # -> Start, End
Y_2 = UnitY(Factor="7.5")
panel_29 = Panel(bang_9.Branch0)
move_11 = Move(Geometry=crv_4, Motion=Y_2)  # -> Geometry, Transform
move_12 = Move(Geometry=end_8.Start, Motion=Y_2)  # -> Geometry, Transform
panel_30 = Panel(dist)
division_8 = Division(A=panel_30, B=panel_29)
split_25 = TextSplit(Text=division_8, Separators=".")
item_18 = ListItem(List=split_25, Index=0, Wrap=True)
ln_6 = Line(StartPoint=end_8.Start, EndPoint=move_12.Geometry)
series_10 = Series(Start=0, Step=panel_29, Count=item_18)
X_3 = UnitX(Factor=panel_30)
X_4 = UnitX(Factor=series_10)
pcx_3 = CurvePlane(Curve=join_6, Plane=xy_2)  # -> flatten(Points), ParamsC, ParamsP
move_13 = Move(Geometry=end_10.Start, Motion=X_4)  # -> Geometry, Transform
move_14 = Move(Geometry=end_10.Start, Motion=X_3)  # -> Geometry, Transform
group_6 = Group(Objects=ln_6)
pdecon_3 = Deconstruct(Point=move_13.Geometry)  # -> XComponent, YComponent, ZComponent
pdecon_4 = Deconstruct(Point=pcx_3.Points)  # -> XComponent, YComponent, ZComponent
ln_7 = Line(StartPoint=end_10.Start, EndPoint=move_14.Geometry)
move_15 = Move(Geometry=ln_7, Motion=Y_2)  # -> Geometry, Transform
larger_2 = LargerThan(FirstNumber=graft(pdecon_4.XComponent), SecondNumber=pdecon_3.XComponent)  # -> LargerThan, OrEqualTo
group_7 = Group(Objects=[crv_4, move_11.Geometry])
loft_4 = Loft(
    Curves=[ln_7, move_15.Geometry],
    Options={Adjust=False, Closed=False, LoftEnds=0, LoftSimp=0, LoftType=0, Rebuild=10, Refit=0.01})
dispatch_4 = Dispatch(List=pdecon_3.XComponent, DispatchPattern=larger_2.LargerThan)  # -> ListA, ListB
pt_7 = ConstructPoint(XCoordinate=dispatch_4.ListB, YCoordinate=0, ZCoordinate=graft(pdecon_4.ZComponent))
srf_cp_3 = SurfaceClosestPoint(Point=end_10.Start, Surface=loft_4)  # -> Point, UVPoint, Distance
replace_6 = ReplaceItems(List=pt_7, Item=graft(pcx_3.Points), Indices=0, Wrap=False)
cullpt_4 = CullDuplicates(Points=replace_6, Tolerance="1", CullMode=3)  # -> Points, Indices, Valence
pline_5 = PolyLine(Vertices=cullpt_4.Points, Closed=False)
explode_9 = Explode(Curve=pline_5, Recursive=True)  # -> Segments, Vertices
move_16 = Move(Geometry=explode_9.Segments, Motion=Y_2)  # -> Geometry, Transform
weave_3 = Weave(Pattern=[0, 1], Stream0=graft(move_16.Geometry), Stream1=graft(explode_9.Segments), NullGaps=False)
loft_5 = Loft(Curves=weave_3, Options={Adjust=False, Closed=False, LoftEnds=0, LoftSimp=0, LoftType=0, Rebuild=10, Refit=0.01})
debrep_4 = DeconstructBrep(Brep=loft_5)  # -> Faces, Edges, Vertices
end_11 = EndPoints(Curve=debrep_4.Edges)  # -> Start, End
pline_6 = PolyLine(Vertices=end_11.Start, Closed=True)
join_7 = JoinCurves(Curves=pline_6, Preserve=False)
trim_4 = TrimTree(Tree=join_7, Depth=3)
split_26 = SplitList(List=reverse(trim_4), Index=1)  # -> ListA, reverse(ListB)
group_8 = Group(Objects=split_26.ListB)
group_9 = Group(Objects=flatten(group_8))

# ----
bbox_2 = BoundingBox(Content=[crv_4, move_11.Geometry], Plane=PlaneXY(0, 0, 0), UnionBox=True)  # -> Box, Box_2
debrep_5 = DeconstructBrep(Brep=bbox_2.Box)  # -> Faces, Edges, Vertices
item_19 = ListItem(List=debrep_5.Faces, Index=5, Wrap=True)
move_17 = Move(Geometry=item_19, Motion=Z_2)  # -> Geometry, Transform
mesh_2 = MeshBrep(
    Brep=move_17.Geometry,
    Settings={GridMaxCount=0, GridMinCount=16, JaggedSeams=False, MaxEdgeLength=0, MinEdgeLength=0.0001, MinTolerance=0, Refine=True, RefineAngle=0, RelativeTolerance=0.65, SimplePlanes=True, Tolerance=0})
mcol_2 = MeshColours(Mesh=mesh_2, Colours=ColourSwatch(SwatchColor=RGB(87, 0, 0)))

# ---- group: module 3 (continued)
entwine_31 = Entwine(Branch00=group_6, Branch01=group_7, Branch02=group_9, Branch03=mcol_2, FlattenInputs=True)
group_10 = Group(Objects=flatten(entwine_31))

# ---- group: module 01
bowl_section_3 = BB_BowlSection(
    touchline=crv_2,
    outline=item_8,
    setDistance=pull.Distance,
    rows=bang_4.Branch0,
    stepDepths=bang_5.Branch0,
    landingDepths=bang_16.Branch0,
    floorHeights=bang_6.Branch0,
    cantilevers=bang_8.Branch0,
    cValues=bang_7.Branch0)  # -> section, sightlines, sectionInfo; inputs touchline: Curve, outline: list of Curve, rows: list of Int32, stepDepths: list, landingDepths: list, floorHeights: list, cantilevers: list, seatOffsets: list, cValues: list, stepHeights: list; plug-in component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
end_12 = EndPoints(Curve=bowl_section_3.sightlines)  # -> Start, End
end_13 = EndPoints(Curve=bowl_section_3.section)  # -> Start, End
Z_7 = UnitZ(Factor="-25")
move_18 = Move(Geometry=end_13.Start, Motion=Z_7)  # -> Geometry, Transform
ln_8 = Line(StartPoint=end_13.Start, EndPoint=move_18.Geometry)
join_8 = JoinCurves(Curves=[bowl_section_3.section, ln_8], Preserve=False)
pt_8 = ConstructPoint(XCoordinate=0, YCoordinate=0, ZCoordinate=bang_3.Branch0)
crv_5 = Curve(bowl_section_3.section)
xy_3 = XYPlane(Origin=pt_8)
end_14 = EndPoints(Curve=bowl_section_3.section)  # -> Start, End
Y_3 = UnitY(Factor="7.5")
panel_31 = Panel(bang_9.Branch0)
move_19 = Move(Geometry=crv_5, Motion=Y_3)  # -> Geometry, Transform
move_20 = Move(Geometry=end_12.Start, Motion=Y_3)  # -> Geometry, Transform
panel_32 = Panel(dist)
division_9 = Division(A=panel_32, B=panel_31)
split_27 = TextSplit(Text=division_9, Separators=".")
item_20 = ListItem(List=split_27, Index=0, Wrap=True)
ln_9 = Line(StartPoint=end_12.Start, EndPoint=move_20.Geometry)
series_11 = Series(Start=0, Step=panel_31, Count=item_20)
X_5 = UnitX(Factor=panel_32)
X_6 = UnitX(Factor=series_11)
pcx_4 = CurvePlane(Curve=join_8, Plane=xy_3)  # -> flatten(Points), ParamsC, ParamsP
move_21 = Move(Geometry=end_14.Start, Motion=X_6)  # -> Geometry, Transform
move_22 = Move(Geometry=end_14.Start, Motion=X_5)  # -> Geometry, Transform
group_11 = Group(Objects=ln_9)
pdecon_5 = Deconstruct(Point=move_21.Geometry)  # -> XComponent, YComponent, ZComponent
pdecon_6 = Deconstruct(Point=pcx_4.Points)  # -> XComponent, YComponent, ZComponent
larger_3 = LargerThan(FirstNumber=graft(pdecon_6.XComponent), SecondNumber=pdecon_5.XComponent)  # -> LargerThan, OrEqualTo
group_12 = Group(Objects=[crv_5, move_19.Geometry])
dispatch_5 = Dispatch(List=pdecon_5.XComponent, DispatchPattern=larger_3.LargerThan)  # -> ListA, ListB
pt_9 = ConstructPoint(XCoordinate=dispatch_5.ListB, YCoordinate=0, ZCoordinate=graft(pdecon_6.ZComponent))
replace_7 = ReplaceItems(List=pt_9, Item=graft(pcx_4.Points), Indices=0, Wrap=False)
cullpt_5 = CullDuplicates(Points=replace_7, Tolerance="1", CullMode=3)  # -> Points, Indices, Valence
pline_7 = PolyLine(Vertices=cullpt_5.Points, Closed=False)
explode_10 = Explode(Curve=pline_7, Recursive=True)  # -> Segments, Vertices
move_23 = Move(Geometry=explode_10.Segments, Motion=Y_3)  # -> Geometry, Transform
weave_4 = Weave(Pattern=[0, 1], Stream0=graft(move_23.Geometry), Stream1=graft(explode_10.Segments), NullGaps=False)
loft_6 = Loft(Curves=weave_4, Options={Adjust=False, Closed=False, LoftEnds=0, LoftSimp=0, LoftType=0, Rebuild=10, Refit=0.01})
debrep_6 = DeconstructBrep(Brep=loft_6)  # -> Faces, Edges, Vertices
end_15 = EndPoints(Curve=debrep_6.Edges)  # -> Start, End
pline_8 = PolyLine(Vertices=end_15.Start, Closed=True)
join_9 = JoinCurves(Curves=pline_8, Preserve=False)
ln_10 = Line(StartPoint=end_14.Start, EndPoint=move_22.Geometry)
trim_5 = TrimTree(Tree=join_9, Depth=3)
move_24 = Move(Geometry=ln_10, Motion=Y_3)  # -> Geometry, Transform
end_16 = EndPoints(Curve=move_24.Geometry)  # -> Start, End
end_17 = EndPoints(Curve=ln_10)  # -> Start, End
lng_3 = ListLength(List=trim_5)
split_28 = SplitList(List=reverse(trim_5), Index=1)  # -> ListA, reverse(ListB)
ln_11 = Line(StartPoint=end_16.Start, EndPoint=end_17.Start)
ln_12 = Line(StartPoint=end_16.End, EndPoint=end_17.End)
item_21 = ListItem(List=flatten(lng_3), Index=0, Wrap=True)
division_10 = Division(A="1", B=item_21)
series_12 = Series(Start=0, Step=division_10, Count=item_21)
tweencrv_2 = TweenCurve(CurveA=ln_11, CurveB=ln_12, Factor=series_12, BlendType=0)
group_13 = Group(Objects=split_28.ListB)
merge_3 = Merge(Data1=tweencrv_2, Data2=ln_12)
group_14 = Group(Objects=flatten(group_13))
loft_7 = Loft(
    Curves=flatten(merge_3),
    Options={Adjust=False, Closed=False, LoftEnds=0, LoftSimp=0, LoftType=1, Rebuild=10, Refit=0.01})
debrep_7 = DeconstructBrep(Brep=loft_7)  # -> Faces, Edges, Vertices
item_22 = ListItem(List=debrep_7.Vertices, Index=3, Wrap=True)
srf_cp_4 = SurfaceClosestPoint(Point=item_22, Surface=loft_7)  # -> Point, UVPoint, Distance

# ----
bbox_3 = BoundingBox(Content=[crv_5, move_19.Geometry], Plane=PlaneXY(0, 0, 0), UnionBox=True)  # -> Box, Box_2
debrep_8 = DeconstructBrep(Brep=bbox_3.Box)  # -> Faces, Edges, Vertices
item_23 = ListItem(List=debrep_8.Faces, Index=5, Wrap=True)
move_25 = Move(Geometry=item_23, Motion=Z)  # -> Geometry, Transform
mesh_3 = MeshBrep(
    Brep=move_25.Geometry,
    Settings={GridMaxCount=0, GridMinCount=16, JaggedSeams=False, MaxEdgeLength=0, MinEdgeLength=0.0001, MinTolerance=0, Refine=True, RefineAngle=0, RelativeTolerance=0.65, SimplePlanes=True, Tolerance=0})
mcol_3 = MeshColours(Mesh=mesh_3, Colours=ColourSwatch(SwatchColor=RGB(255, 132, 0)))

# ---- group: module 01 (continued)
entwine_32 = Entwine(Branch00=group_11, Branch01=group_12, Branch02=group_14, Branch03=mcol_3, FlattenInputs=True)
group_15 = Group(Objects=flatten(entwine_32))

# ----
sporph = Sporph(G=group_15, S0=loft_7, P0=srf_cp_4.UVPoint, S1=clean_2, P1=clean_6, R=False)
sporph_2 = Sporph(G=group_10, S0=loft_7, P0=srf_cp_4.UVPoint, S1=clean_4, P1=clean_8, R=False)
sporph_3 = Sporph(G=group_5, S0=loft_7, P0=srf_cp_4.UVPoint, S1=clean_5, P1=clean_9, R=False)

# ---- group: module 2
bowl_section_4 = BB_BowlSection(
    touchline=crv_2,
    outline=item_8,
    setDistance=pull.Distance,
    rows=bang_4.Branch1,
    stepDepths=bang_5.Branch1,
    landingDepths=bang_16.Branch1,
    floorHeights=bang_6.Branch1,
    cantilevers=bang_8.Branch1,
    cValues=bang_7.Branch1)  # -> section, sightlines, sectionInfo; inputs touchline: Curve, outline: list of Curve, rows: list of Int32, stepDepths: list, landingDepths: list, floorHeights: list, cantilevers: list, seatOffsets: list, cValues: list, stepHeights: list; plug-in component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
end_18 = EndPoints(Curve=bowl_section_4.sightlines)  # -> Start, End
end_19 = EndPoints(Curve=bowl_section_4.section)  # -> Start, End
Z_8 = UnitZ(Factor="-25")
move_26 = Move(Geometry=end_19.Start, Motion=Z_8)  # -> Geometry, Transform
ln_13 = Line(StartPoint=end_19.Start, EndPoint=move_26.Geometry)
join_10 = JoinCurves(Curves=[ln_13, bowl_section_4.section], Preserve=False)
pt_10 = ConstructPoint(XCoordinate=0, YCoordinate=0, ZCoordinate=bang_3.Branch0)
crv_6 = Curve(bowl_section_4.section)
xy_4 = XYPlane(Origin=pt_10)
end_20 = EndPoints(Curve=bowl_section_4.section)  # -> Start, End
Y_4 = UnitY(Factor="7.5")
panel_33 = Panel(bang_9.Branch0)
move_27 = Move(Geometry=crv_6, Motion=Y_4)  # -> Geometry, Transform
move_28 = Move(Geometry=end_18.Start, Motion=Y_4)  # -> Geometry, Transform
panel_34 = Panel(dist)
division_11 = Division(A=panel_34, B=panel_33)
split_29 = TextSplit(Text=division_11, Separators=".")
item_24 = ListItem(List=split_29, Index=0, Wrap=True)
ln_14 = Line(StartPoint=end_18.Start, EndPoint=move_28.Geometry)
series_13 = Series(Start=0, Step=panel_33, Count=item_24)
X_7 = UnitX(Factor=panel_34)
X_8 = UnitX(Factor=series_13)
pcx_5 = CurvePlane(Curve=join_10, Plane=xy_4)  # -> flatten(Points), ParamsC, ParamsP
move_29 = Move(Geometry=end_20.Start, Motion=X_8)  # -> Geometry, Transform
move_30 = Move(Geometry=end_20.Start, Motion=X_7)  # -> Geometry, Transform
group_16 = Group(Objects=ln_14)
pdecon_7 = Deconstruct(Point=move_29.Geometry)  # -> XComponent, YComponent, ZComponent
pdecon_8 = Deconstruct(Point=pcx_5.Points)  # -> XComponent, YComponent, ZComponent
ln_15 = Line(StartPoint=end_20.Start, EndPoint=move_30.Geometry)
move_31 = Move(Geometry=ln_15, Motion=Y_4)  # -> Geometry, Transform
larger_4 = LargerThan(FirstNumber=graft(pdecon_8.XComponent), SecondNumber=pdecon_7.XComponent)  # -> LargerThan, OrEqualTo
group_17 = Group(Objects=[crv_6, move_27.Geometry])
loft_8 = Loft(
    Curves=[ln_15, move_31.Geometry],
    Options={Adjust=False, Closed=False, LoftEnds=0, LoftSimp=0, LoftType=0, Rebuild=10, Refit=0.01})
dispatch_6 = Dispatch(List=pdecon_7.XComponent, DispatchPattern=larger_4.LargerThan)  # -> ListA, ListB
pt_11 = ConstructPoint(XCoordinate=dispatch_6.ListB, YCoordinate=0, ZCoordinate=graft(pdecon_8.ZComponent))
srf_cp_5 = SurfaceClosestPoint(Point=end_20.Start, Surface=loft_8)  # -> Point, UVPoint, Distance
replace_8 = ReplaceItems(List=pt_11, Item=graft(pcx_5.Points), Indices=0, Wrap=False)
cullpt_6 = CullDuplicates(Points=replace_8, Tolerance="1", CullMode=3)  # -> Points, Indices, Valence
pline_9 = PolyLine(Vertices=cullpt_6.Points, Closed=False)
explode_11 = Explode(Curve=pline_9, Recursive=True)  # -> Segments, Vertices
move_32 = Move(Geometry=explode_11.Segments, Motion=Y_4)  # -> Geometry, Transform
weave_5 = Weave(Pattern=[0, 1], Stream0=graft(move_32.Geometry), Stream1=graft(explode_11.Segments), NullGaps=False)
loft_9 = Loft(Curves=weave_5, Options={Adjust=False, Closed=False, LoftEnds=0, LoftSimp=0, LoftType=0, Rebuild=10, Refit=0.01})
debrep_9 = DeconstructBrep(Brep=loft_9)  # -> Faces, Edges, Vertices
end_21 = EndPoints(Curve=debrep_9.Edges)  # -> Start, End
pline_10 = PolyLine(Vertices=end_21.Start, Closed=True)
join_11 = JoinCurves(Curves=pline_10, Preserve=False)
trim_6 = TrimTree(Tree=join_11, Depth=3)
split_30 = SplitList(List=reverse(trim_6), Index=1)  # -> ListA, reverse(ListB)
group_18 = Group(Objects=split_30.ListB)
group_19 = Group(Objects=flatten(group_18))

# ----
bbox_4 = BoundingBox(Content=[crv_6, move_27.Geometry], Plane=PlaneXY(0, 0, 0), UnionBox=True)  # -> Box, Box_2
debrep_10 = DeconstructBrep(Brep=bbox_4.Box)  # -> Faces, Edges, Vertices
item_25 = ListItem(List=debrep_10.Faces, Index=5, Wrap=True)
move_33 = Move(Geometry=item_25, Motion=Z_3)  # -> Geometry, Transform
mesh_4 = MeshBrep(
    Brep=move_33.Geometry,
    Settings={GridMaxCount=0, GridMinCount=16, JaggedSeams=False, MaxEdgeLength=0, MinEdgeLength=0.0001, MinTolerance=0, Refine=True, RefineAngle=0, RelativeTolerance=0.65, SimplePlanes=True, Tolerance=0})
mcol_4 = MeshColours(Mesh=mesh_4, Colours=ColourSwatch(SwatchColor=RGB(43, 87, 0)))

# ---- group: module 2 (continued)
entwine_33 = Entwine(Branch00=group_16, Branch01=group_17, Branch02=group_19, Branch03=mcol_4, FlattenInputs=True)
group_20 = Group(Objects=flatten(entwine_33))

# ----
sporph_4 = Sporph(G=group_20, S0=loft_7, P0=srf_cp_4.UVPoint, S1=clean_3, P1=clean_7, R=False)
weave_6 = Weave(Pattern=repeat, Stream0=sporph, Stream1=sporph_4, Stream2=sporph_2, Stream3=sporph_3, NullGaps=False)
ungroup = Ungroup(Group=flatten(weave_6))
item_26 = ListItem(List=ungroup, Index="2", Wrap=True)
ungroup_2 = Ungroup(Group=item_26)
ungroup_3 = Ungroup(Group=ungroup_2)
panel_35 = Panel(ungroup_3)
trim_7 = TrimTree(Tree=ungroup_3, Depth=1)
tstat = TreeStatistics(Tree=trim_7)  # -> Paths, Length, Count
lng_4 = ListLength(List=tstat.Paths)
series_14 = Series(Start=0, Step=1, Count=lng_4)

# ---- group: floor split
rep = ReplaceText(Text="{0;A;0;?}", Find="A", Replace=series_14, RecursiveReplace=False)
split_31 = SplitTree(Data=ungroup_3, Masks=flatten(rep))  # -> Positive, Negative
cp = ControlPoints(Curve=split_31.Positive)  # -> Points, Weights, Knots
panel_36 = Panel("""0
1
3
2""")
item_27 = ListItem(List=cp.Points, Index=panel_36, Wrap=True)
frompoints = MeshFromPoints(Points=item_27, UDirection="2", VDirection="2")
trim_8 = TrimTree(Tree=frompoints, Depth=1)
split_32 = SplitTree(Data=trim_8, Masks=flatten("{0;?;0;0}"))  # -> Positive, Negative
split_33 = SplitTree(Data=trim_8, Masks=flatten("{0;?;0;1}"))  # -> Positive, Negative
split_34 = SplitTree(Data=trim_8, Masks=flatten("{0;?;0;2}"))  # -> Positive, Negative
split_35 = SplitTree(Data=trim_8, Masks=flatten("{0;?;0;3}"))  # -> Positive, Negative
split_36 = SplitTree(Data=trim_8, Masks=flatten("{0;?;0;4}"))  # -> Positive, Negative
split_37 = SplitTree(Data=trim_8, Masks=flatten("{0;?;0;5}"))  # -> Positive, Negative
split_38 = SplitTree(Data=trim_8, Masks=flatten("{0;?;0;6}"))  # -> Positive, Negative
split_39 = SplitTree(Data=trim_8, Masks=flatten("{0;?;0;7}"))  # -> Positive, Negative
flip_3 = FlipMatrix(Data=split_32.Positive)
flip_4 = FlipMatrix(Data=split_33.Positive)
flip_5 = FlipMatrix(Data=split_34.Positive)
flip_6 = FlipMatrix(Data=split_35.Positive)
flip_7 = FlipMatrix(Data=split_36.Positive)
flip_8 = FlipMatrix(Data=split_37.Positive)
flip_9 = FlipMatrix(Data=split_38.Positive)
flip_10 = FlipMatrix(Data=split_39.Positive)
entwine_34 = Entwine(
    Branch0X=flip_3,
    Branch1X=flip_4,
    Branch2X=flip_5,
    Branch3X=flip_6,
    Branch4X=flip_7,
    Branch5X=flip_8,
    Branch6X=flip_9,
    Branch7X=flip_10,
    FlattenInputs=False)
trim_9 = TrimTree(Tree=simplify(entwine_34), Depth=1)

# ----
panel_37 = Panel(trim_9)
item_28 = ListItem(List=ungroup, Index="0", Wrap=True)  # -> flatten(Item)
lng_5 = ListLength(List=item_28)
larger_5 = LargerThan(FirstNumber=bang_18.Branch3, SecondNumber=expr("x-1", lng_5))  # -> LargerThan, OrEqualTo
larger_6 = LargerThan(FirstNumber=bang_18.Branch7, SecondNumber=expr("x-2", lng_5))  # -> LargerThan, OrEqualTo
dispatch_7 = Dispatch(List=bang_18.Branch3, DispatchPattern=larger_5.LargerThan)  # -> ListA, ListB
dispatch_8 = Dispatch(List=bang_18.Branch7, DispatchPattern=larger_6.LargerThan)  # -> ListA, ListB
larger_7 = LargerThan(FirstNumber=bang_12.Branch0, SecondNumber=expr("x-2", lng_5))  # -> LargerThan, OrEqualTo
dispatch_9 = Dispatch(List=flatten(bang_12.Branch0), DispatchPattern=flatten(larger_7.OrEqualTo))  # -> ListA, ListB

# ---- group: tunnels
panel_38 = Panel(bang_2.Branch1)

# ---- group: bowl
item_29 = ListItem(List=ungroup, Index="1", Wrap=True)
panel_39 = Panel(split_16.Positive)
crv_7 = Curve(<curve referenced from the Rhino model>)
fillet_2 = Fillet(Curve=crv_7, Radius="30")
offset_2 = OffsetCurve(Curve=fillet_2, Distance=panel_39, Corners=1)
Z_9 = UnitZ(Factor="150")
move_34 = Move(Geometry=offset_2, Motion=Z_9)  # -> Geometry, Transform
loft_10 = Loft(
    Curves=[move_34.Geometry, offset_2],
    Options={Adjust=False, Closed=False, LoftEnds=0, LoftSimp=0, LoftType=0, Rebuild=10, Refit=0.01})
material = CreateMaterial(
    Diffuse=ColourSwatch(SwatchColor=RGB(255, 255, 255)),
    Specular=RGB(255, 255, 255),
    Emission=RGB(0, 0, 0),
    Transparency=0,
    Shine=0)

# ---- group: tunnels (continued)
lng_6 = ListLength(List=flatten(item_29))
series_15 = Series(Start=0, Step=1, Count=lng_6)
dispatch_10 = Dispatch(List=flatten(item_29), DispatchPattern=panel_38)  # -> ListA, ListB
dispatch_11 = Dispatch(List=flatten(series_15), DispatchPattern=panel_38)  # -> ListA, ListB
ungroup_4 = Ungroup(Group=dispatch_10.ListB)

# ----
explode_12 = Explode(Curve=graft(ungroup_4), Recursive=True)  # -> Segments, Vertices
split_40 = SplitList(List=explode_12.Vertices, Index=expr("x*2", flatten(bang_2.Branch0)))  # -> ListA, ListB
pline_11 = PolyLine(Vertices=split_40.ListB, Closed=False)

# ---- group: tunnels (continued)
trim_10 = TrimTree(Tree=pline_11, Depth=3)
group_21 = Group(Objects=trim_10)
replace_9 = ReplaceItems(List=flatten(item_29), Item=flatten(group_21), Indices=dispatch_11.ListB, Wrap=True)  # -> graft(List)

# ---- group: bowl (continued)
ungroup_5 = Ungroup(Group=replace_9)
mloft = PythonicMeshLoftPlus(P=ungroup_5, C="0", A="0", E="0")  # -> L; inputs P: list of Polyline, C: Boolean, A: Boolean, E: Int32
# ---------- mloft: Python ----------
"""Create a lofted mesh through a set of section polylines.
    Inputs:
        P: Section polylines
        C: Closed loft
        A: Align section poylines
        E: End caps (0 = none, 1 = flat)
    Output:
        L: Resulting mesh loft"""

__author__ = "p1r4t3b0y"
__email__ = "p1r4t3b0y@gmail.com"
__version__ = "1.1.0"

ghenv.Component.Name = "Pythonic Mesh Loft Plus"
ghenv.Component.NickName = "MLoft+"
ghenv.Component.Category = "Mesh"
ghenv.Component.SubCategory = "Primitive"

import Rhino.Geometry as rg
import scriptcontext as sc
import Grasshopper as gh
import math


class MeshLoft:
    """Creates a lofted mesh through a set of section polylines.
    
    Attributes:
        polylines: A list of valid, closed or open polylines.
        close_loft: Optional, if True the loft will be closed.
        cap_loft: Optional, if True the loft will be capped.
    
    To use:
        >>> ml = MeshLoft(polylines)
        >>> loft = ml.mesh
    """
    def __init__(self, polylines, close_loft=None, cap_loft=None):
        """Inits this mesh loft."""
        self.polylines = polylines
        self.close_loft = close_loft
        self.cap_loft = cap_loft
        self.vertices = self.get_vertices()
        self.faces = self.construct_faces()
        self.mesh = self.construct_mesh()
        
        
    def get_vertices(self):
        """Gets the vertices for each polyline in self.polylines.
        
        Returns:
          The new nested list of vertices per polyline."""
        pline_vertices = []
        for pline in self.polylines:
            vertices = []
            for i in range(len(pline)):
                vertices.append(pline[i])
            pline_vertices.append(vertices)
        return pline_vertices
    
    
    def index_vertices(self):
        """Indexes the vertices of each polyline with integer numbers,
            that are necessary to later assign the vertices to mesh faces.
        
        Returns:
          The nested list of vertex indices (e.g. [[0,1,2], [3,4,5], ..])."""
        vtx_indices = [] 
        for i in range(len(self.vertices)):
            indices = []
            for j in range(len(self.vertices[i])):
                indices.append(i * len(self.vertices[i]) + j)
            vtx_indices.append(indices)
        return vtx_indices
    
    
    def construct_faces(self):
        """Constructs quad faces between all adjacent polyline pairs.       
        
        Returns:
          The nested list of face tuples (e.g. [(0,1,7,6), ...])."""
        vtx_indices = self.index_vertices()
        faces = []
        for i in range(len(vtx_indices)):
            if i < len(vtx_indices) - 1: 
                # Loop the polyline vertex indices up to the last curve
                for j in range(len(vtx_indices[i])-1): # vertices
                    v1 = j + (i * len(vtx_indices[i]))
                    v2 = j + (i * len(vtx_indices[i])) + 1
                    v3 = j + ((i + 1) * len(vtx_indices[i])) + 1
                    v4 = j + ((i + 1) * len(vtx_indices[i]))
                    faces.append((v1, v2, v3, v4))
            else:
                # Loop the polyline vertex indices of the last curve
                if self.close_loft:
                    for j in range(len(vtx_indices[i])-1): # vertices
                        v1 = j + (i * len(vtx_indices[i]))
                        v2 = j + (i * len(vtx_indices[i])) + 1
                        v3 = j + 1
                        v4 = j
                        faces.append((v1, v2, v3, v4))
        return faces
    
    
    def construct_mesh(self, angle_tolerance=-1):
        """Constructs a lofted mesh from self.vertices and self.faces
            and adds caps to it, if necessary.
        
        Args:
          angle_tol: An optional angle tolerance for vertex welding.
        
        Returns:
          The new mesh loft."""
        if angle_tolerance == None or angle_tolerance <= 0:
            angle_tol = sc.doc.ModelAngleToleranceRadians
        
        mesh = rg.Mesh()

        # Add the mesh loft vertices
        for pline_vertices in self.vertices:
            for vertex in pline_vertices:
                mesh.Vertices.Add(vertex)
        # Add the mesh loft faces
        for face in self.faces:
            v0, v1, v2, v3 = face
            mesh.Faces.AddFace(v0, v1, v2, v3)
        # Add the mesh caps
        if self.cap_loft != None and self.cap_loft > 0:
            end_curves = [self.polylines[0], self.polylines[-1]]
            if self.cap_loft == 1: # flat cap
                mesh_caps = [self.construct_flat_cap(c) for c in end_curves]
            cap_fails = 0    
            for cap in mesh_caps:
                if cap != None:
                    mesh.Append(cap)
                    mesh.Weld(angle_tolerance)
                    mesh.Vertices.CombineIdentical(False, False)
                else:
                    cap_fails += 1
            if cap_fails == len(end_curves):
                err = "Both caps failed."
                ghenv.Component.AddRuntimeMessage(\
                    gh.Kernel.GH_RuntimeMessageLevel.Error, err)
            if cap_fails == len(end_curves) - 1:
                err = "One cap failed."
                ghenv.Component.AddRuntimeMessage(\
                    gh.Kernel.GH_RuntimeMessageLevel.Error, err)
        # Compute the normals and compact the mesh
        mesh.Normals.ComputeNormals()
        mesh.Compact()
        return mesh
    
    
    def construct_flat_cap(self, edge, tolerance=None):
        """Constructs a flat mesh cap for a closed, naked mesh edge.
        
        Edge polylines with a count of 4 or 5 vertices produce single,
        triangular or quad faces. A count of more than 5 edge vertices
        results in a triangulated mesh. If these edge vertices share a
        center vertex contained inside the naked edge, the face count
        equals the number of edge segments, and the faces are radially
        oriented around this center vertex. If the center vertex lies 
        outside the closed mesh edge, the triangulated mesh is produced
        from the edge polyline itself.
        
        Args:
            edge: A polyline representing a closed, naked mesh edge.
            tolerance: An optional tolerance for planar projection.
        
        Returns:
            The new mesh cap on success, or None."""
        if tolerance == None or tolerance <= 0:
            tolerance = sc.doc.ModelAbsoluteTolerance
        
        mesh_cap = rg.Mesh()
        # Test for planarity of the mesh edge polyline
        pcurve = rg.PolylineCurve(edge)
        is_planar, plane = pcurve.TryGetPlane()
        if not is_planar:
            # Construct a planar test edge from the non-planar one
            rc, plane = rg.Plane.FitPlaneToPoints(edge)
            proj_pts = [plane.ClosestPoint(pt) for pt in edge]
            pcurve = rg.PolylineCurve(proj_pts)
        # Find the center vertex of the naked mesh edge
        center_vtx = edge.CenterPoint()
        # Test for center vertex mesh edge containment
        rc = pcurve.Contains(center_vtx, plane, tolerance)
        if rc == rg.PointContainment.Outside \
            or rc == rg.PointContainment.Coincident:
            # Mesh cap corresponds to a triangulated polyline
            mesh_cap = rg.Mesh.CreateFromClosedPolyline(edge)
        if rc == rg.PointContainment.Inside:
            if edge.Count - 1 == 3:
                # Mesh cap is composed of a single tri face
                for i in range(edge.Count - 1):
                    mesh_cap.Vertices.Add(edge[i])
                mesh_cap.Faces.AddFace(0, 1, 2) 
            if edge.Count - 1 == 4:
                # Mesh cap is composed of a single quad face
                for i in range(edge.Count - 1):
                    mesh_cap.Vertices.Add(edge[i])
                mesh_cap.Faces.AddFace(0, 1, 2, 3)
            if edge.Count > 5:
                # Mesh cap is radially triangulated around the center vertex
                for i in range(edge.Count):
                    mesh_cap.Vertices.Add(edge[i])
                mesh_cap.Vertices.Add(center_vtx)
                for i in range(edge.Count - 1):
                    v0 = i
                    v1 = i + 1
                    v2 = edge.Count
                    v3 = i
                    mesh_cap.Faces.AddFace(v0, v1, v2, v3)
        if rc == rg.PointContainment.Unset:
            err = "Open polylines can't produce capped mesh lofts."
            ghenv.Component.AddRuntimeMessage(\
                gh.Kernel.GH_RuntimeMessageLevel.Warning, err)
            return
        # Compute the normals and compact the mesh
        mesh_cap.Normals.ComputeNormals()
        mesh_cap.Compact()
        return mesh_cap


###############################################################################  


def align_polylines(polylines, guide_idx=None):
    """Aligns closed polylines so that their start/end vertices fall inline.
        If the optional guide index is not defined, the polylines align to 
        the start/end vertex of the first polyline. 
    
    Args:
      polylines: A list of closed polylines.
      guide_idx: An optional guide index for the polylines to align to.
    
    Returns:
      The list of aligned polylines on success, or the unaltered polylines."""
    if any([True for p in polylines if not p.IsClosed]):
        err = "Open polylines can't be aligned."
        ghenv.Component.AddRuntimeMessage(\
            gh.Kernel.GH_RuntimeMessageLevel.Warning, err)
        return polylines
    
    if guide_idx == None or guide_idx < 0:
        guide_idx = 0
    elif guide_idx > len(polylines[0]):
        guide_idx = 0
    
    aligned_polylines = [polylines[guide_idx]]
    for i in range(1, len(polylines)):
        # Get the guide vertex of the previous polyline
        guide_vtx = polylines[i-1][guide_idx]
        # Get the closest index of a vertex of the current polyline
        closest_idx = polylines[i].ClosestIndex(guide_vtx) # -1 on error
        if closest_idx < 0:
            return
        # Get a list of indices of the current polyline
        indices = range(len(polylines[i])-1)
        # Restructure the polyline indices to align them
        align_indices = indices[closest_idx:] + indices[:closest_idx]
        align_vertices = [polylines[i][j] for j in align_indices]
        align_vertices.append(align_vertices[0])
        aligned_polylines.append(rg.Polyline(align_vertices))
        # Update the guide index
        guide_idx = closest_idx
    return aligned_polylines


###############################################################################   


if __name__ == "__main__":
    if len(P) == 0:
        err = "Input parameter P failed to collect data"
        ghenv.Component.AddRuntimeMessage(\
            gh.Kernel.GH_RuntimeMessageLevel.Warning, err)
    
    if C == None: # closed loft
        C = False
    
    if E == None or E < 0 or E > 1: # capped loft
        E = 0
    
    if E and C:
        err = "Input parameter C (%s) and E (%s) don't work together." \
            %("Closed Loft", "End Caps")
        ghenv.Component.AddRuntimeMessage(\
            gh.Kernel.GH_RuntimeMessageLevel.Warning, err)
        C = False
        E = 0
    
    if A: # align sections
        if C and any([True for pline in P if pline.IsClosed]):
            err = "Aligning sections may produce weird results" + \
                " for closed, radial mesh lofts."
            ghenv.Component.AddRuntimeMessage(\
                gh.Kernel.GH_RuntimeMessageLevel.Remark, err)
        P = align_polylines(P)
    
    if len(P) > 1 and all([pline.IsValid for pline in P]):
        # Initialise this mesh loft
        ml = MeshLoft(P, C, E)
        # Outputs
        L = ml.mesh
    else:
        err = "Input parameter P data includes one or more invalid polylines"
        ghenv.Component.AddRuntimeMessage(\
            gh.Kernel.GH_RuntimeMessageLevel.Warning, err)
# ---------- end mloft ----------
msplit = MeshSplit(Mesh=mloft, Splitters=loft_10)
item_30 = ListItem(List=msplit, Index=0, Wrap=True)
preview_2 = CustomPreview(Geometry=item_30, Material=material)

# ----
panel_40 = Panel(ungroup_5)

# ---- group: assign function
split_41 = TextSplit(Text=split_14.Positive, Separators=".")
item_31 = ListItem(List=split_41, Index=0, Wrap=True)
trim_11 = TrimTree(Tree=item_31, Depth=1)
simplify = SimplifyTree(Tree=trim_11, Front=False)
simplify_2 = SimplifyTree(Tree=split_14.Positive, Front=False)
tstat_2 = TreeStatistics(Tree=simplify(trim_9))  # -> Paths, Length, Count
tstat_3 = TreeStatistics(Tree=simplify(trim_9))  # -> Paths, Length, Count
split_42 = SplitTree(Data=simplify_2, Masks=flatten(tstat_2.Paths))  # -> Positive, Negative
split_43 = SplitTree(Data=simplify, Masks=flatten(tstat_3.Paths))  # -> Positive, Negative
split_44 = TextSplit(Text=split_42.Positive, Separators=".")
lng_7 = ListLength(List=trim_9)
item_32 = ListItem(List=split_44, Index=expr("1", 0), Wrap=False)
trim_12 = TrimTree(Tree=item_32, Depth=1)
repeat_2 = RepeatData(Data=split_43.Positive, Length=lng_7)
repeat_3 = RepeatData(Data=trim_12, Length=lng_7)
larger_8 = LargerThan(FirstNumber=repeat_3, SecondNumber="1")  # -> LargerThan, OrEqualTo
dispatch_12 = Dispatch(List=trim_9, DispatchPattern=larger_8.OrEqualTo)  # -> flatten(ListA), ListB
lng_8 = ListLength(List=flatten(trim_9))
nullrep = ReplaceNulls(Items=larger_8.OrEqualTo, Replacements="0")  # -> Items, Count
series_16 = Series(Start=0, Step=1, Count=lng_8)
medges = MeshEdges(Mesh=dispatch_12.ListA)  # -> NakedEdges, InteriorEdges, NonManifoldEdges
dispatch_13 = Dispatch(List=series_16, DispatchPattern=flatten(nullrep.Items))  # -> ListA, ListB
curvepoint_2 = PointOnCurve(medges.NakedEdges, parameter=0.5)
end_22 = EndPoints(Curve=medges.NakedEdges)  # -> Start, End
item_33 = ListItem(List=curvepoint_2, Index=0, Wrap=True)  # -> Item, Item1, Item2, Item3
item_34 = ListItem(List=end_22.Start, Index=0, Wrap=True)  # -> Item, Item1, Item2, Item3
item_35 = ListItem(List=end_22.End, Index=0, Wrap=True)  # -> Item, Item1, Item2, Item3
weave_7 = Weave(
    Pattern=[0, 1, 2, 3],
    Stream0=item_34.Item,
    Stream1=item_33.Item1,
    Stream2=item_33.Item2,
    Stream3=item_34.Item2,
    NullGaps=False)
weave_8 = Weave(
    Pattern=[0, 1, 2, 3],
    Stream0=item_35.Item1,
    Stream1=item_33.Item1,
    Stream2=item_33.Item2,
    Stream3=item_35.Item2,
    NullGaps=False)
weave_9 = Weave(
    Pattern=[0, 1, 2, 3],
    Stream0=item_34.Item1,
    Stream1=item_33.Item,
    Stream2=item_33.Item3,
    Stream3=item_34.Item3,
    NullGaps=False)
weave_10 = Weave(
    Pattern=[0, 1, 2, 3],
    Stream0=item_35.Item,
    Stream1=item_33.Item,
    Stream2=item_33.Item3,
    Stream3=item_35.Item3,
    NullGaps=False)
pline_12 = PolyLine(Vertices=weave_7, Closed=True)
pline_13 = PolyLine(Vertices=weave_10, Closed=True)
pline_14 = PolyLine(Vertices=weave_9, Closed=True)
pline_15 = PolyLine(Vertices=weave_8, Closed=True)
weave_11 = Weave(Pattern=[0, 1, 2, 3], Stream0=pline_12, Stream1=pline_15, Stream2=pline_14, Stream3=pline_13, NullGaps=False)
panel_41 = Panel(repeat_3)
cp_2 = ControlPoints(Curve=weave_11)  # -> Points, Weights, Knots
panel_42 = Panel("""0
1
3
2""")
item_36 = ListItem(List=cp_2.Points, Index=panel_42, Wrap=True)
flatten_2 = FlattenTree(Tree=panel_41, Path="{0}")
clean_10 = CleanTree(RemoveNulls=True, RemoveInvalid=True, RemoveEmpty=False, Tree=flatten_2)
frompoints_2 = MeshFromPoints(Points=item_36, UDirection="2", VDirection="2")
subtraction_3 = Subtraction(A=clean_10, B=1)
trim_13 = TrimTree(Tree=frompoints_2, Depth=1)
item_37 = ListItem(List=trim_13, Index=graft(subtraction_3), Wrap=False)
panel_43 = Panel(clean_10)
replace_10 = ReplaceItems(List=flatten(trim_9), Item=flatten(item_37), Indices=dispatch_13.ListA, Wrap=False)
panel_44 = Panel(replace_10)
rep_2 = ReplaceText(Text=subtraction_3, Find="0", Replace="a", RecursiveReplace=False)
rep_3 = ReplaceText(Text=rep_2, Find="1", Replace="0", RecursiveReplace=False)
partition = PartitionList(List=replace_10, Size=flatten(lng_7))
rep_4 = ReplaceText(Text=rep_3, Find="a", Replace="1", RecursiveReplace=False)
rep_5 = ReplaceText(Text=rep_4, Find="2", Replace="a", RecursiveReplace=False)
rep_6 = ReplaceText(Text=rep_5, Find="3", Replace="2", RecursiveReplace=False)
rep_7 = ReplaceText(Text=rep_6, Find="a", Replace="3", RecursiveReplace=False)
item_38 = ListItem(List=weave_11, Index=graft(rep_7), Wrap=True)
cp_3 = ControlPoints(Curve=item_38)  # -> Points, Weights, Knots
item_39 = ListItem(List=cp_3.Points, Index=0, Wrap=True)  # -> Item, Item1, Item2, Item3
weave_12 = Weave(
    Pattern=[0, 1, 2, 3],
    Stream0=item_39.Item,
    Stream1=item_39.Item1,
    Stream2=item_39.Item3,
    Stream3=item_39.Item2,
    NullGaps=False)
panel_45 = Panel(item_38)
frompoints_3 = MeshFromPoints(Points=weave_12, UDirection="2", VDirection="2")

# ---- group: gangways
dom = ConstructDomain(DomainStart=bang_18.Branch0, DomainEnd=bang_18.Branch1)
item_40 = ListItem(List=item_28, Index=dispatch_7.ListB, Wrap=True)
subtraction_4 = Subtraction(A=bang_18.Branch1, B=bang_18.Branch0)
ungroup_6 = Ungroup(Group=item_40)
range = Range(Domain=dom, Steps=subtraction_4)
item_41 = ListItem(List=ungroup_6, Index=range, Wrap=True)
len_2 = Length(Curve=item_41)
larger_9 = LargerThan(FirstNumber=len_2, SecondNumber=Slider(2.8, range=0..10))  # -> LargerThan, OrEqualTo
dispatch_14 = Dispatch(List=item_41, DispatchPattern=larger_9.LargerThan)  # -> ListA, ListB
divlength = DivideLength(Curve=dispatch_14.ListA, Length=Slider(1.2, range=0..10))  # -> Points, Tangents, Parameters
shatter_2 = Shatter(Curve=graft(dispatch_14.ListA), Parameters=divlength.Parameters)
replace_11 = ReplaceItems(List=shatter_2, Indices=bang_18.Branch2, Wrap=False)
group_22 = Group(Objects=replace_11)
trim_14 = TrimTree(Tree=group_22, Depth="3")
merge_4 = Merge(Data1=dispatch_14.ListB, Data2=trim_14)

# ----
lng_9 = ListLength(List=ungroup_6)
larger_10 = LargerThan(FirstNumber=range, SecondNumber=lng_9)  # -> LargerThan, OrEqualTo
dispatch_15 = Dispatch(List=merge_4, DispatchPattern=larger_10.OrEqualTo)  # -> ListA, ListB
dispatch_16 = Dispatch(List=range, DispatchPattern=larger_10.OrEqualTo)  # -> ListA, ListB

# ---- group: gangways (continued)
replace_12 = ReplaceItems(List=ungroup_6, Item=dispatch_15.ListB, Indices=dispatch_16.ListB, Wrap=False)
group_23 = Group(Objects=replace_12)  # -> flatten(Group)
replace_13 = ReplaceItems(List=item_28, Item=group_23, Indices=dispatch_7.ListB, Wrap=False)

# ----
panel_46 = Panel(dispatch_16.ListB)

# ---- group: gangways
subtraction_5 = Subtraction(A=addition_4, B=bang_18.Branch4)
dom_2 = ConstructDomain(DomainStart=bang_18.Branch4, DomainEnd=addition_4)
item_42 = ListItem(List=replace_13, Index=dispatch_8.ListB, Wrap=True)
range_2 = Range(Domain=dom_2, Steps=subtraction_5)
ungroup_7 = Ungroup(Group=item_42)
lng_10 = ListLength(List=ungroup_7)
larger_11 = LargerThan(FirstNumber=range_2, SecondNumber=expr("x-1", lng_10))  # -> LargerThan, OrEqualTo
dispatch_17 = Dispatch(List=range_2, DispatchPattern=larger_11.LargerThan)  # -> ListA, ListB
item_43 = ListItem(List=ungroup_7, Index=dispatch_17.ListB, Wrap=False)
len_3 = Length(Curve=item_43)
larger_12 = LargerThan(FirstNumber=len_3, SecondNumber=Slider(2.8, range=0..10))  # -> LargerThan, OrEqualTo
dispatch_18 = Dispatch(List=item_43, DispatchPattern=larger_12.LargerThan)  # -> ListA, ListB
divlength_2 = DivideLength(Curve=dispatch_18.ListA, Length=Slider(1.2, range=0..10))  # -> Points, Tangents, Parameters
shatter_3 = Shatter(Curve=graft(dispatch_18.ListA), Parameters=divlength_2.Parameters)
replace_14 = ReplaceItems(List=shatter_3, Indices=bang_18.Branch6, Wrap=False)
group_24 = Group(Objects=replace_14)
trim_15 = TrimTree(Tree=group_24, Depth="3")
merge_5 = Merge(Data1=dispatch_18.ListB, Data2=trim_15)
replace_15 = ReplaceItems(List=ungroup_7, Item=merge_5, Indices=dispatch_17.ListB, Wrap=False)
group_25 = Group(Objects=replace_15)  # -> flatten(Group)
replace_16 = ReplaceItems(List=replace_13, Item=group_25, Indices=dispatch_8.ListB, Wrap=False)

# ---- group: Programme
sift_3 = SiftPattern(List=partition, SiftPattern=repeat_2)  # -> Output0, Output1, Output2, Output3, Output4, Output5, Output6, Output7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
mcol_5 = MeshColours(Mesh=sift_3.Output2, Colours=ColourSwatch(SwatchColor=RGB(0, 238, 255)))
mcol_6 = MeshColours(Mesh=sift_3.Output1, Colours=ColourSwatch(SwatchColor=RGB(4, 0, 255)))
mcol_7 = MeshColours(Mesh=sift_3.Output0, Colours=ColourSwatch(SwatchColor=RGB(199, 169, 145)))
mcol_8 = MeshColours(Mesh=sift_3.Output4, Colours=ColourSwatch(SwatchColor=RGB(255, 149, 0)))
mcol_9 = MeshColours(Mesh=sift_3.Output5, Colours=ColourSwatch(SwatchColor=RGB(255, 60, 0)))
mcol_10 = MeshColours(Mesh=sift_3.Output6, Colours=ColourSwatch(SwatchColor=RGB(140, 0, 255)))
mcol_11 = MeshColours(Mesh=sift_3.Output7, Colours=ColourSwatch(SwatchColor=RGB(255, 204, 0)))
mcol_12 = MeshColours(Mesh=sift_3.Output8, Colours=ColourSwatch(SwatchColor=RGB(255, 0, 170)))
mcol_13 = MeshColours(Mesh=sift_3.Output9, Colours=ColourSwatch(SwatchColor=RGB(148, 130, 114)))
mcol_14 = MeshColours(Mesh=sift_3.Output3, Colours=ColourSwatch(SwatchColor=RGB(255, 0, 0)))
mcol_15 = MeshColours(Mesh=sift_3.Output10, Colours=ColourSwatch(SwatchColor=RGB(0, 0, 0)))

# ---- group: assign function (continued)
merge_6 = Merge(Data1=simplify(sift_3.Output11), Data2=simplify(frompoints_3))  # -> simplify(Result)

# ---- group: Programme (continued)
mcol_16 = MeshColours(Mesh=merge_6, Colours=ColourSwatch(SwatchColor=RGB(128, 0, 0)))
medges_2 = MeshEdges(Mesh=[mcol_7, mcol_6, mcol_5, mcol_14, mcol_8, mcol_9, mcol_10, mcol_11, mcol_12, mcol_13, mcol_16])  # -> NakedEdges, InteriorEdges, NonManifoldEdges
previewlw = CustomPreviewLineweights(
    Geometry=simplify(medges_2.NakedEdges),
    Shader=simplify(ColourSwatch(SwatchColor=RGB(0, 0, 0))),
    Thickness="2",
    Absolute=False)

# ---- group: Vomitories
series_17 = Series(Start=bang_10.Branch0, Step=1, Count=bang_10.Branch1)
item_44 = ListItem(List=replace_16, Index=dispatch_9.ListB, Wrap=True)
ungroup_8 = Ungroup(Group=item_44)

# ----
lng_11 = ListLength(List=ungroup_8)
larger_13 = LargerThan(FirstNumber=series_17, SecondNumber=lng_11)  # -> LargerThan, OrEqualTo
dispatch_19 = Dispatch(List=series_17, DispatchPattern=larger_13.OrEqualTo)  # -> ListA, ListB

# ---- group: Vomitories (continued)
item_45 = ListItem(List=ungroup_8, Index=dispatch_19.ListB, Wrap=False)
ungroup_9 = Ungroup(Group=item_45)
split_45 = SplitList(List=ungroup_9, Index=Slider(3, range=0..10))  # -> ListA, ListB
group_26 = Group(Objects=split_45.ListB)
trim_16 = TrimTree(Tree=group_26, Depth=Slider(2, range=0..10))
replace_17 = ReplaceItems(List=ungroup_8, Item=trim_16, Indices=dispatch_19.ListB, Wrap=False)
group_27 = Group(Objects=replace_17)
replace_18 = ReplaceItems(List=replace_16, Item=flatten(group_27), Indices=dispatch_9.ListB, Wrap=False)

# ---- group: Vomitories 2
series_18 = Series(Start=bang_10.Branch5, Step=1, Count=bang_10.Branch1)
item_46 = ListItem(List=replace_18, Index=dispatch_9.ListB, Wrap=True)
ungroup_10 = Ungroup(Group=item_46)
lng_12 = ListLength(List=ungroup_10)
larger_14 = LargerThan(FirstNumber=series_18, SecondNumber=lng_12)  # -> LargerThan, OrEqualTo
dispatch_20 = Dispatch(List=series_18, DispatchPattern=larger_14.OrEqualTo)  # -> ListA, ListB
item_47 = ListItem(List=ungroup_10, Index=dispatch_20.ListB, Wrap=False)
ungroup_11 = Ungroup(Group=item_47)
split_46 = SplitList(List=ungroup_11, Index=Slider(3, range=0..10))  # -> ListA, ListB
group_28 = Group(Objects=split_46.ListB)
trim_17 = TrimTree(Tree=group_28, Depth=Slider(2, range=0..10))
replace_19 = ReplaceItems(List=ungroup_10, Item=trim_17, Indices=dispatch_20.ListB, Wrap=False)
group_29 = Group(Objects=replace_19)
replace_20 = ReplaceItems(List=replace_18, Item=flatten(group_29), Indices=dispatch_9.ListB, Wrap=False)

# ---- group: seating tunnels
item_48 = ListItem(List=replace_20, Index=dispatch_11.ListB, Wrap=True)
ungroup_12 = Ungroup(Group=item_48)
split_47 = SplitList(List=ungroup_12, Index=bang_2.Branch0)  # -> ListA, ListB
group_30 = Group(Objects=split_47.ListB)  # -> flatten(Group)
replace_21 = ReplaceItems(List=replace_20, Item=group_30, Indices=dispatch_11.ListB, Wrap=False)

# ----
ungroup_13 = Ungroup(Group=replace_21)
ungroup_14 = Ungroup(Group=ungroup_13)
join_12 = JoinCurves(Curves=ungroup_14, Preserve=False)
len_4 = Length(Curve=join_12)
item_49 = ListItem(List=join_12, Index=0, Wrap=True)
trim_18 = TrimTree(Tree=item_49, Depth=1)
division_12 = Division(A=len_4, B=Slider(0.6, range=0..1))
divide_3 = DivideCurve(Curve=join_12, Count=division_12, Kinks=False)  # -> Points, Tangents, Parameters
end_23 = EndPoints(Curve=trim_18)  # -> Start, End

# ---- group: seats
split_48 = SplitList(List=divide_3.Points, Index=1)  # -> ListA, ListB

# ----
pdecon_9 = Deconstruct(Point=end_23.Start)  # -> XComponent, YComponent, ZComponent
trim_19 = TrimTree(Tree=pdecon_9.ZComponent, Depth=1)
trim_20 = TrimTree(Tree=split_48.ListB, Depth=expr("2", 1))
lng_13 = ListLength(List=trim_20)
ins = InsertItems(List=trim_19, Item="0", Indices="0", Wrap=True)
split_49 = SplitList(List=reverse(ins), Index=1)  # -> ListA, reverse(ListB)
repeat_4 = RepeatData(Data=graft(split_49.ListB), Length=lng_13)

# ---- group: c value
crv_8 = Curve(item_5)
pull_2 = PullPoint(Point=trim_20, Geometry=crv_8, ClosestOnly=True)  # -> ClosestPoint, Distance
pdecon_10 = Deconstruct(Point=trim_20)  # -> XComponent, YComponent, ZComponent
pt_12 = ConstructPoint(XCoordinate=pdecon_10.XComponent, YCoordinate=pdecon_10.YComponent, ZCoordinate=0)
vec2pt_2 = Vector2Pt(PointA=pull_2.ClosestPoint, PointB=pt_12, Unitize=False)  # -> Vector, Length
dist_2 = Distance(PointA=pt_12, PointB=pull_2.ClosestPoint)  # -> expr("x-0.8", Distance)
vec2pt_3 = Vector2Pt(PointA=pull_2.ClosestPoint, PointB=trim_20, Unitize=False)  # -> Vector, Length
angle = Angle(VectorA=vec2pt_2.Vector, VectorB=vec2pt_3.Vector)  # -> Angle, Reflex
tan = Tangent(Value=angle.Angle)
multiplication_2 = Multiplication(A=dist_2, B=tan)
subtraction_6 = Subtraction(A=multiplication_2, B=repeat_4)

# ----
amp_2 = Amplitude(Vector=trim_20, Amplitude=".2")
move_35 = Move(Geometry=trim_20, Motion=amp_2)  # -> Geometry, Transform
ln_16 = Line(StartPoint=trim_20, EndPoint=move_35.Geometry)
panel_47 = Panel(subtraction_6)
sort_2 = SortList(Keys=flatten(subtraction_6))  # -> Keys, ValuesA
lng_14 = ListLength(List=sort_2.Keys)
multiplication_3 = Multiplication(A=lng_14, B=".8")
multiplication_4 = Multiplication(A=lng_14, B=".2")
lng_15 = ListLength(List=flatten(move_35.Geometry))
item_50 = ListItem(List=sort_2.Keys, Index=multiplication_4, Wrap=True)
item_51 = ListItem(List=sort_2.Keys, Index=multiplication_3, Wrap=True)
ma = MassAddition(Input=flatten(subtraction_6))  # -> Result, PartialResults
gradient = Gradient(
    LowerLimit=item_50,
    UpperLimit=item_51,
    Parameter=subtraction_6,
    stops=[0: RGB(128, 0, 128), 0.361: RGB(255, 255, 0), 1: RGB(255, 0, 0)])
lng_16 = ListLength(List=flatten(ln_16))

# ---- group: Capacity
panel_48 = Panel(lng_15)

# ----
division_13 = Division(A=ma.Result, B=lng_16)
previewlw_2 = CustomPreviewLineweights(Geometry=simplify(ln_16), Shader=simplify(gradient), Thickness="8", Absolute=False)
