# Grasshopper definition 05_02_RIBA Stage 0 Construction Strategy Analysis Model.gh (Grasshopper 1.0.7)
# plug-ins: Human, LunchBoxML, CORE.Toolbox.Grasshopper

# Paste the output folder path from the generative model in the panel below
input_folder = Panel("C:\AOMSDML\Stage 0 B")
concatenate = Concatenate(FragmentA=input_folder, FragmentB="\")
concatenate_2 = Concatenate(FragmentA=input_folder, FragmentB="\data.txt")
data = Data(Tree({0;0}: ["0.230082", "0.262742", "0.243117", "0.255858", "0.25249", "0.255565"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], {0;1}: ["0_0.jpeg", "0_1.jpeg", "0_2.jpeg", "0_3.jpeg", "0_4.jpeg", "0_5.jpeg"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], {0;2}: [6828, 6828, 6828, 6828, 6828, 6828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], {0;3}: [17873.57487, 18467.2987, 18417.0974, 18123.71478, 18912.63955, 17790.58151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], {0;4}: ["70", "71", "72", "74", "75", "76", "77", "78", "79", "80"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]))
read_file = ReadFile(File=concatenate_2, PerLineParse=True)
text_split = TextSplit(Text=read_file, Separators=",")
bang = ExplodeTree(Data=data)  # -> Branch0, Branch1, Branch2, Branch3, Branch4

# ---- group: first sheet
division = Division(A="1497", B=2)
division_2 = Division(A="2151", B=2)
dom = ConstructDomain(DomainStart=expr("x*-1", division_2), DomainEnd=division_2)
dom_2 = ConstructDomain(DomainStart=expr("x*-1", division), DomainEnd=division)
planesrf = PlaneSurface(Plane=PlaneXY(0, 0, 0), XSize=dom_2, YSize=dom)
series = Series(Start=0, Step="1497", Count="30")
X = UnitX(Factor=series)
move = Move(Geometry=planesrf, Motion=X)  # -> Geometry, Transform
series_2 = Series(Start=0, Step="2151", Count="30")
Y = UnitY(Factor=expr("x*-1", series_2))
move_2 = Move(Geometry=graft(move.Geometry), Motion=Y)  # -> Geometry, Transform
panel = Panel(concatenate)
flip = FlipMatrix(Data=move_2.Geometry)
panel_2 = Panel("""0_0.jpeg
0_1.jpeg
0_2.jpeg
0_3.jpeg
0_4.jpeg
0_5.jpeg
0_6.jpeg
0_7.jpeg
0_8.jpeg
0_9.jpeg
0_10.jpeg
0_11.jpeg
0_12.jpeg
0_13.jpeg
0_14.jpeg
0_15.jpeg
0_16.jpeg
0_17.jpeg
0_18.jpeg
0_19.jpeg
0_20.jpeg
0_21.jpeg
0_22.jpeg
0_23.jpeg
0_24.jpeg
0_25.jpeg
0_26.jpeg
0_27.jpeg
0_28.jpeg
0_29.jpeg
0_30.jpeg
0_31.jpeg
0_32.jpeg
0_33.jpeg
0_34.jpeg
0_35.jpeg
0_36.jpeg
0_37.jpeg
0_38.jpeg
0_39.jpeg
0_40.jpeg
0_41.jpeg
0_42.jpeg
0_43.jpeg
0_44.jpeg
0_45.jpeg
0_46.jpeg
0_47.jpeg
0_48.jpeg
0_49.jpeg
0_50.jpeg
0_51.jpeg
0_52.jpeg
0_53.jpeg
0_54.jpeg
0_55.jpeg
0_56.jpeg
0_57.jpeg
0_58.jpeg
0_59.jpeg
0_60.jpeg
0_61.jpeg
0_62.jpeg
0_63.jpeg
0_64.jpeg
0_65.jpeg
0_66.jpeg
0_67.jpeg
0_68.jpeg
0_69.jpeg
0_70.jpeg
0_71.jpeg
0_72.jpeg
0_73.jpeg
0_74.jpeg
0_75.jpeg
0_76.jpeg
0_77.jpeg
0_78.jpeg
0_79.jpeg
0_80.jpeg
0_81.jpeg
0_82.jpeg
0_83.jpeg
0_84.jpeg
0_85.jpeg
0_86.jpeg
0_87.jpeg
0_88.jpeg
0_89.jpeg
0_90.jpeg
0_91.jpeg
0_92.jpeg
0_93.jpeg
0_94.jpeg
0_95.jpeg
0_96.jpeg
0_97.jpeg
0_98.jpeg
0_99.jpeg
1_100.jpeg
1_101.jpeg
1_102.jpeg
1_103.jpeg
1_104.jpeg
1_105.jpeg
1_106.jpeg
1_107.jpeg
1_108.jpeg
1_109.jpeg
1_110.jpeg
1_111.jpeg
1_112.jpeg
1_113.jpeg
1_114.jpeg
1_115.jpeg
1_116.jpeg
1_117.jpeg
1_118.jpeg
1_119.jpeg
1_120.jpeg
1_121.jpeg
1_122.jpeg
1_123.jpeg
1_124.jpeg
1_125.jpeg
1_126.jpeg
1_127.jpeg
1_128.jpeg
1_129.jpeg
1_130.jpeg
1_131.jpeg
1_132.jpeg
1_133.jpeg
1_134.jpeg
1_135.jpeg
1_136.jpeg
1_137.jpeg
1_138.jpeg
1_139.jpeg
1_140.jpeg
1_141.jpeg
1_142.jpeg
1_143.jpeg
1_144.jpeg
1_145.jpeg
1_146.jpeg
1_147.jpeg
1_148.jpeg
1_149.jpeg
1_150.jpeg
1_151.jpeg
1_152.jpeg
1_153.jpeg
1_154.jpeg
1_155.jpeg
1_156.jpeg
1_157.jpeg
1_158.jpeg
1_159.jpeg
1_160.jpeg
1_161.jpeg
1_162.jpeg
1_163.jpeg
1_164.jpeg
1_165.jpeg
1_166.jpeg
1_167.jpeg
1_168.jpeg
1_169.jpeg
1_170.jpeg
1_171.jpeg
1_172.jpeg
1_173.jpeg
1_174.jpeg
1_175.jpeg
1_176.jpeg
1_177.jpeg
1_178.jpeg
1_179.jpeg
1_180.jpeg
1_181.jpeg
1_182.jpeg
1_183.jpeg
1_184.jpeg
1_185.jpeg
1_186.jpeg
1_187.jpeg
1_188.jpeg
1_189.jpeg
1_190.jpeg
1_191.jpeg
1_192.jpeg
1_193.jpeg
1_194.jpeg
1_195.jpeg
1_196.jpeg
1_197.jpeg
1_198.jpeg
1_199.jpeg
2_200.jpeg
2_201.jpeg
2_202.jpeg
2_203.jpeg
2_204.jpeg
2_205.jpeg
2_206.jpeg
2_207.jpeg
2_208.jpeg
2_209.jpeg
2_210.jpeg
2_211.jpeg
2_212.jpeg
2_213.jpeg
2_214.jpeg
2_215.jpeg
2_216.jpeg
2_217.jpeg
2_218.jpeg
2_219.jpeg
2_220.jpeg
2_221.jpeg
2_222.jpeg
2_223.jpeg
2_224.jpeg
2_225.jpeg
2_226.jpeg
2_227.jpeg
2_228.jpeg
2_229.jpeg
2_230.jpeg
2_231.jpeg
2_232.jpeg
2_233.jpeg
2_234.jpeg
2_235.jpeg
2_236.jpeg
2_237.jpeg
2_238.jpeg
2_239.jpeg
2_240.jpeg
2_241.jpeg
2_242.jpeg
2_243.jpeg
2_244.jpeg
2_245.jpeg
2_246.jpeg
2_247.jpeg
2_248.jpeg
2_249.jpeg
2_250.jpeg
2_251.jpeg
2_252.jpeg
2_253.jpeg
2_254.jpeg
2_255.jpeg
2_256.jpeg
2_257.jpeg
2_258.jpeg
2_259.jpeg
2_260.jpeg
2_261.jpeg
2_262.jpeg
2_263.jpeg
2_264.jpeg
2_265.jpeg
2_266.jpeg
2_267.jpeg
2_268.jpeg
2_269.jpeg
2_270.jpeg
2_271.jpeg
2_272.jpeg
2_273.jpeg
2_274.jpeg
2_275.jpeg
2_276.jpeg
2_277.jpeg
2_278.jpeg
2_279.jpeg
2_280.jpeg
2_281.jpeg
2_282.jpeg
2_283.jpeg
2_284.jpeg
2_285.jpeg
2_286.jpeg
2_287.jpeg
2_288.jpeg
2_289.jpeg
2_290.jpeg
2_291.jpeg
2_292.jpeg
2_293.jpeg
2_294.jpeg
2_295.jpeg
2_296.jpeg
2_297.jpeg
2_298.jpeg
2_299.jpeg
3_300.jpeg
3_301.jpeg
3_302.jpeg
3_303.jpeg
3_304.jpeg
3_305.jpeg
3_306.jpeg
3_307.jpeg
3_308.jpeg
3_309.jpeg
3_310.jpeg
3_311.jpeg
3_312.jpeg
3_313.jpeg
3_314.jpeg
3_315.jpeg
3_316.jpeg
3_317.jpeg
3_318.jpeg
3_319.jpeg
3_320.jpeg
3_321.jpeg
3_322.jpeg
3_323.jpeg
3_324.jpeg
3_325.jpeg
3_326.jpeg
3_327.jpeg
3_328.jpeg
3_329.jpeg
3_330.jpeg
3_331.jpeg
3_332.jpeg
3_333.jpeg
3_334.jpeg
3_335.jpeg
3_336.jpeg
3_337.jpeg
3_338.jpeg
3_339.jpeg
3_340.jpeg
3_341.jpeg
3_342.jpeg
3_343.jpeg
3_344.jpeg
3_345.jpeg
3_346.jpeg
3_347.jpeg
3_348.jpeg
3_349.jpeg
3_350.jpeg
3_351.jpeg
3_352.jpeg
3_353.jpeg
3_354.jpeg
3_355.jpeg
3_356.jpeg
3_357.jpeg
3_358.jpeg
3_359.jpeg
3_360.jpeg
3_361.jpeg
3_362.jpeg
3_363.jpeg
3_364.jpeg
3_365.jpeg
3_366.jpeg
3_367.jpeg
3_368.jpeg
3_369.jpeg
3_370.jpeg
3_371.jpeg
3_372.jpeg
3_373.jpeg
3_374.jpeg
3_375.jpeg
3_376.jpeg
3_377.jpeg
3_378.jpeg
3_379.jpeg
3_380.jpeg
3_381.jpeg
3_382.jpeg
3_383.jpeg
3_384.jpeg
3_385.jpeg
3_386.jpeg
3_387.jpeg
3_388.jpeg
3_389.jpeg
3_390.jpeg
3_391.jpeg
3_392.jpeg
3_393.jpeg
3_394.jpeg
3_395.jpeg
3_396.jpeg
3_397.jpeg
3_398.jpeg
3_399.jpeg
4_400.jpeg
4_401.jpeg
4_402.jpeg
4_403.jpeg
4_404.jpeg
4_405.jpeg
4_406.jpeg
4_407.jpeg
4_408.jpeg
4_409.jpeg
4_410.jpeg
4_411.jpeg
4_412.jpeg
4_413.jpeg
4_414.jpeg
4_415.jpeg
4_416.jpeg
4_417.jpeg
4_418.jpeg
4_419.jpeg
4_420.jpeg
4_421.jpeg
4_422.jpeg
4_423.jpeg
4_424.jpeg
4_425.jpeg
4_426.jpeg
4_427.jpeg
4_428.jpeg
4_429.jpeg
4_430.jpeg
4_431.jpeg
4_432.jpeg
4_433.jpeg
4_434.jpeg
4_435.jpeg
4_436.jpeg
4_437.jpeg
4_438.jpeg
4_439.jpeg
4_440.jpeg
4_441.jpeg
4_442.jpeg
4_443.jpeg
4_444.jpeg
4_445.jpeg
4_446.jpeg
4_447.jpeg
4_448.jpeg
4_449.jpeg
4_450.jpeg
4_451.jpeg
4_452.jpeg
4_453.jpeg
4_454.jpeg
4_455.jpeg
4_456.jpeg
4_457.jpeg
4_458.jpeg
4_459.jpeg
4_460.jpeg
4_461.jpeg
4_462.jpeg
4_463.jpeg
4_464.jpeg
4_465.jpeg
4_466.jpeg
4_467.jpeg
4_468.jpeg
4_469.jpeg
4_470.jpeg
4_471.jpeg
4_472.jpeg
4_473.jpeg
4_474.jpeg
4_475.jpeg
4_476.jpeg
4_477.jpeg
4_478.jpeg
4_479.jpeg
4_480.jpeg
4_481.jpeg
4_482.jpeg
4_483.jpeg
4_484.jpeg
4_485.jpeg
4_486.jpeg
4_487.jpeg
4_488.jpeg
4_489.jpeg
4_490.jpeg
4_491.jpeg
4_492.jpeg
4_493.jpeg
4_494.jpeg
4_495.jpeg
4_496.jpeg
4_497.jpeg
4_498.jpeg
4_499.jpeg
5_500.jpeg
5_501.jpeg
5_502.jpeg
5_503.jpeg
5_504.jpeg
5_505.jpeg
5_506.jpeg
5_507.jpeg
5_508.jpeg
5_509.jpeg
5_510.jpeg
5_511.jpeg
5_512.jpeg
5_513.jpeg
5_514.jpeg
5_515.jpeg
5_516.jpeg
5_517.jpeg
5_518.jpeg
5_519.jpeg
5_520.jpeg
5_521.jpeg
5_522.jpeg
5_523.jpeg
5_524.jpeg
5_525.jpeg
5_526.jpeg
5_527.jpeg
5_528.jpeg
5_529.jpeg
5_530.jpeg
5_531.jpeg
5_532.jpeg
5_533.jpeg
5_534.jpeg
5_535.jpeg
5_536.jpeg
5_537.jpeg
5_538.jpeg
5_539.jpeg
5_540.jpeg
5_541.jpeg
5_542.jpeg
5_543.jpeg
5_544.jpeg
5_545.jpeg
5_546.jpeg
5_547.jpeg
5_548.jpeg
5_549.jpeg
5_550.jpeg
5_551.jpeg
5_552.jpeg
5_553.jpeg
5_554.jpeg
5_555.jpeg
5_556.jpeg
5_557.jpeg
5_558.jpeg
5_559.jpeg
5_560.jpeg
5_561.jpeg
5_562.jpeg
5_563.jpeg
5_564.jpeg
5_565.jpeg
5_566.jpeg
5_567.jpeg
5_568.jpeg
5_569.jpeg
5_570.jpeg
5_571.jpeg
5_572.jpeg
5_573.jpeg
5_574.jpeg
5_575.jpeg
5_576.jpeg
5_577.jpeg
5_578.jpeg
5_579.jpeg
5_580.jpeg
5_581.jpeg
5_582.jpeg
5_583.jpeg
5_584.jpeg
5_585.jpeg
5_586.jpeg
5_587.jpeg
5_588.jpeg
5_589.jpeg
5_590.jpeg
5_591.jpeg
5_592.jpeg
5_593.jpeg
5_594.jpeg
5_595.jpeg
5_596.jpeg
5_597.jpeg
5_598.jpeg
5_599.jpeg
6_600.jpeg
6_601.jpeg
6_602.jpeg
6_603.jpeg
6_604.jpeg
6_605.jpeg
6_606.jpeg
6_607.jpeg
6_608.jpeg
6_609.jpeg
6_610.jpeg
6_611.jpeg
6_612.jpeg
6_613.jpeg
6_614.jpeg
6_615.jpeg
6_616.jpeg
6_617.jpeg
6_618.jpeg
6_619.jpeg
6_620.jpeg
6_621.jpeg
6_622.jpeg
6_623.jpeg
6_624.jpeg
6_625.jpeg
6_626.jpeg
6_627.jpeg
6_628.jpeg
6_629.jpeg
6_630.jpeg
6_631.jpeg
6_632.jpeg
6_633.jpeg
6_634.jpeg
6_635.jpeg
6_636.jpeg
6_637.jpeg
6_638.jpeg
6_639.jpeg
6_640.jpeg
6_641.jpeg
6_642.jpeg
6_643.jpeg
6_644.jpeg
6_645.jpeg
6_646.jpeg
6_647.jpeg
6_648.jpeg
6_649.jpeg
6_650.jpeg
6_651.jpeg
6_652.jpeg
6_653.jpeg
6_654.jpeg
6_655.jpeg
6_656.jpeg
6_657.jpeg
6_658.jpeg
6_659.jpeg
6_660.jpeg
6_661.jpeg
6_662.jpeg
6_663.jpeg
6_664.jpeg
6_665.jpeg
6_666.jpeg
6_667.jpeg
6_668.jpeg
6_669.jpeg
6_670.jpeg
6_671.jpeg
6_672.jpeg
6_673.jpeg
6_674.jpeg
6_675.jpeg
6_676.jpeg
6_677.jpeg
6_678.jpeg
6_679.jpeg
6_680.jpeg
6_681.jpeg
6_682.jpeg
6_683.jpeg
6_684.jpeg
6_685.jpeg
6_686.jpeg
6_687.jpeg
6_688.jpeg
6_689.jpeg
6_690.jpeg
6_691.jpeg
6_692.jpeg
6_693.jpeg
6_694.jpeg
6_695.jpeg
6_696.jpeg
6_697.jpeg
6_698.jpeg
6_699.jpeg
7_700.jpeg
7_701.jpeg
7_702.jpeg
7_703.jpeg
7_704.jpeg
7_705.jpeg
7_706.jpeg
7_707.jpeg
7_708.jpeg
7_709.jpeg
7_710.jpeg
7_711.jpeg
7_712.jpeg
7_713.jpeg
7_714.jpeg
7_715.jpeg
7_716.jpeg
7_717.jpeg
7_718.jpeg
7_719.jpeg
7_720.jpeg
7_721.jpeg
7_722.jpeg
7_723.jpeg
7_724.jpeg
7_725.jpeg
7_726.jpeg
7_727.jpeg
7_728.jpeg
7_729.jpeg
7_730.jpeg
7_731.jpeg
7_732.jpeg
7_733.jpeg
7_734.jpeg
7_735.jpeg
7_736.jpeg
7_737.jpeg
7_738.jpeg
7_739.jpeg
7_740.jpeg
7_741.jpeg
7_742.jpeg
7_743.jpeg
7_744.jpeg
7_745.jpeg
7_746.jpeg
7_747.jpeg
7_748.jpeg
7_749.jpeg
7_750.jpeg
7_751.jpeg
7_752.jpeg
7_753.jpeg
7_754.jpeg
7_755.jpeg
7_756.jpeg
7_757.jpeg
7_758.jpeg
7_759.jpeg
7_760.jpeg
7_761.jpeg
7_762.jpeg
7_763.jpeg
7_764.jpeg
7_765.jpeg
7_766.jpeg
7_767.jpeg
7_768.jpeg
7_769.jpeg
7_770.jpeg
7_771.jpeg
7_772.jpeg
7_773.jpeg
7_774.jpeg
7_775.jpeg
7_776.jpeg
7_777.jpeg
7_778.jpeg
7_779.jpeg
7_780.jpeg
7_781.jpeg
7_782.jpeg
7_783.jpeg
7_784.jpeg
7_785.jpeg
7_786.jpeg
7_787.jpeg
7_788.jpeg
7_789.jpeg
7_790.jpeg
7_791.jpeg
7_792.jpeg
7_793.jpeg
7_794.jpeg
7_795.jpeg
7_796.jpeg
7_797.jpeg
7_798.jpeg
7_799.jpeg
8_800.jpeg
8_801.jpeg
8_802.jpeg
8_803.jpeg
8_804.jpeg
8_805.jpeg
8_806.jpeg
8_807.jpeg
8_808.jpeg
8_809.jpeg
8_810.jpeg
8_811.jpeg
8_812.jpeg
8_813.jpeg
8_814.jpeg
8_815.jpeg
8_816.jpeg
8_817.jpeg
8_818.jpeg
8_819.jpeg
8_820.jpeg
8_821.jpeg
8_822.jpeg
8_823.jpeg
8_824.jpeg
8_825.jpeg
8_826.jpeg
8_827.jpeg
8_828.jpeg
8_829.jpeg
8_830.jpeg
8_831.jpeg
8_832.jpeg
8_833.jpeg
8_834.jpeg
8_835.jpeg
8_836.jpeg
8_837.jpeg
8_838.jpeg
8_839.jpeg
8_840.jpeg
8_841.jpeg
8_842.jpeg
8_843.jpeg
8_844.jpeg
8_845.jpeg
8_846.jpeg
8_847.jpeg
8_848.jpeg
8_849.jpeg
8_850.jpeg
8_851.jpeg
8_852.jpeg
8_853.jpeg
8_854.jpeg
8_855.jpeg
8_856.jpeg
8_857.jpeg
8_858.jpeg
8_859.jpeg
8_860.jpeg
8_861.jpeg
8_862.jpeg
8_863.jpeg
8_864.jpeg
8_865.jpeg
8_866.jpeg
8_867.jpeg
8_868.jpeg
8_869.jpeg
8_870.jpeg
8_871.jpeg
8_872.jpeg
8_873.jpeg
8_874.jpeg
8_875.jpeg
8_876.jpeg
8_877.jpeg
8_878.jpeg
8_879.jpeg
8_880.jpeg
8_881.jpeg
8_882.jpeg
8_883.jpeg
8_884.jpeg
8_885.jpeg
8_886.jpeg
8_887.jpeg
8_888.jpeg
8_889.jpeg
8_890.jpeg
8_891.jpeg
8_892.jpeg
8_893.jpeg
8_894.jpeg
8_895.jpeg
8_896.jpeg
8_897.jpeg
8_898.jpeg
8_899.jpeg
0_900.jpeg""")
item = ListItem(List=flatten(flip), Index=bang.Branch4, Wrap=True)
weave = Weave(Pattern=[0, 1], Stream0=panel, Stream1=graft(panel_2), NullGaps=False)
debrep = DeconstructBrep(Brep=item)  # -> Faces, Edges, Vertices
area = Area(Geometry=item)  # -> Area, Centroid
join = JoinCurves(Curves=debrep.Edges, Preserve=False)  # -> flatten(Curves)
join_2 = TextJoin(Text=weave)
scale = Scale(Geometry=join, Center=area.Centroid, Factor=Slider(0.68, range=0..1))  # -> Geometry, Transform
previewlw = CustomPreviewLineweights(
    Geometry=scale.Geometry,
    Shader=ColourSwatch(SwatchColor=RGB(255, 0, 0)),
    Thickness=Slider(4.8, range=0..10),
    Absolute=False)
previewmat = CustomPreviewMaterials(Geometry=flatten(flip), DiffuseColor=RGB(255, 255, 255), DiffuseBitmap=flatten(join_2))
panel_3 = Panel(join_2)

# ----
list_item = ListItem(List=flatten(join_2), Index=0, Wrap=True)
panel_4 = Panel(list_item)
flip_matrix = FlipMatrix(Data=text_split)
panel_5 = Panel(bang.Branch1)
repeat_data = RepeatData(Data=flip_matrix, Length="901")
split_list = SplitList(List=bang.Branch1, Index="1")  # -> ListA, ListB
explode_tree = ExplodeTree(Data=repeat_data)  # -> _0000, _0010, _0020, _0030, _0040, _0050
replace_items = ReplaceItems(List=explode_tree._0000, Indices=bang.Branch4, Wrap=False)
replace_items_2 = ReplaceItems(List=explode_tree._0010, Indices=bang.Branch4, Wrap=False)
replace_items_3 = ReplaceItems(List=explode_tree._0040, Indices=bang.Branch4, Wrap=False)
replace_items_4 = ReplaceItems(List=explode_tree._0030, Indices=bang.Branch4, Wrap=False)
panel_6 = Panel(replace_items_4)
replace_items_5 = ReplaceItems(List=explode_tree._0020, Indices=bang.Branch4, Wrap=False)
clean_tree = CleanTree(RemoveNulls=True, RemoveInvalid=True, RemoveEmpty=True, Tree=replace_items_4)
number_slider = Slider(1, range=0..10)
sort_list = SortList(Keys=replace_items_3)  # -> Keys, ValuesValuesA
sort_list_2 = SortList(Keys=replace_items)  # -> Keys, ValuesValuesA
sort_list_3 = SortList(Keys=replace_items_2)  # -> Keys, ValuesValuesA
sort_list_4 = SortList(Keys=replace_items_5)  # -> Keys, ValuesValuesA
sort_list_5 = SortList(Keys=replace_items_4)  # -> Keys, ValuesValuesA
addition = Addition(A=bang.Branch4, B="0")
panel_7 = Panel("""0
1
2
3
4""")
list_item_2 = ListItem(List=reverse(sort_list.Keys), Index=0, Wrap=True)
list_item_3 = ListItem(List=reverse(sort_list_4.Keys), Index=0, Wrap=True)
list_item_4 = ListItem(List=reverse(sort_list_5.Keys), Index=0, Wrap=True)
list_item_5 = ListItem(List=reverse(sort_list_3.Keys), Index=0, Wrap=True)
replace = ReplaceItems(List=split_list.ListB, Indices=addition, Wrap=False)
list_item_6 = ListItem(List=reverse(sort_list_2.Keys), Index=0, Wrap=True)
construct_domain = ConstructDomain(DomainStart="0", DomainEnd=list_item_4)
construct_domain_2 = ConstructDomain(DomainStart="0", DomainEnd=list_item_3)
clean = CleanTree(RemoveNulls=True, RemoveInvalid=True, RemoveEmpty=False, Tree=replace)
construct_domain_3 = ConstructDomain(DomainStart="0", DomainEnd=list_item_2)
seats = ReplaceItems(List=replace_items, Indices=bang.Branch4, Wrap=False)
capacity = ReplaceItems(List=replace_items_3, Indices=bang.Branch4, Wrap=False)
replace_2 = ReplaceItems(List=replace_items_4, Indices=bang.Branch4, Wrap=False)
construct_domain_4 = ConstructDomain(DomainStart="0", DomainEnd=list_item_5)
construct_domain_5 = ConstructDomain(DomainStart="0", DomainEnd=list_item_6)
file_name = ReplaceItems(List=replace_items_2, Indices=bang.Branch4, Wrap=False)
weave_2 = Weave(
    Pattern=panel_7,
    Stream0=graft(replace_items),
    Stream1=graft(replace_items_2),
    Stream2=graft(replace_items_3),
    Stream3=graft(replace_items_4),
    Stream4=graft(replace_items_5),
    NullGaps=False)
clean_2 = CleanTree(RemoveNulls=True, RemoveInvalid=True, RemoveEmpty=False, Tree=capacity)
clean_3 = CleanTree(RemoveNulls=True, RemoveInvalid=True, RemoveEmpty=False, Tree=seats)
clean_4 = CleanTree(RemoveNulls=True, RemoveInvalid=True, RemoveEmpty=False, Tree=file_name)
clean_5 = CleanTree(RemoveNulls=True, RemoveInvalid=True, RemoveEmpty=False, Tree=replace_2)
dispatch = Dispatch(List=clean, DispatchPattern=[True, False])  # -> ListA, ListB
remap_numbers = RemapNumbers(Value=replace_items, Source=construct_domain_5, Target="0 To 10")  # -> Mapped, Clipped
remap_numbers_2 = RemapNumbers(Value=replace_items_2, Source=construct_domain_4, Target="0 To 10")  # -> Mapped, Clipped
remap_numbers_3 = RemapNumbers(Value=replace_items_3, Source=construct_domain_3, Target="0 To 10")  # -> Mapped, Clipped
remap_numbers_4 = RemapNumbers(Value=replace_items_3, Source=construct_domain_2, Target="0 To 10")  # -> Mapped, Clipped
replace_items_6 = ReplaceItems(List=panel_2, Indices=bang.Branch4, Wrap=False)
remap_numbers_5 = RemapNumbers(Value=replace_items_4, Source=construct_domain, Target="10 To 0")  # -> Mapped, Clipped
tree_statistics = TreeStatistics(Tree=weave_2)  # -> Paths, Length, Count
bnd = Bounds(Numbers=clean_2)
clean_tree_2 = CleanTree(RemoveNulls=True, RemoveInvalid=True, RemoveEmpty=True, Tree=replace_items_6)
bnd_2 = Bounds(Numbers=clean_5)
panel_8 = Panel(clean)
weave_3 = Weave(
    Pattern=[0, 1, 2, 3, 4],
    Stream0=graft(remap_numbers.Mapped),
    Stream1=graft(remap_numbers_2.Mapped),
    Stream2=graft(remap_numbers_3.Mapped),
    Stream3=graft(remap_numbers_5.Mapped),
    Stream4=graft(remap_numbers_4.Mapped),
    NullGaps=False)
remap = RemapNumbers(Value=clean_5, Source=bnd_2, Target=Domain(0, 1))  # -> Mapped, Clipped
dispatch_2 = Dispatch(List=tree_statistics.Paths, DispatchPattern=bang.Branch4)  # -> ListA, ListB
short = ShortestList(ListA=clean_3, ListB=clean, TrimMode=2)  # -> ListA, ListB
clean_tree_3 = CleanTree(RemoveNulls=True, RemoveInvalid=True, RemoveEmpty=True, Tree=weave_3)
remap_2 = RemapNumbers(Value=clean_2, Source=bnd, Target=Domain(0, 1))  # -> Mapped, Clipped
short_2 = ShortestList(ListA=clean_3, ListB=clean_2, TrimMode=2)  # -> ListA, ListB
tree_branch = TreeBranch(Tree=weave_2, Path=dispatch_2.ListA, MaintainPaths=True)
mass_addition = MassAddition(Input=clean_tree_3)  # -> Result, PartialResults
clean_tree_4 = CleanTree(RemoveNulls=True, RemoveInvalid=True, RemoveEmpty=True, Tree=tree_branch)
sort_list_6 = SortList(Keys=flatten(mass_addition.Result))  # -> Keys, ValuesValuesA
flip_matrix_2 = FlipMatrix(Data=clean_tree_4)
list_item_7 = ListItem(List=reverse(sort_list_6.Keys), Index=0, Wrap=True)
sort_list_7 = SortList(Keys=flip_matrix_2)  # -> Keys, ValuesValuesA
group = Group(Objects=move_2.Geometry)
construct_domain_6 = ConstructDomain(DomainStart=0, DomainEnd=list_item_7)
list_item_8 = ListItem(List=reverse(sort_list_7.Keys), Index=0, Wrap=True)
construct_domain_7 = ConstructDomain(DomainStart=0, DomainEnd=list_item_8)
remap_numbers_6 = RemapNumbers(Value=mass_addition.Result, Source=construct_domain_6, Target="-1 To 1")  # -> Mapped, Clipped
remap_numbers_7 = RemapNumbers(Value=flip_matrix_2, Source=construct_domain_7, Target="-1 To 1")  # -> Mapped, Clipped
flip_matrix_3 = FlipMatrix(Data=remap_numbers_7.Mapped)
panel_10 = Panel(mass_addition.Result)
tstat = TreeStatistics(Tree=flip_matrix_3)  # -> Paths, Length, Count
split = SplitList(List=flatten(remap_numbers_6.Mapped), Index="80")  # -> graft(ListA), ListB
split_2 = SplitList(List=tstat.Paths, Index="80")  # -> ListA, ListB
point = Point(Point(348596.2026, 1551.937951, 0))
branch = TreeBranch(Tree=flip_matrix_3, Path=split_2.ListA, MaintainPaths=True)  # -> simplify(Branch)
unit_y = UnitY(Factor="40000")

neural_network_trainer = NeuralNetworkTrainer(
    TrainingInputs=branch,
    TrainingOutputs=split.ListA,
    InputNeurons=Slider(2, range=0..20),
    HiddenNeurons=Slider(7, range=0..30),
    Alpha=1,
    Iterations=1000)  # -> TrainedNueralNetwork, ErrorsDynamics
neural_network_tester = NeuralNetworkTesting(TrainedNeuralNetwork=neural_network_trainer.TrainedNueralNetwork, TestInputData=flip_matrix_3)

larger = LargerThan(FirstNumber=bang.Branch0, SecondNumber=Slider(0.26, range=0..1))  # -> LargerThan, OrEqualTo
number_slider_2 = Slider(1000, range=0..1000)
dom_3 = ConstructDomain(DomainStart="-1", DomainEnd="1")
X_2 = UnitX(Factor=Slider(97964, range=0..100000))
dom_4 = ConstructDomain(DomainStart="0", DomainEnd="10")
multiplication = Multiplication(A=graft(remap_numbers_6.Mapped), B=number_slider_2)
multiplication_2 = Multiplication(A=neural_network_tester, B=number_slider_2)
number_slider_3 = Slider(12000, range=0..100000)
remap_3 = RemapNumbers(Value=neural_network_tester, Source=dom_3, Target=dom_4)  # -> Mapped, Clipped
sort_list_8 = SortList(Keys=flatten(remap_3.Mapped))  # -> Keys, ValuesValuesA
list_item_9 = ListItem(List=sort_list_8.Keys, Index=0, Wrap=True)
subtraction = Subtraction(A=remap_3.Mapped, B=list_item_9)
round = Round(Number=subtraction)  # -> flatten(Nearest), Floor, Ceiling
panel_11 = Panel(round.Nearest)
panel_12 = Panel(round.Nearest)
equals = Equality(FirstNumber=round.Nearest, SecondNumber=Slider(0, range=0..10))  # -> Equality, Inequality
sift = SiftPattern(List=short.ListA, SiftPattern=panel_11)  # -> Output0, Output1, Output2, Output3, Output4
sift_2 = SiftPattern(List=clean_2, SiftPattern=panel_11)  # -> Output0, Output1, Output2, Output3, Output4
sift_3 = SiftPattern(List=clean_5, SiftPattern=panel_11)  # -> Output0, Output1, Output2, Output3, Output4
entwine = Entwine(
    Branch00=sift.Output0,
    Branch01=sift.Output1,
    Branch02=sift.Output2,
    Branch03=sift.Output3,
    Branch04=sift.Output4,
    FlattenInputs=True)
entwine_2 = Entwine(
    Branch00=sift_2.Output0,
    Branch01=sift_2.Output1,
    Branch02=sift_2.Output2,
    Branch03=sift_2.Output3,
    Branch04=sift_2.Output4,
    FlattenInputs=True)
entwine_3 = Entwine(
    Branch00=sift_3.Output0,
    Branch01=sift_3.Output1,
    Branch02=sift_3.Output2,
    Branch03=sift_3.Output3,
    Branch04=sift_3.Output4,
    FlattenInputs=True)
clean_6 = CleanTree(RemoveNulls=True, RemoveInvalid=True, RemoveEmpty=False, Tree=entwine_2)
bnd_3 = Bounds(Numbers=entwine)
panel_13 = Panel(bnd_3)
dedomain = DeconstructDomain(Domain=panel_13)  # -> Start, End
subtraction_2 = Subtraction(A=dedomain.End, B=dedomain.Start)
fragment = TextFragment(Text=subtraction_2, Start="2", Count="2")
panel_14 = Panel(fragment)
bnd_4 = Bounds(Numbers=entwine_3)
dispatch_3 = Dispatch(List=clean_3, DispatchPattern=flatten(equals.Equality))  # -> ListA, ListB
dispatch_4 = Dispatch(List=remap_2.Mapped, DispatchPattern=flatten(equals.Equality))  # -> ListA, ListB
dispatch_5 = Dispatch(List=remap.Mapped, DispatchPattern=flatten(equals.Equality))  # -> ListA, ListB
sort = SortList(Keys=clean_6)  # -> Keys, ValuesA
panel_15 = Panel(bnd_4)
bnd_5 = Bounds(Numbers=clean_6)
dispatch_6 = Dispatch(List=short.ListB, DispatchPattern=flatten(equals.Equality))  # -> ListA, ListB
dispatch_7 = Dispatch(List=round.Nearest, DispatchPattern=flatten(larger.LargerThan))  # -> ListA, ListB
panel_16 = Panel(bnd_5)
panel_17 = Panel(sort.Keys)
panel_18 = Panel(dispatch_7.ListA)
panel_19 = Panel("""21366.507809
14179.941532
29039.2868
19995.152389
11375.190784
17574.060588
11842.710061
18611.567338
22196.059077
15129.494971
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""")
addition_2 = Addition(A=multiplication_2, B=number_slider_3)
addition_3 = Addition(A=multiplication, B=number_slider_3)
curve = Curve(<curve referenced from the Rhino model>)
round_2 = Round(Number=addition_2)  # -> Nearest, Floor, Ceiling
round_3 = Round(Number=addition_3)  # -> Nearest, Floor, Ceiling
explode = Explode(Curve=curve, Recursive=True)  # -> Segments, Vertices
panel_20 = Panel(remap_3.Mapped)
partition = PartitionList(List=panel_19, Size="7")
construct_point = ConstructPoint(XCoordinate=round_2.Nearest, YCoordinate=round_3.Nearest, ZCoordinate=0)
offset_curve = OffsetCurve(Curve=explode.Segments, Distance="35", Corners=1)
divide_curve = DivideCurve(Curve=graft(offset_curve), Count="10", Kinks=False)  # -> Points, Tangents, Parameters
circle = Circle(Plane=construct_point, Radius="10")
divide_curve_2 = DivideCurve(Curve=graft(explode.Segments), Count="10", Kinks=False)  # -> Points, Tangents, Parameters
line = Line(StartPoint=divide_curve_2.Points, EndPoint=divide_curve.Points)
tt_lineweight_preview = TTLineweightPreview(Geometry=line, Shader=ColourSwatch(SwatchColor=RGB(0, 0, 0)), Absolute=False)
tt_lineweight_preview_2 = TTLineweightPreview(Geometry=circle, Shader=ColourSwatch(SwatchColor=RGB(0, 0, 0)), Absolute=False)
panel_21 = Panel(replace_items_3)

# ---- group: capacity viz
dispatch_8 = Dispatch(List=short_2.ListB, DispatchPattern=flatten(equals.Equality))  # -> ListA, ListB
sort_2 = SortList(Keys=short_2.ListB)  # -> Keys, ValuesA
item_2 = ListItem(List=reverse(sort_2.Keys), Index=0, Wrap=True)
dom_5 = ConstructDomain(DomainStart=0, DomainEnd=item_2)
pt = ConstructPoint(XCoordinate="150000", YCoordinate="-50000", ZCoordinate=0)
pt_2 = ConstructPoint(XCoordinate="150000", YCoordinate="-25000", ZCoordinate=0)
ln = Line(StartPoint=pt, EndPoint=pt_2)
remap_4 = RemapNumbers(Value=dispatch_8.ListA, Source=dom_5, Target=Domain(0, 1))  # -> Mapped, Clipped
number_slider_4 = Slider(10, range=0..10)
eval = EvaluateCurve(Curve=reparameterize(ln), Parameter=remap_4.Mapped)  # -> Point, Tangent, Angle
range = Range(Domain=dom_5, Steps=number_slider_4)
dom_6 = ConstructDomain(DomainStart=0, DomainEnd="2500")
dom_7 = ConstructDomain(DomainStart=0, DomainEnd="-1000")
divide = DivideCurve(Curve=ln, Count=number_slider_4, Kinks=False)  # -> Points, Tangents, Parameters
X_3 = UnitX(Factor="-500")
round_4 = Round(Number=range)  # -> Nearest, Floor, Ceiling
move_3 = Move(Geometry=divide.Points, Motion=X_3)  # -> Geometry, Transform
rectangle = Rectangle(Plane=eval.Point, XSize=dom_6, YSize=dom_7, Radius=0)  # -> Rectangle, Length
srf = Surface(rectangle.Rectangle)
material = CreateMaterial(
    Diffuse=ColourSwatch(SwatchColor=RGB(111, 0, 255)),
    Specular=RGB(255, 255, 255),
    Emission=RGB(0, 0, 0),
    Transparency=Slider(0.97, range=0..1),
    Shine=0)
tag = TextTag3D(
    Location=move_3.Geometry,
    Text=round_4.Floor,
    Size=Slider(1000, range=0..10000),
    Colour=ColourSwatch(SwatchColor=RGB(0, 0, 0)),
    Justification=9)
preview = CustomPreview(Geometry=srf, Material=material)

# ----
sort_list_9 = SortList(Keys=reverse(dispatch_8.ListA))  # -> Keys, ValuesValuesA

# ---- group: Morphology to portion
dispatch_9 = Dispatch(List=flatten(bang.Branch0), DispatchPattern=flatten(equals.Equality))  # -> ListA, ListB
dispatch_10 = Dispatch(List=panel_2, DispatchPattern=flatten(equals.Equality))  # -> ListA, ListB
number_slider_5 = Slider(10000, range=0..10000)
short_3 = ShortestList(ListA=dispatch_9.ListA, ListB=dispatch_10.ListA, TrimMode=2)  # -> ListA, ListB
split_3 = TextSplit(Text=dispatch_10.ListA, Separators="_")
item_3 = ListItem(List=split_3, Index=0, Wrap=True)
bnd_6 = Bounds(Numbers=short_3.ListA)
dom_8 = ConstructDomain(DomainStart=0, DomainEnd=Slider(21000, range=0..100000))
pt_3 = ConstructPoint(XCoordinate="210000", YCoordinate="-50000", ZCoordinate=0)
pt_4 = ConstructPoint(XCoordinate="210000", YCoordinate="-25000", ZCoordinate=0)
len = TextLength(Text=item_3)
panel_22 = Panel(item_3)
remap_5 = RemapNumbers(Value=short_3.ListA, Source=bnd_6, Target=dom_8)  # -> Mapped, Clipped
ln_2 = Line(StartPoint=pt_3, EndPoint=pt_4)
dom_9 = ConstructDomain(DomainStart="1", DomainEnd="9")
preview_2 = CustomPreview(Geometry=ln_2, Material=ColourSwatch(SwatchColor=RGB(0, 0, 0)))
fragment_2 = TextFragment(Text=item_3, Start=expr("x-1", len), Count=1)
remap_6 = RemapNumbers(Value=expr("x+1", item_3), Source=Domain(0, 9), Target=Domain(-0.1, 1))  # -> flatten(Mapped), Clipped
number_slider_6 = Slider(8, range=0..10)
eval_2 = EvaluateCurve(Curve=reparameterize(ln_2), Parameter=remap_6.Mapped)  # -> Point, Tangent, Angle
dom_10 = ConstructDomain(DomainStart=0, DomainEnd="-1000")
range_2 = Range(Domain=dom_9, Steps=number_slider_6)
dom_11 = ConstructDomain(DomainStart=0, DomainEnd=remap_5.Mapped)
divide_2 = DivideCurve(Curve=ln_2, Count=number_slider_6, Kinks=False)  # -> Points, Tangents, Parameters
panel_23 = Panel(fragment_2)
series_3 = Series(Start=0, Step=1, Count=10)
X_4 = UnitX(Factor="-700")
round_5 = Round(Number=range_2)  # -> Nearest, Floor, Ceiling
rectangle_2 = Rectangle(Plane=eval_2.Point, XSize=dom_11, YSize=dom_10, Radius=0)  # -> Rectangle, Length
move_4 = Move(Geometry=divide_2.Points, Motion=X_4)  # -> Geometry, Transform
concat = Concatenate(FragmentA="Type ", FragmentB=round_5.Nearest)
srf_2 = Surface(rectangle_2.Rectangle)
material_2 = CreateMaterial(
    Diffuse=ColourSwatch(SwatchColor=RGB(255, 191, 0)),
    Specular=RGB(255, 255, 255),
    Emission=RGB(0, 0, 0),
    Transparency=Slider(0.97, range=0..1),
    Shine=0)
tag_2 = TextTag3D(
    Location=move_4.Geometry,
    Text=concat,
    Size=Slider(1000, range=0..10000),
    Colour=ColourSwatch(SwatchColor=RGB(0, 0, 0)),
    Justification=9)
preview_3 = CustomPreview(Geometry=srf_2, Material=material_2)

# ----
series_4 = Series(Start=0, Step=1, Count=10)
preview_4 = CustomPreview(Geometry=ln, Material=ColourSwatch(SwatchColor=RGB(0, 0, 0)))
range_3 = Range(Domain=Domain(0, 1), Steps=10)
range_4 = Range(Domain=Domain(0, 1), Steps=10)

# ---- group: sample sheet
short_4 = ShortestList(ListA=round.Nearest, ListB=clean, TrimMode=2)  # -> ListA, ListB
sort_3 = SortList(Keys=short_4.ListA, ValuesA=short_4.ListB)  # -> Keys, ValuesA
cset = CreateSet(List=sort_3.Keys)  # -> Set, Map
mindex = MemberIndex(Set=sort_3.Keys, Member=cset.Set)  # -> Index, Count
partition_2 = PartitionList(List=sort_3.ValuesA, Size=mindex.Count)
unit_x = UnitX(Factor="300000")
panel_24 = Panel(concatenate)
panel_25 = Panel("""0
1
2
3
4""")
random = Random(Range="0 To 86", Number="4", Seed=Slider(0, range=0..100))
weave_4 = Weave(
    Pattern=panel_25,
    Stream0=graft(replace_items),
    Stream1=graft(replace_items_2),
    Stream2=graft(replace_items_3),
    Stream3=graft(replace_items_4),
    Stream4=graft(replace_items_5),
    NullGaps=False)
tree_statistics_2 = TreeStatistics(Tree=weave_4)  # -> Paths, Length, Count
replace_items_7 = ReplaceItems(List=tree_statistics_2.Paths, Indices=bang.Branch4, Wrap=False)
panel_26 = Panel("""0
1
2
3""")
clean_tree_5 = CleanTree(RemoveNulls=True, RemoveInvalid=True, RemoveEmpty=False, Tree=replace_items_7)
partition_3 = PartitionList(List=clean_tree_5, Size=mindex.Count)
list_item_10 = ListItem(List=partition_3, Index=random, Wrap=True)
tree_branch_2 = TreeBranch(Tree=weave_4, Path=list_item_10, MaintainPaths=True)
list_item_11 = ListItem(List=tree_branch_2, Index=0, Wrap=True)  # -> Item, Item1, Item2, Item3, Item4
bounds = Bounds(Numbers=flatten(list_item_11.Item))
bounds_2 = Bounds(Numbers=flatten(list_item_11.Item1))
bounds_3 = Bounds(Numbers=flatten(list_item_11.Item2))
bounds_4 = Bounds(Numbers=flatten(list_item_11.Item3))
bounds_5 = Bounds(Numbers=flatten(list_item_11.Item4))
deconstruct_domain = DeconstructDomain(Domain=bounds)  # -> Start, End
deconstruct_domain_2 = DeconstructDomain(Domain=bounds_2)  # -> Start, End
deconstruct_domain_3 = DeconstructDomain(Domain=bounds_3)  # -> Start, End
deconstruct_domain_4 = DeconstructDomain(Domain=bounds_4)  # -> Start, End
deconstruct_domain_5 = DeconstructDomain(Domain=bounds_5)  # -> Start, End
list_length = ListLength(List=tree_branch_2)
construct_domain_8 = ConstructDomain(DomainStart=0, DomainEnd=flatten(deconstruct_domain_3.End))
construct_domain_9 = ConstructDomain(DomainStart=0, DomainEnd=flatten(deconstruct_domain.End))
construct_domain_10 = ConstructDomain(DomainStart=0, DomainEnd=flatten(deconstruct_domain_2.End))
construct_domain_11 = ConstructDomain(DomainStart=0, DomainEnd=flatten(deconstruct_domain_4.End))
construct_domain_12 = ConstructDomain(DomainStart=0, DomainEnd=flatten(deconstruct_domain_5.End))
list_item_12 = ListItem(List=flatten(list_length), Index=0, Wrap=True)
unit_y_2 = UnitY(Factor="-200")
unit_x_2 = UnitX(Factor="4200")
unit_y_3 = UnitY(Factor="1500")
addition_4 = Addition(A=unit_x_2, B=unit_y_2)
remap_numbers_8 = RemapNumbers(Value=list_item_11.Item, Source=construct_domain_9, Target="0 To 1")  # -> Mapped, Clipped
remap_numbers_9 = RemapNumbers(Value=list_item_11.Item1, Source=construct_domain_10, Target="0 To 1")  # -> Mapped, Clipped
remap_numbers_10 = RemapNumbers(Value=list_item_11.Item2, Source=construct_domain_8, Target="0 To 1")  # -> Mapped, Clipped
remap_numbers_11 = RemapNumbers(Value=list_item_11.Item3, Source=construct_domain_11, Target="0 To 1")  # -> Mapped, Clipped
remap_numbers_12 = RemapNumbers(Value=list_item_11.Item4, Source=construct_domain_12, Target="0 To 1")  # -> Mapped, Clipped
division_3 = Division(A="360", B=list_item_12)
unit_x_3 = UnitX(Factor="400")
series_5 = Series(Start=division_3, Step=division_3, Count=list_item_12)
merge = Merge(
    Data1=remap_numbers_8.Mapped,
    Data2=remap_numbers_9.Mapped,
    Data3=remap_numbers_10.Mapped,
    Data4=remap_numbers_11.Mapped,
    Data5=remap_numbers_12.Mapped)
panel_27 = Panel("""Roof
area""")
colour_swatch = ColourSwatch(SwatchColor=RGB(0, 0, 0))
panel_28 = Panel("""Building
footprint""")
panel_29 = Panel("""Facade
area""")
panel_30 = Panel("""Number of
types by size""")
panel_31 = Panel("""Number of
elements""")
unit_y_4 = UnitY(Factor="50")

# ---- group: All groups
X_5 = UnitX(Factor="50000")
short_5 = ShortestList(ListA=round.Nearest, ListB=clean, TrimMode=2)  # -> ListA, ListB
sort_4 = SortList(Keys=short_5.ListA, ValuesA=short_5.ListB)  # -> Keys, ValuesA
move_5 = Move(Geometry=group, Motion=X_5)  # -> flatten(Geometry), Transform
cset_2 = CreateSet(List=sort_4.Keys)  # -> Set, Map
mindex_2 = MemberIndex(Set=sort_4.Keys, Member=cset_2.Set)  # -> Index, Count
partition_4 = PartitionList(List=sort_4.ValuesA, Size=mindex_2.Count)
panel_32 = Panel(concatenate)

# ----
ungroup = Ungroup(Group=move_5.Geometry)
flip_2 = FlipMatrix(Data=ungroup)
group_2 = Group(Objects=flip_2)
division_4 = Division(A=mindex_2.Count, B=30)
round_6 = Round(Number=division_4)  # -> Nearest, Floor, Ceiling
ma = MassAddition(Input=round_6.Ceiling)  # -> Result, PartialResults
split_4 = SplitList(List=flatten(group_2), Index=ma.Result)  # -> ListA, ListB
partition_5 = PartitionList(List=split_4.ListA, Size=round_6.Ceiling)
ungroup_2 = Ungroup(Group=partition_5)
trim = TrimTree(Tree=ungroup_2, Depth=1)

# ---- group: sample sheet (continued)
trim_2 = TrimTree(Tree=ungroup_2, Depth=1)
short_6 = ShortestList(ListA=partition_2, ListB=trim_2, TrimMode=2)  # -> ListA, ListB
list_item_13 = ListItem(List=short_6.ListA, Index=random, Wrap=True)
move_6 = Move(Geometry=short_6.ListB, Motion=unit_x)  # -> Geometry, Transform
partition_list = PartitionList(List=move_6.Geometry, Size="30")
list_item_14 = ListItem(List=partition_list, Index=panel_26, Wrap=True)
tree_statistics_3 = TreeStatistics(Tree=list_item_14)  # -> Paths, Length, Count
weave_5 = Weave(Pattern=[0, 1], Stream0=panel_24, Stream1=graft(list_item_13), NullGaps=False)
split_list_2 = SplitList(List=tree_statistics_3.Paths, Index="5")  # -> ListA, ListB
join_3 = TextJoin(Text=weave_5)
tree_branch_3 = TreeBranch(Tree=list_item_14, Path=split_list_2.ListA, MaintainPaths=True)
group_3 = Group(Objects=tree_branch_3)
lng = ListLength(List=flatten(group_3))
series_6 = Series(Start=0, Step="400", Count=lng)
series_7 = Series(Start=0, Step="-200", Count=lng)
unit_x_4 = UnitX(Factor=series_6)
Y_2 = UnitY(Factor=series_7)
addition_5 = Addition(A=Y_2, B=unit_x_4)
move_7 = Move(Geometry=flatten(group_3), Motion=flatten(Y_2))  # -> Geometry, Transform
ungroup_3 = Ungroup(Group=move_7.Geometry)
flip_matrix_4 = FlipMatrix(Data=ungroup_3)
group_4 = Group(Objects=flip_matrix_4)
lng_2 = ListLength(List=flatten(group_4))
series_8 = Series(Start=0, Step="400", Count=lng_2)
unit_x_5 = UnitX(Factor=series_8)
move_8 = Move(Geometry=flatten(group_4), Motion=flatten(unit_x_5))  # -> Geometry, Transform
ungroup_4 = Ungroup(Group=move_8.Geometry)
flip_matrix_5 = FlipMatrix(Data=ungroup_4)

# ----
scale_2 = Scale(Geometry=flip_matrix_5, Center=point, Factor=Slider(5.56, range=0..10))  # -> Geometry, Transform

# ---- group: sample sheet (continued)
area_2 = Area(Geometry=scale_2.Geometry)  # -> Area, Centroid
bbox = BoundingBox(Content=scale_2.Geometry, Plane=PlaneXY(0, 0, 0), UnionBox=True)  # -> Box, Box_2
debrep_2 = DeconstructBrep(Brep=bbox.Box)  # -> Faces, Edges, Vertices
list_item_15 = ListItem(List=debrep_2.Vertices, Index=0, Wrap=True)  # -> Item, Item1, Item2, Item3
move_9 = Move(Geometry=area_2.Centroid, Motion=addition_4)  # -> Geometry, Transform
previewmat_2 = CustomPreviewMaterials(Geometry=flatten(scale_2.Geometry), DiffuseColor=RGB(255, 255, 255), DiffuseBitmap=flatten(join_3))
move_10 = Move(Geometry=[list_item_15.Item1, list_item_15.Item2], Motion=unit_x_3)  # -> Geometry, Transform
move_11 = Move(Geometry=move_9.Geometry, Motion=unit_y_3)  # -> Geometry, Transform
rotate = Rotate(Geometry=graft(move_11.Geometry), Angle=degrees(series_5), Plane=graft(move_9.Geometry))  # -> Geometry, Transform
polyline = PolyLine(Vertices=[move_10.Geometry, list_item_15.Item3, list_item_15.Item], Closed=True)
offset = OffsetCurve(Curve=polyline, Distance="50", Corners=1)
previewlw_2 = CustomPreviewLineweights(Geometry=offset, Shader=ColourSwatch(SwatchColor=RGB(0, 0, 0)), Thickness="2", Absolute=False)
line_2 = Line(StartPoint=graft(move_9.Geometry), EndPoint=rotate.Geometry)
evaluate_curve = EvaluateCurve(Curve=reparameterize(line_2), Parameter=merge)  # -> Point, Tangent, Angle
polyline_2 = PolyLine(Vertices=evaluate_curve.Point, Closed=True)
boundary_surfaces = BoundarySurfaces(Edges=polyline_2)
area_3 = Area(Geometry=boundary_surfaces)  # -> Area, Centroid
tt_lineweight_preview_3 = TTLineweightPreview(Geometry=[polyline_2, line_2], Shader=colour_swatch, Thickness="2", Absolute=False)
bounds_6 = Bounds(Numbers=flatten(area_3.Area))
remap_numbers_13 = RemapNumbers(Value=area_3.Area, Source=bounds_6, Target=".9 To .6")  # -> Mapped, Clipped
list_item_16 = ListItem(List=rotate.Geometry, Index=0, Wrap=True)  # -> Item, Item1, Item2, Item3, Item4
create_material = CreateMaterial(Diffuse=colour_swatch, Specular=RGB(255, 255, 255), Emission=RGB(0, 0, 0), Transparency=remap_numbers_13.Mapped, Shine=0)
move_12 = Move(Geometry=list_item_16.Item4, Motion=unit_y_4)  # -> Geometry, Transform
text_tag_3d = TextTag3D(Location=list_item_16.Item, Text=panel_27, Size="180", Colour=colour_swatch, Justification=9)
text_tag_3d_2 = TextTag3D(Location=list_item_16.Item1, Text=panel_28, Size="180", Colour=colour_swatch, Justification=9)
text_tag_3d_3 = TextTag3D(Location=list_item_16.Item2, Text=panel_29, Size="180", Colour=colour_swatch, Justification=7)
text_tag_3d_4 = TextTag3D(Location=list_item_16.Item3, Text=panel_30, Size="180", Colour=colour_swatch, Justification=7)
text_tag_3d_5 = TextTag3D(Location=move_12.Geometry, Text=panel_31, Size="180", Colour=colour_swatch, Justification=5)
custom_preview = CustomPreview(Geometry=boundary_surfaces, Material=create_material)

# ---- group: All groups (continued)
short_7 = ShortestList(ListA=partition_4, ListB=trim, TrimMode=2)  # -> ListA, ListB
weave_6 = Weave(Pattern=[0, 1], Stream0=panel_32, Stream1=graft(short_7.ListA), NullGaps=False)
join_4 = TextJoin(Text=weave_6)

# ----
group_5 = Group(Objects=short_7.ListB)
lng_3 = ListLength(List=flatten(group_5))
series_9 = Series(Start=0, Step="-2000", Count=lng_3)
Y_3 = UnitY(Factor=series_9)
move_13 = Move(Geometry=flatten(group_5), Motion=flatten(Y_3))  # -> Geometry, Transform
bbox_2 = BoundingBox(Content=move_13.Geometry, Plane=PlaneXY(0, 0, 0))  # -> Box, Box_2
ungroup_5 = Ungroup(Group=move_13.Geometry)

# ---- group: All groups (continued)
previewmat_3 = CustomPreviewMaterials(Geometry=flatten(ungroup_5), DiffuseColor=RGB(255, 255, 255), DiffuseBitmap=flatten(join_4))

# ----
debrep_3 = DeconstructBrep(Brep=bbox_2.Box)  # -> Faces, Edges, Vertices
join_5 = JoinCurves(Curves=debrep_3.Edges, Preserve=False)
offset_2 = OffsetCurve(Curve=join_5, Distance="750", Corners=1)
previewlw_3 = CustomPreviewLineweights(Geometry=offset_2, Shader=ColourSwatch(SwatchColor=RGB(0, 0, 0)), Thickness="2", Absolute=False)

# ---- group: best group
X_6 = UnitX(Factor="100000")
lng_4 = ListLength(List=dispatch_6.ListA)
panel_33 = Panel(panel_32)
weave_7 = Weave(Pattern=[0, 1], Stream0=panel_33, Stream1=graft(dispatch_6.ListA), NullGaps=False)
join_6 = TextJoin(Text=weave_7)
panel_34 = Panel(join_6)

# ----
addition_6 = Addition(A=X_6, B=unit_y)

# ---- group: best group (continued)
move_14 = Move(Geometry=move_2.Geometry, Motion=addition_6)  # -> Geometry, Transform
flip_3 = FlipMatrix(Data=move_14.Geometry)
split_5 = SplitList(List=flip_3, Index=Slider(14, range=0..100))  # -> ListA, ListB
split_6 = SplitList(List=flatten(split_5.ListA), Index=lng_4)  # -> ListA, ListB

# ----
group_6 = Group(Objects=split_6.ListA)
move_15 = Move(Geometry=group_6, Motion=X_2)  # -> Geometry, Transform
bbox_3 = BoundingBox(Content=move_15.Geometry, Plane=PlaneXY(0, 0, 0))  # -> Box, Box_2
area_4 = Area(Geometry=bbox_3.Box)  # -> Area, Centroid
scale_3 = Scale(Geometry=move_15.Geometry, Center=area_4.Centroid, Factor=Slider(6, range=0..10))  # -> Geometry, Transform
ungroup_6 = Ungroup(Group=scale_3.Geometry)

# ---- group: best group (continued)
flip_4 = FlipMatrix(Data=ungroup_6)
previewmat_4 = CustomPreviewMaterials(Geometry=flatten(flip_4), DiffuseColor=RGB(255, 255, 255), DiffuseBitmap=flatten(join_6))

# ---- group: capacity highlight
panel_35 = Panel("10")
sort_5 = SortList(Keys=dispatch_4.ListA, ValuesA=flatten(flip_4))  # -> Keys, ValuesA
division_5 = Division(A="1", B=panel_35)
split_7 = SplitList(List=sort_5.ValuesA, Index=panel_35)  # -> ListA, ListB
series_10 = Series(Start=0, Step=division_5, Count=panel_35)
debrep_4 = DeconstructBrep(Brep=split_7.ListA)  # -> Faces, Edges, Vertices
gradient = Gradient(
    LowerLimit=0,
    UpperLimit=1,
    Parameter=series_10,
    stops=[0: RGB(128, 0, 128), 0.25: RGB(192, 0, 192), 0.5: RGB(255, 0, 255), 0.75: RGB(255, 128, 255), 1: RGB(255, 192, 255)])
join_7 = JoinCurves(Curves=debrep_4.Edges, Preserve=False)
swatch = ColourSwatch(SwatchColor=RGB(255, 0, 221))
offset_3 = OffsetCurve(Curve=join_7, Distance="-300", Corners=1)
panel_36 = Panel("5")

# ---- group: top distance
sort_6 = SortList(Keys=dispatch_3.ListA, ValuesA=flatten(flip_4))  # -> Keys, ValuesA
division_6 = Division(A="1", B=panel_35)
split_8 = SplitList(List=sort_6.ValuesA, Index=panel_35)  # -> ListA, ListB
series_11 = Series(Start=0, Step=division_6, Count=panel_35)
debrep_5 = DeconstructBrep(Brep=split_8.ListA)  # -> Faces, Edges, Vertices
gradient_2 = Gradient(
    LowerLimit=0,
    UpperLimit=1,
    Parameter=series_11,
    stops=[0: RGB(0, 98, 0), 0.25: RGB(81, 175, 17), 0.75: RGB(170, 235, 41), 1: RGB(221, 255, 53), 1: RGB(159, 198, 146)])
join_8 = JoinCurves(Curves=debrep_5.Edges, Preserve=False)
swatch_2 = ColourSwatch(SwatchColor=RGB(255, 0, 221))
offset_4 = OffsetCurve(Curve=join_8, Distance="-100", Corners=1)
panel_37 = Panel("5")

# ----
sort_7 = SortList(Keys=dispatch_5.ListA, ValuesA=flatten(flip_4))  # -> Keys, ValuesA
division_7 = Division(A="1", B=panel_35)
split_9 = SplitList(List=sort_7.ValuesA, Index=panel_35)  # -> ListA, ListB
series_12 = Series(Start=0, Step=division_7, Count=panel_35)
debrep_6 = DeconstructBrep(Brep=split_9.ListA)  # -> Faces, Edges, Vertices
gradient_3 = Gradient(
    LowerLimit=0,
    UpperLimit=1,
    Parameter=series_12,
    stops=[0: RGB(128, 64, 0), 0.25: RGB(192, 64, 0), 0.5: RGB(255, 128, 0), 0.75: RGB(255, 192, 128), 1: RGB(255, 224, 192)])
join_9 = JoinCurves(Curves=debrep_6.Edges, Preserve=False)
swatch_3 = ColourSwatch(SwatchColor=RGB(255, 0, 221))
offset_5 = OffsetCurve(Curve=join_9, Distance="-500", Corners=1)

tt_lineweight_preview_4 = TTLineweightPreview(Geometry=offset_4, Shader=gradient_2, Thickness=panel_37, Absolute=False)
tt_lineweight_preview_5 = TTLineweightPreview(Geometry=offset_3, Shader=gradient, Thickness=panel_36, Absolute=False)
tt_lineweight_preview_6 = TTLineweightPreview(Geometry=offset_5, Shader=gradient_3, Thickness="5", Absolute=False)

# ---- group: orientation to top performing seats
dispatch_11 = Dispatch(List=flatten(clean_tree), DispatchPattern=flatten(equals.Equality))  # -> ListA, ListB
dispatch_12 = Dispatch(List=clean_tree_2, DispatchPattern=flatten(equals.Equality))  # -> ListA, ListB
short_8 = ShortestList(ListA=dispatch_11.ListA, ListB=dispatch_12.ListA, TrimMode=2)  # -> ListA, ListB
split_10 = TextSplit(Text=dispatch_12.ListA, Separators=".")
item_4 = ListItem(List=split_10, Index=0, Wrap=True)
bnd_7 = Bounds(Numbers=short_8.ListA)
dom_12 = ConstructDomain(DomainStart=0, DomainEnd=Slider(21000, range=0..100000))
len_2 = TextLength(Text=item_4)
pt_5 = ConstructPoint(XCoordinate="175000", YCoordinate="-50000", ZCoordinate=0)
pt_6 = ConstructPoint(XCoordinate="175000", YCoordinate="-25000", ZCoordinate=0)
remap_7 = RemapNumbers(Value=short_8.ListA, Source=bnd_7, Target=dom_12)  # -> Mapped, Clipped
ln_3 = Line(StartPoint=pt_5, EndPoint=pt_6)
dom_13 = ConstructDomain(DomainStart="-75", DomainEnd="15")
fragment_3 = TextFragment(Text=item_4, Start=expr("x-1", len_2), Count=1)
preview_5 = CustomPreview(Geometry=ln_3, Material=ColourSwatch(SwatchColor=RGB(0, 0, 0)))
panel_38 = Panel("-1000")
number_slider_7 = Slider(9, range=0..10)
remap_8 = RemapNumbers(Value=fragment_3, Source=Domain(0, 9), Target=Domain(0, 1))  # -> flatten(Mapped), Clipped
eval_3 = EvaluateCurve(Curve=reparameterize(ln_3), Parameter=range_3)  # -> Point, Tangent, Angle
dom_14 = ConstructDomain(DomainStart=0, DomainEnd=remap_7.Mapped)
range_5 = Range(Domain=series_4, Steps=number_slider_7)
divide_3 = DivideCurve(Curve=ln_3, Count=number_slider_7, Kinks=False)  # -> Points, Tangents, Parameters
panel_39 = Panel(fragment_3)
series_13 = Series(Start=0, Step=1, Count=10)
X_7 = UnitX(Factor="-500")
round_7 = Round(Number=range_5)  # -> Nearest, Floor, Ceiling
move_16 = Move(Geometry=divide_3.Points, Motion=X_7)  # -> Geometry, Transform
concat_2 = Concatenate(FragmentA=round_7.Nearest, FragmentB=" deg.")
material_3 = CreateMaterial(
    Diffuse=ColourSwatch(SwatchColor=RGB(255, 85, 0)),
    Specular=RGB(255, 255, 255),
    Emission=RGB(0, 0, 0),
    Transparency=Slider(0.97, range=0..1),
    Shine=0)
tag_3 = TextTag3D(
    Location=move_16.Geometry,
    Text=series_4,
    Size=Slider(1000, range=0..10000),
    Colour=ColourSwatch(SwatchColor=RGB(0, 0, 0)),
    Justification=9)

# ----
sort_list_10 = SortList(Keys=short_8.ListA)  # -> Keys, ValuesValuesA
cset_3 = CreateSet(List=sort_list_10.Keys)  # -> Set, Map
mindex_3 = MemberIndex(Set=sort_list_10.Keys, Member=cset_3.Set)  # -> Index, Count
delete_consecutive = DeleteConsecutive(Set=sort_list_10.Keys, Wrap=False)  # -> Set, Count
list_item_17 = ListItem(List=eval_3.Point, Index=delete_consecutive.Set, Wrap=True)
multiplication_3 = Multiplication(A=mindex_3.Count, B=Slider(376, range=0..1100))
unit_x_6 = UnitX(Factor=multiplication_3)
move_17 = Move(Geometry=graft(list_item_17), Motion=graft(unit_x_6))  # -> Geometry, Transform
unit_y_5 = UnitY(Factor=panel_38)
move_18 = Move(Geometry=list_item_17, Motion=unit_y_5)  # -> Geometry, Transform
move_19 = Move(Geometry=move_17.Geometry, Motion=unit_y_5)  # -> Geometry, Transform
weave_8 = Weave(
    Pattern=[0, 1, 2, 3],
    Stream0=graft(list_item_17),
    Stream1=move_17.Geometry,
    Stream2=move_19.Geometry,
    Stream3=graft(move_18.Geometry),
    NullGaps=False)
polyline_3 = PolyLine(Vertices=weave_8, Closed=True)

# ---- group: orientation to top performing seats (continued)
srf_3 = Surface(polyline_3)
preview_6 = CustomPreview(Geometry=srf_3, Material=material_3)

# ----
unit_y_6 = UnitY(Factor=panel_38)

# ---- group: morpohology and area
dispatch_13 = Dispatch(List=flatten(explode_tree._0010), DispatchPattern=flatten(equals.Equality))  # -> ListA, ListB
dispatch_14 = Dispatch(List=panel_2, DispatchPattern=flatten(equals.Equality))  # -> ListA, ListB
short_9 = ShortestList(ListA=dispatch_13.ListA, ListB=dispatch_14.ListA, TrimMode=2)  # -> ListA, ListB
split_11 = TextSplit(Text=dispatch_14.ListA, Separators="_")
item_5 = ListItem(List=split_11, Index=0, Wrap=True)
bnd_8 = Bounds(Numbers=short_9.ListA)
dom_15 = ConstructDomain(DomainStart=0, DomainEnd=Slider(21000, range=0..100000))
pt_7 = ConstructPoint(XCoordinate="245000", YCoordinate="-50000", ZCoordinate=0)
pt_8 = ConstructPoint(XCoordinate="245000", YCoordinate="-25000", ZCoordinate=0)
len_3 = TextLength(Text=item_5)
panel_40 = Panel(item_5)
remap_9 = RemapNumbers(Value=short_9.ListA, Source=bnd_8, Target=dom_15)  # -> Mapped, Clipped
ln_4 = Line(StartPoint=pt_7, EndPoint=pt_8)
preview_7 = CustomPreview(Geometry=ln_4, Material=ColourSwatch(SwatchColor=RGB(0, 0, 0)))
fragment_4 = TextFragment(Text=item_5, Start=expr("x-1", len_3), Count=1)
remap_10 = RemapNumbers(Value=expr("x+1", item_5), Source=Domain(0, 9), Target=Domain(-0.1, 1))  # -> flatten(Mapped), Clipped
panel_41 = Panel("2500")
dom_16 = ConstructDomain(DomainStart="10000", DomainEnd="20000")
eval_4 = EvaluateCurve(Curve=reparameterize(ln_4), Parameter=remap_10.Mapped)  # -> Point, Tangent, Angle
dom_17 = ConstructDomain(DomainStart=0, DomainEnd="-1000")
range_6 = Range(Domain=dom_16, Steps=Slider(8, range=0..10))
dom_18 = ConstructDomain(DomainStart=0, DomainEnd=remap_9.Mapped)
divide_4 = DivideCurve(Curve=ln_4, Count=Slider(8, range=0..10), Kinks=False)  # -> Points, Tangents, Parameters
panel_42 = Panel(fragment_4)
series_14 = Series(Start=0, Step=1, Count=10)
X_8 = UnitX(Factor="-700")
round_8 = Round(Number=range_6)  # -> Nearest, Floor, Ceiling
rectangle_3 = Rectangle(Plane=eval_4.Point, XSize=dom_18, YSize=dom_17, Radius=0)  # -> Rectangle, Length
move_20 = Move(Geometry=divide_4.Points, Motion=X_8)  # -> Geometry, Transform
concat_3 = Concatenate(FragmentA="Type ", FragmentB=round_8.Nearest)
material_4 = CreateMaterial(
    Diffuse=ColourSwatch(SwatchColor=RGB(60, 255, 0)),
    Specular=RGB(255, 255, 255),
    Emission=RGB(0, 0, 0),
    Transparency=Slider(0.97, range=0..1),
    Shine=0)
tag_4 = TextTag3D(
    Location=move_20.Geometry,
    Text=round_8.Nearest,
    Size=Slider(1000, range=0..10000),
    Colour=ColourSwatch(SwatchColor=RGB(0, 0, 0)),
    Justification=9)

# ----
text_split_2 = TextSplit(Text=dispatch_13.ListA, Separators=".")
list_item_18 = ListItem(List=text_split_2, Index=0, Wrap=True)  # -> flatten(Item)
division_8 = Division(A=list_item_18, B=Slider(1000, range=0..1000))
round_9 = Round(Number=division_8)  # -> Nearest, Floor, Ceiling
sort_list_11 = SortList(Keys=round_9.Nearest)  # -> Keys, ValuesValuesA
cset_4 = CreateSet(List=sort_list_11.Keys)  # -> Set, Map
delete_consecutive_2 = DeleteConsecutive(Set=sort_list_11.Keys, Wrap=False)  # -> Set, Count
mindex_4 = MemberIndex(Set=sort_list_11.Keys, Member=cset_4.Set)  # -> Index, Count
eval_5 = EvaluateCurve(Curve=reparameterize(ln_4), Parameter=range_4)  # -> Point, Tangent, Angle
list_item_19 = ListItem(List=eval_5.Point, Index=delete_consecutive_2.Set, Wrap=True)
multiplication_4 = Multiplication(A=mindex_4.Count, B=Slider(376, range=0..1100))
unit_x_7 = UnitX(Factor=multiplication_4)
move_21 = Move(Geometry=graft(list_item_19), Motion=graft(unit_x_7))  # -> Geometry, Transform
move_22 = Move(Geometry=list_item_19, Motion=unit_y_6)  # -> Geometry, Transform
move_23 = Move(Geometry=move_21.Geometry, Motion=unit_y_6)  # -> Geometry, Transform
weave_9 = Weave(
    Pattern=[0, 1, 2, 3],
    Stream0=graft(list_item_19),
    Stream1=move_21.Geometry,
    Stream2=move_23.Geometry,
    Stream3=graft(move_22.Geometry),
    NullGaps=False)
polyline_4 = PolyLine(Vertices=weave_9, Closed=True)

# ---- group: morpohology and area (continued)
srf_4 = Surface(polyline_4)
preview_8 = CustomPreview(Geometry=srf_4, Material=material_4)
