# Grasshopper definition 06_01_RIBA Stage 1 Defining the Brief Generative Model.gh (Grasshopper 1.0.7)
# plug-ins: Human, HoopSnake, Sasquatch, Wombat, CORE.Toolbox.Grasshopper, Pufferfish

panel = Panel("""15
5
5
15""")
panel_2 = Panel("""5
15""")
panel_3 = Panel("""15
5
5
10""")
panel_4 = Panel("""10
5
15""")
panel_5 = Panel("""15
5
15""")
panel_6 = Panel("""10
15""")
panel_7 = Panel("""15
15""")
entwine = Entwine(
    Branch00="15",
    Branch01="20",
    Branch02=panel_2,
    Branch03="25",
    Branch04=panel_6,
    Branch05=panel_7,
    Branch06=panel_4,
    Branch07=panel_5,
    Branch08=panel_3,
    Branch09=panel,
    FlattenInputs=True)
list_length = ListLength(List=entwine)
text_join = TextJoin(Text=entwine, Join=",")
number_slider = Slider(10, range=0..10)
series = Series(Start=number_slider, Step=number_slider, Count=Slider(10, range=0..10))
repeat_data = RepeatData(Data=graft(series), Length="10")  # -> flatten(Data)
data = Data(Tree({0;0}: ["0", "7", "7", "0", "8", "4", "0", "-11.35", "2", "5", "250", "300", "0"], {1;0;0}: ["5", "19", "12", "3", "22"], {1;0;1}: ["37", "30"], {1;0;2}: ["5", "5", "5", "5", "32"], {1;0;3}: ["41", "32"], {2;0;0}: [".85", ".78", ".78", ".78", ".78", ".78", ".78"]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))
top_gangway_top = SplitTree(Data=data, Masks=flatten("{1;0;0}"))  # -> Positive, Negative
panel_8 = Panel("""1
2""")
series_2 = Series(Start=0, Step=1, Count="9")
repeat_data_2 = RepeatData(Data=graft(series_2), Length="100")  # -> flatten(Data)
series_3 = Series(Start=0, Step=1, Count=Slider(38, range=0..100))
series_4 = Series(Start=1, Step=Slider(2, range=0..10), Count=Slider(38, range=0..100))
series_5 = Series(Start=0, Step=1, Count=Slider(38, range=0..100))
series_6 = Series(Start=0, Step=Slider(2, range=0..10), Count=Slider(38, range=0..100))
series_7 = Series(Start=0, Step=Slider(2, range=0..10), Count=Slider(38, range=0..100))

# ---- group: ellipse
division = Division(A="1", B="8")
division_2 = Division(A="1", B="8")
series_8 = Series(Start=0, Step=division, Count="8")
series_9 = Series(Start=0, Step=division_2, Count="8")
addition = Addition(A=series_9, B="0.0625")
panel_9 = Panel("""0
1""")
dispatch = Dispatch(List=addition, DispatchPattern=panel_9)  # -> ListA, ListB
ellipse = Ellipse(Plane=PlaneXY(0, 0, 0), Radius1=Slider(135, range=0..1000), Radius2=Slider(176, range=0..1000))  # -> Ellipse, Focus1, Focus2
addition_2 = Addition(A=dispatch.ListB, B=".08")
subtraction = Subtraction(A=dispatch.ListA, B=".08")
sort = SortList(Keys=flatten([addition_2, subtraction]))  # -> Keys, ValuesA
shatter = Shatter(Curve=reparameterize(ellipse.Ellipse), Parameters=sort.Keys)
panel_10 = Panel("""1
3
5
7""")
item = ListItem(List=shatter, Index=panel_10, Wrap=True)
end = EndPoints(Curve=item)  # -> Start, End
curvepoint = PointOnCurve(item, parameter=0.5)
panel_11 = Panel("""0
23
0
0""")
pt = ConstructPoint(XCoordinate=0, YCoordinate=0, ZCoordinate=0)
vec2pt = Vector2Pt(PointA=pt, PointB=curvepoint, Unitize=False)  # -> Vector, Length
amp = Amplitude(Vector=vec2pt.Vector, Amplitude=panel_11)
move = Move(Geometry=curvepoint, Motion=amp)  # -> Geometry, Transform
arc = Arc3Pt(PointA=end.Start, PointB=move.Geometry, PointC=end.End)  # -> Arc, Plane, Radius
replace = ReplaceItems(List=shatter, Item=arc.Arc, Indices=panel_10, Wrap=False)
join = JoinCurves(Curves=replace, Preserve=False)
number_slider_2 = Slider(3, range=0..10)
fillet = Fillet(Curve=join, Radius="150")
panel_12 = Panel("""0
1
2
4
5
6
8
9
10
12
13
14""")
explode = Explode(Curve=fillet, Recursive=True)  # -> Segments, Vertices
item_2 = ListItem(List=explode.Segments, Index=panel_12, Wrap=True)
replace_2 = ReplaceItems(List=explode.Segments, Indices=panel_12, Wrap=False)
join_2 = JoinCurves(Curves=item_2, Preserve=False)
clean = CleanTree(RemoveNulls=True, RemoveInvalid=True, RemoveEmpty=False, Tree=replace_2)
reb = RebuildCurve(Curve=join_2, Count=10, Tangents=False)
shift = ShiftList(List=reb, Shift=-1, Wrap=True)
weave = Weave(Pattern=[0, 1], Stream0=shift, Stream1=clean, NullGaps=False)
item_3 = ListItem(List=reb, Index=0, Wrap=True)
join_3 = JoinCurves(Curves=weave, Preserve=False)

# ----
crv = Curve([<curve referenced from the Rhino model> x6])
offset_auditorium_outline = Curve([<curve referenced from the Rhino model> x9])
auditorium_outline = Curve([<curve referenced from the Rhino model> x9])
building_outline = Curve([<curve referenced from the Rhino model> x9])
merge = Merge(Data1=building_outline, Data2=join_3)  # -> flatten(Result)
crv_2 = Curve(<curve referenced from the Rhino model>)
Z = UnitZ(Factor="25")
Z_2 = UnitZ(Factor="25")
Z_3 = UnitZ(Factor="25")
panel_13 = Panel("""0
2
4
6""")
loft_opt = LoftOptions(Closed=False, Adjust=False, Rebuild=0, Refit=1, Type=Slider(1, range=0..10))
number_of_tiers = ValueList({"One": 1, "Two": 2, "Three": 2² - 1, "Four": Sqrt(16)}, selected=["One", "Two", "Three", "Four"])
equality = Equality(FirstNumber=graft(number_of_tiers), SecondNumber=flatten(list_length))  # -> Equality, Inequality
flip_matrix = FlipMatrix(Data=equality.Equality)
sort_list = SortList(Keys=flip_matrix)  # -> reverse(Keys), ValuesValuesA
list_item = ListItem(List=sort_list.Keys, Index=0, Wrap=True)
dispatch_2 = Dispatch(List=flatten(text_join), DispatchPattern=flatten(list_item))  # -> ListA, ListB
list_length_2 = ListLength(List=dispatch_2.ListA)
division_3 = Division(A="100", B=list_length_2)
round = Round(Number=division_3)  # -> Nearest, Floor, Ceiling
repeat_data_3 = RepeatData(Data=graft(dispatch_2.ListA), Length=round.Floor)
repeat_data_4 = RepeatData(Data=flatten(repeat_data_3), Length="100")  # -> flatten(Data)
text_split = TextSplit(Text=repeat_data_4, Separators=",")
panel_14 = Panel(repeat_data_4)
tree_statistics = TreeStatistics(Tree=text_split)  # -> Paths, Length, Count
maximum_capacity = Panel("1000")
maximum_capacity_2 = Panel("40000")
centre_of_playing_field_coordinates = Panel("0,0")
masterplan_entry_points_coordinates = Panel("""-194.285876,-57.380534
-69.40965,-150.096893
173.905901,-101.311259""")
masterplan_outline_optional = Curve(<curve referenced from the Rhino model>)

# ---- group: Set this path to a folder on local drive
output_folder = Panel("C:\AOMSDML\Stage 1")

# ----
text_split_2 = TextSplit(Text=centre_of_playing_field_coordinates, Separators=",")
# Input
text_split_3 = TextSplit(Text=masterplan_entry_points_coordinates, Separators=",")
list_item_2 = ListItem(List=text_split_2, Index=0, Wrap=True)  # -> Item, Item1
list_item_3 = ListItem(List=text_split_3, Index=0, Wrap=True)  # -> Item, Item1
construct_point = ConstructPoint(XCoordinate=list_item_2.Item, YCoordinate=list_item_2.Item1, ZCoordinate=0)  # -> flatten(Point)
xz = XZPlane(Origin=construct_point)
construct_point_2 = ConstructPoint(XCoordinate=list_item_3.Item, YCoordinate=list_item_3.Item1, ZCoordinate=0)  # -> flatten(Point)
polyline = PolyLine(Vertices=construct_point_2, Closed=True)
curve = Curve([masterplan_outline_optional, polyline])
clean_tree = CleanTree(RemoveNulls=True, RemoveInvalid=True, RemoveEmpty=True, Tree=curve)
list_item_4 = ListItem(List=clean_tree, Index=0, Wrap=True)
point = Point(construct_point_2)
panel_15 = Panel(point)
xy_plane = XYPlane(Origin=Point(0, 0, 0))
construct_domain = ConstructDomain(DomainStart="-15", DomainEnd="75")
range = Range(Domain=construct_domain, Steps=Slider(9, range=0..10))  # -> reverse(Range)
point_2 = Point(construct_point_2)
curve_closest_point = CurveClosestPoint(Point=construct_point_2, Curve=list_item_4)  # -> Point, Parameter, Distance
xy_plane_2 = XYPlane(Origin=Point(0, 0, 0))
shatter_2 = Shatter(Curve=list_item_4, Parameters=curve_closest_point.Parameter)
list_length_3 = ListLength(List=repeat_data_2)

# ---- group: Reset record
# Intiate generation
button = Button()

# ----
curve_2 = Curve([<curve referenced from the Rhino model> x17])
point_on_curve = PointOnCurve(shatter_2, parameter=0.5)
curve_3 = Curve(list_item_4)
pull_point = PullPoint(Point=point_2, Geometry=curve_3, ClosestOnly=True)  # -> ClosestPoint, Distance
vector_2pt = Vector2Pt(PointA="0,0,0", PointB=centre_of_playing_field_coordinates, Unitize=False)  # -> Vector, Length
xy_plane_3 = XYPlane(Origin=construct_point)
circle = Circle(Plane=point_2, Radius=Slider(10, range=0..10))
move_2 = Move(Geometry=curve_2, Motion=vector_2pt.Vector)  # -> Geometry, Transform
custom_preview_lineweights = CustomPreviewLineweights(Geometry=circle, Shader=ColourSwatch(SwatchColor=RGB(255, 0, 0)), Thickness="15", Absolute=False)
custom_preview_lineweights_2 = CustomPreviewLineweights(Geometry=curve_3, Shader=ColourSwatch(SwatchColor=RGB(125, 125, 125)), Thickness=Slider(10, range=0..10), Absolute=False)
join_curves = JoinCurves(Curves=curve_3, Preserve=False)
boundary_surfaces = BoundarySurfaces(Edges=curve_3)
panel_16 = Panel(output_folder)
concatenate = Concatenate(FragmentA=output_folder, FragmentB="\data.txt")

# ---- group: module 01
Z_4 = UnitZ(Factor="-25")
Y = UnitY(Factor="7.5")

# ----
Z_5 = UnitZ(Factor="-25")
Y_2 = UnitY(Factor="7.5")

Z_6 = UnitZ(Factor="-25")
Y_3 = UnitY(Factor="7.5")
Z_7 = UnitZ(Factor="25")

Z_8 = UnitZ(Factor="-25")
Y_4 = UnitY(Factor="7.5")

# ---- group: bowl
crv_3 = Curve(<curve referenced from the Rhino model>)
fillet_2 = Fillet(Curve=crv_3, Radius="30")
Z_9 = UnitZ(Factor="150")
material = CreateMaterial(
    Diffuse=ColourSwatch(SwatchColor=RGB(255, 255, 255)),
    Specular=RGB(255, 255, 255),
    Emission=RGB(0, 0, 0),
    Transparency=0,
    Shine=0)

# ---- group: gangways
number_slider_3 = Slider(1.2, range=0..10)

# ---- group: C Value calculation
panel_17 = Panel("8")

# ---- group: Feasibility test
panel_18 = Panel("""1
0""")

# ---- group: masterplan distance
panel_19 = Panel("Top view print 2")
panel_20 = Panel("3")

# ----
list_item_5 = ListItem(List=tree_statistics.Paths, Index=panel_61, Wrap=True)
tree_branch = TreeBranch(Tree=text_split, Path=list_item_5, MaintainPaths=True)
list_length_4 = ListLength(List=tree_branch)
series_10 = Series(Start=0, Step=1, Count=list_length_4)
replace_items = ReplaceItems(List=top_gangway_top.Positive, Item=tree_branch, Indices=series_10, Wrap=True)
split_list = SplitList(List=replace_items, Index=list_length_4)  # -> ListA, ListB
trim_tree = TrimTree(Tree=split_list.ListA, Depth=2)
merge_2 = Merge(Data1=trim_tree, Data2=top_gangway_top.Negative)
panel_21 = Panel(trim_tree)
top_gangway_top_2 = SplitTree(Data=merge_2, Masks=flatten("{0;0}"))  # -> Positive, Negative
panel_22 = Panel(top_gangway_top_2.Positive)
mass_addition = MassAddition(Input=split_list.ListA)  # -> Result, PartialResults
addition_3 = Addition(A=flatten(mass_addition.Result), B="1")
list_item_6 = ListItem(List=repeat_data, Index=panel_61, Wrap=True)
addition_4 = Addition(A=list_item_6, B="2")
replace_3 = ReplaceItems(List=top_gangway_top_2.Positive, Item=list_item_19, Indices=panel_8, Wrap=False)
pshift = ShiftPaths(Data=replace_3, Offset=-1)
merge_3 = Merge(Data1=pshift, Data2=top_gangway_top_2.Negative)
panel_23 = Panel(pshift)
top_gangway_top_3 = SplitTree(Data=merge_3, Masks=flatten("{11;0;1}"))  # -> Positive, Negative
panel_24 = Panel(top_gangway_top_3.Positive)
list_item_7 = ListItem(List=top_gangway_top_3.Positive, Index="0", Wrap=True)
replace_4 = ReplaceItems(List=list_item_7, Item="1", Indices="0", Wrap=False)
pshift_2 = ShiftPaths(Data=replace_4, Offset=-1)
merge_4 = Merge(Data1=pshift_2, Data2=top_gangway_top_3.Negative)
top_gangway_top_4 = SplitTree(Data=merge_4, Masks=flatten("{16;0;0}"))  # -> Positive, Negative
panel_26 = Panel(top_gangway_top_4.Positive)
list_item_8 = ListItem(List=top_gangway_top_4.Positive, Index="0", Wrap=True)
replace_5 = ReplaceItems(List=list_item_8, Item=".5", Indices="0", Wrap=False)
pshift_3 = ShiftPaths(Data=replace_5, Offset=-1)
merge_5 = Merge(Data1=pshift_3, Data2=top_gangway_top_4.Negative)
top_gangway_top_5 = SplitTree(Data=merge_5, Masks=flatten("{18;0;3}"))  # -> Positive, Negative
panel_28 = Panel(top_gangway_top_5.Positive)
list_item_9 = ListItem(List=top_gangway_top_5.Positive, Index=series_3, Wrap=True)
replace_6 = ReplaceItems(List=list_item_9, Item=series_4, Indices="0", Wrap=False)
panel_30 = Panel(list_item_9)
pshift_4 = ShiftPaths(Data=replace_6, Offset=-1)
merge_6 = Merge(Data1=pshift_4, Data2=top_gangway_top_5.Negative)
top_gangway_top_6 = SplitTree(Data=merge_6, Masks=flatten("{18;0;7}"))  # -> Positive, Negative
list_item_10 = ListItem(List=top_gangway_top_6.Positive, Index=series_5, Wrap=True)
panel_31 = Panel(top_gangway_top_6.Positive)
replace_7 = ReplaceItems(List=list_item_10, Item=series_6, Indices="0", Wrap=False)
pshift_5 = ShiftPaths(Data=replace_7, Offset=-1)
merge_7 = Merge(Data1=pshift_5, Data2=top_gangway_top_6.Negative)
top_gangway_top_7 = SplitTree(Data=merge_7, Masks=flatten("{18;0;1}"))  # -> Positive, Negative
list_item_11 = ListItem(List=top_gangway_top_7.Positive, Index="0", Wrap=True)
panel_33 = Panel(top_gangway_top_7.Positive)
replace_8 = ReplaceItems(List=list_item_11, Item=flatten(mass_addition.Result), Indices="0", Wrap=False)
pshift_6 = ShiftPaths(Data=replace_8, Offset=-1)
merge_8 = Merge(Data1=pshift_6, Data2=top_gangway_top_7.Negative)
top_gangway_top_8 = SplitTree(Data=merge_8, Masks=flatten("{18;0;4}"))  # -> Positive, Negative
list_item_12 = ListItem(List=top_gangway_top_8.Positive, Index="0", Wrap=True)
panel_34 = Panel(top_gangway_top_8.Positive)
panel_35 = Panel(pshift_6)
replace_9 = ReplaceItems(List=list_item_12, Item=addition_3, Indices="0", Wrap=False)
pshift_7 = ShiftPaths(Data=replace_9, Offset=-1)
tree_statistics_2 = TreeStatistics(Tree=pshift_7)  # -> Paths, Length, Count
merge_9 = Merge(Data1=pshift_7, Data2=top_gangway_top_8.Negative)
top_gangway_top_9 = SplitTree(Data=merge_9, Masks=flatten("{18;0;5}"))  # -> Positive, Negative
list_item_13 = ListItem(List=top_gangway_top_9.Positive, Index="0", Wrap=True)
panel_36 = Panel(top_gangway_top_9.Positive)
replace_10 = ReplaceItems(List=list_item_13, Item=addition_4, Indices="0", Wrap=False)
pshift_8 = ShiftPaths(Data=replace_10, Offset=-1)
merge_10 = Merge(Data1=pshift_8, Data2=top_gangway_top_9.Negative)
top_gangway_top_10 = SplitTree(Data=merge_10, Masks=flatten("{8;0;0}"))  # -> Positive, Negative
panel_37 = Panel(top_gangway_top_10.Positive)
list_item_14 = ListItem(List=top_gangway_top_10.Positive, Index=0, Wrap=True)
replace_11 = ReplaceItems(List=list_item_14, Indices="0", Wrap=False)
pshift_9 = ShiftPaths(Data=replace_11, Offset=-1)
clean_tree_2 = CleanTree(RemoveNulls=True, RemoveInvalid=True, RemoveEmpty=False, Tree=pshift_9)
merge_11 = Merge(Data1=clean_tree_2, Data2=top_gangway_top_10.Negative)
tokyo = Data(merge_11)
split = SplitTree(Data=tokyo, Masks=flatten("{11;?;?}"))  # -> Positive, Negative
split_2 = SplitTree(Data=tokyo, Masks=flatten("{12;?;?}"))  # -> Positive, Negative
split_3 = SplitTree(Data=tokyo, Masks=flatten("{10;?;?}"))  # -> Positive, Negative
split_4 = SplitTree(Data=tokyo, Masks=flatten("{4;?;?}"))  # -> Positive, Negative
split_5 = SplitTree(Data=tokyo, Masks=flatten("{5;?;?}"))  # -> Positive, Negative
split_6 = SplitTree(Data=tokyo, Masks=flatten("{9;?;?}"))  # -> Positive, Negative
split_7 = SplitTree(Data=tokyo, Masks=flatten("{3;?;?}"))  # -> Positive, Negative
split_8 = SplitTree(Data=tokyo, Masks=flatten("{7;?;?}"))  # -> Positive, Negative
split_9 = SplitTree(Data=tokyo, Masks=flatten("{8;?;?}"))  # -> Positive, Negative
split_10 = SplitTree(Data=tokyo, Masks=flatten("{6;?;?}"))  # -> Positive, Negative
split_11 = SplitTree(Data=tokyo, Masks=flatten("{2;?;?}"))  # -> Positive, Negative
split_12 = SplitTree(Data=tokyo, Masks=flatten("{1;?;?}"))  # -> Positive, Negative
split_13 = SplitTree(Data=tokyo, Masks=flatten("{0;?}"))  # -> Positive, Negative
split_14 = SplitTree(Data=tokyo, Masks=flatten("{13;?;?;?}"))  # -> Positive, Negative
split_15 = SplitTree(Data=tokyo, Masks=flatten("{14;?;?}"))  # -> Positive, Negative
split_16 = SplitTree(Data=tokyo, Masks=flatten("{15;?}"))  # -> Positive, Negative
bang = ExplodeTree(Data=split_3.Positive)  # -> Branch0, Branch1
bang_2 = ExplodeTree(Data=split.Positive)  # -> Branch0, Branch1
split_17 = SplitTree(Data=tokyo, Masks=flatten("{20;?;?}"))  # -> Positive, Negative
split_18 = SplitTree(Data=tokyo, Masks=flatten("{18;?;?}"))  # -> Positive, Negative
bang_3 = ExplodeTree(Data=split_10.Positive)  # -> Branch0, Branch1, Branch2, Branch3
split_19 = SplitTree(Data=tokyo, Masks=flatten("{16;?;?}"))  # -> Positive, Negative
bang_4 = ExplodeTree(Data=split_12.Positive)  # -> Branch0, Branch1, Branch2, Branch3
bang_5 = ExplodeTree(Data=split_11.Positive)  # -> Branch0, Branch1, Branch2, Branch3
bang_6 = ExplodeTree(Data=split_7.Positive)  # -> Branch0, Branch1, Branch2, Branch3
bang_7 = ExplodeTree(Data=split_4.Positive)  # -> Branch0, Branch1, Branch2, Branch3
bang_8 = ExplodeTree(Data=split_5.Positive)  # -> Branch0, Branch1, Branch2, Branch3
bang_9 = ExplodeTree(Data=split_6.Positive)  # -> Branch0, Branch1
bang_10 = ExplodeTree(Data=split_2.Positive)  # -> Branch0, Branch1, Branch2, Branch3, Branch4, Branch5, Branch6
bang_11 = ExplodeTree(Data=split_8.Positive)  # -> Branch0, Branch1
split_20 = SplitTree(Data=tokyo, Masks=flatten("{17;?;?}"))  # -> Positive, Negative
bang_12 = ExplodeTree(Data=split_9.Positive)  # -> Branch0, Branch1, Branch2
split_21 = SplitTree(Data=tokyo, Masks=flatten("{19;0;?}"))  # -> Positive, Negative
item_4 = ListItem(List=split_13.Positive, Index=0, Wrap=True)  # -> Item, Item1, Item2, Item3, Item4, Item5, Item6, Item7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
tree_statistics_3 = TreeStatistics(Tree=split_14.Positive)  # -> Paths, Length, Count
bang_13 = ExplodeTree(Data=split_15.Positive)  # -> Branch0, Branch1, Branch2, Branch3, Branch4, Branch5
bang_14 = ExplodeTree(Data=split_17.Positive)  # -> Branch0, Branch1, Branch2
bang_15 = ExplodeTree(Data=split_19.Positive)  # -> Branch0, Branch1, Branch2
bang_16 = ExplodeTree(Data=split_20.Positive)  # -> Branch0, Branch1, Branch2, Branch3
bang_17 = ExplodeTree(Data=split_21.Positive)  # -> Branch0, Branch1, Branch2, Branch3, Branch4
panel_39 = Panel(tree_statistics_3.Paths)
ma = MassAddition(Input=bang_4.Branch0)  # -> Result, PartialResults
ma_2 = MassAddition(Input=bang_4.Branch1)  # -> Result, PartialResults
ma_3 = MassAddition(Input=bang_4.Branch2)  # -> Result, PartialResults
ma_4 = MassAddition(Input=bang_4.Branch3)  # -> Result, PartialResults
merge_12 = Merge(Data1=ma.Result, Data2=ma_2.Result, Data3=ma_3.Result, Data4=ma_4.Result)
item_5 = ListItem(List=crv, Index=item_4.Item12, Wrap=True)
panel_40 = Panel(bang_4.Branch0)
boundary = BoundarySurfaces(Edges=item_5)
sort_2 = SortList(Keys=flatten(merge_12))  # -> reverse(Keys), ValuesA
item_6 = ListItem(List=sort_2.Keys, Index=0, Wrap=True)

preview = CustomPreview(Geometry=boundary, Material=ColourSwatch(SwatchColor=RGB(18, 110, 0)))

item_7 = ListItem(List=merge, Index=item_4.Item2, Wrap=True)
item_8 = ListItem(List=offset_auditorium_outline, Index=item_4.Item1, Wrap=True)
item_9 = ListItem(List=auditorium_outline, Index=item_4.Item1, Wrap=True)
area = Area(Geometry=item_8)  # -> Area, Centroid
vector_2pt_2 = Vector2Pt(PointA=area.Centroid, PointB=construct_point, Unitize=False)  # -> Vector, Length
move_3 = Move(Geometry=crv_2, Motion=vector_2pt_2.Vector)  # -> Geometry, Transform
move_4 = Move(Geometry=item_7, Motion=vector_2pt_2.Vector)  # -> Geometry, Transform
move_5 = Move(Geometry=item_9, Motion=vector_2pt_2.Vector)  # -> Geometry, Transform
move_6 = Move(Geometry=item_8, Motion=vector_2pt_2.Vector)  # -> Geometry, Transform
pcx = CurvePlane(Curve=move_5.Geometry, Plane=xz)  # -> Points, ParamsC, ParamsP
item_10 = ListItem(List=pcx.Points, Index=0, Wrap=True)  # -> Item, Item1
pull = PullPoint(Point=item_10.Item, Geometry=move_3.Geometry, ClosestOnly=True)  # -> ClosestPoint, Distance
panel_41 = Panel(bang_9.Branch1)
explode_2 = Explode(Curve=move_5.Geometry, Recursive=True)  # -> Segments, Vertices
len = Length(Curve=explode_2.Segments)
division_4 = Division(A=len, B=panel_41)
int = Integer(division_4)

# ---- group: even number of sector divisions
lng = ListLength(List=int)
smaller = SmallerThan(FirstNumber=division_4, SecondNumber=Slider(4, range=0..10))  # -> SmallerThan, OrEqualTo
series_11 = Series(Start=0, Step=1, Count=lng)
dispatch_3 = Dispatch(List=series_11, DispatchPattern=smaller.SmallerThan)  # -> ListA, ListB
replace_12 = ReplaceItems(List=int, Item="4", Indices=dispatch_3.ListA, Wrap=False)
int_2 = Integer(replace_12)
division_5 = Division(A=int_2, B="2")
split_22 = TextSplit(Text=division_5, Separators=".")
item_11 = ListItem(List=split_22, Index=0, Wrap=True)
multiplication = Multiplication(A=item_11, B=2)  # -> flatten(Result)

# ----
panel_42 = Panel(item_4.Item8)
series_12 = Series(Start=0, Step=item_4.Item7, Count=panel_42)
offset = OffsetCurve(Curve=move_4.Geometry, Distance=series_12, Corners=1)
item_12 = ListItem(List=flatten(offset), Index=0, Wrap=True)
explode_3 = Explode(Curve=item_12, Recursive=True)  # -> Segments, Vertices
end_2 = EndPoints(Curve=move_5.Geometry)  # -> Start, End
end_3 = EndPoints(Curve=move_4.Geometry)  # -> Start, End
rev = ReverseList(List=flatten(offset))  # -> graft(List)
replace_13 = ReplaceItems(List=multiplication, Item=item_4.Item5, Indices=panel_13, Wrap=False)
divide = DivideCurve(Curve=graft(explode_3.Segments), Count=graft(replace_13), Kinks=False)  # -> Points, Tangents, Parameters
divide_2 = DivideCurve(Curve=graft(explode_2.Segments), Count=graft(replace_13), Kinks=False)  # -> Points, Tangents, Parameters
ln = Line(StartPoint=divide_2.Points, EndPoint=divide.Points)
dist = Distance(PointA=end_2.Start, PointB=end_3.Start)

bowl_section = BB_BowlSection(
    touchline=move_3.Geometry,
    outline=move_5.Geometry,
    setDistance=pull.Distance,
    rows=bang_4.Branch3,
    stepDepths=bang_5.Branch3,
    landingDepths=bang_16.Branch3,
    floorHeights=bang_6.Branch3,
    cantilevers=bang_8.Branch3,
    cValues=bang_7.Branch3)  # -> section, sightlines, sectionInfo; inputs touchline: Curve, outline: list of Curve, rows: list of Int32, stepDepths: list, landingDepths: list, floorHeights: list, cantilevers: list, seatOffsets: list, cValues: list, stepHeights: list; plug-in component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
end_4 = EndPoints(Curve=bowl_section.sightlines)  # -> Start, End
end_5 = EndPoints(Curve=bowl_section.section)  # -> Start, End
move_7 = Move(Geometry=end_5.Start, Motion=Z_6)  # -> Geometry, Transform
ln_2 = Line(StartPoint=end_5.Start, EndPoint=move_7.Geometry)
join_4 = JoinCurves(Curves=[ln_2, bowl_section.section], Preserve=False)
pt_2 = ConstructPoint(XCoordinate=0, YCoordinate=0, ZCoordinate=bang_3.Branch0)
crv_4 = Curve(bowl_section.section)
xy = XYPlane(Origin=pt_2)
end_6 = EndPoints(Curve=bowl_section.section)  # -> Start, End
panel_43 = Panel(bang_9.Branch0)
move_8 = Move(Geometry=crv_4, Motion=Y_3)  # -> Geometry, Transform
move_9 = Move(Geometry=end_4.Start, Motion=Y_3)  # -> Geometry, Transform
bbox = BoundingBox(Content=[crv_4, move_8.Geometry], Plane=PlaneXY(0, 0, 0), UnionBox=True)  # -> Box, Box_2
panel_44 = Panel(dist)
debrep = DeconstructBrep(Brep=bbox.Box)  # -> Faces, Edges, Vertices
division_6 = Division(A=panel_44, B=panel_43)
item_13 = ListItem(List=debrep.Faces, Index=5, Wrap=True)
split_23 = TextSplit(Text=division_6, Separators=".")
move_10 = Move(Geometry=item_13, Motion=Z_7)  # -> Geometry, Transform
item_14 = ListItem(List=split_23, Index=0, Wrap=True)
ln_3 = Line(StartPoint=end_4.Start, EndPoint=move_9.Geometry)
series_13 = Series(Start=0, Step=panel_43, Count=item_14)
mesh = MeshBrep(
    Brep=move_10.Geometry,
    Settings={GridMaxCount=0, GridMinCount=16, JaggedSeams=False, MaxEdgeLength=0, MinEdgeLength=0.0001, MinTolerance=0, Refine=True, RefineAngle=0, RelativeTolerance=0.65, SimplePlanes=True, Tolerance=0})
X = UnitX(Factor=panel_44)
X_2 = UnitX(Factor=series_13)
pcx_2 = CurvePlane(Curve=join_4, Plane=xy)  # -> flatten(Points), ParamsC, ParamsP
mcol = MeshColours(Mesh=mesh, Colours=ColourSwatch(SwatchColor=RGB(0, 25, 87)))
move_11 = Move(Geometry=end_6.Start, Motion=X_2)  # -> Geometry, Transform
move_12 = Move(Geometry=end_6.Start, Motion=X)  # -> Geometry, Transform
group = Group(Objects=ln_3)
pdecon = Deconstruct(Point=move_11.Geometry)  # -> XComponent, YComponent, ZComponent
pdecon_2 = Deconstruct(Point=pcx_2.Points)  # -> XComponent, YComponent, ZComponent
ln_4 = Line(StartPoint=end_6.Start, EndPoint=move_12.Geometry)
move_13 = Move(Geometry=ln_4, Motion=Y_3)  # -> Geometry, Transform
larger = LargerThan(FirstNumber=graft(pdecon_2.XComponent), SecondNumber=pdecon.XComponent)  # -> LargerThan, OrEqualTo
group_2 = Group(Objects=[crv_4, move_8.Geometry])
loft = Loft(
    Curves=[ln_4, move_13.Geometry],
    Options={Adjust=False, Closed=False, LoftEnds=0, LoftSimp=0, LoftType=0, Rebuild=10, Refit=0.01})
dispatch_4 = Dispatch(List=pdecon.XComponent, DispatchPattern=larger.LargerThan)  # -> ListA, ListB
pt_3 = ConstructPoint(XCoordinate=dispatch_4.ListB, YCoordinate=0, ZCoordinate=graft(pdecon_2.ZComponent))
srf_cp = SurfaceClosestPoint(Point=end_6.Start, Surface=loft)  # -> Point, UVPoint, Distance
replace_14 = ReplaceItems(List=pt_3, Item=graft(pcx_2.Points), Indices=0, Wrap=False)
cullpt = CullDuplicates(Points=replace_14, Tolerance="1", CullMode=3)  # -> Points, Indices, Valence
pline = PolyLine(Vertices=cullpt.Points, Closed=False)
explode_4 = Explode(Curve=pline, Recursive=True)  # -> Segments, Vertices
move_14 = Move(Geometry=explode_4.Segments, Motion=Y_3)  # -> Geometry, Transform
weave_2 = Weave(Pattern=[0, 1], Stream0=graft(move_14.Geometry), Stream1=graft(explode_4.Segments), NullGaps=False)
loft_2 = Loft(Curves=weave_2, Options={Adjust=False, Closed=False, LoftEnds=0, LoftSimp=0, LoftType=0, Rebuild=10, Refit=0.01})
debrep_2 = DeconstructBrep(Brep=loft_2)  # -> Faces, Edges, Vertices
end_7 = EndPoints(Curve=debrep_2.Edges)  # -> Start, End
pline_2 = PolyLine(Vertices=end_7.Start, Closed=True)
join_5 = JoinCurves(Curves=pline_2, Preserve=False)
trim = TrimTree(Tree=join_5, Depth=3)
split_24 = SplitList(List=reverse(trim), Index=1)  # -> ListA, reverse(ListB)
group_3 = Group(Objects=split_24.ListB)
group_4 = Group(Objects=flatten(group_3))
entwine_2 = Entwine(Branch00=group, Branch01=group_2, Branch02=group_4, Branch03=mcol, FlattenInputs=True)
group_5 = Group(Objects=flatten(entwine_2))

addition_5 = Addition(A=dist, B="14")
panel_45 = Panel(replace_13)
series_14 = Series(Start=0, Step=bang_9.Branch0, Count=item_4.Item4)
offset_l = OffsetCurveLoose(Curve=move_6.Geometry, Distance=expr("x+.1", series_14))
ccx = CurveCurve(CurveA=graft(rev), CurveB=flatten(ln))  # -> Points, ParamsA, ParamsB
ccx_2 = CurveCurve(CurveA=graft(offset_l), CurveB=flatten(ln))  # -> Points, ParamsA, ParamsB
trim_2 = TrimTree(Tree=ccx.Points, Depth=1)
trim_3 = TrimTree(Tree=ccx_2.Points, Depth=1)
cullpt_2 = CullDuplicates(Points=trim_2, Tolerance=0.1, CullMode=3)  # -> Points, Indices, Valence
cullpt_3 = CullDuplicates(Points=trim_3, Tolerance=0.1, CullMode=3)  # -> Points, Indices, Valence
pline_3 = PolyLine(Vertices=cullpt_2.Points, Closed=True)  # -> flatten(Polyline)
pline_4 = PolyLine(Vertices=cullpt_3.Points, Closed=True)
flatten = FlattenTree(Tree=pline_4, Path="{0}")
item_15 = ListItem(List=reverse(flatten), Index=0, Wrap=True)
item_16 = ListItem(List=reverse(pline_3), Index=0, Wrap=True)
item_17 = ListItem(List=pline_3, Index=bang_13.Branch5, Wrap=True)
explode_5 = Explode(Curve=item_15, Recursive=True)  # -> Segments, Vertices
explode_6 = Explode(Curve=item_16, Recursive=True)  # -> Segments, Vertices
division_7 = Division(A="1", B=item_4.Item6)
explode_7 = Explode(Curve=pline_3, Recursive=True)  # -> Segments, Vertices
explode_8 = Explode(Curve=flatten, Recursive=True)  # -> Segments, Vertices
series_15 = Series(Start=division_7, Step=division_7, Count=expr("x-1", item_4.Item6))
flip = FlipMatrix(Data=explode_7.Segments)  # -> simplify(Data)
flip_2 = FlipMatrix(Data=explode_8.Segments)  # -> simplify(Data)
tweencrv = TweenCurve(CurveA=graft(explode_5.Segments), CurveB=graft(explode_6.Segments), Factor=series_15, BlendType=0)  # -> simplify(Tween)
merge_13 = Merge(Data1=flip_2, Data2=tweencrv, Data3=flip)
loft_3 = Loft(Curves=merge_13, Options=loft_opt)  # -> flatten(Loft)
shift_2 = ShiftList(List=loft_3, Shift=-1, Wrap=True)
debrep_3 = DeconstructBrep(Brep=shift_2)  # -> Faces, Edges, Vertices
item_18 = ListItem(List=debrep_3.Vertices, Index=Slider(0, range=0..10), Wrap=True)  # -> flatten(Item)
lng_2 = ListLength(List=shift_2)
srf_cp_2 = SurfaceClosestPoint(Point=item_18, Surface=shift_2)  # -> Point, UVPoint, Distance
repeat = RepeatData(Data=bang_11.Branch0, Length=lng_2)
sift = SiftPattern(List=shift_2, SiftPattern=repeat)  # -> Output0, Output1, Output2, Output3
sift_2 = SiftPattern(List=srf_cp_2.UVPoint, SiftPattern=repeat)  # -> Output0, Output1, Output2, Output3
clean_2 = CleanTree(RemoveNulls=True, RemoveInvalid=True, RemoveEmpty=False, Tree=sift.Output0)
clean_3 = CleanTree(RemoveNulls=True, RemoveInvalid=True, RemoveEmpty=False, Tree=sift.Output1)
clean_4 = CleanTree(RemoveNulls=True, RemoveInvalid=True, RemoveEmpty=False, Tree=sift.Output2)
clean_5 = CleanTree(RemoveNulls=True, RemoveInvalid=True, RemoveEmpty=False, Tree=sift.Output3)
clean_6 = CleanTree(RemoveNulls=True, RemoveInvalid=True, RemoveEmpty=False, Tree=sift_2.Output0)
clean_7 = CleanTree(RemoveNulls=True, RemoveInvalid=True, RemoveEmpty=False, Tree=sift_2.Output1)
clean_8 = CleanTree(RemoveNulls=True, RemoveInvalid=True, RemoveEmpty=False, Tree=sift_2.Output2)
clean_9 = CleanTree(RemoveNulls=True, RemoveInvalid=True, RemoveEmpty=False, Tree=sift_2.Output3)
panel_46 = Panel(bang_2.Branch0)
bang_18 = ExplodeTree(Data=split_18.Positive)  # -> Branch0, Branch1, Branch2, Branch3, Branch4, Branch5, Branch6, Branch7
text_join_2 = TextJoin(Text=bang_4.Branch3, Join=",")
text_join_3 = TextJoin(Text=bang_4.Branch1, Join=",")
text_join_4 = TextJoin(Text=bang_4.Branch2, Join=",")
text_join_5 = TextJoin(Text=bang_4.Branch0, Join=",")
weave_3 = Weave(
    Pattern=graft(repeat),
    Stream0=text_join_5,
    Stream1=text_join_3,
    Stream2=text_join_4,
    Stream3=text_join_2,
    NullGaps=False)  # -> flatten(Weave)
text_split_4 = TextSplit(Text=weave_3, Separators=",")
panel_47 = Panel(bang_18.Branch7)
addition_6 = Addition(A=bang_18.Branch5, B="46")

bowl_section_2 = BB_BowlSection(
    touchline=move_3.Geometry,
    outline=move_5.Geometry,
    setDistance=pull.Distance,
    rows=bang_4.Branch2,
    stepDepths=bang_5.Branch2,
    landingDepths=bang_16.Branch2,
    floorHeights=bang_6.Branch2,
    cantilevers=bang_8.Branch2,
    cValues=bang_7.Branch2)  # -> section, sightlines, sectionInfo; inputs touchline: Curve, outline: list of Curve, rows: list of Int32, stepDepths: list, landingDepths: list, floorHeights: list, cantilevers: list, seatOffsets: list, cValues: list, stepHeights: list; plug-in component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
end_8 = EndPoints(Curve=bowl_section_2.sightlines)  # -> Start, End
end_9 = EndPoints(Curve=bowl_section_2.section)  # -> Start, End
move_15 = Move(Geometry=end_9.Start, Motion=Z_5)  # -> Geometry, Transform
ln_5 = Line(StartPoint=end_9.Start, EndPoint=move_15.Geometry)
join_6 = JoinCurves(Curves=[ln_5, bowl_section_2.section], Preserve=False)
pt_4 = ConstructPoint(XCoordinate=0, YCoordinate=0, ZCoordinate=bang_3.Branch0)
crv_5 = Curve(bowl_section_2.section)
xy_2 = XYPlane(Origin=pt_4)
end_10 = EndPoints(Curve=bowl_section_2.section)  # -> Start, End
panel_48 = Panel(bang_9.Branch0)
move_16 = Move(Geometry=crv_5, Motion=Y_2)  # -> Geometry, Transform
move_17 = Move(Geometry=end_8.Start, Motion=Y_2)  # -> Geometry, Transform
panel_49 = Panel(dist)
division_8 = Division(A=panel_49, B=panel_48)
split_25 = TextSplit(Text=division_8, Separators=".")
item_19 = ListItem(List=split_25, Index=0, Wrap=True)
ln_6 = Line(StartPoint=end_8.Start, EndPoint=move_17.Geometry)
series_16 = Series(Start=0, Step=panel_48, Count=item_19)
X_3 = UnitX(Factor=panel_49)
X_4 = UnitX(Factor=series_16)
pcx_3 = CurvePlane(Curve=join_6, Plane=xy_2)  # -> flatten(Points), ParamsC, ParamsP
move_18 = Move(Geometry=end_10.Start, Motion=X_4)  # -> Geometry, Transform
move_19 = Move(Geometry=end_10.Start, Motion=X_3)  # -> Geometry, Transform
group_6 = Group(Objects=ln_6)
pdecon_3 = Deconstruct(Point=move_18.Geometry)  # -> XComponent, YComponent, ZComponent
pdecon_4 = Deconstruct(Point=pcx_3.Points)  # -> XComponent, YComponent, ZComponent
ln_7 = Line(StartPoint=end_10.Start, EndPoint=move_19.Geometry)
move_20 = Move(Geometry=ln_7, Motion=Y_2)  # -> Geometry, Transform
larger_2 = LargerThan(FirstNumber=graft(pdecon_4.XComponent), SecondNumber=pdecon_3.XComponent)  # -> LargerThan, OrEqualTo
group_7 = Group(Objects=[crv_5, move_16.Geometry])
loft_4 = Loft(
    Curves=[ln_7, move_20.Geometry],
    Options={Adjust=False, Closed=False, LoftEnds=0, LoftSimp=0, LoftType=0, Rebuild=10, Refit=0.01})
dispatch_5 = Dispatch(List=pdecon_3.XComponent, DispatchPattern=larger_2.LargerThan)  # -> ListA, ListB
pt_5 = ConstructPoint(XCoordinate=dispatch_5.ListB, YCoordinate=0, ZCoordinate=graft(pdecon_4.ZComponent))
srf_cp_3 = SurfaceClosestPoint(Point=end_10.Start, Surface=loft_4)  # -> Point, UVPoint, Distance
replace_15 = ReplaceItems(List=pt_5, Item=graft(pcx_3.Points), Indices=0, Wrap=False)
cullpt_4 = CullDuplicates(Points=replace_15, Tolerance="1", CullMode=3)  # -> Points, Indices, Valence
pline_5 = PolyLine(Vertices=cullpt_4.Points, Closed=False)
explode_9 = Explode(Curve=pline_5, Recursive=True)  # -> Segments, Vertices
move_21 = Move(Geometry=explode_9.Segments, Motion=Y_2)  # -> Geometry, Transform
weave_4 = Weave(Pattern=[0, 1], Stream0=graft(move_21.Geometry), Stream1=graft(explode_9.Segments), NullGaps=False)
loft_5 = Loft(Curves=weave_4, Options={Adjust=False, Closed=False, LoftEnds=0, LoftSimp=0, LoftType=0, Rebuild=10, Refit=0.01})
debrep_4 = DeconstructBrep(Brep=loft_5)  # -> Faces, Edges, Vertices
end_11 = EndPoints(Curve=debrep_4.Edges)  # -> Start, End
pline_6 = PolyLine(Vertices=end_11.Start, Closed=True)
join_7 = JoinCurves(Curves=pline_6, Preserve=False)
trim_4 = TrimTree(Tree=join_7, Depth=3)
split_26 = SplitList(List=reverse(trim_4), Index=1)  # -> ListA, reverse(ListB)
group_8 = Group(Objects=split_26.ListB)
group_9 = Group(Objects=flatten(group_8))

bbox_2 = BoundingBox(Content=[crv_5, move_16.Geometry], Plane=PlaneXY(0, 0, 0), UnionBox=True)  # -> Box, Box_2
debrep_5 = DeconstructBrep(Brep=bbox_2.Box)  # -> Faces, Edges, Vertices
item_20 = ListItem(List=debrep_5.Faces, Index=5, Wrap=True)
move_22 = Move(Geometry=item_20, Motion=Z_2)  # -> Geometry, Transform
mesh_2 = MeshBrep(
    Brep=move_22.Geometry,
    Settings={GridMaxCount=0, GridMinCount=16, JaggedSeams=False, MaxEdgeLength=0, MinEdgeLength=0.0001, MinTolerance=0, Refine=True, RefineAngle=0, RelativeTolerance=0.65, SimplePlanes=True, Tolerance=0})
mcol_2 = MeshColours(Mesh=mesh_2, Colours=ColourSwatch(SwatchColor=RGB(87, 0, 0)))

entwine_3 = Entwine(Branch00=group_6, Branch01=group_7, Branch02=group_9, Branch03=mcol_2, FlattenInputs=True)
group_10 = Group(Objects=flatten(entwine_3))

# ---- group: module 01 (continued)
bowl_section_3 = BB_BowlSection(
    touchline=move_3.Geometry,
    outline=move_5.Geometry,
    setDistance=pull.Distance,
    rows=bang_4.Branch0,
    stepDepths=bang_5.Branch0,
    landingDepths=bang_16.Branch0,
    floorHeights=bang_6.Branch0,
    cantilevers=bang_8.Branch0,
    cValues=bang_7.Branch0)  # -> section, sightlines, sectionInfo; inputs touchline: Curve, outline: list of Curve, rows: list of Int32, stepDepths: list, landingDepths: list, floorHeights: list, cantilevers: list, seatOffsets: list, cValues: list, stepHeights: list; plug-in component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
end_12 = EndPoints(Curve=bowl_section_3.sightlines)  # -> Start, End
end_13 = EndPoints(Curve=bowl_section_3.section)  # -> Start, End
move_23 = Move(Geometry=end_13.Start, Motion=Z_4)  # -> Geometry, Transform
ln_8 = Line(StartPoint=end_13.Start, EndPoint=move_23.Geometry)
join_8 = JoinCurves(Curves=[bowl_section_3.section, ln_8], Preserve=False)
pt_6 = ConstructPoint(XCoordinate=0, YCoordinate=0, ZCoordinate=bang_3.Branch0)
crv_6 = Curve(bowl_section_3.section)
xy_3 = XYPlane(Origin=pt_6)
end_14 = EndPoints(Curve=bowl_section_3.section)  # -> Start, End
panel_50 = Panel(bang_9.Branch0)
move_24 = Move(Geometry=crv_6, Motion=Y)  # -> Geometry, Transform
move_25 = Move(Geometry=end_12.Start, Motion=Y)  # -> Geometry, Transform
panel_51 = Panel(dist)
division_9 = Division(A=panel_51, B=panel_50)
split_27 = TextSplit(Text=division_9, Separators=".")
item_21 = ListItem(List=split_27, Index=0, Wrap=True)
ln_9 = Line(StartPoint=end_12.Start, EndPoint=move_25.Geometry)
series_17 = Series(Start=0, Step=panel_50, Count=item_21)
X_5 = UnitX(Factor=panel_51)
X_6 = UnitX(Factor=series_17)
pcx_4 = CurvePlane(Curve=join_8, Plane=xy_3)  # -> flatten(Points), ParamsC, ParamsP
move_26 = Move(Geometry=end_14.Start, Motion=X_6)  # -> Geometry, Transform
move_27 = Move(Geometry=end_14.Start, Motion=X_5)  # -> Geometry, Transform
group_11 = Group(Objects=ln_9)
pdecon_5 = Deconstruct(Point=move_26.Geometry)  # -> XComponent, YComponent, ZComponent
pdecon_6 = Deconstruct(Point=pcx_4.Points)  # -> XComponent, YComponent, ZComponent
larger_3 = LargerThan(FirstNumber=graft(pdecon_6.XComponent), SecondNumber=pdecon_5.XComponent)  # -> LargerThan, OrEqualTo
group_12 = Group(Objects=[crv_6, move_24.Geometry])
dispatch_6 = Dispatch(List=pdecon_5.XComponent, DispatchPattern=larger_3.LargerThan)  # -> ListA, ListB
pt_7 = ConstructPoint(XCoordinate=dispatch_6.ListB, YCoordinate=0, ZCoordinate=graft(pdecon_6.ZComponent))
replace_16 = ReplaceItems(List=pt_7, Item=graft(pcx_4.Points), Indices=0, Wrap=False)
cullpt_5 = CullDuplicates(Points=replace_16, Tolerance="1", CullMode=3)  # -> Points, Indices, Valence
pline_7 = PolyLine(Vertices=cullpt_5.Points, Closed=False)
explode_10 = Explode(Curve=pline_7, Recursive=True)  # -> Segments, Vertices
move_28 = Move(Geometry=explode_10.Segments, Motion=Y)  # -> Geometry, Transform
weave_5 = Weave(Pattern=[0, 1], Stream0=graft(move_28.Geometry), Stream1=graft(explode_10.Segments), NullGaps=False)
loft_6 = Loft(Curves=weave_5, Options={Adjust=False, Closed=False, LoftEnds=0, LoftSimp=0, LoftType=0, Rebuild=10, Refit=0.01})
debrep_6 = DeconstructBrep(Brep=loft_6)  # -> Faces, Edges, Vertices
end_15 = EndPoints(Curve=debrep_6.Edges)  # -> Start, End
pline_8 = PolyLine(Vertices=end_15.Start, Closed=True)
join_9 = JoinCurves(Curves=pline_8, Preserve=False)
ln_10 = Line(StartPoint=end_14.Start, EndPoint=move_27.Geometry)
trim_5 = TrimTree(Tree=join_9, Depth=3)
move_29 = Move(Geometry=ln_10, Motion=Y)  # -> Geometry, Transform
end_16 = EndPoints(Curve=move_29.Geometry)  # -> Start, End
end_17 = EndPoints(Curve=ln_10)  # -> Start, End
lng_3 = ListLength(List=trim_5)
split_28 = SplitList(List=reverse(trim_5), Index=1)  # -> ListA, reverse(ListB)
ln_11 = Line(StartPoint=end_16.Start, EndPoint=end_17.Start)
ln_12 = Line(StartPoint=end_16.End, EndPoint=end_17.End)
item_22 = ListItem(List=flatten(lng_3), Index=0, Wrap=True)
division_10 = Division(A="1", B=item_22)
series_18 = Series(Start=0, Step=division_10, Count=item_22)
tweencrv_2 = TweenCurve(CurveA=ln_11, CurveB=ln_12, Factor=series_18, BlendType=0)
group_13 = Group(Objects=split_28.ListB)
merge_14 = Merge(Data1=tweencrv_2, Data2=ln_12)
group_14 = Group(Objects=flatten(group_13))
loft_7 = Loft(
    Curves=flatten(merge_14),
    Options={Adjust=False, Closed=False, LoftEnds=0, LoftSimp=0, LoftType=1, Rebuild=10, Refit=0.01})
debrep_7 = DeconstructBrep(Brep=loft_7)  # -> Faces, Edges, Vertices
item_23 = ListItem(List=debrep_7.Vertices, Index=3, Wrap=True)
srf_cp_4 = SurfaceClosestPoint(Point=item_23, Surface=loft_7)  # -> Point, UVPoint, Distance

# ----
bbox_3 = BoundingBox(Content=[crv_6, move_24.Geometry], Plane=PlaneXY(0, 0, 0), UnionBox=True)  # -> Box, Box_2
debrep_8 = DeconstructBrep(Brep=bbox_3.Box)  # -> Faces, Edges, Vertices
item_24 = ListItem(List=debrep_8.Faces, Index=5, Wrap=True)
move_30 = Move(Geometry=item_24, Motion=Z)  # -> Geometry, Transform
mesh_3 = MeshBrep(
    Brep=move_30.Geometry,
    Settings={GridMaxCount=0, GridMinCount=16, JaggedSeams=False, MaxEdgeLength=0, MinEdgeLength=0.0001, MinTolerance=0, Refine=True, RefineAngle=0, RelativeTolerance=0.65, SimplePlanes=True, Tolerance=0})
mcol_3 = MeshColours(Mesh=mesh_3, Colours=ColourSwatch(SwatchColor=RGB(255, 132, 0)))

# ---- group: module 01 (continued)
entwine_4 = Entwine(Branch00=group_11, Branch01=group_12, Branch02=group_14, Branch03=mcol_3, FlattenInputs=True)
group_15 = Group(Objects=flatten(entwine_4))

# ----
sporph = Sporph(G=group_15, S0=loft_7, P0=srf_cp_4.UVPoint, S1=clean_2, P1=clean_6, R=False)
sporph_2 = Sporph(G=group_10, S0=loft_7, P0=srf_cp_4.UVPoint, S1=clean_4, P1=clean_8, R=False)
sporph_3 = Sporph(G=group_5, S0=loft_7, P0=srf_cp_4.UVPoint, S1=clean_5, P1=clean_9, R=False)

bowl_section_4 = BB_BowlSection(
    touchline=move_3.Geometry,
    outline=move_5.Geometry,
    setDistance=pull.Distance,
    rows=bang_4.Branch1,
    stepDepths=bang_5.Branch1,
    landingDepths=bang_16.Branch1,
    floorHeights=bang_6.Branch1,
    cantilevers=bang_8.Branch1,
    cValues=bang_7.Branch1)  # -> section, sightlines, sectionInfo; inputs touchline: Curve, outline: list of Curve, rows: list of Int32, stepDepths: list, landingDepths: list, floorHeights: list, cantilevers: list, seatOffsets: list, cValues: list, stepHeights: list; plug-in component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
end_18 = EndPoints(Curve=bowl_section_4.sightlines)  # -> Start, End
end_19 = EndPoints(Curve=bowl_section_4.section)  # -> Start, End
move_31 = Move(Geometry=end_19.Start, Motion=Z_8)  # -> Geometry, Transform
ln_13 = Line(StartPoint=end_19.Start, EndPoint=move_31.Geometry)
join_10 = JoinCurves(Curves=[ln_13, bowl_section_4.section], Preserve=False)
pt_8 = ConstructPoint(XCoordinate=0, YCoordinate=0, ZCoordinate=bang_3.Branch0)
crv_7 = Curve(bowl_section_4.section)
xy_4 = XYPlane(Origin=pt_8)
end_20 = EndPoints(Curve=bowl_section_4.section)  # -> Start, End
panel_52 = Panel(bang_9.Branch0)
move_32 = Move(Geometry=crv_7, Motion=Y_4)  # -> Geometry, Transform
move_33 = Move(Geometry=end_18.Start, Motion=Y_4)  # -> Geometry, Transform
panel_53 = Panel(dist)
division_11 = Division(A=panel_53, B=panel_52)
split_29 = TextSplit(Text=division_11, Separators=".")
item_25 = ListItem(List=split_29, Index=0, Wrap=True)
ln_14 = Line(StartPoint=end_18.Start, EndPoint=move_33.Geometry)
series_19 = Series(Start=0, Step=panel_52, Count=item_25)
X_7 = UnitX(Factor=panel_53)
X_8 = UnitX(Factor=series_19)
pcx_5 = CurvePlane(Curve=join_10, Plane=xy_4)  # -> flatten(Points), ParamsC, ParamsP
move_34 = Move(Geometry=end_20.Start, Motion=X_8)  # -> Geometry, Transform
move_35 = Move(Geometry=end_20.Start, Motion=X_7)  # -> Geometry, Transform
group_16 = Group(Objects=ln_14)
pdecon_7 = Deconstruct(Point=move_34.Geometry)  # -> XComponent, YComponent, ZComponent
pdecon_8 = Deconstruct(Point=pcx_5.Points)  # -> XComponent, YComponent, ZComponent
ln_15 = Line(StartPoint=end_20.Start, EndPoint=move_35.Geometry)
move_36 = Move(Geometry=ln_15, Motion=Y_4)  # -> Geometry, Transform
larger_4 = LargerThan(FirstNumber=graft(pdecon_8.XComponent), SecondNumber=pdecon_7.XComponent)  # -> LargerThan, OrEqualTo
group_17 = Group(Objects=[crv_7, move_32.Geometry])
loft_8 = Loft(
    Curves=[ln_15, move_36.Geometry],
    Options={Adjust=False, Closed=False, LoftEnds=0, LoftSimp=0, LoftType=0, Rebuild=10, Refit=0.01})
dispatch_7 = Dispatch(List=pdecon_7.XComponent, DispatchPattern=larger_4.LargerThan)  # -> ListA, ListB
pt_9 = ConstructPoint(XCoordinate=dispatch_7.ListB, YCoordinate=0, ZCoordinate=graft(pdecon_8.ZComponent))
srf_cp_5 = SurfaceClosestPoint(Point=end_20.Start, Surface=loft_8)  # -> Point, UVPoint, Distance
replace_17 = ReplaceItems(List=pt_9, Item=graft(pcx_5.Points), Indices=0, Wrap=False)
cullpt_6 = CullDuplicates(Points=replace_17, Tolerance="1", CullMode=3)  # -> Points, Indices, Valence
pline_9 = PolyLine(Vertices=cullpt_6.Points, Closed=False)
explode_11 = Explode(Curve=pline_9, Recursive=True)  # -> Segments, Vertices
move_37 = Move(Geometry=explode_11.Segments, Motion=Y_4)  # -> Geometry, Transform
weave_6 = Weave(Pattern=[0, 1], Stream0=graft(move_37.Geometry), Stream1=graft(explode_11.Segments), NullGaps=False)
loft_9 = Loft(Curves=weave_6, Options={Adjust=False, Closed=False, LoftEnds=0, LoftSimp=0, LoftType=0, Rebuild=10, Refit=0.01})
debrep_9 = DeconstructBrep(Brep=loft_9)  # -> Faces, Edges, Vertices
end_21 = EndPoints(Curve=debrep_9.Edges)  # -> Start, End
pline_10 = PolyLine(Vertices=end_21.Start, Closed=True)
join_11 = JoinCurves(Curves=pline_10, Preserve=False)
trim_6 = TrimTree(Tree=join_11, Depth=3)
split_30 = SplitList(List=reverse(trim_6), Index=1)  # -> ListA, reverse(ListB)
group_18 = Group(Objects=split_30.ListB)
group_19 = Group(Objects=flatten(group_18))

bbox_4 = BoundingBox(Content=[crv_7, move_32.Geometry], Plane=PlaneXY(0, 0, 0), UnionBox=True)  # -> Box, Box_2
debrep_10 = DeconstructBrep(Brep=bbox_4.Box)  # -> Faces, Edges, Vertices
item_26 = ListItem(List=debrep_10.Faces, Index=5, Wrap=True)
move_38 = Move(Geometry=item_26, Motion=Z_3)  # -> Geometry, Transform
mesh_4 = MeshBrep(
    Brep=move_38.Geometry,
    Settings={GridMaxCount=0, GridMinCount=16, JaggedSeams=False, MaxEdgeLength=0, MinEdgeLength=0.0001, MinTolerance=0, Refine=True, RefineAngle=0, RelativeTolerance=0.65, SimplePlanes=True, Tolerance=0})
mcol_4 = MeshColours(Mesh=mesh_4, Colours=ColourSwatch(SwatchColor=RGB(43, 87, 0)))

entwine_5 = Entwine(Branch00=group_16, Branch01=group_17, Branch02=group_19, Branch03=mcol_4, FlattenInputs=True)
group_20 = Group(Objects=flatten(entwine_5))

sporph_4 = Sporph(G=group_20, S0=loft_7, P0=srf_cp_4.UVPoint, S1=clean_3, P1=clean_7, R=False)
weave_7 = Weave(Pattern=repeat, Stream0=sporph, Stream1=sporph_4, Stream2=sporph_2, Stream3=sporph_3, NullGaps=False)
ungroup = Ungroup(Group=flatten(weave_7))
item_27 = ListItem(List=ungroup, Index="0", Wrap=True)  # -> flatten(Item)
lng_4 = ListLength(List=item_27)
larger_5 = LargerThan(FirstNumber=bang_18.Branch3, SecondNumber=expr("x-1", lng_4))  # -> LargerThan, OrEqualTo
larger_6 = LargerThan(FirstNumber=bang_18.Branch7, SecondNumber=expr("x-2", lng_4))  # -> LargerThan, OrEqualTo
dispatch_8 = Dispatch(List=bang_18.Branch3, DispatchPattern=larger_5.LargerThan)  # -> ListA, ListB
dispatch_9 = Dispatch(List=bang_18.Branch7, DispatchPattern=larger_6.LargerThan)  # -> ListA, ListB
ungroup_2 = Ungroup(Group=item_27)
divlength = DivideLength(Curve=ungroup_2, Length=number_slider_3)  # -> Points, Tangents, Parameters
shatter_3 = Shatter(Curve=graft(ungroup_2), Parameters=divlength.Parameters)
list_item_15 = ListItem(List=shatter_3, Index=1, Wrap=True)
end_points = EndPoints(Curve=list_item_15)  # -> Start, End
trim_tree_2 = TrimTree(Tree=end_points.End, Depth=Slider(2, range=0..10))
larger_7 = LargerThan(FirstNumber=bang_12.Branch0, SecondNumber=expr("x-2", lng_4))  # -> LargerThan, OrEqualTo
partition_list = PartitionList(List=simplify(trim_tree_2), Size=text_split_4)
dispatch_10 = Dispatch(List=flatten(bang_12.Branch0), DispatchPattern=flatten(larger_7.OrEqualTo))  # -> ListA, ListB
polyline_2 = PolyLine(Vertices=partition_list, Closed=False)
trim_tree_3 = TrimTree(Tree=polyline_2, Depth=1)
split_list_2 = SplitList(List=trim_tree_3, Index="1")  # -> ListA, ListB
group_21 = Group(Objects=split_list_2.ListB)
list_item_16 = ListItem(List=flatten(group_21), Index=bang_18.Branch7, Wrap=True)
ungroup_3 = Ungroup(Group=list_item_16)
length = Length(Curve=ungroup_3)
larger_than = LargerThan(FirstNumber=length, SecondNumber=Slider(6, range=0..10))  # -> LargerThan, OrEqualTo
dispatch_11 = Dispatch(List=ungroup_3, DispatchPattern=larger_than.LargerThan)  # -> ListA, ListB
curve_4 = Curve(dispatch_11.ListB)
curve_5 = Curve(dispatch_11.ListA)

# ---- group: tunnels
panel_54 = Panel(bang_2.Branch1)

# ---- group: bowl (continued)
item_28 = ListItem(List=ungroup, Index="1", Wrap=True)
panel_55 = Panel(split_16.Positive)
offset_2 = OffsetCurve(Curve=fillet_2, Distance=panel_55, Corners=1)
move_39 = Move(Geometry=offset_2, Motion=Z_9)  # -> Geometry, Transform
loft_10 = Loft(
    Curves=[move_39.Geometry, offset_2],
    Options={Adjust=False, Closed=False, LoftEnds=0, LoftSimp=0, LoftType=0, Rebuild=10, Refit=0.01})

# ---- group: tunnels (continued)
lng_5 = ListLength(List=flatten(item_28))
series_20 = Series(Start=0, Step=1, Count=lng_5)
dispatch_12 = Dispatch(List=flatten(item_28), DispatchPattern=panel_54)  # -> ListA, ListB
dispatch_13 = Dispatch(List=flatten(series_20), DispatchPattern=panel_54)  # -> ListA, ListB
ungroup_4 = Ungroup(Group=dispatch_12.ListB)

# ----
explode_12 = Explode(Curve=graft(ungroup_4), Recursive=True)  # -> Segments, Vertices
split_31 = SplitList(List=explode_12.Vertices, Index=expr("x*2", flatten(bang_2.Branch0)))  # -> ListA, ListB
pline_11 = PolyLine(Vertices=split_31.ListB, Closed=False)

# ---- group: tunnels (continued)
trim_7 = TrimTree(Tree=pline_11, Depth=3)
group_22 = Group(Objects=trim_7)
replace_18 = ReplaceItems(List=flatten(item_28), Item=flatten(group_22), Indices=dispatch_13.ListB, Wrap=True)  # -> graft(List)

# ---- group: bowl (continued)
ungroup_5 = Ungroup(Group=replace_18)
mloft = PythonicMeshLoftPlus(P=ungroup_5, C="0", A="0", E="0")  # -> L; inputs P: list of Polyline, C: Boolean, A: Boolean, E: Int32
# ---------- mloft: Python ----------
"""Create a lofted mesh through a set of section polylines.
    Inputs:
        P: Section polylines
        C: Closed loft
        A: Align section poylines
        E: End caps (0 = none, 1 = flat)
    Output:
        L: Resulting mesh loft"""

__author__ = "p1r4t3b0y"
__email__ = "p1r4t3b0y@gmail.com"
__version__ = "1.1.0"

ghenv.Component.Name = "Pythonic Mesh Loft Plus"
ghenv.Component.NickName = "MLoft+"
ghenv.Component.Category = "Mesh"
ghenv.Component.SubCategory = "Primitive"

import Rhino.Geometry as rg
import scriptcontext as sc
import Grasshopper as gh
import math


class MeshLoft:
    """Creates a lofted mesh through a set of section polylines.
    
    Attributes:
        polylines: A list of valid, closed or open polylines.
        close_loft: Optional, if True the loft will be closed.
        cap_loft: Optional, if True the loft will be capped.
    
    To use:
        >>> ml = MeshLoft(polylines)
        >>> loft = ml.mesh
    """
    def __init__(self, polylines, close_loft=None, cap_loft=None):
        """Inits this mesh loft."""
        self.polylines = polylines
        self.close_loft = close_loft
        self.cap_loft = cap_loft
        self.vertices = self.get_vertices()
        self.faces = self.construct_faces()
        self.mesh = self.construct_mesh()
        
        
    def get_vertices(self):
        """Gets the vertices for each polyline in self.polylines.
        
        Returns:
          The new nested list of vertices per polyline."""
        pline_vertices = []
        for pline in self.polylines:
            vertices = []
            for i in range(len(pline)):
                vertices.append(pline[i])
            pline_vertices.append(vertices)
        return pline_vertices
    
    
    def index_vertices(self):
        """Indexes the vertices of each polyline with integer numbers,
            that are necessary to later assign the vertices to mesh faces.
        
        Returns:
          The nested list of vertex indices (e.g. [[0,1,2], [3,4,5], ..])."""
        vtx_indices = [] 
        for i in range(len(self.vertices)):
            indices = []
            for j in range(len(self.vertices[i])):
                indices.append(i * len(self.vertices[i]) + j)
            vtx_indices.append(indices)
        return vtx_indices
    
    
    def construct_faces(self):
        """Constructs quad faces between all adjacent polyline pairs.       
        
        Returns:
          The nested list of face tuples (e.g. [(0,1,7,6), ...])."""
        vtx_indices = self.index_vertices()
        faces = []
        for i in range(len(vtx_indices)):
            if i < len(vtx_indices) - 1: 
                # Loop the polyline vertex indices up to the last curve
                for j in range(len(vtx_indices[i])-1): # vertices
                    v1 = j + (i * len(vtx_indices[i]))
                    v2 = j + (i * len(vtx_indices[i])) + 1
                    v3 = j + ((i + 1) * len(vtx_indices[i])) + 1
                    v4 = j + ((i + 1) * len(vtx_indices[i]))
                    faces.append((v1, v2, v3, v4))
            else:
                # Loop the polyline vertex indices of the last curve
                if self.close_loft:
                    for j in range(len(vtx_indices[i])-1): # vertices
                        v1 = j + (i * len(vtx_indices[i]))
                        v2 = j + (i * len(vtx_indices[i])) + 1
                        v3 = j + 1
                        v4 = j
                        faces.append((v1, v2, v3, v4))
        return faces
    
    
    def construct_mesh(self, angle_tolerance=-1):
        """Constructs a lofted mesh from self.vertices and self.faces
            and adds caps to it, if necessary.
        
        Args:
          angle_tol: An optional angle tolerance for vertex welding.
        
        Returns:
          The new mesh loft."""
        if angle_tolerance == None or angle_tolerance <= 0:
            angle_tol = sc.doc.ModelAngleToleranceRadians
        
        mesh = rg.Mesh()

        # Add the mesh loft vertices
        for pline_vertices in self.vertices:
            for vertex in pline_vertices:
                mesh.Vertices.Add(vertex)
        # Add the mesh loft faces
        for face in self.faces:
            v0, v1, v2, v3 = face
            mesh.Faces.AddFace(v0, v1, v2, v3)
        # Add the mesh caps
        if self.cap_loft != None and self.cap_loft > 0:
            end_curves = [self.polylines[0], self.polylines[-1]]
            if self.cap_loft == 1: # flat cap
                mesh_caps = [self.construct_flat_cap(c) for c in end_curves]
            cap_fails = 0    
            for cap in mesh_caps:
                if cap != None:
                    mesh.Append(cap)
                    mesh.Weld(angle_tolerance)
                    mesh.Vertices.CombineIdentical(False, False)
                else:
                    cap_fails += 1
            if cap_fails == len(end_curves):
                err = "Both caps failed."
                ghenv.Component.AddRuntimeMessage(\
                    gh.Kernel.GH_RuntimeMessageLevel.Error, err)
            if cap_fails == len(end_curves) - 1:
                err = "One cap failed."
                ghenv.Component.AddRuntimeMessage(\
                    gh.Kernel.GH_RuntimeMessageLevel.Error, err)
        # Compute the normals and compact the mesh
        mesh.Normals.ComputeNormals()
        mesh.Compact()
        return mesh
    
    
    def construct_flat_cap(self, edge, tolerance=None):
        """Constructs a flat mesh cap for a closed, naked mesh edge.
        
        Edge polylines with a count of 4 or 5 vertices produce single,
        triangular or quad faces. A count of more than 5 edge vertices
        results in a triangulated mesh. If these edge vertices share a
        center vertex contained inside the naked edge, the face count
        equals the number of edge segments, and the faces are radially
        oriented around this center vertex. If the center vertex lies 
        outside the closed mesh edge, the triangulated mesh is produced
        from the edge polyline itself.
        
        Args:
            edge: A polyline representing a closed, naked mesh edge.
            tolerance: An optional tolerance for planar projection.
        
        Returns:
            The new mesh cap on success, or None."""
        if tolerance == None or tolerance <= 0:
            tolerance = sc.doc.ModelAbsoluteTolerance
        
        mesh_cap = rg.Mesh()
        # Test for planarity of the mesh edge polyline
        pcurve = rg.PolylineCurve(edge)
        is_planar, plane = pcurve.TryGetPlane()
        if not is_planar:
            # Construct a planar test edge from the non-planar one
            rc, plane = rg.Plane.FitPlaneToPoints(edge)
            proj_pts = [plane.ClosestPoint(pt) for pt in edge]
            pcurve = rg.PolylineCurve(proj_pts)
        # Find the center vertex of the naked mesh edge
        center_vtx = edge.CenterPoint()
        # Test for center vertex mesh edge containment
        rc = pcurve.Contains(center_vtx, plane, tolerance)
        if rc == rg.PointContainment.Outside \
            or rc == rg.PointContainment.Coincident:
            # Mesh cap corresponds to a triangulated polyline
            mesh_cap = rg.Mesh.CreateFromClosedPolyline(edge)
        if rc == rg.PointContainment.Inside:
            if edge.Count - 1 == 3:
                # Mesh cap is composed of a single tri face
                for i in range(edge.Count - 1):
                    mesh_cap.Vertices.Add(edge[i])
                mesh_cap.Faces.AddFace(0, 1, 2) 
            if edge.Count - 1 == 4:
                # Mesh cap is composed of a single quad face
                for i in range(edge.Count - 1):
                    mesh_cap.Vertices.Add(edge[i])
                mesh_cap.Faces.AddFace(0, 1, 2, 3)
            if edge.Count > 5:
                # Mesh cap is radially triangulated around the center vertex
                for i in range(edge.Count):
                    mesh_cap.Vertices.Add(edge[i])
                mesh_cap.Vertices.Add(center_vtx)
                for i in range(edge.Count - 1):
                    v0 = i
                    v1 = i + 1
                    v2 = edge.Count
                    v3 = i
                    mesh_cap.Faces.AddFace(v0, v1, v2, v3)
        if rc == rg.PointContainment.Unset:
            err = "Open polylines can't produce capped mesh lofts."
            ghenv.Component.AddRuntimeMessage(\
                gh.Kernel.GH_RuntimeMessageLevel.Warning, err)
            return
        # Compute the normals and compact the mesh
        mesh_cap.Normals.ComputeNormals()
        mesh_cap.Compact()
        return mesh_cap


###############################################################################  


def align_polylines(polylines, guide_idx=None):
    """Aligns closed polylines so that their start/end vertices fall inline.
        If the optional guide index is not defined, the polylines align to 
        the start/end vertex of the first polyline. 
    
    Args:
      polylines: A list of closed polylines.
      guide_idx: An optional guide index for the polylines to align to.
    
    Returns:
      The list of aligned polylines on success, or the unaltered polylines."""
    if any([True for p in polylines if not p.IsClosed]):
        err = "Open polylines can't be aligned."
        ghenv.Component.AddRuntimeMessage(\
            gh.Kernel.GH_RuntimeMessageLevel.Warning, err)
        return polylines
    
    if guide_idx == None or guide_idx < 0:
        guide_idx = 0
    elif guide_idx > len(polylines[0]):
        guide_idx = 0
    
    aligned_polylines = [polylines[guide_idx]]
    for i in range(1, len(polylines)):
        # Get the guide vertex of the previous polyline
        guide_vtx = polylines[i-1][guide_idx]
        # Get the closest index of a vertex of the current polyline
        closest_idx = polylines[i].ClosestIndex(guide_vtx) # -1 on error
        if closest_idx < 0:
            return
        # Get a list of indices of the current polyline
        indices = range(len(polylines[i])-1)
        # Restructure the polyline indices to align them
        align_indices = indices[closest_idx:] + indices[:closest_idx]
        align_vertices = [polylines[i][j] for j in align_indices]
        align_vertices.append(align_vertices[0])
        aligned_polylines.append(rg.Polyline(align_vertices))
        # Update the guide index
        guide_idx = closest_idx
    return aligned_polylines


###############################################################################   


if __name__ == "__main__":
    if len(P) == 0:
        err = "Input parameter P failed to collect data"
        ghenv.Component.AddRuntimeMessage(\
            gh.Kernel.GH_RuntimeMessageLevel.Warning, err)
    
    if C == None: # closed loft
        C = False
    
    if E == None or E < 0 or E > 1: # capped loft
        E = 0
    
    if E and C:
        err = "Input parameter C (%s) and E (%s) don't work together." \
            %("Closed Loft", "End Caps")
        ghenv.Component.AddRuntimeMessage(\
            gh.Kernel.GH_RuntimeMessageLevel.Warning, err)
        C = False
        E = 0
    
    if A: # align sections
        if C and any([True for pline in P if pline.IsClosed]):
            err = "Aligning sections may produce weird results" + \
                " for closed, radial mesh lofts."
            ghenv.Component.AddRuntimeMessage(\
                gh.Kernel.GH_RuntimeMessageLevel.Remark, err)
        P = align_polylines(P)
    
    if len(P) > 1 and all([pline.IsValid for pline in P]):
        # Initialise this mesh loft
        ml = MeshLoft(P, C, E)
        # Outputs
        L = ml.mesh
    else:
        err = "Input parameter P data includes one or more invalid polylines"
        ghenv.Component.AddRuntimeMessage(\
            gh.Kernel.GH_RuntimeMessageLevel.Warning, err)
# ---------- end mloft ----------
msplit = MeshSplit(Mesh=mloft, Splitters=loft_10)
item_29 = ListItem(List=msplit, Index=0, Wrap=True)
panel_56 = Panel(item_29)
preview_2 = CustomPreview(Geometry=item_29, Material=material)

# ----
panel_57 = Panel(ungroup_5)
end_points_2 = EndPoints(Curve=ungroup_5)  # -> Start, End
polyline_3 = PolyLine(Vertices=end_points_2.End, Closed=False)
explode_13 = Explode(Curve=ungroup_5, Recursive=True)  # -> Segments, Vertices
polyline_4 = PolyLine(Vertices=end_points_2.Start, Closed=False)

# ---- group: gangways (continued)
dom = ConstructDomain(DomainStart=bang_18.Branch0, DomainEnd=bang_18.Branch1)
item_30 = ListItem(List=item_27, Index=dispatch_8.ListB, Wrap=True)
subtraction_2 = Subtraction(A=bang_18.Branch1, B=bang_18.Branch0)
ungroup_6 = Ungroup(Group=item_30)
range_2 = Range(Domain=dom, Steps=subtraction_2)
item_31 = ListItem(List=ungroup_6, Index=range_2, Wrap=False)
len_2 = Length(Curve=item_31)
larger_8 = LargerThan(FirstNumber=len_2, SecondNumber=Slider(2.8, range=0..10))  # -> LargerThan, OrEqualTo
dispatch_14 = Dispatch(List=item_31, DispatchPattern=larger_8.LargerThan)  # -> ListA, ListB
divlength_2 = DivideLength(Curve=dispatch_14.ListA, Length=number_slider_3)  # -> Points, Tangents, Parameters
shatter_4 = Shatter(Curve=graft(dispatch_14.ListA), Parameters=divlength_2.Parameters)
replace_19 = ReplaceItems(List=shatter_4, Indices=bang_18.Branch2, Wrap=False)
group_23 = Group(Objects=replace_19)
trim_8 = TrimTree(Tree=group_23, Depth="3")
merge_15 = Merge(Data1=dispatch_14.ListB, Data2=trim_8)

# ----
lng_6 = ListLength(List=ungroup_6)
larger_9 = LargerThan(FirstNumber=range_2, SecondNumber=lng_6)  # -> LargerThan, OrEqualTo
dispatch_15 = Dispatch(List=merge_15, DispatchPattern=larger_9.OrEqualTo)  # -> ListA, ListB
dispatch_16 = Dispatch(List=range_2, DispatchPattern=larger_9.OrEqualTo)  # -> ListA, ListB

# ---- group: gangways (continued)
replace_20 = ReplaceItems(List=ungroup_6, Item=dispatch_15.ListB, Indices=dispatch_16.ListB, Wrap=False)
group_24 = Group(Objects=replace_20)  # -> flatten(Group)
replace_21 = ReplaceItems(List=item_27, Item=group_24, Indices=dispatch_8.ListB, Wrap=False)

# ----
panel_58 = Panel(dispatch_16.ListB)

# ---- group: gangways
subtraction_3 = Subtraction(A=addition_6, B=bang_18.Branch4)
dom_2 = ConstructDomain(DomainStart=bang_18.Branch4, DomainEnd=addition_6)
item_32 = ListItem(List=replace_21, Index=dispatch_9.ListB, Wrap=True)
range_3 = Range(Domain=dom_2, Steps=subtraction_3)
ungroup_7 = Ungroup(Group=item_32)
lng_7 = ListLength(List=ungroup_7)
larger_10 = LargerThan(FirstNumber=range_3, SecondNumber=expr("x-1", lng_7))  # -> LargerThan, OrEqualTo
dispatch_17 = Dispatch(List=range_3, DispatchPattern=larger_10.LargerThan)  # -> ListA, ListB
item_33 = ListItem(List=ungroup_7, Index=dispatch_17.ListB, Wrap=False)
len_3 = Length(Curve=item_33)
larger_11 = LargerThan(FirstNumber=len_3, SecondNumber=Slider(2.8, range=0..10))  # -> LargerThan, OrEqualTo
dispatch_18 = Dispatch(List=item_33, DispatchPattern=larger_11.LargerThan)  # -> ListA, ListB
divlength_3 = DivideLength(Curve=dispatch_18.ListA, Length=Slider(1.2, range=0..10))  # -> Points, Tangents, Parameters
shatter_5 = Shatter(Curve=graft(dispatch_18.ListA), Parameters=divlength_3.Parameters)
replace_22 = ReplaceItems(List=shatter_5, Indices=bang_18.Branch6, Wrap=False)
group_25 = Group(Objects=replace_22)
trim_9 = TrimTree(Tree=group_25, Depth="3")
merge_16 = Merge(Data1=dispatch_18.ListB, Data2=trim_9)
replace_23 = ReplaceItems(List=ungroup_7, Item=merge_16, Indices=dispatch_17.ListB, Wrap=False)
group_26 = Group(Objects=replace_23)  # -> flatten(Group)
replace_24 = ReplaceItems(List=replace_21, Item=group_26, Indices=dispatch_9.ListB, Wrap=False)

# ---- group: low gangway
item_34 = ListItem(List=replace_19, Index=expr("X+1", bang_18.Branch2), Wrap=True)
trim_10 = TrimTree(Tree=item_34, Depth=Slider(3, range=0..10))
end_22 = EndPoints(Curve=trim_10)  # -> Start, End
pline_12 = PolyLine(Vertices=end_22.Start, Closed=False)

# ----
list_item_17 = ListItem(List=reverse(end_22.End), Index=1, Wrap=True)
relay = Relay([curve_5, curve_4, pline_12])

# ---- group: Bowl entry points
point_3 = Point(flatten(list_item_17))

# ----
cull_duplicates = CullDuplicates(Points=point_3, Tolerance=Slider(2, range=0..10), CullMode=3)  # -> Points, Indices, Valence

# ---- group: Vomitories
series_21 = Series(Start=bang_10.Branch0, Step=1, Count=bang_10.Branch1)
item_35 = ListItem(List=replace_24, Index=dispatch_10.ListB, Wrap=True)
ungroup_8 = Ungroup(Group=item_35)

# ----
lng_8 = ListLength(List=ungroup_8)
larger_12 = LargerThan(FirstNumber=series_21, SecondNumber=lng_8)  # -> LargerThan, OrEqualTo
dispatch_19 = Dispatch(List=series_21, DispatchPattern=larger_12.OrEqualTo)  # -> ListA, ListB

# ---- group: Vomitories (continued)
item_36 = ListItem(List=ungroup_8, Index=dispatch_19.ListB, Wrap=False)
ungroup_9 = Ungroup(Group=item_36)
split_32 = SplitList(List=ungroup_9, Index=Slider(3, range=0..10))  # -> ListA, ListB
group_27 = Group(Objects=split_32.ListB)
trim_11 = TrimTree(Tree=group_27, Depth=Slider(2, range=0..10))
replace_25 = ReplaceItems(List=ungroup_8, Item=trim_11, Indices=dispatch_19.ListB, Wrap=False)
group_28 = Group(Objects=replace_25)
replace_26 = ReplaceItems(List=replace_24, Item=flatten(group_28), Indices=dispatch_10.ListB, Wrap=False)

# ---- group: Vomitories 2
series_22 = Series(Start=bang_10.Branch5, Step=1, Count=bang_10.Branch1)
item_37 = ListItem(List=replace_26, Index=dispatch_10.ListB, Wrap=True)
ungroup_10 = Ungroup(Group=item_37)
lng_9 = ListLength(List=ungroup_10)
larger_13 = LargerThan(FirstNumber=series_22, SecondNumber=lng_9)  # -> LargerThan, OrEqualTo
dispatch_20 = Dispatch(List=series_22, DispatchPattern=larger_13.OrEqualTo)  # -> ListA, ListB
item_38 = ListItem(List=ungroup_10, Index=dispatch_20.ListB, Wrap=False)
ungroup_11 = Ungroup(Group=item_38)
split_33 = SplitList(List=ungroup_11, Index=Slider(3, range=0..10))  # -> ListA, ListB
group_29 = Group(Objects=split_33.ListB)
trim_12 = TrimTree(Tree=group_29, Depth=Slider(2, range=0..10))
replace_27 = ReplaceItems(List=ungroup_10, Item=trim_12, Indices=dispatch_20.ListB, Wrap=False)
group_30 = Group(Objects=replace_27)
replace_28 = ReplaceItems(List=replace_26, Item=flatten(group_30), Indices=dispatch_10.ListB, Wrap=False)

# ---- group: seating tunnels
item_39 = ListItem(List=replace_28, Index=dispatch_13.ListB, Wrap=True)
ungroup_12 = Ungroup(Group=item_39)
split_34 = SplitList(List=ungroup_12, Index=bang_2.Branch0)  # -> ListA, ListB
group_31 = Group(Objects=split_34.ListB)  # -> flatten(Group)
replace_29 = ReplaceItems(List=replace_28, Item=group_31, Indices=dispatch_13.ListB, Wrap=False)

# ----
ungroup_13 = Ungroup(Group=replace_29)
ungroup_14 = Ungroup(Group=ungroup_13)
join_12 = JoinCurves(Curves=ungroup_14, Preserve=False)
len_4 = Length(Curve=join_12)
division_12 = Division(A=len_4, B=Slider(0.6, range=0..1))
divide_3 = DivideCurve(Curve=join_12, Count=division_12, Kinks=False)  # -> Points, Tangents, Parameters

# ---- group: seats
split_35 = SplitList(List=divide_3.Points, Index=1)  # -> ListA, ListB

# ----
trim_13 = TrimTree(Tree=split_35.ListB, Depth=expr("2", 1))
pull_point_2 = PullPoint(Point=trim_13, Geometry=flatten(relay), ClosestOnly=True)  # -> ClosestPoint, Distance
pull_point_3 = PullPoint(Point=pull_point_2.ClosestPoint, Geometry=flatten(cull_duplicates.Points), ClosestOnly=True)  # -> ClosestPoint, Distance

# ---- group: C Value calculation / c value
crv_8 = Curve(item_5)
pull_2 = PullPoint(Point=trim_13, Geometry=crv_8, ClosestOnly=True)  # -> ClosestPoint, Distance
pdecon_9 = Deconstruct(Point=trim_13)  # -> XComponent, YComponent, ZComponent
pt_10 = ConstructPoint(XCoordinate=pdecon_9.XComponent, YCoordinate=pdecon_9.YComponent, ZCoordinate=0)
vec2pt_2 = Vector2Pt(PointA=pull_2.ClosestPoint, PointB=pt_10, Unitize=False)  # -> Vector, Length
dist_2 = Distance(PointA=pt_10, PointB=pull_2.ClosestPoint)  # -> expr("x-0.8", Distance)
vec2pt_3 = Vector2Pt(PointA=pull_2.ClosestPoint, PointB=trim_13, Unitize=False)  # -> Vector, Length
angle = Angle(VectorA=vec2pt_2.Vector, VectorB=vec2pt_3.Vector)  # -> Angle, Reflex
tan = Tangent(Value=angle.Angle)
multiplication_2 = Multiplication(A=dist_2, B=tan)
subtraction_4 = Subtraction(A=multiplication_2)

# ----
amp_2 = Amplitude(Vector=trim_13, Amplitude=".2")
move_40 = Move(Geometry=trim_13, Motion=amp_2)  # -> Geometry, Transform
ln_16 = Line(StartPoint=trim_13, EndPoint=move_40.Geometry)
lng_10 = ListLength(List=flatten(move_40.Geometry))
panel_59 = Panel(lng_10)
smaller_than = SmallerThan(FirstNumber=lng_10, SecondNumber=maximum_capacity)  # -> SmallerThan, OrEqualTo
larger_than_2 = LargerThan(FirstNumber=lng_10, SecondNumber=maximum_capacity_2)  # -> LargerThan, OrEqualTo

# ---- group: C Value calculation (continued)
sort_3 = SortList(Keys=flatten(subtraction_4))  # -> Keys, ValuesA
lng_11 = ListLength(List=sort_3.Keys)
multiplication_3 = Multiplication(A=lng_11, B=".8")
multiplication_4 = Multiplication(A=lng_11, B=".2")
item_40 = ListItem(List=sort_3.Keys, Index=multiplication_4, Wrap=True)
item_41 = ListItem(List=sort_3.Keys, Index=multiplication_3, Wrap=True)
gradient = Gradient(
    LowerLimit=item_40,
    UpperLimit=item_41,
    Parameter=subtraction_4,
    stops=[0: RGB(128, 0, 128), 0.361: RGB(255, 255, 0), 1: RGB(255, 0, 0)])

# ---- group: C Value calculation / Labelling
lng_12 = ListLength(List=sort_3.Keys)
multiplication_5 = Multiplication(A=lng_12, B="0.15")
split_36 = SplitList(List=sort_3.Keys, Index=multiplication_5)  # -> ListA, ListB
split_37 = SplitList(List=reverse(split_36.ListB), Index=multiplication_5)  # -> ListA, ListB
bnd = Bounds(Numbers=flatten(split_37.ListB))
range_4 = Range(Domain=bnd, Steps=Slider(5, range=0..10))
roundn = RoundToNearest(NumbersX=subtraction_4, NumbersY=range_4, RemapX=False)  # -> Nearest, Index, Difference, RemappedX

# ---- group: top sightline seats
sort_list_2 = SortList(Keys=flatten(roundn.Nearest))  # -> Keys, ValuesValuesA
create_set = CreateSet(List=flatten(sort_list_2.Keys))  # -> Set, Map
member_index = MemberIndex(Set=flatten(sort_list_2.Keys), Member=create_set.Set)  # -> Index, Count
list_item_18 = ListItem(List=member_index.Count, Index=0, Wrap=True)
division_13 = Division(A=list_item_18, B=lng_10)

# ----
list_item_19 = ListItem(List=repeat_data_2, Index=panel_61, Wrap=True)
rotate = Rotate(Geometry=point, Angle=expr("x*-1", degrees(list_item_21)), Plane=xy_plane)  # -> Geometry, Transform
pull_point_4 = PullPoint(Point=pull_point_3.ClosestPoint, Geometry=rotate.Geometry, ClosestOnly=True)  # -> ClosestPoint, Distance
addition_7 = Addition(A=pull_point_3.Distance, B=pull_point_4.Distance)
addition_8 = Addition(A=pull_point_2.Distance, B=addition_7)
sort_list_3 = SortList(Keys=flatten(addition_8))  # -> Keys, ValuesValuesA
lng_13 = ListLength(List=sort_list_3.Keys)
multiplication_6 = Multiplication(A=lng_13, B="0.15")
split_38 = SplitList(List=sort_list_3.Keys, Index=multiplication_6)  # -> ListA, ListB
split_39 = SplitList(List=reverse(split_38.ListB), Index=multiplication_6)  # -> ListA, ListB
bnd_2 = Bounds(Numbers=flatten(split_39.ListB))
range_5 = Range(Domain=bnd_2, Steps=Slider(4, range=0..10))
roundn_2 = RoundToNearest(NumbersX=addition_8, NumbersY=range_5, RemapX=False)  # -> Nearest, Index, Difference, RemappedX

# ---- group: % of closest seats
sort_list_4 = SortList(Keys=flatten(roundn_2.Index))  # -> Keys, ValuesValuesA
create_set_2 = CreateSet(List=sort_list_4.Keys)  # -> Set, Map
list_length_5 = ListLength(List=sort_list_4.Keys)
member_index_2 = MemberIndex(Set=flatten(sort_list_4.Keys), Member=create_set_2.Set)  # -> Index, Count
division_14 = Division(A=member_index_2.Count, B=list_length_5)
panel_60 = Panel(division_14)

# ---- group: Closest seats %
list_item_20 = ListItem(List=division_14, Index=0, Wrap=True)

# ----
list_item_21 = ListItem(List=range, Index=panel_61, Wrap=True)
rotate_2 = Rotate(Geometry=polyline_3, Angle=degrees(list_item_21), Plane=xy_plane_3)  # -> Geometry, Transform
rotate_3 = Rotate(Geometry=polyline_4, Angle=degrees(list_item_21), Plane=PlaneXY(0, 0, 0))  # -> Geometry, Transform
rotate_4 = Rotate(Geometry=explode_13.Segments, Angle=degrees(list_item_21), Plane=xy_plane_3)  # -> Geometry, Transform
join_curves_2 = JoinCurves(Curves=flatten(rotate_2.Geometry), Preserve=False)
join_curves_3 = JoinCurves(Curves=flatten(rotate_3.Geometry), Preserve=False)
project = Project(Geometry=join_curves_2, Plane=PlaneXY(0, 0, 0))  # -> flatten(Geometry), Transform
cull_pattern = CullPattern(List=rotate_4.Geometry, CullPattern=[False, True])  # -> simplify(List)
pull_point_5 = PullPoint(Point=point_on_curve, Geometry=project.Geometry, ClosestOnly=True)  # -> ClosestPoint, Distance
split_tree = SplitTree(Data=cull_pattern, Masks=flatten("{?;0}"))  # -> Positive, Negative
boundary_surfaces_2 = BoundarySurfaces(Edges=flatten([project.Geometry, join_curves_3]))

weave_8 = Weave(Pattern=[0, 1], Stream0=graft(split_tree.Positive), Stream1=graft(split_tree.Negative), NullGaps=False)
loft_11 = Loft(Curves=weave_8, Options={Adjust=False, Closed=False, LoftEnds=0, LoftSimp=0, LoftType=0, Rebuild=10, Refit=0.01})
area_2 = Area(Geometry=loft_11)  # -> flatten(Area), Centroid
round_2 = Round(Number=area_2.Area)  # -> Nearest, Floor, Ceiling
sort_list_5 = SortList(Keys=round_2.Nearest)  # -> Keys, ValuesValuesA
create_set_3 = CreateSet(List=sort_list_5.Keys)  # -> Set, Map
member_index_3 = MemberIndex(Set=sort_list_5.Keys, Member=create_set_3.Set)  # -> Index, Count
list_length_6 = ListLength(List=member_index_3.Count)

# ---- group: building footprint
area_3 = Area(Geometry=flatten(join_curves_3))  # -> Area, Centroid

# ---- group: roof area
area_4 = Area(Geometry=boundary_surfaces_2)  # -> Area, Centroid

# ----
join_curves_4 = JoinCurves(Curves=project.Geometry, Preserve=False)
line = Line(StartPoint=pull_point_5.ClosestPoint, EndPoint=point_on_curve)
rotate_5 = Rotate(Geometry=move_2.Geometry, Angle=degrees(list_item_21), Plane=xy_plane_3)  # -> Geometry, Transform
curve_6 = Curve(flatten([line, join_curves_4, join_curves]))
tt_lineweight_preview = TTLineweightPreview(Geometry=rotate_5.Geometry, Shader=ColourSwatch(SwatchColor=RGB(0, 0, 0)), Absolute=False)
surface_split = SurfaceSplit(Surface=boundary_surfaces, Curves=curve_6)

# ---- group: C Value calculation (continued)
rotate_6 = Rotate(Geometry=ln_16, Angle=degrees(list_item_21), Plane=PlaneXY(0, 0, 0))  # -> Geometry, Transform

# ---- group: Masterplan areas calculation
area_5 = Area(Geometry=surface_split)  # -> Area, Centroid
distance = Distance(PointA=area_5.Centroid, PointB=construct_point)
sort_list_6 = SortList(Keys=distance, ValuesValuesA=surface_split)  # -> Keys, ValuesValuesA
split_list_3 = SplitList(List=sort_list_6.ValuesValuesA, Index=1)  # -> ListA, ListB
area_6 = Area(Geometry=split_list_3.ListB)  # -> flatten(Area), Centroid
list_item_22 = ListItem(List=area_6.Area, Index=0, Wrap=True)
list_item_23 = ListItem(List=reverse(area_6.Area), Index=0, Wrap=True)
subtraction_5 = Subtraction(A=list_item_23, B=list_item_22)

# ----
list_length_7 = ListLength(List=area_2.Area)

# ---- group: Masterplan areas calculation
area_7 = Area(Geometry=surface_split)  # -> Area, Centroid
distance_2 = Distance(PointA=area_7.Centroid, PointB=construct_point)
sort_list_7 = SortList(Keys=distance_2, ValuesValuesA=surface_split)  # -> Keys, ValuesValuesA
split_list_4 = SplitList(List=sort_list_7.ValuesValuesA, Index=1)  # -> ListA, ListB

# ----
area_8 = Area(Geometry=flatten(split_list_4.ListB))  # -> Area, Centroid
bounds = Bounds(Numbers=area_8.Area)
deconstruct_domain = DeconstructDomain(Domain=bounds)  # -> Start, End
gradient_2 = Gradient(
    LowerLimit=deconstruct_domain.Start,
    UpperLimit=deconstruct_domain.End,
    Parameter=area_8.Area,
    stops=[0: RGB(0, 98, 0), 0.25: RGB(81, 175, 17), 0.5: RGB(159, 198, 146), 0.75: RGB(170, 235, 41), 1: RGB(221, 255, 53)])
create_material = CreateMaterial(Diffuse=gradient_2, Specular=RGB(255, 255, 255), Emission=RGB(0, 0, 0), Transparency=Slider(0.757, range=0..1), Shine=0)
custom_preview = CustomPreview(Geometry=split_list_4.ListB, Material=create_material)
clean_tree_3 = CleanTree(RemoveNulls=True, RemoveInvalid=True, RemoveEmpty=True, Tree=flatten(rotate_6.Geometry))
tt_lineweight_preview_2 = TTLineweightPreview(Geometry=flatten(clean_tree_3), Shader=flatten(gradient), Thickness=panel_17, Absolute=False)

# ---- group: Feasibility test (continued)
join_curves_5 = JoinCurves(Curves=flatten(project.Geometry), Preserve=False)
offset_curve = OffsetCurve(Curve=join_curves_5, Distance="5", Corners=1)
curve_curve = CurveCurve(CurveA=offset_curve, CurveB=curve_3)  # -> Points, ParamsA, ParamsB
list_length_8 = ListLength(List=flatten(curve_curve.Points))

# ----
smaller_than_2 = SmallerThan(FirstNumber=list_length_8, SecondNumber="1.1")  # -> SmallerThan, OrEqualTo

# ---- group: Feasibility test (continued)
list_item_24 = ListItem(List=panel_18, Index=smaller_than_2.SmallerThan, Wrap=True)

# ----
merge_17 = Merge(Data1=list_item_24, Data2="0")
list_item_25 = ListItem(List=merge_17, Index=smaller_than.SmallerThan, Wrap=True)
merge_18 = Merge(Data1=list_item_25, Data2="0")
list_item_26 = ListItem(List=merge_18, Index=larger_than_2.LargerThan, Wrap=True)

# ---- group: Right click > Auto Loop All to start generation
hoopsnake = HoopSnake(
    StartingData="0",
    Data=addition_9,
    TerminationCondition=smaller_than_3.OrEqualTo,
    Hoopsnake_Data_autoUpdate=False,
    Hoopsnake_Data_dataLimit=2147483647,
    Hoopsnake_Data_delay=0,
    Hoopsnake_Data_resetCounter=True,
    Hoopsnake_Data_updateView=True)  # -> Feedback, CumulativeFeedback, LoopsCounter, IterationsCounter

# ----
smaller_than_3 = SmallerThan(FirstNumber=hoopsnake.IterationsCounter, SecondNumber=list_length_3)  # -> SmallerThan, OrEqualTo
addition_9 = Addition(A=hoopsnake.IterationsCounter, B=Slider(1, range=0..1))
larger_than_3 = LargerThan(FirstNumber=addition_9, SecondNumber="1")  # -> LargerThan, OrEqualTo
weave_9 = Weave(Pattern=[0, 1], Stream0=item_4.Item1, Stream1=hoopsnake.IterationsCounter, NullGaps=False)
panel_61 = Panel(hoopsnake.IterationsCounter)
text_join_6 = TextJoin(Text=flatten(weave_9), Join="_")

# ---- group: Building footprint area
record_data = RecordData(Data=area_3.Area, Record=larger_than_3.LargerThan, Reset=button, RecordFirstDataOnReset=True)

# ---- group: Capacity
record_data_2 = RecordData(Data=lng_10, Record=larger_than_3.LargerThan, Reset=button, RecordFirstDataOnReset=True)

# ---- group: Number of seating bowl element types
record_data_3 = RecordData(Data=list_length_6, Record=larger_than_3.LargerThan, Reset=button, RecordFirstDataOnReset=True)

# ---- group: Total number of elements
record_data_4 = RecordData(Data=list_length_7, Record=larger_than_3.LargerThan, Reset=button, RecordFirstDataOnReset=True)

# ---- group: Feasibility
record_data_5 = RecordData(Data=list_item_26, Record=larger_than_3.LargerThan, Reset=button, RecordFirstDataOnReset=True)

# ---- group: Percentage high quality seats
record_data_6 = RecordData(Data=division_13, Record=larger_than_3.LargerThan, Reset=button, RecordFirstDataOnReset=True)

# ---- group: Masterplan areas difference
record_data_7 = RecordData(Data=subtraction_5, Record=larger_than_3.LargerThan, Reset=button, RecordFirstDataOnReset=True)

# ---- group: Closest seats % (continued)
# Output
record_data_8 = RecordData(Data=list_item_20, Record=larger_than_3.LargerThan, Reset=button, RecordFirstDataOnReset=True)

# ----
entwine_6 = Entwine(
    Branch00=record_data_8,
    Branch01=record_data_6,
    Branch02=record_data_7,
    Branch03=record_data,
    Branch04=record_data_2,
    Branch05=record_data_3,
    Branch06=record_data_4,
    Branch07=record_data_5,
    FlattenInputs=True)
flip_matrix_2 = FlipMatrix(Data=entwine_6)
text_join_7 = TextJoin(Text=flip_matrix_2, Join=",")  # -> flatten(Result)

# ---- group: masterplan distance (continued)
rep = ReplaceText(Text="\a.jpeg", Find="a", Replace=text_join_6, RecursiveReplace=False)
join_13 = TextJoin(Text=[panel_16, rep])

# ----
write_to_text_file = WriteToTextFile(Run=larger_than_3.LargerThan, TextToWrite=text_join_7, FilePath=concatenate, Append=False, NewOnly=False)
save_viewport_to_file = SaveViewportToFile(Run=larger_than_3.LargerThan, ViewportName=panel_19, Render=False, FilePath=join_13, ScaleFactor=panel_20)
