# Grasshopper definition 06_02_RIBA Stage 1 Defining the Brief Analysis Model.gh (Grasshopper 1.0.7)
# plug-ins: Human, LunchBoxML, CORE.Toolbox.Grasshopper, LunchBox

division = Division(A="2664", B=2)
division_2 = Division(A="2250", B=2)
dom = ConstructDomain(DomainStart=expr("x*-1", division_2), DomainEnd=division_2)
dom_2 = ConstructDomain(DomainStart=expr("x*-1", division), DomainEnd=division)
planesrf = PlaneSurface(Plane=PlaneXY(0, 0, 0), XSize=dom_2, YSize=dom)
unit_x = UnitX(Factor="-30000")
series = Series(Start=0, Step="2664", Count="30")
move = Move(Geometry=planesrf, Motion=unit_x)  # -> Geometry, Transform
unit_x_2 = UnitX(Factor="-30000")
X = UnitX(Factor=series)
move_2 = Move(Geometry=planesrf, Motion=X)  # -> Geometry, Transform
series_2 = Series(Start=0, Step="2250", Count="30")
Y = UnitY(Factor=expr("x*-1", series_2))
# Paste the output folder path from the generative model in the panel below
input_folder = Panel("C:\AOMSDML\Stage 1")
move_3 = Move(Geometry=graft(move_2.Geometry), Motion=Y)  # -> Geometry, Transform
concatenate = Concatenate(FragmentA=input_folder, FragmentB="\data.txt")
read_file = ReadFile(File=concatenate, PerLineParse=True)
flip = FlipMatrix(Data=move_3.Geometry)
repeat_data = RepeatData(Data=read_file, Length="901")
concatenate_2 = Concatenate(FragmentA=input_folder, FragmentB="\")

# ---- group: first sheet
division_3 = Division(A="2664", B=2)
division_4 = Division(A="2250", B=2)
dom_3 = ConstructDomain(DomainStart=expr("x*-1", division_4), DomainEnd=division_4)
dom_4 = ConstructDomain(DomainStart=expr("x*-1", division_3), DomainEnd=division_3)
planesrf_2 = PlaneSurface(Plane=PlaneXY(0, 0, 0), XSize=dom_4, YSize=dom_3)
series_3 = Series(Start=0, Step="2664", Count="20")
X_2 = UnitX(Factor=series_3)
move_4 = Move(Geometry=planesrf_2, Motion=X_2)  # -> Geometry, Transform
series_4 = Series(Start=0, Step="2250", Count="30")
Y_2 = UnitY(Factor=expr("x*-1", series_4))
move_5 = Move(Geometry=graft(move_4.Geometry), Motion=Y_2)  # -> Geometry, Transform
panel = Panel(concatenate_2)
flip_2 = FlipMatrix(Data=move_5.Geometry)
panel_2 = Panel("""0_0.jpeg
0_1.jpeg
0_2.jpeg
0_3.jpeg
0_4.jpeg
0_5.jpeg
0_6.jpeg
0_7.jpeg
0_8.jpeg
0_9.jpeg
0_10.jpeg
0_11.jpeg
0_12.jpeg
0_13.jpeg
0_14.jpeg
0_15.jpeg
0_16.jpeg
0_17.jpeg
0_18.jpeg
0_19.jpeg
0_20.jpeg
0_21.jpeg
0_22.jpeg
0_23.jpeg
0_24.jpeg
0_25.jpeg
0_26.jpeg
0_27.jpeg
0_28.jpeg
0_29.jpeg
0_30.jpeg
0_31.jpeg
0_32.jpeg
0_33.jpeg
0_34.jpeg
0_35.jpeg
0_36.jpeg
0_37.jpeg
0_38.jpeg
0_39.jpeg
0_40.jpeg
0_41.jpeg
0_42.jpeg
0_43.jpeg
0_44.jpeg
0_45.jpeg
0_46.jpeg
0_47.jpeg
0_48.jpeg
0_49.jpeg
0_50.jpeg
0_51.jpeg
0_52.jpeg
0_53.jpeg
0_54.jpeg
0_55.jpeg
0_56.jpeg
0_57.jpeg
0_58.jpeg
0_59.jpeg
0_60.jpeg
0_61.jpeg
0_62.jpeg
0_63.jpeg
0_64.jpeg
0_65.jpeg
0_66.jpeg
0_67.jpeg
0_68.jpeg
0_69.jpeg
0_70.jpeg
0_71.jpeg
0_72.jpeg
0_73.jpeg
0_74.jpeg
0_75.jpeg
0_76.jpeg
0_77.jpeg
0_78.jpeg
0_79.jpeg
0_80.jpeg
0_81.jpeg
0_82.jpeg
0_83.jpeg
0_84.jpeg
0_85.jpeg
0_86.jpeg
0_87.jpeg
0_88.jpeg
0_89.jpeg
0_90.jpeg
0_91.jpeg
0_92.jpeg
0_93.jpeg
0_94.jpeg
0_95.jpeg
0_96.jpeg
0_97.jpeg
0_98.jpeg
0_99.jpeg
1_100.jpeg
1_101.jpeg
1_102.jpeg
1_103.jpeg
1_104.jpeg
1_105.jpeg
1_106.jpeg
1_107.jpeg
1_108.jpeg
1_109.jpeg
1_110.jpeg
1_111.jpeg
1_112.jpeg
1_113.jpeg
1_114.jpeg
1_115.jpeg
1_116.jpeg
1_117.jpeg
1_118.jpeg
1_119.jpeg
1_120.jpeg
1_121.jpeg
1_122.jpeg
1_123.jpeg
1_124.jpeg
1_125.jpeg
1_126.jpeg
1_127.jpeg
1_128.jpeg
1_129.jpeg
1_130.jpeg
1_131.jpeg
1_132.jpeg
1_133.jpeg
1_134.jpeg
1_135.jpeg
1_136.jpeg
1_137.jpeg
1_138.jpeg
1_139.jpeg
1_140.jpeg
1_141.jpeg
1_142.jpeg
1_143.jpeg
1_144.jpeg
1_145.jpeg
1_146.jpeg
1_147.jpeg
1_148.jpeg
1_149.jpeg
1_150.jpeg
1_151.jpeg
1_152.jpeg
1_153.jpeg
1_154.jpeg
1_155.jpeg
1_156.jpeg
1_157.jpeg
1_158.jpeg
1_159.jpeg
1_160.jpeg
1_161.jpeg
1_162.jpeg
1_163.jpeg
1_164.jpeg
1_165.jpeg
1_166.jpeg
1_167.jpeg
1_168.jpeg
1_169.jpeg
1_170.jpeg
1_171.jpeg
1_172.jpeg
1_173.jpeg
1_174.jpeg
1_175.jpeg
1_176.jpeg
1_177.jpeg
1_178.jpeg
1_179.jpeg
1_180.jpeg
1_181.jpeg
1_182.jpeg
1_183.jpeg
1_184.jpeg
1_185.jpeg
1_186.jpeg
1_187.jpeg
1_188.jpeg
1_189.jpeg
1_190.jpeg
1_191.jpeg
1_192.jpeg
1_193.jpeg
1_194.jpeg
1_195.jpeg
1_196.jpeg
1_197.jpeg
1_198.jpeg
1_199.jpeg
2_200.jpeg
2_201.jpeg
2_202.jpeg
2_203.jpeg
2_204.jpeg
2_205.jpeg
2_206.jpeg
2_207.jpeg
2_208.jpeg
2_209.jpeg
2_210.jpeg
2_211.jpeg
2_212.jpeg
2_213.jpeg
2_214.jpeg
2_215.jpeg
2_216.jpeg
2_217.jpeg
2_218.jpeg
2_219.jpeg
2_220.jpeg
2_221.jpeg
2_222.jpeg
2_223.jpeg
2_224.jpeg
2_225.jpeg
2_226.jpeg
2_227.jpeg
2_228.jpeg
2_229.jpeg
2_230.jpeg
2_231.jpeg
2_232.jpeg
2_233.jpeg
2_234.jpeg
2_235.jpeg
2_236.jpeg
2_237.jpeg
2_238.jpeg
2_239.jpeg
2_240.jpeg
2_241.jpeg
2_242.jpeg
2_243.jpeg
2_244.jpeg
2_245.jpeg
2_246.jpeg
2_247.jpeg
2_248.jpeg
2_249.jpeg
2_250.jpeg
2_251.jpeg
2_252.jpeg
2_253.jpeg
2_254.jpeg
2_255.jpeg
2_256.jpeg
2_257.jpeg
2_258.jpeg
2_259.jpeg
2_260.jpeg
2_261.jpeg
2_262.jpeg
2_263.jpeg
2_264.jpeg
2_265.jpeg
2_266.jpeg
2_267.jpeg
2_268.jpeg
2_269.jpeg
2_270.jpeg
2_271.jpeg
2_272.jpeg
2_273.jpeg
2_274.jpeg
2_275.jpeg
2_276.jpeg
2_277.jpeg
2_278.jpeg
2_279.jpeg
2_280.jpeg
2_281.jpeg
2_282.jpeg
2_283.jpeg
2_284.jpeg
2_285.jpeg
2_286.jpeg
2_287.jpeg
2_288.jpeg
2_289.jpeg
2_290.jpeg
2_291.jpeg
2_292.jpeg
2_293.jpeg
2_294.jpeg
2_295.jpeg
2_296.jpeg
2_297.jpeg
2_298.jpeg
2_299.jpeg
3_300.jpeg
3_301.jpeg
3_302.jpeg
3_303.jpeg
3_304.jpeg
3_305.jpeg
3_306.jpeg
3_307.jpeg
3_308.jpeg
3_309.jpeg
3_310.jpeg
3_311.jpeg
3_312.jpeg
3_313.jpeg
3_314.jpeg
3_315.jpeg
3_316.jpeg
3_317.jpeg
3_318.jpeg
3_319.jpeg
3_320.jpeg
3_321.jpeg
3_322.jpeg
3_323.jpeg
3_324.jpeg
3_325.jpeg
3_326.jpeg
3_327.jpeg
3_328.jpeg
3_329.jpeg
3_330.jpeg
3_331.jpeg
3_332.jpeg
3_333.jpeg
3_334.jpeg
3_335.jpeg
3_336.jpeg
3_337.jpeg
3_338.jpeg
3_339.jpeg
3_340.jpeg
3_341.jpeg
3_342.jpeg
3_343.jpeg
3_344.jpeg
3_345.jpeg
3_346.jpeg
3_347.jpeg
3_348.jpeg
3_349.jpeg
3_350.jpeg
3_351.jpeg
3_352.jpeg
3_353.jpeg
3_354.jpeg
3_355.jpeg
3_356.jpeg
3_357.jpeg
3_358.jpeg
3_359.jpeg
3_360.jpeg
3_361.jpeg
3_362.jpeg
3_363.jpeg
3_364.jpeg
3_365.jpeg
3_366.jpeg
3_367.jpeg
3_368.jpeg
3_369.jpeg
3_370.jpeg
3_371.jpeg
3_372.jpeg
3_373.jpeg
3_374.jpeg
3_375.jpeg
3_376.jpeg
3_377.jpeg
3_378.jpeg
3_379.jpeg
3_380.jpeg
3_381.jpeg
3_382.jpeg
3_383.jpeg
3_384.jpeg
3_385.jpeg
3_386.jpeg
3_387.jpeg
3_388.jpeg
3_389.jpeg
3_390.jpeg
3_391.jpeg
3_392.jpeg
3_393.jpeg
3_394.jpeg
3_395.jpeg
3_396.jpeg
3_397.jpeg
3_398.jpeg
3_399.jpeg
4_400.jpeg
4_401.jpeg
4_402.jpeg
4_403.jpeg
4_404.jpeg
4_405.jpeg
4_406.jpeg
4_407.jpeg
4_408.jpeg
4_409.jpeg
4_410.jpeg
4_411.jpeg
4_412.jpeg
4_413.jpeg
4_414.jpeg
4_415.jpeg
4_416.jpeg
4_417.jpeg
4_418.jpeg
4_419.jpeg
4_420.jpeg
4_421.jpeg
4_422.jpeg
4_423.jpeg
4_424.jpeg
4_425.jpeg
4_426.jpeg
4_427.jpeg
4_428.jpeg
4_429.jpeg
4_430.jpeg
4_431.jpeg
4_432.jpeg
4_433.jpeg
4_434.jpeg
4_435.jpeg
4_436.jpeg
4_437.jpeg
4_438.jpeg
4_439.jpeg
4_440.jpeg
4_441.jpeg
4_442.jpeg
4_443.jpeg
4_444.jpeg
4_445.jpeg
4_446.jpeg
4_447.jpeg
4_448.jpeg
4_449.jpeg
4_450.jpeg
4_451.jpeg
4_452.jpeg
4_453.jpeg
4_454.jpeg
4_455.jpeg
4_456.jpeg
4_457.jpeg
4_458.jpeg
4_459.jpeg
4_460.jpeg
4_461.jpeg
4_462.jpeg
4_463.jpeg
4_464.jpeg
4_465.jpeg
4_466.jpeg
4_467.jpeg
4_468.jpeg
4_469.jpeg
4_470.jpeg
4_471.jpeg
4_472.jpeg
4_473.jpeg
4_474.jpeg
4_475.jpeg
4_476.jpeg
4_477.jpeg
4_478.jpeg
4_479.jpeg
4_480.jpeg
4_481.jpeg
4_482.jpeg
4_483.jpeg
4_484.jpeg
4_485.jpeg
4_486.jpeg
4_487.jpeg
4_488.jpeg
4_489.jpeg
4_490.jpeg
4_491.jpeg
4_492.jpeg
4_493.jpeg
4_494.jpeg
4_495.jpeg
4_496.jpeg
4_497.jpeg
4_498.jpeg
4_499.jpeg
5_500.jpeg
5_501.jpeg
5_502.jpeg
5_503.jpeg
5_504.jpeg
5_505.jpeg
5_506.jpeg
5_507.jpeg
5_508.jpeg
5_509.jpeg
5_510.jpeg
5_511.jpeg
5_512.jpeg
5_513.jpeg
5_514.jpeg
5_515.jpeg
5_516.jpeg
5_517.jpeg
5_518.jpeg
5_519.jpeg
5_520.jpeg
5_521.jpeg
5_522.jpeg
5_523.jpeg
5_524.jpeg
5_525.jpeg
5_526.jpeg
5_527.jpeg
5_528.jpeg
5_529.jpeg
5_530.jpeg
5_531.jpeg
5_532.jpeg
5_533.jpeg
5_534.jpeg
5_535.jpeg
5_536.jpeg
5_537.jpeg
5_538.jpeg
5_539.jpeg
5_540.jpeg
5_541.jpeg
5_542.jpeg
5_543.jpeg
5_544.jpeg
5_545.jpeg
5_546.jpeg
5_547.jpeg
5_548.jpeg
5_549.jpeg
5_550.jpeg
5_551.jpeg
5_552.jpeg
5_553.jpeg
5_554.jpeg
5_555.jpeg
5_556.jpeg
5_557.jpeg
5_558.jpeg
5_559.jpeg
5_560.jpeg
5_561.jpeg
5_562.jpeg
5_563.jpeg
5_564.jpeg
5_565.jpeg
5_566.jpeg
5_567.jpeg
5_568.jpeg
5_569.jpeg
5_570.jpeg
5_571.jpeg
5_572.jpeg
5_573.jpeg
5_574.jpeg
5_575.jpeg
5_576.jpeg
5_577.jpeg
5_578.jpeg
5_579.jpeg
5_580.jpeg
5_581.jpeg
5_582.jpeg
5_583.jpeg
5_584.jpeg
5_585.jpeg
5_586.jpeg
5_587.jpeg
5_588.jpeg
5_589.jpeg
5_590.jpeg
5_591.jpeg
5_592.jpeg
5_593.jpeg
5_594.jpeg
5_595.jpeg
5_596.jpeg
5_597.jpeg
5_598.jpeg
5_599.jpeg
6_600.jpeg
6_601.jpeg
6_602.jpeg
6_603.jpeg
6_604.jpeg
6_605.jpeg
6_606.jpeg
6_607.jpeg
6_608.jpeg
6_609.jpeg
6_610.jpeg
6_611.jpeg
6_612.jpeg
6_613.jpeg
6_614.jpeg
6_615.jpeg
6_616.jpeg
6_617.jpeg
6_618.jpeg
6_619.jpeg
6_620.jpeg
6_621.jpeg
6_622.jpeg
6_623.jpeg
6_624.jpeg
6_625.jpeg
6_626.jpeg
6_627.jpeg
6_628.jpeg
6_629.jpeg
6_630.jpeg
6_631.jpeg
6_632.jpeg
6_633.jpeg
6_634.jpeg
6_635.jpeg
6_636.jpeg
6_637.jpeg
6_638.jpeg
6_639.jpeg
6_640.jpeg
6_641.jpeg
6_642.jpeg
6_643.jpeg
6_644.jpeg
6_645.jpeg
6_646.jpeg
6_647.jpeg
6_648.jpeg
6_649.jpeg
6_650.jpeg
6_651.jpeg
6_652.jpeg
6_653.jpeg
6_654.jpeg
6_655.jpeg
6_656.jpeg
6_657.jpeg
6_658.jpeg
6_659.jpeg
6_660.jpeg
6_661.jpeg
6_662.jpeg
6_663.jpeg
6_664.jpeg
6_665.jpeg
6_666.jpeg
6_667.jpeg
6_668.jpeg
6_669.jpeg
6_670.jpeg
6_671.jpeg
6_672.jpeg
6_673.jpeg
6_674.jpeg
6_675.jpeg
6_676.jpeg
6_677.jpeg
6_678.jpeg
6_679.jpeg
6_680.jpeg
6_681.jpeg
6_682.jpeg
6_683.jpeg
6_684.jpeg
6_685.jpeg
6_686.jpeg
6_687.jpeg
6_688.jpeg
6_689.jpeg
6_690.jpeg
6_691.jpeg
6_692.jpeg
6_693.jpeg
6_694.jpeg
6_695.jpeg
6_696.jpeg
6_697.jpeg
6_698.jpeg
6_699.jpeg
7_700.jpeg
7_701.jpeg
7_702.jpeg
7_703.jpeg
7_704.jpeg
7_705.jpeg
7_706.jpeg
7_707.jpeg
7_708.jpeg
7_709.jpeg
7_710.jpeg
7_711.jpeg
7_712.jpeg
7_713.jpeg
7_714.jpeg
7_715.jpeg
7_716.jpeg
7_717.jpeg
7_718.jpeg
7_719.jpeg
7_720.jpeg
7_721.jpeg
7_722.jpeg
7_723.jpeg
7_724.jpeg
7_725.jpeg
7_726.jpeg
7_727.jpeg
7_728.jpeg
7_729.jpeg
7_730.jpeg
7_731.jpeg
7_732.jpeg
7_733.jpeg
7_734.jpeg
7_735.jpeg
7_736.jpeg
7_737.jpeg
7_738.jpeg
7_739.jpeg
7_740.jpeg
7_741.jpeg
7_742.jpeg
7_743.jpeg
7_744.jpeg
7_745.jpeg
7_746.jpeg
7_747.jpeg
7_748.jpeg
7_749.jpeg
7_750.jpeg
7_751.jpeg
7_752.jpeg
7_753.jpeg
7_754.jpeg
7_755.jpeg
7_756.jpeg
7_757.jpeg
7_758.jpeg
7_759.jpeg
7_760.jpeg
7_761.jpeg
7_762.jpeg
7_763.jpeg
7_764.jpeg
7_765.jpeg
7_766.jpeg
7_767.jpeg
7_768.jpeg
7_769.jpeg
7_770.jpeg
7_771.jpeg
7_772.jpeg
7_773.jpeg
7_774.jpeg
7_775.jpeg
7_776.jpeg
7_777.jpeg
7_778.jpeg
7_779.jpeg
7_780.jpeg
7_781.jpeg
7_782.jpeg
7_783.jpeg
7_784.jpeg
7_785.jpeg
7_786.jpeg
7_787.jpeg
7_788.jpeg
7_789.jpeg
7_790.jpeg
7_791.jpeg
7_792.jpeg
7_793.jpeg
7_794.jpeg
7_795.jpeg
7_796.jpeg
7_797.jpeg
7_798.jpeg
7_799.jpeg
8_800.jpeg
8_801.jpeg
8_802.jpeg
8_803.jpeg
8_804.jpeg
8_805.jpeg
8_806.jpeg
8_807.jpeg
8_808.jpeg
8_809.jpeg
8_810.jpeg
8_811.jpeg
8_812.jpeg
8_813.jpeg
8_814.jpeg
8_815.jpeg
8_816.jpeg
8_817.jpeg
8_818.jpeg
8_819.jpeg
8_820.jpeg
8_821.jpeg
8_822.jpeg
8_823.jpeg
8_824.jpeg
8_825.jpeg
8_826.jpeg
8_827.jpeg
8_828.jpeg
8_829.jpeg
8_830.jpeg
8_831.jpeg
8_832.jpeg
8_833.jpeg
8_834.jpeg
8_835.jpeg
8_836.jpeg
8_837.jpeg
8_838.jpeg
8_839.jpeg
8_840.jpeg
8_841.jpeg
8_842.jpeg
8_843.jpeg
8_844.jpeg
8_845.jpeg
8_846.jpeg
8_847.jpeg
8_848.jpeg
8_849.jpeg
8_850.jpeg
8_851.jpeg
8_852.jpeg
8_853.jpeg
8_854.jpeg
8_855.jpeg
8_856.jpeg
8_857.jpeg
8_858.jpeg
8_859.jpeg
8_860.jpeg
8_861.jpeg
8_862.jpeg
8_863.jpeg
8_864.jpeg
8_865.jpeg
8_866.jpeg
8_867.jpeg
8_868.jpeg
8_869.jpeg
8_870.jpeg
8_871.jpeg
8_872.jpeg
8_873.jpeg
8_874.jpeg
8_875.jpeg
8_876.jpeg
8_877.jpeg
8_878.jpeg
8_879.jpeg
8_880.jpeg
8_881.jpeg
8_882.jpeg
8_883.jpeg
8_884.jpeg
8_885.jpeg
8_886.jpeg
8_887.jpeg
8_888.jpeg
8_889.jpeg
8_890.jpeg
8_891.jpeg
8_892.jpeg
8_893.jpeg
8_894.jpeg
8_895.jpeg
8_896.jpeg
8_897.jpeg
8_898.jpeg
8_899.jpeg
0_900.jpeg""")
weave = Weave(Pattern=[0, 1], Stream0=panel, Stream1=graft(panel_2), NullGaps=False)
join = TextJoin(Text=weave)
previewmat = CustomPreviewMaterials(Geometry=flatten(flip_2), DiffuseColor=RGB(255, 255, 255), DiffuseBitmap=flatten(join))
panel_3 = Panel(join)

# ----
move_6 = Move(Geometry=planesrf_2, Motion=unit_x_2)  # -> Geometry, Transform
panel_4 = Panel(concatenate_2)
panel_5 = Panel("""0_1.jpeg
0_2.jpeg
0_3.jpeg
0_4.jpeg
0_5.jpeg
0_6.jpeg
0_7.jpeg
0_8.jpeg
0_9.jpeg
0_10.jpeg
0_11.jpeg
0_12.jpeg
0_13.jpeg
0_14.jpeg
0_15.jpeg
0_16.jpeg
0_17.jpeg
0_18.jpeg
0_19.jpeg
0_20.jpeg
0_21.jpeg
0_22.jpeg
0_23.jpeg
0_24.jpeg
0_25.jpeg
0_26.jpeg
0_27.jpeg
0_28.jpeg
0_29.jpeg
0_30.jpeg
0_31.jpeg
0_32.jpeg
0_33.jpeg
0_34.jpeg
0_35.jpeg
0_36.jpeg
0_37.jpeg
0_38.jpeg
0_39.jpeg
0_40.jpeg
0_41.jpeg
0_42.jpeg
0_43.jpeg
0_44.jpeg
0_45.jpeg
0_46.jpeg
0_47.jpeg
0_48.jpeg
0_49.jpeg
0_50.jpeg
0_51.jpeg
0_52.jpeg
0_53.jpeg
0_54.jpeg
0_55.jpeg
0_56.jpeg
0_57.jpeg
0_58.jpeg
0_59.jpeg
0_60.jpeg
0_61.jpeg
0_62.jpeg
0_63.jpeg
0_64.jpeg
0_65.jpeg
0_66.jpeg
0_67.jpeg
0_68.jpeg
0_69.jpeg
0_70.jpeg
0_71.jpeg
0_72.jpeg
0_73.jpeg
0_74.jpeg
0_75.jpeg
0_76.jpeg
0_77.jpeg
0_78.jpeg
0_79.jpeg
0_80.jpeg
0_81.jpeg
0_82.jpeg
0_83.jpeg
0_84.jpeg
0_85.jpeg
0_86.jpeg
0_87.jpeg
0_88.jpeg
0_89.jpeg
0_90.jpeg
0_91.jpeg
0_92.jpeg
0_93.jpeg
0_94.jpeg
0_95.jpeg
0_96.jpeg
0_97.jpeg
0_98.jpeg
0_99.jpeg
1_100.jpeg
1_101.jpeg
1_102.jpeg
1_103.jpeg
1_104.jpeg
1_105.jpeg
1_106.jpeg
1_107.jpeg
1_108.jpeg
1_109.jpeg
1_110.jpeg
1_111.jpeg
1_112.jpeg
1_113.jpeg
1_114.jpeg
1_115.jpeg
1_116.jpeg
1_117.jpeg
1_118.jpeg
1_119.jpeg
1_120.jpeg
1_121.jpeg
1_122.jpeg
1_123.jpeg
1_124.jpeg
1_125.jpeg
1_126.jpeg
1_127.jpeg
1_128.jpeg
1_129.jpeg
1_130.jpeg
1_131.jpeg
1_132.jpeg
1_133.jpeg
1_134.jpeg
1_135.jpeg
1_136.jpeg
1_137.jpeg
1_138.jpeg
1_139.jpeg
1_140.jpeg
1_141.jpeg
1_142.jpeg
1_143.jpeg
1_144.jpeg
1_145.jpeg
1_146.jpeg
1_147.jpeg
1_148.jpeg
1_149.jpeg
1_150.jpeg
1_151.jpeg
1_152.jpeg
1_153.jpeg
1_154.jpeg
1_155.jpeg
1_156.jpeg
1_157.jpeg
1_158.jpeg
1_159.jpeg
1_160.jpeg
1_161.jpeg
1_162.jpeg
1_163.jpeg
1_164.jpeg
1_165.jpeg
1_166.jpeg
1_167.jpeg
1_168.jpeg
1_169.jpeg
1_170.jpeg
1_171.jpeg
1_172.jpeg
1_173.jpeg
1_174.jpeg
1_175.jpeg
1_176.jpeg
1_177.jpeg
1_178.jpeg
1_179.jpeg
1_180.jpeg
1_181.jpeg
1_182.jpeg
1_183.jpeg
1_184.jpeg
1_185.jpeg
1_186.jpeg
1_187.jpeg
1_188.jpeg
1_189.jpeg
1_190.jpeg
1_191.jpeg
1_192.jpeg
1_193.jpeg
1_194.jpeg
1_195.jpeg
1_196.jpeg
1_197.jpeg
1_198.jpeg
1_199.jpeg
2_200.jpeg
2_201.jpeg
2_202.jpeg
2_203.jpeg
2_204.jpeg
2_205.jpeg
2_206.jpeg
2_207.jpeg
2_208.jpeg
2_209.jpeg
2_210.jpeg
2_211.jpeg
2_212.jpeg
2_213.jpeg
2_214.jpeg
2_215.jpeg
2_216.jpeg
2_217.jpeg
2_218.jpeg
2_219.jpeg
2_220.jpeg
2_221.jpeg
2_222.jpeg
2_223.jpeg
2_224.jpeg
2_225.jpeg
2_226.jpeg
2_227.jpeg
2_228.jpeg
2_229.jpeg
2_230.jpeg
2_231.jpeg
2_232.jpeg
2_233.jpeg
2_234.jpeg
2_235.jpeg
2_236.jpeg
2_237.jpeg
2_238.jpeg
2_239.jpeg
2_240.jpeg
2_241.jpeg
2_242.jpeg
2_243.jpeg
2_244.jpeg
2_245.jpeg
2_246.jpeg
2_247.jpeg
2_248.jpeg
2_249.jpeg
2_250.jpeg
2_251.jpeg
2_252.jpeg
2_253.jpeg
2_254.jpeg
2_255.jpeg
2_256.jpeg
2_257.jpeg
2_258.jpeg
2_259.jpeg
2_260.jpeg
2_261.jpeg
2_262.jpeg
2_263.jpeg
2_264.jpeg
2_265.jpeg
2_266.jpeg
2_267.jpeg
2_268.jpeg
2_269.jpeg
2_270.jpeg
2_271.jpeg
2_272.jpeg
2_273.jpeg
2_274.jpeg
2_275.jpeg
2_276.jpeg
2_277.jpeg
2_278.jpeg
2_279.jpeg
2_280.jpeg
2_281.jpeg
2_282.jpeg
2_283.jpeg
2_284.jpeg
2_285.jpeg
2_286.jpeg
2_287.jpeg
2_288.jpeg
2_289.jpeg
2_290.jpeg
2_291.jpeg
2_292.jpeg
2_293.jpeg
2_294.jpeg
2_295.jpeg
2_296.jpeg
2_297.jpeg
2_298.jpeg
2_299.jpeg
3_300.jpeg
3_301.jpeg
3_302.jpeg
3_303.jpeg
3_304.jpeg
3_305.jpeg
3_306.jpeg
3_307.jpeg
3_308.jpeg
3_309.jpeg
3_310.jpeg
3_311.jpeg
3_312.jpeg
3_313.jpeg
3_314.jpeg
3_315.jpeg
3_316.jpeg
3_317.jpeg
3_318.jpeg
3_319.jpeg
3_320.jpeg
3_321.jpeg
3_322.jpeg
3_323.jpeg
3_324.jpeg
3_325.jpeg
3_326.jpeg
3_327.jpeg
3_328.jpeg
3_329.jpeg
3_330.jpeg
3_331.jpeg
3_332.jpeg
3_333.jpeg
3_334.jpeg
3_335.jpeg
3_336.jpeg
3_337.jpeg
3_338.jpeg
3_339.jpeg
3_340.jpeg
3_341.jpeg
3_342.jpeg
3_343.jpeg
3_344.jpeg
3_345.jpeg
3_346.jpeg
3_347.jpeg
3_348.jpeg
3_349.jpeg
3_350.jpeg
3_351.jpeg
3_352.jpeg
3_353.jpeg
3_354.jpeg
3_355.jpeg
3_356.jpeg
3_357.jpeg
3_358.jpeg
3_359.jpeg
3_360.jpeg
3_361.jpeg
3_362.jpeg
3_363.jpeg
3_364.jpeg
3_365.jpeg
3_366.jpeg
3_367.jpeg
3_368.jpeg
3_369.jpeg
3_370.jpeg
3_371.jpeg
3_372.jpeg
3_373.jpeg
3_374.jpeg
3_375.jpeg
3_376.jpeg
3_377.jpeg
3_378.jpeg
3_379.jpeg
3_380.jpeg
3_381.jpeg
3_382.jpeg
3_383.jpeg
3_384.jpeg
3_385.jpeg
3_386.jpeg
3_387.jpeg
3_388.jpeg
3_389.jpeg
3_390.jpeg
3_391.jpeg
3_392.jpeg
3_393.jpeg
3_394.jpeg
3_395.jpeg
3_396.jpeg
3_397.jpeg
3_398.jpeg
3_399.jpeg
4_400.jpeg
4_401.jpeg
4_402.jpeg
4_403.jpeg
4_404.jpeg
4_405.jpeg
4_406.jpeg
4_407.jpeg
4_408.jpeg
4_409.jpeg
4_410.jpeg
4_411.jpeg
4_412.jpeg
4_413.jpeg
4_414.jpeg
4_415.jpeg
4_416.jpeg
4_417.jpeg
4_418.jpeg
4_419.jpeg
4_420.jpeg
4_421.jpeg
4_422.jpeg
4_423.jpeg
4_424.jpeg
4_425.jpeg
4_426.jpeg
4_427.jpeg
4_428.jpeg
4_429.jpeg
4_430.jpeg
4_431.jpeg
4_432.jpeg
4_433.jpeg
4_434.jpeg
4_435.jpeg
4_436.jpeg
4_437.jpeg
4_438.jpeg
4_439.jpeg
4_440.jpeg
4_441.jpeg
4_442.jpeg
4_443.jpeg
4_444.jpeg
4_445.jpeg
4_446.jpeg
4_447.jpeg
4_448.jpeg
4_449.jpeg
4_450.jpeg
4_451.jpeg
4_452.jpeg
4_453.jpeg
4_454.jpeg
4_455.jpeg
4_456.jpeg
4_457.jpeg
4_458.jpeg
4_459.jpeg
4_460.jpeg
4_461.jpeg
4_462.jpeg
4_463.jpeg
4_464.jpeg
4_465.jpeg
4_466.jpeg
4_467.jpeg
4_468.jpeg
4_469.jpeg
4_470.jpeg
4_471.jpeg
4_472.jpeg
4_473.jpeg
4_474.jpeg
4_475.jpeg
4_476.jpeg
4_477.jpeg
4_478.jpeg
4_479.jpeg
4_480.jpeg
4_481.jpeg
4_482.jpeg
4_483.jpeg
4_484.jpeg
4_485.jpeg
4_486.jpeg
4_487.jpeg
4_488.jpeg
4_489.jpeg
4_490.jpeg
4_491.jpeg
4_492.jpeg
4_493.jpeg
4_494.jpeg
4_495.jpeg
4_496.jpeg
4_497.jpeg
4_498.jpeg
4_499.jpeg
5_500.jpeg
5_501.jpeg
5_502.jpeg
5_503.jpeg
5_504.jpeg
5_505.jpeg
5_506.jpeg
5_507.jpeg
5_508.jpeg
5_509.jpeg
5_510.jpeg
5_511.jpeg
5_512.jpeg
5_513.jpeg
5_514.jpeg
5_515.jpeg
5_516.jpeg
5_517.jpeg
5_518.jpeg
5_519.jpeg
5_520.jpeg
5_521.jpeg
5_522.jpeg
5_523.jpeg
5_524.jpeg
5_525.jpeg
5_526.jpeg
5_527.jpeg
5_528.jpeg
5_529.jpeg
5_530.jpeg
5_531.jpeg
5_532.jpeg
5_533.jpeg
5_534.jpeg
5_535.jpeg
5_536.jpeg
5_537.jpeg
5_538.jpeg
5_539.jpeg
5_540.jpeg
5_541.jpeg
5_542.jpeg
5_543.jpeg
5_544.jpeg
5_545.jpeg
5_546.jpeg
5_547.jpeg
5_548.jpeg
5_549.jpeg
5_550.jpeg
5_551.jpeg
5_552.jpeg
5_553.jpeg
5_554.jpeg
5_555.jpeg
5_556.jpeg
5_557.jpeg
5_558.jpeg
5_559.jpeg
5_560.jpeg
5_561.jpeg
5_562.jpeg
5_563.jpeg
5_564.jpeg
5_565.jpeg
5_566.jpeg
5_567.jpeg
5_568.jpeg
5_569.jpeg
5_570.jpeg
5_571.jpeg
5_572.jpeg
5_573.jpeg
5_574.jpeg
5_575.jpeg
5_576.jpeg
5_577.jpeg
5_578.jpeg
5_579.jpeg
5_580.jpeg
5_581.jpeg
5_582.jpeg
5_583.jpeg
5_584.jpeg
5_585.jpeg
5_586.jpeg
5_587.jpeg
5_588.jpeg
5_589.jpeg
5_590.jpeg
5_591.jpeg
5_592.jpeg
5_593.jpeg
5_594.jpeg
5_595.jpeg
5_596.jpeg
5_597.jpeg
5_598.jpeg
5_599.jpeg
6_600.jpeg
6_601.jpeg
6_602.jpeg
6_603.jpeg
6_604.jpeg
6_605.jpeg
6_606.jpeg
6_607.jpeg
6_608.jpeg
6_609.jpeg
6_610.jpeg
6_611.jpeg
6_612.jpeg
6_613.jpeg
6_614.jpeg
6_615.jpeg
6_616.jpeg
6_617.jpeg
6_618.jpeg
6_619.jpeg
6_620.jpeg
6_621.jpeg
6_622.jpeg
6_623.jpeg
6_624.jpeg
6_625.jpeg
6_626.jpeg
6_627.jpeg
6_628.jpeg
6_629.jpeg
6_630.jpeg
6_631.jpeg
6_632.jpeg
6_633.jpeg
6_634.jpeg
6_635.jpeg
6_636.jpeg
6_637.jpeg
6_638.jpeg
6_639.jpeg
6_640.jpeg
6_641.jpeg
6_642.jpeg
6_643.jpeg
6_644.jpeg
6_645.jpeg
6_646.jpeg
6_647.jpeg
6_648.jpeg
6_649.jpeg
6_650.jpeg
6_651.jpeg
6_652.jpeg
6_653.jpeg
6_654.jpeg
6_655.jpeg
6_656.jpeg
6_657.jpeg
6_658.jpeg
6_659.jpeg
6_660.jpeg
6_661.jpeg
6_662.jpeg
6_663.jpeg
6_664.jpeg
6_665.jpeg
6_666.jpeg
6_667.jpeg
6_668.jpeg
6_669.jpeg
6_670.jpeg
6_671.jpeg
6_672.jpeg
6_673.jpeg
6_674.jpeg
6_675.jpeg
6_676.jpeg
6_677.jpeg
6_678.jpeg
6_679.jpeg
6_680.jpeg
6_681.jpeg
6_682.jpeg
6_683.jpeg
6_684.jpeg
6_685.jpeg
6_686.jpeg
6_687.jpeg
6_688.jpeg
6_689.jpeg
6_690.jpeg
6_691.jpeg
6_692.jpeg
6_693.jpeg
6_694.jpeg
6_695.jpeg
6_696.jpeg
6_697.jpeg
6_698.jpeg
6_699.jpeg
7_700.jpeg
7_701.jpeg
7_702.jpeg
7_703.jpeg
7_704.jpeg
7_705.jpeg
7_706.jpeg
7_707.jpeg
7_708.jpeg
7_709.jpeg
7_710.jpeg
7_711.jpeg
7_712.jpeg
7_713.jpeg
7_714.jpeg
7_715.jpeg
7_716.jpeg
7_717.jpeg
7_718.jpeg
7_719.jpeg
7_720.jpeg
7_721.jpeg
7_722.jpeg
7_723.jpeg
7_724.jpeg
7_725.jpeg
7_726.jpeg
7_727.jpeg
7_728.jpeg
7_729.jpeg
7_730.jpeg
7_731.jpeg
7_732.jpeg
7_733.jpeg
7_734.jpeg
7_735.jpeg
7_736.jpeg
7_737.jpeg
7_738.jpeg
7_739.jpeg
7_740.jpeg
7_741.jpeg
7_742.jpeg
7_743.jpeg
7_744.jpeg
7_745.jpeg
7_746.jpeg
7_747.jpeg
7_748.jpeg
7_749.jpeg
7_750.jpeg
7_751.jpeg
7_752.jpeg
7_753.jpeg
7_754.jpeg
7_755.jpeg
7_756.jpeg
7_757.jpeg
7_758.jpeg
7_759.jpeg
7_760.jpeg
7_761.jpeg
7_762.jpeg
7_763.jpeg
7_764.jpeg
7_765.jpeg
7_766.jpeg
7_767.jpeg
7_768.jpeg
7_769.jpeg
7_770.jpeg
7_771.jpeg
7_772.jpeg
7_773.jpeg
7_774.jpeg
7_775.jpeg
7_776.jpeg
7_777.jpeg
7_778.jpeg
7_779.jpeg
7_780.jpeg
7_781.jpeg
7_782.jpeg
7_783.jpeg
7_784.jpeg
7_785.jpeg
7_786.jpeg
7_787.jpeg
7_788.jpeg
7_789.jpeg
7_790.jpeg
7_791.jpeg
7_792.jpeg
7_793.jpeg
7_794.jpeg
7_795.jpeg
7_796.jpeg
7_797.jpeg
7_798.jpeg
7_799.jpeg
8_800.jpeg
8_801.jpeg
8_802.jpeg
8_803.jpeg
8_804.jpeg
8_805.jpeg
8_806.jpeg
8_807.jpeg
8_808.jpeg
8_809.jpeg
8_810.jpeg
8_811.jpeg
8_812.jpeg
8_813.jpeg
8_814.jpeg
8_815.jpeg
8_816.jpeg
8_817.jpeg
8_818.jpeg
8_819.jpeg
8_820.jpeg
8_821.jpeg
8_822.jpeg
8_823.jpeg
8_824.jpeg
8_825.jpeg
8_826.jpeg
8_827.jpeg
8_828.jpeg
8_829.jpeg
8_830.jpeg
8_831.jpeg
8_832.jpeg
8_833.jpeg
8_834.jpeg
8_835.jpeg
8_836.jpeg
8_837.jpeg
8_838.jpeg
8_839.jpeg
8_840.jpeg
8_841.jpeg
8_842.jpeg
8_843.jpeg
8_844.jpeg
8_845.jpeg
8_846.jpeg
8_847.jpeg
8_848.jpeg
8_849.jpeg
8_850.jpeg
8_851.jpeg
8_852.jpeg
8_853.jpeg
8_854.jpeg
8_855.jpeg
8_856.jpeg
8_857.jpeg
8_858.jpeg
8_859.jpeg
8_860.jpeg
8_861.jpeg
8_862.jpeg
8_863.jpeg
8_864.jpeg
8_865.jpeg
8_866.jpeg
8_867.jpeg
8_868.jpeg
8_869.jpeg
8_870.jpeg
8_871.jpeg
8_872.jpeg
8_873.jpeg
8_874.jpeg
8_875.jpeg
8_876.jpeg
8_877.jpeg
8_878.jpeg
8_879.jpeg
8_880.jpeg
8_881.jpeg
8_882.jpeg
8_883.jpeg
8_884.jpeg
8_885.jpeg
8_886.jpeg
8_887.jpeg
8_888.jpeg
8_889.jpeg
8_890.jpeg
8_891.jpeg
8_892.jpeg
8_893.jpeg
8_894.jpeg
8_895.jpeg
8_896.jpeg
8_897.jpeg
8_898.jpeg
8_899.jpeg
0_900.jpeg""")
weave_2 = Weave(Pattern=[0, 1], Stream0=panel_4, Stream1=graft(panel_5), NullGaps=False)
text_split = TextSplit(Text=repeat_data, Separators=",")
join_2 = TextJoin(Text=weave_2)
list_item = ListItem(List=text_split, Index="7", Wrap=True)
custom_preview_materials = CustomPreviewMaterials(Geometry=flatten(flip), DiffuseColor=RGB(255, 255, 255), DiffuseBitmap=flatten(join_2))
list_length = ListLength(List=flatten(list_item))
equality = Equality(FirstNumber=flatten(list_item), SecondNumber="0")  # -> Equality, Inequality
panel_6 = Panel(join_2)
series_5 = Series(Start=0, Step=1, Count=list_length)
dispatch = Dispatch(List=series_5, DispatchPattern=equality.Equality)  # -> ListA, ListB
item = ListItem(List=flatten(flip), Index=dispatch.ListB, Wrap=True)
debrep = DeconstructBrep(Brep=item)  # -> Faces, Edges, Vertices
area = Area(Geometry=item)  # -> Area, Centroid
join_3 = JoinCurves(Curves=debrep.Edges, Preserve=False)  # -> flatten(Curves)
scale = Scale(Geometry=join_3, Center=area.Centroid, Factor=Slider(0.68, range=0..1))  # -> Geometry, Transform
previewlw = CustomPreviewLineweights(
    Geometry=scale.Geometry,
    Shader=ColourSwatch(SwatchColor=RGB(255, 0, 0)),
    Thickness=Slider(4.8, range=0..10),
    Absolute=False)
flip_matrix = FlipMatrix(Data=text_split)
replace_items = ReplaceItems(List=flip_matrix, Indices=dispatch.ListB, Wrap=False)
clean_tree = CleanTree(RemoveNulls=True, RemoveInvalid=True, RemoveEmpty=True, Tree=replace_items)
panel_7 = Panel("""3
7""")
flip_matrix_2 = FlipMatrix(Data=clean_tree)
bounds = Bounds(Numbers=clean_tree)
explode_tree = ExplodeTree(Data=flip_matrix)  # -> _0000, _0001, _0002, _0003, _0004, _0005, _0006, _0007
data = Data(["0_0.jpeg", "0_1.jpeg", "0_2.jpeg", "0_3.jpeg", "0_4.jpeg", "0_5.jpeg"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])
replace_items_2 = ReplaceItems(List=flip_matrix_2, Indices=panel_7, Wrap=False)
deconstruct_domain = DeconstructDomain(Domain=bounds)  # -> Start, End
split_list = SplitList(List=data, Index="1")  # -> ListA, ListB
clean_tree_2 = CleanTree(RemoveNulls=True, RemoveInvalid=True, RemoveEmpty=True, Tree=replace_items_2)
construct_domain = ConstructDomain(DomainStart=0, DomainEnd=deconstruct_domain.End)
panel_8 = Panel(explode_tree._0004)
remap_numbers = RemapNumbers(Value=clean_tree, Source=construct_domain, Target=Domain(0, 1))  # -> Mapped, Clipped
replace_items_3 = ReplaceItems(List=explode_tree._0002, Indices=dispatch.ListB, Wrap=False)
replace_items_4 = ReplaceItems(List=explode_tree._0003, Indices=dispatch.ListB, Wrap=False)
replace_items_5 = ReplaceItems(List=explode_tree._0004, Indices=dispatch.ListB, Wrap=False)
replace_items_6 = ReplaceItems(List=explode_tree._0005, Indices=dispatch.ListB, Wrap=False)
series_6 = Series(Start=0, Step="2700", Count="4")
flip_matrix_3 = FlipMatrix(Data=remap_numbers.Mapped)
clean_tree_3 = CleanTree(RemoveNulls=True, RemoveInvalid=True, RemoveEmpty=True, Tree=replace_items_6)
panel_9 = Panel("""3
7""")
flip_matrix_4 = FlipMatrix(Data=clean_tree)
unit_x_3 = UnitX(Factor=series_6)
replace_items_7 = ReplaceItems(List=flip_matrix_3, Indices=panel_9, Wrap=False)
number_slider = Slider(1, range=0..10)
clean_tree_4 = CleanTree(RemoveNulls=True, RemoveInvalid=True, RemoveEmpty=True, Tree=replace_items_7)
series_7 = Series(Start=0, Step="528", Count="10")
addition = Addition(A=dispatch.ListB, B="0")
unit_y = UnitY(Factor=expr("X*-5", series_7))
replace = ReplaceItems(List=split_list.ListB, Indices=addition, Wrap=False)
mass_addition = MassAddition(Input=clean_tree_4)  # -> Result, PartialResults
clean = CleanTree(RemoveNulls=True, RemoveInvalid=True, RemoveEmpty=False, Tree=replace)
seats = ReplaceItems(List=replace_items_3, Indices=dispatch.ListB, Wrap=False)
capacity = ReplaceItems(List=replace_items_5, Indices=dispatch.ListB, Wrap=False)
replace_2 = ReplaceItems(List=replace_items_6, Indices=dispatch.ListB, Wrap=False)
file_name = ReplaceItems(List=replace_items_4, Indices=dispatch.ListB, Wrap=False)
division_5 = Division(A=mass_addition.Result, B=9)
clean_2 = CleanTree(RemoveNulls=True, RemoveInvalid=True, RemoveEmpty=False, Tree=capacity)
clean_3 = CleanTree(RemoveNulls=True, RemoveInvalid=True, RemoveEmpty=False, Tree=seats)
clean_4 = CleanTree(RemoveNulls=True, RemoveInvalid=True, RemoveEmpty=False, Tree=file_name)
clean_5 = CleanTree(RemoveNulls=True, RemoveInvalid=True, RemoveEmpty=False, Tree=replace_2)
dispatch_2 = Dispatch(List=clean, DispatchPattern=[True, False])  # -> ListA, ListB
remap_numbers_2 = RemapNumbers(Value=division_5, Source="0 To 1", Target="-1 To 1")  # -> Mapped, Clipped
replace_items_8 = ReplaceItems(List=panel_2, Indices=dispatch.ListB, Wrap=False)
bnd = Bounds(Numbers=clean_2)
clean_tree_5 = CleanTree(RemoveNulls=True, RemoveInvalid=True, RemoveEmpty=True, Tree=replace_items_8)
tree_statistics = TreeStatistics(Tree=remap_numbers_2.Mapped)  # -> Paths, Length, Count
bnd_2 = Bounds(Numbers=clean_5)
panel_10 = Panel(clean)
remap = RemapNumbers(Value=clean_5, Source=bnd_2, Target=Domain(0, 1))  # -> Mapped, Clipped
short = ShortestList(ListA=clean_3, ListB=clean, TrimMode=2)  # -> ListA, ListB
point = Point(Point(497030.5434, 2478.570647, 0))
random_split_list = RandomSplitList(MasterList=tree_statistics.Paths, Seed=2, Split=".2")  # -> ListA, ListB
remap_2 = RemapNumbers(Value=clean_2, Source=bnd, Target=Domain(0, 1))  # -> Mapped, Clipped
short_2 = ShortestList(ListA=clean_3, ListB=clean_2, TrimMode=2)  # -> ListA, ListB
tree_branch = TreeBranch(Tree=clean_tree_4, Path=random_split_list.ListB, MaintainPaths=True)
tree_branch_2 = TreeBranch(Tree=remap_numbers_2.Mapped, Path=random_split_list.ListB, MaintainPaths=True)
unit_y_2 = UnitY(Factor="1200")
group = Group(Objects=move_5.Geometry)
neural_network_trainer = NeuralNetworkTrainer(TrainingInputs=tree_branch, TrainingOutputs=tree_branch_2, InputNeurons=2, HiddenNeurons=2, Alpha=1, Iterations=1000)  # -> TrainedNueralNetwork, ErrorsDynamics
unit_y_3 = UnitY(Factor="40000")
neural_network_tester = NeuralNetworkTesting(TrainedNeuralNetwork=neural_network_trainer.TrainedNueralNetwork, TestInputData=clean_tree_4)
unit_x_4 = UnitX(Factor="-2200")
number_slider_2 = Slider(1000, range=0..1000)
swatch = ColourSwatch(SwatchColor=RGB(0, 0, 0))
series_8 = Series(Start="1", Step=1, Count="9")
dom_5 = ConstructDomain(DomainStart="-1", DomainEnd="1")
X_3 = UnitX(Factor=Slider(97964, range=0..100000))
dom_6 = ConstructDomain(DomainStart="0", DomainEnd="23")
multiplication = Multiplication(A=graft(remap_numbers_2.Mapped), B=number_slider_2)
multiplication_2 = Multiplication(A=neural_network_tester, B=number_slider_2)
number_slider_3 = Slider(12000, range=0..100000)
remap_3 = RemapNumbers(Value=neural_network_tester, Source=dom_5, Target=dom_6)  # -> Mapped, Clipped
sort_list = SortList(Keys=flatten(remap_3.Mapped))  # -> Keys, ValuesValuesA
list_item_2 = ListItem(List=sort_list.Keys, Index=0, Wrap=True)
subtraction = Subtraction(A=remap_3.Mapped, B=list_item_2)
round = Round(Number=subtraction)  # -> flatten(Nearest), Floor, Ceiling
equals = Equality(FirstNumber=round.Nearest, SecondNumber=Slider(0, range=0..10))  # -> Equality, Inequality
dispatch_3 = Dispatch(List=clean_3, DispatchPattern=flatten(equals.Equality))  # -> ListA, ListB
dispatch_4 = Dispatch(List=remap_2.Mapped, DispatchPattern=flatten(equals.Equality))  # -> ListA, ListB
dispatch_5 = Dispatch(List=remap.Mapped, DispatchPattern=flatten(equals.Equality))  # -> ListA, ListB
dispatch_6 = Dispatch(List=short.ListB, DispatchPattern=flatten(equals.Equality))  # -> ListA, ListB
addition_2 = Addition(A=multiplication_2, B=number_slider_3)
addition_3 = Addition(A=multiplication, B=number_slider_3)
curve = Curve(<curve referenced from the Rhino model>)
round_2 = Round(Number=addition_2)  # -> Nearest, Floor, Ceiling
round_3 = Round(Number=addition_3)  # -> Nearest, Floor, Ceiling
explode = Explode(Curve=curve, Recursive=True)  # -> Segments, Vertices
panel_11 = Panel(remap_3.Mapped)
construct_point = ConstructPoint(XCoordinate=round_2.Nearest, YCoordinate=round_3.Nearest, ZCoordinate=0)
offset_curve = OffsetCurve(Curve=explode.Segments, Distance="35", Corners=1)
divide_curve = DivideCurve(Curve=graft(offset_curve), Count="10", Kinks=False)  # -> Points, Tangents, Parameters
circle = Circle(Plane=construct_point, Radius="10")
divide_curve_2 = DivideCurve(Curve=graft(explode.Segments), Count="10", Kinks=False)  # -> Points, Tangents, Parameters

# ---- group: capacity viz
dispatch_7 = Dispatch(List=flatten(explode_tree._0004), DispatchPattern=flatten(equals.Equality))  # -> ListA, ListB
sort = SortList(Keys=short_2.ListB)  # -> Keys, ValuesA
item_2 = ListItem(List=reverse(sort.Keys), Index=0, Wrap=True)
dom_7 = ConstructDomain(DomainStart=0, DomainEnd=item_2)
pt = ConstructPoint(XCoordinate="200000", YCoordinate="-50000", ZCoordinate=0)
pt_2 = ConstructPoint(XCoordinate="200000", YCoordinate="-25000", ZCoordinate=0)
ln = Line(StartPoint=pt, EndPoint=pt_2)
remap_4 = RemapNumbers(Value=dispatch_7.ListA, Source=dom_7, Target=Domain(0, 1))  # -> Mapped, Clipped
number_slider_4 = Slider(10, range=0..10)
eval = EvaluateCurve(Curve=reparameterize(ln), Parameter=remap_4.Mapped)  # -> Point, Tangent, Angle
range = Range(Domain=dom_7, Steps=number_slider_4)
dom_8 = ConstructDomain(DomainStart=0, DomainEnd="2500")
dom_9 = ConstructDomain(DomainStart=0, DomainEnd="-1000")
divide = DivideCurve(Curve=ln, Count=number_slider_4, Kinks=False)  # -> Points, Tangents, Parameters
X_4 = UnitX(Factor="-500")
round_4 = Round(Number=range)  # -> Nearest, Floor, Ceiling
move_7 = Move(Geometry=divide.Points, Motion=X_4)  # -> Geometry, Transform
rectangle = Rectangle(Plane=eval.Point, XSize=dom_8, YSize=dom_9, Radius=0)  # -> Rectangle, Length
srf = Surface(rectangle.Rectangle)
material = CreateMaterial(
    Diffuse=ColourSwatch(SwatchColor=RGB(111, 0, 255)),
    Specular=RGB(255, 255, 255),
    Emission=RGB(0, 0, 0),
    Transparency=Slider(0.97, range=0..1),
    Shine=0)
tag = TextTag3D(
    Location=move_7.Geometry,
    Text=round_4.Floor,
    Size=Slider(1000, range=0..10000),
    Colour=ColourSwatch(SwatchColor=RGB(0, 0, 0)),
    Justification=9)
preview = CustomPreview(Geometry=srf, Material=material)

# ----
line = Line(StartPoint=divide_curve_2.Points, EndPoint=divide_curve.Points)
tt_lineweight_preview = TTLineweightPreview(Geometry=line, Shader=ColourSwatch(SwatchColor=RGB(0, 0, 0)), Absolute=False)
tt_lineweight_preview_2 = TTLineweightPreview(Geometry=circle, Shader=ColourSwatch(SwatchColor=RGB(0, 0, 0)), Absolute=False)
panel_12 = Panel(replace_items_5)
sort_list_2 = SortList(Keys=reverse(dispatch_7.ListA))  # -> Keys, ValuesValuesA
panel_13 = Panel(explode_tree._0000)

# ---- group: Morphology to portion
dispatch_8 = Dispatch(List=flatten(explode_tree._0000), DispatchPattern=flatten(equals.Equality))  # -> ListA, ListB
dispatch_9 = Dispatch(List=short.ListB, DispatchPattern=flatten(equals.Equality))  # -> ListA, ListB
number_slider_5 = Slider(10000, range=0..10000)
short_3 = ShortestList(ListA=dispatch_8.ListA, ListB=dispatch_9.ListA, TrimMode=2)  # -> ListA, ListB
split = TextSplit(Text=dispatch_9.ListA, Separators="_")
item_3 = ListItem(List=split, Index=0, Wrap=True)
bnd_3 = Bounds(Numbers=short_3.ListA)
dom_10 = ConstructDomain(DomainStart=0, DomainEnd=Slider(21000, range=0..100000))
pt_3 = ConstructPoint(XCoordinate="260000", YCoordinate="-50000", ZCoordinate=0)
pt_4 = ConstructPoint(XCoordinate="260000", YCoordinate="-25000", ZCoordinate=0)
len = TextLength(Text=item_3)
panel_14 = Panel(item_3)
remap_5 = RemapNumbers(Value=short_3.ListA, Source=bnd_3, Target=dom_10)  # -> Mapped, Clipped
ln_2 = Line(StartPoint=pt_3, EndPoint=pt_4)
dom_11 = ConstructDomain(DomainStart="1", DomainEnd="9")
preview_2 = CustomPreview(Geometry=ln_2, Material=ColourSwatch(SwatchColor=RGB(0, 0, 0)))
fragment = TextFragment(Text=item_3, Start=expr("x-1", len), Count=1)
remap_6 = RemapNumbers(Value=expr("x+1", item_3), Source=Domain(0, 9), Target=Domain(-0.1, 1))  # -> flatten(Mapped), Clipped
number_slider_6 = Slider(8, range=0..10)
eval_2 = EvaluateCurve(Curve=reparameterize(ln_2), Parameter=remap_6.Mapped)  # -> Point, Tangent, Angle
dom_12 = ConstructDomain(DomainStart=0, DomainEnd="-1000")
range_2 = Range(Domain=dom_11, Steps=number_slider_6)
dom_13 = ConstructDomain(DomainStart=0, DomainEnd=remap_5.Mapped)
divide_2 = DivideCurve(Curve=ln_2, Count=number_slider_6, Kinks=False)  # -> Points, Tangents, Parameters
panel_15 = Panel(fragment)
series_9 = Series(Start=0, Step=1, Count=10)
X_5 = UnitX(Factor="-700")
round_5 = Round(Number=range_2)  # -> Nearest, Floor, Ceiling
rectangle_2 = Rectangle(Plane=eval_2.Point, XSize=dom_13, YSize=dom_12, Radius=0)  # -> Rectangle, Length
move_8 = Move(Geometry=divide_2.Points, Motion=X_5)  # -> Geometry, Transform
concat = Concatenate(FragmentA="Type ", FragmentB=round_5.Nearest)
srf_2 = Surface(rectangle_2.Rectangle)
material_2 = CreateMaterial(
    Diffuse=ColourSwatch(SwatchColor=RGB(255, 191, 0)),
    Specular=RGB(255, 255, 255),
    Emission=RGB(0, 0, 0),
    Transparency=Slider(0.97, range=0..1),
    Shine=0)
tag_2 = TextTag3D(
    Location=move_8.Geometry,
    Text=concat,
    Size=Slider(1000, range=0..10000),
    Colour=ColourSwatch(SwatchColor=RGB(0, 0, 0)),
    Justification=9)
preview_3 = CustomPreview(Geometry=srf_2, Material=material_2)

# ----
series_10 = Series(Start=0, Step=1, Count=10)
preview_4 = CustomPreview(Geometry=ln, Material=ColourSwatch(SwatchColor=RGB(0, 0, 0)))
range_3 = Range(Domain=Domain(0, 1), Steps=10)

# ---- group: morpohology and area
dispatch_10 = Dispatch(List=flatten(explode_tree._0003), DispatchPattern=flatten(equals.Equality))  # -> ListA, ListB
dispatch_11 = Dispatch(List=panel_2, DispatchPattern=flatten(equals.Equality))  # -> ListA, ListB
short_4 = ShortestList(ListA=dispatch_10.ListA, ListB=dispatch_11.ListA, TrimMode=2)  # -> ListA, ListB
split_2 = TextSplit(Text=dispatch_11.ListA, Separators="_")
item_4 = ListItem(List=split_2, Index=0, Wrap=True)
bnd_4 = Bounds(Numbers=short_4.ListA)
dom_14 = ConstructDomain(DomainStart=0, DomainEnd=Slider(11455, range=0..100000))
pt_5 = ConstructPoint(XCoordinate="295000", YCoordinate="-50000", ZCoordinate=0)
pt_6 = ConstructPoint(XCoordinate="295000", YCoordinate="-25000", ZCoordinate=0)
len_2 = TextLength(Text=item_4)
panel_16 = Panel(item_4)
remap_7 = RemapNumbers(Value=short_4.ListA, Source=bnd_4, Target=dom_14)  # -> Mapped, Clipped
ln_3 = Line(StartPoint=pt_5, EndPoint=pt_6)
preview_5 = CustomPreview(Geometry=ln_3, Material=ColourSwatch(SwatchColor=RGB(0, 0, 0)))
fragment_2 = TextFragment(Text=item_4, Start=expr("x-1", len_2), Count=1)
remap_8 = RemapNumbers(Value=expr("x+1", item_4), Source=Domain(0, 9), Target=Domain(-0.1, 1))  # -> flatten(Mapped), Clipped
panel_17 = Panel("2500")
dom_15 = ConstructDomain(DomainStart="5000", DomainEnd="15000")
eval_3 = EvaluateCurve(Curve=reparameterize(ln_3), Parameter=remap_8.Mapped)  # -> Point, Tangent, Angle
dom_16 = ConstructDomain(DomainStart=0, DomainEnd="-1000")
range_4 = Range(Domain=dom_15, Steps=Slider(8, range=0..10))
dom_17 = ConstructDomain(DomainStart=0, DomainEnd=short_4.ListA)
divide_3 = DivideCurve(Curve=ln_3, Count=Slider(8, range=0..10), Kinks=False)  # -> Points, Tangents, Parameters
panel_18 = Panel(fragment_2)
series_11 = Series(Start=0, Step=1, Count=10)
X_6 = UnitX(Factor="-700")
round_6 = Round(Number=range_4)  # -> Nearest, Floor, Ceiling
rectangle_3 = Rectangle(Plane=eval_3.Point, XSize=dom_17, YSize=dom_16, Radius=0)  # -> Rectangle, Length
move_9 = Move(Geometry=divide_3.Points, Motion=X_6)  # -> Geometry, Transform
concat_2 = Concatenate(FragmentA="Type ", FragmentB=round_6.Nearest)
srf_3 = Surface(rectangle_3.Rectangle)
material_3 = CreateMaterial(
    Diffuse=ColourSwatch(SwatchColor=RGB(60, 255, 0)),
    Specular=RGB(255, 255, 255),
    Emission=RGB(0, 0, 0),
    Transparency=Slider(0.97, range=0..1),
    Shine=0)
tag_3 = TextTag3D(
    Location=move_9.Geometry,
    Text=round_6.Nearest,
    Size=Slider(1000, range=0..10000),
    Colour=ColourSwatch(SwatchColor=RGB(0, 0, 0)),
    Justification=9)
preview_6 = CustomPreview(Geometry=srf_3, Material=material_3)

# ----
text_split_2 = TextSplit(Text=dispatch_10.ListA, Separators=".")
list_item_3 = ListItem(List=text_split_2, Index=0, Wrap=True)  # -> flatten(Item)
division_6 = Division(A=list_item_3, B=Slider(1000, range=0..1000))
round_7 = Round(Number=division_6)  # -> Nearest, Floor, Ceiling

# ----
# Percentage closest seats to zone 4
# filename
# Capacity
# Zone 4 areas
# Number of zone 4 areas
# touching boundary
# roof area
# building footprint
# facade area
# number of element types
# total numer of elements
# top sightline seats
# % top seats
# file name
# capacity
# area domain differernce
# touching boundary
group_2 = Group(Objects=move_3.Geometry)
X_7 = UnitX(Factor="100000")
short_5 = ShortestList(ListA=round.Nearest, ListB=clean, TrimMode=2)  # -> ListA, ListB
sort_2 = SortList(Keys=short_5.ListA, ValuesA=short_5.ListB)  # -> Keys, ValuesA
move_10 = Move(Geometry=group_2, Motion=X_7)  # -> flatten(Geometry), Transform
short_6 = ShortestList(ListA=round.Nearest, ListB=data, TrimMode=2)  # -> ListA, ListB
ungroup = Ungroup(Group=move_10.Geometry)
cset = CreateSet(List=sort_2.Keys)  # -> Set, Map
flip_3 = FlipMatrix(Data=ungroup)
sort_3 = SortList(Keys=short_6.ListA, ValuesA=short_6.ListB)  # -> Keys, ValuesA
mindex = MemberIndex(Set=sort_2.Keys, Member=cset.Set)  # -> Index, Count
group_3 = Group(Objects=flip_3)
cset_2 = CreateSet(List=sort_3.Keys)  # -> Set, Map
mindex_2 = MemberIndex(Set=sort_3.Keys, Member=cset_2.Set)  # -> Index, Count
panel_19 = Panel(clean_tree_2)
partition = PartitionList(List=sort_3.ValuesA, Size=mindex_2.Count)
unit_x_5 = UnitX(Factor="400000")
random = Random(Range="0 To 86", Number="4", Seed=Slider(37, range=0..100))
tree_statistics_2 = TreeStatistics(Tree=clean_tree_2)  # -> Paths, Length, Count
panel_20 = Panel("""0
1
2
3""")
partition_2 = PartitionList(List=tree_statistics_2.Paths, Size=mindex_2.Count)
list_item_4 = ListItem(List=partition_2, Index=random, Wrap=True)
tree_branch_3 = TreeBranch(Tree=clean_tree_2, Path=list_item_4, MaintainPaths=True)
list_item_5 = ListItem(List=tree_branch_3, Index=0, Wrap=True)  # -> Item, Item1, Item2, Item3, Item4
bounds_2 = Bounds(Numbers=flatten(list_item_5.Item))
bounds_3 = Bounds(Numbers=flatten(list_item_5.Item1))
bounds_4 = Bounds(Numbers=flatten(list_item_5.Item2))
bounds_5 = Bounds(Numbers=flatten(list_item_5.Item3))
bounds_6 = Bounds(Numbers=flatten(list_item_5.Item4))
deconstruct_domain_2 = DeconstructDomain(Domain=bounds_2)  # -> Start, End
deconstruct_domain_3 = DeconstructDomain(Domain=bounds_3)  # -> Start, End
deconstruct_domain_4 = DeconstructDomain(Domain=bounds_4)  # -> Start, End
deconstruct_domain_5 = DeconstructDomain(Domain=bounds_5)  # -> Start, End
deconstruct_domain_6 = DeconstructDomain(Domain=bounds_6)  # -> Start, End
list_length_2 = ListLength(List=tree_branch_3)
construct_domain_2 = ConstructDomain(DomainStart=0, DomainEnd=flatten(deconstruct_domain_4.End))
construct_domain_3 = ConstructDomain(DomainStart=0, DomainEnd=flatten(deconstruct_domain_2.End))
construct_domain_4 = ConstructDomain(DomainStart=0, DomainEnd=flatten(deconstruct_domain_3.End))
construct_domain_5 = ConstructDomain(DomainStart=0, DomainEnd=flatten(deconstruct_domain_5.End))
construct_domain_6 = ConstructDomain(DomainStart=0, DomainEnd=flatten(deconstruct_domain_6.End))
list_item_6 = ListItem(List=flatten(list_length_2), Index=0, Wrap=True)
unit_y_4 = UnitY(Factor="500")
unit_x_6 = UnitX(Factor="3670")
unit_y_5 = UnitY(Factor="1000")
addition_4 = Addition(A=unit_x_6, B=unit_y_4)
remap_numbers_3 = RemapNumbers(Value=list_item_5.Item, Source=construct_domain_3, Target="0 To 1")  # -> Mapped, Clipped
remap_numbers_4 = RemapNumbers(Value=list_item_5.Item1, Source=construct_domain_4, Target="1 To 0")  # -> Mapped, Clipped
remap_numbers_5 = RemapNumbers(Value=list_item_5.Item2, Source=construct_domain_2, Target="0 To 1")  # -> Mapped, Clipped
remap_numbers_6 = RemapNumbers(Value=list_item_5.Item3, Source=construct_domain_5, Target="0 To 1")  # -> Mapped, Clipped
remap_numbers_7 = RemapNumbers(Value=list_item_5.Item4, Source=construct_domain_6, Target="0 To 1")  # -> Mapped, Clipped
division_7 = Division(A="360", B=list_item_6)
unit_x_7 = UnitX(Factor="400")
series_12 = Series(Start=division_7, Step=division_7, Count=list_item_6)
merge = Merge(
    Data1=remap_numbers_3.Mapped,
    Data2=remap_numbers_4.Mapped,
    Data3=remap_numbers_5.Mapped,
    Data4=remap_numbers_6.Mapped,
    Data5=remap_numbers_7.Mapped)
unit_x_8 = UnitX(Factor="-700")
panel_21 = Panel("""Masterplan
distribution""")
series_13 = Series(Start="1", Step=1, Count="9")
panel_22 = Panel("""Seats proximity
to Zone 4""")
colour_swatch = ColourSwatch(SwatchColor=RGB(0, 0, 0))
panel_23 = Panel("""Number of
elements""")
unit_y_6 = UnitY(Factor="100")
panel_24 = Panel("""Building
footprint""")
panel_25 = Panel("""Roof
area""")

# ---- group: All groups
X_8 = UnitX(Factor="100000")
short_7 = ShortestList(ListA=round.Nearest, ListB=clean, TrimMode=2)  # -> ListA, ListB
sort_4 = SortList(Keys=short_7.ListA, ValuesA=short_7.ListB)  # -> Keys, ValuesA
move_11 = Move(Geometry=group, Motion=X_8)  # -> flatten(Geometry), Transform
cset_3 = CreateSet(List=sort_4.Keys)  # -> Set, Map
mindex_3 = MemberIndex(Set=sort_4.Keys, Member=cset_3.Set)  # -> Index, Count
partition_3 = PartitionList(List=sort_4.ValuesA, Size=mindex_3.Count)
panel_26 = Panel(concatenate_2)

# ----
ungroup_2 = Ungroup(Group=move_11.Geometry)
flip_4 = FlipMatrix(Data=ungroup_2)
group_4 = Group(Objects=flip_4)
division_8 = Division(A=mindex_3.Count, B=30)
round_8 = Round(Number=division_8)  # -> Nearest, Floor, Ceiling
ma = MassAddition(Input=round_8.Ceiling)  # -> Result, PartialResults
split_3 = SplitList(List=flatten(group_4), Index=ma.Result)  # -> ListA, ListB
partition_4 = PartitionList(List=split_3.ListA, Size=round_8.Ceiling)
ungroup_3 = Ungroup(Group=partition_4)
trim = TrimTree(Tree=ungroup_3, Depth=1)

split_4 = SplitList(List=flatten(group_3), Index=ma.Result)  # -> ListA, ListB
partition_5 = PartitionList(List=split_4.ListA, Size=round_8.Ceiling)
ungroup_4 = Ungroup(Group=partition_5)
trim_2 = TrimTree(Tree=ungroup_4, Depth=1)
panel_27 = Panel(trim_2)
panel_28 = Panel(panel_26)
short_8 = ShortestList(ListA=partition, ListB=trim_2, TrimMode=2)  # -> ListA, ListB
move_12 = Move(Geometry=short_8.ListB, Motion=unit_x_5)  # -> Geometry, Transform
list_item_7 = ListItem(List=short_8.ListA, Index=random, Wrap=True)
partition_list = PartitionList(List=move_12.Geometry, Size="30")
list_item_8 = ListItem(List=partition_list, Index=panel_20, Wrap=True)
weave_3 = Weave(Pattern=[0, 1], Stream0=panel_28, Stream1=graft(list_item_7), NullGaps=False)
tree_statistics_3 = TreeStatistics(Tree=list_item_8)  # -> Paths, Length, Count
split_list_2 = SplitList(List=tree_statistics_3.Paths, Index="9")  # -> ListA, ListB
join_4 = TextJoin(Text=weave_3)
tree_branch_4 = TreeBranch(Tree=list_item_8, Path=split_list_2.ListA, MaintainPaths=True)
group_5 = Group(Objects=tree_branch_4)
lng = ListLength(List=flatten(group_5))
series_14 = Series(Start=0, Step="400", Count=lng)
series_15 = Series(Start=0, Step="-200", Count=lng)
unit_x_9 = UnitX(Factor=series_14)
Y_3 = UnitY(Factor=series_15)
addition_5 = Addition(A=Y_3, B=unit_x_9)
move_13 = Move(Geometry=flatten(group_5), Motion=flatten(Y_3))  # -> Geometry, Transform
ungroup_5 = Ungroup(Group=move_13.Geometry)

list_item_9 = ListItem(List=flatten(move_12.Geometry), Index=0, Wrap=True)
move_14 = Move(Geometry=list_item_9, Motion=unit_y)  # -> Geometry, Transform
move_15 = Move(Geometry=graft(move_14.Geometry), Motion=unit_x_3)  # -> Geometry, Transform

flip_matrix_5 = FlipMatrix(Data=move_15.Geometry)
group_6 = Group(Objects=flip_matrix_5)
lng_2 = ListLength(List=flatten(group_6))
series_16 = Series(Start=0, Step="400", Count=lng_2)
unit_x_10 = UnitX(Factor=series_16)
move_16 = Move(Geometry=flatten(group_6), Motion=flatten(unit_x_10))  # -> Geometry, Transform
ungroup_6 = Ungroup(Group=move_16.Geometry)
flip_matrix_6 = FlipMatrix(Data=ungroup_6)

scale_2 = Scale(Geometry=flip_matrix_6, Center=point, Factor=Slider(2.67, range=0..10))  # -> Geometry, Transform

area_2 = Area(Geometry=scale_2.Geometry)  # -> Area, Centroid
bbox = BoundingBox(Content=scale_2.Geometry, Plane=PlaneXY(0, 0, 0), UnionBox=True)  # -> Box, Box_2
debrep_2 = DeconstructBrep(Brep=bbox.Box)  # -> Faces, Edges, Vertices
list_item_10 = ListItem(List=debrep_2.Vertices, Index=0, Wrap=True)  # -> Item, Item1, Item2, Item3
move_17 = Move(Geometry=area_2.Centroid, Motion=addition_4)  # -> Geometry, Transform
previewmat_2 = CustomPreviewMaterials(Geometry=flatten(scale_2.Geometry), DiffuseColor=RGB(255, 255, 255), DiffuseBitmap=flatten(join_4))
move_18 = Move(Geometry=[list_item_10.Item1, list_item_10.Item2], Motion=unit_x_7)  # -> Geometry, Transform
move_19 = Move(Geometry=move_17.Geometry, Motion=unit_y_5)  # -> Geometry, Transform
polyline = PolyLine(Vertices=[move_18.Geometry, list_item_10.Item3, list_item_10.Item], Closed=True)
offset = OffsetCurve(Curve=polyline, Distance="50", Corners=1)
rotate = Rotate(Geometry=graft(move_19.Geometry), Angle=degrees(series_12), Plane=graft(move_17.Geometry))  # -> Geometry, Transform
previewlw_2 = CustomPreviewLineweights(Geometry=offset, Shader=ColourSwatch(SwatchColor=RGB(0, 0, 0)), Thickness="2", Absolute=False)
line_2 = Line(StartPoint=graft(move_17.Geometry), EndPoint=rotate.Geometry)
list_item_11 = ListItem(List=debrep_2.Vertices, Index=0, Wrap=True)
move_20 = Move(Geometry=list_item_11, Motion=unit_x_8)  # -> Geometry, Transform
evaluate_curve = EvaluateCurve(Curve=reparameterize(line_2), Parameter=merge)  # -> Point, Tangent, Angle
polyline_2 = PolyLine(Vertices=evaluate_curve.Point, Closed=True)
boundary_surfaces = BoundarySurfaces(Edges=polyline_2)
area_3 = Area(Geometry=boundary_surfaces)  # -> Area, Centroid
tt_lineweight_preview_3 = TTLineweightPreview(Geometry=[polyline_2, line_2], Shader=colour_swatch, Thickness="2", Absolute=False)
bounds_7 = Bounds(Numbers=flatten(area_3.Area))
text_tag_3d = TextTag3D(Location=move_20.Geometry, Text=graft(series_13), Size=Slider(611, range=0..1000), Colour=swatch, Justification=7)
remap_numbers_8 = RemapNumbers(Value=area_3.Area, Source=bounds_7, Target=".9 To .6")  # -> Mapped, Clipped
create_material = CreateMaterial(Diffuse=colour_swatch, Specular=RGB(255, 255, 255), Emission=RGB(0, 0, 0), Transparency=remap_numbers_8.Mapped, Shine=0)
custom_preview = CustomPreview(Geometry=boundary_surfaces, Material=create_material)

move_21 = Move(Geometry=move_17.Geometry, Motion=unit_y_2)  # -> Geometry, Transform
rotate_2 = Rotate(Geometry=graft(move_21.Geometry), Angle=degrees(series_12), Plane=graft(move_17.Geometry))  # -> Geometry, Transform

list_item_12 = ListItem(List=rotate_2.Geometry, Index=0, Wrap=True)  # -> Item, Item1, Item2, Item3, Item4, Item5, Item6, Item7, Item8
move_22 = Move(Geometry=list_item_12.Item6, Motion=unit_y_6)  # -> Geometry, Transform
text_tag_3d_2 = TextTag3D(Location=list_item_12.Item, Text=panel_22, Size="100", Colour=colour_swatch, Justification=9)
text_tag_3d_3 = TextTag3D(Location=list_item_12.Item1, Text="Capacity", Size="100", Colour=colour_swatch, Justification=6)
text_tag_3d_4 = TextTag3D(Location=list_item_12.Item2, Text=panel_21, Size="100", Colour=colour_swatch, Justification=9)
text_tag_3d_5 = TextTag3D(Location=list_item_12.Item3, Text=panel_22, Size="100", Colour=colour_swatch, Justification=7)
text_tag_3d_6 = TextTag3D(Location=list_item_12.Item4, Text=panel_23, Size="100", Colour=colour_swatch, Justification=4)
text_tag_3d_7 = TextTag3D(Location=list_item_12.Item5, Text=panel_24, Size="100", Colour=colour_swatch, Justification=7)
text_tag_3d_8 = TextTag3D(Location=move_22.Geometry, Text="Sightlines", Size="100", Colour=colour_swatch, Justification=2)

# ---- group: All groups (continued)
short_9 = ShortestList(ListA=partition_3, ListB=trim, TrimMode=2)  # -> ListA, ListB
weave_4 = Weave(Pattern=[0, 1], Stream0=panel_26, Stream1=graft(short_9.ListA), NullGaps=False)
join_5 = TextJoin(Text=weave_4)

# ----
group_7 = Group(Objects=short_9.ListB)
lng_3 = ListLength(List=flatten(group_7))
series_17 = Series(Start=0, Step="-2000", Count=lng_3)
Y_4 = UnitY(Factor=series_17)
move_23 = Move(Geometry=flatten(group_7), Motion=flatten(Y_4))  # -> Geometry, Transform
bbox_2 = BoundingBox(Content=move_23.Geometry, Plane=PlaneXY(0, 0, 0))  # -> Box, Box_2
ungroup_7 = Ungroup(Group=move_23.Geometry)

# ---- group: All groups (continued)
previewmat_3 = CustomPreviewMaterials(Geometry=flatten(ungroup_7), DiffuseColor=RGB(255, 255, 255), DiffuseBitmap=flatten(join_5))

# ----
debrep_3 = DeconstructBrep(Brep=bbox_2.Box)  # -> Faces, Edges, Vertices
list_item_13 = ListItem(List=debrep_3.Vertices, Index=0, Wrap=True)
join_6 = JoinCurves(Curves=debrep_3.Edges, Preserve=False)
move_24 = Move(Geometry=list_item_13, Motion=unit_x_4)  # -> Geometry, Transform
offset_2 = OffsetCurve(Curve=join_6, Distance="750", Corners=1)
previewlw_3 = CustomPreviewLineweights(Geometry=offset_2, Shader=swatch, Thickness="2", Absolute=False)
text_tag_3d_9 = TextTag3D(Location=move_24.Geometry, Text=graft(series_8), Size=Slider(1000, range=0..1000), Colour=swatch, Justification=7)

# ---- group: best group
X_9 = UnitX(Factor="200000")
lng_4 = ListLength(List=dispatch_6.ListA)
panel_29 = Panel(panel_26)
weave_5 = Weave(Pattern=[0, 1], Stream0=panel_29, Stream1=graft(dispatch_6.ListA), NullGaps=False)
join_7 = TextJoin(Text=weave_5)
panel_30 = Panel(join_7)

# ----
addition_6 = Addition(A=X_9, B=unit_y_3)

# ---- group: best group (continued)
move_25 = Move(Geometry=move_5.Geometry, Motion=addition_6)  # -> Geometry, Transform
flip_5 = FlipMatrix(Data=move_25.Geometry)
split_5 = SplitList(List=flip_5, Index=Slider(14, range=0..100))  # -> ListA, ListB
split_6 = SplitList(List=flatten(split_5.ListA), Index=lng_4)  # -> ListA, ListB

# ----
group_8 = Group(Objects=split_6.ListA)
move_26 = Move(Geometry=group_8, Motion=X_3)  # -> Geometry, Transform
bbox_3 = BoundingBox(Content=move_26.Geometry, Plane=PlaneXY(0, 0, 0))  # -> Box, Box_2
area_4 = Area(Geometry=bbox_3.Box)  # -> Area, Centroid
scale_3 = Scale(Geometry=move_26.Geometry, Center=area_4.Centroid, Factor=Slider(6, range=0..10))  # -> Geometry, Transform
ungroup_8 = Ungroup(Group=scale_3.Geometry)

# ---- group: best group (continued)
flip_6 = FlipMatrix(Data=ungroup_8)
previewmat_4 = CustomPreviewMaterials(Geometry=flatten(flip_6), DiffuseColor=RGB(255, 255, 255), DiffuseBitmap=flatten(join_7))

# ---- group: capacity highlight
panel_31 = Panel("4")
sort_5 = SortList(Keys=dispatch_4.ListA, ValuesA=flatten(flip_6))  # -> Keys, ValuesA
division_9 = Division(A="1", B=panel_31)
split_7 = SplitList(List=sort_5.ValuesA, Index=panel_31)  # -> ListA, ListB
series_18 = Series(Start=0, Step=division_9, Count=panel_31)
debrep_4 = DeconstructBrep(Brep=split_7.ListA)  # -> Faces, Edges, Vertices
gradient = Gradient(
    LowerLimit=0,
    UpperLimit=1,
    Parameter=series_18,
    stops=[0: RGB(128, 0, 128), 0.25: RGB(192, 0, 192), 0.5: RGB(255, 0, 255), 0.75: RGB(255, 128, 255), 1: RGB(255, 192, 255)])
join_8 = JoinCurves(Curves=debrep_4.Edges, Preserve=False)
swatch_2 = ColourSwatch(SwatchColor=RGB(255, 0, 221))
offset_3 = OffsetCurve(Curve=join_8, Distance="-300", Corners=1)
panel_32 = Panel("5")

# ---- group: top distance
sort_6 = SortList(Keys=dispatch_3.ListA, ValuesA=flatten(flip_6))  # -> Keys, ValuesA
division_10 = Division(A="1", B=panel_31)
split_8 = SplitList(List=sort_6.ValuesA, Index=panel_31)  # -> ListA, ListB
series_19 = Series(Start=0, Step=division_10, Count=panel_31)
debrep_5 = DeconstructBrep(Brep=split_8.ListA)  # -> Faces, Edges, Vertices
gradient_2 = Gradient(
    LowerLimit=0,
    UpperLimit=1,
    Parameter=series_19,
    stops=[0: RGB(0, 98, 0), 0.25: RGB(81, 175, 17), 0.75: RGB(170, 235, 41), 1: RGB(221, 255, 53), 1: RGB(159, 198, 146)])
join_9 = JoinCurves(Curves=debrep_5.Edges, Preserve=False)
swatch_3 = ColourSwatch(SwatchColor=RGB(255, 0, 221))
offset_4 = OffsetCurve(Curve=join_9, Distance="-100", Corners=1)
panel_33 = Panel("5")

# ----
sort_7 = SortList(Keys=dispatch_5.ListA, ValuesA=flatten(flip_6))  # -> Keys, ValuesA
division_11 = Division(A="1", B=panel_31)
split_9 = SplitList(List=sort_7.ValuesA, Index=panel_31)  # -> ListA, ListB
series_20 = Series(Start=0, Step=division_11, Count=panel_31)
debrep_6 = DeconstructBrep(Brep=split_9.ListA)  # -> Faces, Edges, Vertices
gradient_3 = Gradient(
    LowerLimit=0,
    UpperLimit=1,
    Parameter=series_20,
    stops=[0: RGB(128, 64, 0), 0.25: RGB(192, 64, 0), 0.5: RGB(255, 128, 0), 0.75: RGB(255, 192, 128), 1: RGB(255, 224, 192)])
join_10 = JoinCurves(Curves=debrep_6.Edges, Preserve=False)
swatch_4 = ColourSwatch(SwatchColor=RGB(255, 0, 221))
offset_5 = OffsetCurve(Curve=join_10, Distance="-500", Corners=1)

tt_lineweight_preview_4 = TTLineweightPreview(Geometry=offset_4, Shader=gradient_2, Thickness=panel_33, Absolute=False)
tt_lineweight_preview_5 = TTLineweightPreview(Geometry=offset_3, Shader=gradient, Thickness=panel_32, Absolute=False)
tt_lineweight_preview_6 = TTLineweightPreview(Geometry=offset_5, Shader=gradient_3, Thickness="5", Absolute=False)

# ---- group: orientation to top performing seats
dispatch_12 = Dispatch(List=flatten(clean_tree_3), DispatchPattern=flatten(equals.Equality))  # -> ListA, ListB
dispatch_13 = Dispatch(List=flatten(explode_tree._0005), DispatchPattern=flatten(equals.Equality))  # -> ListA, ListB
short_10 = ShortestList(ListA=dispatch_12.ListA, ListB=dispatch_13.ListA, TrimMode=2)  # -> ListA, ListB
split_10 = TextSplit(Text=dispatch_13.ListA, Separators=".")
item_5 = ListItem(List=split_10, Index=0, Wrap=True)
bnd_5 = Bounds(Numbers=short_10.ListA)
dom_18 = ConstructDomain(DomainStart=0, DomainEnd=Slider(21000, range=0..100000))
len_3 = TextLength(Text=item_5)
pt_7 = ConstructPoint(XCoordinate="225000", YCoordinate="-50000", ZCoordinate=0)
pt_8 = ConstructPoint(XCoordinate="225000", YCoordinate="-25000", ZCoordinate=0)
remap_9 = RemapNumbers(Value=short_10.ListA, Source=bnd_5, Target=dom_18)  # -> Mapped, Clipped
ln_4 = Line(StartPoint=pt_7, EndPoint=pt_8)
dom_19 = ConstructDomain(DomainStart="-75", DomainEnd="15")
fragment_3 = TextFragment(Text=item_5, Start=expr("x-1", len_3), Count=1)
preview_7 = CustomPreview(Geometry=ln_4, Material=ColourSwatch(SwatchColor=RGB(0, 0, 0)))
panel_34 = Panel("-1000")
number_slider_7 = Slider(9, range=0..10)
remap_10 = RemapNumbers(Value=fragment_3, Source=Domain(0, 9), Target=Domain(0, 1))  # -> flatten(Mapped), Clipped
eval_4 = EvaluateCurve(Curve=reparameterize(ln_4), Parameter=range_3)  # -> Point, Tangent, Angle
dom_20 = ConstructDomain(DomainStart=0, DomainEnd=remap_9.Mapped)
range_5 = Range(Domain=series_10, Steps=number_slider_7)
divide_4 = DivideCurve(Curve=ln_4, Count=number_slider_7, Kinks=False)  # -> Points, Tangents, Parameters
panel_35 = Panel(fragment_3)
X_10 = UnitX(Factor="-500")
round_9 = Round(Number=range_5)  # -> Nearest, Floor, Ceiling
move_27 = Move(Geometry=divide_4.Points, Motion=X_10)  # -> Geometry, Transform
concat_3 = Concatenate(FragmentA=round_9.Nearest, FragmentB=" deg.")
material_4 = CreateMaterial(
    Diffuse=ColourSwatch(SwatchColor=RGB(255, 85, 0)),
    Specular=RGB(255, 255, 255),
    Emission=RGB(0, 0, 0),
    Transparency=Slider(0.97, range=0..1),
    Shine=0)
tag_4 = TextTag3D(
    Location=move_27.Geometry,
    Text=series_10,
    Size=Slider(1000, range=0..10000),
    Colour=ColourSwatch(SwatchColor=RGB(0, 0, 0)),
    Justification=9)

# ----
sort_list_3 = SortList(Keys=short_10.ListA)  # -> Keys, ValuesValuesA
cset_4 = CreateSet(List=sort_list_3.Keys)  # -> Set, Map
mindex_4 = MemberIndex(Set=sort_list_3.Keys, Member=cset_4.Set)  # -> Index, Count
delete_consecutive = DeleteConsecutive(Set=sort_list_3.Keys, Wrap=False)  # -> Set, Count
list_item_14 = ListItem(List=eval_4.Point, Index=delete_consecutive.Set, Wrap=True)
multiplication_3 = Multiplication(A=mindex_4.Count, B=Slider(376, range=0..1100))
unit_x_11 = UnitX(Factor=multiplication_3)
move_28 = Move(Geometry=graft(list_item_14), Motion=graft(unit_x_11))  # -> Geometry, Transform
unit_y_7 = UnitY(Factor=panel_34)
move_29 = Move(Geometry=list_item_14, Motion=unit_y_7)  # -> Geometry, Transform
move_30 = Move(Geometry=move_28.Geometry, Motion=unit_y_7)  # -> Geometry, Transform
weave_6 = Weave(
    Pattern=[0, 1, 2, 3],
    Stream0=graft(list_item_14),
    Stream1=move_28.Geometry,
    Stream2=move_30.Geometry,
    Stream3=graft(move_29.Geometry),
    NullGaps=False)
polyline_3 = PolyLine(Vertices=weave_6, Closed=True)

# ---- group: orientation to top performing seats (continued)
srf_4 = Surface(polyline_3)
preview_8 = CustomPreview(Geometry=srf_4, Material=material_4)

# ----
dispatch_14 = Dispatch(List=flatten(explode_tree._0002), DispatchPattern=flatten(equals.Equality))  # -> ListA, ListB
dispatch_15 = Dispatch(List=panel_2, DispatchPattern=flatten(equals.Equality))  # -> ListA, ListB
split_11 = TextSplit(Text=dispatch_15.ListA, Separators="_")
panel_36 = Panel("295000")
item_6 = ListItem(List=split_11, Index=0, Wrap=True)
dom_21 = ConstructDomain(DomainStart=0, DomainEnd=Slider(11455, range=0..100000))
pt_9 = ConstructPoint(XCoordinate="335000", YCoordinate="-50000", ZCoordinate=0)
pt_10 = ConstructPoint(XCoordinate="335000", YCoordinate="-25000", ZCoordinate=0)
len_4 = TextLength(Text=item_6)
panel_37 = Panel(item_6)
ln_5 = Line(StartPoint=pt_9, EndPoint=pt_10)
preview_9 = CustomPreview(Geometry=ln_5, Material=ColourSwatch(SwatchColor=RGB(0, 0, 0)))
fragment_4 = TextFragment(Text=item_6, Start=expr("x-1", len_4), Count=1)
remap_11 = RemapNumbers(Value=expr("x+1", item_6), Source=Domain(0, 9), Target=Domain(-0.1, 1))  # -> flatten(Mapped), Clipped
dom_22 = ConstructDomain(DomainStart="5000", DomainEnd="15000")
eval_5 = EvaluateCurve(Curve=reparameterize(ln_5), Parameter=remap_11.Mapped)  # -> Point, Tangent, Angle
dom_23 = ConstructDomain(DomainStart=0, DomainEnd="-1000")
range_6 = Range(Domain=dom_22, Steps=Slider(8, range=0..10))
divide_5 = DivideCurve(Curve=ln_5, Count=Slider(8, range=0..10), Kinks=False)  # -> Points, Tangents, Parameters
panel_39 = Panel(fragment_4)
series_21 = Series(Start=0, Step=1, Count=10)
X_11 = UnitX(Factor="-700")
round_10 = Round(Number=range_6)  # -> Nearest, Floor, Ceiling
move_31 = Move(Geometry=divide_5.Points, Motion=X_11)  # -> Geometry, Transform
concat_4 = Concatenate(FragmentA="Type ", FragmentB=round_10.Nearest)
material_5 = CreateMaterial(
    Diffuse=ColourSwatch(SwatchColor=RGB(0, 200, 255)),
    Specular=RGB(255, 255, 255),
    Emission=RGB(0, 0, 0),
    Transparency=Slider(0.97, range=0..1),
    Shine=0)
tag_5 = TextTag3D(
    Location=move_31.Geometry,
    Text=round_10.Nearest,
    Size=Slider(1000, range=0..10000),
    Colour=ColourSwatch(SwatchColor=RGB(0, 0, 0)),
    Justification=9)

absolute = Absolute(Value=dispatch_14.ListA)

text_split_3 = TextSplit(Text=absolute, Separators=".")
short_11 = ShortestList(ListA=absolute, ListB=dispatch_15.ListA, TrimMode=2)  # -> ListA, ListB
bnd_6 = Bounds(Numbers=short_11.ListA)
list_item_15 = ListItem(List=text_split_3, Index=0, Wrap=True)  # -> flatten(Item)
remap_12 = RemapNumbers(Value=short_11.ListA, Source=bnd_6, Target=dom_21)  # -> Mapped, Clipped
division_12 = Division(A=list_item_15, B=Slider(1000, range=0..1000))
round_11 = Round(Number=division_12)  # -> Nearest, Floor, Ceiling
dom_24 = ConstructDomain(DomainStart=0, DomainEnd=short_11.ListA)
rectangle_4 = Rectangle(Plane=eval_5.Point, XSize=dom_24, YSize=dom_23, Radius=0)  # -> Rectangle, Length
srf_5 = Surface(rectangle_4.Rectangle)
preview_10 = CustomPreview(Geometry=srf_5, Material=material_5)

dispatch_16 = Dispatch(List=flatten(explode_tree._0000), DispatchPattern=flatten(equals.Equality))  # -> ListA, ListB
dispatch_17 = Dispatch(List=panel_2, DispatchPattern=flatten(equals.Equality))  # -> ListA, ListB
split_12 = TextSplit(Text=dispatch_17.ListA, Separators="_")
item_7 = ListItem(List=split_12, Index=0, Wrap=True)
pt_11 = ConstructPoint(XCoordinate="375000", YCoordinate="-50000", ZCoordinate=0)
pt_12 = ConstructPoint(XCoordinate="375000", YCoordinate="-25000", ZCoordinate=0)
len_5 = TextLength(Text=item_7)
panel_41 = Panel(item_7)
ln_6 = Line(StartPoint=pt_11, EndPoint=pt_12)
preview_11 = CustomPreview(Geometry=ln_6, Material=ColourSwatch(SwatchColor=RGB(0, 0, 0)))
fragment_5 = TextFragment(Text=item_7, Start=expr("x-1", len_5), Count=1)
remap_13 = RemapNumbers(Value=expr("x+1", item_7), Source=Domain(0, 9), Target=Domain(-0.1, 1))  # -> flatten(Mapped), Clipped
eval_6 = EvaluateCurve(Curve=reparameterize(ln_6), Parameter=remap_13.Mapped)  # -> Point, Tangent, Angle
dom_25 = ConstructDomain(DomainStart=0, DomainEnd="-1000")
divide_6 = DivideCurve(Curve=ln_6, Count=Slider(8, range=0..10), Kinks=False)  # -> Points, Tangents, Parameters
panel_43 = Panel(fragment_5)
X_12 = UnitX(Factor="-700")
move_32 = Move(Geometry=divide_6.Points, Motion=X_12)  # -> Geometry, Transform
material_6 = CreateMaterial(
    Diffuse=ColourSwatch(SwatchColor=RGB(255, 0, 0)),
    Specular=RGB(255, 255, 255),
    Emission=RGB(0, 0, 0),
    Transparency=Slider(0.97, range=0..1),
    Shine=0)

multiplication_4 = Multiplication(A=dispatch_16.ListA, B=Slider(48500, range=0..100000))
short_12 = ShortestList(ListA=dispatch_16.ListA, ListB=dispatch_17.ListA, TrimMode=2)  # -> ListA, ListB
bounds_8 = Bounds(Numbers=short_12.ListA)

short_13 = ShortestList(ListA=multiplication_4, ListB=dispatch_17.ListA, TrimMode=2)  # -> ListA, ListB
range_7 = Range(Domain=bounds_8, Steps=Slider(8, range=0..10))
dom_26 = ConstructDomain(DomainStart=0, DomainEnd=short_13.ListA)
round_12 = Round(Number=range_7)  # -> Nearest, Floor, Ceiling
rectangle_5 = Rectangle(Plane=eval_6.Point, XSize=dom_26, YSize=dom_25, Radius=0)  # -> Rectangle, Length
concat_5 = Concatenate(FragmentA=range_7, FragmentB="%")
srf_6 = Surface(rectangle_5.Rectangle)
tag_6 = TextTag3D(
    Location=move_32.Geometry,
    Text=concat_5,
    Size=Slider(1000, range=0..10000),
    Colour=ColourSwatch(SwatchColor=RGB(0, 0, 0)),
    Justification=9)
preview_12 = CustomPreview(Geometry=srf_6, Material=material_6)
