# Grasshopper definition 06_02_RIBA Stage 1 Defining the Brief Analysis Train.gh (Grasshopper 1.0.7)
# plug-ins: LunchBoxML, LunchBox, Pufferfish

# ---- group: Source data
data = Data(Tree({0;0}: ["0.230082", "0.262742", "0.243117", "0.255858", "0.25249", "0.255565"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], {0;1}: ["0_0.jpeg", "0_1.jpeg", "0_2.jpeg", "0_3.jpeg", "0_4.jpeg", "0_5.jpeg"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], {0;2}: [6828, 6828, 6828, 6828, 6828, 6828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], {0;3}: [17873.57487, 18467.2987, 18417.0974, 18123.71478, 18912.63955, 17790.58151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], {0;4}: ["70", "71", "72", "74", "75", "76", "77", "78", "79", "80"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]))

# ---- group: Dataset split
split_list = SplitList(List=data, Index="900")  # -> ListA, ListB
bang = ExplodeTree(Data=split_list.ListA)  # -> Branch0, Branch1, Branch2, Branch3, Branch4
panel = Panel("""799
600""")
replace_items = ReplaceItems(List=bang.Branch0, Indices=panel, Wrap=False)
replace_items_2 = ReplaceItems(List=bang.Branch1, Indices=panel, Wrap=False)
replace_items_3 = ReplaceItems(List=bang.Branch2, Indices=panel, Wrap=False)
replace_items_4 = ReplaceItems(List=bang.Branch3, Indices=panel, Wrap=False)
clean_tree = CleanTree(RemoveNulls=True, RemoveInvalid=True, RemoveEmpty=False, Tree=replace_items)
clean_tree_2 = CleanTree(RemoveNulls=True, RemoveInvalid=True, RemoveEmpty=False, Tree=replace_items_2)
clean_tree_3 = CleanTree(RemoveNulls=True, RemoveInvalid=True, RemoveEmpty=False, Tree=replace_items_3)
clean_tree_4 = CleanTree(RemoveNulls=True, RemoveInvalid=True, RemoveEmpty=False, Tree=replace_items_4)
clean = CleanTree(RemoveNulls=True, RemoveInvalid=True, RemoveEmpty=False, Tree=clean_tree)
clean_2 = CleanTree(RemoveNulls=True, RemoveInvalid=True, RemoveEmpty=False, Tree=clean_tree_2)
clean_3 = CleanTree(RemoveNulls=True, RemoveInvalid=True, RemoveEmpty=False, Tree=clean_tree_3)
clean_4 = CleanTree(RemoveNulls=True, RemoveInvalid=True, RemoveEmpty=False, Tree=clean_tree_4)

# ----
number_slider = Slider(3361, range=0..10000)

# ---- group: Dataset split
panel_2 = Panel(".8")

# ----
panel_3 = Panel("3019")
data_inputs = Data(Tree({0}: [0.6754411233, 0.9500728071, 0.4419541413], {1}: [0.6754411233, 0.9500728071, 0.4419541413], {2}: [0.6754411233, 0.9500728071, 0.4419541413], {3}: [0.6754411233, 0.9500728071, 0.4419541413], {4}: [0.6754411233, 0.9500728071, 0.4419541413], {5}: [0.6754411233, 0.9500728071, 0.4419541413]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))
data_outputs = Data(Tree({0}: [0], {1}: [0], {2}: [0], {3}: [0], {4}: [0], {5}: [0]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))

# ---- group: Labels rounding
panel_4 = Panel("0 To 1")
series = Series(Start=0, Step=1, Count=10)
panel_5 = Panel(series)

# ---- group: labels
bounds = Bounds(Numbers=flatten(clean_3))
bounds_2 = Bounds(Numbers=flatten(clean))
bounds_3 = Bounds(Numbers=flatten(clean_4))
deconstruct_domain = DeconstructDomain(Domain=bounds)  # -> Start, End
deconstruct_domain_2 = DeconstructDomain(Domain=bounds_2)  # -> Start, End
deconstruct_domain_3 = DeconstructDomain(Domain=bounds_3)  # -> Start, End
construct_domain = ConstructDomain(DomainStart=0, DomainEnd=deconstruct_domain.End)
construct_domain_2 = ConstructDomain(DomainStart=0, DomainEnd=deconstruct_domain_2.End)
construct_domain_3 = ConstructDomain(DomainStart=0, DomainEnd=deconstruct_domain_3.End)
remap_numbers = RemapNumbers(Value=clean_3, Source=construct_domain, Target="0 To 1")  # -> Mapped, Clipped
remap_numbers_2 = RemapNumbers(Value=clean, Source=construct_domain_2, Target="0 To 1")  # -> Mapped, Clipped
remap_numbers_3 = RemapNumbers(Value=clean_4, Source=construct_domain_3, Target="0 To 1")  # -> Mapped, Clipped

# ---- group: Labels rounding
remap_numbers_4 = RemapNumbers(Value=clean, Source=construct_domain_2, Target="0 To 1")  # -> Mapped, Clipped
remap_numbers_5 = RemapNumbers(Value=clean_3, Source=construct_domain, Target=panel_4)  # -> Mapped, Clipped
remap_numbers_6 = RemapNumbers(Value=clean_4, Source=construct_domain_3, Target="0 To 1")  # -> Mapped, Clipped

# ----
subtraction = Subtraction(A="1", B=remap_numbers.Mapped)

# ---- group: Labels rounding (continued)
weave = Weave(
    Pattern=[0, 1, 2],
    Stream0=graft(remap_numbers_4.Mapped),
    Stream1=graft(remap_numbers_5.Mapped),
    Stream2=graft(remap_numbers_6.Mapped),
    NullGaps=False)

# ---- group: labels (continued)
weave_2 = Weave(
    Pattern=[0, 1, 2],
    Stream0=graft(remap_numbers_2.Mapped),
    Stream1=graft(subtraction),
    Stream2=graft(remap_numbers_3.Mapped),
    NullGaps=False)
mass_addition = MassAddition(Input=weave_2)  # -> Result, PartialResults
division = Division(A=mass_addition.Result, B=3)

# ----
bounds_4 = Bounds(Numbers=flatten(division))

# ---- group: labels (continued)
remap_numbers_7 = RemapNumbers(Value=division, Source=bounds_4, Target="0 To 1")  # -> Mapped, Clipped

# ---- group: Validation graph
tree_statistics = TreeStatistics(Tree=remap_numbers_7.Mapped)  # -> Paths, Length, Count
random_split_list = RandomSplitList(MasterList=tree_statistics.Paths, Seed=Slider(4088, range=1500..5600), Split=panel_2)  # -> ListA, ListB
tree_branch = TreeBranch(Tree=remap_numbers_7.Mapped, Path=random_split_list.ListB, MaintainPaths=True)
tree_branch_2 = TreeBranch(Tree=remap_numbers_7.Mapped, Path=random_split_list.ListA, MaintainPaths=True)
round_to_nearest = RoundToNearest(NumbersX=expr("x*10", tree_branch_2), NumbersY=panel_5, RemapX=False)  # -> expr("x/10", Nearest), Index, Difference, RemappedX
number_slider_2 = Slider(12000, range=0..100000)
number_slider_3 = Slider(1000, range=0..1000)
multiplication = Multiplication(A=tree_branch_2, B=number_slider_3)
panel_6 = Panel(multiplication)
addition = Addition(A=multiplication, B=number_slider_2)

# ---- group: Labels rounding (continued)
tree_branch_3 = TreeBranch(Tree=weave, Path=random_split_list.ListB, MaintainPaths=True)
round_to_nearest_2 = RoundToNearest(NumbersX=expr("x*10", tree_branch), NumbersY=panel_5, RemapX=False)  # -> expr("x/10", Nearest), Index, Difference, RemappedX
tree_branch_4 = TreeBranch(Tree=weave, Path=random_split_list.ListA, MaintainPaths=True)

# ----
round_to_nearest_3 = RoundToNearest(NumbersX=expr("x*10", tree_branch), NumbersY=panel_5, RemapX=False)  # -> expr("x/10", Nearest), Index, Difference, RemappedX

# ---- group: Balance dataset
sort_list = SortList(Keys=flatten(round_to_nearest_3.Nearest), ValuesValuesA=random_split_list.ListB)  # -> Keys, ValuesValuesA
shift_list = ShiftList(List=sort_list.Keys, Shift=1, Wrap=True)
panel_7 = Panel(sort_list.Keys)
list_length = ListLength(List=sort_list.Keys)
equality = Equality(FirstNumber=sort_list.Keys, SecondNumber=shift_list)  # -> Equality, Inequality
panel_8 = Panel(list_length)
panel_9 = Panel(equality.Equality)
series_2 = Series(Start="1", Step=1, Count=panel_8)
dispatch = Dispatch(List=series_2, DispatchPattern=equality.Equality)  # -> ListA, ListB
shift_list_2 = ShiftList(List=dispatch.ListB, Shift=1, Wrap=True)
list_item = ListItem(List=dispatch.ListB, Index=0, Wrap=True)
subtraction_2 = Subtraction(A=dispatch.ListB, B=shift_list_2)
insert_items = InsertItems(List=subtraction_2, Item=list_item, Indices=0, Wrap=True)
split_list_2 = SplitList(List=reverse(insert_items), Index="1")  # -> ListA, reverse(ListB)
absolute = Absolute(Value=split_list_2.ListB)
partition_list = PartitionList(List=sort_list.ValuesValuesA, Size=absolute)
split_list_3 = SplitList(List=partition_list, Index="80")  # -> ListA, ListB
repeat_data = RepeatData(Data=split_list_3.ListA, Length=graft("80"))  # -> flatten(Data)
trim_tree = TrimTree(Tree=round_to_nearest_2.Nearest, Depth=1)
tree_branch_5 = TreeBranch(Tree=tree_branch_3, Path=repeat_data, MaintainPaths=False)
tree_branch_6 = TreeBranch(Tree=trim_tree, Path=repeat_data, MaintainPaths=False)

# ----
sort_list_2 = SortList(Keys=flatten(round_to_nearest.Nearest))  # -> Keys, ValuesValuesA
panel_10 = Panel(sort_list_2.Keys)
panel_11 = Panel(tree_branch_5)

# ---- group: Train
neural_network_trainer = NeuralNetworkTrainer(
    TrainingInputs=simplify(tree_branch_5),
    TrainingOutputs=graft(tree_branch_6),
    HiddenNeurons=Slider(2, range=0..13),
    LearningAlgorithm=1,
    ActivationFunction=0,
    Alpha=2,
    Iterations=500)  # -> TrainedNueralNetwork, ErrorsDynamics

# ----
panel_12 = Panel(tree_branch_6)
panel_13 = Panel(neural_network_trainer.ErrorsDynamics)

# ---- group: Test
neural_network_tester = NeuralNetworkTesting(TrainedNeuralNetwork=neural_network_trainer.TrainedNueralNetwork, TestInputData=tree_branch_4)

# ---- group: Scale bars
tree_branch_7 = TreeBranch(Tree=remap_numbers_7.Mapped, Path=random_split_list.ListA, MaintainPaths=True)
round_to_nearest_4 = RoundToNearest(NumbersX=expr("x*10", tree_branch_7), NumbersY=panel_5, RemapX=False)  # -> expr("x/10", Nearest), Index, Difference, RemappedX
sort_list_3 = SortList(Keys=flatten(round_to_nearest_4.Nearest))  # -> Keys, ValuesValuesA
round_to_nearest_5 = RoundToNearest(NumbersX=expr("x*10", neural_network_tester), NumbersY=panel_5, RemapX=False)  # -> expr("x/10", Nearest), Index, Difference, RemappedX
panel_14 = Panel(sort_list_3.Keys)
number_slider_4 = Slider(12000, range=0..100000)
number_slider_5 = Slider(1000, range=0..1000)
multiplication_2 = Multiplication(A=tree_branch_7, B=number_slider_5)
multiplication_3 = Multiplication(A=round_to_nearest_5.Nearest, B=number_slider_5)
panel_15 = Panel(multiplication_2)
addition_2 = Addition(A=multiplication_2, B=number_slider_4)
addition_3 = Addition(A=multiplication_3, B=number_slider_4)
construct_point = ConstructPoint(XCoordinate=addition_2, YCoordinate=addition_3, ZCoordinate=0)
panel_16 = Panel("10")
sort_list_4 = SortList(Keys=flatten(multiplication_3), ValuesValuesA=flatten(construct_point))  # -> Keys, ValuesValuesA
panel_17 = Panel(sort_list_4.Keys)
shift_list_3 = ShiftList(List=sort_list_4.Keys, Shift=1, Wrap=True)
list_length_2 = ListLength(List=sort_list_4.Keys)
equality_2 = Equality(FirstNumber=sort_list_4.Keys, SecondNumber=shift_list_3)  # -> Equality, Inequality
panel_18 = Panel(list_length_2)
panel_19 = Panel(equality_2.Equality)
series_3 = Series(Start="1", Step=1, Count=panel_18)
dispatch_2 = Dispatch(List=series_3, DispatchPattern=equality_2.Equality)  # -> ListA, ListB
list_item_2 = ListItem(List=dispatch_2.ListB, Index=0, Wrap=True)
shift_list_4 = ShiftList(List=dispatch_2.ListB, Shift=1, Wrap=True)
multiplication_4 = Multiplication(A=list_item_2, B=-1)
subtraction_3 = Subtraction(A=dispatch_2.ListB, B=shift_list_4)
shift_list_5 = ShiftList(List=subtraction_3, Shift=-1, Wrap=True)
panel_20 = Panel("""1
3""")

# ---- group: Scale bars / size of group 1
panel_21 = Panel(multiplication_4)

# ---- group: Scale bars (continued)
replace_items_5 = ReplaceItems(List=shift_list_5, Item=panel_21, Indices="0", Wrap=False)
absolute_2 = Absolute(Value=replace_items_5)
partition_list_2 = PartitionList(List=sort_list_4.ValuesValuesA, Size=absolute_2)
circle_cnr = CircleCNR(Center=partition_list_2, Normal=Vector(0, 0, 1), Radius="20")
bounding_box = BoundingBox(Content=circle_cnr, Plane=PlaneXY(0, 0, 0), UnionBox=True)  # -> Box, Box_2
deconstruct_brep = DeconstructBrep(Brep=bounding_box.Box)  # -> Faces, Edges, Vertices
list_item_3 = ListItem(List=deconstruct_brep.Edges, Index=panel_20, Wrap=True)
evaluate_curve = EvaluateCurve(Curve=reparameterize(list_item_3), Parameter=0.5)  # -> Point, Tangent, Angle
polyline = PolyLine(Vertices=evaluate_curve.Point, Closed=False)

# ---- group: Validation graph (continued)
round_to_nearest_6 = RoundToNearest(NumbersX=expr("x*10", neural_network_tester), NumbersY=panel_5, RemapX=False)  # -> expr("x/10", Nearest), Index, Difference, RemappedX
multiplication_5 = Multiplication(A=neural_network_tester, B=number_slider_3)
addition_4 = Addition(A=multiplication_5, B=number_slider_2)
construct_point_2 = ConstructPoint(XCoordinate=addition, YCoordinate=addition_4, ZCoordinate=0)
circle = Circle(Plane=construct_point_2, Radius="10")

# ---- group: Accuracy
equality_3 = Equality(FirstNumber=round_to_nearest.Nearest, SecondNumber=round_to_nearest_6.Nearest)  # -> Equality, Inequality
list_length_3 = ListLength(List=flatten(round_to_nearest_6.Nearest))
repeat_data_2 = RepeatData(Data="1", Length=list_length_3)
dispatch_3 = Dispatch(List=repeat_data_2, DispatchPattern=flatten(equality_3.Equality))  # -> ListA, ListB
mass_addition_2 = MassAddition(Input=dispatch_3.ListA)  # -> Result, PartialResults
division_2 = Division(A=mass_addition_2.Result, B=list_length_3)
panel_22 = Panel(division_2)

# ----
sort_list_5 = SortList(Keys=flatten(multiplication_5))  # -> Keys, ValuesValuesA

# ---- group: Validation graph (continued)
panel_23 = Panel(sort_list_5.Keys)
