# Grasshopper definition 07_01_RIBA Stage 2 Concept Design Generative Model.gh (Grasshopper 1.0.7)
# plug-ins: Human, MeshEdit Components, Pufferfish, HoopSnake, froGH, Shortest Walk in Gh, CORE.Toolbox.Grasshopper, Sasquatch

series = Series(Start="15", Step="2", Count="5")
tokyo = Data(Tree({0;0}: ["0", "7", "7", "0", "8", "4", "0", "-11.35", "2", "5", "250", "300", "0"], {1;0;0}: ["5", "19", "12", "3", "22"], {1;0;1}: ["37", "30"], {1;0;2}: ["5", "5", "5", "5", "32"], {1;0;3}: ["41", "32"], {2;0;0}: [".85", ".78", ".78", ".78", ".78", ".78", ".78"]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))
dusseldorf = Data(tokyo)
top_gangway_top = SplitTree(Data=dusseldorf, Masks=flatten("{2;0;0}"))  # -> Positive, Negative
series_2 = Series(Start=0, Step=1, Count="400")
repeat_data = RepeatData(Data=graft(series_2), Length="10")  # -> flatten(Data)
entwine = Entwine(
    Branch00=repeat_data,
    Branch01=repeat_data,
    Branch02=repeat_data,
    Branch03=repeat_data,
    Branch04=repeat_data,
    Branch05=repeat_data,
    Branch06=repeat_data,
    Branch07=repeat_data,
    FlattenInputs=True)  # -> flatten(Result)
number_slider = Slider(10, range=0..10)
series_3 = Series(Start=number_slider, Step=number_slider, Count=Slider(10, range=0..10))
repeat_data_2 = RepeatData(Data=graft(series_3), Length="10")  # -> flatten(Data)
number_slider_2 = Slider(0.01, range=0..0.01)
series_4 = Series(Start="1", Step=1, Count="8")
repeat_data_3 = RepeatData(Data=graft(series_4), Length="4000")  # -> flatten(Data)
building_ouline_offset = Slider(-9, range=-10.01..0)
grid_depth = Slider(9, range=0..10)
grid_width = Slider(7, range=0..10)

series_5 = Series(Start=0, Step=1, Count="9")
repeat_data_4 = RepeatData(Data=graft(series_5), Length="100")  # -> flatten(Data)

panel = Panel("""1
2
4
8
6
7""")
repeat_data_5 = RepeatData(Data="0", Length=Slider(1, range=0..10))
merge = Merge(Data1="1", Data2=repeat_data_5)  # -> flatten(Result)
panel_2 = Panel("{0}")
series_6 = Series(Start=0, Step=1, Count=Slider(38, range=0..100))
series_7 = Series(Start=0, Step=Slider(2, range=0..10), Count=Slider(38, range=0..100))
# Other circulation
# Vertical circulation
# WC
# Commercial
# Service / Store
# Performers
# Hospitality
# Media
# Other
# Parking
# Concourse
panel_3 = Panel("{13;0;0;?}")
panel_4 = Panel("""0
1
2
3
4""")
panel_5 = Panel("""0
1
2
3
4
5""")
panel_6 = Panel("""6
7
8
9
10
11""")
tree_statistics = TreeStatistics()  # -> Paths, Length, Count
panel_7 = Panel("""0,1,2,3,4,5,6,7
1,3,5,7""")
_01_4 = Data(Tree({0;0}: ["10"], {0;1}: ["11", "11", "11", "11", "11", "11", "11", "11", "11", "11"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], {0;2}: ["11", "11", "11", "11", "11", "11", "11", "11", "11", "11"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], {0;3}: ["11", "11", "11", "11", "11", "11", "11", "11", "11", "11"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]))
_02_08 = Data(Tree({0;0}: ["10"], {0;1}: ["4", "4", "4", "4", "4", "4", "4", "4", "4", "4"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], {0;2}: ["4", "4", "4", "4", "4", "4", "4", "4", "4", "4"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], {0;3}: ["4", "4", "4", "4", "4", "4", "4", "4", "4", "4"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]))
_01_6 = Data(Tree({0;0}: ["10"], {0;1}: ["11", "11", "11", "11", "11", "11", "11", "11", "11", "11"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], {0;2}: ["11", "11", "11", "11", "11", "11", "11", "11", "11", "11"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], {0;3}: ["11", "11", "11", "11", "11", "11", "11", "11", "11", "11"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]))
_01_8 = Data(Tree({0;0}: ["10"], {0;1}: ["11", "11", "11", "11", "11", "11", "11", "11", "11", "11"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], {0;2}: ["11", "11", "11", "11", "11", "11", "11", "11", "11", "11"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], {0;3}: ["11", "11", "11", "11", "11", "11", "11", "11", "11", "11"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]))
_02_04 = Data(Tree({0;0}: ["10"], {0;1}: ["4", "4", "4", "4", "4", "4", "4", "4", "4", "4"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], {0;2}: ["4", "4", "4", "4", "4", "4", "4", "4", "4", "4"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], {0;3}: ["4", "4", "4", "4", "4", "4", "4", "4", "4", "4"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]))
_02_06 = Data(Tree({0;0}: ["10"], {0;1}: ["4", "4", "4", "4", "4", "4", "4", "4", "4", "4"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], {0;2}: ["4", "4", "4", "4", "4", "4", "4", "4", "4", "4"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], {0;3}: ["4", "4", "4", "4", "4", "4", "4", "4", "4", "4"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]))
list_item = ListItem(List=panel_7, Index="1", Wrap=True)
tree_statistics_2 = TreeStatistics(Tree=_02_08)  # -> Paths, Length, Count
panel_8 = Panel("""0
1
2""")
replace_paths = ReplacePaths(Data=_02_08, Search=tree_statistics_2.Paths, Replace=reverse(tree_statistics_2.Paths))
text_split = TextSplit(Text=list_item, Separators=",")
_01_6_2 = Data(Tree({0;0}: ["11", "11", "11", "11", "11", "11", "11", "11", "11", "11"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], {0;1}: ["11", "11", "11", "11", "11", "11", "11", "11", "11", "11"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], {0;2}: ["11", "11", "11", "11", "11", "11", "11", "11", "11", "11"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], {0;3}: ["10"]))
_01_4_2 = Data(Tree({0;0}: ["11", "11", "11", "11", "11", "11", "11", "11", "11", "11"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], {0;1}: ["11", "11", "11", "11", "11", "11", "11", "11", "11", "11"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], {0;2}: ["11", "11", "11", "11", "11", "11", "11", "11", "11", "11"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], {0;3}: ["10"]))
_01_8_2 = Data(Tree({0;0}: ["11", "11", "11", "11", "11", "11", "11", "11", "11", "11"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], {0;1}: ["11", "11", "11", "11", "11", "11", "11", "11", "11", "11"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], {0;2}: ["11", "11", "11", "11", "11", "11", "11", "11", "11", "11"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], {0;3}: ["10"]))
_02_06_2 = Data(Tree({0;0}: ["4", "4", "4", "4", "4", "4", "4", "4", "4", "4"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], {0;1}: ["4", "4", "4", "4", "4", "4", "4", "4", "4", "4"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], {0;2}: ["4", "4", "4", "4", "4", "4", "4", "4", "4", "4"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], {0;3}: ["10"]))
_02_04_2 = Data(Tree({0;0}: ["4", "4", "4", "4", "4", "4", "4", "4", "4", "4"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], {0;1}: ["4", "4", "4", "4", "4", "4", "4", "4", "4", "4"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], {0;2}: ["4", "4", "4", "4", "4", "4", "4", "4", "4", "4"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], {0;3}: ["10"]))
_02_08_2 = Data(Tree({0;0}: ["4", "4", "4", "4", "4", "4", "4", "4", "4", "4"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], {0;1}: ["4", "4", "4", "4", "4", "4", "4", "4", "4", "4"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], {0;2}: ["4", "4", "4", "4", "4", "4", "4", "4", "4", "4"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], {0;3}: ["10"]))

# ---- group: case study number
panel_9 = Panel("03")

# ----
entwine_2 = Entwine(
    Branch0X=_01_4_2,
    Branch1X=_01_6_2,
    Branch2X=_01_8_2,
    Branch3X=_02_04_2,
    Branch4X=_02_06_2,
    Branch5X=_02_08_2,
    Branch6X=_02_04_2,
    Branch7X=_02_06_2,
    Branch8X=_02_08_2,
    Branch9X=_02_04_2,
    Branch10X=_02_06_2,
    Branch11X=_02_08_2,
    Branch12X=_02_08_2,
    FlattenInputs=False)
_04_08 = Data(Tree({0;0}: ["11", "11", "11", "11", "11", "11", "11", "11", "11", "11"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], {0;1}: ["11", "11", "11", "1", "11", "11", "11", "1", "11", "11"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], {0;2}: ["11", "11", "11", "11", "11", "11", "11", "11", "11", "11"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]))
_05_01 = Data(_04_08)
tree_statistics_3 = TreeStatistics(Tree=_05_01)  # -> Paths, Length, Count
panel_10 = Panel("""1
2""")
panel_11 = Panel("""0
1""")
list_item_2 = ListItem(List=tree_statistics_3.Paths, Index=panel_10, Wrap=True)
tree_branch = TreeBranch(Tree=_05_01, Path=list_item_2, MaintainPaths=True)
list_item_3 = ListItem(List=tree_statistics_3.Paths, Index=panel_11, Wrap=True)
replace_paths_2 = ReplacePaths(Data=tree_branch, Search=list_item_2, Replace=list_item_3)
panel_12 = Panel(replace_paths_2)
panel_13 = Panel("""0
2
3
4""")
tree_statistics_4 = TreeStatistics()  # -> Paths, Length, Count
_04_06 = Data(Tree({0;0}: ["11", "11", "11", "1", "11", "11", "11", "1", "11", "11"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], {0;1}: ["11", "11", "11", "11", "11", "11", "11", "11", "11", "11"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]))
_04_08_2 = Data(Tree({0;0}: ["11", "11", "11", "1", "11", "11", "11", "1", "11", "11"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], {0;1}: ["11", "11", "11", "11", "11", "11", "11", "11", "11", "11"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]))
_02_04_3 = Data(Tree({0;0}: ["11", "11", "11", "11", "11", "11", "11", "11", "11", "11"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], {0;1}: ["11", "11", "11", "11", "11", "11", "11", "11", "11", "11"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], {0;2}: ["11", "11", "11", "11", "11", "11", "11", "11", "11", "11"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]))
panel_14 = Panel(_02_04_3)
_02_06_3 = Data(Tree({0;0}: ["11", "11", "11", "11", "11", "11", "11", "11", "11", "11"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], {0;1}: ["11", "11", "11", "11", "11", "11", "11", "11", "11", "11"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], {0;2}: ["11", "11", "11", "11", "11", "11", "11", "11", "11", "11"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]))
_03_04 = Data(Tree({0;0}: ["11", "11", "11", "11", "11", "11", "11", "11", "11", "11"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], {0;1}: ["11", "11", "11", "11", "11", "11", "11", "11", "11", "11"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], {0;2}: ["11", "11", "11", "11", "11", "11", "11", "11", "11", "11"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]))
_03_08 = Data(Tree({0;0}: ["11", "11", "11", "11", "11", "11", "11", "11", "11", "11"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], {0;1}: ["11", "11", "11", "11", "11", "11", "11", "11", "11", "11"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], {0;2}: ["11", "11", "11", "11", "11", "11", "11", "11", "11", "11"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]))
_05_01_2 = Data(Tree({0;0}: ["11", "11", "11", "1", "11", "11", "11", "1", "11", "11"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], {0;1}: ["11"], {0;2}: ["11", "11"]))
_03_06 = Data(Tree({0;0}: ["11", "11", "11", "11", "11", "11", "11", "11", "11", "11"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], {0;1}: ["11", "11", "11", "11", "11", "11", "11", "11", "11", "11"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], {0;2}: ["11", "11", "11", "11", "11", "11", "11", "11", "11", "11"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]))
_04_04 = Data(Tree({0;0}: ["11", "11", "11", "1", "11", "11", "11", "1", "11", "11"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], {0;1}: ["11", "11", "11", "11", "11", "11", "11", "11", "11", "11"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]))
_02_08_3 = Data(Tree({0;0}: ["11", "11", "11", "11", "11", "11", "11", "11", "11", "11"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], {0;1}: ["11", "11", "11", "11", "11", "11", "11", "11", "11", "11"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], {0;2}: ["11", "11", "11", "11", "11", "11", "11", "11", "11", "11"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]))
list_item_4 = ListItem(List=tree_statistics_4.Paths, Index=panel_13, Wrap=True)
split_list = SplitList(List=_02_04_3, Index="64")  # -> ListA, ListB
split_list_2 = SplitList(List=_02_06_3, Index="64")  # -> ListA, ListB
split_list_3 = SplitList(List=_02_08_3, Index="64")  # -> ListA, ListB
panel_15 = Panel("""{0;0}
{0;1}
{0;2}""")
tree_branch_2 = TreeBranch(Path=list_item_4, MaintainPaths=True)
tree_statistics_5 = TreeStatistics(Tree=tree_branch_2)  # -> Paths, Length, Count
replace_paths_3 = ReplacePaths(Data=tree_branch_2, Search=tree_statistics_5.Paths, Replace=panel_15)
entwine_3 = Entwine(
    Branch0X="10",
    Branch1X="10",
    Branch2X="10",
    Branch3X=split_list.ListA,
    Branch4X=split_list_2.ListA,
    Branch5X=split_list_3.ListA,
    Branch6X=_03_04,
    Branch7X=_03_06,
    Branch8X=_03_08,
    Branch9X=_04_04,
    Branch10X=_04_06,
    Branch11X=_04_08_2,
    Branch12X=_05_01_2,
    FlattenInputs=False)
panel_16 = Panel("""1
2""")
panel_17 = Panel("""0
1""")
_04_06_2 = Data(Tree({0;0}: ["11", "11", "11", "11", "11", "11", "11", "11", "11", "11"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], {0;1}: ["11", "11", "11", "1", "11", "11", "11", "1", "11", "11"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], {0;2}: ["11", "11", "11", "11", "11", "11", "11", "11", "11", "11"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]))
_05_01_3 = Data(_04_06_2)
tree_statistics_6 = TreeStatistics(Tree=_05_01_3)  # -> Paths, Length, Count
list_item_5 = ListItem(List=tree_statistics_6.Paths, Index=panel_16, Wrap=True)
tree_branch_3 = TreeBranch(Tree=_05_01_3, Path=list_item_5, MaintainPaths=True)
list_item_6 = ListItem(List=tree_statistics_6.Paths, Index=panel_17, Wrap=True)
tree_statistics_7 = TreeStatistics()  # -> Paths, Length, Count
replace_paths_4 = ReplacePaths(Data=tree_branch_3, Search=list_item_5, Replace=list_item_6)
_04_04_2 = Data(Tree({0;0}: ["11", "11", "11", "1", "11", "11", "11", "1", "11", "11"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], {0;1}: ["11", "11", "11", "11", "11", "11", "11", "11", "11", "11"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]))
_05_01_4 = Data(Tree({0;0}: ["6", "6", "6", "1", "6", "6", "6", "1", "6", "6"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], {0;1}: ["6"]))
_04_06_3 = Data(Tree({0;0}: ["11", "11", "11", "1", "11", "11", "11", "1", "11", "11"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], {0;1}: ["11", "11", "11", "11", "11", "11", "11", "11", "11", "11"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]))
_04_08_3 = Data(Tree({0;0}: ["11", "11", "11", "1", "11", "11", "11", "1", "11", "11"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], {0;1}: ["11", "11", "11", "11", "11", "11", "11", "11", "11", "11"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]))
list_item_7 = ListItem(List=tree_statistics_7.Paths, Index=[1, 2, 3], Wrap=True)
list_item_8 = ListItem(List=tree_statistics_7.Paths, Index=[0, 1, 2], Wrap=True)
tree_branch_4 = TreeBranch(Path=list_item_7, MaintainPaths=True)
replace_paths_5 = ReplacePaths(Data=tree_branch_4, Search=list_item_7, Replace=list_item_8)
entwine_4 = Entwine(
    Branch0X="10",
    Branch1X="10",
    Branch2X="10",
    Branch3X="10",
    Branch4X="10",
    Branch5X="10",
    Branch6X="10",
    Branch7X="10",
    Branch8X="10",
    Branch9X=_04_04_2,
    Branch10X=_04_06_3,
    Branch11X=_04_08_3,
    Branch12X=_05_01_4,
    FlattenInputs=False)
_05_01_5 = Data(Tree({0;0}: ["11"], {0;1}: ["11", "11", "11", "1", "11", "11", "11", "1", "11", "11"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]))
tree_statistics_8 = TreeStatistics(Tree=_05_01_5)  # -> Paths, Length, Count
tree_statistics_9 = TreeStatistics(Tree=_05_01_5)  # -> Paths, Length, Count
list_item_9 = ListItem(List=tree_statistics_8.Paths, Index=Slider(1, range=0..1), Wrap=True)
replace_paths_6 = ReplacePaths(Data=_05_01_5, Search=tree_statistics_9.Paths, Replace=reverse(tree_statistics_9.Paths))
tree_branch_5 = TreeBranch(Tree=_05_01_5, Path=list_item_9, MaintainPaths=True)
entwine_5 = Entwine(Branch0X=tree_branch_5, Branch1X=_05_01_5, FlattenInputs=False)  # -> simplify(Result)
_05_01_6 = Data(Tree({0;0}: ["11", "11", "11", "1", "11", "11", "11", "1", "11", "11"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], {0;1}: ["11"]))
tree_statistics_10 = TreeStatistics(Tree=entwine_5)  # -> Paths, Length, Count
panel_18 = Panel("""{0;0}
{0;1}
{0;2}""")
replace_paths_7 = ReplacePaths(Data=entwine_5, Search=tree_statistics_10.Paths, Replace=panel_18)
entwine_6 = Entwine(
    Branch0X="10",
    Branch1X="10",
    Branch2X="10",
    Branch3X="10",
    Branch4X="10",
    Branch5X="10",
    Branch6X="10",
    Branch7X="10",
    Branch8X="10",
    Branch9X="10",
    Branch10X="10",
    Branch11X="10",
    Branch12X=_05_01_6,
    FlattenInputs=False)
panel_19 = Panel("""25
26
27
28
29
30
31
32
33
34
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""")
panel_20 = Panel("""28
29
30
31
32
33
34
35
36
37
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""")
addition = Addition(A=panel_19, B="5")
addition_2 = Addition(A=panel_20, B="5")
repeat_data_6 = RepeatData(Data="0", Length="30")
repeat_data_7 = RepeatData(Data="32", Length="30")
repeat_data_8 = RepeatData(Data="99", Length="150")
entwine_7 = Entwine(
    Branch00=repeat_data_6,
    Branch01=repeat_data_7,
    Branch02=addition,
    Branch03=addition,
    Branch04=addition_2,
    FlattenInputs=True)  # -> flatten(Result)
panel_21 = Panel(entwine_7)
tree_statistics_11 = TreeStatistics(Tree="0")  # -> Paths, Length, Count

# ---- group: c value jpeg export
rep = ReplaceText(Text="a_02_06_b.jpeg", Find="a", Replace=panel_9, RecursiveReplace=False)
join = TextJoin(Text=rep)
rep_2 = ReplaceText(Text=join, Find="b", RecursiveReplace=False)
saveview = SaveViewportToFile(Run=Button(), ViewportName="Top view print", Render=False, FilePath=rep_2, ScaleFactor="3")

# ----
panel_22 = Panel("""0
2
4
6""")
crv = Curve([<curve referenced from the Rhino model> x6])
building_outline = Curve([<curve referenced from the Rhino model> x9])
offset_auditorium_outline = Curve([<curve referenced from the Rhino model> x9])
auditorium_outline = Curve([<curve referenced from the Rhino model> x9])
scale = Scale(Geometry=building_outline, Center=Point(0, 0, 0), Factor="2")  # -> Geometry, Transform
unit_z = UnitZ(Factor="-50")
crv_2 = Curve(<curve referenced from the Rhino model>)
unit_z_2 = UnitZ(Factor="90")
xz = XZPlane(Origin=Point(0, 0, 0))
Z = UnitZ(Factor="-25")
Y = UnitY(Factor="7.5")
Z_2 = UnitZ(Factor="-25")
pt = ConstructPoint(XCoordinate=0, YCoordinate=0, ZCoordinate=0)
xy = XYPlane(Origin=pt)
Y_2 = UnitY(Factor="7.5")
Z_3 = UnitZ(Factor="25")
Z_4 = UnitZ(Factor="25")
Z_5 = UnitZ(Factor="25")
Z_6 = UnitZ(Factor="25")
panel_23 = Panel("""0
2
4
6""")
loft_opt = LoftOptions(Closed=False, Adjust=False, Rebuild=0, Refit=1, Type=Slider(1, range=0..10))
unit_z_3 = UnitZ(Factor=1)
unit_x = UnitX(Factor="3000")
swatch = ColourSwatch(SwatchColor=RGB(209, 27, 67))
colour_rgb = ColourRGB(Alpha=255, Red="255", Green="40", Blue=0)
swatch_2 = ColourSwatch(SwatchColor=RGB(209, 27, 139))
swatch_3 = ColourSwatch(SwatchColor=RGB(128, 0, 0))
swatch_4 = ColourSwatch(SwatchColor=RGB(204, 0, 0))
swatch_5 = ColourSwatch(SwatchColor=RGB(242, 189, 162))
swatch_6 = ColourSwatch(SwatchColor=RGB(255, 85, 0))
swatch_7 = ColourSwatch(SwatchColor=RGB(4, 0, 255))
swatch_8 = ColourSwatch(SwatchColor=RGB(199, 169, 145))
swatch_9 = ColourSwatch(SwatchColor=RGB(0, 238, 255))
swatch_10 = ColourSwatch(SwatchColor=RGB(255, 0, 0))
swatch_11 = ColourSwatch(SwatchColor=RGB(255, 149, 0))
swatch_12 = ColourSwatch(SwatchColor=RGB(140, 0, 255))
swatch_13 = ColourSwatch(SwatchColor=RGB(255, 204, 0))
swatch_14 = ColourSwatch(SwatchColor=RGB(255, 0, 170))
swatch_15 = ColourSwatch(SwatchColor=RGB(148, 130, 114))
number_slider_3 = Slider(96, range=0..100)
unit_x_2 = UnitX(Factor="3000")
unit_z_4 = UnitZ(Factor=".2")
mesh = Mesh()
merge_2 = Merge(
    Data1=swatch_8,
    Data2=swatch_7,
    Data3=swatch_9,
    Data4=swatch_10,
    Data5=swatch_11,
    Data6=swatch_5,
    Data7=swatch_12,
    Data8=swatch_13,
    Data9=swatch_14,
    Data10=swatch_15,
    Data11=swatch_4,
    Data12=swatch_4,
    Data13=swatch_4)
panel_24 = Panel(".3")
panel_25 = Panel(".17")
custom_material = CustomMaterial(
    DiffuseColor=merge_2,
    AmbientColor=RGB(0, 0, 0),
    EmissionColor=RGB(0, 0, 0),
    ReflectionColor=merge_2,
    Reflectivity=Slider(0.28, range=0..1),
    ReflectionGlossiness="1",
    RefractionGlossiness="1",
    FresnelReflections=True,
    IndexOfRefraction="2",
    Transparency=Slider(0.039, range=0..1))
colour_swatch = ColourSwatch(SwatchColor=RGB(255, 255, 255))
unit_x_3 = UnitX(Factor="500")
number_slider_4 = Slider(1, range=0..1)
unit_x_4 = UnitX(Factor="7500")
unit_x_5 = UnitX(Factor="1000")
centre_of_playing_field_coordinates = Panel("0,0")
masterplan_entry_points_coordinates = Panel("""-78.858204,194.238912
91.545697,81.202722
70.304814,-110.021107
-71.149708,-105.255384""")
masterplan_outline_optional = Curve(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)

# ---- group: Set this path to a folder on local drive
# Remaining parameters are set up manualy in the input section of definition
output_folder = Panel("C:\AOMSDML\Stage 2")

# ----
text_split_2 = TextSplit(Text=centre_of_playing_field_coordinates, Separators=",")
# Input
text_split_3 = TextSplit(Text=masterplan_entry_points_coordinates, Separators=",")
list_item_10 = ListItem(List=text_split_2, Index=0, Wrap=True)  # -> Item, Item1
list_item_11 = ListItem(List=text_split_3, Index=0, Wrap=True)  # -> Item, Item1
construct_point = ConstructPoint(XCoordinate=list_item_10.Item, YCoordinate=list_item_10.Item1, ZCoordinate=0)  # -> flatten(Point)
construct_point_2 = ConstructPoint(XCoordinate=list_item_11.Item, YCoordinate=list_item_11.Item1, ZCoordinate=0)  # -> flatten(Point)
concatenate = Concatenate(FragmentA=output_folder, FragmentB="\")
polyline = PolyLine(Vertices=construct_point_2, Closed=True)
curve = Curve([masterplan_outline_optional, polyline])
clean_tree = CleanTree(RemoveNulls=True, RemoveInvalid=True, RemoveEmpty=True, Tree=curve)
list_item_12 = ListItem(List=clean_tree, Index=0, Wrap=True)

# ---- group: Reset record
# Intiate generation
button = Button()

# ----
panel_26 = Panel("75")
panel_27 = Panel("-15")
construct_domain = ConstructDomain(DomainStart="-5", DomainEnd="10")
curve_closest_point = CurveClosestPoint(Point=construct_point_2, Curve=masterplan_outline_optional)  # -> Point, Parameter, Distance
range = Range(Domain=construct_domain, Steps=Slider(9, range=0..10))  # -> reverse(Range)
shatter = Shatter(Curve=masterplan_outline_optional, Parameters=curve_closest_point.Parameter)
point_on_curve = PointOnCurve(shatter, parameter=0.5)
point = Point(construct_point_2)
curve_2 = Curve(list_item_12)
point_2 = Point(point_on_curve)
xy_plane = XYPlane(Origin=Point(0, 0, 0))
panel_28 = Panel("""500
1000""")
explode = Explode(Curve=curve_2, Recursive=True)  # -> Segments, Vertices
unit_x_6 = UnitX(Factor="7500")
unit_x_7 = UnitX(Factor="1000")
move = Move(Geometry=curve_2, Motion=unit_x_6)  # -> Geometry, Transform
number_slider_5 = Slider(0.3, range=0..1)
number_slider_6 = Slider(10, range=0..10)
unit_x_8 = UnitX(Factor=panel_28)
curve_3 = Curve([<curve referenced from the Rhino model> x17])
circle = Circle(Plane=point, Radius=Slider(10, range=0..10))
xy_plane_2 = XYPlane(Origin=Point(0, 0, 0))
colour_swatch_2 = ColourSwatch(SwatchColor=RGB(255, 0, 0))
colour_swatch_3 = ColourSwatch(SwatchColor=RGB(125, 125, 125))
move_2 = Move(Geometry=curve_2, Motion=unit_x_8)  # -> Geometry, Transform
move_3 = Move(Geometry=curve_2, Motion=unit_x_6)  # -> Geometry, Transform
custom_preview_lineweights = CustomPreviewLineweights(Geometry=move.Geometry, Shader=colour_swatch_3, Thickness=number_slider_6, Absolute=False)
move_4 = Move(Geometry=circle, Motion=graft(unit_x_6))  # -> Geometry, Transform
colour_swatch_4 = ColourSwatch(SwatchColor=RGB(0, 0, 0))
number_slider_7 = Slider(3, range=0..10)
boundary_surfaces = BoundarySurfaces(Edges=move_2.Geometry)
boundary_surfaces_2 = BoundarySurfaces(Edges=move_3.Geometry)
join_curves = JoinCurves(Curves=curve_2, Preserve=False)
custom_preview_lineweights_2 = CustomPreviewLineweights(Geometry=move_4.Geometry, Shader=colour_swatch_2, Thickness="15", Absolute=False)
custom_preview = CustomPreview(Geometry=boundary_surfaces, Material=ColourSwatch(SwatchColor=RGB(212, 212, 212)))
boundary_surfaces_3 = BoundarySurfaces(Edges=curve_2)
custom_preview_2 = CustomPreview(Geometry=boundary_surfaces_2, Material=ColourSwatch(SwatchColor=RGB(212, 212, 212)))
series_8 = Series(Start="500", Step="500", Count="5")
unit_x_9 = UnitX(Factor=series_8)
move_5 = Move(Geometry=explode.Segments, Motion=graft(unit_x_9))  # -> Geometry, Transform
move_6 = Move(Geometry=circle, Motion=graft(unit_x_9))  # -> Geometry, Transform
custom_preview_lineweights_3 = CustomPreviewLineweights(Geometry=[move_5.Geometry, curve_2], Shader=colour_swatch_3, Thickness=number_slider_6, Absolute=False)
custom_preview_lineweights_4 = CustomPreviewLineweights(Geometry=[move_6.Geometry, circle], Shader=colour_swatch_2, Thickness="15", Absolute=False)
unit_x_10 = UnitX(Factor="500")
panel_29 = Panel("""1500
2000
2500""")
unit_x_11 = UnitX(Factor=panel_29)
unit_x_12 = UnitX(Factor="2000")
unit_x_13 = UnitX(Factor="1000")
unit_x_14 = UnitX(Factor="1500")
list_length = ListLength(List=repeat_data_4)
panel_30 = Panel(concatenate)
# seats close to bowl exit
# seats to gangway
# Seats to stadium exit
# seat to masterplan
# file name
# capacity
# masterplan split areas
# iteration number
# roof area
# building footprint
# facade area
# number of element types
# total number of elements
# Areas
# top sightline seats
panel_31 = Panel(concatenate)

# ---- group: Stage 2 rows
subtraction = Subtraction(A="50", B="40")
series_9 = Series(Start="40", Step=1, Count=subtraction)

# ----
list_length_2 = ListLength(List=series_9)
repeat_data_9 = RepeatData(Data=graft(series), Length=list_length_2)
repeat_data_10 = RepeatData(Data=series_9, Length="60")
list_length_3 = ListLength(List=series_9)
repeat_data_11 = RepeatData(Data=graft(panel_5), Length=list_length_3)  # -> flatten(Data)

# ---- group: Stage 2 rows (continued)
subtraction_2 = Subtraction(A=series_9, B=repeat_data_9)
weave = Weave(Pattern=[0, 1], Stream0=graft(subtraction_2), Stream1=graft(repeat_data_9), NullGaps=False)
panel_32 = Panel(weave)
list_item_13 = ListItem(List=weave, Index=0, Wrap=True)  # -> Item, Item1
subtraction_3 = Subtraction(A=list_item_13.Item1, B="5")
weave_2 = Weave(Pattern=[0, 1, 2], Stream0=list_item_13.Item, Stream1="5", Stream2=subtraction_3, NullGaps=False)

# ----
text_join = TextJoin(Text=weave, Join=",")
repeat_data_12 = RepeatData(Data=flatten(text_join), Length="300")
split_tree = SplitTree(Data=weave_2, Masks=flatten("{0;0;0;0;*}"))  # -> Positive, Negative
list_item_14 = ListItem(List=split_tree.Negative, Index=0, Wrap=True)
tree_statistics_12 = TreeStatistics(Tree=split_tree.Negative)  # -> Paths, Length, Count
smaller_than = SmallerThan(FirstNumber=list_item_14, SecondNumber=Slider(10, range=0..10))  # -> flatten(SmallerThan), OrEqualTo
text_split_4 = TextSplit(Text=repeat_data_12, Separators=",")
dispatch = Dispatch(List=tree_statistics_12.Paths, DispatchPattern=smaller_than.SmallerThan)  # -> ListA, ListB
split_tree_2 = SplitTree(Data=split_tree.Negative, Masks=flatten(dispatch.ListA))  # -> Positive, Negative
tree_statistics_13 = TreeStatistics(Tree=split_tree_2.Negative)  # -> Paths, Length, Count

# ---- group: Stage 2 rows (continued)
entwine_8 = Entwine(Branch0X=graft(repeat_data_10), Branch1X=text_split_4, Branch2X=split_tree_2.Negative, FlattenInputs=False)
panel_34 = Panel(entwine_8)

# ----
list_item_15 = ListItem(List=split_tree_2.Negative, Index=0, Wrap=True)  # -> Item, Item1
panel_35 = Panel(split_tree_2.Negative)
addition_3 = Addition(A=list_item_15.Item, B=list_item_15.Item1)
tree_statistics_14 = TreeStatistics(Tree=entwine_8)  # -> Paths, Length, Count
tree_statistics_15 = TreeStatistics(Tree=weave)  # -> Paths, Length, Count
tree_statistics_16 = TreeStatistics(Tree=split_tree_2.Negative)  # -> Paths, Length, Count
list_length_4 = ListLength(List=tree_statistics_16.Paths)
list_length_5 = ListLength(List=tree_statistics_15.Paths)
repeat_data_13 = RepeatData(Data=graft(panel_6), Length=list_length_5)  # -> flatten(Data)
repeat_data_14 = RepeatData(Data=graft("12"), Length=list_length_4)  # -> flatten(Data)
entwine_9 = Entwine(Branch00=repeat_data_11, Branch01=repeat_data_13, Branch02=repeat_data_14, FlattenInputs=True)  # -> flatten(Result)

# ---- group: Floor heights generation (adaptive)
panel_36 = Panel("""0.2
2.5
2.5
1.2
2.6""")
xz_2 = XZPlane(Origin=Point(0, 0, 0))
panel_37 = Panel("""2
2
2
.1
1.5
0
0
2.5""")
panel_38 = Panel("""2.2
1.2
0.01
1
0.01
0.01
1
0.01""")
panel_39 = Panel(""".75
.75
.75
.75
.75
.75
.75""")
panel_40 = Panel(""".12
.12
.12
.12
.12
.12
.12
.12""")
panel_41 = Panel("2.75")

# ----
replace_paths_8 = ReplacePaths(Data=panel_39, Search="{0}", Replace="{2;0;0}")
merge_3 = Merge(Data1=replace_paths_8, Data2=top_gangway_top.Negative)
top_gangway_top_2 = SplitTree(Data=merge_3, Masks=flatten("{17;0;0}"))  # -> Positive, Negative
replace_paths_9 = ReplacePaths(Data=panel_37, Search="{0}", Replace="{17;0;0}")
merge_4 = Merge(Data1=replace_paths_9, Data2=top_gangway_top_2.Negative)
top_gangway_top_3 = SplitTree(Data=merge_4, Masks=flatten("{3;0;0}"))  # -> Positive, Negative
replace_paths_10 = ReplacePaths(Data=panel_36, Search="{0}", Replace="{3;0;0}")
merge_5 = Merge(Data1=replace_paths_10, Data2=top_gangway_top_3.Negative)
top_gangway_top_4 = SplitTree(Data=merge_5, Masks=flatten("{5;0;0}"))  # -> Positive, Negative
replace_paths_11 = ReplacePaths(Data=panel_38, Search="{0}", Replace="{5;0;0}")
merge_6 = Merge(Data1=replace_paths_11, Data2=top_gangway_top_4.Negative)
top_gangway_top_5 = SplitTree(Data=merge_6, Masks=flatten("{4;0;0}"))  # -> Positive, Negative
replace_paths_12 = ReplacePaths(Data=panel_40, Search="{0}", Replace="{4;0;0}")
merge_7 = Merge(Data1=replace_paths_12, Data2=top_gangway_top_5.Negative)
top_gangway_top_6 = SplitTree(Data=merge_7, Masks=flatten("{1;0;0}"))  # -> Positive, Negative

# ---- group: Number of bay divisions with 4 corner divisions
panel_42 = Panel("4")

# ---- group: Central bay number per stand
panel_43 = Panel("""1
3
5
7""")

# ----
inner_outline = Slider(8, range=0..10)
outter_outline = Slider(3, range=0..10)
number_of_inner_offsets = Slider(3, range=0..10)
number_of_outter_offsets = Slider(1, range=0..10)
not_in_use = Slider(3, range=0..10)

# ---- group: largest outline that fits site
number_slider_8 = Slider(30, range=0..100)
series_10 = Series(Start=0.1, Step=-2.5, Count=number_slider_8)

# ----
division = Division(A=Slider(1, range=0..1), B=number_slider_8)
series_11 = Series(Start=division, Step=division, Count=number_slider_8)

# ---- group: ellipse
pt_2 = ConstructPoint(XCoordinate=0, YCoordinate=0, ZCoordinate=0)

# ---- group: Crop buble line
number_slider_9 = Slider(30, range=0..100)
division_2 = Division(A=Slider(1, range=0..1), B=number_slider_9)
series_12 = Series(Start=division_2, Step=division_2, Count=number_slider_9)

# ---- group: module 01
Z_7 = UnitZ(Factor="-25")
Y_3 = UnitY(Factor="7.5")

# ----
Z_8 = UnitZ(Factor="-25")
Y_4 = UnitY(Factor="7.5")

Z_9 = UnitZ(Factor="-25")
Y_5 = UnitY(Factor="7.5")

# ---- group: bowl
crv_3 = Curve(<curve referenced from the Rhino model>)
fillet = Fillet(Curve=crv_3, Radius="30")
Z_10 = UnitZ(Factor="150")
material = CreateMaterial(
    Diffuse=ColourSwatch(SwatchColor=RGB(255, 255, 255)),
    Specular=RGB(255, 255, 255),
    Emission=RGB(0, 0, 0),
    Transparency=0,
    Shine=0)

# ---- group: circulation grid
panel_44 = Panel(""".25
.5
.75""")
panel_45 = Panel(""".25
.5
.75""")

# ---- group: floor split
panel_46 = Panel("""0
1
3
2""")

# ---- group: assign function
panel_47 = Panel("""0
1
3
2""")

# ---- group: circulation grid
panel_48 = Panel(".5")
panel_49 = Panel(""".25
.5
.75""")

panel_50 = Panel("0.5")
panel_51 = Panel(""".25
.5
.75""")

panel_52 = Panel(""".25
.5
.75""")
panel_53 = Panel(".5")

panel_54 = Panel(""".25
.5
.75""")
panel_55 = Panel(""".25
.5
.75""")

# ---- group: gangways
number_slider_10 = Slider(1.2, range=0..10)

# ---- group: Auditorium volume
unit_z_5 = UnitZ(Factor=1)

# ---- group: Closest line to bowl for circulation grid
number_slider_11 = Slider(1, range=0..1)

# ----
curve_4 = Curve([<curve referenced from the Rhino model> x17])
curve_5 = Curve(<curve referenced from the Rhino model>)
unit_x_15 = UnitX(Factor="3000")
move_7 = Move(Geometry=curve_4, Motion=unit_x_15)  # -> Geometry, Transform
custom_preview_3 = CustomPreview(Geometry=move_7.Geometry, Material=ColourSwatch(SwatchColor=RGB(0, 0, 0)))

# ---- group: masterplan distance
button_2 = Button()

# ---- group: programme
button_3 = Button()

# ---- group: stadium exit
button_4 = Button()

# ----
button_5 = Button()

# ---- group: section
button_6 = Button()

# ---- group: programme
button_7 = Button()

# ---- group: bowl exit
button_8 = Button()

# ----
list_item_16 = ListItem(List=entwine, Index=panel_136, Wrap=True)
panel_56 = Panel(list_item_16)
panel_57 = Panel(panel_56)
panel_58 = Panel(panel_57)
list_item_17 = ListItem(List=tree_statistics_14.Paths, Index=panel_58, Wrap=True)
tree_branch_6 = TreeBranch(Tree=entwine_8, Path=list_item_17, MaintainPaths=True)
list_length_6 = ListLength(List=tree_branch_6)
series_13 = Series(Start=0, Step=1, Count=list_length_6)
list_item_18 = ListItem(List=repeat_data_2, Index=panel_58, Wrap=True)
replace_paths_13 = ReplacePaths(Data=tree_branch_6, Search=list_item_17, Replace="{1;0;0}")
replace_items = ReplaceItems(List=top_gangway_top_6.Positive, Item=tree_branch_6, Indices=series_13, Wrap=True)
merge_8 = Merge(Data1=replace_paths_13, Data2=top_gangway_top_6.Negative)
split_list_4 = SplitList(List=replace_items, Index=list_length_6)  # -> ListA, ListB
trim_tree = TrimTree(Tree=split_list_4.ListA, Depth=2)
panel_59 = Panel(trim_tree)
smaller_than_2 = SmallerThan(FirstNumber=panel_58, SecondNumber="210")  # -> SmallerThan, OrEqualTo
larger_than = LargerThan(FirstNumber=panel_58, SecondNumber=Slider(30, range=0..100))  # -> LargerThan, OrEqualTo
dispatch_2 = Dispatch(List="0", DispatchPattern=larger_than.LargerThan)  # -> ListA, ListB
list_item_19 = ListItem(List=flatten(repeat_data_3), Index=panel_57, Wrap=True)
list_item_20 = ListItem(List=auditorium_outline, Index=list_item_19, Wrap=True)
explode_2 = Explode(Curve=list_item_20, Recursive=True)  # -> Segments, Vertices

# ---- group: Number of bay divisions with 4 corner divisions (continued)
len = Length(Curve=explode_2.Segments)
division_3 = Division(A=len, B=grid_width)
int = Integer(division_3)
lng = ListLength(List=int)
smaller = SmallerThan(FirstNumber=division_3, SecondNumber=Slider(4, range=0..10))  # -> SmallerThan, OrEqualTo
series_14 = Series(Start=0, Step=1, Count=lng)
dispatch_3 = Dispatch(List=series_14, DispatchPattern=smaller.SmallerThan)  # -> ListA, ListB
replace = ReplaceItems(List=int, Item=panel_42, Indices=dispatch_3.ListA, Wrap=False)
int_2 = Integer(replace)
division_4 = Division(A=int_2, B="2")
split = TextSplit(Text=division_4, Separators=".")
item = ListItem(List=split, Index=0, Wrap=True)
multiplication = Multiplication(A=item, B=2)  # -> flatten(Result)
replace_2 = ReplaceItems(List=multiplication, Item=panel_42, Indices=panel_23, Wrap=False)

# ---- group: Central bay number per stand (continued)
explode_3 = Explode(Curve=explode_2.Segments, Recursive=True)  # -> Segments, Vertices
list_item_21 = ListItem(List=flatten(explode_3.Segments), Index=panel_43, Wrap=True)
length = Length(Curve=list_item_21)
division_5 = Division(A=length, B=grid_width)
round = Round(Number=division_5)  # -> Nearest, Floor, Ceiling
weave_3 = Weave(Pattern=[0, 1, 0, 1, 0, 1, 0, 1], Stream0=panel_42, Stream1=graft(round.Nearest), NullGaps=False)  # -> flatten(Weave)
mass_addition = MassAddition(Input=weave_3)  # -> Result, PartialResults
list_item_22 = ListItem(List=mass_addition.PartialResults, Index=0, Wrap=True)  # -> Item, Item1, Item2, Item3, Item4, Item5, Item6, Item7
list_item_23 = ListItem(List=round.Nearest, Index=0, Wrap=True)  # -> Item, Item1, Item2, Item3, Item4, Item5, Item6, Item7

# ----
merge_9 = Merge(
    Data1=list_item_19,
    Data2=outter_outline,
    Data3=number_of_inner_offsets,
    Data4=number_of_outter_offsets,
    Data5=not_in_use,
    Data6=building_ouline_offset)

top_gangway_top_7 = SplitTree(Data=merge_8, Masks=flatten("{0;0}"))  # -> Positive, Negative
mass_addition_2 = MassAddition(Input=replace_2)  # -> Result, PartialResults
replace_3 = ReplaceItems(List=top_gangway_top_7.Positive, Item=merge_9, Indices=panel, Wrap=False)
pshift = ShiftPaths(Data=replace_3, Offset=-1)
division_6 = Division(A=list_item_23.Item6, B="2")
series_15 = Series(Start=0, Step=1, Count=mass_addition_2.Result)
division_7 = Division(A=list_item_23.Item2, B="2")
merge_10 = Merge(Data1=pshift, Data2=top_gangway_top_7.Negative)
center_long_east_stand = Addition(A=list_item_22.Item6, B=division_6)
round_2 = Round(Number=division_7)  # -> Nearest, Floor, Ceiling
top_gangway_top_8 = SplitTree(Data=merge_10, Masks=flatten("{9;0;0}"))  # -> Positive, Negative
center_long_east_stand_2 = Addition(A=list_item_22.Item2, B=round_2.Nearest)
replace_4 = ReplaceItems(List=top_gangway_top_8.Positive, Item=grid_depth, Indices="0", Wrap=False)
dispatch_4 = Dispatch(List=series_15, DispatchPattern=merge)  # -> ListA, ListB
trim_tree_2 = TrimTree(Tree=replace_4, Depth=1)
merge_11 = Merge(Data1=trim_tree_2, Data2=top_gangway_top_8.Negative)
top_gangway_top_9 = SplitTree(Data=merge_11, Masks=flatten("{9;0;1}"))  # -> Positive, Negative
panel_60 = Panel(replace_4)
panel_61 = Panel(dispatch_4.ListA)
replace_5 = ReplaceItems(List=top_gangway_top_9.Positive, Item=grid_width, Indices="0", Wrap=False)
panel_62 = Panel(panel_61)
trim_tree_3 = TrimTree(Tree=replace_5, Depth=1)
merge_12 = Merge(Data1=trim_tree_3, Data2=top_gangway_top_9.Negative)
floor_height = SplitTree(Data=merge_12, Masks=flatten("{6;0;0}"))  # -> Positive, Negative
panel_63 = Panel(replace_5)
panel_64 = Panel(top_gangway_top_7.Positive)
tree_statistics_17 = TreeStatistics(Tree=panel_62)  # -> Paths, Length, Count
replace_paths_14 = ReplacePaths(Data=panel_62, Search=tree_statistics_17.Paths, Replace="{18;0;3}")
mass_addition_3 = MassAddition(Input=split_list_4.ListA)  # -> Result, PartialResults
addition_4 = Addition(A=flatten(mass_addition_3.Result), B="1")
addition_5 = Addition(A=list_item_18, B="2")
mass_addition_4 = MassAddition(Input=trim_tree)  # -> Result, PartialResults
division_8 = Division(A=mass_addition_4.Result, B=10)
# Other circulation
# Vertical circulation
# WC
# Commercial
# Service / Store
# Performers
# Hospitality
# Media
# Other
# Parking
# Concourse
round_3 = Round(Number=division_8)  # -> Nearest, Floor, Ceiling
repeat_data_15 = RepeatData(Data="11", Length=round_3.Nearest)
list_item_24 = ListItem(List=entwine_9, Index=panel_58, Wrap=True)
panel_65 = Panel(list_item_24)
panel_66 = Panel(list_item_24)
replace_text = ReplaceText(Text="{A;0;*}", Find="A", Replace=panel_66, RecursiveReplace=False)
split_tree_3 = SplitTree(Data=entwine_2, Masks=flatten(replace_text))  # -> Positive, Negative
tree_statistics_18 = TreeStatistics(Tree=split_tree_3.Positive)  # -> Paths, Length, Count
replace_text_2 = ReplaceText(Text="{A;0;*}", Find="A", Replace=panel_66, RecursiveReplace=False)
split_tree_4 = SplitTree(Data=entwine_3, Masks=flatten(replace_text_2))  # -> Positive, Negative
tree_statistics_19 = TreeStatistics(Tree=split_tree_4.Positive)  # -> Paths, Length, Count
replace_text_3 = ReplaceText(Text="{A;0;*}", Find="A", Replace=panel_66, RecursiveReplace=False)
split_tree_5 = SplitTree(Data=entwine_4, Masks=flatten(replace_text_3))  # -> Positive, Negative
tree_statistics_20 = TreeStatistics(Tree=split_tree_5.Positive)  # -> Paths, Length, Count
replace_text_4 = ReplaceText(Text="{A;0;*}", Find="A", Replace=panel_66, RecursiveReplace=False)
split_tree_6 = SplitTree(Data=entwine_6, Masks=flatten(replace_text_4))  # -> Positive, Negative
tree_statistics_21 = TreeStatistics(Tree=split_tree_6.Positive)  # -> Paths, Length, Count
tree_statistics_22 = TreeStatistics(Tree=panel_62)  # -> Paths, Length, Count
replace_paths_15 = ReplacePaths(Data=panel_62, Search=tree_statistics_22.Paths, Replace="{8;0;0}")
list_item_25 = ListItem(List=entwine_7, Index=panel_58, Wrap=True)
replace_paths_16 = ReplacePaths(Data=list_item_25, Search=tree_statistics_11.Paths, Replace="{12;0;0}")
item_2 = ListItem(List=auditorium_outline, Index=list_item_19, Wrap=True)
pcx = CurvePlane(Curve=item_2, Plane=xz)  # -> Points, ParamsC, ParamsP
item_3 = ListItem(List=pcx.Points, Index=0, Wrap=True)  # -> Item, Item1
pull = PullPoint(Point=item_3.Item, Geometry=crv_2, ClosestOnly=True)  # -> ClosestPoint, Distance
explode_4 = Explode(Curve=item_2, Recursive=True)  # -> Segments, Vertices
len_2 = Length(Curve=explode_4.Segments)

# ---- group: Floor heights generation (adaptive) (continued)
pcx_2 = CurvePlane(Curve=item_2, Plane=xz_2)  # -> Points, ParamsC, ParamsP
item_4 = ListItem(List=pcx_2.Points, Index=list_item_19, Wrap=True)  # -> Item, Item1
pull_2 = PullPoint(Point=item_4.Item, Geometry=crv_2, ClosestOnly=True)  # -> ClosestPoint, Distance
bowl_section = BB_BowlSection(
    touchline=crv_2,
    outline=item_2,
    setDistance=pull_2.Distance,
    rows=tree_branch_6,
    stepDepths=panel_39,
    landingDepths=panel_37,
    floorHeights=panel_36,
    cantilevers=panel_38,
    cValues=panel_40)  # -> section, sightlines, sectionInfo; inputs touchline: Curve, outline: list of Curve, rows: list of Int32, stepDepths: list, landingDepths: list, floorHeights: list, cantilevers: list, seatOffsets: list, cValues: list, stepHeights: list; plug-in component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
explode_5 = Explode(Curve=bowl_section.section, Recursive=True)  # -> Segments, Vertices
length_2 = Length(Curve=explode_5.Segments)
equality = Equality(FirstNumber=length_2, SecondNumber=panel_41)  # -> Equality, Inequality; disabled

# ----
similarity = Similarity(FirstNumber=length_2, SecondNumber=panel_41, Threshold=0.1)  # -> Similarity, AbsoluteDifference

# ---- group: Floor heights generation (adaptive) (continued)
dispatch_5 = Dispatch(List=explode_5.Segments, DispatchPattern=similarity.Similarity)  # -> ListA, ListB
point_on_curve_2 = PointOnCurve(dispatch_5.ListA, parameter=0.5)
deconstruct = Deconstruct(Point=point_on_curve_2)  # -> XComponent, YComponent, ZComponent

# ----
subtraction_4 = Subtraction(A=deconstruct.ZComponent, B="0.1")
list_length_7 = ListLength(List=subtraction_4)
larger_than_2 = LargerThan(FirstNumber=list_length_7, SecondNumber="1")  # -> LargerThan, OrEqualTo
equality_2 = Equality(FirstNumber=list_length_7, SecondNumber="1")  # -> Equality, Inequality
dispatch_6 = Dispatch(List=subtraction_4, DispatchPattern=larger_than_2.LargerThan)  # -> ListA, ListB
dispatch_7 = Dispatch(List=subtraction_4, DispatchPattern=equality_2.Equality)  # -> ListA, ListB
insert_items = InsertItems(List=dispatch_6.ListA, Item="0", Indices="0", Wrap=True)
list_length_8 = ListLength(List=insert_items)
division_9 = Division(A=dispatch_7.ListA, B="2")
list_item_26 = ListItem(List=insert_items, Index=expr("x-2", list_length_8), Wrap=True)
dispatch_8 = Dispatch(List=division_9, DispatchPattern=larger_than.LargerThan)  # -> ListA, ListB
addition_6 = Addition(A=list_item_26, B="3.5")
replace_items_2 = ReplaceItems(List=insert_items, Item=addition_6, Indices=expr("x-1", list_length_8), Wrap=False)
dispatch_9 = Dispatch(List=replace_items_2, DispatchPattern=smaller_than_2.SmallerThan)  # -> ListA, ListB
insert_items_2 = InsertItems(List=dispatch_8.ListA, Item="0", Indices="0", Wrap=True)
split_list_5 = SplitList(List=reverse(dispatch_9.ListA), Index="1")  # -> ListA, reverse(ListB)
merge_13 = Merge(Data1=dispatch_2.ListB, Data2=dispatch_9.ListB, Data3=insert_items_2, Data4=split_list_5.ListB)
clean_tree_2 = CleanTree(RemoveNulls=True, RemoveInvalid=True, RemoveEmpty=False, Tree=flatten(merge_13))
sort_list = SortList(Keys=clean_tree_2)  # -> Keys, ValuesValuesA
floor_height_2 = Panel(sort_list.Keys)
addition_7 = Addition(A=floor_height_2, B=Slider(8, range=0..10))
tree_statistics_23 = TreeStatistics(Tree=floor_height_2)  # -> Paths, Length, Count
replace_paths_17 = ReplacePaths(Data=floor_height_2, Search=tree_statistics_23.Paths, Replace="{6;0;0}")
merge_14 = Merge(Data1=replace_paths_17, Data2=floor_height.Negative)
top_gangway_top_10 = SplitTree(Data=merge_14, Masks=flatten("{11;0;1}"))  # -> Positive, Negative
panel_67 = Panel(replace_paths_17)
panel_68 = Panel(top_gangway_top_10.Positive)
tree_statistics_24 = TreeStatistics(Tree=merge_14)  # -> Paths, Length, Count
list_item_27 = ListItem(List=top_gangway_top_10.Positive, Index="0", Wrap=True)
replace_6 = ReplaceItems(List=list_item_27, Item="1", Indices="0", Wrap=False)
pshift_2 = ShiftPaths(Data=replace_6, Offset=-1)
panel_70 = Panel(tree_statistics_24.Paths)
merge_15 = Merge(Data1=pshift_2, Data2=top_gangway_top_10.Negative)
top_gangway_top_11 = SplitTree(Data=merge_15, Masks=flatten("{16;0;0}"))  # -> Positive, Negative
panel_71 = Panel(top_gangway_top_11.Positive)
list_item_28 = ListItem(List=top_gangway_top_11.Positive, Index="0", Wrap=True)
replace_7 = ReplaceItems(List=list_item_28, Item=".5", Indices="0", Wrap=False)
pshift_3 = ShiftPaths(Data=replace_7, Offset=-1)
merge_16 = Merge(Data1=pshift_3, Data2=top_gangway_top_11.Negative)
top_gangway_top_12 = SplitTree(Data=merge_16, Masks=flatten("{18;0;3}"))  # -> Positive, Negative
panel_73 = Panel(top_gangway_top_12.Positive)
merge_17 = Merge(Data1=replace_paths_14, Data2=top_gangway_top_12.Negative)
top_gangway_top_13 = SplitTree(Data=merge_17, Masks=flatten("{18;0;7}"))  # -> Positive, Negative
list_item_29 = ListItem(List=top_gangway_top_13.Positive, Index=series_6, Wrap=True)
panel_74 = Panel(top_gangway_top_13.Positive)
replace_8 = ReplaceItems(List=list_item_29, Item=series_7, Indices="0", Wrap=False)
pshift_4 = ShiftPaths(Data=replace_8, Offset=-1)
merge_18 = Merge(Data1=pshift_4, Data2=top_gangway_top_13.Negative)
top_gangway_top_14 = SplitTree(Data=merge_18, Masks=flatten("{18;0;1}"))  # -> Positive, Negative
list_item_30 = ListItem(List=top_gangway_top_14.Positive, Index="0", Wrap=True)
panel_76 = Panel(top_gangway_top_14.Positive)
replace_9 = ReplaceItems(List=list_item_30, Item=flatten(mass_addition_3.Result), Indices="0", Wrap=False)
pshift_5 = ShiftPaths(Data=replace_9, Offset=-1)
merge_19 = Merge(Data1=pshift_5, Data2=top_gangway_top_14.Negative)
top_gangway_top_15 = SplitTree(Data=merge_19, Masks=flatten("{18;0;4}"))  # -> Positive, Negative
list_item_31 = ListItem(List=top_gangway_top_15.Positive, Index="0", Wrap=True)
panel_77 = Panel(top_gangway_top_15.Positive)
panel_78 = Panel(pshift_5)
replace_10 = ReplaceItems(List=list_item_31, Item=addition_4, Indices="0", Wrap=False)
pshift_6 = ShiftPaths(Data=replace_10, Offset=-1)
tree_statistics_25 = TreeStatistics(Tree=pshift_6)  # -> Paths, Length, Count
merge_20 = Merge(Data1=pshift_6, Data2=top_gangway_top_15.Negative)
top_gangway_top_16 = SplitTree(Data=merge_20, Masks=flatten("{18;0;5}"))  # -> Positive, Negative
list_item_32 = ListItem(List=top_gangway_top_16.Positive, Index="0", Wrap=True)
panel_79 = Panel(top_gangway_top_16.Positive)
replace_11 = ReplaceItems(List=list_item_32, Item=addition_5, Indices="0", Wrap=False)
pshift_7 = ShiftPaths(Data=replace_11, Offset=-1)
merge_21 = Merge(Data1=pshift_7, Data2=top_gangway_top_16.Negative)
top_gangway_top_17 = SplitTree(Data=merge_21, Masks=flatten("{8;0;0}"))  # -> Positive, Negative
list_item_33 = ListItem(List=top_gangway_top_17.Positive, Index=0, Wrap=True)
panel_80 = Panel(top_gangway_top_17.Positive)
replace_12 = ReplaceItems(List=list_item_33, Indices="0", Wrap=False)
pshift_8 = ShiftPaths(Data=replace_12, Offset=-1)
clean_tree_3 = CleanTree(RemoveNulls=True, RemoveInvalid=True, RemoveEmpty=False, Tree=pshift_8)
merge_22 = Merge(Data1=clean_tree_3, Data2=top_gangway_top_17.Negative)
top_gangway_top_18 = SplitTree(Data=merge_22, Masks=flatten(panel_3))  # -> Positive, Negative
tree_statistics_26 = TreeStatistics(Tree=top_gangway_top_18.Positive)  # -> Paths, Length, Count
list_length_9 = ListLength(List=tree_statistics_26.Paths)
subtraction_5 = Subtraction(A=list_length_9, B=round_3.Nearest)
panel_81 = Panel(top_gangway_top_18.Positive)
repeat_data_16 = RepeatData(Data="10", Length=subtraction_5)
entwine_10 = Entwine(Branch00=repeat_data_15, Branch01=repeat_data_16, FlattenInputs=True)  # -> flatten(Result)
graft_tree = GraftTree(Tree=entwine_10, IncludeEmptyLists=True, IncludeNullItems=True)
tree_statistics_27 = TreeStatistics(Tree=graft_tree)  # -> Paths, Length, Count
list_item_34 = ListItem(List=tree_statistics_27.Paths, Index=panel_4, Wrap=True)
split_tree_7 = SplitTree(Data=graft_tree, Masks=flatten(list_item_34))  # -> Positive, Negative
tree_statistics_28 = TreeStatistics(Tree=split_tree_7.Positive)  # -> Paths, Length, Count
replace_paths_18 = ReplacePaths(Data=split_tree_3.Positive, Search=tree_statistics_18.Paths, Replace=tree_statistics_28.Paths)
tree_statistics_29 = TreeStatistics(Tree=replace_paths_18)  # -> Paths, Length, Count
replace_paths_19 = ReplacePaths(Data=replace_paths_18, Search=tree_statistics_29.Paths, Replace=tree_statistics_26.Paths)
merge_23 = Merge(Data1=replace_paths_19, Data2=top_gangway_top_18.Negative)
top_gangway_top_19 = SplitTree(Data=merge_23, Masks=flatten("{13;1;0;?}"))  # -> Positive, Negative
tree_statistics_30 = TreeStatistics(Tree=top_gangway_top_19.Positive)  # -> Paths, Length, Count
tree_statistics_31 = TreeStatistics(Tree=graft_tree)  # -> Paths, Length, Count
list_item_35 = ListItem(List=tree_statistics_31.Paths, Index=panel_8, Wrap=True)
split_tree_8 = SplitTree(Data=graft_tree, Masks=flatten(list_item_35))  # -> Positive, Negative
tree_statistics_32 = TreeStatistics(Tree=split_tree_8.Positive)  # -> Paths, Length, Count
replace_paths_20 = ReplacePaths(Data=split_tree_4.Positive, Search=tree_statistics_19.Paths, Replace=tree_statistics_32.Paths)
tree_statistics_33 = TreeStatistics(Tree=replace_paths_20)  # -> Paths, Length, Count
replace_paths_21 = ReplacePaths(Data=replace_paths_20, Search=tree_statistics_33.Paths, Replace=tree_statistics_30.Paths)
merge_24 = Merge(Data1=replace_paths_21, Data2=top_gangway_top_19.Negative)
tree_statistics_34 = TreeStatistics(Tree=merge_24)  # -> Paths, Length, Count
panel_82 = Panel(tree_statistics_34.Paths)
panel_83 = Panel(tree_statistics_34.Length)
tree_statistics_35 = TreeStatistics(Tree=graft_tree)  # -> Paths, Length, Count
list_item_36 = ListItem(List=tree_statistics_35.Paths, Index=panel_8, Wrap=True)
top_gangway_top_20 = SplitTree(Data=merge_24, Masks=flatten("{13;2;0;?}"))  # -> Positive, Negative
tree_statistics_36 = TreeStatistics(Tree=top_gangway_top_20.Positive)  # -> Paths, Length, Count
split_tree_9 = SplitTree(Data=graft_tree, Masks=flatten(list_item_36))  # -> Positive, Negative
tree_statistics_37 = TreeStatistics(Tree=split_tree_9.Positive)  # -> Paths, Length, Count
replace_paths_22 = ReplacePaths(Data=split_tree_5.Positive, Search=tree_statistics_20.Paths, Replace=tree_statistics_37.Paths)
tree_statistics_38 = TreeStatistics(Tree=replace_paths_22)  # -> Paths, Length, Count
replace_paths_23 = ReplacePaths(Data=replace_paths_22, Search=tree_statistics_38.Paths, Replace=tree_statistics_36.Paths)
merge_25 = Merge(Data1=replace_paths_23, Data2=top_gangway_top_20.Negative)
tree_statistics_39 = TreeStatistics(Tree=graft_tree)  # -> Paths, Length, Count
list_item_37 = ListItem(List=tree_statistics_39.Paths, Index=panel_8, Wrap=True)
top_gangway_top_21 = SplitTree(Data=merge_25, Masks=flatten("{13;3;0;?}"))  # -> Positive, Negative
tree_statistics_40 = TreeStatistics(Tree=top_gangway_top_21.Positive)  # -> Paths, Length, Count
split_tree_10 = SplitTree(Data=graft_tree, Masks=flatten(list_item_37))  # -> Positive, Negative
tree_statistics_41 = TreeStatistics(Tree=split_tree_10.Positive)  # -> Paths, Length, Count
replace_paths_24 = ReplacePaths(Data=split_tree_6.Positive, Search=tree_statistics_21.Paths, Replace=tree_statistics_41.Paths)
tree_statistics_42 = TreeStatistics(Tree=replace_paths_24)  # -> Paths, Length, Count
replace_paths_25 = ReplacePaths(Data=replace_paths_24, Search=tree_statistics_42.Paths, Replace=tree_statistics_40.Paths)
merge_26 = Merge(Data1=replace_paths_25, Data2=top_gangway_top_21.Negative)
tree_statistics_43 = TreeStatistics(Tree=merge_26)  # -> Paths, Length, Count
panel_84 = Panel(tree_statistics_43.Paths)
top_gangway_top_22 = SplitTree(Data=merge_26, Masks=flatten("{8;0;0}"))  # -> Positive, Negative
merge_27 = Merge(Data1=replace_paths_15, Data2=top_gangway_top_22.Negative)
top_gangway_top_23 = SplitTree(Data=merge_27, Masks=flatten("{12;0;0}"))  # -> Positive, Negative
merge_28 = Merge(Data1=replace_paths_16, Data2=top_gangway_top_23.Negative)
split_2 = SplitTree(Data=merge_28, Masks=flatten("{11;?;?}"))  # -> Positive, Negative
split_3 = SplitTree(Data=merge_28, Masks=flatten("{12;?;?}"))  # -> Positive, Negative
split_4 = SplitTree(Data=merge_28, Masks=flatten("{10;?;?}"))  # -> Positive, Negative
split_5 = SplitTree(Data=merge_28, Masks=flatten("{4;?;?}"))  # -> Positive, Negative
split_6 = SplitTree(Data=merge_28, Masks=flatten("{5;?;?}"))  # -> Positive, Negative
split_7 = SplitTree(Data=merge_28, Masks=flatten("{9;?;?}"))  # -> Positive, Negative
split_8 = SplitTree(Data=merge_28, Masks=flatten("{3;?;?}"))  # -> Positive, Negative
split_9 = SplitTree(Data=merge_28, Masks=flatten("{7;?;?}"))  # -> Positive, Negative
split_10 = SplitTree(Data=merge_28, Masks=flatten("{8;?;?}"))  # -> Positive, Negative
split_11 = SplitTree(Data=merge_28, Masks=flatten("{6;?;?}"))  # -> Positive, Negative
split_12 = SplitTree(Data=merge_28, Masks=flatten("{2;?;?}"))  # -> Positive, Negative
split_13 = SplitTree(Data=merge_28, Masks=flatten("{1;?;?}"))  # -> Positive, Negative
split_14 = SplitTree(Data=merge_28, Masks=flatten("{0;?}"))  # -> Positive, Negative
split_15 = SplitTree(Data=merge_28, Masks=flatten("{13;?;?;?}"))  # -> Positive, Negative
split_16 = SplitTree(Data=merge_28, Masks=flatten("{14;?;?}"))  # -> Positive, Negative
split_17 = SplitTree(Data=merge_28, Masks=flatten("{15;?}"))  # -> Positive, Negative
bang = ExplodeTree(Data=split_4.Positive)  # -> Branch0, Branch1
bang_2 = ExplodeTree(Data=split_2.Positive)  # -> Branch0, Branch1
split_18 = SplitTree(Data=merge_28, Masks=flatten("{20;?;?}"))  # -> Positive, Negative
split_19 = SplitTree(Data=merge_28, Masks=flatten("{18;?;?}"))  # -> Positive, Negative
bang_3 = ExplodeTree(Data=split_11.Positive)  # -> Branch0, Branch1, Branch2, Branch3
split_20 = SplitTree(Data=merge_28, Masks=flatten("{16;?;?}"))  # -> Positive, Negative
bang_4 = ExplodeTree(Data=split_13.Positive)  # -> Branch0, Branch1, Branch2, Branch3
bang_5 = ExplodeTree(Data=split_12.Positive)  # -> Branch0, Branch1, Branch2, Branch3
bang_6 = ExplodeTree(Data=split_8.Positive)  # -> Branch0, Branch1, Branch2, Branch3
bang_7 = ExplodeTree(Data=split_5.Positive)  # -> Branch0, Branch1, Branch2, Branch3
bang_8 = ExplodeTree(Data=split_6.Positive)  # -> Branch0, Branch1, Branch2, Branch3
bang_9 = ExplodeTree(Data=split_7.Positive)  # -> Branch0, Branch1
bang_10 = ExplodeTree(Data=split_3.Positive)  # -> Branch0, Branch1, Branch2, Branch3, Branch4, Branch5, Branch6
bang_11 = ExplodeTree(Data=split_9.Positive)  # -> Branch0, Branch1
split_21 = SplitTree(Data=merge_28, Masks=flatten("{17;?;?}"))  # -> Positive, Negative
bang_12 = ExplodeTree(Data=split_10.Positive)  # -> Branch0, Branch1, Branch2
split_22 = SplitTree(Data=merge_28, Masks=flatten("{19;0;?}"))  # -> Positive, Negative
item_5 = ListItem(List=split_14.Positive, Index=0, Wrap=True)  # -> Item, Item1, Item2, Item3, Item4, Item5, Item6, Item7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
larger_than_3 = LargerThan(FirstNumber=item_5.Item2, SecondNumber="3")  # -> LargerThan, OrEqualTo
tree_statistics_44 = TreeStatistics(Tree=split_15.Positive)  # -> Paths, Length, Count
bang_13 = ExplodeTree(Data=split_16.Positive)  # -> Branch0, Branch1, Branch2, Branch3, Branch4, Branch5
bang_14 = ExplodeTree(Data=split_18.Positive)  # -> Branch0, Branch1, Branch2
bang_15 = ExplodeTree(Data=split_20.Positive)  # -> Branch0, Branch1, Branch2
bang_16 = ExplodeTree(Data=split_21.Positive)  # -> Branch0, Branch1, Branch2, Branch3
bang_17 = ExplodeTree(Data=split_22.Positive)  # -> Branch0, Branch1, Branch2, Branch3, Branch4
panel_85 = Panel(tree_statistics_44.Paths)
panel_86 = Panel(bang_4.Branch0)
ma = MassAddition(Input=bang_4.Branch0)  # -> Result, PartialResults
ma_2 = MassAddition(Input=bang_4.Branch1)  # -> Result, PartialResults
ma_3 = MassAddition(Input=bang_4.Branch2)  # -> Result, PartialResults
ma_4 = MassAddition(Input=bang_4.Branch3)  # -> Result, PartialResults
merge_29 = Merge(Data1=ma.Result, Data2=ma_2.Result, Data3=ma_3.Result, Data4=ma_4.Result)
item_6 = ListItem(List=crv, Index=item_5.Item12, Wrap=True)
boundary = BoundarySurfaces(Edges=item_6)
sort = SortList(Keys=flatten(merge_29))  # -> reverse(Keys), ValuesA
item_7 = ListItem(List=sort.Keys, Index=0, Wrap=True)

preview = CustomPreview(Geometry=boundary, Material=ColourSwatch(SwatchColor=RGB(18, 110, 0)))

item_8 = ListItem(List=offset_auditorium_outline, Index=item_5.Item1, Wrap=True)

# ---- group: make building outline divisible by grid depth
item_9 = ListItem(List=auditorium_outline, Index=item_5.Item1, Wrap=True)
item_10 = ListItem(List=scale.Geometry, Index=item_5.Item2, Wrap=True)
explode_6 = Explode(Curve=item_9, Recursive=True)  # -> Segments, Vertices
explode_7 = Explode(Curve=item_10, Recursive=True)  # -> Segments, Vertices
list_item_38 = ListItem(List=explode_7.Segments, Index=3, Wrap=True)
list_item_39 = ListItem(List=explode_6.Segments, Index=3, Wrap=True)
point_on_curve_3 = PointOnCurve(list_item_38, parameter=0.5)
point_on_curve_4 = PointOnCurve(list_item_39, parameter=0.5)
dist = Distance(PointA=point_on_curve_4, PointB=point_on_curve_3)
division_10 = Division(A=dist, B=bang_9.Branch0)
round_4 = Round(Number=division_10)  # -> Nearest, Floor, Ceiling
multiplication_2 = Multiplication(A=round_4.Ceiling, B=bang_9.Branch0)
subtraction_6 = Subtraction(A=multiplication_2, B=dist)
offset_curve_loose = OffsetCurveLoose(Curve=scale.Geometry, Distance=subtraction_6)

# ----
item_11 = ListItem(List=offset_curve_loose, Index=item_5.Item2, Wrap=True)
addition_8 = Addition(A=bang_3.Branch0, B=".01")
bowl_section_2 = BB_BowlSection(
    touchline=crv_2,
    outline=item_2,
    setDistance=pull.Distance,
    rows=bang_4.Branch0,
    stepDepths=bang_5.Branch0,
    landingDepths=bang_16.Branch0,
    floorHeights=bang_6.Branch0,
    cantilevers=bang_8.Branch0,
    cValues=bang_7.Branch0)  # -> section, sightlines, sectionInfo; inputs touchline: Curve, outline: list of Curve, rows: list of Int32, stepDepths: list, landingDepths: list, floorHeights: list, cantilevers: list, seatOffsets: list, cValues: list, stepHeights: list; plug-in component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
text_join_2 = TextJoin(Text=addition_8, Join=",")
end = EndPoints(Curve=bowl_section_2.sightlines)  # -> Start, End
end_2 = EndPoints(Curve=bowl_section_2.section)  # -> Start, End
bowl_section_3 = BB_BowlSection(
    touchline=crv_2,
    outline=item_2,
    setDistance=pull.Distance,
    rows=bang_4.Branch3,
    stepDepths=bang_5.Branch3,
    landingDepths=bang_16.Branch3,
    floorHeights=bang_6.Branch3,
    cantilevers=bang_8.Branch3,
    cValues=bang_7.Branch3)  # -> section, sightlines, sectionInfo; inputs touchline: Curve, outline: list of Curve, rows: list of Int32, stepDepths: list, landingDepths: list, floorHeights: list, cantilevers: list, seatOffsets: list, cValues: list, stepHeights: list; plug-in component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
list_length_10 = ListLength(List=bang_3.Branch0)
move_8 = Move(Geometry=end_2.Start, Motion=Z)  # -> Geometry, Transform
equality_3 = Equality(FirstNumber=list_length_10, SecondNumber="1")  # -> Equality, Inequality
ln = Line(StartPoint=end_2.Start, EndPoint=move_8.Geometry)
join_2 = JoinCurves(Curves=[bowl_section_2.section, ln], Preserve=False)
dispatch_10 = Dispatch(List=text_join_2, DispatchPattern=equality_3.Equality)  # -> ListA, ListB
insert_items_3 = InsertItems(List=dispatch_10.ListA, Item="0", Indices="0", Wrap=True)
text_split_5 = TextSplit(Text=dispatch_10.ListB, Separators=",")
crv_4 = Curve(bowl_section_2.section)
end_3 = EndPoints(Curve=bowl_section_2.section)  # -> Start, End
end_4 = EndPoints(Curve=bowl_section_3.sightlines)  # -> Start, End
merge_30 = Merge(Data1=insert_items_3, Data2=text_split_5)
end_5 = EndPoints(Curve=bowl_section_3.section)  # -> Start, End
clean_tree_4 = CleanTree(RemoveNulls=True, RemoveInvalid=True, RemoveEmpty=True, Tree=flatten(merge_30))
panel_87 = Panel(bang_9.Branch0)
move_9 = Move(Geometry=end_5.Start, Motion=Z_2)  # -> Geometry, Transform
move_10 = Move(Geometry=crv_4, Motion=Y)  # -> Geometry, Transform
move_11 = Move(Geometry=end.Start, Motion=Y)  # -> Geometry, Transform
panel_88 = Panel(dist)
ln_2 = Line(StartPoint=end_5.Start, EndPoint=move_9.Geometry)
join_3 = JoinCurves(Curves=[ln_2, bowl_section_3.section], Preserve=False)
pt_3 = ConstructPoint(XCoordinate=0, YCoordinate=0, ZCoordinate=bang_3.Branch0)
division_11 = Division(A=panel_88, B=panel_87)
pcx_3 = CurvePlane(Curve=join_2, Plane=xy)  # -> flatten(Points), ParamsC, ParamsP
crv_5 = Curve(bowl_section_3.section)
xy_2 = XYPlane(Origin=pt_3)
end_6 = EndPoints(Curve=bowl_section_3.section)  # -> Start, End
list_item_40 = ListItem(List=pcx_3.Points, Index=Slider(1, range=0..10), Wrap=True)
round_5 = Round(Number=division_11)  # -> Nearest, Floor, Ceiling
panel_89 = Panel(bang_9.Branch0)
ln_3 = Line(StartPoint=end.Start, EndPoint=move_11.Geometry)
move_12 = Move(Geometry=crv_5, Motion=Y_2)  # -> Geometry, Transform
series_16 = Series(Start=0, Step=panel_87, Count=round_5.Nearest)
move_13 = Move(Geometry=end_4.Start, Motion=Y_2)  # -> Geometry, Transform
panel_90 = Panel(pcx_3.Points)
X = UnitX(Factor=panel_88)
X_2 = UnitX(Factor=series_16)
bbox = BoundingBox(Content=[crv_5, move_12.Geometry], Plane=PlaneXY(0, 0, 0), UnionBox=True)  # -> Box, Box_2
panel_91 = Panel(dist)
move_14 = Move(Geometry=end_3.Start, Motion=X_2)  # -> Geometry, Transform
move_15 = Move(Geometry=end_3.Start, Motion=X)  # -> Geometry, Transform
group = Group(Objects=ln_3)
pdecon = Deconstruct(Point=move_14.Geometry)  # -> XComponent, YComponent, ZComponent
debrep = DeconstructBrep(Brep=bbox.Box)  # -> Faces, Edges, Vertices
division_12 = Division(A=panel_91, B=panel_89)
pdecon_2 = Deconstruct(Point=pcx_3.Points)  # -> XComponent, YComponent, ZComponent
item_12 = ListItem(List=debrep.Faces, Index=5, Wrap=True)
split_23 = TextSplit(Text=division_12, Separators=".")
larger = LargerThan(FirstNumber=graft(pdecon_2.XComponent), SecondNumber=pdecon.XComponent)  # -> LargerThan, OrEqualTo
group_2 = Group(Objects=[crv_4, move_10.Geometry])
move_16 = Move(Geometry=item_12, Motion=Z_6)  # -> Geometry, Transform
item_13 = ListItem(List=split_23, Index=0, Wrap=True)
dispatch_11 = Dispatch(List=pdecon.XComponent, DispatchPattern=larger.LargerThan)  # -> ListA, ListB
ln_4 = Line(StartPoint=end_4.Start, EndPoint=move_13.Geometry)
series_17 = Series(Start=0, Step=panel_89, Count=item_13)
mesh_2 = MeshBrep(
    Brep=move_16.Geometry,
    Settings={GridMaxCount=0, GridMinCount=16, JaggedSeams=False, MaxEdgeLength=0, MinEdgeLength=0.0001, MinTolerance=0, Refine=True, RefineAngle=0, RelativeTolerance=0.65, SimplePlanes=True, Tolerance=0})
X_3 = UnitX(Factor=panel_91)
pt_4 = ConstructPoint(XCoordinate=dispatch_11.ListB, YCoordinate=0, ZCoordinate=graft(pdecon_2.ZComponent))
X_4 = UnitX(Factor=series_17)
pcx_4 = CurvePlane(Curve=join_3, Plane=xy_2)  # -> flatten(Points), ParamsC, ParamsP
mcol = MeshColours(Mesh=mesh_2, Colours=ColourSwatch(SwatchColor=RGB(0, 25, 87)))
replace_13 = ReplaceItems(List=pt_4, Item=graft(pcx_3.Points), Indices=0, Wrap=False)
move_17 = Move(Geometry=end_6.Start, Motion=X_4)  # -> Geometry, Transform
move_18 = Move(Geometry=end_6.Start, Motion=X_3)  # -> Geometry, Transform
group_3 = Group(Objects=ln_4)
cullpt = CullDuplicates(Points=replace_13, Tolerance="1", CullMode=3)  # -> Points, Indices, Valence
pdecon_3 = Deconstruct(Point=move_17.Geometry)  # -> XComponent, YComponent, ZComponent
pdecon_4 = Deconstruct(Point=pcx_4.Points)  # -> XComponent, YComponent, ZComponent
ln_5 = Line(StartPoint=end_6.Start, EndPoint=move_18.Geometry)
pline = PolyLine(Vertices=cullpt.Points, Closed=False)
move_19 = Move(Geometry=ln_5, Motion=Y_2)  # -> Geometry, Transform
explode_8 = Explode(Curve=pline, Recursive=True)  # -> Segments, Vertices
move_20 = Move(Geometry=explode_8.Segments, Motion=Y)  # -> Geometry, Transform
larger_2 = LargerThan(FirstNumber=graft(pdecon_4.XComponent), SecondNumber=pdecon_3.XComponent)  # -> LargerThan, OrEqualTo
group_4 = Group(Objects=[crv_5, move_12.Geometry])
loft = Loft(
    Curves=[ln_5, move_19.Geometry],
    Options={Adjust=False, Closed=False, LoftEnds=0, LoftSimp=0, LoftType=0, Rebuild=10, Refit=0.01})
weave_4 = Weave(Pattern=[0, 1], Stream0=graft(move_20.Geometry), Stream1=graft(explode_8.Segments), NullGaps=False)
dispatch_12 = Dispatch(List=pdecon_3.XComponent, DispatchPattern=larger_2.LargerThan)  # -> ListA, ListB
loft_2 = Loft(Curves=weave_4, Options={Adjust=False, Closed=False, LoftEnds=0, LoftSimp=0, LoftType=0, Rebuild=10, Refit=0.01})
pt_5 = ConstructPoint(XCoordinate=dispatch_12.ListB, YCoordinate=0, ZCoordinate=graft(pdecon_4.ZComponent))
debrep_2 = DeconstructBrep(Brep=loft_2)  # -> Faces, Edges, Vertices
srf_cp = SurfaceClosestPoint(Point=end_6.Start, Surface=loft)  # -> Point, UVPoint, Distance
replace_14 = ReplaceItems(List=pt_5, Item=graft(pcx_4.Points), Indices=0, Wrap=False)
end_7 = EndPoints(Curve=debrep_2.Edges)  # -> Start, End
ln_6 = Line(StartPoint=end_3.Start, EndPoint=move_15.Geometry)
cullpt_2 = CullDuplicates(Points=replace_14, Tolerance="1", CullMode=3)  # -> Points, Indices, Valence
pline_2 = PolyLine(Vertices=end_7.Start, Closed=True)
move_21 = Move(Geometry=ln_6, Motion=Y)  # -> Geometry, Transform
pline_3 = PolyLine(Vertices=cullpt_2.Points, Closed=False)
join_4 = JoinCurves(Curves=pline_2, Preserve=False)
end_8 = EndPoints(Curve=move_21.Geometry)  # -> Start, End
end_9 = EndPoints(Curve=ln_6)  # -> Start, End
explode_9 = Explode(Curve=pline_3, Recursive=True)  # -> Segments, Vertices
move_22 = Move(Geometry=explode_9.Segments, Motion=Y_2)  # -> Geometry, Transform
trim = TrimTree(Tree=join_4, Depth=3)
tree_statistics_45 = TreeStatistics(Tree=trim)  # -> Paths, Length, Count
ln_7 = Line(StartPoint=end_8.Start, EndPoint=end_9.Start)
ln_8 = Line(StartPoint=end_8.End, EndPoint=end_9.End)
item_14 = ListItem(List=tree_statistics_45.Paths, Index=0, Wrap=True)
weave_5 = Weave(Pattern=[0, 1], Stream0=graft(move_22.Geometry), Stream1=graft(explode_9.Segments), NullGaps=False)
lng_2 = ListLength(List=trim)
tree_branch_7 = TreeBranch(Tree=trim, Path=item_14, MaintainPaths=True)
loft_3 = Loft(Curves=weave_5, Options={Adjust=False, Closed=False, LoftEnds=0, LoftSimp=0, LoftType=0, Rebuild=10, Refit=0.01})
split_24 = SplitList(List=reverse(trim), Index=1)  # -> ListA, reverse(ListB)
item_15 = ListItem(List=flatten(lng_2), Index=0, Wrap=True)
division_13 = Division(A="1", B=item_15)
series_18 = Series(Start=0, Step=division_13, Count=item_15)
tweencrv = TweenCurve(CurveA=ln_7, CurveB=ln_8, Factor=series_18, BlendType=0)
merge_31 = Merge(Data1=tweencrv, Data2=ln_8)
debrep_3 = DeconstructBrep(Brep=loft_3)  # -> Faces, Edges, Vertices
end_10 = EndPoints(Curve=debrep_3.Edges)  # -> Start, End
explode_10 = Explode(Curve=tree_branch_7, Recursive=True)  # -> Segments, Vertices
pline_4 = PolyLine(Vertices=end_10.Start, Closed=True)
group_5 = Group(Objects=split_24.ListB)
join_5 = JoinCurves(Curves=pline_4, Preserve=False)
list_item_41 = ListItem(List=explode_10.Segments, Index=0, Wrap=True)  # -> Item, Item1, Item2
flatten_tree = FlattenTree(Tree=list_item_41.Item2, Path="{0}")
trim_2 = TrimTree(Tree=join_5, Depth=3)
group_6 = Group(Objects=flatten(group_5))
list_item_42 = ListItem(List=reverse(flatten_tree), Index=0, Wrap=True)
loft_4 = Loft(
    Curves=flatten(merge_31),
    Options={Adjust=False, Closed=False, LoftEnds=0, LoftSimp=0, LoftType=1, Rebuild=10, Refit=0.01})
debrep_4 = DeconstructBrep(Brep=loft_4)  # -> Faces, Edges, Vertices
split_25 = SplitList(List=reverse(trim_2), Index=1)  # -> ListA, reverse(ListB)
flip_curve = FlipCurve(Curve=list_item_42)  # -> Curve, Flag
item_16 = ListItem(List=debrep_4.Vertices, Index=3, Wrap=True)
merge_32 = Merge(Data1=flatten(list_item_41.Item), Data2=flip_curve.Curve)
list_length_11 = ListLength(List=merge_32)
srf_cp_2 = SurfaceClosestPoint(Point=item_16, Surface=loft_4)  # -> Point, UVPoint, Distance
group_7 = Group(Objects=split_25.ListB)
loft_5 = Loft(Curves=merge_32, Options={Adjust=False, Closed=False, LoftEnds=0, LoftSimp=0, LoftType=1, Rebuild=10, Refit=0.01})
group_8 = Group(Objects=flatten(group_7))
entwine_11 = Entwine(Branch00=group_3, Branch01=group_4, Branch02=group_8, Branch03=mcol, FlattenInputs=True)
group_9 = Group(Objects=flatten(entwine_11))
panel_92 = Panel(bang_9.Branch1)
division_14 = Division(A=len_2, B=panel_92)
int_3 = Integer(division_14)

# ---- group: even number of sector divisions
lng_3 = ListLength(List=int_3)
smaller_2 = SmallerThan(FirstNumber=division_14, SecondNumber=Slider(4, range=0..10))  # -> SmallerThan, OrEqualTo
series_19 = Series(Start=0, Step=1, Count=lng_3)
dispatch_13 = Dispatch(List=series_19, DispatchPattern=smaller_2.SmallerThan)  # -> ListA, ListB
replace_15 = ReplaceItems(List=int_3, Item="4", Indices=dispatch_13.ListA, Wrap=False)
int_4 = Integer(replace_15)
division_15 = Division(A=int_4, B="2")
split_26 = TextSplit(Text=division_15, Separators=".")
item_17 = ListItem(List=split_26, Index=0, Wrap=True)
multiplication_3 = Multiplication(A=item_17, B=2)  # -> flatten(Result)

# ----
panel_93 = Panel(item_5.Item8)
series_20 = Series(Start=0, Step=item_5.Item7, Count=panel_93)
offset = OffsetCurve(Curve=item_11, Distance=series_20, Corners=1)
item_18 = ListItem(List=flatten(offset), Index=0, Wrap=True)
explode_11 = Explode(Curve=item_18, Recursive=True)  # -> Segments, Vertices
replace_16 = ReplaceItems(List=multiplication_3, Item=item_5.Item5, Indices=panel_23, Wrap=False)
divide = DivideCurve(Curve=graft(explode_11.Segments), Count=graft(replace_16), Kinks=False)  # -> Points, Tangents, Parameters
divide_2 = DivideCurve(Curve=graft(explode_4.Segments), Count=graft(replace_16), Kinks=False)  # -> Points, Tangents, Parameters
rev = ReverseList(List=flatten(offset))  # -> graft(List)
ln_9 = Line(StartPoint=divide_2.Points, EndPoint=divide.Points)
panel_94 = Panel(replace_16)
series_21 = Series(Start=0, Step=bang_9.Branch0, Count=item_5.Item4)
offset_l = OffsetCurveLoose(Curve=item_8, Distance=expr("x+.1", series_21))
ccx = CurveCurve(CurveA=graft(rev), CurveB=flatten(ln_9))  # -> Points, ParamsA, ParamsB
ccx_2 = CurveCurve(CurveA=graft(offset_l), CurveB=flatten(ln_9))  # -> Points, ParamsA, ParamsB
trim_3 = TrimTree(Tree=ccx.Points, Depth=1)
trim_4 = TrimTree(Tree=ccx_2.Points, Depth=1)
cullpt_3 = CullDuplicates(Points=trim_3, Tolerance=0.1, CullMode=3)  # -> Points, Indices, Valence
cullpt_4 = CullDuplicates(Points=trim_4, Tolerance=0.1, CullMode=3)  # -> Points, Indices, Valence
pline_5 = PolyLine(Vertices=cullpt_3.Points, Closed=True)  # -> flatten(Polyline)
pline_6 = PolyLine(Vertices=cullpt_4.Points, Closed=True)
flatten = FlattenTree(Tree=pline_6, Path="{0}")
item_19 = ListItem(List=reverse(flatten), Index=0, Wrap=True)
item_20 = ListItem(List=reverse(pline_5), Index=0, Wrap=True)
item_21 = ListItem(List=pline_5, Index=bang_13.Branch5, Wrap=True)
explode_12 = Explode(Curve=item_19, Recursive=True)  # -> Segments, Vertices
explode_13 = Explode(Curve=item_20, Recursive=True)  # -> Segments, Vertices
explode_14 = Explode(Curve=pline_5, Recursive=True)  # -> Segments, Vertices
explode_15 = Explode(Curve=flatten, Recursive=True)  # -> Segments, Vertices
flip = FlipMatrix(Data=explode_14.Segments)  # -> simplify(Data)
flip_2 = FlipMatrix(Data=explode_15.Segments)  # -> simplify(Data)
panel_95 = Panel(bang_2.Branch0)
bang_18 = ExplodeTree(Data=split_19.Positive)  # -> Branch0, Branch1, Branch2, Branch3, Branch4, Branch5, Branch6, Branch7
text_join_3 = TextJoin(Text=bang_4.Branch3, Join=",")
text_join_4 = TextJoin(Text=bang_4.Branch1, Join=",")
text_join_5 = TextJoin(Text=bang_4.Branch2, Join=",")
text_join_6 = TextJoin(Text=bang_4.Branch0, Join=",")
panel_96 = Panel(bang_18.Branch7)
weave_6 = Weave(
    Pattern=graft([0, 1]),
    Stream0=text_join_6,
    Stream1=text_join_4,
    Stream2=text_join_5,
    Stream3=text_join_3,
    NullGaps=False)  # -> flatten(Weave)
addition_9 = Addition(A=bang_18.Branch5, B="46")
text_split_6 = TextSplit(Text=weave_6, Separators=",")

# ---- group: largest outline that fits site (continued)
list_item_43 = ListItem(List=building_outline, Index=item_5.Item2, Wrap=True)

# ----
scale_2 = Scale(Geometry=list_item_43, Center=Point(0, 0, 0), Factor=series_11)  # -> Geometry, Transform

# ---- group: automtically calculate tweens / number of offsets measure
list_item_44 = ListItem(List=offset_curve_loose, Index=item_5.Item2, Wrap=True)
explode_16 = Explode(Curve=list_item_44, Recursive=True)  # -> Segments, Vertices
list_item_45 = ListItem(List=explode_16.Segments, Index="3", Wrap=True)
point_on_curve_5 = PointOnCurve(list_item_45, parameter=0.5)

# ---- group: automtically calculate tweens
list_item_46 = ListItem(List=auditorium_outline, Index=item_5.Item1, Wrap=True)
explode_17 = Explode(Curve=list_item_46, Recursive=True)  # -> Segments, Vertices
list_item_47 = ListItem(List=explode_17.Segments, Index="3", Wrap=True)
point_on_curve_6 = PointOnCurve(list_item_47, parameter=0.5)
subtraction_7 = Subtraction(A=item_5.Item4, B="1")
multiplication_4 = Multiplication(A=subtraction_7, B=grid_depth)

# ---- group: automtically calculate tweens / number of offsets measure (continued)
distance = Distance(PointA=point_on_curve_5, PointB=point_on_curve_6)

# ---- group: automtically calculate tweens (continued)
subtraction_8 = Subtraction(A=distance, B=multiplication_4)
division_16 = Division(A=subtraction_8, B=bang_9.Branch0)
round_6 = Round(Number=division_16)  # -> Nearest, Floor, Ceiling

# ----
addition_10 = Addition(A=round_6.Nearest, B=Slider(0, range=0..10))
division_17 = Division(A="1", B=addition_10)
series_22 = Series(Start=division_17, Step=division_17, Count=expr("x-1", addition_10))
tweencrv_2 = TweenCurve(CurveA=graft(explode_12.Segments), CurveB=graft(explode_13.Segments), Factor=series_22, BlendType=0)  # -> simplify(Tween)
merge_33 = Merge(Data1=flip_2, Data2=tweencrv_2, Data3=flip)
split_list_6 = SplitList(List=merge_33, Index=list_length_11)  # -> ListA, ListB
loft_6 = Loft(Curves=split_list_6.ListA, Options=loft_opt)  # -> flatten(Loft)
list_item_48 = ListItem(List=loft_6, Index=Slider(-8, range=-30..10), Wrap=True)
deconstruct_brep = DeconstructBrep(Brep=list_item_48)  # -> Faces, Edges, Vertices
shift = ShiftList(List=loft_6, Shift=-1, Wrap=True)
shift_2 = ShiftList(List=loft_6, Shift=-1, Wrap=True)  # disabled
debrep_5 = DeconstructBrep(Brep=shift)  # -> Faces, Edges, Vertices
item_22 = ListItem(List=debrep_5.Vertices, Index=Slider(0, range=0..10), Wrap=True)  # -> flatten(Item)
lng_4 = ListLength(List=shift)
srf_cp_3 = SurfaceClosestPoint(Point=item_22, Surface=shift)  # -> Point, UVPoint, Distance
repeat = RepeatData(Data=bang_11.Branch0, Length=lng_4)
sift = SiftPattern(List=shift, SiftPattern=repeat)  # -> Output0, Output1, Output2, Output3
sift_2 = SiftPattern(List=srf_cp_3.UVPoint, SiftPattern=repeat)  # -> Output0, Output1, Output2, Output3
clean = CleanTree(RemoveNulls=True, RemoveInvalid=True, RemoveEmpty=False, Tree=sift.Output0)
clean_2 = CleanTree(RemoveNulls=True, RemoveInvalid=True, RemoveEmpty=False, Tree=sift.Output1)
clean_3 = CleanTree(RemoveNulls=True, RemoveInvalid=True, RemoveEmpty=False, Tree=sift.Output2)
clean_4 = CleanTree(RemoveNulls=True, RemoveInvalid=True, RemoveEmpty=False, Tree=sift.Output3)
clean_5 = CleanTree(RemoveNulls=True, RemoveInvalid=True, RemoveEmpty=False, Tree=sift_2.Output0)
clean_6 = CleanTree(RemoveNulls=True, RemoveInvalid=True, RemoveEmpty=False, Tree=sift_2.Output1)
clean_7 = CleanTree(RemoveNulls=True, RemoveInvalid=True, RemoveEmpty=False, Tree=sift_2.Output2)
clean_8 = CleanTree(RemoveNulls=True, RemoveInvalid=True, RemoveEmpty=False, Tree=sift_2.Output3)

bowl_section_4 = BB_BowlSection(
    touchline=crv_2,
    outline=item_2,
    setDistance=pull.Distance,
    rows=bang_4.Branch2,
    stepDepths=bang_5.Branch2,
    landingDepths=bang_16.Branch2,
    floorHeights=bang_6.Branch2,
    cantilevers=bang_8.Branch2,
    cValues=bang_7.Branch2)  # -> section, sightlines, sectionInfo; inputs touchline: Curve, outline: list of Curve, rows: list of Int32, stepDepths: list, landingDepths: list, floorHeights: list, cantilevers: list, seatOffsets: list, cValues: list, stepHeights: list; plug-in component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
end_11 = EndPoints(Curve=bowl_section_4.sightlines)  # -> Start, End
end_12 = EndPoints(Curve=bowl_section_4.section)  # -> Start, End
move_23 = Move(Geometry=end_12.Start, Motion=Z_8)  # -> Geometry, Transform
ln_10 = Line(StartPoint=end_12.Start, EndPoint=move_23.Geometry)
join_6 = JoinCurves(Curves=[ln_10, bowl_section_4.section], Preserve=False)
pt_6 = ConstructPoint(XCoordinate=0, YCoordinate=0, ZCoordinate=bang_3.Branch0)
crv_6 = Curve(bowl_section_4.section)
xy_3 = XYPlane(Origin=pt_6)
end_13 = EndPoints(Curve=bowl_section_4.section)  # -> Start, End
panel_97 = Panel(bang_9.Branch0)
move_24 = Move(Geometry=crv_6, Motion=Y_4)  # -> Geometry, Transform
move_25 = Move(Geometry=end_11.Start, Motion=Y_4)  # -> Geometry, Transform
panel_98 = Panel(dist)
division_18 = Division(A=panel_98, B=panel_97)
split_27 = TextSplit(Text=division_18, Separators=".")
item_23 = ListItem(List=split_27, Index=0, Wrap=True)
ln_11 = Line(StartPoint=end_11.Start, EndPoint=move_25.Geometry)
series_23 = Series(Start=0, Step=panel_97, Count=item_23)
X_5 = UnitX(Factor=panel_98)
X_6 = UnitX(Factor=series_23)
pcx_5 = CurvePlane(Curve=join_6, Plane=xy_3)  # -> flatten(Points), ParamsC, ParamsP
move_26 = Move(Geometry=end_13.Start, Motion=X_6)  # -> Geometry, Transform
move_27 = Move(Geometry=end_13.Start, Motion=X_5)  # -> Geometry, Transform
group_10 = Group(Objects=ln_11)
pdecon_5 = Deconstruct(Point=move_26.Geometry)  # -> XComponent, YComponent, ZComponent
pdecon_6 = Deconstruct(Point=pcx_5.Points)  # -> XComponent, YComponent, ZComponent
ln_12 = Line(StartPoint=end_13.Start, EndPoint=move_27.Geometry)
move_28 = Move(Geometry=ln_12, Motion=Y_4)  # -> Geometry, Transform
larger_3 = LargerThan(FirstNumber=graft(pdecon_6.XComponent), SecondNumber=pdecon_5.XComponent)  # -> LargerThan, OrEqualTo
group_11 = Group(Objects=[crv_6, move_24.Geometry])
loft_7 = Loft(
    Curves=[ln_12, move_28.Geometry],
    Options={Adjust=False, Closed=False, LoftEnds=0, LoftSimp=0, LoftType=0, Rebuild=10, Refit=0.01})
dispatch_14 = Dispatch(List=pdecon_5.XComponent, DispatchPattern=larger_3.LargerThan)  # -> ListA, ListB
pt_7 = ConstructPoint(XCoordinate=dispatch_14.ListB, YCoordinate=0, ZCoordinate=graft(pdecon_6.ZComponent))
srf_cp_4 = SurfaceClosestPoint(Point=end_13.Start, Surface=loft_7)  # -> Point, UVPoint, Distance
replace_17 = ReplaceItems(List=pt_7, Item=graft(pcx_5.Points), Indices=0, Wrap=False)
cullpt_5 = CullDuplicates(Points=replace_17, Tolerance="1", CullMode=3)  # -> Points, Indices, Valence
pline_7 = PolyLine(Vertices=cullpt_5.Points, Closed=False)
explode_18 = Explode(Curve=pline_7, Recursive=True)  # -> Segments, Vertices
move_29 = Move(Geometry=explode_18.Segments, Motion=Y_4)  # -> Geometry, Transform
weave_7 = Weave(Pattern=[0, 1], Stream0=graft(move_29.Geometry), Stream1=graft(explode_18.Segments), NullGaps=False)
loft_8 = Loft(Curves=weave_7, Options={Adjust=False, Closed=False, LoftEnds=0, LoftSimp=0, LoftType=0, Rebuild=10, Refit=0.01})
debrep_6 = DeconstructBrep(Brep=loft_8)  # -> Faces, Edges, Vertices
end_14 = EndPoints(Curve=debrep_6.Edges)  # -> Start, End
pline_8 = PolyLine(Vertices=end_14.Start, Closed=True)
join_7 = JoinCurves(Curves=pline_8, Preserve=False)
trim_5 = TrimTree(Tree=join_7, Depth=3)
split_28 = SplitList(List=reverse(trim_5), Index=1)  # -> ListA, reverse(ListB)
group_12 = Group(Objects=split_28.ListB)
group_13 = Group(Objects=flatten(group_12))

bbox_2 = BoundingBox(Content=[crv_6, move_24.Geometry], Plane=PlaneXY(0, 0, 0), UnionBox=True)  # -> Box, Box_2
debrep_7 = DeconstructBrep(Brep=bbox_2.Box)  # -> Faces, Edges, Vertices
item_24 = ListItem(List=debrep_7.Faces, Index=5, Wrap=True)
move_30 = Move(Geometry=item_24, Motion=Z_4)  # -> Geometry, Transform
mesh_3 = MeshBrep(
    Brep=move_30.Geometry,
    Settings={GridMaxCount=0, GridMinCount=16, JaggedSeams=False, MaxEdgeLength=0, MinEdgeLength=0.0001, MinTolerance=0, Refine=True, RefineAngle=0, RelativeTolerance=0.65, SimplePlanes=True, Tolerance=0})
mcol_2 = MeshColours(Mesh=mesh_3, Colours=ColourSwatch(SwatchColor=RGB(87, 0, 0)))

entwine_12 = Entwine(Branch00=group_10, Branch01=group_11, Branch02=group_13, Branch03=mcol_2, FlattenInputs=True)
group_14 = Group(Objects=flatten(entwine_12))

# ---- group: module 01 (continued)
bowl_section_5 = BB_BowlSection(
    touchline=crv_2,
    outline=item_2,
    setDistance=pull.Distance,
    rows=bang_4.Branch0,
    stepDepths=bang_5.Branch0,
    landingDepths=bang_16.Branch0,
    floorHeights=bang_6.Branch0,
    cantilevers=bang_8.Branch0,
    cValues=bang_7.Branch0)  # -> section, sightlines, sectionInfo; inputs touchline: Curve, outline: list of Curve, rows: list of Int32, stepDepths: list, landingDepths: list, floorHeights: list, cantilevers: list, seatOffsets: list, cValues: list, stepHeights: list; plug-in component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
end_15 = EndPoints(Curve=bowl_section_5.sightlines)  # -> Start, End
end_16 = EndPoints(Curve=bowl_section_5.section)  # -> Start, End
move_31 = Move(Geometry=end_16.Start, Motion=Z_7)  # -> Geometry, Transform
ln_13 = Line(StartPoint=end_16.Start, EndPoint=move_31.Geometry)
join_8 = JoinCurves(Curves=[bowl_section_5.section, ln_13], Preserve=False)
crv_7 = Curve(bowl_section_5.section)
end_17 = EndPoints(Curve=bowl_section_5.section)  # -> Start, End
pt_8 = ConstructPoint(XCoordinate=0, YCoordinate=0, ZCoordinate=clean_tree_4)
panel_99 = Panel(bang_9.Branch0)
move_32 = Move(Geometry=crv_7, Motion=Y_3)  # -> Geometry, Transform
move_33 = Move(Geometry=end_15.Start, Motion=Y_3)  # -> Geometry, Transform
xy_4 = XYPlane(Origin=pt_8)
panel_100 = Panel(dist)
division_19 = Division(A=panel_100, B=panel_99)
pcx_6 = CurvePlane(Curve=join_8, Plane=xy_4)  # -> flatten(Points), ParamsC, ParamsP
ln_14 = Line(StartPoint=end_15.Start, EndPoint=move_33.Geometry)
X_7 = UnitX(Factor=panel_100)
move_34 = Move(Geometry=end_17.Start, Motion=X_7)  # -> Geometry, Transform
group_15 = Group(Objects=ln_14)
pdecon_7 = Deconstruct(Point=pcx_6.Points)  # -> XComponent, YComponent, ZComponent
group_16 = Group(Objects=[crv_7, move_32.Geometry])
ln_15 = Line(StartPoint=end_17.Start, EndPoint=move_34.Geometry)
move_35 = Move(Geometry=ln_15, Motion=Y_3)  # -> Geometry, Transform
end_18 = EndPoints(Curve=move_35.Geometry)  # -> Start, End
end_19 = EndPoints(Curve=ln_15)  # -> Start, End
ln_16 = Line(StartPoint=end_18.Start, EndPoint=end_19.Start)
ln_17 = Line(StartPoint=end_18.End, EndPoint=end_19.End)

# ----
end_20 = EndPoints(Curve=bowl_section_5.section)  # -> Start, End
deconstruct_2 = Deconstruct(Point=end_20.End)  # -> XComponent, YComponent, ZComponent
bbox_3 = BoundingBox(Content=[crv_7, move_32.Geometry], Plane=PlaneXY(0, 0, 0), UnionBox=True)  # -> Box, Box_2
debrep_8 = DeconstructBrep(Brep=bbox_3.Box)  # -> Faces, Edges, Vertices
item_25 = ListItem(List=debrep_8.Faces, Index=5, Wrap=True)
round_7 = Round(Number=division_19)  # -> Nearest, Floor, Ceiling
move_36 = Move(Geometry=item_25, Motion=Z_3)  # -> Geometry, Transform
mesh_4 = MeshBrep(
    Brep=move_36.Geometry,
    Settings={GridMaxCount=0, GridMinCount=16, JaggedSeams=False, MaxEdgeLength=0, MinEdgeLength=0.0001, MinTolerance=0, Refine=True, RefineAngle=0, RelativeTolerance=0.65, SimplePlanes=True, Tolerance=0})
panel_101 = Panel(pcx_6.Points)
mcol_3 = MeshColours(Mesh=mesh_4, Colours=ColourSwatch(SwatchColor=RGB(255, 132, 0)))
entwine_13 = Entwine(Branch00=group, Branch01=group_2, Branch02=group_6, Branch03=mcol_3, FlattenInputs=True)
group_17 = Group(Objects=flatten(entwine_13))

bowl_section_6 = BB_BowlSection(
    touchline=crv_2,
    outline=item_2,
    setDistance=pull.Distance,
    rows=bang_4.Branch1,
    stepDepths=bang_5.Branch1,
    landingDepths=bang_16.Branch1,
    floorHeights=bang_6.Branch1,
    cantilevers=bang_8.Branch1,
    cValues=bang_7.Branch1)  # -> section, sightlines, sectionInfo; inputs touchline: Curve, outline: list of Curve, rows: list of Int32, stepDepths: list, landingDepths: list, floorHeights: list, cantilevers: list, seatOffsets: list, cValues: list, stepHeights: list; plug-in component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
end_21 = EndPoints(Curve=bowl_section_6.sightlines)  # -> Start, End
end_22 = EndPoints(Curve=bowl_section_6.section)  # -> Start, End
move_37 = Move(Geometry=end_22.Start, Motion=Z_9)  # -> Geometry, Transform
ln_18 = Line(StartPoint=end_22.Start, EndPoint=move_37.Geometry)
join_9 = JoinCurves(Curves=[ln_18, bowl_section_6.section], Preserve=False)
pt_9 = ConstructPoint(XCoordinate=0, YCoordinate=0, ZCoordinate=bang_3.Branch0)
crv_8 = Curve(bowl_section_6.section)
xy_5 = XYPlane(Origin=pt_9)
end_23 = EndPoints(Curve=bowl_section_6.section)  # -> Start, End
panel_102 = Panel(bang_9.Branch0)
move_38 = Move(Geometry=crv_8, Motion=Y_5)  # -> Geometry, Transform
move_39 = Move(Geometry=end_21.Start, Motion=Y_5)  # -> Geometry, Transform
panel_103 = Panel(dist)
division_20 = Division(A=panel_103, B=panel_102)
split_29 = TextSplit(Text=division_20, Separators=".")
item_26 = ListItem(List=split_29, Index=0, Wrap=True)
ln_19 = Line(StartPoint=end_21.Start, EndPoint=move_39.Geometry)
series_24 = Series(Start=0, Step=panel_102, Count=item_26)
X_8 = UnitX(Factor=panel_103)
X_9 = UnitX(Factor=series_24)
pcx_7 = CurvePlane(Curve=join_9, Plane=xy_5)  # -> flatten(Points), ParamsC, ParamsP
move_40 = Move(Geometry=end_23.Start, Motion=X_9)  # -> Geometry, Transform
move_41 = Move(Geometry=end_23.Start, Motion=X_8)  # -> Geometry, Transform
group_18 = Group(Objects=ln_19)
pdecon_8 = Deconstruct(Point=move_40.Geometry)  # -> XComponent, YComponent, ZComponent
pdecon_9 = Deconstruct(Point=pcx_7.Points)  # -> XComponent, YComponent, ZComponent
ln_20 = Line(StartPoint=end_23.Start, EndPoint=move_41.Geometry)
move_42 = Move(Geometry=ln_20, Motion=Y_5)  # -> Geometry, Transform
larger_4 = LargerThan(FirstNumber=graft(pdecon_9.XComponent), SecondNumber=pdecon_8.XComponent)  # -> LargerThan, OrEqualTo
group_19 = Group(Objects=[crv_8, move_38.Geometry])
loft_9 = Loft(
    Curves=[ln_20, move_42.Geometry],
    Options={Adjust=False, Closed=False, LoftEnds=0, LoftSimp=0, LoftType=0, Rebuild=10, Refit=0.01})
dispatch_15 = Dispatch(List=pdecon_8.XComponent, DispatchPattern=larger_4.LargerThan)  # -> ListA, ListB
pt_10 = ConstructPoint(XCoordinate=dispatch_15.ListB, YCoordinate=0, ZCoordinate=graft(pdecon_9.ZComponent))
srf_cp_5 = SurfaceClosestPoint(Point=end_23.Start, Surface=loft_9)  # -> Point, UVPoint, Distance
replace_18 = ReplaceItems(List=pt_10, Item=graft(pcx_7.Points), Indices=0, Wrap=False)
cullpt_6 = CullDuplicates(Points=replace_18, Tolerance="1", CullMode=3)  # -> Points, Indices, Valence
pline_9 = PolyLine(Vertices=cullpt_6.Points, Closed=False)
explode_19 = Explode(Curve=pline_9, Recursive=True)  # -> Segments, Vertices
move_43 = Move(Geometry=explode_19.Segments, Motion=Y_5)  # -> Geometry, Transform
weave_8 = Weave(Pattern=[0, 1], Stream0=graft(move_43.Geometry), Stream1=graft(explode_19.Segments), NullGaps=False)
loft_10 = Loft(Curves=weave_8, Options={Adjust=False, Closed=False, LoftEnds=0, LoftSimp=0, LoftType=0, Rebuild=10, Refit=0.01})
debrep_9 = DeconstructBrep(Brep=loft_10)  # -> Faces, Edges, Vertices
end_24 = EndPoints(Curve=debrep_9.Edges)  # -> Start, End
pline_10 = PolyLine(Vertices=end_24.Start, Closed=True)
join_10 = JoinCurves(Curves=pline_10, Preserve=False)
trim_6 = TrimTree(Tree=join_10, Depth=3)
split_30 = SplitList(List=reverse(trim_6), Index=1)  # -> ListA, reverse(ListB)
group_20 = Group(Objects=split_30.ListB)
group_21 = Group(Objects=flatten(group_20))

bbox_4 = BoundingBox(Content=[crv_8, move_38.Geometry], Plane=PlaneXY(0, 0, 0), UnionBox=True)  # -> Box, Box_2
debrep_10 = DeconstructBrep(Brep=bbox_4.Box)  # -> Faces, Edges, Vertices
item_27 = ListItem(List=debrep_10.Faces, Index=5, Wrap=True)
move_44 = Move(Geometry=item_27, Motion=Z_5)  # -> Geometry, Transform
mesh_5 = MeshBrep(
    Brep=move_44.Geometry,
    Settings={GridMaxCount=0, GridMinCount=16, JaggedSeams=False, MaxEdgeLength=0, MinEdgeLength=0.0001, MinTolerance=0, Refine=True, RefineAngle=0, RelativeTolerance=0.65, SimplePlanes=True, Tolerance=0})
mcol_4 = MeshColours(Mesh=mesh_5, Colours=ColourSwatch(SwatchColor=RGB(43, 87, 0)))

entwine_14 = Entwine(Branch00=group_18, Branch01=group_19, Branch02=group_21, Branch03=mcol_4, FlattenInputs=True)
group_22 = Group(Objects=flatten(entwine_14))

# ---- group: module 01 (continued)
series_25 = Series(Start=0, Step=panel_99, Count=round_7.Nearest)
X_10 = UnitX(Factor=series_25)
move_45 = Move(Geometry=end_17.Start, Motion=X_10)  # -> Geometry, Transform
pdecon_10 = Deconstruct(Point=move_45.Geometry)  # -> XComponent, YComponent, ZComponent
larger_5 = LargerThan(FirstNumber=graft(pdecon_7.XComponent), SecondNumber=pdecon_10.XComponent)  # -> LargerThan, OrEqualTo
dispatch_16 = Dispatch(List=pdecon_10.XComponent, DispatchPattern=larger_5.LargerThan)  # -> ListA, ListB
pt_11 = ConstructPoint(XCoordinate=dispatch_16.ListB, YCoordinate=0, ZCoordinate=graft(pdecon_7.ZComponent))

# ----
insert_items_4 = InsertItems(List=pt_11, Item=graft(pcx_6.Points), Indices="0", Wrap=True)
cull_duplicates = CullDuplicates(Points=insert_items_4, Tolerance="2", CullMode=3)  # -> Points, Indices, Valence

# ---- group: module 01 (continued)
pline_11 = PolyLine(Vertices=cull_duplicates.Points, Closed=False)
explode_20 = Explode(Curve=pline_11, Recursive=True)  # -> Segments, Vertices
move_46 = Move(Geometry=explode_20.Segments, Motion=Y_3)  # -> Geometry, Transform
weave_9 = Weave(Pattern=[0, 1], Stream0=graft(move_46.Geometry), Stream1=graft(explode_20.Segments), NullGaps=False)
loft_11 = Loft(Curves=weave_9, Options={Adjust=False, Closed=False, LoftEnds=0, LoftSimp=0, LoftType=0, Rebuild=10, Refit=0.01})
debrep_11 = DeconstructBrep(Brep=loft_11)  # -> Faces, Edges, Vertices
end_25 = EndPoints(Curve=debrep_11.Edges)  # -> Start, End
pline_12 = PolyLine(Vertices=end_25.Start, Closed=True)
join_11 = JoinCurves(Curves=pline_12, Preserve=False)
trim_7 = TrimTree(Tree=join_11, Depth=3)

# ---- group: grid trimmer
end_points = EndPoints(Curve=bowl_section_5.section)  # -> Start, End
area = Area(Geometry=trim_7)  # -> Area, Centroid
point_3 = Point(end_points.End)
deconstruct_3 = Deconstruct(Point=area.Centroid)  # -> XComponent, YComponent, ZComponent
deconstruct_4 = Deconstruct(Point=point_3)  # -> XComponent, YComponent, ZComponent
addition_11 = Addition(A=deconstruct_4.XComponent, B="5")
larger_than_4 = LargerThan(FirstNumber=deconstruct_3.XComponent, SecondNumber=addition_11)  # -> LargerThan, OrEqualTo
dispatch_17 = Dispatch(List=trim_7, DispatchPattern=larger_than_4.LargerThan)  # -> ListA, reverse(ListB)

# ---- group: module 01 (continued)
lng_5 = ListLength(List=dispatch_17.ListB)
split_31 = SplitList(List=reverse(dispatch_17.ListB), Index=1)  # -> ListA, reverse(ListB)
item_28 = ListItem(List=flatten(lng_5), Index=0, Wrap=True)
division_21 = Division(A="1", B=item_28)
series_26 = Series(Start=0, Step=division_21, Count=item_28)
tweencrv_3 = TweenCurve(CurveA=ln_16, CurveB=ln_17, Factor=series_26, BlendType=0)
merge_34 = Merge(Data1=tweencrv_3, Data2=ln_17)
loft_12 = Loft(
    Curves=flatten(merge_34),
    Options={Adjust=False, Closed=False, LoftEnds=0, LoftSimp=0, LoftType=1, Rebuild=10, Refit=0.01})
group_23 = Group(Objects=dispatch_17.ListB)
debrep_12 = DeconstructBrep(Brep=loft_12)  # -> Faces, Edges, Vertices
group_24 = Group(Objects=flatten(group_23))
entwine_15 = Entwine(Branch00=group_15, Branch01=group_16, Branch02=group_24, Branch03=mcol_3, FlattenInputs=True)
group_25 = Group(Objects=flatten(entwine_15))
item_29 = ListItem(List=debrep_12.Vertices, Index=3, Wrap=True)
srf_cp_6 = SurfaceClosestPoint(Point=item_29, Surface=loft_12)  # -> Point, UVPoint, Distance

# ----
number_of_divisions_in_module_01 = Panel(item_28)
sporph = Sporph(G=group_25, S0=loft_5, P0=srf_cp_6.UVPoint, S1=clean, P1=clean_5, R=False)
sporph_2 = Sporph(G=group_14, S0=loft_12, P0=srf_cp_6.UVPoint, S1=clean_3, P1=clean_7, R=False)
sporph_3 = Sporph(G=group_9, S0=loft_12, P0=srf_cp_6.UVPoint, S1=clean_4, P1=clean_8, R=False)
sporph_4 = Sporph(G=group_22, S0=loft_12, P0=srf_cp_6.UVPoint, S1=clean_2, P1=clean_6, R=False)
weave_10 = Weave(Pattern=repeat, Stream0=sporph, Stream1=sporph_4, Stream2=sporph_2, Stream3=sporph_3, NullGaps=False)
ungroup = Ungroup(Group=flatten(weave_10))
item_30 = ListItem(List=ungroup, Index="2", Wrap=True)
ungroup_2 = Ungroup(Group=item_30)
ungroup_3 = Ungroup(Group=ungroup_2)
panel_104 = Panel(ungroup_3)
trim_8 = TrimTree(Tree=ungroup_3, Depth=1)
tstat = TreeStatistics(Tree=trim_8)  # -> Paths, Length, Count
lng_6 = ListLength(List=ungroup_3)
lng_7 = ListLength(List=tstat.Paths)
larger_6 = LargerThan(FirstNumber=lng_6, SecondNumber=Slider(2, range=0..10))  # -> LargerThan, OrEqualTo
tstat_2 = TreeStatistics(Tree=ungroup_3)  # -> Paths, Length, Count
series_27 = Series(Start=0, Step=1, Count=lng_7)
dispatch_18 = Dispatch(List=tstat_2.Paths, DispatchPattern=flatten(larger_6.LargerThan))  # -> ListA, ListB
branch = TreeBranch(Tree=ungroup_3, Path=dispatch_18.ListA, MaintainPaths=True)
tstat_3 = TreeStatistics(Tree=branch)  # -> Paths, Length, Count
item_31 = ListItem(List=tstat_3.Paths, Index=0, Wrap=True)
branch_2 = TreeBranch(Tree=branch, Path=item_31, MaintainPaths=True)
panel_105 = Panel(tstat_3.Paths)

# ---- group: floor split (continued)
rep_3 = ReplaceText(Text="{0;A;0;?}", Find="A", Replace=series_27, RecursiveReplace=False)
split_32 = SplitTree(Data=ungroup_3, Masks=flatten(rep_3))  # -> Positive, Negative
cp = ControlPoints(Curve=split_32.Positive)  # -> Points, Weights, Knots
item_32 = ListItem(List=cp.Points, Index=panel_46, Wrap=True)
frompoints = MeshFromPoints(Points=item_32, UDirection="2", VDirection="2")
trim_9 = TrimTree(Tree=frompoints, Depth=1)
split_33 = SplitTree(Data=trim_9, Masks=flatten("{0;?;0;0}"))  # -> Positive, Negative
split_34 = SplitTree(Data=trim_9, Masks=flatten("{0;?;0;1}"))  # -> Positive, Negative
split_35 = SplitTree(Data=trim_9, Masks=flatten("{0;?;0;2}"))  # -> Positive, Negative
split_36 = SplitTree(Data=trim_9, Masks=flatten("{0;?;0;3}"))  # -> Positive, Negative
split_37 = SplitTree(Data=trim_9, Masks=flatten("{0;?;0;4}"))  # -> Positive, Negative
split_38 = SplitTree(Data=trim_9, Masks=flatten("{0;?;0;5}"))  # -> Positive, Negative
split_39 = SplitTree(Data=trim_9, Masks=flatten("{0;?;0;6}"))  # -> Positive, Negative
split_40 = SplitTree(Data=trim_9, Masks=flatten("{0;?;0;7}"))  # -> Positive, Negative
flip_3 = FlipMatrix(Data=split_33.Positive)
flip_4 = FlipMatrix(Data=split_34.Positive)
flip_5 = FlipMatrix(Data=split_35.Positive)
flip_6 = FlipMatrix(Data=split_36.Positive)
flip_7 = FlipMatrix(Data=split_37.Positive)
flip_8 = FlipMatrix(Data=split_38.Positive)
flip_9 = FlipMatrix(Data=split_39.Positive)
flip_10 = FlipMatrix(Data=split_40.Positive)
entwine_16 = Entwine(
    Branch0X=flip_3,
    Branch1X=flip_4,
    Branch2X=flip_5,
    Branch3X=flip_6,
    Branch4X=flip_7,
    Branch5X=flip_8,
    Branch6X=flip_9,
    Branch7X=flip_10,
    FlattenInputs=False)
trim_10 = TrimTree(Tree=simplify(entwine_16), Depth=1)

# ----
item_33 = ListItem(List=ungroup, Index="0", Wrap=True)  # -> flatten(Item)
lng_8 = ListLength(List=item_33)
larger_7 = LargerThan(FirstNumber=bang_18.Branch3, SecondNumber=expr("x-1", lng_8))  # -> LargerThan, OrEqualTo
larger_8 = LargerThan(FirstNumber=bang_18.Branch7, SecondNumber=expr("x-2", lng_8))  # -> LargerThan, OrEqualTo
dispatch_19 = Dispatch(List=bang_18.Branch3, DispatchPattern=larger_7.LargerThan)  # -> ListA, ListB
dispatch_20 = Dispatch(List=bang_18.Branch7, DispatchPattern=larger_8.LargerThan)  # -> ListA, ListB
larger_9 = LargerThan(FirstNumber=bang_12.Branch0, SecondNumber=expr("x-2", lng_8))  # -> LargerThan, OrEqualTo
ungroup_4 = Ungroup(Group=item_33)
dispatch_21 = Dispatch(List=flatten(bang_12.Branch0), DispatchPattern=flatten(larger_9.LargerThan))  # -> ListA, ListB
divlength = DivideLength(Curve=ungroup_4, Length=number_slider_10)  # -> Points, Tangents, Parameters
shatter_2 = Shatter(Curve=graft(ungroup_4), Parameters=divlength.Parameters)
list_item_49 = ListItem(List=shatter_2, Index=1, Wrap=True)
end_points_2 = EndPoints(Curve=list_item_49)  # -> Start, End
trim_tree_4 = TrimTree(Tree=end_points_2.End, Depth=Slider(2, range=0..10))
partition_list = PartitionList(List=simplify(trim_tree_4), Size=text_split_6)
polyline_2 = PolyLine(Vertices=partition_list, Closed=False)
trim_tree_5 = TrimTree(Tree=polyline_2, Depth=1)
split_list_7 = SplitList(List=trim_tree_5, Index="1")  # -> ListA, ListB
group_26 = Group(Objects=split_list_7.ListB)
list_item_50 = ListItem(List=flatten(group_26), Index=bang_18.Branch7, Wrap=True)
ungroup_5 = Ungroup(Group=list_item_50)
length_3 = Length(Curve=ungroup_5)
larger_than_5 = LargerThan(FirstNumber=length_3, SecondNumber=Slider(6, range=0..10))  # -> LargerThan, OrEqualTo
dispatch_22 = Dispatch(List=ungroup_5, DispatchPattern=larger_than_5.LargerThan)  # -> ListA, ListB
curve_6 = Curve(dispatch_22.ListB)
curve_7 = Curve(dispatch_22.ListA)
end_points_3 = EndPoints(Curve=curve_6)  # -> Start, End

# ---- group: tunnels
panel_106 = Panel(bang_2.Branch1)

# ---- group: bowl (continued)
item_34 = ListItem(List=ungroup, Index="1", Wrap=True)
panel_107 = Panel(split_17.Positive)
offset_2 = OffsetCurve(Curve=fillet, Distance=panel_107, Corners=1)
move_47 = Move(Geometry=offset_2, Motion=Z_10)  # -> Geometry, Transform
loft_13 = Loft(
    Curves=[move_47.Geometry, offset_2],
    Options={Adjust=False, Closed=False, LoftEnds=0, LoftSimp=0, LoftType=0, Rebuild=10, Refit=0.01})

# ---- group: tunnels (continued)
lng_9 = ListLength(List=flatten(item_34))
series_28 = Series(Start=0, Step=1, Count=lng_9)
dispatch_23 = Dispatch(List=flatten(item_34), DispatchPattern=panel_106)  # -> ListA, ListB
dispatch_24 = Dispatch(List=flatten(series_28), DispatchPattern=panel_106)  # -> ListA, ListB
ungroup_6 = Ungroup(Group=dispatch_23.ListB)

# ----
explode_21 = Explode(Curve=graft(ungroup_6), Recursive=True)  # -> Segments, Vertices
split_41 = SplitList(List=explode_21.Vertices, Index=expr("x*2", flatten(bang_2.Branch0)))  # -> ListA, ListB
pline_13 = PolyLine(Vertices=split_41.ListB, Closed=False)

# ---- group: tunnels (continued)
trim_11 = TrimTree(Tree=pline_13, Depth=3)
group_27 = Group(Objects=trim_11)
replace_19 = ReplaceItems(List=flatten(item_34), Item=flatten(group_27), Indices=dispatch_24.ListB, Wrap=True)  # -> graft(List)

# ---- group: bowl (continued)
ungroup_7 = Ungroup(Group=replace_19)
mloft = PythonicMeshLoftPlus(P=ungroup_7, C="0", A="0", E="0")  # -> L; inputs P: list of Polyline, C: Boolean, A: Boolean, E: Int32
# ---------- mloft: Python ----------
"""Create a lofted mesh through a set of section polylines.
    Inputs:
        P: Section polylines
        C: Closed loft
        A: Align section poylines
        E: End caps (0 = none, 1 = flat)
    Output:
        L: Resulting mesh loft"""

__author__ = "p1r4t3b0y"
__email__ = "p1r4t3b0y@gmail.com"
__version__ = "1.1.0"

ghenv.Component.Name = "Pythonic Mesh Loft Plus"
ghenv.Component.NickName = "MLoft+"
ghenv.Component.Category = "Mesh"
ghenv.Component.SubCategory = "Primitive"

import Rhino.Geometry as rg
import scriptcontext as sc
import Grasshopper as gh
import math


class MeshLoft:
    """Creates a lofted mesh through a set of section polylines.
    
    Attributes:
        polylines: A list of valid, closed or open polylines.
        close_loft: Optional, if True the loft will be closed.
        cap_loft: Optional, if True the loft will be capped.
    
    To use:
        >>> ml = MeshLoft(polylines)
        >>> loft = ml.mesh
    """
    def __init__(self, polylines, close_loft=None, cap_loft=None):
        """Inits this mesh loft."""
        self.polylines = polylines
        self.close_loft = close_loft
        self.cap_loft = cap_loft
        self.vertices = self.get_vertices()
        self.faces = self.construct_faces()
        self.mesh = self.construct_mesh()
        
        
    def get_vertices(self):
        """Gets the vertices for each polyline in self.polylines.
        
        Returns:
          The new nested list of vertices per polyline."""
        pline_vertices = []
        for pline in self.polylines:
            vertices = []
            for i in range(len(pline)):
                vertices.append(pline[i])
            pline_vertices.append(vertices)
        return pline_vertices
    
    
    def index_vertices(self):
        """Indexes the vertices of each polyline with integer numbers,
            that are necessary to later assign the vertices to mesh faces.
        
        Returns:
          The nested list of vertex indices (e.g. [[0,1,2], [3,4,5], ..])."""
        vtx_indices = [] 
        for i in range(len(self.vertices)):
            indices = []
            for j in range(len(self.vertices[i])):
                indices.append(i * len(self.vertices[i]) + j)
            vtx_indices.append(indices)
        return vtx_indices
    
    
    def construct_faces(self):
        """Constructs quad faces between all adjacent polyline pairs.       
        
        Returns:
          The nested list of face tuples (e.g. [(0,1,7,6), ...])."""
        vtx_indices = self.index_vertices()
        faces = []
        for i in range(len(vtx_indices)):
            if i < len(vtx_indices) - 1: 
                # Loop the polyline vertex indices up to the last curve
                for j in range(len(vtx_indices[i])-1): # vertices
                    v1 = j + (i * len(vtx_indices[i]))
                    v2 = j + (i * len(vtx_indices[i])) + 1
                    v3 = j + ((i + 1) * len(vtx_indices[i])) + 1
                    v4 = j + ((i + 1) * len(vtx_indices[i]))
                    faces.append((v1, v2, v3, v4))
            else:
                # Loop the polyline vertex indices of the last curve
                if self.close_loft:
                    for j in range(len(vtx_indices[i])-1): # vertices
                        v1 = j + (i * len(vtx_indices[i]))
                        v2 = j + (i * len(vtx_indices[i])) + 1
                        v3 = j + 1
                        v4 = j
                        faces.append((v1, v2, v3, v4))
        return faces
    
    
    def construct_mesh(self, angle_tolerance=-1):
        """Constructs a lofted mesh from self.vertices and self.faces
            and adds caps to it, if necessary.
        
        Args:
          angle_tol: An optional angle tolerance for vertex welding.
        
        Returns:
          The new mesh loft."""
        if angle_tolerance == None or angle_tolerance <= 0:
            angle_tol = sc.doc.ModelAngleToleranceRadians
        
        mesh = rg.Mesh()

        # Add the mesh loft vertices
        for pline_vertices in self.vertices:
            for vertex in pline_vertices:
                mesh.Vertices.Add(vertex)
        # Add the mesh loft faces
        for face in self.faces:
            v0, v1, v2, v3 = face
            mesh.Faces.AddFace(v0, v1, v2, v3)
        # Add the mesh caps
        if self.cap_loft != None and self.cap_loft > 0:
            end_curves = [self.polylines[0], self.polylines[-1]]
            if self.cap_loft == 1: # flat cap
                mesh_caps = [self.construct_flat_cap(c) for c in end_curves]
            cap_fails = 0    
            for cap in mesh_caps:
                if cap != None:
                    mesh.Append(cap)
                    mesh.Weld(angle_tolerance)
                    mesh.Vertices.CombineIdentical(False, False)
                else:
                    cap_fails += 1
            if cap_fails == len(end_curves):
                err = "Both caps failed."
                ghenv.Component.AddRuntimeMessage(\
                    gh.Kernel.GH_RuntimeMessageLevel.Error, err)
            if cap_fails == len(end_curves) - 1:
                err = "One cap failed."
                ghenv.Component.AddRuntimeMessage(\
                    gh.Kernel.GH_RuntimeMessageLevel.Error, err)
        # Compute the normals and compact the mesh
        mesh.Normals.ComputeNormals()
        mesh.Compact()
        return mesh
    
    
    def construct_flat_cap(self, edge, tolerance=None):
        """Constructs a flat mesh cap for a closed, naked mesh edge.
        
        Edge polylines with a count of 4 or 5 vertices produce single,
        triangular or quad faces. A count of more than 5 edge vertices
        results in a triangulated mesh. If these edge vertices share a
        center vertex contained inside the naked edge, the face count
        equals the number of edge segments, and the faces are radially
        oriented around this center vertex. If the center vertex lies 
        outside the closed mesh edge, the triangulated mesh is produced
        from the edge polyline itself.
        
        Args:
            edge: A polyline representing a closed, naked mesh edge.
            tolerance: An optional tolerance for planar projection.
        
        Returns:
            The new mesh cap on success, or None."""
        if tolerance == None or tolerance <= 0:
            tolerance = sc.doc.ModelAbsoluteTolerance
        
        mesh_cap = rg.Mesh()
        # Test for planarity of the mesh edge polyline
        pcurve = rg.PolylineCurve(edge)
        is_planar, plane = pcurve.TryGetPlane()
        if not is_planar:
            # Construct a planar test edge from the non-planar one
            rc, plane = rg.Plane.FitPlaneToPoints(edge)
            proj_pts = [plane.ClosestPoint(pt) for pt in edge]
            pcurve = rg.PolylineCurve(proj_pts)
        # Find the center vertex of the naked mesh edge
        center_vtx = edge.CenterPoint()
        # Test for center vertex mesh edge containment
        rc = pcurve.Contains(center_vtx, plane, tolerance)
        if rc == rg.PointContainment.Outside \
            or rc == rg.PointContainment.Coincident:
            # Mesh cap corresponds to a triangulated polyline
            mesh_cap = rg.Mesh.CreateFromClosedPolyline(edge)
        if rc == rg.PointContainment.Inside:
            if edge.Count - 1 == 3:
                # Mesh cap is composed of a single tri face
                for i in range(edge.Count - 1):
                    mesh_cap.Vertices.Add(edge[i])
                mesh_cap.Faces.AddFace(0, 1, 2) 
            if edge.Count - 1 == 4:
                # Mesh cap is composed of a single quad face
                for i in range(edge.Count - 1):
                    mesh_cap.Vertices.Add(edge[i])
                mesh_cap.Faces.AddFace(0, 1, 2, 3)
            if edge.Count > 5:
                # Mesh cap is radially triangulated around the center vertex
                for i in range(edge.Count):
                    mesh_cap.Vertices.Add(edge[i])
                mesh_cap.Vertices.Add(center_vtx)
                for i in range(edge.Count - 1):
                    v0 = i
                    v1 = i + 1
                    v2 = edge.Count
                    v3 = i
                    mesh_cap.Faces.AddFace(v0, v1, v2, v3)
        if rc == rg.PointContainment.Unset:
            err = "Open polylines can't produce capped mesh lofts."
            ghenv.Component.AddRuntimeMessage(\
                gh.Kernel.GH_RuntimeMessageLevel.Warning, err)
            return
        # Compute the normals and compact the mesh
        mesh_cap.Normals.ComputeNormals()
        mesh_cap.Compact()
        return mesh_cap


###############################################################################  


def align_polylines(polylines, guide_idx=None):
    """Aligns closed polylines so that their start/end vertices fall inline.
        If the optional guide index is not defined, the polylines align to 
        the start/end vertex of the first polyline. 
    
    Args:
      polylines: A list of closed polylines.
      guide_idx: An optional guide index for the polylines to align to.
    
    Returns:
      The list of aligned polylines on success, or the unaltered polylines."""
    if any([True for p in polylines if not p.IsClosed]):
        err = "Open polylines can't be aligned."
        ghenv.Component.AddRuntimeMessage(\
            gh.Kernel.GH_RuntimeMessageLevel.Warning, err)
        return polylines
    
    if guide_idx == None or guide_idx < 0:
        guide_idx = 0
    elif guide_idx > len(polylines[0]):
        guide_idx = 0
    
    aligned_polylines = [polylines[guide_idx]]
    for i in range(1, len(polylines)):
        # Get the guide vertex of the previous polyline
        guide_vtx = polylines[i-1][guide_idx]
        # Get the closest index of a vertex of the current polyline
        closest_idx = polylines[i].ClosestIndex(guide_vtx) # -1 on error
        if closest_idx < 0:
            return
        # Get a list of indices of the current polyline
        indices = range(len(polylines[i])-1)
        # Restructure the polyline indices to align them
        align_indices = indices[closest_idx:] + indices[:closest_idx]
        align_vertices = [polylines[i][j] for j in align_indices]
        align_vertices.append(align_vertices[0])
        aligned_polylines.append(rg.Polyline(align_vertices))
        # Update the guide index
        guide_idx = closest_idx
    return aligned_polylines


###############################################################################   


if __name__ == "__main__":
    if len(P) == 0:
        err = "Input parameter P failed to collect data"
        ghenv.Component.AddRuntimeMessage(\
            gh.Kernel.GH_RuntimeMessageLevel.Warning, err)
    
    if C == None: # closed loft
        C = False
    
    if E == None or E < 0 or E > 1: # capped loft
        E = 0
    
    if E and C:
        err = "Input parameter C (%s) and E (%s) don't work together." \
            %("Closed Loft", "End Caps")
        ghenv.Component.AddRuntimeMessage(\
            gh.Kernel.GH_RuntimeMessageLevel.Warning, err)
        C = False
        E = 0
    
    if A: # align sections
        if C and any([True for pline in P if pline.IsClosed]):
            err = "Aligning sections may produce weird results" + \
                " for closed, radial mesh lofts."
            ghenv.Component.AddRuntimeMessage(\
                gh.Kernel.GH_RuntimeMessageLevel.Remark, err)
        P = align_polylines(P)
    
    if len(P) > 1 and all([pline.IsValid for pline in P]):
        # Initialise this mesh loft
        ml = MeshLoft(P, C, E)
        # Outputs
        L = ml.mesh
    else:
        err = "Input parameter P data includes one or more invalid polylines"
        ghenv.Component.AddRuntimeMessage(\
            gh.Kernel.GH_RuntimeMessageLevel.Warning, err)
# ---------- end mloft ----------
msplit = MeshSplit(Mesh=mloft, Splitters=loft_13)
item_35 = ListItem(List=msplit, Index=0, Wrap=True)
panel_108 = Panel(item_35)

# ----
panel_109 = Panel(ungroup_7)
list_item_51 = ListItem(List=ungroup_7, Index=0, Wrap=True)
end_points_4 = EndPoints(Curve=list_item_51)  # -> Start, End
move_48 = Move(Geometry=end_points_4.End, Motion=unit_z_3)  # -> Geometry, Transform
line = Line(StartPoint=end_points_4.End, EndPoint=move_48.Geometry)
mesh_join = MeshJoin(Meshes=flatten(item_35))
weave_11 = Weave(Pattern=[0, 1], Stream0=list_item_51, Stream1=line, NullGaps=False)
join_curves_2 = JoinCurves(Curves=weave_11, Preserve=False)
mloft_2 = PythonicMeshLoftPlus(P=flatten(join_curves_2), C="1", A="0", E="0")  # -> L; inputs P: list of Polyline, C: Boolean, A: Boolean, E: Int32; same code as mloft
mesh_to_polysurface = MeshToPolysurface(Mesh=mloft_2, Triangles=False, FaceMerge=False)
cap_holes = CapHoles(Brep=mesh_to_polysurface)

# ---- group: Auditorium volume (continued)
list_item_52 = ListItem(List=ungroup_7, Index=0, Wrap=True)
end_points_5 = EndPoints(Curve=list_item_52)  # -> Start, End
move_49 = Move(Geometry=end_points_5.End, Motion=unit_z_5)  # -> Geometry, Transform
line_2 = Line(StartPoint=end_points_5.End, EndPoint=move_49.Geometry)
weave_12 = Weave(Pattern=[0, 1], Stream0=list_item_52, Stream1=line_2, NullGaps=False)
join_curves_3 = JoinCurves(Curves=weave_12, Preserve=False)
loft_14 = Loft(
    Curves=flatten(join_curves_3),
    Options={Adjust=False, Closed=True, LoftEnds=0, LoftSimp=0, LoftType=0, Rebuild=10, Refit=0.01})
cap_holes_2 = CapHoles(Brep=loft_14)

# ----
end_points_6 = EndPoints(Curve=ungroup_7)  # -> Start, End
polyline_3 = PolyLine(Vertices=end_points_6.Start, Closed=False)
polyline_4 = PolyLine(Vertices=end_points_6.Start, Closed=False)
explode_22 = Explode(Curve=ungroup_7, Recursive=True)  # -> Segments, Vertices
cull_pattern = CullPattern(List=explode_22.Segments, CullPattern=[False, True])  # -> simplify(List)
split_tree_11 = SplitTree(Data=cull_pattern, Masks=flatten("{?;0}"))  # -> Positive, Negative

# ---- group: circulation grid (continued)
rep_4 = ReplaceText(Text="{0;A;0;?}", Find="A", Replace=series_27, RecursiveReplace=False)
split_42 = SplitTree(Data=ungroup_3, Masks=flatten(rep_4))  # -> Positive, Negative
trim_12 = TrimTree(Tree=split_42.Positive, Depth=0)
split_43 = SplitTree(Data=trim_12, Masks=flatten("{0;?;0;0}"))  # -> Positive, Negative
split_44 = SplitTree(Data=trim_12, Masks=flatten("{0;?;0;1}"))  # -> Positive, Negative
split_45 = SplitTree(Data=trim_12, Masks=flatten("{0;?;0;2}"))  # -> Positive, Negative
split_46 = SplitTree(Data=trim_12, Masks=flatten("{0;?;0;3}"))  # -> Positive, Negative
split_47 = SplitTree(Data=trim_12, Masks=flatten("{0;?;0;4}"))  # -> Positive, Negative
split_48 = SplitTree(Data=trim_12, Masks=flatten("{0;?;0;5}"))  # -> Positive, Negative
split_49 = SplitTree(Data=trim_12, Masks=flatten("{0;?;0;6}"))  # -> Positive, Negative
split_50 = SplitTree(Data=trim_12, Masks=flatten("{0;?;0;7}"))  # -> Positive, Negative
split_51 = TextSplit(Text=split_15.Positive, Separators=".")
flip_11 = FlipMatrix(Data=split_43.Positive)
flip_12 = FlipMatrix(Data=split_44.Positive)
flip_13 = FlipMatrix(Data=split_45.Positive)
flip_14 = FlipMatrix(Data=split_46.Positive)
flip_15 = FlipMatrix(Data=split_47.Positive)
flip_16 = FlipMatrix(Data=split_48.Positive)
flip_17 = FlipMatrix(Data=split_49.Positive)
flip_18 = FlipMatrix(Data=split_50.Positive)
item_36 = ListItem(List=split_51, Index=0, Wrap=True)
entwine_17 = Entwine(
    Branch0X=flip_11,
    Branch1X=flip_12,
    Branch2X=flip_13,
    Branch3X=flip_14,
    Branch4X=flip_15,
    Branch5X=flip_16,
    Branch6X=flip_17,
    Branch7X=flip_18,
    FlattenInputs=False)
trim_13 = TrimTree(Tree=item_36, Depth=1)
simplify = SimplifyTree(Tree=trim_13, Front=False)
trim_14 = TrimTree(Tree=simplify(entwine_17), Depth=1)
simplify_2 = SimplifyTree(Tree=split_15.Positive, Front=False)

# ---- group: Clean up unnecesary slots
list_length_12 = ListLength(List=trim_10)
list_length_13 = ListLength(List=split_15.Positive)
sort_list_2 = SortList(Keys=flatten(list_length_13))  # -> reverse(Keys), ValuesValuesA
sort_list_3 = SortList(Keys=flatten(list_length_12))  # -> reverse(Keys), ValuesValuesA
list_item_53 = ListItem(List=sort_list_2.Keys, Index=0, Wrap=True)
list_item_54 = ListItem(List=sort_list_3.Keys, Index=0, Wrap=True)
minimum = Minimum(A=list_item_54, B=list_item_53)
split_list_8 = SplitList(List=trim_10, Index=minimum)  # -> simplify(ListA), ListB
split_list_9 = SplitList(List=split_15.Positive, Index=minimum)  # -> ListA, ListB
text_split_7 = TextSplit(Text=split_list_9.ListA, Separators=".")
list_item_55 = ListItem(List=text_split_7, Index=0, Wrap=True)
trim_tree_6 = TrimTree(Tree=list_item_55, Depth=1)
replace_nulls = ReplaceNulls(Items=trim_tree_6, Replacements="10")  # -> Items, Count
panel_110 = Panel(replace_nulls.Items)

# ----
panel_111 = Panel(list_length_13)
panel_112 = Panel(split_list_8.ListA)
tstat_4 = TreeStatistics(Tree=simplify(split_list_8.ListA))  # -> Paths, Length, Count
simplify_3 = SimplifyTree(Tree=replace_nulls.Items, Front=False)
split_52 = SplitTree(Data=simplify_3, Masks=flatten(tstat_4.Paths))  # -> Positive, Negative

# ---- group: Clean up unnecesary slots (continued)
repeat_data_17 = RepeatData(Data=split_52.Positive, Length=minimum)  # -> simplify(Data)
tree_statistics_46 = TreeStatistics(Tree=repeat_data_17)  # -> Paths, Length, Count
tree_branch_8 = TreeBranch(Tree=split_list_8.ListA, Path=tree_statistics_46.Paths, MaintainPaths=True)

# ----
tree_branch_9 = TreeBranch(Tree=trim_14, Path=tree_statistics_46.Paths, MaintainPaths=True)
tree_statistics_47 = TreeStatistics(Tree=tree_branch_8)  # -> Paths, Length, Count
panel_113 = Panel(tree_statistics_47.Paths)
panel_114 = Panel(repeat_data_17)

# ---- group: circulation grid (continued)
explode_23 = Explode(Curve=tree_branch_9, Recursive=True)  # -> Segments, Vertices
tstat_5 = TreeStatistics(Tree=simplify(tree_branch_9))  # -> Paths, Length, Count
list_item_56 = ListItem(List=explode_23.Segments, Index=0, Wrap=True)  # -> Item, Item1, Item2, Item3
tstat_6 = TreeStatistics(Tree=simplify(tree_branch_9))  # -> Paths, Length, Count
split_53 = SplitTree(Data=simplify_2, Masks=flatten(tstat_5.Paths))  # -> Positive, Negative
split_54 = SplitTree(Data=simplify, Masks=flatten(tstat_6.Paths))  # -> Positive, Negative
split_55 = TextSplit(Text=split_53.Positive, Separators=".")
lng_10 = ListLength(List=tree_branch_9)
flip_curve_2 = FlipCurve(Curve=list_item_56.Item2)  # -> Curve, Flag
flip_curve_3 = FlipCurve(Curve=list_item_56.Item3)  # -> Curve, Flag
item_37 = ListItem(List=split_55, Index=expr("1", 0), Wrap=False)
trim_15 = TrimTree(Tree=item_37, Depth=1)
repeat_2 = RepeatData(Data=split_54.Positive, Length=lng_10)
evaluate_curve = EvaluateCurve(Curve=reparameterize(list_item_56.Item), Parameter=panel_44)  # -> Point, Tangent, Angle
evaluate_curve_2 = EvaluateCurve(Curve=reparameterize(flip_curve_2.Curve), Parameter=panel_44)  # -> Point, Tangent, Angle
evaluate_curve_3 = EvaluateCurve(Curve=reparameterize(list_item_56.Item1), Parameter=panel_45)  # -> Point, Tangent, Angle
evaluate_curve_4 = EvaluateCurve(Curve=reparameterize(flip_curve_3.Curve), Parameter=panel_45)  # -> Point, Tangent, Angle
repeat_3 = RepeatData(Data=trim_15, Length=lng_10)
larger_10 = LargerThan(FirstNumber=repeat_3, SecondNumber="1")  # -> LargerThan, OrEqualTo
line_3 = Line(StartPoint=evaluate_curve.Point, EndPoint=evaluate_curve_2.Point)
line_4 = Line(StartPoint=evaluate_curve_3.Point, EndPoint=evaluate_curve_4.Point)
dispatch_25 = Dispatch(List=tree_branch_9, DispatchPattern=larger_10.OrEqualTo)  # -> flatten(ListA), ListB
lng_11 = ListLength(List=flatten(tree_branch_9))
explode_24 = Explode(Curve=dispatch_25.ListA, Recursive=True)  # -> Segments, Vertices
shatter_3 = Shatter(Curve=reparameterize(line_4), Parameters=panel_44)
shatter_4 = Shatter(Curve=reparameterize(line_3), Parameters=panel_45)
nullrep = ReplaceNulls(Items=larger_10.OrEqualTo, Replacements="0")  # -> Items, Count
series_29 = Series(Start=0, Step=1, Count=lng_11)
trim_tree_7 = TrimTree(Tree=shatter_3, Depth=1)
trim_tree_8 = TrimTree(Tree=shatter_4, Depth=1)
end_26 = EndPoints(Curve=explode_24.Segments)  # -> Start, End
curvepoint = PointOnCurve(explode_24.Segments, parameter=0.5)
dispatch_26 = Dispatch(List=series_29, DispatchPattern=flatten(nullrep.Items))  # -> ListA, ListB
item_38 = ListItem(List=end_26.Start, Index=0, Wrap=True)  # -> Item, Item1, Item2, Item3
item_39 = ListItem(List=end_26.End, Index=0, Wrap=True)  # -> Item, Item1, Item2, Item3
item_40 = ListItem(List=curvepoint, Index=0, Wrap=True)  # -> Item, Item1, Item2, Item3
merge_35 = Merge(Data1=trim_tree_8, Data2=trim_tree_7)
group_28 = Group(Objects=merge_35)
panel_115 = Panel(repeat_3)
flatten_2 = FlattenTree(Tree=panel_115, Path="{0}")
clean_9 = CleanTree(RemoveNulls=True, RemoveInvalid=True, RemoveEmpty=False, Tree=flatten_2)
subtraction_9 = Subtraction(A=clean_9, B=1)
panel_116 = Panel(clean_9)
rep_5 = ReplaceText(Text=subtraction_9, Find="0", Replace="a", RecursiveReplace=False)
rep_6 = ReplaceText(Text=rep_5, Find="1", Replace="0", RecursiveReplace=False)
rep_7 = ReplaceText(Text=rep_6, Find="a", Replace="1", RecursiveReplace=False)
rep_8 = ReplaceText(Text=rep_7, Find="2", Replace="a", RecursiveReplace=False)
rep_9 = ReplaceText(Text=rep_8, Find="3", Replace="2", RecursiveReplace=False)
rep_10 = ReplaceText(Text=rep_9, Find="a", Replace="3", RecursiveReplace=False)

# ---- group: assign function (continued)
tstat_7 = TreeStatistics(Tree=simplify(tree_branch_8))  # -> Paths, Length, Count
simplify_4 = SimplifyTree(Tree=split_15.Positive, Front=False)
split_56 = SplitTree(Data=simplify_4, Masks=flatten(tstat_7.Paths))  # -> Positive, Negative
split_57 = TextSplit(Text=split_56.Positive, Separators=".")
lng_12 = ListLength(List=tree_branch_8)
item_41 = ListItem(List=split_57, Index=expr("1", 0), Wrap=False)
trim_16 = TrimTree(Tree=item_41, Depth=1)
repeat_4 = RepeatData(Data=trim_16, Length=lng_12)
larger_11 = LargerThan(FirstNumber=repeat_4, SecondNumber="1")  # -> LargerThan, OrEqualTo
dispatch_27 = Dispatch(List=tree_branch_8, DispatchPattern=larger_11.OrEqualTo)  # -> flatten(ListA), ListB
lng_13 = ListLength(List=flatten(tree_branch_8))
nullrep_2 = ReplaceNulls(Items=larger_11.OrEqualTo, Replacements="0")  # -> Items, Count
series_30 = Series(Start=0, Step=1, Count=lng_13)
medges = MeshEdges(Mesh=dispatch_27.ListA)  # -> NakedEdges, InteriorEdges, NonManifoldEdges
dispatch_28 = Dispatch(List=series_30, DispatchPattern=flatten(nullrep_2.Items))  # -> ListA, ListB
end_27 = EndPoints(Curve=medges.NakedEdges)  # -> Start, End
curvepoint_2 = PointOnCurve(medges.NakedEdges, parameter=0.5)
item_42 = ListItem(List=curvepoint_2, Index=0, Wrap=True)  # -> Item, Item1, Item2, Item3
item_43 = ListItem(List=end_27.Start, Index=0, Wrap=True)  # -> Item, Item1, Item2, Item3
item_44 = ListItem(List=end_27.End, Index=0, Wrap=True)  # -> Item, Item1, Item2, Item3
weave_13 = Weave(
    Pattern=[0, 1, 2, 3],
    Stream0=item_43.Item,
    Stream1=item_42.Item1,
    Stream2=item_42.Item2,
    Stream3=item_43.Item2,
    NullGaps=False)
weave_14 = Weave(
    Pattern=[0, 1, 2, 3],
    Stream0=item_44.Item1,
    Stream1=item_42.Item1,
    Stream2=item_42.Item2,
    Stream3=item_44.Item2,
    NullGaps=False)
weave_15 = Weave(
    Pattern=[0, 1, 2, 3],
    Stream0=item_43.Item1,
    Stream1=item_42.Item,
    Stream2=item_42.Item3,
    Stream3=item_43.Item3,
    NullGaps=False)
weave_16 = Weave(
    Pattern=[0, 1, 2, 3],
    Stream0=item_44.Item,
    Stream1=item_42.Item,
    Stream2=item_42.Item3,
    Stream3=item_44.Item3,
    NullGaps=False)
pline_14 = PolyLine(Vertices=weave_13, Closed=True)
pline_15 = PolyLine(Vertices=weave_16, Closed=True)
pline_16 = PolyLine(Vertices=weave_15, Closed=True)
pline_17 = PolyLine(Vertices=weave_14, Closed=True)
weave_17 = Weave(Pattern=[0, 1, 2, 3], Stream0=pline_14, Stream1=pline_17, Stream2=pline_16, Stream3=pline_15, NullGaps=False)
panel_117 = Panel(repeat_4)
cp_2 = ControlPoints(Curve=weave_17)  # -> Points, Weights, Knots
item_45 = ListItem(List=cp_2.Points, Index=panel_47, Wrap=True)
flatten_3 = FlattenTree(Tree=panel_117, Path="{0}")
clean_10 = CleanTree(RemoveNulls=True, RemoveInvalid=True, RemoveEmpty=False, Tree=flatten_3)
frompoints_2 = MeshFromPoints(Points=item_45, UDirection="2", VDirection="2")
subtraction_10 = Subtraction(A=clean_10, B=1)
trim_17 = TrimTree(Tree=frompoints_2, Depth=1)
item_46 = ListItem(List=trim_17, Index=graft(subtraction_10), Wrap=False)
panel_118 = Panel(clean_10)
replace_20 = ReplaceItems(List=flatten(tree_branch_8), Item=flatten(item_46), Indices=dispatch_28.ListA, Wrap=False)
panel_119 = Panel(replace_20)
rep_11 = ReplaceText(Text=subtraction_10, Find="0", Replace="a", RecursiveReplace=False)
rep_12 = ReplaceText(Text=rep_11, Find="1", Replace="0", RecursiveReplace=False)
partition = PartitionList(List=replace_20, Size=flatten(lng_12))  # -> simplify(Chunks)
rep_13 = ReplaceText(Text=rep_12, Find="a", Replace="1", RecursiveReplace=False)
rep_14 = ReplaceText(Text=rep_13, Find="2", Replace="a", RecursiveReplace=False)
rep_15 = ReplaceText(Text=rep_14, Find="3", Replace="2", RecursiveReplace=False)
rep_16 = ReplaceText(Text=rep_15, Find="a", Replace="3", RecursiveReplace=False)
item_47 = ListItem(List=weave_17, Index=graft(rep_16), Wrap=True)
cp_3 = ControlPoints(Curve=item_47)  # -> Points, Weights, Knots
item_48 = ListItem(List=cp_3.Points, Index=0, Wrap=True)  # -> Item, Item1, Item2, Item3
weave_18 = Weave(
    Pattern=[0, 1, 2, 3],
    Stream0=item_48.Item,
    Stream1=item_48.Item1,
    Stream2=item_48.Item3,
    Stream3=item_48.Item2,
    NullGaps=False)
panel_120 = Panel(item_47)
frompoints_3 = MeshFromPoints(Points=weave_18, UDirection="2", VDirection="2")

# ----
sift_3 = SiftPattern(List=partition, SiftPattern=repeat_data_17)  # -> Output0, Output1, Output2, Output3, Output4, Output5, Output6, Output7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

# ---- group: assign function (continued)
merge_36 = Merge(Data1=simplify(sift_3.Output11), Data2=simplify(frompoints_3))  # -> simplify(Result)

# ----
mcol_5 = MeshColours(Mesh=sift_3.Output4, Colours=swatch_11)
mcol_6 = MeshColours(Mesh=sift_3.Output11, Colours=swatch_4)
mcol_7 = MeshColours(Mesh=sift_3.Output0, Colours=swatch_8)
mcol_8 = MeshColours(Mesh=sift_3.Output1, Colours=swatch_7)
mcol_9 = MeshColours(Mesh=sift_3.Output2, Colours=swatch_9)
mcol_10 = MeshColours(Mesh=sift_3.Output3, Colours=swatch_10)
mcol_11 = MeshColours(Mesh=sift_3.Output5, Colours=swatch_5)
mcol_12 = MeshColours(Mesh=sift_3.Output6, Colours=swatch_12)
mcol_13 = MeshColours(Mesh=sift_3.Output7, Colours=swatch_13)
mcol_14 = MeshColours(Mesh=sift_3.Output8, Colours=swatch_14)
mcol_15 = MeshColours(Mesh=sift_3.Output9, Colours=swatch_15)
mcol_16 = MeshColours(Mesh=sift_3.Output10, Colours=ColourSwatch(SwatchColor=RGB(0, 0, 0)))
pick_n_choose = PickNChoose(
    Pattern=repeat_data_17,
    Stream0=mcol_7,
    Stream1=mcol_8,
    Stream2=mcol_9,
    Stream3=mcol_10,
    Stream4=mcol_5,
    Stream5=mcol_11,
    Stream6=mcol_12,
    Stream7=mcol_13,
    Stream8=mcol_14,
    Stream9=mcol_15,
    Stream11=mcol_6)
area_2 = Area(Geometry=mcol_6)  # -> Area, Centroid
area_3 = Area(Geometry=mcol_8)  # -> Area, Centroid
area_4 = Area(Geometry=mcol_5)  # -> Area, Centroid
area_5 = Area(Geometry=mcol_11)  # -> Area, Centroid
mesh_edges = MeshEdges(Mesh=pick_n_choose)  # -> NakedEdges, InteriorEdges, NonManifoldEdges
join_curves_4 = JoinCurves(Curves=mesh_edges.NakedEdges, Preserve=False)
replace_nulls_2 = ReplaceNulls(Items=flatten(area_2.Area), Replacements="0")  # -> Items, Count
replace_nulls_3 = ReplaceNulls(Items=flatten(area_3.Area), Replacements="0")  # -> Items, Count
replace_nulls_4 = ReplaceNulls(Items=flatten(area_4.Area), Replacements="0")  # -> Items, Count
replace_nulls_5 = ReplaceNulls(Items=flatten(area_5.Area), Replacements="0")  # -> Items, Count
trim_tree_9 = TrimTree(Tree=join_curves_4, Depth=2)
mass_addition_5 = MassAddition(Input=flatten(replace_nulls_2.Items))  # -> Result, PartialResults
mass_addition_6 = MassAddition(Input=flatten(replace_nulls_3.Items))  # -> Result, PartialResults
mass_addition_7 = MassAddition(Input=flatten(replace_nulls_4.Items))  # -> Result, PartialResults
mass_addition_8 = MassAddition(Input=flatten(replace_nulls_5.Items))  # -> Result, PartialResults
clean_tree_5 = CleanTree(RemoveNulls=True, RemoveInvalid=True, RemoveEmpty=True, Tree=trim_tree_9)
merge_37 = Merge(Data1=mass_addition_6.Result, Data2=mass_addition_7.Result, Data3=mass_addition_8.Result, Data4=mass_addition_5.Result)

# ---- group: Target function
mesh_6 = Mesh(flatten(mcol_10))

# ----
text_join_7 = TextJoin(Text=merge_37, Join=";")

# ---- group: circulation grid (continued)
line_5 = Line(StartPoint=item_40.Item2, EndPoint=item_40.Item)
line_6 = Line(StartPoint=item_39.Item1, EndPoint=item_38.Item1)
line_7 = Line(StartPoint=item_39.Item1, EndPoint=item_40.Item2)
line_8 = Line(StartPoint=item_38.Item1, EndPoint=item_40.Item)
evaluate_curve_5 = EvaluateCurve(Curve=reparameterize(line_7), Parameter=panel_55)  # -> Point, Tangent, Angle
evaluate_curve_6 = EvaluateCurve(Curve=reparameterize(line_8), Parameter=panel_55)  # -> Point, Tangent, Angle
evaluate_curve_7 = EvaluateCurve(Curve=reparameterize(line_5), Parameter=panel_54)  # -> Point, Tangent, Angle
evaluate_curve_8 = EvaluateCurve(Curve=reparameterize(line_6), Parameter=panel_54)  # -> Point, Tangent, Angle
line_9 = Line(StartPoint=evaluate_curve_5.Point, EndPoint=evaluate_curve_6.Point)
line_10 = Line(StartPoint=evaluate_curve_7.Point, EndPoint=evaluate_curve_8.Point)

line_11 = Line(StartPoint=item_38.Item1, EndPoint=item_40.Item1)
line_12 = Line(StartPoint=item_40.Item1, EndPoint=item_40.Item3)
line_13 = Line(StartPoint=item_38.Item1, EndPoint=item_38.Item)
line_14 = Line(StartPoint=item_38.Item, EndPoint=item_40.Item3)
evaluate_curve_9 = EvaluateCurve(Curve=reparameterize(line_11), Parameter=panel_49)  # -> Point, Tangent, Angle
evaluate_curve_10 = EvaluateCurve(Curve=reparameterize(line_14), Parameter=panel_49)  # -> Point, Tangent, Angle
evaluate_curve_11 = EvaluateCurve(Curve=reparameterize(line_12), Parameter=panel_48)  # -> Point, Tangent, Angle
evaluate_curve_12 = EvaluateCurve(Curve=reparameterize(line_13), Parameter=panel_48)  # -> Point, Tangent, Angle
line_15 = Line(StartPoint=evaluate_curve_9.Point, EndPoint=evaluate_curve_10.Point)
line_16 = Line(StartPoint=evaluate_curve_11.Point, EndPoint=evaluate_curve_12.Point)

line_17 = Line(StartPoint=item_40.Item1, EndPoint=item_39.Item1)
line_18 = Line(StartPoint=item_39.Item1, EndPoint=item_39.Item2)
line_19 = Line(StartPoint=item_40.Item3, EndPoint=item_39.Item2)
line_20 = Line(StartPoint=item_40.Item1, EndPoint=item_40.Item3)
evaluate_curve_13 = EvaluateCurve(Curve=reparameterize(line_17), Parameter=panel_51)  # -> Point, Tangent, Angle
evaluate_curve_14 = EvaluateCurve(Curve=reparameterize(line_19), Parameter=panel_51)  # -> Point, Tangent, Angle
evaluate_curve_15 = EvaluateCurve(Curve=reparameterize(line_18), Parameter=panel_50)  # -> Point, Tangent, Angle
evaluate_curve_16 = EvaluateCurve(Curve=reparameterize(line_20), Parameter=panel_50)  # -> Point, Tangent, Angle
line_21 = Line(StartPoint=evaluate_curve_15.Point, EndPoint=evaluate_curve_16.Point)
line_22 = Line(StartPoint=evaluate_curve_13.Point, EndPoint=evaluate_curve_14.Point)

line_23 = Line(StartPoint=item_40.Item2, EndPoint=item_39.Item2)
line_24 = Line(StartPoint=item_40.Item2, EndPoint=item_40.Item)
line_25 = Line(StartPoint=item_39.Item2, EndPoint=item_38.Item)
line_26 = Line(StartPoint=item_40.Item, EndPoint=item_38.Item)
evaluate_curve_17 = EvaluateCurve(Curve=reparameterize(line_23), Parameter=panel_53)  # -> Point, Tangent, Angle
evaluate_curve_18 = EvaluateCurve(Curve=reparameterize(line_26), Parameter=panel_53)  # -> Point, Tangent, Angle
evaluate_curve_19 = EvaluateCurve(Curve=reparameterize(line_25), Parameter=panel_52)  # -> Point, Tangent, Angle
evaluate_curve_20 = EvaluateCurve(Curve=reparameterize(line_24), Parameter=panel_52)  # -> Point, Tangent, Angle
line_27 = Line(StartPoint=evaluate_curve_17.Point, EndPoint=evaluate_curve_18.Point)
line_28 = Line(StartPoint=evaluate_curve_19.Point, EndPoint=evaluate_curve_20.Point)

shatter_5 = Shatter(Curve=reparameterize(line_16), Parameters=panel_49)
shatter_6 = Shatter(Curve=reparameterize(line_15), Parameters=panel_48)
shatter_7 = Shatter(Curve=reparameterize(line_28), Parameters=panel_53)
shatter_8 = Shatter(Curve=reparameterize(line_21), Parameters=panel_51)
shatter_9 = Shatter(Curve=reparameterize(line_27), Parameters=panel_52)
shatter_10 = Shatter(Curve=reparameterize(line_22), Parameters=panel_50)
shatter_11 = Shatter(Curve=reparameterize(line_10), Parameters=panel_55)
shatter_12 = Shatter(Curve=reparameterize(line_9), Parameters=panel_54)
trim_tree_10 = TrimTree(Tree=shatter_5, Depth=1)
trim_tree_11 = TrimTree(Tree=shatter_6, Depth=1)
trim_tree_12 = TrimTree(Tree=shatter_7, Depth=1)
trim_tree_13 = TrimTree(Tree=shatter_8, Depth=1)
trim_tree_14 = TrimTree(Tree=shatter_9, Depth=1)
trim_tree_15 = TrimTree(Tree=shatter_10, Depth=1)
trim_tree_16 = TrimTree(Tree=shatter_11, Depth=1)
trim_tree_17 = TrimTree(Tree=shatter_12, Depth=1)

merge_38 = Merge(Data1=trim_tree_11, Data2=trim_tree_10)
group_29 = Group(Objects=merge_38)

merge_39 = Merge(Data1=trim_tree_15, Data2=trim_tree_13)
group_30 = Group(Objects=merge_39)

merge_40 = Merge(Data1=trim_tree_14, Data2=trim_tree_12)
group_31 = Group(Objects=merge_40)

merge_41 = Merge(Data1=trim_tree_17, Data2=trim_tree_16)
group_32 = Group(Objects=merge_41)

weave_19 = Weave(Pattern=[0, 1, 2, 3], Stream0=group_29, Stream1=group_30, Stream2=group_31, Stream3=group_32, NullGaps=False)
item_49 = ListItem(List=weave_19, Index=graft(subtraction_9), Wrap=False)
replace_21 = ReplaceItems(List=flatten(group_28), Item=flatten(item_49), Indices=dispatch_26.ListA, Wrap=False)
partition_2 = PartitionList(List=replace_21, Size=flatten(lng_10))
sift_4 = SiftPattern(List=partition_2, SiftPattern=repeat_2)  # -> Output0, Output1, Output2, Output3, Output4, Output5, Output6, Output7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
item_50 = ListItem(List=weave_19, Index=graft(rep_10), Wrap=True)
merge_42 = Merge(Data1=simplify(sift_4.Output11), Data2=simplify(item_50), Data3=simplify(sift_4.Output1))  # -> simplify(Result)
panel_121 = Panel(item_50)
ungroup_8 = Ungroup(Group=merge_42)

# ----
ungroup_9 = Ungroup(Group=sift_4.Output1)
list_item_57 = ListItem(List=ungroup_9, Index=5, Wrap=True)
end_points_7 = EndPoints(Curve=list_item_57)  # -> Start, End
trim_tree_18 = TrimTree(Tree=end_points_7.End, Depth=1)
flip_matrix = FlipMatrix(Data=trim_tree_18)
polyline_5 = PolyLine(Vertices=flip_matrix, Closed=False)
explode_25 = Explode(Curve=polyline_5, Recursive=True)  # -> flatten(Segments), Vertices

# ---- group: floor heights
floor_heights = Number(bang_3.Branch0)
top_of_bowl = Number(deconstruct_2.ZComponent)
insert_items_5 = InsertItems(List=reverse(floor_heights), Item=top_of_bowl, Indices="0", Wrap=True)  # -> reverse(List)
shift_list = ShiftList(List=insert_items_5, Shift=1, Wrap=True)
subtraction_11 = Subtraction(A=shift_list, B=insert_items_5)

# ----
insert_items_6 = InsertItems(List=floor_heights, Item="0", Indices="0", Wrap=True)

# ---- group: floor heights (continued)
list_length_14 = ListLength(List=insert_items_6)
split_list_10 = SplitList(List=subtraction_11, Index=list_length_14)  # -> ListA, ListB

# ----
subtraction_12 = Subtraction(A=split_list_10.ListA, B=Slider(1.2, range=0..10))

# ---- group: gangways (continued)
dom = ConstructDomain(DomainStart=bang_18.Branch0, DomainEnd=bang_18.Branch1)
item_51 = ListItem(List=item_33, Index=dispatch_19.ListB, Wrap=True)
subtraction_13 = Subtraction(A=bang_18.Branch1, B=bang_18.Branch0)
ungroup_10 = Ungroup(Group=item_51)
range_2 = Range(Domain=dom, Steps=subtraction_13)
item_52 = ListItem(List=ungroup_10, Index=range_2, Wrap=False)
len_3 = Length(Curve=item_52)
larger_12 = LargerThan(FirstNumber=len_3, SecondNumber=Slider(2.8, range=0..10))  # -> LargerThan, OrEqualTo
dispatch_29 = Dispatch(List=item_52, DispatchPattern=larger_12.LargerThan)  # -> ListA, ListB
divlength_2 = DivideLength(Curve=dispatch_29.ListA, Length=number_slider_10)  # -> Points, Tangents, Parameters
shatter_13 = Shatter(Curve=graft(dispatch_29.ListA), Parameters=divlength_2.Parameters)
replace_22 = ReplaceItems(List=shatter_13, Indices=bang_18.Branch2, Wrap=False)
group_33 = Group(Objects=replace_22)
trim_18 = TrimTree(Tree=group_33, Depth="3")
merge_43 = Merge(Data1=dispatch_29.ListB, Data2=trim_18)
group_34 = Group(Objects=merge_43)  # -> flatten(Group)
replace_23 = ReplaceItems(List=item_33, Item=group_34, Indices=dispatch_19.ListB, Wrap=False)

# ---- group: switched off because it was messing top line
lng_14 = ListLength(List=ungroup_10)  # disabled
larger_13 = LargerThan(FirstNumber=range_2, SecondNumber=lng_14)  # -> LargerThan, OrEqualTo; disabled
dispatch_30 = Dispatch(List=merge_43, DispatchPattern=larger_13.OrEqualTo)  # -> ListA, ListB; disabled
dispatch_31 = Dispatch(List=range_2, DispatchPattern=larger_13.OrEqualTo)  # -> ListA, ListB; disabled
panel_122 = Panel(dispatch_30.ListA)  # disabled

# ---- group: gangways (continued)
replace_24 = ReplaceItems(List=ungroup_10, Item=dispatch_30.ListB, Indices=dispatch_31.ListB, Wrap=False)

subtraction_14 = Subtraction(A=addition_9, B=bang_18.Branch4)
dom_2 = ConstructDomain(DomainStart=bang_18.Branch4, DomainEnd=addition_9)
item_53 = ListItem(List=replace_23, Index=dispatch_20.ListB, Wrap=True)
range_3 = Range(Domain=dom_2, Steps=subtraction_14)
ungroup_11 = Ungroup(Group=item_53)
lng_15 = ListLength(List=ungroup_11)
larger_14 = LargerThan(FirstNumber=range_3, SecondNumber=expr("x-1", lng_15))  # -> LargerThan, OrEqualTo
dispatch_32 = Dispatch(List=range_3, DispatchPattern=larger_14.LargerThan)  # -> ListA, ListB
item_54 = ListItem(List=ungroup_11, Index=dispatch_32.ListB, Wrap=False)
len_4 = Length(Curve=item_54)
larger_15 = LargerThan(FirstNumber=len_4, SecondNumber=Slider(2.8, range=0..10))  # -> LargerThan, OrEqualTo
dispatch_33 = Dispatch(List=item_54, DispatchPattern=larger_15.LargerThan)  # -> ListA, ListB
divlength_3 = DivideLength(Curve=dispatch_33.ListA, Length=Slider(1.2, range=0..10))  # -> Points, Tangents, Parameters
shatter_14 = Shatter(Curve=graft(dispatch_33.ListA), Parameters=divlength_3.Parameters)
replace_25 = ReplaceItems(List=shatter_14, Indices=bang_18.Branch6, Wrap=False)
group_35 = Group(Objects=replace_25)
trim_19 = TrimTree(Tree=group_35, Depth="3")
merge_44 = Merge(Data1=dispatch_33.ListB, Data2=trim_19)
replace_26 = ReplaceItems(List=ungroup_11, Item=merge_44, Indices=dispatch_32.ListB, Wrap=False)
group_36 = Group(Objects=replace_26)  # -> flatten(Group)
replace_27 = ReplaceItems(List=replace_23, Item=group_36, Indices=dispatch_20.ListB, Wrap=False)

# ---- group: bowl exit points / low gangway
item_55 = ListItem(List=replace_22, Index=expr("X+1", bang_18.Branch2), Wrap=True)
trim_20 = TrimTree(Tree=item_55, Depth=Slider(3, range=0..10))
end_28 = EndPoints(Curve=trim_20)  # -> Start, End
pline_18 = PolyLine(Vertices=end_28.Start, Closed=False)
end_29 = EndPoints(Curve=pline_18)  # -> Start, End

# ---- group: bowl exit points
list_item_58 = ListItem(List=reverse(end_28.End), Index=1, Wrap=True)

# ----
relay = Relay([curve_7, curve_6, pline_18])

# ---- group: Closest line to bowl for circulation grid (continued)
mesh_edges_2 = MeshEdges(Mesh=mcol_6)  # -> NakedEdges, InteriorEdges, NonManifoldEdges
mesh_join_2 = MeshJoin(Meshes=item_35)
point_on_curve_7 = PointOnCurve(mesh_edges_2.NakedEdges, parameter=0.5)
pull_point = PullPoint(Point=point_on_curve_7, Geometry=flatten(mesh_join_2), ClosestOnly=True)  # -> ClosestPoint, Distance

# ----
sort_list_4 = SortList(Keys=flatten(pull_point.Distance))  # -> Keys, ValuesValuesA
list_item_59 = ListItem(List=sort_list_4.Keys, Index=0, Wrap=True)
addition_12 = Addition(A=list_item_59, B=Slider(3, range=0..10))

# ---- group: Closest line to bowl for circulation grid (continued)
larger_than_6 = LargerThan(FirstNumber=pull_point.Distance, SecondNumber=addition_12)  # -> LargerThan, OrEqualTo
dispatch_34 = Dispatch(List=mesh_edges_2.NakedEdges, DispatchPattern=larger_than_6.LargerThan)  # -> ListA, ListB

# ----
end_points_8 = EndPoints(Curve=flatten(dispatch_34.ListB))  # -> Start, End
deconstruct_5 = Deconstruct(Point=end_points_8.End)  # -> XComponent, YComponent, ZComponent
sort_list_5 = SortList(Keys=deconstruct_5.ZComponent)  # -> Keys, ValuesValuesA
list_item_60 = ListItem(List=reverse(sort_list_5.Keys), Index=0, Wrap=True)

# ---- group: Tareget filter
area_6 = Area(Geometry=mesh_6)  # -> Area, Centroid
delete_consecutive = DeleteConsecutive(Set=sort_list_5.Keys, Wrap=False)  # -> Set, Count
deconstruct_6 = Deconstruct(Point=area_6.Centroid)  # -> XComponent, YComponent, ZComponent
list_item_61 = ListItem(List=delete_consecutive.Set, Index=0, Wrap=True)  # -> Item, Item1
similarity_2 = Similarity(FirstNumber=deconstruct_6.ZComponent, SecondNumber=list_item_61.Item, Threshold=0.1)  # -> Similarity, AbsoluteDifference
similarity_3 = Similarity(FirstNumber=deconstruct_6.ZComponent, SecondNumber=list_item_61.Item1, Threshold=0.1)  # -> Similarity, AbsoluteDifference
dispatch_35 = Dispatch(List=mesh_6, DispatchPattern=similarity_3.Similarity)  # -> ListA, ListB
dispatch_36 = Dispatch(List=mesh_6, DispatchPattern=similarity_2.Similarity)  # -> ListA, ListB

# ----
mesh_7 = Mesh(flatten([dispatch_36.ListA, dispatch_35.ListA]))

# ---- group: programme volumes
curve_8 = Curve(clean_tree_5)
tree_statistics_48 = TreeStatistics(Tree=curve_8)  # -> Paths, Length, Count

# ---- group: bowl exit points
list_item_62 = ListItem(List=bang_4.Branch0, Index=0, Wrap=True)  # -> Item, Item1
addition_13 = Addition(A=list_item_62.Item, B=list_item_62.Item1)
list_item_63 = ListItem(List=end_28.Start, Index=expr("x-1", list_item_62.Item), Wrap=True)
list_item_64 = ListItem(List=end_28.Start, Index=expr("x-1", addition_13), Wrap=True)

# ---- group: Vomitories
series_31 = Series(Start=bang_10.Branch0, Step=1, Count=bang_10.Branch1)
item_56 = ListItem(List=replace_27, Index=dispatch_21.ListB, Wrap=True)
ungroup_12 = Ungroup(Group=item_56)

# ----
lng_16 = ListLength(List=ungroup_12)
larger_16 = LargerThan(FirstNumber=series_31, SecondNumber=lng_16)  # -> LargerThan, OrEqualTo
dispatch_37 = Dispatch(List=series_31, DispatchPattern=larger_16.OrEqualTo)  # -> ListA, ListB

# ---- group: Vomitories (continued)
item_57 = ListItem(List=ungroup_12, Index=dispatch_37.ListB, Wrap=False)
ungroup_13 = Ungroup(Group=item_57)
split_58 = SplitList(List=ungroup_13, Index=Slider(3, range=0..10))  # -> ListA, ListB
group_37 = Group(Objects=split_58.ListB)
trim_21 = TrimTree(Tree=group_37, Depth=Slider(2, range=0..10))
replace_28 = ReplaceItems(List=ungroup_12, Item=trim_21, Indices=dispatch_37.ListB, Wrap=False)
group_38 = Group(Objects=replace_28)
replace_29 = ReplaceItems(List=replace_27, Item=flatten(group_38), Indices=dispatch_21.ListB, Wrap=False)

# ----
panel_123 = Panel(item_57)
clean_tree_6 = CleanTree(RemoveNulls=True, RemoveInvalid=True, RemoveEmpty=True, Tree=item_57)
item_58 = ListItem(List=clean_tree_6, Index="0", Wrap=False)

# ---- group: Vomitories 2
series_32 = Series(Start=bang_10.Branch5, Step=1, Count=bang_10.Branch1)
item_59 = ListItem(List=replace_29, Index=dispatch_21.ListB, Wrap=True)
ungroup_14 = Ungroup(Group=item_59)
lng_17 = ListLength(List=ungroup_14)
larger_17 = LargerThan(FirstNumber=series_32, SecondNumber=lng_17)  # -> LargerThan, OrEqualTo
dispatch_38 = Dispatch(List=series_32, DispatchPattern=larger_17.OrEqualTo)  # -> ListA, ListB
item_60 = ListItem(List=ungroup_14, Index=dispatch_38.ListB, Wrap=False)
ungroup_15 = Ungroup(Group=item_60)
split_59 = SplitList(List=ungroup_15, Index=Slider(3, range=0..10))  # -> ListA, ListB
group_39 = Group(Objects=split_59.ListB)
trim_22 = TrimTree(Tree=group_39, Depth=Slider(2, range=0..10))
replace_30 = ReplaceItems(List=ungroup_14, Item=trim_22, Indices=dispatch_38.ListB, Wrap=False)
group_40 = Group(Objects=replace_30)
replace_31 = ReplaceItems(List=replace_29, Item=flatten(group_40), Indices=dispatch_21.ListB, Wrap=False)

# ----
ungroup_16 = Ungroup(Group=item_58)
panel_124 = Panel(item_58)
item_61 = ListItem(List=item_60, Index="0", Wrap=False)
item_62 = ListItem(List=ungroup_16, Index=0, Wrap=True)
end_30 = EndPoints(Curve=item_62)  # -> Start, End
panel_125 = Panel(item_61)
ungroup_17 = Ungroup(Group=item_61)
item_63 = ListItem(List=ungroup_17, Index=0, Wrap=True)
end_31 = EndPoints(Curve=item_63)  # -> Start, End

# ---- group: Vomitories n gangway
point_4 = Point(flatten([end_31.End, end_30.End]))
pull_point_2 = PullPoint(Point=flatten(point_4), Geometry=graft(curve_7), ClosestOnly=True)  # -> ClosestPoint, Distance
sort_list_6 = SortList(Keys=pull_point_2.Distance, ValuesValuesA=point_4)  # -> Keys, ValuesValuesA
list_item_65 = ListItem(List=sort_list_6.Keys, Index=0, Wrap=True)
larger_than_7 = LargerThan(FirstNumber=list_item_65, SecondNumber=Slider(6.55, range=0..10))  # -> LargerThan, OrEqualTo
dispatch_39 = Dispatch(List=flatten(curve_7), DispatchPattern=flatten(larger_than_7.LargerThan))  # -> ListA, ListB

# ----
end_points_9 = EndPoints(Curve=dispatch_39.ListA)  # -> Start, End
deconstruct_7 = Deconstruct(Point=end_points_9.End)  # -> XComponent, YComponent, ZComponent
sort_list_7 = SortList(Keys=deconstruct_7.ZComponent)  # -> Keys, ValuesValuesA
list_item_66 = ListItem(List=reverse(sort_list_7.Keys), Index=0, Wrap=True)
subtraction_15 = Subtraction(A=list_item_66, B=Slider(4, range=0..10))
larger_than_8 = LargerThan(FirstNumber=deconstruct_7.ZComponent, SecondNumber=subtraction_15)  # -> LargerThan, OrEqualTo
dispatch_40 = Dispatch(List=end_points_9.End, DispatchPattern=larger_than_8.LargerThan)  # -> ListA, ListB
point_5 = Point([end_30.End, end_31.End])

# ---- group: seating tunnels
item_64 = ListItem(List=replace_31, Index=dispatch_24.ListB, Wrap=True)
ungroup_18 = Ungroup(Group=item_64)
split_60 = SplitList(List=ungroup_18, Index=bang_2.Branch0)  # -> ListA, ListB
group_41 = Group(Objects=split_60.ListB)  # -> flatten(Group)
replace_32 = ReplaceItems(List=replace_31, Item=group_41, Indices=dispatch_24.ListB, Wrap=False)

# ----
ungroup_19 = Ungroup(Group=replace_32)
ungroup_20 = Ungroup(Group=ungroup_19)
join_12 = JoinCurves(Curves=ungroup_20, Preserve=False)
len_5 = Length(Curve=join_12)
item_65 = ListItem(List=join_12, Index=0, Wrap=True)
trim_23 = TrimTree(Tree=item_65, Depth=1)
division_22 = Division(A=len_5, B=Slider(0.6, range=0..1))
divide_3 = DivideCurve(Curve=join_12, Count=division_22, Kinks=False)  # -> Points, Tangents, Parameters
end_32 = EndPoints(Curve=trim_23)  # -> Start, End

# ---- group: seats
split_61 = SplitList(List=divide_3.Points, Index=1)  # -> ListA, ListB

# ----
pdecon_11 = Deconstruct(Point=end_32.Start)  # -> XComponent, YComponent, ZComponent
list_length_15 = ListLength(List=flatten(split_61.ListB))
trim_tree_19 = TrimTree(Tree=split_61.ListB, Depth=3)
trim_24 = TrimTree(Tree=pdecon_11.ZComponent, Depth=1)
tree_statistics_49 = TreeStatistics(Tree=trim_tree_19)  # -> Paths, Length, Count
panel_126 = Panel(list_length_15)
list_item_67 = ListItem(List=trim_tree_19, Index=Slider(2, range=0..10), Wrap=True)
trim_25 = TrimTree(Tree=split_61.ListB, Depth=expr("2", 1))
lng_18 = ListLength(List=trim_25)
ins = InsertItems(List=trim_24, Item="0", Indices="0", Wrap=True)
pull_point_3 = PullPoint(Point=trim_25, Geometry=flatten(relay), ClosestOnly=True)  # -> ClosestPoint, Distance
split_62 = SplitList(List=reverse(ins), Index=1)  # -> ListA, reverse(ListB)
repeat_5 = RepeatData(Data=graft(split_62.ListB), Length=lng_18)

# ---- group: c value
crv_9 = Curve(item_6)
pull_3 = PullPoint(Point=trim_25, Geometry=crv_9, ClosestOnly=True)  # -> ClosestPoint, Distance
pdecon_12 = Deconstruct(Point=trim_25)  # -> XComponent, YComponent, ZComponent
pt_12 = ConstructPoint(XCoordinate=pdecon_12.XComponent, YCoordinate=pdecon_12.YComponent, ZCoordinate=0)
vec2pt = Vector2Pt(PointA=pull_3.ClosestPoint, PointB=pt_12, Unitize=False)  # -> Vector, Length
dist_2 = Distance(PointA=pt_12, PointB=pull_3.ClosestPoint)  # -> expr("x-0.8", Distance)
vec2pt_2 = Vector2Pt(PointA=pull_3.ClosestPoint, PointB=trim_25, Unitize=False)  # -> Vector, Length
angle = Angle(VectorA=vec2pt.Vector, VectorB=vec2pt_2.Vector)  # -> Angle, Reflex
tan = Tangent(Value=angle.Angle)
multiplication_5 = Multiplication(A=dist_2, B=tan)
subtraction_16 = Subtraction(A=multiplication_5, B=repeat_5)

# ----
amp = Amplitude(Vector=trim_25, Amplitude=".2")
move_50 = Move(Geometry=trim_25, Motion=amp)  # -> Geometry, Transform
ln_21 = Line(StartPoint=trim_25, EndPoint=move_50.Geometry)
panel_127 = Panel(ln_21)
sort_2 = SortList(Keys=flatten(subtraction_16))  # -> Keys, ValuesA
lng_19 = ListLength(List=sort_2.Keys)

# ---- group: Labelling
lng_20 = ListLength(List=sort_2.Keys)
multiplication_6 = Multiplication(A=lng_20, B="0.15")
split_63 = SplitList(List=sort_2.Keys, Index=multiplication_6)  # -> ListA, ListB
split_64 = SplitList(List=reverse(split_63.ListB), Index=multiplication_6)  # -> ListA, ListB
bnd = Bounds(Numbers=flatten(split_64.ListB))
range_4 = Range(Domain=bnd, Steps=Slider(5, range=0..10))
roundn = RoundToNearest(NumbersX=subtraction_16, NumbersY=range_4, RemapX=False)  # -> Nearest, Index, Difference, RemappedX
dedomain = DeconstructDomain(Domain=bnd)  # -> Start, End; disabled
gradient = Gradient(
    LowerLimit=dedomain.Start,
    UpperLimit=dedomain.End,
    Parameter=roundn.Nearest,
    stops=[0: RGB(128, 0, 128), 0.361: RGB(255, 255, 0), 1: RGB(255, 0, 0)])
previewlw = CustomPreviewLineweights(Geometry=simplify(ln_21), Shader=simplify(gradient), Thickness="8", Absolute=False)

# ----
multiplication_7 = Multiplication(A=lng_19, B=".8")
multiplication_8 = Multiplication(A=lng_19, B=".2")
lng_21 = ListLength(List=flatten(move_50.Geometry))
item_66 = ListItem(List=sort_2.Keys, Index=multiplication_8, Wrap=True)
item_67 = ListItem(List=sort_2.Keys, Index=multiplication_7, Wrap=True)
ma_5 = MassAddition(Input=flatten(subtraction_16))  # -> Result, PartialResults
gradient_2 = Gradient(
    LowerLimit=item_66,
    UpperLimit=item_67,
    Parameter=subtraction_16,
    stops=[0: RGB(128, 0, 128), 0.361: RGB(255, 255, 0), 1: RGB(255, 0, 0)])
panel_128 = Panel(lng_21)
lng_22 = ListLength(List=flatten(ln_21))
division_23 = Division(A=ma_5.Result, B=lng_22)
sort_list_8 = SortList(Keys=flatten(pull_point_3.Distance))  # -> Keys, ValuesValuesA

# ---- group: seats to gangway
larger_than_9 = LargerThan(FirstNumber=flatten(pull_point_3.Distance), SecondNumber="7")  # -> LargerThan, OrEqualTo
dispatch_41 = Dispatch(List=flatten(pull_point_3.Distance), DispatchPattern=larger_than_9.LargerThan)  # -> ListA, ListB
list_length_16 = ListLength(List=larger_than_9.LargerThan)
list_length_17 = ListLength(List=dispatch_41.ListB)
division_24 = Division(A=list_length_17, B=list_length_16)
data_recorder = DataRecorder(division_24, DataLimit=-10, RecordData=True)

# ---- group: top sightline seats
sort_list_9 = SortList(Keys=flatten(roundn.Nearest))  # -> Keys, ValuesValuesA
create_set = CreateSet(List=flatten(sort_list_9.Keys))  # -> Set, Map
member_index = MemberIndex(Set=flatten(sort_list_9.Keys), Member=create_set.Set)  # -> Index, Count
list_item_68 = ListItem(List=member_index.Count, Index=0, Wrap=True)
division_25 = Division(A=list_item_68)

# ----
panel_129 = Panel(data_recorder)

# ---- group: stadium exits
tree_branch_10 = TreeBranch(Tree=trim_14, Path="{0;0}", MaintainPaths=True)
explode_26 = Explode(Curve=tree_branch_10, Recursive=True)  # -> Segments, Vertices
list_item_69 = ListItem(List=explode_26.Segments, Index="2", Wrap=True)
point_on_curve_8 = PointOnCurve(list_item_69, parameter=0.5)

# ---- group: bowl exit points (continued)
point_6 = Point(flatten([point_5, list_item_63]))
point_7 = Point(flatten([point_5, list_item_63, list_item_64]))

# ----
weave_20 = Weave(Pattern=[0, 1], Stream0=graft(split_tree_11.Positive), Stream1=graft(split_tree_11.Negative), NullGaps=False)
loft_15 = Loft(Curves=weave_20, Options={Adjust=False, Closed=False, LoftEnds=0, LoftSimp=0, LoftType=0, Rebuild=10, Refit=0.01})
area_7 = Area(Geometry=loft_15)  # -> flatten(Area), Centroid
round_8 = Round(Number=area_7.Area)  # -> Nearest, Floor, Ceiling
bounds = Bounds(Numbers=area_7.Area)
sort_list_10 = SortList(Keys=round_8.Nearest)  # -> Keys, ValuesValuesA
deconstruct_domain = DeconstructDomain(Domain=bounds)  # -> Start, End
create_set_2 = CreateSet(List=sort_list_10.Keys)  # -> Set, Map
gradient_3 = Gradient(
    LowerLimit=deconstruct_domain.Start,
    UpperLimit=deconstruct_domain.End,
    Parameter=round_8.Nearest,
    stops=[0: RGB(243, 57, 0), 0.1: RGB(236, 27, 60), 0.2: RGB(210, 0, 118), 0.3: RGB(103, 0, 120), 0.4: RGB(39, 72, 161), 0.5: RGB(1, 192, 229), 0.6: RGB(18, 178, 90), 0.7: RGB(79, 186, 8), 0.8: RGB(220, 237, 32), 0.9: RGB(247, 159, 20), 1: RGB(243, 57, 0)])
member_index_2 = MemberIndex(Set=sort_list_10.Keys, Member=create_set_2.Set)  # -> Index, Count
list_length_18 = ListLength(List=member_index_2.Count)

list_length_19 = ListLength(List=area_7.Area)
rotate = Rotate(Geometry=curve_2, Angle=degrees(list_item_83), Plane=xy_plane)  # -> Geometry, Transform
curve_9 = Curve(rotate.Geometry)

# ---- group: largest outline that fits site (continued)
curve_curve = CurveCurve(CurveA=scale_2.Geometry, CurveB=curve_9)  # -> Points, ParamsA, ParamsB
list_length_20 = ListLength(List=curve_curve.Points)
equality_4 = Equality(FirstNumber=list_length_20, SecondNumber="0")  # -> flatten(Equality), Inequality
dispatch_42 = Dispatch(List=scale_2.Geometry, DispatchPattern=equality_4.Equality)  # -> ListA, ListB
list_item_70 = ListItem(List=reverse(dispatch_42.ListA), Index=Slider(1, range=0..10), Wrap=True)

# ----
explode_27 = Explode(Curve=list_item_70, Recursive=True)  # -> Segments, Vertices
list_item_71 = ListItem(List=explode_27.Segments, Index=text_split, Wrap=True)
point_on_curve_9 = PointOnCurve(list_item_71, parameter=0.5)
vector_2pt = Vector2Pt(PointA=pt_2, PointB=point_on_curve_9, Unitize=False)  # -> Vector, Length
list_length_21 = ListLength(List=point_on_curve_9)
amplitude = Amplitude(Vector=vector_2pt.Vector, Amplitude=Slider(4017, range=0..10000))
project_point = ProjectPoint(Point=point_on_curve_9, Direction=amplitude, Geometry=curve_9)  # -> Point, Index
distance_2 = Distance(PointA=pt_2, PointB=project_point.Point)
distance_3 = Distance(PointA=point_on_curve_9, PointB=project_point.Point)
subtraction_17 = Subtraction(A=distance_2, B="140")
larger_than_10 = LargerThan(FirstNumber=distance_2, SecondNumber="140")  # -> LargerThan, OrEqualTo
series_33 = Series(Start=0, Step=1, Count=list_length_21)
replace_nulls_6 = ReplaceNulls(Items=distance_3, Replacements="0")  # -> Items, Count
offset_curve = OffsetCurve(Curve=curve_9, Distance="-10", Corners=1)
dispatch_43 = Dispatch(List=series_33, DispatchPattern=larger_than_10.LargerThan)  # -> ListA, ListB
dispatch_44 = Dispatch(List=subtraction_17, DispatchPattern=larger_than_10.LargerThan)  # -> ListA, ListB
dispatch_45 = Dispatch(List=replace_nulls_6.Items, DispatchPattern=larger_than_10.LargerThan)  # -> ListA, ListB
list_item_72 = ListItem(List=explode_27.Segments, Index=panel_22, Wrap=True)
subtraction_18 = Subtraction(A=dispatch_45.ListA, B=dispatch_44.ListA)
point_on_curve_10 = PointOnCurve(list_item_72, parameter=0.5)
replace_items_3 = ReplaceItems(List=replace_nulls_6.Items, Item=subtraction_18, Indices=dispatch_43.ListA, Wrap=False)
multiplication_9 = Multiplication(A=replace_items_3, B=Slider(0.79, range=0..1))
join_curves_5 = JoinCurves(Curves=explode_27.Segments, Preserve=False)
shift_list_2 = ShiftList(List=point_on_curve_10, Shift=1, Wrap=True)
end_points_10 = EndPoints(Curve=list_item_72)  # -> Start, End

# ---- group: ellipse (continued)
end_33 = EndPoints(Curve=list_item_71)  # -> Start, End
amp_2 = Amplitude(Vector=vector_2pt.Vector, Amplitude=multiplication_9)
move_51 = Move(Geometry=point_on_curve_9, Motion=amp_2)  # -> Geometry, Transform
arc = Arc3Pt(PointA=end_33.Start, PointB=move_51.Geometry, PointC=end_33.End)  # -> Arc, Plane, Radius

# ----
arc_2 = Arc3Pt(PointA=point_on_curve_10, PointB=move_51.Geometry, PointC=shift_list_2)  # -> Arc, Plane, Radius

# ---- group: ellipse (continued)
join_13 = JoinCurves(Curves=arc_2.Arc, Preserve=False)
fillet_2 = Fillet(Curve=join_13, Radius="150")

# ---- group: Crop buble line (continued)
scale_3 = Scale(Geometry=fillet_2, Center=Point(0, 0, 0), Factor=series_12)  # -> Geometry, Transform
curve_curve_2 = CurveCurve(CurveA=scale_3.Geometry, CurveB=curve_9)  # -> Points, ParamsA, ParamsB
list_length_22 = ListLength(List=curve_curve_2.Points)
equality_5 = Equality(FirstNumber=list_length_22, SecondNumber="0")  # -> flatten(Equality), Inequality
dispatch_46 = Dispatch(List=scale_3.Geometry, DispatchPattern=equality_5.Equality)  # -> ListA, ListB
list_item_73 = ListItem(List=reverse(dispatch_46.ListA), Index=Slider(0, range=0..10), Wrap=True)

# ----
curve_10 = Curve(offset_curve)

rotate_2 = Rotate(Geometry=offset_curve, Angle=expr("x*-1", degrees(list_item_83)), Plane=PlaneXY(0, 0, 0))  # -> Geometry, Transform
move_52 = Move(Geometry=rotate_2.Geometry, Motion=graft(unit_x_9))  # -> Geometry, Transform
custom_preview_lineweights_5 = CustomPreviewLineweights(Geometry=[rotate_2.Geometry, move_52.Geometry], Shader=ColourSwatch(SwatchColor=RGB(89, 89, 89)), Absolute=False)
rotate_3 = Rotate(Geometry=offset_curve, Angle=expr("x*-2", degrees(list_item_83)), Plane=PlaneXY(0, 0, 0))  # -> Geometry, Transform
move_53 = Move(Geometry=rotate_3.Geometry, Motion=unit_z)  # -> Geometry, Transform
extrude = Extrude(Base=move_53.Geometry, Direction=unit_z_2)
cap_holes_3 = CapHoles(Brep=extrude)
msplit_2 = MeshSplit(Mesh=mesh_join, Splitters=extrude)
deconstruct_mesh = DeconstructMesh(Mesh=msplit_2)  # -> Vertices, Faces, Colours, Normals
list_item_74 = ListItem(List=deconstruct_mesh.Vertices, Index=12, Wrap=True)  # -> flatten(Item)
point_in_brep = PointInBrep(Brep=cap_holes_3, Point=list_item_74, Strict=False)
dispatch_47 = Dispatch(List=msplit_2, DispatchPattern=point_in_brep)  # -> ListA, ListB
move_54 = Move(Geometry=dispatch_47.ListA, Motion=unit_x)  # -> Geometry, Transform

# ---- group: bowl (continued)
preview_2 = CustomPreview(Geometry=move_54.Geometry, Material=material)

# ----
trim_with_brep = TrimWithBrep(Curve=[ungroup_8, explode_25.Segments], Brep=cap_holes_3)  # -> Inside, Outside

# ---- group: stadium exits (continued)
pull_point_4 = PullPoint(Point=flatten(point_on_curve_8), Geometry=flatten(trim_with_brep.Inside), ClosestOnly=True)  # -> ClosestPoint, Distance

# ----
point_in_brep_2 = PointInBrep(Brep=cap_holes_3, Point=trim_25, Strict=False)
dispatch_48 = Dispatch(List=ln_21, DispatchPattern=point_in_brep_2)  # -> ListA, ListB
dispatch_49 = Dispatch(List=gradient_2, DispatchPattern=point_in_brep_2)  # -> ListA, ListB
dispatch_50 = Dispatch(List=dispatch_49.ListA, DispatchPattern=point_in_brep_2)  # -> ListA, ListB

# ---- group: programme volumes (continued)
trim_with_brep_2 = TrimWithBrep(Curve=curve_8, Brep=cap_holes_3)  # -> Inside, Outside
trim_tree_20 = TrimTree(Tree=trim_with_brep_2.Inside, Depth=1)
list_length_23 = ListLength(List=trim_with_brep_2.Inside)
close_curve = CloseCurve(Curve=trim_tree_20, CloseType=0, Bulge=0.5, Tolerance=0)  # -> Closed, ResultBoolean
larger_than_11 = LargerThan(FirstNumber=list_length_23, SecondNumber="1")  # -> LargerThan, OrEqualTo
trim_tree_21 = TrimTree(Tree=larger_than_11.OrEqualTo, Depth=1)
tree_statistics_50 = TreeStatistics(Tree=trim_tree_21)  # -> Paths, Length, Count
tree_statistics_51 = TreeStatistics(Tree=close_curve.Closed)  # -> Paths, Length, Count
replace_paths_26 = ReplacePaths(Data=trim_tree_21, Search=tree_statistics_50.Paths, Replace=tree_statistics_48.Paths)
panel_130 = Panel(trim_tree_21)

# ----
move_55 = Move(Geometry=close_curve.Closed, Motion=unit_x_2)  # -> Geometry, Transform
medges_2 = MeshEdges(Mesh=move_55.Geometry)  # -> NakedEdges, InteriorEdges, NonManifoldEdges
previewlw_2 = CustomPreviewLineweights(
    Geometry=simplify(medges_2.NakedEdges),
    Shader=simplify(ColourSwatch(SwatchColor=RGB(0, 0, 0))),
    Thickness="2",
    Absolute=False)
move_56 = Move(Geometry=move_55.Geometry, Motion=unit_z_4)  # -> Geometry, Transform
boundary_surfaces_4 = BoundarySurfaces(Edges=move_55.Geometry)
tree_statistics_52 = TreeStatistics(Tree=replace_paths_26)  # -> Paths, Length, Count
panel_131 = Panel(close_curve.Closed)
custom_preview_lineweights_6 = CustomPreviewLineweights(Geometry=move_56.Geometry, Shader=ColourSwatch(SwatchColor=RGB(255, 255, 255)), Absolute=False)
tree_branch_11 = TreeBranch(Tree=repeat_data_17, Path=tree_statistics_52.Paths, MaintainPaths=True)

# ---- group: programme volumes (continued)
dispatch_51 = Dispatch(List=tree_branch_11, DispatchPattern=replace_paths_26)  # -> ListA, ListB
tree_statistics_53 = TreeStatistics(Tree=dispatch_51.ListA)  # -> Paths, Length, Count
replace_paths_27 = ReplacePaths(Data=close_curve.Closed, Search=tree_statistics_51.Paths, Replace=tree_statistics_53.Paths)
tree_statistics_54 = TreeStatistics(Tree=replace_paths_27)  # -> Paths, Length, Count
text_split_8 = TextSplit(Text=tree_statistics_54.Paths, Separators=";")
list_item_75 = ListItem(List=text_split_8, Index=0, Wrap=True)
text_fragment = TextFragment(Text=list_item_75, Start=1, Count=2)
list_item_76 = ListItem(List=subtraction_12, Index=text_fragment, Wrap=False)
unit_z_6 = UnitZ(Factor=list_item_76)
move_57 = Move(Geometry=replace_paths_27, Motion=unit_z_6)  # -> Geometry, Transform
trim_with_brep_3 = TrimWithBrep(Curve=graft(move_57.Geometry), Brep=cap_holes)  # -> Inside, Outside
trim_tree_22 = TrimTree(Tree=trim_with_brep_3.Outside, Depth=1)
join_curves_6 = JoinCurves(Curves=trim_tree_22, Preserve=False)
trim_tree_23 = TrimTree(Tree=join_curves_6, Depth=2)
close_curve_2 = CloseCurve(Curve=trim_tree_23, CloseType=0, Bulge=0.5, Tolerance=0)  # -> Closed, ResultBoolean
move_58 = Move(Geometry=close_curve_2.Closed, Motion=expr("x*-1", unit_z_6))  # -> Geometry, Transform

# ----
panel_132 = Panel(list_item_76)
panel_133 = Panel(unit_z_6)
list_length_24 = ListLength(List=trim_with_brep_3.Outside)
equality_6 = Equality(FirstNumber=list_length_24, SecondNumber="0")  # -> Equality, Inequality
dispatch_52 = Dispatch(List=flatten(dispatch_51.ListA), DispatchPattern=flatten(equality_6.Equality))  # -> ListA, ListB
weave_21 = Weave(Pattern=[0, 1], Stream0=graft(move_58.Geometry), Stream1=graft(close_curve_2.Closed), NullGaps=False)
list_length_25 = ListLength(List=dispatch_51.ListA)
mloft_3 = PythonicMeshLoftPlus(P=weave_21, C="0", A="0", E="0")  # -> L; inputs P: list of Polyline, C: Boolean, A: Boolean, E: Int32; same code as mloft
partition_list_2 = PartitionList(List=dispatch_52.ListB, Size=flatten(list_length_25))
mesh_to_polysurface_2 = MeshToPolysurface(Mesh=mloft_3, Triangles=False, FaceMerge=False)
trim_tree_24 = TrimTree(Tree=mesh_to_polysurface_2, Depth=1)
cap_holes_4 = CapHoles(Brep=trim_tree_24)
sift_5 = SiftPattern(List=close_curve_2.Closed, SiftPattern=partition_list_2)  # -> Output0, Output1, Output2, Output3, Output4, Output5, Output6, Output7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
volume = Volume(Geometry=cap_holes_4)  # -> Volume, Centroid
region_union = RegionUnion(Curves=sift_5.Output11)
region_union_2 = RegionUnion(Curves=sift_5.Output6)
region_union_3 = RegionUnion(Curves=sift_5.Output5)
region_union_4 = RegionUnion(Curves=sift_5.Output4)
region_union_5 = RegionUnion(Curves=sift_5.Output1)
move_59 = Move(Geometry=region_union, Motion=expr("x*-1", unit_z_6))  # -> Geometry, Transform
scale_4 = Scale(Geometry=cap_holes_4, Center=volume.Centroid, Factor=".99")  # -> Geometry, Transform
move_60 = Move(Geometry=region_union_2, Motion=expr("x*-1", unit_z_6))  # -> Geometry, Transform
move_61 = Move(Geometry=region_union_4, Motion=expr("x*-1", unit_z_6))  # -> Geometry, Transform
move_62 = Move(Geometry=region_union_3, Motion=expr("x*-1", unit_z_6))  # -> Geometry, Transform
move_63 = Move(Geometry=region_union_5, Motion=expr("x*-1", unit_z_6))  # -> Geometry, Transform

# ---- group: programme volumes (continued)
list_item_77 = ListItem(List=custom_material, Index=partition_list_2, Wrap=True)

# ----
tt_material_preview = TTMaterialPreview(Geometry=boundary_surfaces_4, Material=list_item_77)
list_length_26 = ListLength(List=tt_material_preview)
larger_than_12 = LargerThan(FirstNumber=list_length_26, SecondNumber="-1")  # -> LargerThan, OrEqualTo
custom_preview_4 = CustomPreview(Geometry=rotate_5.Geometry, Material=list_item_77)

# ---- group: programme volumes (continued)
custom_preview_5 = CustomPreview(Geometry=move_66.Geometry, Material=list_item_77)

# ----
rotate_4 = Rotate(
    Geometry=[move_63.Geometry, move_61.Geometry, move_62.Geometry, move_60.Geometry, move_59.Geometry, region_union_5, region_union_4, region_union_3, region_union_2, region_union],
    Angle=degrees(list_item_83),
    Plane=PlaneXY(0, 0, 0))  # -> Geometry, Transform

# ---- group: building outline
tree_statistics_55 = TreeStatistics(Tree=rotate_4.Geometry)  # -> Paths, Length, Count
list_item_78 = ListItem(List=tree_statistics_55.Paths, Index=0, Wrap=True)
tree_branch_12 = TreeBranch(Tree=rotate_4.Geometry, Path=list_item_78, MaintainPaths=True)
clean_tree_7 = CleanTree(RemoveNulls=True, RemoveInvalid=True, RemoveEmpty=True, Tree=tree_branch_12)
end_points_11 = EndPoints(Curve=clean_tree_7)  # -> Start, End
deconstruct_8 = Deconstruct(Point=end_points_11.Start)  # -> XComponent, YComponent, ZComponent
sort_list_11 = SortList(Keys=deconstruct_8.ZComponent)  # -> Keys, ValuesValuesA
list_item_79 = ListItem(List=sort_list_11.Keys, Index=0, Wrap=True)
member_index_3 = MemberIndex(Set=deconstruct_8.ZComponent, Member=list_item_79)  # -> Index, Count
list_item_80 = ListItem(List=clean_tree_7, Index=member_index_3.Index, Wrap=True)
region_union_6 = RegionUnion(Curves=list_item_80)
area_8 = Area(Geometry=region_union_6)  # -> Area, Centroid
sort_list_12 = SortList(Keys=area_8.Area, ValuesValuesA=region_union_6)  # -> Keys, ValuesValuesA
list_item_81 = ListItem(List=reverse(sort_list_12.ValuesValuesA), Index=0, Wrap=True)

# ----
move_64 = Move(Geometry=rotate_4.Geometry, Motion=unit_x_3)  # -> Geometry, Transform
custom_preview_lineweights_7 = CustomPreviewLineweights(Geometry=move_64.Geometry, Shader=colour_swatch, Thickness="2", Absolute=False)
move_65 = Move(Geometry=rotate_4.Geometry, Motion=unit_x_4)  # -> Geometry, Transform
custom_preview_lineweights_8 = CustomPreviewLineweights(Geometry=move_65.Geometry, Shader=colour_swatch, Thickness="2", Absolute=False)
rotate_5 = Rotate(Geometry=scale_4.Geometry, Angle=degrees(list_item_83), Plane=PlaneXY(0, 0, 0))  # -> Geometry, Transform
move_66 = Move(Geometry=rotate_5.Geometry, Motion=unit_x_3)  # -> Geometry, Transform
move_67 = Move(Geometry=rotate_5.Geometry, Motion=unit_x_4)  # -> Geometry, Transform
custom_preview_6 = CustomPreview(Geometry=move_67.Geometry, Material=list_item_77)

# ---- group: bowl exit points (continued)
smaller_than_3 = SmallerThan(FirstNumber=hoopsnake.IterationsCounter, SecondNumber="60")  # -> SmallerThan, OrEqualTo
dispatch_53 = Dispatch(List=point_5, DispatchPattern=smaller_than_3.SmallerThan)  # -> ListA, ListB
larger_than_13 = LargerThan(FirstNumber=hoopsnake.IterationsCounter, SecondNumber="59")  # -> LargerThan, OrEqualTo
dispatch_54 = Dispatch(List=point_6, DispatchPattern=larger_than_13.LargerThan)  # -> ListA, ListB
smaller_than_4 = SmallerThan(FirstNumber=hoopsnake.IterationsCounter, SecondNumber="359")  # -> SmallerThan, OrEqualTo
dispatch_55 = Dispatch(List=dispatch_54.ListA, DispatchPattern=smaller_than_4.OrEqualTo)  # -> ListA, ListB
larger_than_14 = LargerThan(FirstNumber=hoopsnake.IterationsCounter, SecondNumber="359")  # -> LargerThan, OrEqualTo
dispatch_56 = Dispatch(List=point_7, DispatchPattern=larger_than_14.LargerThan)  # -> ListA, ListB
merge_45 = Merge(Data1=dispatch_53.ListA, Data2=dispatch_55.ListA, Data3=dispatch_56.ListA)

# ---- group: bowl exit points / Bowl entry points
point_8 = Point(flatten(merge_45))

# ----
pull_point_5 = PullPoint(Point=point_8, Geometry=pull_point_4.ClosestPoint, ClosestOnly=True)  # -> ClosestPoint, Distance

# ---- group: paths to stadium exit
line_29 = Line(StartPoint=pull_point_5.ClosestPoint, EndPoint=point_8)

# ----
shortest_walk = ShortestWalk(Curves=flatten(trim_with_brep.Inside), WantedPath=line_29)  # -> ShortestWalk, Succession, Direction, Length
end_points_12 = EndPoints(Curve=shortest_walk.ShortestWalk)  # -> Start, End
bounds_2 = Bounds(Numbers=shortest_walk.Length)
cull_duplicates_2 = CullDuplicates(Points=point_8, Tolerance=Slider(2, range=0..10), CullMode=3)  # -> Points, Indices, Valence
deconstruct_domain_2 = DeconstructDomain(Domain=bounds_2)  # -> Start, End
gradient_4 = Gradient(
    LowerLimit=deconstruct_domain_2.Start,
    UpperLimit=deconstruct_domain_2.End,
    Parameter=shortest_walk.Length,
    stops=[0.15: RGB(0, 255, 0), 0.85: RGB(0, 128, 0)])
pull_point_6 = PullPoint(Point=pull_point_3.ClosestPoint, Geometry=flatten(cull_duplicates_2.Points), ClosestOnly=True)  # -> ClosestPoint, Distance
distance_4 = Distance(PointA=pull_point_6.ClosestPoint, PointB=end_points_12.End)
sort_list_13 = SortList(Keys=distance_4, ValuesValuesA=shortest_walk.Length)  # -> Keys, ValuesValuesA
list_item_82 = ListItem(List=sort_list_13.ValuesValuesA, Index=0, Wrap=True)
list_length_27 = ListLength(List=pull_point_6.ClosestPoint)
repeat_data_18 = RepeatData(Data=list_item_82, Length=list_length_27)
addition_14 = Addition(A=pull_point_3.Distance, B=pull_point_6.Distance)
addition_15 = Addition(A=addition_14, B=repeat_data_18)
sort_list_14 = SortList(Keys=flatten(pull_point_6.Distance))  # -> Keys, ValuesValuesA
bounds_3 = Bounds(Numbers=flatten(addition_14))

# ---- group: seats close to bowl exit
larger_than_15 = LargerThan(FirstNumber=flatten(addition_14), SecondNumber="25")  # -> LargerThan, OrEqualTo
dispatch_57 = Dispatch(List=flatten(addition_14), DispatchPattern=larger_than_15.LargerThan)  # -> ListA, ListB
list_length_28 = ListLength(List=larger_than_15.LargerThan)
list_length_29 = ListLength(List=dispatch_57.ListB)
division_26 = Division(A=list_length_29, B=list_length_28)
data_recorder_2 = DataRecorder(division_26, DataLimit=-10, RecordData=True)
panel_134 = Panel(data_recorder_2)

# ----
larger_than_16 = LargerThan(FirstNumber=flatten(addition_15), SecondNumber="40")  # -> LargerThan, OrEqualTo
dispatch_58 = Dispatch(List=flatten(addition_15), DispatchPattern=larger_than_16.LargerThan)  # -> ListA, ListB
list_length_30 = ListLength(List=larger_than_16.LargerThan)
list_length_31 = ListLength(List=dispatch_58.ListB)
division_27 = Division(A=list_length_31, B=list_length_30)
data_recorder_3 = DataRecorder(division_27, DataLimit=-10, RecordData=True)
panel_135 = Panel(data_recorder_3)

sort_list_15 = SortList(Keys=flatten(addition_15))  # -> Keys, ValuesValuesA

rotate_6 = Rotate(Geometry=shortest_walk.ShortestWalk, Angle=degrees(list_item_83), Plane=PlaneXY(0, 0, 0))  # -> Geometry, Transform
move_68 = Move(Geometry=rotate_6.Geometry, Motion=unit_x_5)  # -> Geometry, Transform
tt_lineweight_preview = TTLineweightPreview(Geometry=move_68.Geometry, Shader=gradient_4, Thickness="6", Absolute=False)

# ---- group: Right click -> Auto Loop All to initiate geneartion
hoopsnake = HoopSnake(
    StartingData="0",
    Data=addition_16,
    TerminationCondition=larger_than_17.LargerThan,
    Hoopsnake_Data_autoUpdate=False,
    Hoopsnake_Data_dataLimit=2147483647,
    Hoopsnake_Data_delay=0,
    Hoopsnake_Data_resetCounter=True,
    Hoopsnake_Data_updateView=True)  # -> Feedback, CumulativeFeedback, LoopsCounter, IterationsCounter

# ----
smaller_than_5 = SmallerThan(FirstNumber=hoopsnake.IterationsCounter, SecondNumber="70000")  # -> SmallerThan, OrEqualTo
addition_16 = Addition(A=hoopsnake.IterationsCounter, B=Slider(1, range=0..1))
larger_than_17 = LargerThan(FirstNumber=addition_16, SecondNumber="-2000")  # -> LargerThan, OrEqualTo
weave_22 = Weave(Pattern=[0, 1], Stream0=item_5.Item1, Stream1=hoopsnake.IterationsCounter, NullGaps=False)
panel_136 = Panel(hoopsnake.IterationsCounter)
text_join_8 = TextJoin(Text=flatten(weave_22), Join="_")
panel_137 = Panel(panel_136)
list_item_83 = ListItem(List=range, Index=panel_137, Wrap=True)
rotate_7 = Rotate(Geometry=polyline_3, Angle=degrees(list_item_83), Plane=PlaneXY(0, 0, 0))  # -> Geometry, Transform
rotate_8 = Rotate(Geometry=point, Angle=expr("x*-1", degrees(list_item_83)), Plane=xy_plane)  # -> Geometry, Transform
rotate_9 = Rotate(Geometry=list_item_81, Angle=degrees(list_item_83), Plane=PlaneXY(0, 0, 0))  # -> Geometry, Transform
rotate_10 = Rotate(Geometry=polyline_3, Angle=degrees(list_item_83), Plane=PlaneXY(0, 0, 0))  # -> Geometry, Transform
join_curves_7 = JoinCurves(Curves=flatten(rotate_7.Geometry), Preserve=False)
pull_point_7 = PullPoint(Point=pull_point_6.ClosestPoint, Geometry=rotate_8.Geometry, ClosestOnly=True)  # -> ClosestPoint, Distance
join_curves_8 = JoinCurves(Curves=flatten(rotate_9.Geometry), Preserve=False)
rotate_11 = Rotate(Geometry=join_curves_8, Angle=expr("x*-1", degrees(list_item_83)), Plane=PlaneXY(0, 0, 0))  # -> Geometry, Transform
project = Project(Geometry=rotate_10.Geometry, Plane=PlaneXY(0, 0, 0))  # -> flatten(Geometry), Transform
move_69 = Move(Geometry=rotate_11.Geometry, Motion=unit_x_7)  # -> Geometry, Transform
rotate_12 = Rotate(Geometry=curve_3, Angle=degrees(list_item_83), Plane=xy_plane_2)  # -> Geometry, Transform
custom_preview_lineweights_9 = CustomPreviewLineweights(Geometry=move_69.Geometry, Shader=ColourSwatch(SwatchColor=RGB(120, 120, 120)), Absolute=False)
pull_point_8 = PullPoint(Point=point_2, Geometry=project.Geometry, ClosestOnly=True)  # -> ClosestPoint, Distance
addition_17 = Addition(A=pull_point_6.Distance, B=pull_point_7.Distance)
boundary_surfaces_5 = BoundarySurfaces(Edges=flatten([project.Geometry, join_curves_8]))
join_curves_9 = JoinCurves(Curves=flatten(project.Geometry), Preserve=False)
join_curves_10 = JoinCurves(Curves=project.Geometry, Preserve=False)

# ---- group: building footprint
area_9 = Area(Geometry=flatten(join_curves_8))  # -> Area, Centroid

# ---- group: roof area
area_10 = Area(Geometry=boundary_surfaces_5)  # -> Area, Centroid

# ----
length_4 = Length(Curve=join_curves_8)
area_11 = Area(Geometry=flatten(join_curves_7))  # -> Area, Centroid
line_30 = Line(StartPoint=pull_point_8.ClosestPoint, EndPoint=point_2)
move_70 = Move(Geometry=rotate_12.Geometry, Motion=graft(unit_x_6))  # -> Geometry, Transform
move_71 = Move(Geometry=rotate_12.Geometry, Motion=graft(unit_x_9))  # -> Geometry, Transform
addition_18 = Addition(A=pull_point_3.Distance, B=addition_17)
distance_5 = Distance(PointA=area_11.Centroid, PointB=area_10.Centroid)
curve_11 = Curve(flatten([line_30, join_curves_10, join_curves]))
custom_preview_7 = CustomPreview(Geometry=[move_70.Geometry, rotate_12.Geometry], Material=colour_swatch_4)
curve_curve_3 = CurveCurve(CurveA=join_curves_9, CurveB=curve_2)  # -> Points, ParamsA, ParamsB
custom_preview_8 = CustomPreview(Geometry=[move_71.Geometry, rotate_12.Geometry], Material=colour_swatch_4)
addition_19 = Addition(A=distance_5, B="2.2")
list_length_32 = ListLength(List=flatten(curve_curve_3.Points))

# ---- group: facade area
multiplication_10 = Multiplication(A=length_4, B=addition_19)

# ----
panel_138 = Panel(addition_19)
surface_split = SurfaceSplit(Surface=boundary_surfaces_3, Curves=curve_11)
split_list_11 = SplitList(List=surface_split, Index=1)  # -> ListA, ListB
panel_139 = Panel(list_length_32)
rotate_13 = Rotate(Geometry=loft_15, Angle=degrees(list_item_83), Plane=PlaneXY(0, 0, 0))  # -> Geometry, Transform
area_12 = Area(Geometry=flatten(surface_split))  # -> Area, Centroid
sort_list_16 = SortList(Keys=flatten(addition_18))  # -> Keys, ValuesValuesA
list_length_33 = ListLength(List=flatten(addition_18))
bounds_4 = Bounds(Numbers=area_12.Area)
list_length_34 = ListLength(List=flatten(addition_18))
area_13 = Area(Geometry=surface_split)  # -> flatten(Area), Centroid

custom_preview_9 = CustomPreview(Geometry=flatten(rotate_13.Geometry), Material=gradient_3)  # disabled

deconstruct_domain_3 = DeconstructDomain(Domain=bounds_4)  # -> Start, End
lng_23 = ListLength(List=sort_list_16.Keys)
multiplication_11 = Multiplication(A=list_length_33, B=".1")
multiplication_12 = Multiplication(A=list_length_34, B=".1")
rotate_14 = Rotate(Geometry=dispatch_48.ListA, Angle=degrees(list_item_83), Plane=xy_plane_2)  # -> Geometry, Transform
split_list_12 = SplitList(List=flatten(sort_list_14.Keys), Index=multiplication_11)  # -> ListA, ListB
multiplication_13 = Multiplication(A=lng_23, B="0.15")
gradient_5 = Gradient(
    LowerLimit=deconstruct_domain_3.Start,
    UpperLimit=deconstruct_domain_3.End,
    Parameter=area_12.Area,
    stops=[0: RGB(0, 98, 0), 0.25: RGB(81, 175, 17), 0.5: RGB(159, 198, 146), 0.75: RGB(170, 235, 41), 1: RGB(221, 255, 53)])
split_list_13 = SplitList(List=flatten(sort_list_8.Keys), Index=multiplication_12)  # -> ListA, ListB
split_65 = SplitList(List=sort_list_16.Keys, Index=multiplication_13)  # -> ListA, ListB
split_list_14 = SplitList(List=reverse(flatten(split_list_12.ListB)), Index=multiplication_11)  # -> ListA, ListB
move_72 = Move(Geometry=rotate_14.Geometry, Motion=unit_x_10)  # -> Geometry, Transform
deconstruct_brep_2 = DeconstructBrep(Brep=surface_split)  # -> flatten(Faces), Edges, Vertices
split_list_15 = SplitList(List=reverse(flatten(split_list_13.ListB)), Index=multiplication_12)  # -> ListA, ListB
split_66 = SplitList(List=reverse(split_65.ListB), Index=multiplication_13)  # -> ListA, ListB
bounds_5 = Bounds(Numbers=flatten(split_list_14.ListB))
join_curves_11 = JoinCurves(Curves=deconstruct_brep_2.Edges, Preserve=False)  # -> flatten(Curves)
bounds_6 = Bounds(Numbers=flatten(split_list_15.ListB))
bnd_2 = Bounds(Numbers=flatten(split_66.ListB))
create_material = CreateMaterial(Diffuse=gradient_5, Specular=RGB(255, 255, 255), Emission=RGB(0, 0, 0), Transparency=Slider(0.757, range=0..1), Shine=0)
previewlw_3 = CustomPreviewLineweights(Geometry=simplify(move_72.Geometry), Shader=simplify(dispatch_49.ListA), Thickness="8", Absolute=False)
deconstruct_domain_4 = DeconstructDomain(Domain=bounds_5)  # -> Start, End
move_73 = Move(Geometry=join_curves_11, Motion=graft(unit_x_11))  # -> Geometry, Transform
range_5 = Range(Domain=bnd_2, Steps=Slider(4, range=0..10))
deconstruct_domain_5 = DeconstructDomain(Domain=bounds_6)  # -> Start, End
roundn_2 = RoundToNearest(NumbersX=addition_18, NumbersY=range_5, RemapX=False)  # -> Nearest, Index, Difference, RemappedX
rotate_15 = Rotate(Geometry=ln_21, Angle=degrees(list_item_83), Plane=PlaneXY(0, 0, 0))  # -> Geometry, Transform
panel_140 = Panel(rotate_15.Geometry)
custom_preview_lineweights_10 = CustomPreviewLineweights(Geometry=move_73.Geometry, Shader=ColourSwatch(SwatchColor=RGB(0, 0, 0)), Thickness="2", Absolute=False)
move_74 = Move(Geometry=rotate_15.Geometry, Motion=unit_x_12)  # -> Geometry, Transform
move_75 = Move(Geometry=rotate_15.Geometry, Motion=unit_x_13)  # -> Geometry, Transform
boundary_surfaces_6 = BoundarySurfaces(Edges=move_73.Geometry)
move_76 = Move(Geometry=rotate_15.Geometry, Motion=unit_x_14)  # -> Geometry, Transform

# ---- group: % of closest seats
sort_list_17 = SortList(Keys=flatten(roundn_2.Index))  # -> Keys, ValuesValuesA
create_set_3 = CreateSet(List=sort_list_17.Keys)  # -> Set, Map
list_length_35 = ListLength(List=sort_list_17.Keys)
member_index_4 = MemberIndex(Set=flatten(sort_list_17.Keys), Member=create_set_3.Set)  # -> Index, Count
division_28 = Division(A=member_index_4.Count, B=list_length_35)
panel_141 = Panel(division_28)

# ----
custom_preview_10 = CustomPreview(Geometry=surface_split, Material=create_material)
custom_preview_11 = CustomPreview(Geometry=boundary_surfaces_6, Material=create_material)
panel_142 = Panel(move_73.Geometry)
gradient_6 = Gradient(
    LowerLimit=deconstruct_domain_4.Start,
    UpperLimit=deconstruct_domain_4.End,
    Parameter=addition_14,
    stops=[0.15: RGB(192, 255, 255), 0.85: RGB(0, 139, 139)])
gradient_7 = Gradient(
    LowerLimit=deconstruct_domain_5.Start,
    UpperLimit=deconstruct_domain_5.End,
    Parameter=pull_point_3.Distance,
    stops=[0.15: RGB(255, 192, 255), 0.85: RGB(192, 0, 192)])
dispatch_59 = Dispatch(List=move_74.Geometry, DispatchPattern=point_in_brep_2)  # -> ListA, ListB
dispatch_60 = Dispatch(List=move_75.Geometry, DispatchPattern=point_in_brep_2)  # -> ListA, ListB
dispatch_61 = Dispatch(List=gradient_6, DispatchPattern=point_in_brep_2)  # -> ListA, ListB
dispatch_62 = Dispatch(List=move_76.Geometry, DispatchPattern=point_in_brep_2)  # -> ListA, ListB
dispatch_63 = Dispatch(List=gradient_7, DispatchPattern=point_in_brep_2)  # -> ListA, ListB
previewlw_4 = CustomPreviewLineweights(Geometry=simplify(dispatch_59.ListA), Shader=simplify(dispatch_61.ListA), Thickness="8", Absolute=False)
previewlw_5 = CustomPreviewLineweights(Geometry=simplify(dispatch_62.ListA), Shader=simplify(dispatch_63.ListA), Thickness="8", Absolute=False)
dispatch_64 = Dispatch(List=rotate_15.Geometry, DispatchPattern=point_in_brep_2)  # -> ListA, ListB
list_length_36 = ListLength(List=area_13.Area)
partition_list_3 = PartitionList(List=list_length_36, Size="4")

# ---- group: masterplan distance (continued)
rep_17 = ReplaceText(Text="*_masterplan.jpeg", Find="*", Replace=text_join_8, RecursiveReplace=False)
join_14 = TextJoin(Text=[panel_30, rep_17])
saveview_2 = SaveViewportToFile(Run=larger_than_17.LargerThan, ViewportName="Top view print", Render=False, FilePath=join_14, ScaleFactor="3")  # disabled

# ----
panel_143 = Panel(join_14)
text_join_9 = TextJoin(Text=division_28, Join="~")

# ---- group: programme (continued)
rep_18 = ReplaceText(Text="*_programme.jpeg", Find="*", Replace=text_join_8, RecursiveReplace=False)
join_15 = TextJoin(Text=[panel_30, rep_18])
panel_144 = Panel(join_15)
save_viewport_to_file = SaveViewportToFile(Run=larger_than_17.LargerThan, ViewportName="Axo 02", Render=False, FilePath=join_15, ScaleFactor="3")
saveview_3 = SaveViewportToFile(Run=larger_than_17.LargerThan, ViewportName="Axo 02", Render=False, FilePath=join_15, ScaleFactor="3")  # disabled

# ---- group: stadium exit (continued)
rep_19 = ReplaceText(Text="*_stadium exit.jpeg", Find="*", Replace=text_join_8, RecursiveReplace=False)
join_16 = TextJoin(Text=[panel_30, rep_19])
panel_145 = Panel(join_16)
save_viewport_to_file_2 = SaveViewportToFile(Run=larger_than_17.LargerThan, ViewportName="Axo 03", Render=False, FilePath=join_16, ScaleFactor="3")
saveview_4 = SaveViewportToFile(Run=larger_than_17.LargerThan, ViewportName="Axo 03", Render=False, FilePath=join_16, ScaleFactor="3")  # disabled

# ----
rep_20 = ReplaceText(Text="*_gangway.jpeg", Find="*", Replace=text_join_8, RecursiveReplace=False)
join_17 = TextJoin(Text=[panel_30, rep_20])
panel_146 = Panel(join_17)
save_viewport_to_file_3 = SaveViewportToFile(Run=larger_than_17.LargerThan, ViewportName="Top view print 02", Render=False, FilePath=join_17, ScaleFactor="3")
saveview_5 = SaveViewportToFile(Run=larger_than_17.LargerThan, ViewportName="Top view print 02", Render=False, FilePath=join_17, ScaleFactor="3")

# ---- group: section (continued)
rep_21 = ReplaceText(Text="*_section.jpeg", Find="*", Replace=text_join_8, RecursiveReplace=False)
join_18 = TextJoin(Text=[panel_30, rep_21])
panel_147 = Panel(join_18)
save_viewport_to_file_4 = SaveViewportToFile(Run=larger_than_12.LargerThan, ViewportName="Axo section", Render=False, FilePath=join_18, ScaleFactor="3")
saveview_6 = SaveViewportToFile(Run=larger_than_12.LargerThan, ViewportName="Axo section", Render=False, FilePath=join_18, ScaleFactor="3")  # disabled

# ---- group: programme (continued)
rep_22 = ReplaceText(Text="*_programme2.jpeg", Find="*", Replace=text_join_8, RecursiveReplace=False)
join_19 = TextJoin(Text=[panel_30, rep_22])
panel_148 = Panel(join_19)
save_viewport_to_file_5 = SaveViewportToFile(Run=larger_than_12.LargerThan, ViewportName="Axo 05", Render=False, FilePath=join_19, ScaleFactor="3")
saveview_7 = SaveViewportToFile(Run=larger_than_12.LargerThan, ViewportName="Axo 05", Render=False, FilePath=join_19, ScaleFactor="3")  # disabled

# ---- group: bowl exit (continued)
rep_23 = ReplaceText(Text="*_bowl exit.jpeg", Find="*", Replace=text_join_8, RecursiveReplace=False)
join_20 = TextJoin(Text=[panel_30, rep_23])
panel_149 = Panel(join_20)
save_viewport_to_file_6 = SaveViewportToFile(Run=larger_than_17.LargerThan, ViewportName="Top view print 03", Render=False, FilePath=join_20, ScaleFactor="3")
saveview_8 = SaveViewportToFile(Run=larger_than_17.LargerThan, ViewportName="Top view print 03", Render=False, FilePath=join_20, ScaleFactor="3")

# ----
entwine_18 = Entwine(
    Branch0X=division_26,
    Branch1X=division_24,
    Branch2X=division_27,
    Branch3X=text_join_9,
    Branch4X=rep_17,
    Branch5X=lng_21,
    Branch6X=list_length_36,
    Branch7X=hoopsnake.IterationsCounter,
    Branch8X=area_10.Area,
    Branch9X=area_9.Area,
    Branch10X=multiplication_10,
    Branch11X=list_length_18,
    Branch12X=list_length_19,
    Branch13X=text_join_7,
    Branch14X=list_item_68,
    FlattenInputs=False)
text_join_10 = TextJoin(Text=flatten(entwine_18), Join=",")
record_data = RecordData(Data=text_join_10, Record=True, Reset=button, RecordFirstDataOnReset=True)
save_string_to_file = SaveStringToFile(String=record_data, FilePath=panel_31, FileName="data.txt", SaveTrigger=larger_than_17.LargerThan)
panel_150 = Panel(entwine_18)

list_length_37 = ListLength(List=flatten(addition_18))
multiplication_14 = Multiplication(A=list_length_37, B=".1")
split_list_16 = SplitList(List=flatten(sort_list_15.Keys), Index=multiplication_14)  # -> ListA, ListB
split_list_17 = SplitList(List=reverse(flatten(split_list_16.ListB)), Index=multiplication_14)  # -> ListA, ListB
bounds_7 = Bounds(Numbers=flatten(split_list_17.ListB))
deconstruct_domain_6 = DeconstructDomain(Domain=bounds_7)  # -> Start, End
gradient_8 = Gradient(
    LowerLimit=deconstruct_domain_6.Start,
    UpperLimit=deconstruct_domain_6.End,
    Parameter=addition_15,
    stops=[0.15: RGB(255, 224, 192), 0.85: RGB(255, 128, 0)])

dispatch_65 = Dispatch(List=gradient_8, DispatchPattern=point_in_brep_2)  # -> ListA, ListB

previewlw_6 = CustomPreviewLineweights(Geometry=simplify(dispatch_60.ListA), Shader=simplify(dispatch_65.ListA), Thickness="8", Absolute=False)

# ---- group: bowl
rotate_16 = Rotate(Geometry=dispatch_47.ListA, Angle=degrees(list_item_83), Plane=xy_plane_2)  # -> Geometry, Transform

# ----
move_77 = Move(Geometry=rotate_16.Geometry, Motion=graft(unit_x_9))  # -> Geometry, Transform

# ---- group: bowl (continued)
custom_preview_12 = CustomPreview(Geometry=[rotate_16.Geometry, move_77.Geometry], Material=ColourSwatch(SwatchColor=RGB(255, 255, 255)))

# ---- group: seat to materplan exit
list_length_38 = ListLength(List=flatten(addition_18))
sort_list_18 = SortList(Keys=flatten(addition_18))  # -> Keys, ValuesValuesA
multiplication_15 = Multiplication(A=list_length_38, B=".1")
split_list_18 = SplitList(List=flatten(sort_list_18.Keys), Index=multiplication_15)  # -> ListA, ListB
split_list_19 = SplitList(List=reverse(flatten(split_list_18.ListB)), Index=multiplication_15)  # -> ListA, ListB
bounds_8 = Bounds(Numbers=flatten(split_list_19.ListB))
deconstruct_domain_7 = DeconstructDomain(Domain=bounds_8)  # -> Start, End
gradient_9 = Gradient(
    LowerLimit=deconstruct_domain_7.Start,
    UpperLimit=deconstruct_domain_7.End,
    Parameter=addition_18,
    stops=[0: RGB(0, 98, 0), 0.25: RGB(81, 175, 17), 0.5: RGB(159, 198, 146), 0.75: RGB(170, 235, 41), 1: RGB(221, 255, 53)])

# ----
dispatch_66 = Dispatch(List=gradient_9, DispatchPattern=point_in_brep_2)  # -> ListA, ListB

# ---- group: seat to materplan exit (continued)
previewlw_7 = CustomPreviewLineweights(Geometry=simplify(dispatch_64.ListA), Shader=simplify(dispatch_66.ListA), Thickness="8", Absolute=False)

# ----
deconstruct_brep_3 = DeconstructBrep(Brep=surface_split)  # -> flatten(Faces), Edges, Vertices
rotate_17 = Rotate(Geometry=curve_10, Angle=expr("x*-2", degrees(list_item_83)), Plane=PlaneXY(0, 0, 0))  # -> Geometry, Transform
join_curves_12 = JoinCurves(Curves=deconstruct_brep_3.Edges, Preserve=False)  # -> flatten(Curves)
rotate_18 = Rotate(Geometry=rotate_14.Geometry, Angle=expr("x*-1", degrees(list_item_83)), Plane=PlaneXY(0, 0, 0))  # -> Geometry, Transform
rotate_19 = Rotate(Geometry=join_curves_12, Angle=expr("x*-1", degrees(list_item_83)), Plane=PlaneXY(0, 0, 0))  # -> Geometry, Transform
rotate_20 = Rotate(Geometry=curve_5, Angle=expr("x*-1", degrees(list_item_83)), Plane=PlaneXY(0, 0, 0))  # -> Geometry, Transform
move_78 = Move(Geometry=rotate_17.Geometry, Motion=unit_x_15)  # -> Geometry, Transform
move_79 = Move(Geometry=rotate_18.Geometry, Motion=unit_x_15)  # -> Geometry, Transform
move_80 = Move(Geometry=rotate_19.Geometry, Motion=unit_x_15)  # -> Geometry, Transform
move_81 = Move(Geometry=rotate_20.Geometry, Motion=unit_x_15)  # -> Geometry, Transform
custom_preview_lineweights_11 = CustomPreviewLineweights(Geometry=move_78.Geometry, Shader=ColourSwatch(SwatchColor=RGB(89, 89, 89)), Absolute=False)
boundary_surfaces_7 = BoundarySurfaces(Edges=move_80.Geometry)
custom_preview_lineweights_12 = CustomPreviewLineweights(
    Geometry=move_81.Geometry,
    Shader=ColourSwatch(SwatchColor=RGB(125, 125, 125)),
    Thickness=Slider(10, range=0..10),
    Absolute=False)
custom_preview_13 = CustomPreview(Geometry=boundary_surfaces_7, Material=create_material)

dispatch_67 = Dispatch(List=move_79.Geometry, DispatchPattern=point_in_brep_2)  # -> ListA, ListB

previewlw_8 = CustomPreviewLineweights(Geometry=simplify(dispatch_67.ListA), Shader=simplify(dispatch_50.ListA), Thickness="8", Absolute=False)
