# Grasshopper definition 07_02_RIBA Stage 2 Concept Design Analysis Model.gh (Grasshopper 1.0.7)
# plug-ins: Human, LunchBoxML, Pufferfish

output_folder = Panel("C:\AOMSDML\Stage 2")
labels_sightlines = GenePool(Decimals=0, Maximum=3, Minimum=0, Value=[0, 3, 0, 2])

# ---- group: Labels Circulation
labels_sightlines_2 = GenePool(Decimals=0, Maximum=3, Minimum=0, Value=[3, 2, 1, 0])

# ---- group: Labels Programme
labels_sightlines_3 = GenePool(Decimals=0, Maximum=3, Minimum=0, Value=[0, 1, 2, 3])

# ----
concatenate = Concatenate(FragmentA=output_folder, FragmentB="\data.txt")
concatenate_2 = Concatenate(FragmentA=output_folder, FragmentB="\")
file_path = FilePath(concatenate)
read_file = ReadFile(File=file_path, PerLineParse=True)
panel = Panel("""0
1
2""")
split_list = SplitList(List=read_file, Index="2")  # -> ListA, ListB
panel_2 = Panel(concatenate_2)
split_list_2 = SplitList(List=split_list.ListB, Index="4000")  # -> ListA, ListB
text_split = TextSplit(Text=split_list_2.ListA, Separators=",")
list_item = ListItem(List=text_split, Index=panel, Wrap=True)
panel_3 = Panel(list_item)
mass_addition = MassAddition(Input=list_item)  # -> Result, PartialResults
division = Division(A=mass_addition.Result, B=3)

# ---- group: programme
list_item_2 = ListItem(List=reverse(text_split), Index="1", Wrap=True)
panel_4 = Panel(list_item_2)
text_split_2 = TextSplit(Text=list_item_2, Separators=";")
mass_addition_2 = MassAddition(Input=text_split_2)  # -> Result, PartialResults
tree_statistics = TreeStatistics(Tree=text_split_2)  # -> Paths, Length, Count
panel_5 = Panel("""300
300
1500
1500
400""")
number_slider = Slider(10, range=0..20)
partition_list = PartitionList(List=flatten(tree_statistics.Paths), Size=panel_5)
partition_list_2 = PartitionList(List=flatten(mass_addition_2.Result), Size=panel_5)
division_2 = Division(A=panel_5, B=number_slider)
sort_list = SortList(Keys=partition_list_2, ValuesValuesA=partition_list)  # -> Keys, ValuesValuesA
series = Series(Start=0, Step=division_2, Count=number_slider)
list_item_3 = ListItem(List=sort_list.ValuesValuesA, Index=series, Wrap=True)
tree_statistics_2 = TreeStatistics(Tree=list_item_3)  # -> Paths, Length, Count
list_item_4 = ListItem(List=tree_statistics_2.Paths, Index=0, Wrap=True)  # -> Item, Item1, Item2, Item3, Item4
tree_branch = TreeBranch(Tree=list_item_3, Path=list_item_4.Item, MaintainPaths=True)
tree_branch_2 = TreeBranch(Tree=list_item_3, Path=list_item_4.Item1, MaintainPaths=True)
tree_branch_3 = TreeBranch(Tree=list_item_3, Path=list_item_4.Item2, MaintainPaths=True)
tree_branch_4 = TreeBranch(Tree=list_item_3, Path=list_item_4.Item3, MaintainPaths=True)
tree_branch_5 = TreeBranch(Tree=list_item_3, Path=list_item_4.Item4, MaintainPaths=True)
tree_branch_6 = TreeBranch(Tree=text_split_2, Path=tree_branch_2, MaintainPaths=True)
tree_branch_7 = TreeBranch(Tree=text_split_2, Path=tree_branch_3, MaintainPaths=True)
tree_branch_8 = TreeBranch(Tree=text_split_2, Path=tree_branch_4, MaintainPaths=True)
tree_branch_9 = TreeBranch(Tree=text_split_2, Path=tree_branch_5, MaintainPaths=True)
tree_branch_10 = TreeBranch(Tree=text_split_2, Path=tree_branch, MaintainPaths=True)
k_means_clustering = KMeansClustering(TrainingInputs=tree_branch_6, OfClusters="4", RandomSeed=5)  # -> Result, Likelihood, Centroids
k_means_clustering_2 = KMeansClustering(TrainingInputs=tree_branch_7, OfClusters="4", RandomSeed=5)  # -> Result, Likelihood, Centroids
k_means_clustering_3 = KMeansClustering(TrainingInputs=tree_branch_8, OfClusters="4", RandomSeed=5)  # -> Result, Likelihood, Centroids
k_means_clustering_4 = KMeansClustering(TrainingInputs=tree_branch_9, OfClusters="4", RandomSeed=5)  # -> Result, Likelihood, Centroids
k_means_clustering_5 = KMeansClustering(TrainingInputs=tree_branch_10, OfClusters="4", RandomSeed=5)  # -> Result, Likelihood, Centroids
entwine = Entwine(
    Branch00=k_means_clustering_5.Result,
    Branch01=k_means_clustering.Result,
    Branch02=k_means_clustering_2.Result,
    Branch03=k_means_clustering_3.Result,
    Branch04=k_means_clustering_4.Result,
    FlattenInputs=True)

# ---- group: sightlines
list_item_5 = ListItem(List=reverse(text_split), Index="0", Wrap=True)
text_split_3 = TextSplit(Text=list_item_5, Separators=";")
mass_addition_3 = MassAddition(Input=text_split_3)  # -> Result, PartialResults
tree_statistics_3 = TreeStatistics(Tree=text_split_3)  # -> Paths, Length, Count
panel_6 = Panel("""300
300
1500
1500
400""")
number_slider_2 = Slider(10, range=0..20)
partition_list_3 = PartitionList(List=flatten(mass_addition_3.Result), Size=panel_6)
partition_list_4 = PartitionList(List=flatten(tree_statistics_3.Paths), Size=panel_6)
division_3 = Division(A=panel_6, B=number_slider_2)
sort_list_2 = SortList(Keys=partition_list_3, ValuesValuesA=partition_list_4)  # -> Keys, ValuesValuesA
series_2 = Series(Start=0, Step=division_3, Count=number_slider_2)
list_item_6 = ListItem(List=sort_list_2.ValuesValuesA, Index=series_2, Wrap=True)
tree_statistics_4 = TreeStatistics(Tree=list_item_6)  # -> Paths, Length, Count
list_item_7 = ListItem(List=tree_statistics_4.Paths, Index=0, Wrap=True)  # -> Item, Item1, Item2, Item3, Item4
tree_branch_11 = TreeBranch(Tree=list_item_6, Path=list_item_7.Item, MaintainPaths=True)
tree_branch_12 = TreeBranch(Tree=list_item_6, Path=list_item_7.Item1, MaintainPaths=True)
tree_branch_13 = TreeBranch(Tree=list_item_6, Path=list_item_7.Item2, MaintainPaths=True)
tree_branch_14 = TreeBranch(Tree=list_item_6, Path=list_item_7.Item3, MaintainPaths=True)
tree_branch_15 = TreeBranch(Tree=list_item_6, Path=list_item_7.Item4, MaintainPaths=True)
tree_branch_16 = TreeBranch(Tree=text_split_3, Path=tree_branch_12, MaintainPaths=True)
tree_branch_17 = TreeBranch(Tree=text_split_3, Path=tree_branch_13, MaintainPaths=True)
tree_branch_18 = TreeBranch(Tree=text_split_3, Path=tree_branch_14, MaintainPaths=True)
tree_branch_19 = TreeBranch(Tree=text_split_3, Path=tree_branch_15, MaintainPaths=True)
tree_branch_20 = TreeBranch(Tree=text_split_3, Path=tree_branch_11, MaintainPaths=True)
k_means_clustering_6 = KMeansClustering(TrainingInputs=tree_branch_16, OfClusters="4", RandomSeed=5)  # -> Result, Likelihood, Centroids
k_means_clustering_7 = KMeansClustering(TrainingInputs=tree_branch_17, OfClusters="4", RandomSeed=5)  # -> Result, Likelihood, Centroids
k_means_clustering_8 = KMeansClustering(TrainingInputs=tree_branch_18, OfClusters="4", RandomSeed=5)  # -> Result, Likelihood, Centroids
k_means_clustering_9 = KMeansClustering(TrainingInputs=tree_branch_19, OfClusters="4", RandomSeed=5)  # -> Result, Likelihood, Centroids
k_means_clustering_10 = KMeansClustering(TrainingInputs=tree_branch_20, OfClusters="4", RandomSeed=5)  # -> Result, Likelihood, Centroids
entwine_2 = Entwine(
    Branch00=k_means_clustering_10.Result,
    Branch01=k_means_clustering_6.Result,
    Branch02=k_means_clustering_7.Result,
    Branch03=k_means_clustering_8.Result,
    Branch04=k_means_clustering_9.Result,
    FlattenInputs=True)
sort_list_3 = SortList(Keys=entwine_2, ValuesValuesA=list_item_6)  # -> Keys, ValuesValuesA

# ----
panel_7 = Panel(text_split)

text_split_4 = TextSplit(Text=division, Separators=";")
mass_addition_4 = MassAddition(Input=text_split_4)  # -> Result, PartialResults
tree_statistics_5 = TreeStatistics(Tree=text_split_4)  # -> Paths, Length, Count
panel_8 = Panel("""300
300
1500
1500
400""")
number_slider_3 = Slider(10, range=0..20)
partition_list_5 = PartitionList(List=flatten(mass_addition_4.Result), Size=panel_8)
partition_list_6 = PartitionList(List=flatten(tree_statistics_5.Paths), Size=panel_8)
division_4 = Division(A=panel_8, B=number_slider_3)
sort_list_4 = SortList(Keys=partition_list_5, ValuesValuesA=partition_list_6)  # -> Keys, ValuesValuesA
series_3 = Series(Start=0, Step=division_4, Count=number_slider_3)
list_item_8 = ListItem(List=sort_list_4.ValuesValuesA, Index=series_3, Wrap=True)
tree_statistics_6 = TreeStatistics(Tree=list_item_8)  # -> Paths, Length, Count
list_item_9 = ListItem(List=tree_statistics_6.Paths, Index=0, Wrap=True)  # -> Item, Item1, Item2, Item3, Item4
tree_branch_21 = TreeBranch(Tree=list_item_8, Path=list_item_9.Item, MaintainPaths=True)
tree_branch_22 = TreeBranch(Tree=list_item_8, Path=list_item_9.Item1, MaintainPaths=True)
tree_branch_23 = TreeBranch(Tree=list_item_8, Path=list_item_9.Item2, MaintainPaths=True)
tree_branch_24 = TreeBranch(Tree=list_item_8, Path=list_item_9.Item3, MaintainPaths=True)
tree_branch_25 = TreeBranch(Tree=list_item_8, Path=list_item_9.Item4, MaintainPaths=True)
tree_branch_26 = TreeBranch(Tree=text_split_4, Path=tree_branch_21, MaintainPaths=True)
tree_branch_27 = TreeBranch(Tree=text_split_4, Path=tree_branch_22, MaintainPaths=True)
tree_branch_28 = TreeBranch(Tree=text_split_4, Path=tree_branch_23, MaintainPaths=True)
tree_branch_29 = TreeBranch(Tree=text_split_4, Path=tree_branch_24, MaintainPaths=True)
tree_branch_30 = TreeBranch(Tree=text_split_4, Path=tree_branch_25, MaintainPaths=True)
k_means_clustering_11 = KMeansClustering(TrainingInputs=tree_branch_27, OfClusters="4", RandomSeed=5)  # -> Result, Likelihood, Centroids
k_means_clustering_12 = KMeansClustering(TrainingInputs=tree_branch_28, OfClusters="4", RandomSeed=5)  # -> Result, Likelihood, Centroids
k_means_clustering_13 = KMeansClustering(TrainingInputs=tree_branch_29, OfClusters="4", RandomSeed=5)  # -> Result, Likelihood, Centroids
k_means_clustering_14 = KMeansClustering(TrainingInputs=tree_branch_30, OfClusters="4", RandomSeed=5)  # -> Result, Likelihood, Centroids
k_means_clustering_15 = KMeansClustering(TrainingInputs=tree_branch_26, OfClusters="4", RandomSeed=5)  # -> Result, Likelihood, Centroids
panel_9 = Panel(list_item_8)
entwine_3 = Entwine(
    Branch00=k_means_clustering_15.Result,
    Branch01=k_means_clustering_11.Result,
    Branch02=k_means_clustering_12.Result,
    Branch03=k_means_clustering_13.Result,
    Branch04=k_means_clustering_14.Result,
    FlattenInputs=True)
sort_list_5 = SortList(Keys=entwine_3, ValuesValuesA=list_item_8)  # -> Keys, ValuesValuesA

tree_statistics_7 = TreeStatistics(Tree=text_split)  # -> Paths, Length, Count
replace_text = ReplaceText(Text=sort_list_5.Keys, Find="0", Replace="a", RecursiveReplace=False)
replace_text_2 = ReplaceText(Text=sort_list_3.Keys, Find="0", Replace="a", RecursiveReplace=False)
replace_text_3 = ReplaceText(Text=replace_text, Find="1", Replace="b", RecursiveReplace=False)
replace_text_4 = ReplaceText(Text=replace_text_3, Find="2", Replace="c", RecursiveReplace=False)
replace_text_5 = ReplaceText(Text=replace_text_2, Find="1", Replace="b", RecursiveReplace=False)
list_item_10 = ListItem(List=labels_sightlines_2, Index=0, Wrap=True)  # -> Item, Item1, Item2, Item3
replace_text_6 = ReplaceText(Text=entwine, Find="0", Replace="a", RecursiveReplace=False)
replace_text_7 = ReplaceText(Text=replace_text_5, Find="2", Replace="c", RecursiveReplace=False)
replace_text_8 = ReplaceText(Text=replace_text_4, Find="3", Replace="d", RecursiveReplace=False)
list_item_11 = ListItem(List=labels_sightlines_3, Index=0, Wrap=True)  # -> Item, Item1, Item2, Item3
replace_text_9 = ReplaceText(Text=replace_text_8, Find="a", Replace=list_item_10.Item, RecursiveReplace=False)
replace_text_10 = ReplaceText(Text=replace_text_6, Find="1", Replace="b", RecursiveReplace=False)
replace_text_11 = ReplaceText(Text=replace_text_7, Find="3", Replace="d", RecursiveReplace=False)
replace_text_12 = ReplaceText(Text=replace_text_11, Find="a", Replace=list_item_11.Item, RecursiveReplace=False)
replace_text_13 = ReplaceText(Text=replace_text_9, Find="b", Replace=list_item_10.Item1, RecursiveReplace=False)
replace_text_14 = ReplaceText(Text=replace_text_10, Find="2", Replace="c", RecursiveReplace=False)
list_item_12 = ListItem(List=labels_sightlines, Index=0, Wrap=True)  # -> Item, Item1, Item2, Item3
replace_text_15 = ReplaceText(Text=replace_text_13, Find="c", Replace=list_item_10.Item2, RecursiveReplace=False)
replace_text_16 = ReplaceText(Text=replace_text_12, Find="b", Replace=list_item_11.Item1, RecursiveReplace=False)
replace_text_17 = ReplaceText(Text=replace_text_14, Find="3", Replace="d", RecursiveReplace=False)
replace_text_18 = ReplaceText(Text=replace_text_17, Find="a", Replace=list_item_12.Item, RecursiveReplace=False)
replace_text_19 = ReplaceText(Text=replace_text_16, Find="c", Replace=list_item_11.Item2, RecursiveReplace=False)
replace_text_20 = ReplaceText(Text=replace_text_15, Find="d", Replace=list_item_10.Item3, RecursiveReplace=False)
replace_text_21 = ReplaceText(Text=replace_text_18, Find="b", Replace=list_item_12.Item1, RecursiveReplace=False)
replace_text_22 = ReplaceText(Text=replace_text_19, Find="d", Replace=list_item_11.Item3, RecursiveReplace=False)
replace_text_23 = ReplaceText(Text=replace_text_21, Find="c", Replace=list_item_12.Item2, RecursiveReplace=False)
replace_text_24 = ReplaceText(Text=replace_text_23, Find="d", Replace=list_item_12.Item3, RecursiveReplace=False)
sort_list_6 = SortList(Keys=replace_text_24, ValuesValuesA=list_item_3)  # -> Keys, ValuesValuesA
text_split_5 = TextSplit(Text=sort_list_6.ValuesValuesA, Separators=";")
panel_10 = Panel(text_split_5)
create_set = CreateSet(List=replace_text_22)  # -> Set, Map
list_item_13 = ListItem(List=text_split_5, Index="4", Wrap=True)
create_set_2 = CreateSet(List=sort_list_6.Keys)  # -> Set, Map
create_set_3 = CreateSet(List=replace_text_20)  # -> Set, Map
text_split_6 = TextSplit(Text=list_item_13, Separators="}")
member_index = MemberIndex(Set=replace_text_22, Member=create_set.Set)  # -> Index, Count
member_index_2 = MemberIndex(Set=sort_list_6.Keys, Member=create_set_2.Set)  # -> Index, Count
member_index_3 = MemberIndex(Set=replace_text_20, Member=create_set_3.Set)  # -> Index, Count
create_set_4 = CreateSet(List=labels_sightlines_2)  # -> Set, Map
member_index_4 = MemberIndex(Set=labels_sightlines_2, Member=create_set_4.Set)  # -> Index, Count
list_item_14 = ListItem(List=text_split_6, Index="0", Wrap=True)

construct_point = ConstructPoint(XCoordinate=expr("x*-1", "80000"), YCoordinate=0, ZCoordinate=0)
panel_11 = Panel("200")
division_5 = Division(A="4074", B=2)
division_6 = Division(A="2250", B=2)
addition = Addition(A="4074", B=Slider(1500, range=0..2000))
dom = ConstructDomain(DomainStart=expr("x*-1", division_6), DomainEnd=division_6)
dom_2 = ConstructDomain(DomainStart=expr("x*-1", division_5), DomainEnd=division_5)
planesrf = PlaneSurface(Plane=construct_point, XSize=dom_2, YSize=dom)
series_4 = Series(Start=0, Step=addition, Count="5")
addition_2 = Addition(A="2250", B=Slider(1318, range=0..2000))
X = UnitX(Factor=series_4)
move = Move(Geometry=planesrf, Motion=X)  # -> Geometry, Transform
series_5 = Series(Start=0, Step=addition_2, Count="10")
unit_y = UnitY(Factor=expr("x*-1", series_5))
move_2 = Move(Geometry=graft(move.Geometry), Motion=unit_y)  # -> Geometry, Transform
replace_text_25 = ReplaceText(Text="1_~_programme.jpeg", Find="~", Replace=flatten(list_item_14), RecursiveReplace=False)
partition_list_7 = PartitionList(List=move_2.Geometry, Size=member_index_2.Count)
panel_12 = Panel(partition_list_7)
bounding_box = BoundingBox(Content=partition_list_7, Plane=PlaneXY(0, 0, 0), UnionBox=True)  # -> Box, Box_2
deconstruct_brep = DeconstructBrep(Brep=bounding_box.Box)  # -> Faces, Edges, Vertices
panel_13 = Panel("""2
1""")
panel_14 = Panel("""0
3""")
list_item_15 = ListItem(List=deconstruct_brep.Vertices, Index=panel_13, Wrap=True)
list_item_16 = ListItem(List=deconstruct_brep.Vertices, Index=panel_14, Wrap=True)
unit_x = UnitX(Factor="1400")
move_3 = Move(Geometry=list_item_15, Motion=unit_x)  # -> Geometry, Transform
weave = Weave(Pattern=[0, 1], Stream0=panel_2, Stream1=graft(replace_text_25), NullGaps=False)
join = TextJoin(Text=weave)  # -> flatten(Result)
weave_2 = Weave(Pattern=[1, 1, 0, 0], Stream0=move_3.Geometry, Stream1=list_item_16, NullGaps=False)
polyline = PolyLine(Vertices=weave_2, Closed=True)
previewmat = CustomPreviewMaterials(Geometry=flatten(move_2.Geometry), DiffuseColor=RGB(255, 255, 255), DiffuseBitmap=flatten(join))
boundary_surfaces = BoundarySurfaces(Edges=polyline)
unit_z = UnitZ(Factor="1")
trim_tree = TrimTree(Tree=polyline, Depth=2)
merge = Merge(
    Data1=ColourSwatch(SwatchColor=RGB(255, 0, 0)),
    Data2=ColourSwatch(SwatchColor=RGB(255, 149, 0)),
    Data3=ColourSwatch(SwatchColor=RGB(0, 64, 255)),
    Data4=ColourSwatch(SwatchColor=RGB(151, 196, 0)))
move_4 = Move(Geometry=boundary_surfaces, Motion=unit_z)  # -> Geometry, Transform
trim_tree_2 = TrimTree(Tree=move_4.Geometry, Depth=2)
create_material = CreateMaterial(Diffuse=merge, Specular=RGB(255, 255, 255), Emission=RGB(0, 0, 0), Transparency=Slider(0.864, range=0..1), Shine=0)
list_length = ListLength(List=trim_tree_2)
series_6 = Series(Start=0, Step=1, Count=list_length)
list_item_17 = ListItem(List=merge, Index=series_6, Wrap=True)
list_item_18 = ListItem(List=create_material, Index=series_6, Wrap=True)
custom_preview_lineweights = CustomPreviewLineweights(Geometry=trim_tree, Shader=list_item_17, Thickness="3", Absolute=False)
custom_preview = CustomPreview(Geometry=trim_tree_2, Material=list_item_18)

construct_point_2 = ConstructPoint(XCoordinate=expr("x*-1", "40000"), YCoordinate=0, ZCoordinate=0)
division_7 = Division(A="4074", B=2)
division_8 = Division(A="2250", B=2)
addition_3 = Addition(A="4074", B=Slider(1500, range=0..2000))
dom_3 = ConstructDomain(DomainStart=expr("x*-1", division_8), DomainEnd=division_8)
dom_4 = ConstructDomain(DomainStart=expr("x*-1", division_7), DomainEnd=division_7)
planesrf_2 = PlaneSurface(Plane=construct_point_2, XSize=dom_4, YSize=dom_3)
series_7 = Series(Start=0, Step=addition_3, Count="5")
addition_4 = Addition(A="2250", B=Slider(1318, range=0..2000))
X_2 = UnitX(Factor=series_7)
move_5 = Move(Geometry=planesrf_2, Motion=X_2)  # -> Geometry, Transform
series_8 = Series(Start=0, Step=addition_4, Count="10")
unit_y_2 = UnitY(Factor=expr("x*-1", series_8))
move_6 = Move(Geometry=graft(move_5.Geometry), Motion=unit_y_2)  # -> Geometry, Transform
replace_text_26 = ReplaceText(Text="1_~_programme2.jpeg", Find="~", Replace=flatten(list_item_14), RecursiveReplace=False)
partition_list_8 = PartitionList(List=move_6.Geometry, Size=member_index.Count)
panel_16 = Panel(partition_list_8)
bounding_box_2 = BoundingBox(Content=partition_list_8, Plane=PlaneXY(0, 0, 0), UnionBox=True)  # -> Box, Box_2
deconstruct_brep_2 = DeconstructBrep(Brep=bounding_box_2.Box)  # -> Faces, Edges, Vertices
panel_17 = Panel("""2
1""")
panel_18 = Panel("""0
3""")
list_item_19 = ListItem(List=deconstruct_brep_2.Vertices, Index=panel_17, Wrap=True)
list_item_20 = ListItem(List=deconstruct_brep_2.Vertices, Index=panel_18, Wrap=True)
unit_x_2 = UnitX(Factor="1400")
move_7 = Move(Geometry=list_item_19, Motion=unit_x_2)  # -> Geometry, Transform
weave_3 = Weave(Pattern=[0, 1], Stream0=panel_2, Stream1=graft(replace_text_26), NullGaps=False)
join_2 = TextJoin(Text=weave_3)  # -> flatten(Result)
weave_4 = Weave(Pattern=[1, 1, 0, 0], Stream0=move_7.Geometry, Stream1=list_item_20, NullGaps=False)
polyline_2 = PolyLine(Vertices=weave_4, Closed=True)
previewmat_2 = CustomPreviewMaterials(Geometry=flatten(move_6.Geometry), DiffuseColor=RGB(255, 255, 255), DiffuseBitmap=flatten(join_2))
boundary_surfaces_2 = BoundarySurfaces(Edges=polyline_2)
unit_z_2 = UnitZ(Factor="1")
trim_tree_3 = TrimTree(Tree=polyline_2, Depth=2)
merge_2 = Merge(
    Data1=ColourSwatch(SwatchColor=RGB(255, 0, 0)),
    Data2=ColourSwatch(SwatchColor=RGB(255, 149, 0)),
    Data3=ColourSwatch(SwatchColor=RGB(0, 64, 255)),
    Data4=ColourSwatch(SwatchColor=RGB(151, 196, 0)))
move_8 = Move(Geometry=boundary_surfaces_2, Motion=unit_z_2)  # -> Geometry, Transform
trim_tree_4 = TrimTree(Tree=move_8.Geometry, Depth=2)
create_material_2 = CreateMaterial(Diffuse=merge_2, Specular=RGB(255, 255, 255), Emission=RGB(0, 0, 0), Transparency=Slider(0.864, range=0..1), Shine=0)
list_length_2 = ListLength(List=trim_tree_4)
series_9 = Series(Start=0, Step=1, Count=list_length_2)
list_item_21 = ListItem(List=merge_2, Index=series_9, Wrap=True)
list_item_22 = ListItem(List=create_material_2, Index=series_9, Wrap=True)
custom_preview_lineweights_2 = CustomPreviewLineweights(Geometry=trim_tree_3, Shader=list_item_21, Thickness="3", Absolute=False)
custom_preview_2 = CustomPreview(Geometry=trim_tree_4, Material=list_item_22)

division_9 = Division(A="4074", B=2)
division_10 = Division(A="2250", B=2)
addition_5 = Addition(A="4074", B=Slider(1500, range=0..2000))
dom_5 = ConstructDomain(DomainStart=expr("x*-1", division_10), DomainEnd=division_10)
dom_6 = ConstructDomain(DomainStart=expr("x*-1", division_9), DomainEnd=division_9)
planesrf_3 = PlaneSurface(Plane=PlaneXY(0, 0, 0), XSize=dom_6, YSize=dom_5)
series_10 = Series(Start=0, Step=addition_5, Count="5")
addition_6 = Addition(A="2250", B=Slider(1318, range=0..2000))
X_3 = UnitX(Factor=series_10)
move_9 = Move(Geometry=planesrf_3, Motion=X_3)  # -> Geometry, Transform
series_11 = Series(Start=0, Step=addition_6, Count="10")
unit_y_3 = UnitY(Factor=expr("x*-1", series_11))
move_10 = Move(Geometry=graft(move_9.Geometry), Motion=unit_y_3)  # -> Geometry, Transform
replace_text_27 = ReplaceText(Text="1_~_stadium exit.jpeg", Find="~", Replace=flatten(list_item_14), RecursiveReplace=False)
partition_list_9 = PartitionList(List=move_10.Geometry, Size=member_index_3.Count)
panel_20 = Panel(partition_list_9)
bounding_box_3 = BoundingBox(Content=partition_list_9, Plane=PlaneXY(0, 0, 0), UnionBox=True)  # -> Box, Box_2
deconstruct_brep_3 = DeconstructBrep(Brep=bounding_box_3.Box)  # -> Faces, Edges, Vertices
panel_21 = Panel("""2
1""")
panel_22 = Panel("""0
3""")
list_item_23 = ListItem(List=deconstruct_brep_3.Vertices, Index=panel_21, Wrap=True)
list_item_24 = ListItem(List=deconstruct_brep_3.Vertices, Index=panel_22, Wrap=True)
unit_x_3 = UnitX(Factor="1400")
move_11 = Move(Geometry=list_item_23, Motion=unit_x_3)  # -> Geometry, Transform
weave_5 = Weave(Pattern=[0, 1], Stream0=panel_2, Stream1=graft(replace_text_27), NullGaps=False)
join_3 = TextJoin(Text=weave_5)  # -> flatten(Result)
weave_6 = Weave(Pattern=[1, 1, 0, 0], Stream0=move_11.Geometry, Stream1=list_item_24, NullGaps=False)
previewmat_3 = CustomPreviewMaterials(Geometry=flatten(move_10.Geometry), DiffuseColor=RGB(255, 255, 255), DiffuseBitmap=flatten(join_3))
polyline_3 = PolyLine(Vertices=weave_6, Closed=True)
boundary_surfaces_3 = BoundarySurfaces(Edges=polyline_3)
unit_z_3 = UnitZ(Factor="1")
trim_tree_5 = TrimTree(Tree=polyline_3, Depth=2)
merge_3 = Merge(
    Data1=ColourSwatch(SwatchColor=RGB(255, 0, 0)),
    Data2=ColourSwatch(SwatchColor=RGB(255, 149, 0)),
    Data3=ColourSwatch(SwatchColor=RGB(0, 64, 255)),
    Data4=ColourSwatch(SwatchColor=RGB(151, 196, 0)))
move_12 = Move(Geometry=boundary_surfaces_3, Motion=unit_z_3)  # -> Geometry, Transform
trim_tree_6 = TrimTree(Tree=move_12.Geometry, Depth=2)
create_material_3 = CreateMaterial(Diffuse=merge_3, Specular=RGB(255, 255, 255), Emission=RGB(0, 0, 0), Transparency=Slider(0.864, range=0..1), Shine=0)
list_length_3 = ListLength(List=trim_tree_6)
series_12 = Series(Start=0, Step=1, Count=list_length_3)
list_item_25 = ListItem(List=merge_3, Index=series_12, Wrap=True)
list_item_26 = ListItem(List=create_material_3, Index=series_12, Wrap=True)
custom_preview_lineweights_3 = CustomPreviewLineweights(Geometry=trim_tree_5, Shader=list_item_25, Thickness="3", Absolute=False)
custom_preview_3 = CustomPreview(Geometry=trim_tree_6, Material=list_item_26)

list_item_27 = ListItem(List=tree_statistics_7.Paths, Index=list_item_14, Wrap=True)
entwine_4 = Entwine(
    Branch00=flatten(replace_text_20),
    Branch01=flatten(replace_text_22),
    Branch02=flatten(sort_list_6.Keys),
    FlattenInputs=True)
list_length_4 = ListLength(List=create_set_4.Set)
list_item_28 = ListItem(List=member_index_4.Index, Index=0, Wrap=True)
tree_branch_31 = TreeBranch(Tree=text_split, Path=list_item_27, MaintainPaths=False)
create_set_5 = CreateSet(List=labels_sightlines)  # -> Set, Map
list_item_29 = ListItem(List=labels_sightlines_2, Index=flatten(list_item_28), Wrap=True)
flip_matrix = FlipMatrix(Data=entwine_4)
member_index_5 = MemberIndex(Set=labels_sightlines, Member=create_set_5.Set)  # -> Index, Count
create_set_6 = CreateSet(List=labels_sightlines_3)  # -> Set, Map
replace_text_28 = ReplaceText(Text=list_item_3, Find=";0}", Replace="}", RecursiveReplace=False)
member_index_6 = MemberIndex(Set=labels_sightlines_3, Member=create_set_6.Set)  # -> Index, Count
split_list_3 = SplitList(List=flatten(bounding_box_3.Box), Index=list_length_4)  # -> ListA, ListB
list_length_5 = ListLength(List=create_set_5.Set)
list_item_30 = ListItem(List=member_index_5.Index, Index=0, Wrap=True)
panel_23 = Panel("""0
2
3""")
panel_24 = Panel("""0
1
2
5
8
9""")
deconstruct_brep_4 = DeconstructBrep(Brep=split_list_3.ListA)  # -> Faces, Edges, Vertices
panel_25 = Panel(flip_matrix)
list_length_6 = ListLength(List=create_set_6.Set)
list_item_31 = ListItem(List=member_index_6.Index, Index=0, Wrap=True)
list_item_32 = ListItem(List=labels_sightlines, Index=flatten(list_item_30), Wrap=True)
tree_branch_32 = TreeBranch(Tree=text_split, Path=flatten(replace_text_28), MaintainPaths=True)
mass_addition_5 = MassAddition(Input=flip_matrix)  # -> Result, PartialResults
panel_26 = Panel("""0
2
3""")
list_item_33 = ListItem(List=reverse(tree_branch_31), Index="1", Wrap=True)
panel_27 = Panel("""0
1
2
5
8
9""")
list_item_34 = ListItem(List=deconstruct_brep_4.Vertices, Index=0, Wrap=True)
unit_x_4 = UnitX(Factor="-2500")
list_item_35 = ListItem(List=labels_sightlines_3, Index=flatten(list_item_31), Wrap=True)
list_item_36 = ListItem(List=reverse(text_split), Index=panel_23, Wrap=True)
list_item_37 = ListItem(List=text_split, Index=panel_24, Wrap=True)
split_list_4 = SplitList(List=flatten(bounding_box.Box), Index=list_length_5)  # -> ListA, ListB
bounds = Bounds(Numbers=flatten(mass_addition_5.Result))
move_13 = Move(Geometry=list_item_34, Motion=unit_x_4)  # -> Geometry, Transform
list_item_38 = ListItem(List=reverse(tree_branch_32), Index=panel_26, Wrap=True)
merge_4 = Merge(Data1=list_item_37, Data2=list_item_36)
list_item_39 = ListItem(List=tree_branch_32, Index=panel_27, Wrap=True)
split_list_5 = SplitList(List=flatten(bounding_box_2.Box), Index=list_length_6)  # -> ListA, ListB
text_split_7 = TextSplit(Text=list_item_33, Separators=";")
deconstruct_brep_5 = DeconstructBrep(Brep=split_list_4.ListA)  # -> Faces, Edges, Vertices
# circulation
# 
# seats close to bowl exit
# seats to gangway
# Seats to stadium exit
# 
# 
# Capacity
panel_28 = Panel("""0
1
2""")
remap_numbers = RemapNumbers(Value=mass_addition_5.Result, Source=bounds, Target="-1 To 1")  # -> Mapped, Clipped
merge_5 = Merge(Data1=list_item_39, Data2=list_item_38)
deconstruct_brep_6 = DeconstructBrep(Brep=split_list_5.ListA)  # -> Faces, Edges, Vertices
flip_matrix_2 = FlipMatrix(Data=merge_4)
list_item_40 = ListItem(List=tree_branch_31, Index=panel_28, Wrap=True)
list_item_41 = ListItem(List=deconstruct_brep_5.Vertices, Index=0, Wrap=True)
unit_x_5 = UnitX(Factor="-2500")
list_item_42 = ListItem(List=text_split_7, Index=0, Wrap=True)  # -> Item, Item1, Item2, Item3
text_tag_3d = TextTag3D(
    Location=move_13.Geometry,
    Text=graft(list_item_29),
    Size="1500",
    Colour=ColourSwatch(SwatchColor=RGB(0, 0, 0)),
    Justification=7)
bounds_2 = Bounds(Numbers=flip_matrix_2)
list_item_43 = ListItem(List=deconstruct_brep_6.Vertices, Index=0, Wrap=True)
unit_x_6 = UnitX(Factor="-2500")

# ---- group: Circulation
mass_addition_6 = MassAddition(Input=list_item_40)  # -> Result, PartialResults
bounds_3 = Bounds(Numbers=flatten(mass_addition_6.Result))
deconstruct_domain = DeconstructDomain(Domain=bounds_3)  # -> Start, End
construct_domain = ConstructDomain(DomainStart=0, DomainEnd=deconstruct_domain.End)
panel_29 = Panel("0 To 1")
remap_numbers_2 = RemapNumbers(Value=mass_addition_6.Result, Source=construct_domain, Target=panel_29)  # -> Mapped, Clipped

# ---- group: capacity
list_item_44 = ListItem(List=tree_branch_31, Index="5", Wrap=True)
mass_addition_7 = MassAddition(Input=list_item_44)  # -> Result, PartialResults
bounds_4 = Bounds(Numbers=flatten(mass_addition_7.Result))
deconstruct_domain_2 = DeconstructDomain(Domain=bounds_4)  # -> Start, End
construct_domain_2 = ConstructDomain(DomainStart=0, DomainEnd=deconstruct_domain_2.End)
remap_numbers_3 = RemapNumbers(Value=mass_addition_7.Result, Source=construct_domain_2, Target=panel_29)  # -> Mapped, Clipped

# ---- group: sightlines
list_item_45 = ListItem(List=reverse(tree_branch_31), Index="0", Wrap=True)
mass_addition_8 = MassAddition(Input=list_item_45)  # -> Result, PartialResults
bounds_5 = Bounds(Numbers=flatten(mass_addition_8.Result))
deconstruct_domain_3 = DeconstructDomain(Domain=bounds_5)  # -> Start, End
construct_domain_3 = ConstructDomain(DomainStart=0, DomainEnd=deconstruct_domain_3.End)
remap_numbers_4 = RemapNumbers(Value=mass_addition_8.Result, Source=construct_domain_3, Target=panel_29)  # -> Mapped, Clipped

# ----
flip_matrix_3 = FlipMatrix(Data=merge_5)
move_14 = Move(Geometry=list_item_41, Motion=unit_x_5)  # -> Geometry, Transform

# ---- group: service
mass_addition_9 = MassAddition(Input=list_item_42.Item1)  # -> Result, PartialResults
bounds_6 = Bounds(Numbers=flatten(mass_addition_9.Result))
deconstruct_domain_4 = DeconstructDomain(Domain=bounds_6)  # -> Start, End
construct_domain_4 = ConstructDomain(DomainStart=0, DomainEnd=deconstruct_domain_4.End)
remap_numbers_5 = RemapNumbers(Value=mass_addition_9.Result, Source=construct_domain_4, Target=panel_29)  # -> Mapped, Clipped

# ---- group: performers
mass_addition_10 = MassAddition(Input=list_item_42.Item2)  # -> Result, PartialResults
bounds_7 = Bounds(Numbers=flatten(mass_addition_10.Result))
deconstruct_domain_5 = DeconstructDomain(Domain=bounds_7)  # -> Start, End
construct_domain_5 = ConstructDomain(DomainStart=0, DomainEnd=deconstruct_domain_5.End)
remap_numbers_6 = RemapNumbers(Value=mass_addition_10.Result, Source=construct_domain_5, Target=panel_29)  # -> Mapped, Clipped

# ---- group: concourse
mass_addition_11 = MassAddition(Input=list_item_42.Item2)  # -> Result, PartialResults
bounds_8 = Bounds(Numbers=flatten(mass_addition_11.Result))
deconstruct_domain_6 = DeconstructDomain(Domain=bounds_8)  # -> Start, End
construct_domain_6 = ConstructDomain(DomainStart=0, DomainEnd=deconstruct_domain_6.End)
remap_numbers_7 = RemapNumbers(Value=mass_addition_11.Result, Source=construct_domain_6, Target=panel_29)  # -> Mapped, Clipped

# ----
move_15 = Move(Geometry=list_item_43, Motion=unit_x_6)  # -> Geometry, Transform
remap_numbers_8 = RemapNumbers(Value=flip_matrix_2, Source=bounds_2, Target="-1 To 1")  # -> Mapped, Clipped
text_tag_3d_2 = TextTag3D(
    Location=move_14.Geometry,
    Text=graft(list_item_32),
    Size="1500",
    Colour=ColourSwatch(SwatchColor=RGB(0, 0, 0)),
    Justification=7)
flip_matrix_4 = FlipMatrix(Data=remap_numbers_8.Mapped)
remap_numbers_9 = RemapNumbers(Value=flip_matrix_3, Source=bounds_2, Target="-1 To 1")  # -> Mapped, Clipped
text_tag_3d_3 = TextTag3D(
    Location=move_15.Geometry,
    Text=graft(list_item_35),
    Size="1500",
    Colour=ColourSwatch(SwatchColor=RGB(0, 0, 0)),
    Justification=7)
flip_matrix_5 = FlipMatrix(Data=remap_numbers_9.Mapped)
panel_30 = Panel(list_item_14)

neural_network_trainer = NeuralNetworkTrainer(
    TrainingInputs=flip_matrix_5,
    TrainingOutputs=remap_numbers.Mapped,
    InputNeurons=2,
    HiddenNeurons=2,
    Alpha=2,
    Iterations=500)  # -> TrainedNueralNetwork, ErrorsDynamics
neural_network_testing = NeuralNetworkTesting(TrainedNeuralNetwork=neural_network_trainer.TrainedNueralNetwork, TestInputData=flip_matrix_4)

number_slider_4 = Slider(7, range=0..10)
panel_31 = Panel("""0
1
2
3
4
5
6""")
area = Area(Geometry=move_10.Geometry)  # -> Area, flatten(Centroid)
unit_y_4 = UnitY(Factor="-500")
unit_x_7 = UnitX(Factor="2600")
division_11 = Division(A="360", B=number_slider_4)
unit_y_5 = UnitY(Factor=Slider(333, range=0..1000))
series_13 = Series(Start=division_11, Step=division_11, Count=number_slider_4)
addition_7 = Addition(A=unit_y_4, B=unit_x_7)
remap_numbers_10 = RemapNumbers(Value=neural_network_testing, Source="-1 To 1", Target="0 To 9")  # -> Mapped, Clipped
move_16 = Move(Geometry=area.Centroid, Motion=addition_7)  # -> Geometry, Transform
tree_statistics_8 = TreeStatistics(Tree=remap_numbers_10.Mapped)  # -> Paths, Length, Count
round = Round(Number=remap_numbers_10.Mapped)  # -> Nearest, Floor, Ceiling
move_17 = Move(Geometry=move_16.Geometry, Motion=unit_y_5)  # -> Geometry, Transform
sort_list_7 = SortList(Keys=flatten(round.Nearest), ValuesValuesA=tree_statistics_8.Paths)  # -> Keys, ValuesValuesA
panel_32 = Panel(remap_numbers_10.Mapped)
line = Line(StartPoint=move_16.Geometry, EndPoint=move_17.Geometry)
create_set_7 = CreateSet(List=flatten(sort_list_7.Keys))  # -> Set, Map
rotate = Rotate(Geometry=graft(line), Angle=degrees(series_13), Plane=graft(move_16.Geometry))  # -> Geometry, Transform
member_index_7 = MemberIndex(Set=flatten(sort_list_7.Keys), Member=create_set_7.Set)  # -> Index, Count
series_14 = Series(Start=0, Step="40000", Count=3)
partition_list_10 = PartitionList(List=sort_list_7.ValuesValuesA, Size=member_index_7.Count)
group = Group(Objects=rotate.Geometry)
end_points = EndPoints(Curve=rotate.Geometry)  # -> Start, End
unit_x_8 = UnitX(Factor="40000")
unit_x_9 = UnitX(Factor=expr("x*-1", series_14))
vector_2pt = Vector2Pt(PointA=end_points.Start, PointB=end_points.End, Unitize=False)  # -> Vector, Length
split_list_6 = SplitList(List=partition_list_10, Index="5")  # -> ListA, ListB
move_18 = Move(Geometry=planesrf_3, Motion=unit_x_8)  # -> Geometry, Transform
text_split_8 = TextSplit(Text=split_list_6.ListA, Separators=";")
amplitude = Amplitude(Vector=vector_2pt.Vector, Amplitude=Slider(190, range=0..1000))
move_19 = Move(Geometry=group, Motion=unit_x_9)  # -> Geometry, Transform
panel_33 = Panel(split_list_6.ListA)
move_20 = Move(Geometry=move_18.Geometry, Motion=X_3)  # -> Geometry, Transform
move_21 = Move(Geometry=end_points.End, Motion=amplitude)  # -> Geometry, Transform
list_item_46 = ListItem(List=reverse(text_split_8), Index=0, Wrap=True)
unit_x_10 = UnitX(Factor=expr("x*-1", Slider(169, range=0..1000)))
text_split_9 = TextSplit(Text=list_item_46, Separators="}")
move_22 = Move(Geometry=graft(move_20.Geometry), Motion=unit_y_3)  # -> Geometry, Transform
panel_34 = Panel("""Circulation
Capacity
Sightlines
Hospitality
Service
Performers
Concourse""")
number_slider_5 = Slider(62, range=0..1000)
move_23 = Move(Geometry=move_21.Geometry, Motion=unit_x_10)  # -> Geometry, Transform
group_2 = Group(Objects=move_23.Geometry)
move_24 = Move(Geometry=group_2, Motion=unit_x_9)  # -> Geometry, Transform
list_item_47 = ListItem(List=text_split_9, Index=0, Wrap=True)  # -> reverse(flatten(Item))
graft_tree = GraftTree(Tree=list_item_47, IncludeEmptyLists=True, IncludeNullItems=True)
flip_matrix_6 = FlipMatrix(Data=move_22.Geometry)
ungroup = Ungroup(Group=move_24.Geometry)
bounding_box_4 = BoundingBox(Content=flip_matrix_6, Plane=PlaneXY(0, 0, 0), UnionBox=True)  # -> Box, Box_2
replace_text_29 = ReplaceText(Text="1_~_section.jpeg", Find="~", Replace=flatten(graft_tree), RecursiveReplace=False)
text_tag_3d_4 = TextTag3D(Location=ungroup, Text=panel_34, Size=number_slider_5, Colour=ColourSwatch(SwatchColor=RGB(0, 0, 0)), Justification=7)
panel_35 = Panel(list_item_47)
deconstruct_brep_7 = DeconstructBrep(Brep=bounding_box_4.Box)  # -> Faces, Edges, Vertices
list_item_48 = ListItem(List=deconstruct_brep_7.Vertices, Index=0, Wrap=True)  # -> Item, Item1, Item2, Item3
unit_x_11 = UnitX(Factor="1500")
move_25 = Move(Geometry=[list_item_48.Item2, list_item_48.Item1], Motion=unit_x_11)  # -> Geometry, Transform
polyline_4 = PolyLine(Vertices=[move_25.Geometry, list_item_48.Item, list_item_48.Item3], Closed=True)
construct_domain_7 = ConstructDomain(DomainStart=Slider(0.904, range=0..1), DomainEnd=Slider(0.56, range=0..1))
colour_swatch = ColourSwatch(SwatchColor=RGB(0, 0, 0))
custom_preview_lineweights_4 = CustomPreviewLineweights(Geometry=move_19.Geometry, Shader=colour_swatch, Thickness=".5", Absolute=False)
offset_curve = OffsetCurve(Curve=polyline_4, Distance="200", Corners=1)
control_points = ControlPoints(Curve=offset_curve)  # -> Points, Weights, Knots
weave_7 = Weave(Pattern=[0, 1], Stream0=panel_2, Stream1=graft(replace_text_29), NullGaps=False)
unit_x_12 = UnitX(Factor="-1000")
list_item_49 = ListItem(List=control_points.Points, Index=2, Wrap=True)
join_4 = TextJoin(Text=weave_7)  # -> flatten(Result)
colour_swatch_2 = ColourSwatch(SwatchColor=RGB(0, 0, 0))
move_26 = Move(Geometry=list_item_49, Motion=unit_x_12)  # -> Geometry, Transform
previewmat_4 = CustomPreviewMaterials(Geometry=flatten(flip_matrix_6), DiffuseColor=RGB(255, 255, 255), DiffuseBitmap=flatten(join_4))
series_15 = Series(Start=1, Step=1, Count=10)
custom_preview_lineweights_5 = CustomPreviewLineweights(Geometry=offset_curve, Shader=colour_swatch_2, Thickness="3", Absolute=False)
list_item_50 = ListItem(List=tree_statistics_7.Paths, Index=graft_tree, Wrap=True)
tree_branch_33 = TreeBranch(Tree=text_split, Path=list_item_50, MaintainPaths=False)
text_tag_3d_5 = TextTag3D(Location=move_26.Geometry, Text=graft(series_15), Size="500", Colour=colour_swatch_2, Justification=7)
list_item_51 = ListItem(List=reverse(tree_branch_33), Index="1", Wrap=True)
text_split_10 = TextSplit(Text=list_item_51, Separators=";")
# circulation
# 
# seats close to bowl exit
# seats to gangway
# Seats to stadium exit
# 
# 
# Capacity
panel_36 = Panel("""0
1
2""")
# seats close to bowl exit
# seats to gangway
# Seats to stadium exit
# seat to masterplan
# file name
# capacity
# masterplan split areas
# iteration number
# roof area
# building footprint
# facade area
# number of element types
# total number of elements
# Areas
# top sightline seats
panel_37 = Panel("5")
list_item_52 = ListItem(List=reverse(tree_branch_33), Index="0", Wrap=True)
list_item_53 = ListItem(List=tree_branch_33, Index=panel_36, Wrap=True)
list_item_54 = ListItem(List=text_split_10, Index=0, Wrap=True)  # -> Item, Item1, Item2, Item3
mass_addition_12 = MassAddition(Input=list_item_54.Item)  # -> Result, PartialResults
list_item_55 = ListItem(List=tree_branch_33, Index=panel_37, Wrap=True)
larger_than = LargerThan(FirstNumber=flatten(mass_addition_12.Result), SecondNumber=0)  # -> LargerThan, OrEqualTo
list_length_7 = ListLength(List=flatten(mass_addition_12.Result))
mass_addition_13 = MassAddition(Input=list_item_53)  # -> Result, PartialResults
mass_addition_14 = MassAddition(Input=list_item_55)  # -> Result, PartialResults
mass_addition_15 = MassAddition(Input=list_item_52)  # -> Result, PartialResults
series_16 = Series(Start=0, Step=1, Count=list_length_7)
mass_addition_16 = MassAddition(Input=list_item_54.Item1)  # -> Result, PartialResults
mass_addition_17 = MassAddition(Input=list_item_54.Item2)  # -> Result, PartialResults
mass_addition_18 = MassAddition(Input=list_item_54.Item3)  # -> Result, PartialResults
bounds_9 = Bounds(Numbers=flatten(mass_addition_13.Result))
dispatch = Dispatch(List=series_16, DispatchPattern=larger_than.LargerThan)  # -> ListA, ListB
bounds_10 = Bounds(Numbers=flatten(mass_addition_14.Result))
bounds_11 = Bounds(Numbers=flatten(mass_addition_15.Result))
bounds_12 = Bounds(Numbers=flatten(mass_addition_16.Result))
bounds_13 = Bounds(Numbers=flatten(mass_addition_17.Result))
bounds_14 = Bounds(Numbers=flatten(mass_addition_18.Result))
deconstruct_domain_7 = DeconstructDomain(Domain=bounds_9)  # -> Start, End
deconstruct_domain_8 = DeconstructDomain(Domain=bounds_10)  # -> Start, End
deconstruct_domain_9 = DeconstructDomain(Domain=bounds_11)  # -> Start, End
replace_items = ReplaceItems(List=flatten(mass_addition_12.Result), Item="300", Indices=dispatch.ListB, Wrap=False)  # -> graft(List)
bounds_15 = Bounds(Numbers=flatten(replace_items))
deconstruct_domain_10 = DeconstructDomain(Domain=bounds_15)  # -> Start, End
deconstruct_domain_11 = DeconstructDomain(Domain=bounds_12)  # -> Start, End
deconstruct_domain_12 = DeconstructDomain(Domain=bounds_13)  # -> Start, End
deconstruct_domain_13 = DeconstructDomain(Domain=bounds_14)  # -> Start, End
construct_domain_8 = ConstructDomain(DomainStart=0, DomainEnd=deconstruct_domain_7.End)
construct_domain_9 = ConstructDomain(DomainStart=0, DomainEnd=deconstruct_domain_8.End)
construct_domain_10 = ConstructDomain(DomainStart=0, DomainEnd=deconstruct_domain_9.End)
construct_domain_11 = ConstructDomain(DomainStart=0, DomainEnd=deconstruct_domain_10.End)
construct_domain_12 = ConstructDomain(DomainStart=0, DomainEnd=deconstruct_domain_11.End)
construct_domain_13 = ConstructDomain(DomainStart=0, DomainEnd=deconstruct_domain_12.End)
construct_domain_14 = ConstructDomain(DomainStart=0, DomainEnd=deconstruct_domain_13.End)
remap_numbers_11 = RemapNumbers(Value=mass_addition_13.Result, Source=construct_domain_8, Target="0 To 1")  # -> Mapped, Clipped
remap_numbers_12 = RemapNumbers(Value=mass_addition_14.Result, Source=construct_domain_9, Target="0 To 1")  # -> Mapped, Clipped
remap_numbers_13 = RemapNumbers(Value=mass_addition_15.Result, Source=construct_domain_10, Target="0 To 1")  # -> Mapped, Clipped
remap_numbers_14 = RemapNumbers(Value=replace_items, Source=construct_domain_11, Target="0 To 1")  # -> Mapped, Clipped
remap_numbers_15 = RemapNumbers(Value=mass_addition_16.Result, Source=construct_domain_12, Target="0 To 1")  # -> Mapped, Clipped
remap_numbers_16 = RemapNumbers(Value=mass_addition_17.Result, Source=construct_domain_13, Target="0 To 1")  # -> Mapped, Clipped
remap_numbers_17 = RemapNumbers(Value=mass_addition_18.Result, Source=construct_domain_14, Target="0 To 1")  # -> Mapped, Clipped
number_slider_6 = Slider(7, range=0..10)
panel_39 = Panel("""0
1
2
3
4
5
6""")
area_2 = Area(Geometry=flip_matrix_6)  # -> Area, flatten(Centroid)
unit_y_6 = UnitY(Factor="-500")
unit_x_13 = UnitX(Factor="2600")
division_12 = Division(A="360", B=number_slider_6)
weave_8 = Weave(
    Pattern=panel_39,
    Stream0=remap_numbers_11.Mapped,
    Stream1=remap_numbers_12.Mapped,
    Stream2=remap_numbers_13.Mapped,
    Stream3=remap_numbers_14.Mapped,
    Stream4=remap_numbers_15.Mapped,
    Stream5=remap_numbers_16.Mapped,
    Stream6=remap_numbers_17.Mapped,
    NullGaps=False)  # -> simplify(Weave)
unit_y_7 = UnitY(Factor=Slider(333, range=0..1000))
series_17 = Series(Start=division_12, Step=division_12, Count=number_slider_6)
addition_8 = Addition(A=unit_y_6, B=unit_x_13)
move_27 = Move(Geometry=area_2.Centroid, Motion=addition_8)  # -> Geometry, Transform
move_28 = Move(Geometry=move_27.Geometry, Motion=unit_y_7)  # -> Geometry, Transform
line_2 = Line(StartPoint=move_27.Geometry, EndPoint=move_28.Geometry)
rotate_2 = Rotate(Geometry=graft(line_2), Angle=degrees(series_17), Plane=graft(move_27.Geometry))  # -> Geometry, Transform
evaluate_curve = EvaluateCurve(Curve=reparameterize(rotate_2.Geometry), Parameter=weave_8)  # -> Point, Tangent, Angle
end_points_2 = EndPoints(Curve=rotate_2.Geometry)  # -> Start, End
polyline_5 = PolyLine(Vertices=evaluate_curve.Point, Closed=True)
vector_2pt_2 = Vector2Pt(PointA=end_points_2.Start, PointB=end_points_2.End, Unitize=False)  # -> Vector, Length
boundary_surfaces_4 = BoundarySurfaces(Edges=polyline_5)
amplitude_2 = Amplitude(Vector=vector_2pt_2.Vector, Amplitude=Slider(190, range=0..1000))
area_3 = Area(Geometry=boundary_surfaces_4)  # -> Area, Centroid
list_item_56 = ListItem(List=reverse(text_split), Index="1", Wrap=True)
move_29 = Move(Geometry=end_points_2.End, Motion=amplitude_2)  # -> Geometry, Transform
bounds_16 = Bounds(Numbers=flatten(area_3.Area))
unit_x_14 = UnitX(Factor=expr("x*-1", Slider(169, range=0..1000)))
panel_40 = Panel("""0
1
2""")
text_split_11 = TextSplit(Text=list_item_56, Separators=";")
deconstruct_domain_14 = DeconstructDomain(Domain=bounds_16)  # -> Start, End
move_30 = Move(Geometry=move_29.Geometry, Motion=unit_x_14)  # -> Geometry, Transform
list_item_57 = ListItem(List=reverse(text_split), Index="0", Wrap=True)
list_item_58 = ListItem(List=text_split, Index=panel_40, Wrap=True)
list_item_59 = ListItem(List=text_split, Index="5", Wrap=True)
list_item_60 = ListItem(List=text_split_11, Index=0, Wrap=True)  # -> Item, Item1, Item2, Item3
construct_domain_15 = ConstructDomain(DomainStart=0, DomainEnd=deconstruct_domain_14.End)
construct_domain_16 = ConstructDomain(DomainStart=Slider(0.904, range=0..1), DomainEnd=Slider(0.56, range=0..1))
colour_swatch_3 = ColourSwatch(SwatchColor=RGB(0, 0, 0))
remap_numbers_18 = RemapNumbers(Value=boundary_surfaces_4, Source=bounds_16, Target=construct_domain_16)  # -> Mapped, Clipped
text_tag_3d_6 = TextTag3D(
    Location=move_30.Geometry,
    Text=panel_34,
    Size=number_slider_5,
    Colour=ColourSwatch(SwatchColor=RGB(0, 0, 0)),
    Justification=7)
weave_9 = Weave(
    Pattern=[0, 0, 1, 2, 3, 4, 5, 6],
    Stream0=list_item_58,
    Stream1=list_item_59,
    Stream2=list_item_57,
    Stream3=list_item_60.Item,
    Stream4=list_item_60.Item1,
    Stream5=list_item_60.Item2,
    Stream6=list_item_60.Item3,
    NullGaps=False)
create_material_4 = CreateMaterial(
    Diffuse=colour_swatch_3,
    Specular=RGB(255, 255, 255),
    Emission=RGB(0, 0, 0),
    Transparency=remap_numbers_18.Mapped,
    Shine=0)
custom_preview_lineweights_6 = CustomPreviewLineweights(Geometry=rotate_2.Geometry, Shader=colour_swatch_3, Thickness=".5", Absolute=False)
custom_preview_lineweights_7 = CustomPreviewLineweights(Geometry=polyline_5, Shader=colour_swatch_3, Thickness=".5", Absolute=False)
custom_preview_4 = CustomPreview(Geometry=boundary_surfaces_4, Material=create_material_4)
weave_10 = Weave(
    Pattern=[0, 0, 1, 2, 3, 4, 5, 6],
    Stream0=list_item_53,
    Stream1=list_item_55,
    Stream2=list_item_52,
    Stream3=list_item_54.Item,
    Stream4=list_item_54.Item1,
    Stream5=list_item_54.Item2,
    Stream6=list_item_54.Item3,
    NullGaps=False)
series_18 = Series(Start="24", Step=1, Count="5")
series_19 = Series(Start="24", Step=1, Count="5")
tree_statistics_9 = TreeStatistics(Tree=weave_10)  # -> Paths, Length, Count
tree_statistics_10 = TreeStatistics(Tree=weave_9)  # -> Paths, Length, Count
list_item_61 = ListItem(List=tree_statistics_9.Paths, Index=series_18, Wrap=True)
list_item_62 = ListItem(List=tree_statistics_10.Paths, Index=series_19, Wrap=True)
tree_branch_34 = TreeBranch(Tree=weave_9, Path=list_item_62, MaintainPaths=True)
series_20 = Series(Start=0, Step="7500", Count="9")
tree_branch_35 = TreeBranch(Tree=weave_10, Path=list_item_61, MaintainPaths=True)
flip_matrix_7 = FlipMatrix(Data=weave_9)
flip_matrix_8 = FlipMatrix(Data=tree_branch_35)
curve = Curve(reparameterize(<curve referenced from the Rhino model>))
unit_x_15 = UnitX(Factor=series_20)
bounds_17 = Bounds(Numbers=flip_matrix_7)
bounds_18 = Bounds(Numbers=flip_matrix_8)
range = Range(Domain=bounds_17, Steps="10")
move_31 = Move(Geometry=curve, Motion=unit_x_15)  # -> Geometry, Transform
tree_statistics_11 = TreeStatistics(Tree=range)  # -> Paths, Length, Count
deconstruct_domain_15 = DeconstructDomain(Domain=bounds_17)  # -> Start, End
panel_41 = Panel("""0
1
8""")
custom_preview_lineweights_8 = CustomPreviewLineweights(
    Geometry=move_31.Geometry,
    Shader=ColourSwatch(SwatchColor=RGB(0, 0, 0)),
    Thickness=Slider(3, range=0..10),
    Absolute=False)
list_item_63 = ListItem(List=tree_statistics_11.Paths, Index=panel_41, Wrap=True)
addition_9 = Addition(A="0.1", B=1)
deconstruct_domain_16 = DeconstructDomain(Domain=bounds_18)  # -> Start, End
split_tree = SplitTree(Data=range, Masks=flatten(list_item_63))  # -> Positive, Negative
number_slider_7 = Slider(2, range=0..10)
multiplication = Multiplication(A=deconstruct_domain_15.End, B=addition_9)
multiplication_2 = Multiplication(A=deconstruct_domain_15.Start, B="0.1")
multiplication_3 = Multiplication(A=split_tree.Positive, B=100)
panel_42 = Panel(deconstruct_domain_15.Start)
panel_43 = Panel(deconstruct_domain_16.Start)
subtraction = Subtraction(A=deconstruct_domain_15.Start, B=multiplication_2)
series_21 = Series(Start=0, Step=Slider(0.1, range=0..0.1), Count="11")
construct_domain_17 = ConstructDomain(DomainStart=subtraction, DomainEnd=multiplication)
round_to_decimal_place = RoundToDecimalPlace(NumberX=multiplication_3, DecimalPlace=number_slider_7, RoundType=0)  # -> Rounded, Difference
round_to_decimal_place_2 = RoundToDecimalPlace(NumberX=split_tree.Negative, DecimalPlace=number_slider_7, RoundType=0)  # -> Rounded, Difference
remap_numbers_19 = RemapNumbers(Value=deconstruct_domain_16.End, Source=construct_domain_17, Target="0 To 1")  # -> Mapped, Clipped
remap_numbers_20 = RemapNumbers(Value=deconstruct_domain_16.Start, Source=construct_domain_17, Target="0 To 1")  # -> Mapped, Clipped
remap_numbers_21 = RemapNumbers(Value=deconstruct_domain_15.Start, Source=construct_domain_17, Target="0 To 1")  # -> Mapped, Clipped
remap_numbers_22 = RemapNumbers(Value=deconstruct_domain_15.End, Source=construct_domain_17, Target="0 To 1")  # -> Mapped, Clipped
concatenate_3 = Concatenate(FragmentA=round_to_decimal_place.Rounded, FragmentB="%")
evaluate_curve_2 = EvaluateCurve(Curve=graft(move_31.Geometry), Parameter=series_21)  # -> Point, Tangent, Angle
unit_x_16 = UnitX(Factor="-500")
merge_6 = Merge(Data1=round_to_decimal_place_2.Rounded, Data2=concatenate_3)
evaluate_curve_3 = EvaluateCurve(Curve=graft(move_31.Geometry), Parameter=remap_numbers_20.Mapped)  # -> Point, Tangent, Angle
evaluate_curve_4 = EvaluateCurve(Curve=graft(move_31.Geometry), Parameter=remap_numbers_19.Mapped)  # -> Point, Tangent, Angle
evaluate_curve_5 = EvaluateCurve(Curve=graft(move_31.Geometry), Parameter=remap_numbers_22.Mapped)  # -> Point, Tangent, Angle
evaluate_curve_6 = EvaluateCurve(Curve=graft(move_31.Geometry), Parameter=remap_numbers_21.Mapped)  # -> Point, Tangent, Angle
unit_z_4 = UnitZ(Factor="2000")
unit_x_17 = UnitX(Factor="2000")
unit_x_18 = UnitX(Factor="1000")
move_32 = Move(Geometry=evaluate_curve_2.Point, Motion=unit_x_16)  # -> Geometry, Transform
move_33 = Move(Geometry=evaluate_curve_3.Point, Motion=unit_x_17)  # -> Geometry, Transform
addition_10 = Addition(A=unit_x_17, B=unit_z_4)
move_34 = Move(Geometry=evaluate_curve_5.Point, Motion=unit_x_18)  # -> Geometry, Transform
rectangle_2pt = Rectangle2Pt(Plane=PlaneXY(0, 0, 0), PointA=move_33.Geometry, PointB=evaluate_curve_4.Point, Radius=0)  # -> Rectangle, Length
rectangle_2pt_2 = Rectangle2Pt(Plane=PlaneXY(0, 0, 0), PointA=move_34.Geometry, PointB=evaluate_curve_6.Point, Radius=0)  # -> Rectangle, Length
move_35 = Move(Geometry=rectangle_2pt.Rectangle, Motion=unit_z_4)  # -> Geometry, Transform
text_tag_3d_7 = TextTag3D(
    Location=move_32.Geometry,
    Text=merge_6,
    Size=Slider(500, range=0..1000),
    Colour=ColourSwatch(SwatchColor=RGB(0, 0, 0)),
    Justification=6)
boundary_surfaces_5 = BoundarySurfaces(Edges=rectangle_2pt_2.Rectangle)
custom_preview_5 = CustomPreview(Geometry=boundary_surfaces_5, Material=ColourSwatch(SwatchColor=RGB(82, 82, 82)))
boundary_surfaces_6 = BoundarySurfaces(Edges=move_35.Geometry)
create_material_5 = CreateMaterial(
    Diffuse=ColourSwatch(SwatchColor=RGB(242, 0, 255)),
    Specular=RGB(255, 255, 255),
    Emission=RGB(0, 0, 0),
    Transparency=Slider(0.77, range=0..1),
    Shine=0)
custom_preview_6 = CustomPreview(Geometry=boundary_surfaces_6, Material=create_material_5)

# ---- group: Hospitality
mass_addition_19 = MassAddition(Input=list_item_42.Item)  # -> Result, PartialResults

# ----
larger_than_2 = LargerThan(FirstNumber=flatten(mass_addition_19.Result), SecondNumber=0)  # -> LargerThan, OrEqualTo
list_length_8 = ListLength(List=flatten(mass_addition_19.Result))
series_22 = Series(Start=0, Step=1, Count=list_length_8)
dispatch_2 = Dispatch(List=series_22, DispatchPattern=larger_than_2.LargerThan)  # -> ListA, ListB
replace_items_2 = ReplaceItems(List=flatten(mass_addition_19.Result), Item="300", Indices=dispatch_2.ListB, Wrap=False)  # -> graft(List)

# ---- group: Hospitality (continued)
bounds_19 = Bounds(Numbers=flatten(replace_items_2))
deconstruct_domain_17 = DeconstructDomain(Domain=bounds_19)  # -> Start, End
construct_domain_18 = ConstructDomain(DomainStart=0, DomainEnd=deconstruct_domain_17.End)
remap_numbers_23 = RemapNumbers(Value=replace_items_2, Source=construct_domain_18, Target=panel_29)  # -> Mapped, Clipped

# ----
weave_11 = Weave(
    Pattern=panel_31,
    Stream0=remap_numbers_2.Mapped,
    Stream1=remap_numbers_3.Mapped,
    Stream2=remap_numbers_4.Mapped,
    Stream3=remap_numbers_23.Mapped,
    Stream4=remap_numbers_5.Mapped,
    Stream5=remap_numbers_6.Mapped,
    Stream6=remap_numbers_7.Mapped,
    NullGaps=False)  # -> simplify(Weave)
evaluate_curve_7 = EvaluateCurve(Curve=reparameterize(rotate.Geometry), Parameter=weave_11)  # -> Point, Tangent, Angle
polyline_6 = PolyLine(Vertices=evaluate_curve_7.Point, Closed=True)
move_36 = Move(Geometry=polyline_6, Motion=unit_x_9)  # -> Geometry, Transform
boundary_surfaces_7 = BoundarySurfaces(Edges=move_36.Geometry)
area_4 = Area(Geometry=boundary_surfaces_7)  # -> Area, Centroid
bounds_20 = Bounds(Numbers=flatten(area_4.Area))
deconstruct_domain_18 = DeconstructDomain(Domain=bounds_20)  # -> Start, End
construct_domain_19 = ConstructDomain(DomainStart=0, DomainEnd=deconstruct_domain_18.End)
remap_numbers_24 = RemapNumbers(Value=boundary_surfaces_7, Source=bounds_20, Target=construct_domain_7)  # -> Mapped, Clipped
create_material_6 = CreateMaterial(Diffuse=colour_swatch, Specular=RGB(255, 255, 255), Emission=RGB(0, 0, 0), Transparency=remap_numbers_24.Mapped, Shine=0)
custom_preview_lineweights_9 = CustomPreviewLineweights(Geometry=move_36.Geometry, Shader=colour_swatch, Thickness=".5", Absolute=False)
custom_preview_7 = CustomPreview(Geometry=boundary_surfaces_7, Material=create_material_6)
