# Grasshopper definition 09_01_RIBA Stage 3 Stand Scale Analysis Model.gh (Grasshopper 1.0.7)
# plug-ins: Human, MeshEdit Components, LunchBoxML, froGH

panel = Panel("1")
series = Series(Start="15", Step="2", Count="5")
tokyo = Data(Tree({0;0}: ["0", "7", "7", "0", "8", "4", "0", "-11.35", "2", "5", "250", "300", "0"], {1;0;0}: ["5", "19", "12", "3", "22"], {1;0;1}: ["37", "30"], {1;0;2}: ["5", "5", "5", "5", "32"], {1;0;3}: ["41", "32"], {2;0;0}: [".85", ".78", ".78", ".78", ".78", ".78", ".78"]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))
dusseldorf = Data(tokyo)
top_gangway_top = SplitTree(Data=dusseldorf, Masks=flatten("{2;0;0}"))  # -> Positive, Negative
series_2 = Series(Start=0, Step=1, Count="400")
repeat_data = RepeatData(Data=graft(series_2), Length="10")  # -> flatten(Data)
entwine = Entwine(
    Branch00=repeat_data,
    Branch01=repeat_data,
    Branch02=repeat_data,
    Branch03=repeat_data,
    Branch04=repeat_data,
    Branch05=repeat_data,
    Branch06=repeat_data,
    Branch07=repeat_data,
    FlattenInputs=True)  # -> flatten(Result)
list_item = ListItem(List=entwine, Index=panel, Wrap=True)
panel_2 = Panel(list_item)
panel_3 = Panel(panel_2)
number_slider = Slider(10, range=0..10)
panel_4 = Panel(panel_3)
series_3 = Series(Start=number_slider, Step=number_slider, Count=Slider(10, range=0..10))
repeat_data_2 = RepeatData(Data=graft(series_3), Length="10")  # -> flatten(Data)
list_item_2 = ListItem(List=repeat_data_2, Index=panel_4, Wrap=True)
number_slider_2 = Slider(0.01, range=0..0.01)
smaller_than = SmallerThan(FirstNumber=panel_4, SecondNumber="210")  # -> SmallerThan, OrEqualTo
larger_than = LargerThan(FirstNumber=panel_4, SecondNumber=Slider(30, range=0..100))  # -> LargerThan, OrEqualTo
series_4 = Series(Start="1", Step=1, Count="8")
dispatch = Dispatch(List="0", DispatchPattern=larger_than.LargerThan)  # -> ListA, ListB
repeat_data_3 = RepeatData(Data=graft(series_4), Length="4000")  # -> flatten(Data)
list_item_3 = ListItem(List=flatten(repeat_data_3), Index=panel_3, Wrap=True)
building_ouline_offset = Slider(-9, range=-10.01..0)

inner_outline = Slider(8, range=0..10)
outter_outline = Slider(3, range=0..10)
number_of_inner_offsets = Slider(3, range=0..10)
number_of_outter_offsets = Slider(1, range=0..10)
not_in_use = Slider(3, range=0..10)
merge = Merge(
    Data1=list_item_3,
    Data2=outter_outline,
    Data3=number_of_inner_offsets,
    Data4=number_of_outter_offsets,
    Data5=not_in_use,
    Data6=building_ouline_offset)

grid_depth = Slider(9, range=0..10)
grid_width = Slider(7, range=0..10)

series_5 = Series(Start=0, Step=1, Count="9")
repeat_data_4 = RepeatData(Data=graft(series_5), Length="100")  # -> flatten(Data)

panel_5 = Panel("""1
2
4
8
6
7""")
repeat_data_5 = RepeatData(Data="0", Length=Slider(1, range=0..10))
merge_2 = Merge(Data1="1", Data2=repeat_data_5)  # -> flatten(Result)
panel_6 = Panel("{0}")
series_6 = Series(Start=0, Step=1, Count=Slider(38, range=0..100))
series_7 = Series(Start=0, Step=Slider(2, range=0..10), Count=Slider(38, range=0..100))
berlin = Data(Tree({0;0}: ["0", "7", "7", "0", "15", "8", "0", "-11", "1", "6", "300", "250", "0"], {1;0;0}: ["27", "14", "32"], {1;0;1}: ["41"], {1;0;2}: ["5", "5", "5", "8", "32"], {1;0;3}: ["41", "32"], {2;0;0}: [".76", ".76", ".76"]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))
berlin_2 = Data(berlin)
panel_7 = Panel("""0
4
6
9
11
15
17
22
24
28
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""")
low_gangway_top = SplitTree(Data=berlin_2, Masks=flatten("{08;0;0}"))  # -> Positive, Negative
addition = Addition(A=list_item_2, B="2")
panel_8 = Panel(low_gangway_top.Positive)
panel_9 = Panel("""3
3
4
5
8""")
list_length = ListLength(List=low_gangway_top.Positive)
series_8 = Series(Start=0, Step=1, Count=10)
series_9 = Series(Start=0, Step=1, Count=list_length)
panel_10 = Panel(panel_7)
replace_items = ReplaceItems(List=panel_8, Indices=series_9, Wrap=False)
clean_tree = CleanTree(RemoveNulls=True, RemoveInvalid=True, RemoveEmpty=False, Tree=replace_items)
list_length_2 = ListLength(List=panel_10)
series_10 = Series(Start=0, Step=1, Count=list_length_2)
insert_items = InsertItems(List=clean_tree, Item=panel_10, Indices=series_10, Wrap=False)
clean_tree_2 = CleanTree(RemoveNulls=True, RemoveInvalid=True, RemoveEmpty=False, Tree=insert_items)
panel_11 = Panel("{18;0;4}")
trim_tree = TrimTree(Tree=clean_tree_2, Depth=3)
rotate = Rotate(Angle=degrees(1.570796327), Plane=PlaneXY(0, 0, 0))  # -> Geometry, Transform
sort_list = SortList(Keys=trim_tree)  # -> Keys, ValuesValuesA
panel_12 = Panel(trim_tree)
curve = Curve(rotate.Geometry)
# Other circulation
# Vertical circulation
# WC
# Commercial
# Service / Store
# Performers
# Hospitality
# Media
# Other
# Parking
# Concourse
panel_13 = Panel("{13;0;0;?}")
panel_14 = Panel("""0
1
2
3
4""")
merge_3 = Merge(Data1=sort_list.Keys, Data2=low_gangway_top.Negative)
panel_15 = Panel("""0
1
2
3
4
5""")
panel_16 = Panel("""6
7
8
9
10
11""")
tree_statistics = TreeStatistics()  # -> Paths, Length, Count
panel_17 = Panel("""0,1,2,3,4,5,6,7
1,3,5,7""")
_01_4 = Data(Tree({0;0}: ["10"], {0;1}: ["11", "11", "11", "11", "11", "11", "11", "11", "11", "11"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], {0;2}: ["11", "11", "11", "11", "11", "11", "11", "11", "11", "11"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], {0;3}: ["11", "11", "11", "11", "11", "11", "11", "11", "11", "11"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]))
_02_08 = Data(Tree({0;0}: ["10"], {0;1}: ["4", "4", "4", "4", "4", "4", "4", "4", "4", "4"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], {0;2}: ["4", "4", "4", "4", "4", "4", "4", "4", "4", "4"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], {0;3}: ["4", "4", "4", "4", "4", "4", "4", "4", "4", "4"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]))
_02_04 = Data(Tree({0;0}: ["10"], {0;1}: ["4", "4", "4", "4", "4", "4", "4", "4", "4", "4"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], {0;2}: ["4", "4", "4", "4", "4", "4", "4", "4", "4", "4"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], {0;3}: ["4", "4", "4", "4", "4", "4", "4", "4", "4", "4"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]))
_01_6 = Data(Tree({0;0}: ["10"], {0;1}: ["11", "11", "11", "11", "11", "11", "11", "11", "11", "11"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], {0;2}: ["11", "11", "11", "11", "11", "11", "11", "11", "11", "11"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], {0;3}: ["11", "11", "11", "11", "11", "11", "11", "11", "11", "11"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]))
_01_8 = Data(Tree({0;0}: ["10"], {0;1}: ["11", "11", "11", "11", "11", "11", "11", "11", "11", "11"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], {0;2}: ["11", "11", "11", "11", "11", "11", "11", "11", "11", "11"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], {0;3}: ["11", "11", "11", "11", "11", "11", "11", "11", "11", "11"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]))
_02_06 = Data(Tree({0;0}: ["10"], {0;1}: ["4", "4", "4", "4", "4", "4", "4", "4", "4", "4"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], {0;2}: ["4", "4", "4", "4", "4", "4", "4", "4", "4", "4"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], {0;3}: ["4", "4", "4", "4", "4", "4", "4", "4", "4", "4"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]))
list_item_4 = ListItem(List=panel_17, Index="1", Wrap=True)
tree_statistics_2 = TreeStatistics(Tree=_02_08)  # -> Paths, Length, Count
panel_18 = Panel("""0
1
2""")
replace_paths = ReplacePaths(Data=_02_08, Search=tree_statistics_2.Paths, Replace=reverse(tree_statistics_2.Paths))
text_split = TextSplit(Text=list_item_4, Separators=",")
_01_6_2 = Data(Tree({0;0}: ["11", "11", "11", "11", "11", "11", "11", "11", "11", "11"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], {0;1}: ["11", "11", "11", "11", "11", "11", "11", "11", "11", "11"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], {0;2}: ["11", "11", "11", "11", "11", "11", "11", "11", "11", "11"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], {0;3}: ["10"]))
_01_4_2 = Data(Tree({0;0}: ["11", "11", "11", "11", "11", "11", "11", "11", "11", "11"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], {0;1}: ["11", "11", "11", "11", "11", "11", "11", "11", "11", "11"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], {0;2}: ["11", "11", "11", "11", "11", "11", "11", "11", "11", "11"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], {0;3}: ["10"]))
_01_8_2 = Data(Tree({0;0}: ["11", "11", "11", "11", "11", "11", "11", "11", "11", "11"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], {0;1}: ["11", "11", "11", "11", "11", "11", "11", "11", "11", "11"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], {0;2}: ["11", "11", "11", "11", "11", "11", "11", "11", "11", "11"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], {0;3}: ["10"]))
_02_06_2 = Data(Tree({0;0}: ["4", "4", "4", "4", "4", "4", "4", "4", "4", "4"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], {0;1}: ["4", "4", "4", "4", "4", "4", "4", "4", "4", "4"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], {0;2}: ["4", "4", "4", "4", "4", "4", "4", "4", "4", "4"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], {0;3}: ["10"]))
_02_04_2 = Data(Tree({0;0}: ["4", "4", "4", "4", "4", "4", "4", "4", "4", "4"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], {0;1}: ["4", "4", "4", "4", "4", "4", "4", "4", "4", "4"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], {0;2}: ["4", "4", "4", "4", "4", "4", "4", "4", "4", "4"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], {0;3}: ["10"]))
_02_08_2 = Data(Tree({0;0}: ["4", "4", "4", "4", "4", "4", "4", "4", "4", "4"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], {0;1}: ["4", "4", "4", "4", "4", "4", "4", "4", "4", "4"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], {0;2}: ["4", "4", "4", "4", "4", "4", "4", "4", "4", "4"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], {0;3}: ["10"]))

# ---- group: case study number
panel_19 = Panel("03")

# ----
panel_20 = Panel("C:\Users\yakim\Desktop\PhD\220104 Main study\Case Studies Output\03 Arena da Amazonia\")
entwine_2 = Entwine(
    Branch0X=_01_4_2,
    Branch1X=_01_6_2,
    Branch2X=_01_8_2,
    Branch3X=_02_04_2,
    Branch4X=_02_06_2,
    Branch5X=_02_08_2,
    Branch6X=_02_04_2,
    Branch7X=_02_06_2,
    Branch8X=_02_08_2,
    Branch9X=_02_04_2,
    Branch10X=_02_06_2,
    Branch11X=_02_08_2,
    Branch12X=_02_08_2,
    FlattenInputs=False)
_04_08 = Data(Tree({0;0}: ["11", "11", "11", "11", "11", "11", "11", "11", "11", "11"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], {0;1}: ["11", "11", "11", "1", "11", "11", "11", "1", "11", "11"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], {0;2}: ["11", "11", "11", "11", "11", "11", "11", "11", "11", "11"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]))
_05_01 = Data(_04_08)
tree_statistics_3 = TreeStatistics(Tree=_05_01)  # -> Paths, Length, Count
panel_21 = Panel("""1
2""")
panel_22 = Panel("""0
1""")
list_item_5 = ListItem(List=tree_statistics_3.Paths, Index=panel_21, Wrap=True)
tree_branch = TreeBranch(Tree=_05_01, Path=list_item_5, MaintainPaths=True)
list_item_6 = ListItem(List=tree_statistics_3.Paths, Index=panel_22, Wrap=True)
replace_paths_2 = ReplacePaths(Data=tree_branch, Search=list_item_5, Replace=list_item_6)
panel_23 = Panel(replace_paths_2)
panel_24 = Panel("""0
2
3
4""")
tree_statistics_4 = TreeStatistics()  # -> Paths, Length, Count
_04_06 = Data(Tree({0;0}: ["11", "11", "11", "1", "11", "11", "11", "1", "11", "11"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], {0;1}: ["11", "11", "11", "11", "11", "11", "11", "11", "11", "11"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]))
_04_08_2 = Data(Tree({0;0}: ["11", "11", "11", "1", "11", "11", "11", "1", "11", "11"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], {0;1}: ["11", "11", "11", "11", "11", "11", "11", "11", "11", "11"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]))
_02_04_3 = Data(Tree({0;0}: ["11", "11", "11", "11", "11", "11", "11", "11", "11", "11"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], {0;1}: ["11", "11", "11", "11", "11", "11", "11", "11", "11", "11"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], {0;2}: ["11", "11", "11", "11", "11", "11", "11", "11", "11", "11"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]))
panel_25 = Panel(_02_04_3)
_02_06_3 = Data(Tree({0;0}: ["11", "11", "11", "11", "11", "11", "11", "11", "11", "11"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], {0;1}: ["11", "11", "11", "11", "11", "11", "11", "11", "11", "11"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], {0;2}: ["11", "11", "11", "11", "11", "11", "11", "11", "11", "11"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]))
_05_01_2 = Data(Tree({0;0}: ["11", "11", "11", "1", "11", "11", "11", "1", "11", "11"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], {0;1}: ["11"], {0;2}: ["11", "11"]))
_03_04 = Data(Tree({0;0}: ["11", "11", "11", "11", "11", "11", "11", "11", "11", "11"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], {0;1}: ["11", "11", "11", "11", "11", "11", "11", "11", "11", "11"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], {0;2}: ["11", "11", "11", "11", "11", "11", "11", "11", "11", "11"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]))
_03_06 = Data(Tree({0;0}: ["11", "11", "11", "11", "11", "11", "11", "11", "11", "11"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], {0;1}: ["11", "11", "11", "11", "11", "11", "11", "11", "11", "11"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], {0;2}: ["11", "11", "11", "11", "11", "11", "11", "11", "11", "11"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]))
_03_08 = Data(Tree({0;0}: ["11", "11", "11", "11", "11", "11", "11", "11", "11", "11"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], {0;1}: ["11", "11", "11", "11", "11", "11", "11", "11", "11", "11"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], {0;2}: ["11", "11", "11", "11", "11", "11", "11", "11", "11", "11"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]))
_02_08_3 = Data(Tree({0;0}: ["11", "11", "11", "11", "11", "11", "11", "11", "11", "11"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], {0;1}: ["11", "11", "11", "11", "11", "11", "11", "11", "11", "11"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], {0;2}: ["11", "11", "11", "11", "11", "11", "11", "11", "11", "11"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]))
_04_04 = Data(Tree({0;0}: ["11", "11", "11", "1", "11", "11", "11", "1", "11", "11"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], {0;1}: ["11", "11", "11", "11", "11", "11", "11", "11", "11", "11"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]))
list_item_7 = ListItem(List=tree_statistics_4.Paths, Index=panel_24, Wrap=True)
split_list = SplitList(List=_02_04_3, Index="64")  # -> ListA, ListB
split_list_2 = SplitList(List=_02_06_3, Index="64")  # -> ListA, ListB
split_list_3 = SplitList(List=_02_08_3, Index="64")  # -> ListA, ListB
panel_26 = Panel("""{0;0}
{0;1}
{0;2}""")
tree_branch_2 = TreeBranch(Path=list_item_7, MaintainPaths=True)
tree_statistics_5 = TreeStatistics(Tree=tree_branch_2)  # -> Paths, Length, Count
replace_paths_3 = ReplacePaths(Data=tree_branch_2, Search=tree_statistics_5.Paths, Replace=panel_26)
entwine_3 = Entwine(
    Branch0X="10",
    Branch1X="10",
    Branch2X="10",
    Branch3X=split_list.ListA,
    Branch4X=split_list_2.ListA,
    Branch5X=split_list_3.ListA,
    Branch6X=_03_04,
    Branch7X=_03_06,
    Branch8X=_03_08,
    Branch9X=_04_04,
    Branch10X=_04_06,
    Branch11X=_04_08_2,
    Branch12X=_05_01_2,
    FlattenInputs=False)
panel_27 = Panel("""1
2""")
panel_28 = Panel("""0
1""")
_04_06_2 = Data(Tree({0;0}: ["11", "11", "11", "11", "11", "11", "11", "11", "11", "11"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], {0;1}: ["11", "11", "11", "1", "11", "11", "11", "1", "11", "11"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], {0;2}: ["11", "11", "11", "11", "11", "11", "11", "11", "11", "11"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]))
_05_01_3 = Data(_04_06_2)
tree_statistics_6 = TreeStatistics(Tree=_05_01_3)  # -> Paths, Length, Count
list_item_8 = ListItem(List=tree_statistics_6.Paths, Index=panel_27, Wrap=True)
tree_branch_3 = TreeBranch(Tree=_05_01_3, Path=list_item_8, MaintainPaths=True)
list_item_9 = ListItem(List=tree_statistics_6.Paths, Index=panel_28, Wrap=True)
tree_statistics_7 = TreeStatistics()  # -> Paths, Length, Count
replace_paths_4 = ReplacePaths(Data=tree_branch_3, Search=list_item_8, Replace=list_item_9)
_04_04_2 = Data(Tree({0;0}: ["11", "11", "11", "1", "11", "11", "11", "1", "11", "11"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], {0;1}: ["11", "11", "11", "11", "11", "11", "11", "11", "11", "11"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]))
_05_01_4 = Data(Tree({0;0}: ["6", "6", "6", "1", "6", "6", "6", "1", "6", "6"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], {0;1}: ["6"]))
_04_06_3 = Data(Tree({0;0}: ["11", "11", "11", "1", "11", "11", "11", "1", "11", "11"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], {0;1}: ["11", "11", "11", "11", "11", "11", "11", "11", "11", "11"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]))
_04_08_3 = Data(Tree({0;0}: ["11", "11", "11", "1", "11", "11", "11", "1", "11", "11"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], {0;1}: ["11", "11", "11", "11", "11", "11", "11", "11", "11", "11"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]))
list_item_10 = ListItem(List=tree_statistics_7.Paths, Index=[1, 2, 3], Wrap=True)
list_item_11 = ListItem(List=tree_statistics_7.Paths, Index=[0, 1, 2], Wrap=True)
tree_branch_4 = TreeBranch(Path=list_item_10, MaintainPaths=True)
replace_paths_5 = ReplacePaths(Data=tree_branch_4, Search=list_item_10, Replace=list_item_11)
entwine_4 = Entwine(
    Branch0X="10",
    Branch1X="10",
    Branch2X="10",
    Branch3X="10",
    Branch4X="10",
    Branch5X="10",
    Branch6X="10",
    Branch7X="10",
    Branch8X="10",
    Branch9X=_04_04_2,
    Branch10X=_04_06_3,
    Branch11X=_04_08_3,
    Branch12X=_05_01_4,
    FlattenInputs=False)
_05_01_5 = Data(Tree({0;0}: ["11"], {0;1}: ["11", "11", "11", "1", "11", "11", "11", "1", "11", "11"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]))
tree_statistics_8 = TreeStatistics(Tree=_05_01_5)  # -> Paths, Length, Count
tree_statistics_9 = TreeStatistics(Tree=_05_01_5)  # -> Paths, Length, Count
list_item_12 = ListItem(List=tree_statistics_8.Paths, Index=Slider(1, range=0..1), Wrap=True)
replace_paths_6 = ReplacePaths(Data=_05_01_5, Search=tree_statistics_9.Paths, Replace=reverse(tree_statistics_9.Paths))
tree_branch_5 = TreeBranch(Tree=_05_01_5, Path=list_item_12, MaintainPaths=True)
entwine_5 = Entwine(Branch0X=tree_branch_5, Branch1X=_05_01_5, FlattenInputs=False)  # -> simplify(Result)
_05_01_6 = Data(Tree({0;0}: ["11", "11", "11", "1", "11", "11", "11", "1", "11", "11"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], {0;1}: ["11"]))
tree_statistics_10 = TreeStatistics(Tree=entwine_5)  # -> Paths, Length, Count
panel_29 = Panel("""{0;0}
{0;1}
{0;2}""")
replace_paths_7 = ReplacePaths(Data=entwine_5, Search=tree_statistics_10.Paths, Replace=panel_29)
entwine_6 = Entwine(
    Branch0X="10",
    Branch1X="10",
    Branch2X="10",
    Branch3X="10",
    Branch4X="10",
    Branch5X="10",
    Branch6X="10",
    Branch7X="10",
    Branch8X="10",
    Branch9X="10",
    Branch10X="10",
    Branch11X="10",
    Branch12X=_05_01_6,
    FlattenInputs=False)
panel_30 = Panel("""25
26
27
28
29
30
31
32
33
34
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""")
panel_31 = Panel("""28
29
30
31
32
33
34
35
36
37
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""")
addition_2 = Addition(A=panel_30, B="5")
addition_3 = Addition(A=panel_31, B="5")
repeat_data_6 = RepeatData(Data="0", Length="30")
repeat_data_7 = RepeatData(Data="32", Length="30")
repeat_data_8 = RepeatData(Data="99", Length="150")
entwine_7 = Entwine(
    Branch00=repeat_data_6,
    Branch01=repeat_data_7,
    Branch02=addition_2,
    Branch03=addition_2,
    Branch04=addition_3,
    FlattenInputs=True)  # -> flatten(Result)
list_item_13 = ListItem(List=entwine_7, Index=panel_4, Wrap=True)
panel_32 = Panel(entwine_7)
tree_statistics_11 = TreeStatistics(Tree="0")  # -> Paths, Length, Count
replace_paths_8 = ReplacePaths(Data=list_item_13, Search=tree_statistics_11.Paths, Replace="{12;0;0}")
allianz_v2 = Data(Tree({0;0}: ["0", "4", "4", "0", "11", "4", "0", "-7.55", "1", "4", "250", "300", "0"], {1;0;0}: ["26", "26", "20"], {1;0;1}: ["26", "18", "3", "20"], {1;0;2}: ["5", "5", "5", "5", "32"], {1;0;3}: ["41", "32"], {2;0;0}: [".78", ".78", ".78", ".8"]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))
panel_33 = Panel("7.5")
top_gangway_top_2 = SplitTree(Data=allianz_v2, Masks=flatten("{9;0;1}"))  # -> Positive, Negative
replace = ReplaceItems(List=top_gangway_top_2.Positive, Item="6.5", Indices="0", Wrap=False)
trim_tree_2 = TrimTree(Tree=replace, Depth=1)
panel_34 = Panel(replace)
tree_statistics_12 = TreeStatistics(Tree="1")  # -> Paths, Length, Count
merge_4 = Merge(Data1=trim_tree_2, Data2=top_gangway_top_2.Negative)
top_gangway_top_3 = SplitTree(Data=merge_4, Masks=flatten("{7;0;0}"))  # -> Positive, Negative
replace_paths_9 = ReplacePaths(Data="1", Search=tree_statistics_12.Paths, Replace="{7;0;0}")
panel_35 = Panel("""0
2
4
6
8
10
12
14
16
17
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""")
merge_5 = Merge(Data1=replace_paths_9, Data2=top_gangway_top_3.Negative)
tree_statistics_13 = TreeStatistics(Tree=panel_35)  # -> Paths, Length, Count
top_gangway_top_4 = SplitTree(Data=merge_5, Masks=flatten("{8;0;0}"))  # -> Positive, Negative
replace_paths_10 = ReplacePaths(Data=panel_35, Search=tree_statistics_13.Paths, Replace="{8;0;0}")
panel_36 = Panel(top_gangway_top_4.Positive)
merge_6 = Merge(Data1=replace_paths_10, Data2=top_gangway_top_4.Negative)
top_gangway_top_5 = SplitTree(Data=merge_6, Masks=flatten("{13;0;0;*}"))  # -> Positive, Negative
tree_statistics_14 = TreeStatistics(Tree=top_gangway_top_5.Positive)  # -> Paths, Length, Count
panel_37 = Panel("""4
5""")
entwine_8 = Entwine(Branch00="9", Branch01="9", Branch02="9", Branch03="9", FlattenInputs=True)
panel_38 = Panel("""0
1
2
3""")
list_item_14 = ListItem(List=tree_statistics_14.Paths, Index=panel_37, Wrap=True)
top_gangway_top_6 = SplitTree(Data=merge_6, Masks=flatten(list_item_14))  # -> Positive, Negative
list_item_15 = ListItem(List=tree_statistics_14.Paths, Index=panel_38, Wrap=True)
tree_statistics_15 = TreeStatistics(Tree=entwine_8)  # -> Paths, Length, Count
entwine_9 = Entwine(Branch00="4", Branch01="4", FlattenInputs=True)
replace_paths_11 = ReplacePaths(Data=entwine_8, Search=tree_statistics_15.Paths, Replace=list_item_15)
top_gangway_top_7 = SplitTree(Data=top_gangway_top_6.Negative, Masks=flatten(list_item_15))  # -> Positive, Negative
tree_statistics_16 = TreeStatistics(Tree=entwine_9)  # -> Paths, Length, Count
panel_39 = Panel(top_gangway_top_7.Positive)
replace_paths_12 = ReplacePaths(Data=entwine_9, Search=tree_statistics_16.Paths, Replace=list_item_14)
merge_7 = Merge(Data1=top_gangway_top_7.Negative, Data2=replace_paths_12, Data3=replace_paths_11)
top_gangway_top_8 = SplitTree(Data=merge_7, Masks=flatten("{13;1;0;*}"))  # -> Positive, Negative
tree_statistics_17 = TreeStatistics(Tree=top_gangway_top_8.Positive)  # -> Paths, Length, Count
split_list_4 = SplitList(List=reverse(tree_statistics_17.Paths), Index="1")  # -> ListA, reverse(ListB)
shift_list = ShiftList(List=tree_statistics_17.Paths, Shift=1, Wrap=False)
list_item_16 = ListItem(List=tree_statistics_17.Paths, Index=0, Wrap=True)
tree_branch_6 = TreeBranch(Tree=top_gangway_top_8.Positive, Path=split_list_4.ListB, MaintainPaths=True)
replace_paths_13 = ReplacePaths(Data=tree_branch_6, Search=split_list_4.ListB, Replace=shift_list)
replace_paths_14 = ReplacePaths(Data="9", Search="{0}", Replace=list_item_16)
merge_8 = Merge(Data1=replace_paths_13, Data2=replace_paths_14, Data3=top_gangway_top_8.Negative)
panel_40 = Panel("""11,11,3,3,3,11,11,11,3,3,3,11,11,11,3,3,3
11,3
11,11,3,3
11,11,11,11,3,3,3,3""")
list_item_17 = ListItem(List=panel_40, Index=0, Wrap=True)
text_split_2 = TextSplit(Text=list_item_17, Separators=",")
tree_statistics_18 = TreeStatistics(Tree=text_split_2)  # -> Paths, Length, Count

top_gangway_top_9 = SplitTree(Data=merge_8, Masks=flatten("{13;2;0;*}"))  # -> Positive, Negative
tree_statistics_19 = TreeStatistics(Tree=top_gangway_top_9.Positive)  # -> Paths, Length, Count
split_list_5 = SplitList(List=reverse(tree_statistics_19.Paths), Index="1")  # -> ListA, reverse(ListB)
shift_list_2 = ShiftList(List=tree_statistics_19.Paths, Shift=1, Wrap=False)
list_item_18 = ListItem(List=tree_statistics_19.Paths, Index=0, Wrap=True)
tree_branch_7 = TreeBranch(Tree=top_gangway_top_9.Positive, Path=split_list_5.ListB, MaintainPaths=True)
panel_41 = Panel("""11
1
11
1
11
1
11
1
11
1
11
1
11
1
11
1
11""")
replace_paths_15 = ReplacePaths(Data=tree_branch_7, Search=split_list_5.ListB, Replace=shift_list_2)
replace_paths_16 = ReplacePaths(Data=panel_41, Search="{0}", Replace=list_item_18)
tree_statistics_20 = TreeStatistics(Tree=replace_paths_15)  # -> Paths, Length, Count
list_item_19 = ListItem(List=tree_statistics_20.Paths, Index="1", Wrap=True)
panel_42 = Panel(tree_statistics_18.Paths)
split_tree = SplitTree(Data=replace_paths_15, Masks=flatten(list_item_19))  # -> Positive, Negative
replace_paths_17 = ReplacePaths(Data=text_split_2, Search=panel_42, Replace=list_item_19)
merge_9 = Merge(Data1=split_tree.Negative, Data2=replace_paths_17)
tree_statistics_21 = TreeStatistics(Tree=merge_9)  # -> Paths, Length, Count
panel_43 = Panel("""11
11
2
2
1
11
11
11
2
2
1
11
11
11
2
2
1""")
list_item_20 = ListItem(List=tree_statistics_21.Paths, Index="2", Wrap=True)
split_tree_2 = SplitTree(Data=merge_9, Masks=flatten(list_item_20))  # -> Positive, Negative
replace_paths_18 = ReplacePaths(Data=panel_43, Search="{0}", Replace=list_item_20)
merge_10 = Merge(Data1=split_tree_2.Negative, Data2=replace_paths_18)
merge_11 = Merge(Data1=merge_10, Data2=replace_paths_16, Data3=top_gangway_top_9.Negative)

panel_44 = Panel("""6
3
3
3
1
3
3
3
3
3
1
3
3
3
3
3
1""")
panel_45 = Panel("""6
3
3
3
3
3
3
3
3
3
3
3
3
3
3
3
3""")
top_gangway_top_10 = SplitTree(Data=merge_11, Masks=flatten("{13;3;0;*}"))  # -> Positive, Negative
tree_statistics_22 = TreeStatistics(Tree=top_gangway_top_10.Positive)  # -> Paths, Length, Count
entwine_10 = Entwine(Branch00=panel_45, Branch01=panel_45, FlattenInputs=True)
list_item_21 = ListItem(List=tree_statistics_22.Paths, Index=[0, 1], Wrap=True)
list_item_22 = ListItem(List=tree_statistics_22.Paths, Index=2, Wrap=True)
tree_statistics_23 = TreeStatistics(Tree=entwine_10)  # -> Paths, Length, Count
replace_paths_19 = ReplacePaths(Data=panel_44, Search="{0}", Replace=list_item_22)
replace_paths_20 = ReplacePaths(Data=entwine_10, Search=tree_statistics_23.Paths, Replace=list_item_21)
panel_46 = Panel("""6
6
6
6
1
2
6
6
6
6
1
2
6
6
6
6
1""")
merge_12 = Merge(Data1=top_gangway_top_10.Negative, Data2=replace_paths_19, Data3=replace_paths_20)
panel_47 = Panel(top_gangway_top_10.Positive)
top_gangway_top_11 = SplitTree(Data=merge_12, Masks=flatten("{13;4;0;*}"))  # -> Positive, Negative
tree_statistics_24 = TreeStatistics(Tree=top_gangway_top_11.Positive)  # -> Paths, Length, Count
list_item_23 = ListItem(List=tree_statistics_24.Paths, Index=1, Wrap=True)
list_item_24 = ListItem(List=tree_statistics_24.Paths, Index=0, Wrap=True)
replace_paths_21 = ReplacePaths(Data=panel_46, Search="{0}", Replace=list_item_23)
replace_paths_22 = ReplacePaths(Data="6", Search="{0}", Replace=list_item_24)
merge_13 = Merge(Data1=top_gangway_top_11.Negative, Data2=replace_paths_21, Data3=replace_paths_22)
panel_48 = Panel("""2
3.3
3
2.3
2
2.3
2
3.3
3
2.3
2
3.3
3
2.3
2
3.3
3""")
panel_49 = Panel("""11
11
11
11
1.2
11
11
11
11
11
1.2
11
11
11
11
11
1.2""")
top_gangway_top_12 = SplitTree(Data=merge_13, Masks=flatten("{13;5;0;*}"))  # -> Positive, Negative
panel_50 = Panel("""6
3
3
3
3
3
3
3
3
3
3
3
3
3
3
3
3""")
tree_statistics_25 = TreeStatistics(Tree=top_gangway_top_12.Positive)  # -> Paths, Length, Count
list_item_25 = ListItem(List=tree_statistics_25.Paths, Index=0, Wrap=True)
list_item_26 = ListItem(List=tree_statistics_25.Paths, Index=1, Wrap=True)
tree_branch_8 = TreeBranch(Tree=top_gangway_top_12.Positive, Path=list_item_25, MaintainPaths=True)
replace_paths_23 = ReplacePaths(Data=panel_48, Search="{0}", Replace=list_item_25)
replace_paths_24 = ReplacePaths(Data=panel_49, Search="{0}", Replace=list_item_26)
panel_51 = Panel(tree_branch_8)
merge_14 = Merge(Data1=top_gangway_top_12.Negative, Data2=replace_paths_23, Data3=replace_paths_24)

# ---- group: c value jpeg export
rep = ReplaceText(Text="a_02_06_b.jpeg", Find="a", Replace=panel_19, RecursiveReplace=False)
join = TextJoin(Text=[panel_20, rep])
rep_2 = ReplaceText(Text=join, Find="b", RecursiveReplace=False)
saveview = SaveViewportToFile(Run=Button(), ViewportName="Top view print", Render=False, FilePath=rep_2, ScaleFactor="3")

# ----
split = SplitTree(Data=merge_14, Masks=flatten("{11;?;?}"))  # -> Positive, Negative
split_2 = SplitTree(Data=merge_14, Masks=flatten("{12;?;?}"))  # -> Positive, Negative
split_3 = SplitTree(Data=merge_14, Masks=flatten("{10;?;?}"))  # -> Positive, Negative
split_4 = SplitTree(Data=merge_14, Masks=flatten("{4;?;?}"))  # -> Positive, Negative
split_5 = SplitTree(Data=merge_14, Masks=flatten("{5;?;?}"))  # -> Positive, Negative
split_6 = SplitTree(Data=merge_14, Masks=flatten("{9;?;?}"))  # -> Positive, Negative
split_7 = SplitTree(Data=merge_14, Masks=flatten("{3;?;?}"))  # -> Positive, Negative
split_8 = SplitTree(Data=merge_14, Masks=flatten("{7;?;?}"))  # -> Positive, Negative
split_9 = SplitTree(Data=merge_14, Masks=flatten("{8;?;?}"))  # -> Positive, Negative
split_10 = SplitTree(Data=merge_14, Masks=flatten("{6;?;?}"))  # -> Positive, Negative
split_11 = SplitTree(Data=merge_14, Masks=flatten("{2;?;?}"))  # -> Positive, Negative
split_12 = SplitTree(Data=merge_14, Masks=flatten("{1;?;?}"))  # -> Positive, Negative
split_13 = SplitTree(Data=merge_14, Masks=flatten("{0;?}"))  # -> Positive, Negative
split_14 = SplitTree(Data=merge_14, Masks=flatten("{13;?;?;?}"))  # -> Positive, Negative
split_15 = SplitTree(Data=merge_14, Masks=flatten("{14;?;?}"))  # -> Positive, Negative
split_16 = SplitTree(Data=merge_14, Masks=flatten("{15;?}"))  # -> Positive, Negative
bang = ExplodeTree(Data=split_3.Positive)  # -> Branch0, Branch1
bang_2 = ExplodeTree(Data=split.Positive)  # -> Branch0, Branch1
split_17 = SplitTree(Data=merge_14, Masks=flatten("{20;?;?}"))  # -> Positive, Negative
split_18 = SplitTree(Data=merge_14, Masks=flatten("{18;?;?}"))  # -> Positive, Negative
bang_3 = ExplodeTree(Data=split_10.Positive)  # -> Branch0, Branch1, Branch2, Branch3
split_19 = SplitTree(Data=merge_14, Masks=flatten("{16;?;?}"))  # -> Positive, Negative
bang_4 = ExplodeTree(Data=split_12.Positive)  # -> Branch0, Branch1, Branch2, Branch3
bang_5 = ExplodeTree(Data=split_11.Positive)  # -> Branch0, Branch1, Branch2, Branch3
bang_6 = ExplodeTree(Data=split_7.Positive)  # -> Branch0, Branch1, Branch2, Branch3
bang_7 = ExplodeTree(Data=split_4.Positive)  # -> Branch0, Branch1, Branch2, Branch3
bang_8 = ExplodeTree(Data=split_5.Positive)  # -> Branch0, Branch1, Branch2, Branch3
bang_9 = ExplodeTree(Data=split_6.Positive)  # -> Branch0, Branch1
bang_10 = ExplodeTree(Data=split_2.Positive)  # -> Branch0, Branch1, Branch2, Branch3, Branch4, Branch5, Branch6
bang_11 = ExplodeTree(Data=split_8.Positive)  # -> Branch0, Branch1
panel_52 = Panel(bang_11.Branch0)
split_20 = SplitTree(Data=merge_14, Masks=flatten("{17;?;?}"))  # -> Positive, Negative
bang_12 = ExplodeTree(Data=split_9.Positive)  # -> Branch0, Branch1, Branch2
split_21 = SplitTree(Data=merge_14, Masks=flatten("{19;0;?}"))  # -> Positive, Negative
item = ListItem(List=split_13.Positive, Index=0, Wrap=True)  # -> Item, Item1, Item2, Item3, Item4, Item5, Item6, Item7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
larger_than_2 = LargerThan(FirstNumber=item.Item2, SecondNumber="3")  # -> LargerThan, OrEqualTo
move = Move(Motion=graft(Vector(0, 0, 10)))  # -> Geometry, Transform
tree_statistics_26 = TreeStatistics(Tree=split_14.Positive)  # -> Paths, Length, Count
bang_13 = ExplodeTree(Data=split_15.Positive)  # -> Branch0, Branch1, Branch2, Branch3, Branch4, Branch5
bang_14 = ExplodeTree(Data=split_17.Positive)  # -> Branch0, Branch1, Branch2
bang_15 = ExplodeTree(Data=split_19.Positive)  # -> Branch0, Branch1, Branch2
bang_16 = ExplodeTree(Data=split_20.Positive)  # -> Branch0, Branch1, Branch2, Branch3
bang_17 = ExplodeTree(Data=split_21.Positive)  # -> Branch0, Branch1, Branch2, Branch3, Branch4
panel_53 = Panel(split_14.Positive)
panel_54 = Panel(bang_4.Branch0)
ma = MassAddition(Input=bang_4.Branch0)  # -> Result, PartialResults
ma_2 = MassAddition(Input=bang_4.Branch1)  # -> Result, PartialResults
ma_3 = MassAddition(Input=bang_4.Branch2)  # -> Result, PartialResults
ma_4 = MassAddition(Input=bang_4.Branch3)  # -> Result, PartialResults
curve_2 = Curve(<curve referenced from the Rhino model>)
curve_3 = Curve(<curve referenced from the Rhino model>)
crv = Curve([<curve referenced from the Rhino model> x6])
repeat_data_9 = RepeatData(Data=curve_2, Length="9")
merge_15 = Merge(Data1=ma.Result, Data2=ma_2.Result, Data3=ma_3.Result, Data4=ma_4.Result)
repeat_data_10 = RepeatData(Data=curve_3, Length="9")
item_2 = ListItem(List=crv, Index=item.Item12, Wrap=True)
boundary = BoundarySurfaces(Edges=item_2)
sort = SortList(Keys=flatten(merge_15))  # -> reverse(Keys), ValuesA
panel_55 = Panel("4")

preview = CustomPreview(Geometry=boundary, Material=ColourSwatch(SwatchColor=RGB(18, 110, 0)))

item_3 = ListItem(List=sort.Keys, Index=0, Wrap=True)
building_outline = Curve(repeat_data_9)
offset_auditorium_outline = Curve([<curve referenced from the Rhino model> x9])
auditorium_outline = Curve(repeat_data_10)
list_item_27 = ListItem(List=auditorium_outline, Index=list_item_3, Wrap=True)
explode = Explode(Curve=list_item_27, Recursive=True)  # -> Segments, Vertices
scale = Scale(Geometry=building_outline, Center=Point(0, 0, 0), Factor="2")  # -> Geometry, Transform
crv_2 = Curve(<curve referenced from the Rhino model>)
item_4 = ListItem(List=offset_auditorium_outline, Index=item.Item1, Wrap=True)

# ---- group: make building outline divisible by grid depth
item_5 = ListItem(List=auditorium_outline, Index=item.Item1, Wrap=True)
item_6 = ListItem(List=scale.Geometry, Index=item.Item2, Wrap=True)
explode_2 = Explode(Curve=item_5, Recursive=True)  # -> Segments, Vertices
explode_3 = Explode(Curve=item_6, Recursive=True)  # -> Segments, Vertices
list_item_28 = ListItem(List=explode_3.Segments, Index=3, Wrap=True)
list_item_29 = ListItem(List=explode_2.Segments, Index=3, Wrap=True)
point_on_curve = PointOnCurve(list_item_28, parameter=0.5)
point_on_curve_2 = PointOnCurve(list_item_29, parameter=0.5)
dist = Distance(PointA=point_on_curve_2, PointB=point_on_curve)
division = Division(A=dist, B=bang_9.Branch0)
round = Round(Number=division)  # -> Nearest, Floor, Ceiling
multiplication = Multiplication(A=round.Ceiling, B=bang_9.Branch0)
subtraction = Subtraction(A=multiplication, B=dist)
offset_curve_loose = OffsetCurveLoose(Curve=scale.Geometry, Distance=subtraction)

# ----
xz = XZPlane(Origin=Point(0, 0, 0))
item_7 = ListItem(List=offset_curve_loose, Index=item.Item2, Wrap=True)
item_8 = ListItem(List=auditorium_outline, Index=list_item_3, Wrap=True)
pcx = CurvePlane(Curve=item_8, Plane=xz)  # -> Points, ParamsC, ParamsP
item_9 = ListItem(List=pcx.Points, Index=0, Wrap=True)  # -> Item, Item1
pull = PullPoint(Point=item_9.Item, Geometry=crv_2, ClosestOnly=True)  # -> ClosestPoint, Distance

curve_4 = Curve(<curve referenced from the Rhino model>)
curve_5 = Curve(curve_4)

panel_56 = Panel(bang_8.Branch1)
addition_4 = Addition(A=bang_3.Branch0, B=".01")
bowl_section = BB_BowlSection(
    touchline=crv_2,
    outline=item_8,
    setDistance=pull.Distance,
    rows=bang_4.Branch0,
    stepDepths=bang_5.Branch0,
    landingDepths=bang_16.Branch0,
    floorHeights=bang_6.Branch0,
    cantilevers=bang_8.Branch0,
    cValues=bang_7.Branch0)  # -> section, sightlines, sectionInfo; inputs touchline: Curve, outline: list of Curve, rows: list of Int32, stepDepths: list, landingDepths: list, floorHeights: list, cantilevers: list, seatOffsets: list, cValues: list, stepHeights: list; plug-in component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
panel_57 = Panel("""2.6
0.01
0.58
0.01""")
text_join = TextJoin(Text=addition_4, Join=",")
end = EndPoints(Curve=bowl_section.sightlines)  # -> Start, End
end_2 = EndPoints(Curve=bowl_section.section)  # -> Start, End
Z = UnitZ(Factor="-25")

bowl_section_2 = BB_BowlSection(
    touchline=crv_2,
    outline=item_8,
    setDistance=pull.Distance,
    rows=bang_4.Branch3,
    stepDepths=bang_5.Branch3,
    landingDepths=bang_16.Branch3,
    floorHeights=bang_6.Branch3,
    cantilevers=bang_8.Branch3,
    cValues=bang_7.Branch3)  # -> section, sightlines, sectionInfo; inputs touchline: Curve, outline: list of Curve, rows: list of Int32, stepDepths: list, landingDepths: list, floorHeights: list, cantilevers: list, seatOffsets: list, cValues: list, stepHeights: list; plug-in component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
end_3 = EndPoints(Curve=bowl_section_2.sightlines)  # -> Start, End
end_4 = EndPoints(Curve=bowl_section_2.section)  # -> Start, End
Z_2 = UnitZ(Factor="-25")
move_2 = Move(Geometry=end_4.Start, Motion=Z_2)  # -> Geometry, Transform
ln = Line(StartPoint=end_4.Start, EndPoint=move_2.Geometry)
join_2 = JoinCurves(Curves=[ln, bowl_section_2.section], Preserve=False)
pt = ConstructPoint(XCoordinate=0, YCoordinate=0, ZCoordinate=bang_3.Branch0)
crv_3 = Curve(bowl_section_2.section)
xy = XYPlane(Origin=pt)
end_5 = EndPoints(Curve=bowl_section_2.section)  # -> Start, End
Y = UnitY(Factor="7.5")
panel_58 = Panel(bang_9.Branch0)
move_3 = Move(Geometry=crv_3, Motion=Y)  # -> Geometry, Transform
move_4 = Move(Geometry=end_3.Start, Motion=Y)  # -> Geometry, Transform
bbox = BoundingBox(Content=[crv_3, move_3.Geometry], Plane=PlaneXY(0, 0, 0), UnionBox=True)  # -> Box, Box_2
panel_59 = Panel(dist)
debrep = DeconstructBrep(Brep=bbox.Box)  # -> Faces, Edges, Vertices
division_2 = Division(A=panel_59, B=panel_58)
Z_3 = UnitZ(Factor="25")
item_10 = ListItem(List=debrep.Faces, Index=5, Wrap=True)
split_22 = TextSplit(Text=division_2, Separators=".")
move_5 = Move(Geometry=item_10, Motion=Z_3)  # -> Geometry, Transform
item_11 = ListItem(List=split_22, Index=0, Wrap=True)
ln_2 = Line(StartPoint=end_3.Start, EndPoint=move_4.Geometry)
series_11 = Series(Start=0, Step=panel_58, Count=item_11)
mesh = MeshBrep(
    Brep=move_5.Geometry,
    Settings={GridMaxCount=0, GridMinCount=16, JaggedSeams=False, MaxEdgeLength=0, MinEdgeLength=0.0001, MinTolerance=0, Refine=True, RefineAngle=0, RelativeTolerance=0.65, SimplePlanes=True, Tolerance=0})
X = UnitX(Factor=panel_59)
X_2 = UnitX(Factor=series_11)
pcx_2 = CurvePlane(Curve=join_2, Plane=xy)  # -> flatten(Points), ParamsC, ParamsP
mcol = MeshColours(Mesh=mesh, Colours=ColourSwatch(SwatchColor=RGB(0, 25, 87)))
move_6 = Move(Geometry=end_5.Start, Motion=X_2)  # -> Geometry, Transform
move_7 = Move(Geometry=end_5.Start, Motion=X)  # -> Geometry, Transform
group = Group(Objects=ln_2)
pdecon = Deconstruct(Point=move_6.Geometry)  # -> XComponent, YComponent, ZComponent
pdecon_2 = Deconstruct(Point=pcx_2.Points)  # -> XComponent, YComponent, ZComponent
ln_3 = Line(StartPoint=end_5.Start, EndPoint=move_7.Geometry)
move_8 = Move(Geometry=ln_3, Motion=Y)  # -> Geometry, Transform
larger = LargerThan(FirstNumber=graft(pdecon_2.XComponent), SecondNumber=pdecon.XComponent)  # -> LargerThan, OrEqualTo
group_2 = Group(Objects=[crv_3, move_3.Geometry])
loft = Loft(
    Curves=[ln_3, move_8.Geometry],
    Options={Adjust=False, Closed=False, LoftEnds=0, LoftSimp=0, LoftType=0, Rebuild=10, Refit=0.01})
dispatch_2 = Dispatch(List=pdecon.XComponent, DispatchPattern=larger.LargerThan)  # -> ListA, ListB
pt_2 = ConstructPoint(XCoordinate=dispatch_2.ListB, YCoordinate=0, ZCoordinate=graft(pdecon_2.ZComponent))
srf_cp = SurfaceClosestPoint(Point=end_5.Start, Surface=loft)  # -> Point, UVPoint, Distance
replace_2 = ReplaceItems(List=pt_2, Item=graft(pcx_2.Points), Indices=0, Wrap=False)
cullpt = CullDuplicates(Points=replace_2, Tolerance="1", CullMode=3)  # -> Points, Indices, Valence
pline = PolyLine(Vertices=cullpt.Points, Closed=False)
explode_4 = Explode(Curve=pline, Recursive=True)  # -> Segments, Vertices
move_9 = Move(Geometry=explode_4.Segments, Motion=Y)  # -> Geometry, Transform
weave = Weave(Pattern=[0, 1], Stream0=graft(move_9.Geometry), Stream1=graft(explode_4.Segments), NullGaps=False)
loft_2 = Loft(Curves=weave, Options={Adjust=False, Closed=False, LoftEnds=0, LoftSimp=0, LoftType=0, Rebuild=10, Refit=0.01})
debrep_2 = DeconstructBrep(Brep=loft_2)  # -> Faces, Edges, Vertices
end_6 = EndPoints(Curve=debrep_2.Edges)  # -> Start, End
pline_2 = PolyLine(Vertices=end_6.Start, Closed=True)
join_3 = JoinCurves(Curves=pline_2, Preserve=False)
trim = TrimTree(Tree=join_3, Depth=3)
split_23 = SplitList(List=reverse(trim), Index=1)  # -> ListA, reverse(ListB)
group_3 = Group(Objects=split_23.ListB)
group_4 = Group(Objects=flatten(group_3))
entwine_11 = Entwine(Branch00=group, Branch01=group_2, Branch02=group_4, Branch03=mcol, FlattenInputs=True)
group_5 = Group(Objects=flatten(entwine_11))

bowl_section_3 = BB_BowlSection(
    touchline=crv_2,
    outline=item_8,
    setDistance=pull.Distance,
    rows=bang_4.Branch1,
    stepDepths=bang_5.Branch1,
    landingDepths=bang_16.Branch1,
    floorHeights=bang_6.Branch1,
    cantilevers=bang_8.Branch1,
    cValues=bang_7.Branch1)  # -> section, sightlines, sectionInfo; inputs touchline: Curve, outline: list of Curve, rows: list of Int32, stepDepths: list, landingDepths: list, floorHeights: list, cantilevers: list, seatOffsets: list, cValues: list, stepHeights: list; plug-in component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
addition_5 = Addition(A=bang_3.Branch0, B=".01")
text_join_2 = TextJoin(Text=addition_5, Join=",")
end_7 = EndPoints(Curve=curve_4)  # -> Start, End
list_length_3 = ListLength(List=bang_3.Branch0)
end_8 = EndPoints(Curve=bowl_section_3.sightlines)  # -> Start, End
end_9 = EndPoints(Curve=curve_4)  # -> Start, End
Z_4 = UnitZ(Factor="-25")
equality = Equality(FirstNumber=list_length_3, SecondNumber="1")  # -> Equality, Inequality
deconstruct = Deconstruct(Point=end_7.End)  # -> XComponent, YComponent, ZComponent
move_10 = Move(Geometry=end_9.Start, Motion=Z_4)  # -> Geometry, Transform
dispatch_3 = Dispatch(List=text_join_2, DispatchPattern=equality.Equality)  # -> ListA, ListB
ln_4 = Line(StartPoint=end_9.Start, EndPoint=move_10.Geometry)
join_4 = JoinCurves(Curves=[curve_4, ln_4], Preserve=False)
insert_items_2 = InsertItems(List=dispatch_3.ListA, Item="0", Indices="0", Wrap=True)
text_split_3 = TextSplit(Text=dispatch_3.ListB, Separators=",")
merge_16 = Merge(Data1=insert_items_2, Data2=text_split_3)
crv_4 = Curve(curve_4)
end_10 = EndPoints(Curve=curve_4)  # -> Start, End
clean_tree_3 = CleanTree(RemoveNulls=True, RemoveInvalid=True, RemoveEmpty=True, Tree=flatten(merge_16))
Y_2 = UnitY(Factor="7.5")
pt_3 = ConstructPoint(XCoordinate=0, YCoordinate=0, ZCoordinate=clean_tree_3)
panel_60 = Panel(bang_9.Branch0)
move_11 = Move(Geometry=crv_4, Motion=Y_2)  # -> Geometry, Transform
move_12 = Move(Geometry=end_8.Start, Motion=Y_2)  # -> Geometry, Transform
xy_2 = XYPlane(Origin=pt_3)
panel_61 = Panel(dist)
bbox_2 = BoundingBox(Content=[crv_4, move_11.Geometry], Plane=PlaneXY(0, 0, 0), UnionBox=True)  # -> Box, Box_2
debrep_3 = DeconstructBrep(Brep=bbox_2.Box)  # -> Faces, Edges, Vertices
division_3 = Division(A=panel_61, B=panel_60)
pcx_3 = CurvePlane(Curve=join_4, Plane=xy_2)  # -> flatten(Points), ParamsC, ParamsP
Z_5 = UnitZ(Factor="25")
item_12 = ListItem(List=debrep_3.Faces, Index=5, Wrap=True)
round_2 = Round(Number=division_3)  # -> Nearest, Floor, Ceiling
move_13 = Move(Geometry=item_12, Motion=Z_5)  # -> Geometry, Transform
ln_5 = Line(StartPoint=end_8.Start, EndPoint=move_12.Geometry)
mesh_2 = MeshBrep(
    Brep=move_13.Geometry,
    Settings={GridMaxCount=0, GridMinCount=16, JaggedSeams=False, MaxEdgeLength=0, MinEdgeLength=0.0001, MinTolerance=0, Refine=True, RefineAngle=0, RelativeTolerance=0.65, SimplePlanes=True, Tolerance=0})
series_12 = Series(Start=0, Step=panel_60, Count=round_2.Nearest)
panel_62 = Panel(pcx_3.Points)
X_3 = UnitX(Factor=panel_61)
mcol_2 = MeshColours(Mesh=mesh_2, Colours=ColourSwatch(SwatchColor=RGB(255, 132, 0)))
X_4 = UnitX(Factor=series_12)
move_14 = Move(Geometry=end_10.Start, Motion=X_4)  # -> Geometry, Transform
move_15 = Move(Geometry=end_10.Start, Motion=X_3)  # -> Geometry, Transform
group_6 = Group(Objects=ln_5)
pdecon_3 = Deconstruct(Point=move_14.Geometry)  # -> XComponent, YComponent, ZComponent
pdecon_4 = Deconstruct(Point=pcx_3.Points)  # -> XComponent, YComponent, ZComponent
larger_2 = LargerThan(FirstNumber=graft(pdecon_4.XComponent), SecondNumber=pdecon_3.XComponent)  # -> LargerThan, OrEqualTo
group_7 = Group(Objects=[crv_4, move_11.Geometry])
dispatch_4 = Dispatch(List=pdecon_3.XComponent, DispatchPattern=larger_2.LargerThan)  # -> ListA, ListB
pt_4 = ConstructPoint(XCoordinate=dispatch_4.ListB, YCoordinate=0, ZCoordinate=graft(pdecon_4.ZComponent))
insert_items_3 = InsertItems(List=pt_4, Item=graft(pcx_3.Points), Indices="0", Wrap=True)
cull_duplicates = CullDuplicates(Points=insert_items_3, Tolerance="2", CullMode=3)  # -> Points, Indices, Valence
pline_3 = PolyLine(Vertices=cull_duplicates.Points, Closed=False)
explode_5 = Explode(Curve=pline_3, Recursive=True)  # -> Segments, Vertices
move_16 = Move(Geometry=explode_5.Segments, Motion=Y_2)  # -> Geometry, Transform
weave_2 = Weave(Pattern=[0, 1], Stream0=graft(move_16.Geometry), Stream1=graft(explode_5.Segments), NullGaps=False)
loft_3 = Loft(Curves=weave_2, Options={Adjust=False, Closed=False, LoftEnds=0, LoftSimp=0, LoftType=0, Rebuild=10, Refit=0.01})
debrep_4 = DeconstructBrep(Brep=loft_3)  # -> Faces, Edges, Vertices
end_11 = EndPoints(Curve=debrep_4.Edges)  # -> Start, End
pline_4 = PolyLine(Vertices=end_11.Start, Closed=True)
ln_6 = Line(StartPoint=end_10.Start, EndPoint=move_15.Geometry)
join_5 = JoinCurves(Curves=pline_4, Preserve=False)
move_17 = Move(Geometry=ln_6, Motion=Y_2)  # -> Geometry, Transform
end_points = EndPoints(Curve=curve_4)  # -> Start, End
trim_2 = TrimTree(Tree=join_5, Depth=3)
end_12 = EndPoints(Curve=move_17.Geometry)  # -> Start, End
end_13 = EndPoints(Curve=ln_6)  # -> Start, End
area = Area(Geometry=trim_2)  # -> Area, Centroid
ln_7 = Line(StartPoint=end_12.Start, EndPoint=end_13.Start)
ln_8 = Line(StartPoint=end_12.End, EndPoint=end_13.End)
point = Point(end_points.End)
deconstruct_2 = Deconstruct(Point=area.Centroid)  # -> XComponent, YComponent, ZComponent
deconstruct_3 = Deconstruct(Point=point)  # -> XComponent, YComponent, ZComponent
lng = ListLength(List=trim_2)
item_13 = ListItem(List=flatten(lng), Index=0, Wrap=True)
division_4 = Division(A="1", B=item_13)
series_13 = Series(Start=0, Step=division_4, Count=item_13)
tweencrv = TweenCurve(CurveA=ln_7, CurveB=ln_8, Factor=series_13, BlendType=0)
merge_17 = Merge(Data1=tweencrv, Data2=ln_8)
addition_6 = Addition(A=deconstruct_3.XComponent, B="5")
group_8 = Group(Objects=trim_2)
larger_than_3 = LargerThan(FirstNumber=deconstruct_2.XComponent, SecondNumber=addition_6)  # -> LargerThan, OrEqualTo
loft_4 = Loft(
    Curves=flatten(merge_17),
    Options={Adjust=False, Closed=False, LoftEnds=0, LoftSimp=0, LoftType=1, Rebuild=10, Refit=0.01})
group_9 = Group(Objects=flatten(group_8))
entwine_12 = Entwine(Branch00=group_6, Branch01=group_7, Branch02=group_9, Branch03=mcol_2, FlattenInputs=True)
dispatch_5 = Dispatch(List=trim_2, DispatchPattern=larger_than_3.LargerThan)  # -> ListA, reverse(ListB)
debrep_5 = DeconstructBrep(Brep=loft_4)  # -> Faces, Edges, Vertices
group_10 = Group(Objects=flatten(entwine_12))
item_14 = ListItem(List=debrep_5.Vertices, Index=3, Wrap=True)
srf_cp_2 = SurfaceClosestPoint(Point=item_14, Surface=loft_4)  # -> Point, UVPoint, Distance

list_length_4 = ListLength(List=bang_3.Branch0)
move_18 = Move(Geometry=end_2.Start, Motion=Z)  # -> Geometry, Transform
equality_2 = Equality(FirstNumber=list_length_4, SecondNumber="1")  # -> Equality, Inequality
end_14 = EndPoints(Curve=curve_5)  # -> Start, End
deconstruct_4 = Deconstruct(Point=end_14.End)  # -> XComponent, YComponent, ZComponent
ln_9 = Line(StartPoint=end_2.Start, EndPoint=move_18.Geometry)
join_6 = JoinCurves(Curves=[bowl_section.section, ln_9], Preserve=False)
dispatch_6 = Dispatch(List=text_join, DispatchPattern=equality_2.Equality)  # -> ListA, ListB
insert_items_4 = InsertItems(List=dispatch_6.ListA, Item="0", Indices="0", Wrap=True)
text_split_4 = TextSplit(Text=dispatch_6.ListB, Separators=",")
crv_5 = Curve(bowl_section.section)
end_15 = EndPoints(Curve=bowl_section.section)  # -> Start, End
merge_18 = Merge(Data1=insert_items_4, Data2=text_split_4)
Y_3 = UnitY(Factor="7.5")
clean_tree_4 = CleanTree(RemoveNulls=True, RemoveInvalid=True, RemoveEmpty=True, Tree=flatten(merge_18))
panel_63 = Panel(bang_9.Branch0)
pt_5 = ConstructPoint(XCoordinate=0, YCoordinate=0, ZCoordinate=0)
move_19 = Move(Geometry=crv_5, Motion=Y_3)  # -> Geometry, Transform
move_20 = Move(Geometry=end.Start, Motion=Y_3)  # -> Geometry, Transform
xy_3 = XYPlane(Origin=pt_5)
panel_64 = Panel(dist)
division_5 = Division(A=panel_64, B=panel_63)
pcx_4 = CurvePlane(Curve=join_6, Plane=xy_3)  # -> flatten(Points), ParamsC, ParamsP
list_item_30 = ListItem(List=pcx_4.Points, Index=Slider(1, range=0..10), Wrap=True)
round_3 = Round(Number=division_5)  # -> Nearest, Floor, Ceiling
Z_6 = UnitZ(Factor="25")
ln_10 = Line(StartPoint=end.Start, EndPoint=move_20.Geometry)
series_14 = Series(Start=0, Step=panel_63, Count=round_3.Nearest)
panel_65 = Panel(pcx_4.Points)
X_5 = UnitX(Factor=panel_64)
X_6 = UnitX(Factor=series_14)
move_21 = Move(Geometry=end_15.Start, Motion=X_6)  # -> Geometry, Transform
move_22 = Move(Geometry=end_15.Start, Motion=X_5)  # -> Geometry, Transform
group_11 = Group(Objects=ln_10)
pdecon_5 = Deconstruct(Point=move_21.Geometry)  # -> XComponent, YComponent, ZComponent
pdecon_6 = Deconstruct(Point=pcx_4.Points)  # -> XComponent, YComponent, ZComponent
Z_7 = UnitZ(Factor="25")
larger_3 = LargerThan(FirstNumber=graft(pdecon_6.XComponent), SecondNumber=pdecon_5.XComponent)  # -> LargerThan, OrEqualTo
group_12 = Group(Objects=[crv_5, move_19.Geometry])
dispatch_7 = Dispatch(List=pdecon_5.XComponent, DispatchPattern=larger_3.LargerThan)  # -> ListA, ListB
pt_6 = ConstructPoint(XCoordinate=dispatch_7.ListB, YCoordinate=0, ZCoordinate=graft(pdecon_6.ZComponent))
replace_3 = ReplaceItems(List=pt_6, Item=graft(pcx_4.Points), Indices=0, Wrap=False)
cullpt_2 = CullDuplicates(Points=replace_3, Tolerance="1", CullMode=3)  # -> Points, Indices, Valence
pline_5 = PolyLine(Vertices=cullpt_2.Points, Closed=False)
explode_6 = Explode(Curve=pline_5, Recursive=True)  # -> Segments, Vertices
move_23 = Move(Geometry=explode_6.Segments, Motion=Y_3)  # -> Geometry, Transform
weave_3 = Weave(Pattern=[0, 1], Stream0=graft(move_23.Geometry), Stream1=graft(explode_6.Segments), NullGaps=False)
loft_5 = Loft(Curves=weave_3, Options={Adjust=False, Closed=False, LoftEnds=0, LoftSimp=0, LoftType=0, Rebuild=10, Refit=0.01})
debrep_6 = DeconstructBrep(Brep=loft_5)  # -> Faces, Edges, Vertices
end_16 = EndPoints(Curve=debrep_6.Edges)  # -> Start, End
ln_11 = Line(StartPoint=end_15.Start, EndPoint=move_22.Geometry)
pline_6 = PolyLine(Vertices=end_16.Start, Closed=True)
move_24 = Move(Geometry=ln_11, Motion=Y_3)  # -> Geometry, Transform
join_7 = JoinCurves(Curves=pline_6, Preserve=False)
end_17 = EndPoints(Curve=move_24.Geometry)  # -> Start, End
end_18 = EndPoints(Curve=ln_11)  # -> Start, End
trim_3 = TrimTree(Tree=join_7, Depth=3)
tree_statistics_27 = TreeStatistics(Tree=trim_3)  # -> Paths, Length, Count
ln_12 = Line(StartPoint=end_17.Start, EndPoint=end_18.Start)
ln_13 = Line(StartPoint=end_17.End, EndPoint=end_18.End)
item_15 = ListItem(List=tree_statistics_27.Paths, Index=0, Wrap=True)
lng_2 = ListLength(List=trim_3)
tree_branch_9 = TreeBranch(Tree=trim_3, Path=item_15, MaintainPaths=True)
split_24 = SplitList(List=reverse(trim_3), Index=1)  # -> ListA, reverse(ListB)
item_16 = ListItem(List=flatten(lng_2), Index=0, Wrap=True)
division_6 = Division(A="1", B=item_16)
series_15 = Series(Start=0, Step=division_6, Count=item_16)
tweencrv_2 = TweenCurve(CurveA=ln_12, CurveB=ln_13, Factor=series_15, BlendType=0)
merge_19 = Merge(Data1=tweencrv_2, Data2=ln_13)
explode_7 = Explode(Curve=tree_branch_9, Recursive=True)  # -> Segments, Vertices
group_13 = Group(Objects=split_24.ListB)
list_item_31 = ListItem(List=explode_7.Segments, Index=0, Wrap=True)  # -> Item, Item1, Item2
flatten_tree = FlattenTree(Tree=list_item_31.Item2, Path="{0}")
group_14 = Group(Objects=flatten(group_13))
list_item_32 = ListItem(List=reverse(flatten_tree), Index=0, Wrap=True)
loft_6 = Loft(
    Curves=flatten(merge_19),
    Options={Adjust=False, Closed=False, LoftEnds=0, LoftSimp=0, LoftType=1, Rebuild=10, Refit=0.01})
debrep_7 = DeconstructBrep(Brep=loft_6)  # -> Faces, Edges, Vertices
flip_curve = FlipCurve(Curve=list_item_32)  # -> Curve, Flag
item_17 = ListItem(List=debrep_7.Vertices, Index=3, Wrap=True)
merge_20 = Merge(Data1=flatten(list_item_31.Item), Data2=flip_curve.Curve)
list_length_5 = ListLength(List=merge_20)
srf_cp_3 = SurfaceClosestPoint(Point=item_17, Surface=loft_6)  # -> Point, UVPoint, Distance
loft_7 = Loft(Curves=merge_20, Options={Adjust=False, Closed=False, LoftEnds=0, LoftSimp=0, LoftType=1, Rebuild=10, Refit=0.01})
panel_66 = Panel(bang_9.Branch1)
explode_8 = Explode(Curve=item_8, Recursive=True)  # -> Segments, Vertices
len = Length(Curve=explode_8.Segments)
division_7 = Division(A=len, B=panel_66)
int = Integer(division_7)

# ---- group: even number of sector divisions
lng_3 = ListLength(List=int)
smaller = SmallerThan(FirstNumber=division_7, SecondNumber=Slider(4, range=0..10))  # -> SmallerThan, OrEqualTo
series_16 = Series(Start=0, Step=1, Count=lng_3)
dispatch_8 = Dispatch(List=series_16, DispatchPattern=smaller.SmallerThan)  # -> ListA, ListB
replace_4 = ReplaceItems(List=int, Item="4", Indices=dispatch_8.ListA, Wrap=False)
int_2 = Integer(replace_4)
division_8 = Division(A=int_2, B="2")
split_25 = TextSplit(Text=division_8, Separators=".")
item_18 = ListItem(List=split_25, Index=0, Wrap=True)
multiplication_2 = Multiplication(A=item_18, B=2)  # -> flatten(Result)

# ----
panel_67 = Panel(item.Item8)
curve_6 = Curve(<curve referenced from the Rhino model>)
series_17 = Series(Start=0, Step=item.Item7, Count=panel_67)
offset = OffsetCurve(Curve=item_7, Distance=series_17, Corners=1)
item_19 = ListItem(List=flatten(curve_6), Index=0, Wrap=True)
explode_9 = Explode(Curve=item_19, Recursive=True)  # -> Segments, Vertices
panel_68 = Panel("""0
2
4
6""")

# ---- group: Number of bay divisions with 4 corner divisions
len_2 = Length(Curve=explode.Segments)
division_9 = Division(A=len_2, B=grid_width)
int_3 = Integer(division_9)
lng_4 = ListLength(List=int_3)
smaller_2 = SmallerThan(FirstNumber=division_9, SecondNumber=Slider(4, range=0..10))  # -> SmallerThan, OrEqualTo
series_18 = Series(Start=0, Step=1, Count=lng_4)
panel_69 = Panel("4")
dispatch_9 = Dispatch(List=series_18, DispatchPattern=smaller_2.SmallerThan)  # -> ListA, ListB
replace_5 = ReplaceItems(List=int_3, Item=panel_69, Indices=dispatch_9.ListA, Wrap=False)
int_4 = Integer(replace_5)
division_10 = Division(A=int_4, B="2")
split_26 = TextSplit(Text=division_10, Separators=".")
item_20 = ListItem(List=split_26, Index=0, Wrap=True)
multiplication_3 = Multiplication(A=item_20, B=2)  # -> flatten(Result)
replace_6 = ReplaceItems(List=multiplication_3, Item=panel_69, Indices=panel_68, Wrap=False)

# ---- group: Central bay number per stand
explode_10 = Explode(Curve=explode.Segments, Recursive=True)  # -> Segments, Vertices
panel_70 = Panel("""1
3
5
7""")
list_item_33 = ListItem(List=flatten(explode_10.Segments), Index=panel_70, Wrap=True)
length = Length(Curve=list_item_33)
division_11 = Division(A=length, B=grid_width)
round_4 = Round(Number=division_11)  # -> Nearest, Floor, Ceiling
weave_4 = Weave(Pattern=[0, 1, 0, 1, 0, 1, 0, 1], Stream0=panel_69, Stream1=graft(round_4.Nearest), NullGaps=False)  # -> flatten(Weave)
mass_addition = MassAddition(Input=weave_4)  # -> Result, PartialResults
list_item_34 = ListItem(List=mass_addition.PartialResults, Index=0, Wrap=True)  # -> Item, Item1, Item2, Item3, Item4, Item5, Item6, Item7
list_item_35 = ListItem(List=round_4.Nearest, Index=0, Wrap=True)  # -> Item, Item1, Item2, Item3, Item4, Item5, Item6, Item7

# ----
mass_addition_2 = MassAddition(Input=replace_6)  # -> Result, PartialResults
division_12 = Division(A=list_item_35.Item6, B="2")
series_19 = Series(Start=0, Step=1, Count=mass_addition_2.Result)
division_13 = Division(A=list_item_35.Item2, B="2")
center_long_east_stand = Addition(A=list_item_34.Item6, B=division_12)
round_5 = Round(Number=division_13)  # -> Nearest, Floor, Ceiling
center_long_east_stand_2 = Addition(A=list_item_34.Item2, B=round_5.Nearest)
dispatch_10 = Dispatch(List=series_19, DispatchPattern=merge_2)  # -> ListA, ListB
panel_71 = Panel(dispatch_10.ListA)
panel_72 = Panel(panel_71)
tree_statistics_28 = TreeStatistics(Tree=panel_72)  # -> Paths, Length, Count
replace_paths_25 = ReplacePaths(Data=panel_72, Search=tree_statistics_28.Paths, Replace="{18;0;3}")
tree_statistics_29 = TreeStatistics(Tree=panel_72)  # -> Paths, Length, Count
replace_paths_26 = ReplacePaths(Data=panel_72, Search=tree_statistics_29.Paths, Replace="{8;0;0}")
shift_list_3 = ShiftList(List=explode_9.Segments, Shift=Slider(3, range=0..10), Wrap=True)
replace_7 = ReplaceItems(List=multiplication_2, Item="8", Indices=panel_68, Wrap=False)
rev = ReverseList(List=flatten(curve_6))  # -> graft(List)
panel_73 = Panel("""6
10
6
15
6
10
6
15""")
divide = DivideCurve(Curve=graft(shift_list_3), Count=graft(panel_73), Kinks=False)  # -> Points, Tangents, Parameters
divide_2 = DivideCurve(Curve=graft(explode_8.Segments), Count=graft(panel_73), Kinks=False)  # -> Points, Tangents, Parameters
panel_74 = Panel(replace_7)
series_20 = Series(Start=0, Step=bang_9.Branch0, Count=item.Item4)
ln_14 = Line(StartPoint=divide_2.Points, EndPoint=divide.Points)
offset_l = OffsetCurveLoose(Curve=item_4, Distance=expr("x+.1", series_20))
ccx = CurveCurve(CurveA=graft(rev), CurveB=flatten(ln_14))  # -> Points, ParamsA, ParamsB
ccx_2 = CurveCurve(CurveA=graft(offset_l), CurveB=flatten(ln_14))  # -> Points, ParamsA, ParamsB
trim_4 = TrimTree(Tree=ccx.Points, Depth=1)
trim_5 = TrimTree(Tree=ccx_2.Points, Depth=1)
cullpt_3 = CullDuplicates(Points=trim_4, Tolerance=0.1, CullMode=3)  # -> Points, Indices, Valence
cullpt_4 = CullDuplicates(Points=trim_5, Tolerance=0.1, CullMode=3)  # -> Points, Indices, Valence
pline_7 = PolyLine(Vertices=cullpt_3.Points, Closed=True)  # -> flatten(Polyline)
pline_8 = PolyLine(Vertices=cullpt_4.Points, Closed=True)
flatten = FlattenTree(Tree=pline_8, Path="{0}")
item_21 = ListItem(List=reverse(flatten), Index=0, Wrap=True)
item_22 = ListItem(List=reverse(pline_7), Index=0, Wrap=True)
item_23 = ListItem(List=pline_7, Index=bang_13.Branch5, Wrap=True)
explode_11 = Explode(Curve=item_21, Recursive=True)  # -> Segments, Vertices
explode_12 = Explode(Curve=item_22, Recursive=True)  # -> Segments, Vertices
explode_13 = Explode(Curve=pline_7, Recursive=True)  # -> Segments, Vertices
explode_14 = Explode(Curve=flatten, Recursive=True)  # -> Segments, Vertices
flip = FlipMatrix(Data=explode_13.Segments)  # -> simplify(Data)
flip_2 = FlipMatrix(Data=explode_14.Segments)  # -> simplify(Data)
loft_opt = LoftOptions(Closed=False, Adjust=False, Rebuild=0, Refit=1, Type=Slider(1, range=0..10))
panel_75 = Panel("50")
series_21 = Series(Start=Slider(58, range=0..100), Step=1, Count="17")
analysis_data_processed = Panel("C:\AOMSDML\Stage 3\data processed.txt")

# ---- group: select data types for data analysis
# On the right there are groups for NN classification and K-Means clustering
analysis_type = ValueList({"paths longer than 12m": 0, "averge lenght of shortest path": 1, "difference between shortest and longest path": 2, "average ray length": 3, "rays above 20m": 4, "area commercial": 5, "area concourse": 6}, selected=["paths longer than 12m", "averge lenght of shortest path", "difference between shortest and longest path", "average ray length", "rays above 20m", "area commercial", "area concourse"])

# ---- group: connect those two for other data input
read_file = ReadFile(File=analysis_data_processed, PerLineParse=True)
data = Data([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])

# ----
text_split_5 = TextSplit(Text=data, Separators=",")
tree_statistics_30 = TreeStatistics(Tree=text_split_5)  # -> Paths, Length, Count
list_item_36 = ListItem(List=tree_statistics_30.Paths, Index=analysis_type, Wrap=True)
tree_branch_10 = TreeBranch(Tree=text_split_5, Path=list_item_36, MaintainPaths=True)
flip_matrix = FlipMatrix(Data=tree_branch_10)
isovist_n_circulation_performance = Data(flip_matrix)

# ---- group: Stage 2 rows
subtraction_2 = Subtraction(A="50", B="40")
series_22 = Series(Start="40", Step=1, Count=subtraction_2)

# ----
list_length_6 = ListLength(List=series_22)
repeat_data_11 = RepeatData(Data=graft(series), Length=list_length_6)
repeat_data_12 = RepeatData(Data=series_22, Length="60")
list_length_7 = ListLength(List=series_22)
repeat_data_13 = RepeatData(Data=graft(panel_15), Length=list_length_7)  # -> flatten(Data)

# ---- group: Stage 2 rows (continued)
subtraction_3 = Subtraction(A=series_22, B=repeat_data_11)
weave_5 = Weave(Pattern=[0, 1], Stream0=graft(subtraction_3), Stream1=graft(repeat_data_11), NullGaps=False)
panel_76 = Panel(weave_5)
list_item_37 = ListItem(List=weave_5, Index=0, Wrap=True)  # -> Item, Item1
subtraction_4 = Subtraction(A=list_item_37.Item1, B="5")
weave_6 = Weave(Pattern=[0, 1, 2], Stream0=list_item_37.Item, Stream1="5", Stream2=subtraction_4, NullGaps=False)

# ----
text_join_3 = TextJoin(Text=weave_5, Join=",")
repeat_data_14 = RepeatData(Data=flatten(text_join_3), Length="300")
split_tree_3 = SplitTree(Data=weave_6, Masks=flatten("{0;0;0;0;*}"))  # -> Positive, Negative
list_item_38 = ListItem(List=split_tree_3.Negative, Index=0, Wrap=True)
tree_statistics_31 = TreeStatistics(Tree=split_tree_3.Negative)  # -> Paths, Length, Count
smaller_than_2 = SmallerThan(FirstNumber=list_item_38, SecondNumber=Slider(10, range=0..10))  # -> flatten(SmallerThan), OrEqualTo
text_split_6 = TextSplit(Text=repeat_data_14, Separators=",")
dispatch_11 = Dispatch(List=tree_statistics_31.Paths, DispatchPattern=smaller_than_2.SmallerThan)  # -> ListA, ListB
split_tree_4 = SplitTree(Data=split_tree_3.Negative, Masks=flatten(dispatch_11.ListA))  # -> Positive, Negative
tree_statistics_32 = TreeStatistics(Tree=split_tree_4.Negative)  # -> Paths, Length, Count

# ---- group: Stage 2 rows (continued)
entwine_13 = Entwine(Branch0X=graft(repeat_data_12), Branch1X=text_split_6, Branch2X=split_tree_4.Negative, FlattenInputs=False)
panel_78 = Panel(entwine_13)

# ----
list_item_39 = ListItem(List=split_tree_4.Negative, Index=0, Wrap=True)  # -> Item, Item1
panel_79 = Panel(split_tree_4.Negative)
addition_7 = Addition(A=list_item_39.Item, B=list_item_39.Item1)
tree_statistics_33 = TreeStatistics(Tree=entwine_13)  # -> Paths, Length, Count
list_item_40 = ListItem(List=tree_statistics_33.Paths, Index=panel_4, Wrap=True)
tree_branch_11 = TreeBranch(Tree=entwine_13, Path=list_item_40, MaintainPaths=True)
list_length_8 = ListLength(List=tree_branch_11)
series_23 = Series(Start=0, Step=1, Count=list_length_8)
replace_paths_27 = ReplacePaths(Data=tree_branch_11, Search=list_item_40, Replace="{1;0;0}")
tree_statistics_34 = TreeStatistics(Tree=weave_5)  # -> Paths, Length, Count
tree_statistics_35 = TreeStatistics(Tree=split_tree_4.Negative)  # -> Paths, Length, Count
list_length_9 = ListLength(List=tree_statistics_35.Paths)
list_length_10 = ListLength(List=tree_statistics_34.Paths)
repeat_data_15 = RepeatData(Data=graft(panel_16), Length=list_length_10)  # -> flatten(Data)
repeat_data_16 = RepeatData(Data=graft("12"), Length=list_length_9)  # -> flatten(Data)
entwine_14 = Entwine(Branch00=repeat_data_13, Branch01=repeat_data_15, Branch02=repeat_data_16, FlattenInputs=True)  # -> flatten(Result)
list_item_41 = ListItem(List=entwine_14, Index=panel_4, Wrap=True)
panel_80 = Panel(list_item_41)
panel_81 = Panel(list_item_41)
replace_text = ReplaceText(Text="{A;0;*}", Find="A", Replace=panel_81, RecursiveReplace=False)
split_tree_5 = SplitTree(Data=entwine_2, Masks=flatten(replace_text))  # -> Positive, Negative
tree_statistics_36 = TreeStatistics(Tree=split_tree_5.Positive)  # -> Paths, Length, Count
replace_text_2 = ReplaceText(Text="{A;0;*}", Find="A", Replace=panel_81, RecursiveReplace=False)
split_tree_6 = SplitTree(Data=entwine_3, Masks=flatten(replace_text_2))  # -> Positive, Negative
tree_statistics_37 = TreeStatistics(Tree=split_tree_6.Positive)  # -> Paths, Length, Count
replace_text_3 = ReplaceText(Text="{A;0;*}", Find="A", Replace=panel_81, RecursiveReplace=False)
split_tree_7 = SplitTree(Data=entwine_4, Masks=flatten(replace_text_3))  # -> Positive, Negative
tree_statistics_38 = TreeStatistics(Tree=split_tree_7.Positive)  # -> Paths, Length, Count
replace_text_4 = ReplaceText(Text="{A;0;*}", Find="A", Replace=panel_81, RecursiveReplace=False)
split_tree_8 = SplitTree(Data=entwine_6, Masks=flatten(replace_text_4))  # -> Positive, Negative
tree_statistics_39 = TreeStatistics(Tree=split_tree_8.Positive)  # -> Paths, Length, Count

# ---- group: Floor heights generation (adaptive)
panel_82 = Panel("""0.2
2.5
2.5
1.2
2.6""")
xz_2 = XZPlane(Origin=Point(0, 0, 0))
panel_83 = Panel("""2
2
2
.1
1.5
0
0
2.5""")
panel_84 = Panel("""2.2
1.2
0.01
1
0.01
0.01
1
0.01""")
panel_85 = Panel(""".75
.75
.75
.75
.75
.75
.75""")
panel_86 = Panel(""".12
.12
.12
.12
.12
.12
.12
.12""")
pcx_5 = CurvePlane(Curve=item_8, Plane=xz_2)  # -> Points, ParamsC, ParamsP
item_24 = ListItem(List=pcx_5.Points, Index=list_item_3, Wrap=True)  # -> Item, Item1
pull_2 = PullPoint(Point=item_24.Item, Geometry=crv_2, ClosestOnly=True)  # -> ClosestPoint, Distance
bowl_section_4 = BB_BowlSection(
    touchline=crv_2,
    outline=item_8,
    setDistance=pull_2.Distance,
    rows=tree_branch_11,
    stepDepths=panel_85,
    landingDepths=panel_83,
    floorHeights=panel_82,
    cantilevers=panel_84,
    cValues=panel_86)  # -> section, sightlines, sectionInfo; inputs touchline: Curve, outline: list of Curve, rows: list of Int32, stepDepths: list, landingDepths: list, floorHeights: list, cantilevers: list, seatOffsets: list, cValues: list, stepHeights: list; plug-in component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
explode_15 = Explode(Curve=bowl_section_4.section, Recursive=True)  # -> Segments, Vertices
length_2 = Length(Curve=explode_15.Segments)
panel_87 = Panel("2.75")
equality_3 = Equality(FirstNumber=length_2, SecondNumber=panel_87)  # -> Equality, Inequality; disabled

# ----
replace_paths_28 = ReplacePaths(Data=panel_85, Search="{0}", Replace="{2;0;0}")
merge_21 = Merge(Data1=replace_paths_28, Data2=top_gangway_top.Negative)
top_gangway_top_13 = SplitTree(Data=merge_21, Masks=flatten("{17;0;0}"))  # -> Positive, Negative
replace_paths_29 = ReplacePaths(Data=panel_83, Search="{0}", Replace="{17;0;0}")
merge_22 = Merge(Data1=replace_paths_29, Data2=top_gangway_top_13.Negative)
top_gangway_top_14 = SplitTree(Data=merge_22, Masks=flatten("{3;0;0}"))  # -> Positive, Negative
replace_paths_30 = ReplacePaths(Data=panel_82, Search="{0}", Replace="{3;0;0}")
merge_23 = Merge(Data1=replace_paths_30, Data2=top_gangway_top_14.Negative)
top_gangway_top_15 = SplitTree(Data=merge_23, Masks=flatten("{5;0;0}"))  # -> Positive, Negative
replace_paths_31 = ReplacePaths(Data=panel_84, Search="{0}", Replace="{5;0;0}")
merge_24 = Merge(Data1=replace_paths_31, Data2=top_gangway_top_15.Negative)
top_gangway_top_16 = SplitTree(Data=merge_24, Masks=flatten("{4;0;0}"))  # -> Positive, Negative
replace_paths_32 = ReplacePaths(Data=panel_86, Search="{0}", Replace="{4;0;0}")
merge_25 = Merge(Data1=replace_paths_32, Data2=top_gangway_top_16.Negative)
similarity = Similarity(FirstNumber=length_2, SecondNumber=panel_87, Threshold=0.1)  # -> Similarity, AbsoluteDifference
top_gangway_top_17 = SplitTree(Data=merge_25, Masks=flatten("{1;0;0}"))  # -> Positive, Negative

# ---- group: Floor heights generation (adaptive) (continued)
dispatch_12 = Dispatch(List=explode_15.Segments, DispatchPattern=similarity.Similarity)  # -> ListA, ListB
point_on_curve_3 = PointOnCurve(dispatch_12.ListA, parameter=0.5)
deconstruct_5 = Deconstruct(Point=point_on_curve_3)  # -> XComponent, YComponent, ZComponent

# ----
replace_items_2 = ReplaceItems(List=top_gangway_top_17.Positive, Item=tree_branch_11, Indices=series_23, Wrap=True)
merge_26 = Merge(Data1=replace_paths_27, Data2=top_gangway_top_17.Negative)
split_list_6 = SplitList(List=replace_items_2, Index=list_length_8)  # -> ListA, ListB
subtraction_5 = Subtraction(A=deconstruct_5.ZComponent, B="0.1")
list_length_11 = ListLength(List=subtraction_5)
trim_tree_3 = TrimTree(Tree=split_list_6.ListA, Depth=2)
larger_than_4 = LargerThan(FirstNumber=list_length_11, SecondNumber="1")  # -> LargerThan, OrEqualTo
equality_4 = Equality(FirstNumber=list_length_11, SecondNumber="1")  # -> Equality, Inequality
panel_88 = Panel(trim_tree_3)
dispatch_13 = Dispatch(List=subtraction_5, DispatchPattern=larger_than_4.LargerThan)  # -> ListA, ListB
dispatch_14 = Dispatch(List=subtraction_5, DispatchPattern=equality_4.Equality)  # -> ListA, ListB
insert_items_5 = InsertItems(List=dispatch_13.ListA, Item="0", Indices="0", Wrap=True)
list_length_12 = ListLength(List=insert_items_5)
division_14 = Division(A=dispatch_14.ListA, B="2")
list_item_42 = ListItem(List=insert_items_5, Index=expr("x-2", list_length_12), Wrap=True)
dispatch_15 = Dispatch(List=division_14, DispatchPattern=larger_than.LargerThan)  # -> ListA, ListB
addition_8 = Addition(A=list_item_42, B="3.5")
replace_items_3 = ReplaceItems(List=insert_items_5, Item=addition_8, Indices=expr("x-1", list_length_12), Wrap=False)
dispatch_16 = Dispatch(List=replace_items_3, DispatchPattern=smaller_than.SmallerThan)  # -> ListA, ListB
insert_items_6 = InsertItems(List=dispatch_15.ListA, Item="0", Indices="0", Wrap=True)
split_list_7 = SplitList(List=reverse(dispatch_16.ListA), Index="1")  # -> ListA, reverse(ListB)
merge_27 = Merge(Data1=dispatch.ListB, Data2=dispatch_16.ListB, Data3=insert_items_6, Data4=split_list_7.ListB)
clean_tree_5 = CleanTree(RemoveNulls=True, RemoveInvalid=True, RemoveEmpty=False, Tree=flatten(merge_27))
sort_list_2 = SortList(Keys=clean_tree_5)  # -> Keys, ValuesValuesA
floor_height = Panel(sort_list_2.Keys)
top_gangway_top_18 = SplitTree(Data=merge_26, Masks=flatten("{0;0}"))  # -> Positive, Negative
addition_9 = Addition(A=floor_height, B=Slider(8, range=0..10))
replace_8 = ReplaceItems(List=top_gangway_top_18.Positive, Item=merge, Indices=panel_5, Wrap=False)
pshift = ShiftPaths(Data=replace_8, Offset=-1)
merge_28 = Merge(Data1=pshift, Data2=top_gangway_top_18.Negative)
top_gangway_top_19 = SplitTree(Data=merge_28, Masks=flatten("{9;0;0}"))  # -> Positive, Negative
replace_9 = ReplaceItems(List=top_gangway_top_19.Positive, Item=grid_depth, Indices="0", Wrap=False)
trim_tree_4 = TrimTree(Tree=replace_9, Depth=1)
merge_29 = Merge(Data1=trim_tree_4, Data2=top_gangway_top_19.Negative)
top_gangway_top_20 = SplitTree(Data=merge_29, Masks=flatten("{9;0;1}"))  # -> Positive, Negative
panel_89 = Panel(replace_9)
tree_statistics_40 = TreeStatistics(Tree=floor_height)  # -> Paths, Length, Count
replace_10 = ReplaceItems(List=top_gangway_top_20.Positive, Item=grid_width, Indices="0", Wrap=False)
trim_tree_5 = TrimTree(Tree=replace_10, Depth=1)
merge_30 = Merge(Data1=trim_tree_5, Data2=top_gangway_top_20.Negative)
floor_height_2 = SplitTree(Data=merge_30, Masks=flatten("{6;0;0}"))  # -> Positive, Negative
panel_90 = Panel(replace_10)
replace_paths_33 = ReplacePaths(Data=floor_height, Search=tree_statistics_40.Paths, Replace="{6;0;0}")
merge_31 = Merge(Data1=replace_paths_33, Data2=floor_height_2.Negative)
top_gangway_top_21 = SplitTree(Data=merge_31, Masks=flatten("{11;0;1}"))  # -> Positive, Negative
panel_91 = Panel(replace_paths_33)
panel_92 = Panel(top_gangway_top_18.Positive)
panel_93 = Panel(top_gangway_top_21.Positive)
tree_statistics_41 = TreeStatistics(Tree=merge_31)  # -> Paths, Length, Count
list_item_43 = ListItem(List=top_gangway_top_21.Positive, Index="0", Wrap=True)
replace_11 = ReplaceItems(List=list_item_43, Item="1", Indices="0", Wrap=False)
pshift_2 = ShiftPaths(Data=replace_11, Offset=-1)
panel_95 = Panel(tree_statistics_41.Paths)
merge_32 = Merge(Data1=pshift_2, Data2=top_gangway_top_21.Negative)
top_gangway_top_22 = SplitTree(Data=merge_32, Masks=flatten("{16;0;0}"))  # -> Positive, Negative
panel_96 = Panel(top_gangway_top_22.Positive)
list_item_44 = ListItem(List=top_gangway_top_22.Positive, Index="0", Wrap=True)
replace_12 = ReplaceItems(List=list_item_44, Item=".5", Indices="0", Wrap=False)
pshift_3 = ShiftPaths(Data=replace_12, Offset=-1)
merge_33 = Merge(Data1=pshift_3, Data2=top_gangway_top_22.Negative)
top_gangway_top_23 = SplitTree(Data=merge_33, Masks=flatten("{18;0;3}"))  # -> Positive, Negative
panel_98 = Panel(top_gangway_top_23.Positive)
merge_34 = Merge(Data1=replace_paths_25, Data2=top_gangway_top_23.Negative)
top_gangway_top_24 = SplitTree(Data=merge_34, Masks=flatten("{18;0;7}"))  # -> Positive, Negative
list_item_45 = ListItem(List=top_gangway_top_24.Positive, Index=series_6, Wrap=True)
panel_99 = Panel(top_gangway_top_24.Positive)
replace_13 = ReplaceItems(List=list_item_45, Item=series_7, Indices="0", Wrap=False)
pshift_4 = ShiftPaths(Data=replace_13, Offset=-1)
merge_35 = Merge(Data1=pshift_4, Data2=top_gangway_top_24.Negative)
top_gangway_top_25 = SplitTree(Data=merge_35, Masks=flatten("{18;0;1}"))  # -> Positive, Negative
mass_addition_3 = MassAddition(Input=split_list_6.ListA)  # -> Result, PartialResults
list_item_46 = ListItem(List=top_gangway_top_25.Positive, Index="0", Wrap=True)
panel_101 = Panel(top_gangway_top_25.Positive)
replace_14 = ReplaceItems(List=list_item_46, Item=flatten(mass_addition_3.Result), Indices="0", Wrap=False)
pshift_5 = ShiftPaths(Data=replace_14, Offset=-1)
addition_10 = Addition(A=flatten(mass_addition_3.Result), B="1")
merge_36 = Merge(Data1=pshift_5, Data2=top_gangway_top_25.Negative)
top_gangway_top_26 = SplitTree(Data=merge_36, Masks=flatten("{18;0;4}"))  # -> Positive, Negative
list_item_47 = ListItem(List=top_gangway_top_26.Positive, Index="0", Wrap=True)
panel_102 = Panel(top_gangway_top_26.Positive)
panel_103 = Panel(pshift_5)
replace_15 = ReplaceItems(List=list_item_47, Item=addition_10, Indices="0", Wrap=False)
pshift_6 = ShiftPaths(Data=replace_15, Offset=-1)
tree_statistics_42 = TreeStatistics(Tree=pshift_6)  # -> Paths, Length, Count
merge_37 = Merge(Data1=pshift_6, Data2=top_gangway_top_26.Negative)
top_gangway_top_27 = SplitTree(Data=merge_37, Masks=flatten("{18;0;5}"))  # -> Positive, Negative
list_item_48 = ListItem(List=top_gangway_top_27.Positive, Index="0", Wrap=True)
panel_104 = Panel(top_gangway_top_27.Positive)
replace_16 = ReplaceItems(List=list_item_48, Item=addition, Indices="0", Wrap=False)
pshift_7 = ShiftPaths(Data=replace_16, Offset=-1)
merge_38 = Merge(Data1=pshift_7, Data2=top_gangway_top_27.Negative)
top_gangway_top_28 = SplitTree(Data=merge_38, Masks=flatten("{8;0;0}"))  # -> Positive, Negative
mass_addition_4 = MassAddition(Input=trim_tree_3)  # -> Result, PartialResults
division_15 = Division(A=mass_addition_4.Result, B=10)
list_item_49 = ListItem(List=top_gangway_top_28.Positive, Index=0, Wrap=True)
panel_105 = Panel(top_gangway_top_28.Positive)
replace_17 = ReplaceItems(List=list_item_49, Indices="0", Wrap=False)
# Other circulation
# Vertical circulation
# WC
# Commercial
# Service / Store
# Performers
# Hospitality
# Media
# Other
# Parking
# Concourse
round_6 = Round(Number=division_15)  # -> Nearest, Floor, Ceiling
pshift_8 = ShiftPaths(Data=replace_17, Offset=-1)
clean_tree_6 = CleanTree(RemoveNulls=True, RemoveInvalid=True, RemoveEmpty=False, Tree=pshift_8)
merge_39 = Merge(Data1=clean_tree_6, Data2=top_gangway_top_28.Negative)
top_gangway_top_29 = SplitTree(Data=merge_39, Masks=flatten(panel_13))  # -> Positive, Negative
tree_statistics_43 = TreeStatistics(Tree=top_gangway_top_29.Positive)  # -> Paths, Length, Count
list_length_13 = ListLength(List=tree_statistics_43.Paths)
subtraction_6 = Subtraction(A=list_length_13, B=round_6.Nearest)
panel_106 = Panel(top_gangway_top_29.Positive)
repeat_data_17 = RepeatData(Data="11", Length=round_6.Nearest)
repeat_data_18 = RepeatData(Data="10", Length=subtraction_6)
entwine_15 = Entwine(Branch00=repeat_data_17, Branch01=repeat_data_18, FlattenInputs=True)  # -> flatten(Result)
graft_tree = GraftTree(Tree=entwine_15, IncludeEmptyLists=True, IncludeNullItems=True)
tree_statistics_44 = TreeStatistics(Tree=graft_tree)  # -> Paths, Length, Count
list_item_50 = ListItem(List=tree_statistics_44.Paths, Index=panel_14, Wrap=True)
split_tree_9 = SplitTree(Data=graft_tree, Masks=flatten(list_item_50))  # -> Positive, Negative
tree_statistics_45 = TreeStatistics(Tree=split_tree_9.Positive)  # -> Paths, Length, Count
replace_paths_34 = ReplacePaths(Data=split_tree_5.Positive, Search=tree_statistics_36.Paths, Replace=tree_statistics_45.Paths)
tree_statistics_46 = TreeStatistics(Tree=replace_paths_34)  # -> Paths, Length, Count
replace_paths_35 = ReplacePaths(Data=replace_paths_34, Search=tree_statistics_46.Paths, Replace=tree_statistics_43.Paths)
merge_40 = Merge(Data1=replace_paths_35, Data2=top_gangway_top_29.Negative)
top_gangway_top_30 = SplitTree(Data=merge_40, Masks=flatten("{13;1;0;?}"))  # -> Positive, Negative
tree_statistics_47 = TreeStatistics(Tree=top_gangway_top_30.Positive)  # -> Paths, Length, Count
tree_statistics_48 = TreeStatistics(Tree=graft_tree)  # -> Paths, Length, Count
list_item_51 = ListItem(List=tree_statistics_48.Paths, Index=panel_18, Wrap=True)
split_tree_10 = SplitTree(Data=graft_tree, Masks=flatten(list_item_51))  # -> Positive, Negative
tree_statistics_49 = TreeStatistics(Tree=split_tree_10.Positive)  # -> Paths, Length, Count
replace_paths_36 = ReplacePaths(Data=split_tree_6.Positive, Search=tree_statistics_37.Paths, Replace=tree_statistics_49.Paths)
tree_statistics_50 = TreeStatistics(Tree=replace_paths_36)  # -> Paths, Length, Count
replace_paths_37 = ReplacePaths(Data=replace_paths_36, Search=tree_statistics_50.Paths, Replace=tree_statistics_47.Paths)
merge_41 = Merge(Data1=replace_paths_37, Data2=top_gangway_top_30.Negative)
tree_statistics_51 = TreeStatistics(Tree=merge_41)  # -> Paths, Length, Count
panel_107 = Panel(tree_statistics_51.Paths)
panel_108 = Panel(tree_statistics_51.Length)
tree_statistics_52 = TreeStatistics(Tree=graft_tree)  # -> Paths, Length, Count
list_item_52 = ListItem(List=tree_statistics_52.Paths, Index=panel_18, Wrap=True)
top_gangway_top_31 = SplitTree(Data=merge_41, Masks=flatten("{13;2;0;?}"))  # -> Positive, Negative
tree_statistics_53 = TreeStatistics(Tree=top_gangway_top_31.Positive)  # -> Paths, Length, Count
split_tree_11 = SplitTree(Data=graft_tree, Masks=flatten(list_item_52))  # -> Positive, Negative
tree_statistics_54 = TreeStatistics(Tree=split_tree_11.Positive)  # -> Paths, Length, Count
replace_paths_38 = ReplacePaths(Data=split_tree_7.Positive, Search=tree_statistics_38.Paths, Replace=tree_statistics_54.Paths)
tree_statistics_55 = TreeStatistics(Tree=replace_paths_38)  # -> Paths, Length, Count
replace_paths_39 = ReplacePaths(Data=replace_paths_38, Search=tree_statistics_55.Paths, Replace=tree_statistics_53.Paths)
merge_42 = Merge(Data1=replace_paths_39, Data2=top_gangway_top_31.Negative)
tree_statistics_56 = TreeStatistics(Tree=graft_tree)  # -> Paths, Length, Count
list_item_53 = ListItem(List=tree_statistics_56.Paths, Index=panel_18, Wrap=True)
top_gangway_top_32 = SplitTree(Data=merge_42, Masks=flatten("{13;3;0;?}"))  # -> Positive, Negative
tree_statistics_57 = TreeStatistics(Tree=top_gangway_top_32.Positive)  # -> Paths, Length, Count
split_tree_12 = SplitTree(Data=graft_tree, Masks=flatten(list_item_53))  # -> Positive, Negative
tree_statistics_58 = TreeStatistics(Tree=split_tree_12.Positive)  # -> Paths, Length, Count
replace_paths_40 = ReplacePaths(Data=split_tree_8.Positive, Search=tree_statistics_39.Paths, Replace=tree_statistics_58.Paths)
tree_statistics_59 = TreeStatistics(Tree=replace_paths_40)  # -> Paths, Length, Count
replace_paths_41 = ReplacePaths(Data=replace_paths_40, Search=tree_statistics_59.Paths, Replace=tree_statistics_57.Paths)
merge_43 = Merge(Data1=replace_paths_41, Data2=top_gangway_top_32.Negative)
tree_statistics_60 = TreeStatistics(Tree=merge_43)  # -> Paths, Length, Count
panel_109 = Panel(tree_statistics_60.Paths)
top_gangway_top_33 = SplitTree(Data=merge_43, Masks=flatten("{8;0;0}"))  # -> Positive, Negative
merge_44 = Merge(Data1=replace_paths_26, Data2=top_gangway_top_33.Negative)
top_gangway_top_34 = SplitTree(Data=merge_44, Masks=flatten("{12;0;0}"))  # -> Positive, Negative
merge_45 = Merge(Data1=replace_paths_8, Data2=top_gangway_top_34.Negative)

# ---- group: largest outline that fits site
list_item_54 = ListItem(List=building_outline, Index=item.Item2, Wrap=True)
number_slider_3 = Slider(30, range=0..100)
series_24 = Series(Start=0.1, Step=-2.5, Count=number_slider_3)

# ----
division_16 = Division(A=Slider(1, range=0..1), B=number_slider_3)
series_25 = Series(Start=division_16, Step=division_16, Count=number_slider_3)
scale_2 = Scale(Geometry=list_item_54, Center=Point(0, 0, 0), Factor=series_25)  # -> Geometry, Transform

# ---- group: largest outline that fits site (continued)
curve_curve = CurveCurve(CurveA=scale_2.Geometry, CurveB=curve)  # -> Points, ParamsA, ParamsB
list_length_14 = ListLength(List=curve_curve.Points)
equality_5 = Equality(FirstNumber=list_length_14, SecondNumber="0")  # -> flatten(Equality), Inequality
dispatch_17 = Dispatch(List=scale_2.Geometry, DispatchPattern=equality_5.Equality)  # -> ListA, ListB
list_item_55 = ListItem(List=reverse(dispatch_17.ListA), Index=Slider(1, range=0..10), Wrap=True)

# ----
explode_16 = Explode(Curve=list_item_55, Recursive=True)  # -> Segments, Vertices
list_item_56 = ListItem(List=explode_16.Segments, Index=text_split, Wrap=True)

# ---- group: automtically calculate tweens / number of offsets measure
list_item_57 = ListItem(List=offset_curve_loose, Index=item.Item2, Wrap=True)
explode_17 = Explode(Curve=list_item_57, Recursive=True)  # -> Segments, Vertices
list_item_58 = ListItem(List=explode_17.Segments, Index="3", Wrap=True)
point_on_curve_4 = PointOnCurve(list_item_58, parameter=0.5)

# ---- group: automtically calculate tweens
list_item_59 = ListItem(List=auditorium_outline, Index=item.Item1, Wrap=True)
explode_18 = Explode(Curve=list_item_59, Recursive=True)  # -> Segments, Vertices
list_item_60 = ListItem(List=explode_18.Segments, Index="3", Wrap=True)
point_on_curve_5 = PointOnCurve(list_item_60, parameter=0.5)
subtraction_7 = Subtraction(A=item.Item4, B="1")
multiplication_4 = Multiplication(A=subtraction_7, B=grid_depth)

# ---- group: automtically calculate tweens / number of offsets measure (continued)
distance = Distance(PointA=point_on_curve_4, PointB=point_on_curve_5)

# ---- group: automtically calculate tweens (continued)
subtraction_8 = Subtraction(A=distance, B=multiplication_4)
division_17 = Division(A=subtraction_8, B=bang_9.Branch0)
round_7 = Round(Number=division_17)  # -> Nearest, Floor, Ceiling

# ----
addition_11 = Addition(A=round_7.Nearest, B=Slider(0, range=0..10))
division_18 = Division(A="1", B=addition_11)
series_26 = Series(Start=division_18, Step=division_18, Count=expr("x-1", addition_11))
tweencrv_3 = TweenCurve(CurveA=graft(explode_11.Segments), CurveB=graft(explode_12.Segments), Factor=series_26, BlendType=0)  # -> simplify(Tween)
merge_46 = Merge(Data1=flip_2, Data2=tweencrv_3, Data3=flip)
split_list_8 = SplitList(List=merge_46, Index=list_length_5)  # -> ListA, ListB
loft_8 = Loft(Curves=split_list_8.ListA, Options=loft_opt)  # -> flatten(Loft)
list_item_61 = ListItem(List=loft_8, Index=Slider(-8, range=-30..10), Wrap=True)
deconstruct_brep = DeconstructBrep(Brep=list_item_61)  # -> Faces, Edges, Vertices
shift = ShiftList(List=loft_8, Shift=-1, Wrap=True)
shift_2 = ShiftList(List=loft_8, Shift=-1, Wrap=True)  # disabled
debrep_8 = DeconstructBrep(Brep=shift)  # -> Faces, Edges, Vertices
item_25 = ListItem(List=debrep_8.Vertices, Index=Slider(0, range=0..10), Wrap=True)  # -> flatten(Item)
srf_cp_4 = SurfaceClosestPoint(Point=item_25, Surface=shift)  # -> Point, UVPoint, Distance
lng_5 = ListLength(List=shift)
repeat = RepeatData(Data=bang_11.Branch0, Length=lng_5)
sift = SiftPattern(List=shift, SiftPattern=repeat)  # -> Output0, Output1, Output2, Output3
sift_2 = SiftPattern(List=srf_cp_4.UVPoint, SiftPattern=repeat)  # -> Output0, Output1, Output2, Output3
clean = CleanTree(RemoveNulls=True, RemoveInvalid=True, RemoveEmpty=False, Tree=sift.Output0)
clean_2 = CleanTree(RemoveNulls=True, RemoveInvalid=True, RemoveEmpty=False, Tree=sift.Output1)
clean_3 = CleanTree(RemoveNulls=True, RemoveInvalid=True, RemoveEmpty=False, Tree=sift.Output2)
clean_4 = CleanTree(RemoveNulls=True, RemoveInvalid=True, RemoveEmpty=False, Tree=sift.Output3)
clean_5 = CleanTree(RemoveNulls=True, RemoveInvalid=True, RemoveEmpty=False, Tree=sift_2.Output0)
clean_6 = CleanTree(RemoveNulls=True, RemoveInvalid=True, RemoveEmpty=False, Tree=sift_2.Output1)
clean_7 = CleanTree(RemoveNulls=True, RemoveInvalid=True, RemoveEmpty=False, Tree=sift_2.Output2)
clean_8 = CleanTree(RemoveNulls=True, RemoveInvalid=True, RemoveEmpty=False, Tree=sift_2.Output3)

bowl_section_5 = BB_BowlSection(
    touchline=crv_2,
    outline=item_8,
    setDistance=pull.Distance,
    rows=bang_4.Branch2,
    stepDepths=bang_5.Branch2,
    landingDepths=bang_16.Branch2,
    floorHeights=bang_6.Branch2,
    cantilevers=bang_8.Branch2,
    cValues=bang_7.Branch2)  # -> section, sightlines, sectionInfo; inputs touchline: Curve, outline: list of Curve, rows: list of Int32, stepDepths: list, landingDepths: list, floorHeights: list, cantilevers: list, seatOffsets: list, cValues: list, stepHeights: list; plug-in component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
end_19 = EndPoints(Curve=bowl_section_5.sightlines)  # -> Start, End
end_20 = EndPoints(Curve=bowl_section_5.section)  # -> Start, End
Z_8 = UnitZ(Factor="-25")
move_25 = Move(Geometry=end_20.Start, Motion=Z_8)  # -> Geometry, Transform
ln_15 = Line(StartPoint=end_20.Start, EndPoint=move_25.Geometry)
join_8 = JoinCurves(Curves=[ln_15, bowl_section_5.section], Preserve=False)
pt_7 = ConstructPoint(XCoordinate=0, YCoordinate=0, ZCoordinate=bang_3.Branch0)
crv_6 = Curve(bowl_section_5.section)
xy_4 = XYPlane(Origin=pt_7)
end_21 = EndPoints(Curve=bowl_section_5.section)  # -> Start, End
Y_4 = UnitY(Factor="7.5")
panel_110 = Panel(bang_9.Branch0)
move_26 = Move(Geometry=crv_6, Motion=Y_4)  # -> Geometry, Transform
move_27 = Move(Geometry=end_19.Start, Motion=Y_4)  # -> Geometry, Transform
panel_111 = Panel(dist)
division_19 = Division(A=panel_111, B=panel_110)
split_27 = TextSplit(Text=division_19, Separators=".")
item_26 = ListItem(List=split_27, Index=0, Wrap=True)
ln_16 = Line(StartPoint=end_19.Start, EndPoint=move_27.Geometry)
series_27 = Series(Start=0, Step=panel_110, Count=item_26)
X_7 = UnitX(Factor=panel_111)
X_8 = UnitX(Factor=series_27)
pcx_6 = CurvePlane(Curve=join_8, Plane=xy_4)  # -> flatten(Points), ParamsC, ParamsP
move_28 = Move(Geometry=end_21.Start, Motion=X_8)  # -> Geometry, Transform
move_29 = Move(Geometry=end_21.Start, Motion=X_7)  # -> Geometry, Transform
group_15 = Group(Objects=ln_16)
pdecon_7 = Deconstruct(Point=move_28.Geometry)  # -> XComponent, YComponent, ZComponent
pdecon_8 = Deconstruct(Point=pcx_6.Points)  # -> XComponent, YComponent, ZComponent
ln_17 = Line(StartPoint=end_21.Start, EndPoint=move_29.Geometry)
move_30 = Move(Geometry=ln_17, Motion=Y_4)  # -> Geometry, Transform
larger_4 = LargerThan(FirstNumber=graft(pdecon_8.XComponent), SecondNumber=pdecon_7.XComponent)  # -> LargerThan, OrEqualTo
group_16 = Group(Objects=[crv_6, move_26.Geometry])
loft_9 = Loft(
    Curves=[ln_17, move_30.Geometry],
    Options={Adjust=False, Closed=False, LoftEnds=0, LoftSimp=0, LoftType=0, Rebuild=10, Refit=0.01})
dispatch_18 = Dispatch(List=pdecon_7.XComponent, DispatchPattern=larger_4.LargerThan)  # -> ListA, ListB
pt_8 = ConstructPoint(XCoordinate=dispatch_18.ListB, YCoordinate=0, ZCoordinate=graft(pdecon_8.ZComponent))
srf_cp_5 = SurfaceClosestPoint(Point=end_21.Start, Surface=loft_9)  # -> Point, UVPoint, Distance
replace_18 = ReplaceItems(List=pt_8, Item=graft(pcx_6.Points), Indices=0, Wrap=False)
cullpt_5 = CullDuplicates(Points=replace_18, Tolerance="1", CullMode=3)  # -> Points, Indices, Valence
pline_9 = PolyLine(Vertices=cullpt_5.Points, Closed=False)
explode_19 = Explode(Curve=pline_9, Recursive=True)  # -> Segments, Vertices
move_31 = Move(Geometry=explode_19.Segments, Motion=Y_4)  # -> Geometry, Transform
weave_7 = Weave(Pattern=[0, 1], Stream0=graft(move_31.Geometry), Stream1=graft(explode_19.Segments), NullGaps=False)
loft_10 = Loft(Curves=weave_7, Options={Adjust=False, Closed=False, LoftEnds=0, LoftSimp=0, LoftType=0, Rebuild=10, Refit=0.01})
debrep_9 = DeconstructBrep(Brep=loft_10)  # -> Faces, Edges, Vertices
end_22 = EndPoints(Curve=debrep_9.Edges)  # -> Start, End
pline_10 = PolyLine(Vertices=end_22.Start, Closed=True)
join_9 = JoinCurves(Curves=pline_10, Preserve=False)
trim_6 = TrimTree(Tree=join_9, Depth=3)
split_28 = SplitList(List=reverse(trim_6), Index=1)  # -> ListA, reverse(ListB)
group_17 = Group(Objects=split_28.ListB)
group_18 = Group(Objects=flatten(group_17))

bbox_3 = BoundingBox(Content=[crv_6, move_26.Geometry], Plane=PlaneXY(0, 0, 0), UnionBox=True)  # -> Box, Box_2
debrep_10 = DeconstructBrep(Brep=bbox_3.Box)  # -> Faces, Edges, Vertices
item_27 = ListItem(List=debrep_10.Faces, Index=5, Wrap=True)
move_32 = Move(Geometry=item_27, Motion=Z_7)  # -> Geometry, Transform
mesh_3 = MeshBrep(
    Brep=move_32.Geometry,
    Settings={GridMaxCount=0, GridMinCount=16, JaggedSeams=False, MaxEdgeLength=0, MinEdgeLength=0.0001, MinTolerance=0, Refine=True, RefineAngle=0, RelativeTolerance=0.65, SimplePlanes=True, Tolerance=0})
mcol_3 = MeshColours(Mesh=mesh_3, Colours=ColourSwatch(SwatchColor=RGB(87, 0, 0)))

entwine_16 = Entwine(Branch00=group_15, Branch01=group_16, Branch02=group_18, Branch03=mcol_3, FlattenInputs=True)
group_19 = Group(Objects=flatten(entwine_16))

# ---- group: module 01
bowl_section_6 = BB_BowlSection(
    touchline=crv_2,
    outline=item_8,
    setDistance=pull.Distance,
    rows=bang_4.Branch0,
    stepDepths=bang_5.Branch0,
    landingDepths=bang_16.Branch0,
    floorHeights=bang_6.Branch0,
    cantilevers=bang_8.Branch0,
    cValues=bang_7.Branch0)  # -> section, sightlines, sectionInfo; inputs touchline: Curve, outline: list of Curve, rows: list of Int32, stepDepths: list, landingDepths: list, floorHeights: list, cantilevers: list, seatOffsets: list, cValues: list, stepHeights: list; plug-in component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
end_23 = EndPoints(Curve=curve_5)  # -> Start, End
Z_9 = UnitZ(Factor="-25")
end_24 = EndPoints(Curve=bowl_section_6.sightlines)  # -> Start, End
move_33 = Move(Geometry=end_23.Start, Motion=Z_9)  # -> Geometry, Transform
ln_18 = Line(StartPoint=end_23.Start, EndPoint=move_33.Geometry)
join_10 = JoinCurves(Curves=[curve_5, ln_18], Preserve=False)
crv_7 = Curve(curve_5)
end_25 = EndPoints(Curve=curve_5)  # -> Start, End
Y_5 = UnitY(Factor="7.5")
panel_112 = Panel(bang_9.Branch0)
pt_9 = ConstructPoint(XCoordinate=0, YCoordinate=0, ZCoordinate=clean_tree_4)
move_34 = Move(Geometry=crv_7, Motion=Y_5)  # -> Geometry, Transform
move_35 = Move(Geometry=end_24.Start, Motion=Y_5)  # -> Geometry, Transform
xy_5 = XYPlane(Origin=pt_9)
panel_113 = Panel(dist)
division_20 = Division(A=panel_113, B=panel_112)
pcx_7 = CurvePlane(Curve=join_10, Plane=xy_5)  # -> flatten(Points), ParamsC, ParamsP
ln_19 = Line(StartPoint=end_24.Start, EndPoint=move_35.Geometry)
X_9 = UnitX(Factor=panel_113)
move_36 = Move(Geometry=end_25.Start, Motion=X_9)  # -> Geometry, Transform
group_20 = Group(Objects=ln_19)
pdecon_9 = Deconstruct(Point=pcx_7.Points)  # -> XComponent, YComponent, ZComponent
group_21 = Group(Objects=[crv_7, move_34.Geometry])
ln_20 = Line(StartPoint=end_25.Start, EndPoint=move_36.Geometry)
move_37 = Move(Geometry=ln_20, Motion=Y_5)  # -> Geometry, Transform
end_26 = EndPoints(Curve=move_37.Geometry)  # -> Start, End
end_27 = EndPoints(Curve=ln_20)  # -> Start, End
ln_21 = Line(StartPoint=end_26.Start, EndPoint=end_27.Start)
ln_22 = Line(StartPoint=end_26.End, EndPoint=end_27.End)

# ----
bbox_4 = BoundingBox(Content=[crv_7, move_34.Geometry], Plane=PlaneXY(0, 0, 0), UnionBox=True)  # -> Box, Box_2
debrep_11 = DeconstructBrep(Brep=bbox_4.Box)  # -> Faces, Edges, Vertices
item_28 = ListItem(List=debrep_11.Faces, Index=5, Wrap=True)
round_8 = Round(Number=division_20)  # -> Nearest, Floor, Ceiling
move_38 = Move(Geometry=item_28, Motion=Z_6)  # -> Geometry, Transform
mesh_4 = MeshBrep(
    Brep=move_38.Geometry,
    Settings={GridMaxCount=0, GridMinCount=16, JaggedSeams=False, MaxEdgeLength=0, MinEdgeLength=0.0001, MinTolerance=0, Refine=True, RefineAngle=0, RelativeTolerance=0.65, SimplePlanes=True, Tolerance=0})
panel_114 = Panel(pcx_7.Points)
mcol_4 = MeshColours(Mesh=mesh_4, Colours=ColourSwatch(SwatchColor=RGB(255, 132, 0)))
entwine_17 = Entwine(Branch00=group_11, Branch01=group_12, Branch02=group_14, Branch03=mcol_4, FlattenInputs=True)
group_22 = Group(Objects=flatten(entwine_17))

# ---- group: module 01 (continued)
series_28 = Series(Start=0, Step=panel_112, Count=round_8.Nearest)
X_10 = UnitX(Factor=series_28)
move_39 = Move(Geometry=end_25.Start, Motion=X_10)  # -> Geometry, Transform
pdecon_10 = Deconstruct(Point=move_39.Geometry)  # -> XComponent, YComponent, ZComponent
larger_5 = LargerThan(FirstNumber=graft(pdecon_9.XComponent), SecondNumber=pdecon_10.XComponent)  # -> LargerThan, OrEqualTo
dispatch_19 = Dispatch(List=pdecon_10.XComponent, DispatchPattern=larger_5.LargerThan)  # -> ListA, ListB
pt_10 = ConstructPoint(XCoordinate=dispatch_19.ListB, YCoordinate=0, ZCoordinate=graft(pdecon_9.ZComponent))

# ----
insert_items_7 = InsertItems(List=pt_10, Item=graft(pcx_7.Points), Indices="0", Wrap=True)
cull_duplicates_2 = CullDuplicates(Points=insert_items_7, Tolerance="2", CullMode=3)  # -> Points, Indices, Valence

# ---- group: module 01 (continued)
pline_11 = PolyLine(Vertices=cull_duplicates_2.Points, Closed=False)
explode_20 = Explode(Curve=pline_11, Recursive=True)  # -> Segments, Vertices
move_40 = Move(Geometry=explode_20.Segments, Motion=Y_5)  # -> Geometry, Transform
weave_8 = Weave(Pattern=[0, 1], Stream0=graft(move_40.Geometry), Stream1=graft(explode_20.Segments), NullGaps=False)
loft_11 = Loft(Curves=weave_8, Options={Adjust=False, Closed=False, LoftEnds=0, LoftSimp=0, LoftType=0, Rebuild=10, Refit=0.01})
debrep_12 = DeconstructBrep(Brep=loft_11)  # -> Faces, Edges, Vertices
end_28 = EndPoints(Curve=debrep_12.Edges)  # -> Start, End
pline_12 = PolyLine(Vertices=end_28.Start, Closed=True)
join_11 = JoinCurves(Curves=pline_12, Preserve=False)
trim_7 = TrimTree(Tree=join_11, Depth=3)
lng_6 = ListLength(List=trim_7)
item_29 = ListItem(List=flatten(lng_6), Index=0, Wrap=True)
division_21 = Division(A="1", B=item_29)
series_29 = Series(Start=0, Step=division_21, Count=item_29)
tweencrv_4 = TweenCurve(CurveA=ln_21, CurveB=ln_22, Factor=series_29, BlendType=0)
merge_47 = Merge(Data1=tweencrv_4, Data2=ln_22)
loft_12 = Loft(
    Curves=flatten(merge_47),
    Options={Adjust=False, Closed=False, LoftEnds=0, LoftSimp=0, LoftType=1, Rebuild=10, Refit=0.01})
group_23 = Group(Objects=trim_7)
debrep_13 = DeconstructBrep(Brep=loft_12)  # -> Faces, Edges, Vertices
group_24 = Group(Objects=flatten(group_23))
entwine_18 = Entwine(Branch00=group_20, Branch01=group_21, Branch02=group_24, Branch03=mcol_4, FlattenInputs=True)
item_30 = ListItem(List=debrep_13.Vertices, Index=3, Wrap=True)
group_25 = Group(Objects=flatten(entwine_18))
srf_cp_6 = SurfaceClosestPoint(Point=item_30, Surface=loft_12)  # -> Point, UVPoint, Distance

# ----
number_of_divisions_in_module_01 = Panel(item_29)

# ---- group: grid trimmer
end_points_2 = EndPoints(Curve=curve_5)  # -> Start, End
area_2 = Area(Geometry=trim_7)  # -> Area, Centroid
point_2 = Point(end_points_2.End)
deconstruct_6 = Deconstruct(Point=area_2.Centroid)  # -> XComponent, YComponent, ZComponent
deconstruct_7 = Deconstruct(Point=point_2)  # -> XComponent, YComponent, ZComponent
addition_12 = Addition(A=deconstruct_7.XComponent, B="5")
larger_than_5 = LargerThan(FirstNumber=deconstruct_6.XComponent, SecondNumber=addition_12)  # -> LargerThan, OrEqualTo
dispatch_20 = Dispatch(List=trim_7, DispatchPattern=larger_than_5.LargerThan)  # -> ListA, reverse(ListB)

# ----
sporph = Sporph(G=group_19, S0=loft_12, P0=srf_cp_6.UVPoint, S1=clean_3, P1=clean_7, R=False)
sporph_2 = Sporph(G=group_5, S0=loft_12, P0=srf_cp_6.UVPoint, S1=clean_4, P1=clean_8, R=False)
sporph_3 = Sporph(G=group_10, S0=loft_7, P0=srf_cp_6.UVPoint, S1=clean_2, P1=clean_6, R=False)
sporph_4 = Sporph(G=group_25, S0=loft_7, P0=srf_cp_6.UVPoint, S1=clean, P1=clean_5, R=False)
weave_9 = Weave(Pattern=repeat, Stream0=sporph_4, Stream1=sporph_3, Stream2=sporph, Stream3=sporph_2, NullGaps=False)
list_item_62 = ListItem(List=weave_9, Index=series_21, Wrap=True)
list_item_63 = ListItem(List=weave_9, Index=0, Wrap=True)
ungroup = Ungroup(Group=flatten(list_item_62))
item_31 = ListItem(List=ungroup, Index="2", Wrap=True)
ungroup_2 = Ungroup(Group=item_31)
ungroup_3 = Ungroup(Group=ungroup_2)
trim_8 = TrimTree(Tree=ungroup_3, Depth=1)
tstat = TreeStatistics(Tree=trim_8)  # -> Paths, Length, Count
lng_7 = ListLength(List=tstat.Paths)
series_30 = Series(Start=0, Step=1, Count=lng_7)

# ---- group: floor split
rep_3 = ReplaceText(Text="{0;A;0;?}", Find="A", Replace=series_30, RecursiveReplace=False)
split_29 = SplitTree(Data=ungroup_3, Masks=flatten(rep_3))  # -> Positive, Negative
cp = ControlPoints(Curve=split_29.Positive)  # -> Points, Weights, Knots
panel_115 = Panel("""0
1
3
2""")
item_32 = ListItem(List=cp.Points, Index=panel_115, Wrap=True)
frompoints = MeshFromPoints(Points=item_32, UDirection="2", VDirection="2")
trim_9 = TrimTree(Tree=frompoints, Depth=1)
split_30 = SplitTree(Data=trim_9, Masks=flatten("{0;?;0;0}"))  # -> Positive, Negative
split_31 = SplitTree(Data=trim_9, Masks=flatten("{0;?;0;1}"))  # -> Positive, Negative
split_32 = SplitTree(Data=trim_9, Masks=flatten("{0;?;0;2}"))  # -> Positive, Negative
split_33 = SplitTree(Data=trim_9, Masks=flatten("{0;?;0;3}"))  # -> Positive, Negative
split_34 = SplitTree(Data=trim_9, Masks=flatten("{0;?;0;4}"))  # -> Positive, Negative
split_35 = SplitTree(Data=trim_9, Masks=flatten("{0;?;0;5}"))  # -> Positive, Negative
split_36 = SplitTree(Data=trim_9, Masks=flatten("{0;?;0;6}"))  # -> Positive, Negative
split_37 = SplitTree(Data=trim_9, Masks=flatten("{0;?;0;7}"))  # -> Positive, Negative
flip_3 = FlipMatrix(Data=split_30.Positive)
flip_4 = FlipMatrix(Data=split_31.Positive)
flip_5 = FlipMatrix(Data=split_32.Positive)
flip_6 = FlipMatrix(Data=split_33.Positive)
flip_7 = FlipMatrix(Data=split_34.Positive)
flip_8 = FlipMatrix(Data=split_35.Positive)
flip_9 = FlipMatrix(Data=split_36.Positive)
flip_10 = FlipMatrix(Data=split_37.Positive)
entwine_19 = Entwine(
    Branch0X=flip_3,
    Branch1X=flip_4,
    Branch2X=flip_5,
    Branch3X=flip_6,
    Branch4X=flip_7,
    Branch5X=flip_8,
    Branch6X=flip_9,
    Branch7X=flip_10,
    FlattenInputs=False)
trim_10 = TrimTree(Tree=simplify(entwine_19), Depth=1)

# ---- group: Clean up unnecesary slots
list_length_15 = ListLength(List=trim_10)
list_length_16 = ListLength(List=split_14.Positive)
sort_list_3 = SortList(Keys=flatten(list_length_16))  # -> reverse(Keys), ValuesValuesA
sort_list_4 = SortList(Keys=flatten(list_length_15))  # -> reverse(Keys), ValuesValuesA
list_item_64 = ListItem(List=sort_list_3.Keys, Index=0, Wrap=True)
list_item_65 = ListItem(List=sort_list_4.Keys, Index=0, Wrap=True)
minimum = Minimum(A=list_item_65, B=list_item_64)
split_list_9 = SplitList(List=trim_10, Index=minimum)  # -> simplify(ListA), ListB
split_list_10 = SplitList(List=split_14.Positive, Index=minimum)  # -> ListA, ListB
text_split_7 = TextSplit(Text=split_list_10.ListA, Separators=".")
list_item_66 = ListItem(List=text_split_7, Index=0, Wrap=True)
trim_tree_6 = TrimTree(Tree=list_item_66, Depth=1)
replace_nulls = ReplaceNulls(Items=trim_tree_6, Replacements="10")  # -> Items, Count

# ----
panel_116 = Panel(list_length_16)
tstat_2 = TreeStatistics(Tree=simplify(split_list_9.ListA))  # -> Paths, Length, Count
simplify = SimplifyTree(Tree=replace_nulls.Items, Front=False)
split_38 = SplitTree(Data=simplify, Masks=flatten(tstat_2.Paths))  # -> Positive, Negative

# ---- group: Clean up unnecesary slots (continued)
repeat_data_19 = RepeatData(Data=split_38.Positive, Length=minimum)  # -> simplify(Data)
tree_statistics_61 = TreeStatistics(Tree=repeat_data_19)  # -> Paths, Length, Count
tree_branch_12 = TreeBranch(Tree=split_list_9.ListA, Path=tree_statistics_61.Paths, MaintainPaths=True)

# ---- group: assign function
tstat_3 = TreeStatistics(Tree=simplify(tree_branch_12))  # -> Paths, Length, Count
simplify_2 = SimplifyTree(Tree=split_14.Positive, Front=False)
split_39 = SplitTree(Data=simplify_2, Masks=flatten(tstat_3.Paths))  # -> Positive, Negative
split_40 = TextSplit(Text=split_39.Positive, Separators=".")
lng_8 = ListLength(List=tree_branch_12)
item_33 = ListItem(List=split_40, Index=expr("1", 0), Wrap=False)
trim_11 = TrimTree(Tree=item_33, Depth=1)
repeat_2 = RepeatData(Data=trim_11, Length=lng_8)
larger_6 = LargerThan(FirstNumber=repeat_2, SecondNumber="1")  # -> LargerThan, OrEqualTo
dispatch_21 = Dispatch(List=tree_branch_12, DispatchPattern=larger_6.OrEqualTo)  # -> flatten(ListA), ListB
lng_9 = ListLength(List=flatten(tree_branch_12))
nullrep = ReplaceNulls(Items=larger_6.OrEqualTo, Replacements="0")  # -> Items, Count
series_31 = Series(Start=0, Step=1, Count=lng_9)
medges = MeshEdges(Mesh=dispatch_21.ListA)  # -> NakedEdges, InteriorEdges, NonManifoldEdges
dispatch_22 = Dispatch(List=series_31, DispatchPattern=flatten(nullrep.Items))  # -> ListA, ListB
curvepoint = PointOnCurve(medges.NakedEdges, parameter=0.5)
end_29 = EndPoints(Curve=medges.NakedEdges)  # -> Start, End
item_34 = ListItem(List=curvepoint, Index=0, Wrap=True)  # -> Item, Item1, Item2, Item3
item_35 = ListItem(List=end_29.Start, Index=0, Wrap=True)  # -> Item, Item1, Item2, Item3
item_36 = ListItem(List=end_29.End, Index=0, Wrap=True)  # -> Item, Item1, Item2, Item3
weave_10 = Weave(
    Pattern=[0, 1, 2, 3],
    Stream0=item_35.Item,
    Stream1=item_34.Item1,
    Stream2=item_34.Item2,
    Stream3=item_35.Item2,
    NullGaps=False)
weave_11 = Weave(
    Pattern=[0, 1, 2, 3],
    Stream0=item_36.Item1,
    Stream1=item_34.Item1,
    Stream2=item_34.Item2,
    Stream3=item_36.Item2,
    NullGaps=False)
weave_12 = Weave(
    Pattern=[0, 1, 2, 3],
    Stream0=item_35.Item1,
    Stream1=item_34.Item,
    Stream2=item_34.Item3,
    Stream3=item_35.Item3,
    NullGaps=False)
weave_13 = Weave(
    Pattern=[0, 1, 2, 3],
    Stream0=item_36.Item,
    Stream1=item_34.Item,
    Stream2=item_34.Item3,
    Stream3=item_36.Item3,
    NullGaps=False)
pline_13 = PolyLine(Vertices=weave_10, Closed=True)
pline_14 = PolyLine(Vertices=weave_13, Closed=True)
pline_15 = PolyLine(Vertices=weave_12, Closed=True)
pline_16 = PolyLine(Vertices=weave_11, Closed=True)
weave_14 = Weave(Pattern=[0, 1, 2, 3], Stream0=pline_13, Stream1=pline_16, Stream2=pline_15, Stream3=pline_14, NullGaps=False)
panel_117 = Panel(repeat_2)
cp_2 = ControlPoints(Curve=weave_14)  # -> Points, Weights, Knots
panel_118 = Panel("""0
1
3
2""")
item_37 = ListItem(List=cp_2.Points, Index=panel_118, Wrap=True)
flatten_2 = FlattenTree(Tree=panel_117, Path="{0}")
clean_9 = CleanTree(RemoveNulls=True, RemoveInvalid=True, RemoveEmpty=False, Tree=flatten_2)
frompoints_2 = MeshFromPoints(Points=item_37, UDirection="2", VDirection="2")
subtraction_9 = Subtraction(A=clean_9, B=1)
trim_12 = TrimTree(Tree=frompoints_2, Depth=1)
item_38 = ListItem(List=trim_12, Index=graft(subtraction_9), Wrap=False)
panel_119 = Panel(clean_9)
replace_19 = ReplaceItems(List=flatten(tree_branch_12), Item=flatten(item_38), Indices=dispatch_22.ListA, Wrap=False)
panel_120 = Panel(replace_19)
rep_4 = ReplaceText(Text=subtraction_9, Find="0", Replace="a", RecursiveReplace=False)
rep_5 = ReplaceText(Text=rep_4, Find="1", Replace="0", RecursiveReplace=False)
partition = PartitionList(List=replace_19, Size=flatten(lng_8))  # -> simplify(Chunks)
rep_6 = ReplaceText(Text=rep_5, Find="a", Replace="1", RecursiveReplace=False)
rep_7 = ReplaceText(Text=rep_6, Find="2", Replace="a", RecursiveReplace=False)
rep_8 = ReplaceText(Text=rep_7, Find="3", Replace="2", RecursiveReplace=False)
rep_9 = ReplaceText(Text=rep_8, Find="a", Replace="3", RecursiveReplace=False)
item_39 = ListItem(List=weave_14, Index=graft(rep_9), Wrap=True)
cp_3 = ControlPoints(Curve=item_39)  # -> Points, Weights, Knots
item_40 = ListItem(List=cp_3.Points, Index=0, Wrap=True)  # -> Item, Item1, Item2, Item3
weave_15 = Weave(
    Pattern=[0, 1, 2, 3],
    Stream0=item_40.Item,
    Stream1=item_40.Item1,
    Stream2=item_40.Item3,
    Stream3=item_40.Item2,
    NullGaps=False)
panel_121 = Panel(item_39)
frompoints_3 = MeshFromPoints(Points=weave_15, UDirection="2", VDirection="2")
merge_48 = Merge(Data2=simplify(frompoints_3))  # -> simplify(Result)

# ----
tree_statistics_62 = TreeStatistics(Tree=tree_branch_12)  # -> Paths, Length, Count
panel_122 = Panel(tree_statistics_62.Paths)

# ---- group: K-Means clusters
tree_statistics_63 = TreeStatistics(Tree=repeat_data_19)  # -> Paths, Length, Count
tree_statistics_64 = TreeStatistics(Tree=partition)  # -> Paths, Length, Count
replace_paths_42 = ReplacePaths(Data=partition, Search=tree_statistics_64.Paths, Replace=tree_statistics_63.Paths)
panel_123 = Panel("""{2;0}
{2;1}
{2;2}
{2;3}""")
split_tree_13 = SplitTree(Data=repeat_data_19, Masks=flatten(panel_123))  # -> Positive, Negative
split_tree_14 = SplitTree(Data=replace_paths_42, Masks=flatten(panel_123))  # -> Positive, Negative
divisions = Slider(8, range=0..10)
mesh_subdivide_quad_faces = MeshSubdivideQuadFaces(Mesh=split_tree_14.Positive, USubdivisions=divisions, VSubdivisions=divisions)
mesh_explode = MeshExplode(Mesh=mesh_subdivide_quad_faces, Interpolate=False)  # -> reverse(Faces)
number_slider_4 = Slider(6, range=0..20)
partition_list = PartitionList(List=mesh_explode, Size=divisions)  # -> reverse(Chunks)
path_mapper = PathMapper(partition_list, source="{A;B;C;D}(i)", target="{A;B;i%item_count}")
k_means_clustering = KMeansClustering(TrainingInputs=isovist_n_circulation_performance, OfClusters=number_slider_4, RandomSeed=5)  # -> Result, Likelihood, Centroids
construct_domain = ConstructDomain(DomainStart=0, DomainEnd=number_slider_4)
remap_numbers = RemapNumbers(Value=k_means_clustering.Result, Source=construct_domain, Target="0 To 1")  # -> Mapped, Clipped
gradient = Gradient(
    LowerLimit=0,
    UpperLimit=1,
    Parameter=remap_numbers.Mapped,
    stops=[0: RGB(243, 57, 0), 0.1: RGB(236, 27, 60), 0.2: RGB(210, 0, 118), 0.3: RGB(103, 0, 120), 0.4: RGB(39, 72, 161), 0.5: RGB(1, 192, 229), 0.6: RGB(18, 178, 90), 0.7: RGB(79, 186, 8), 0.8: RGB(220, 237, 32), 0.9: RGB(247, 159, 20), 1: RGB(243, 57, 0)])
create_material = CreateMaterial(Diffuse=gradient, Specular=gradient, Emission=gradient, Transparency=0, Shine=0)
custom_preview = CustomPreview(Geometry=flatten(path_mapper), Material=flatten(create_material))

# ---- group: Neural Networks Classification
tree_statistics_65 = TreeStatistics(Tree=isovist_n_circulation_performance)  # -> Paths, Length, Count
list_length_17 = ListLength(List=tree_statistics_65.Paths)
construct_domain_2 = ConstructDomain(DomainStart=0, DomainEnd=list_length_17)
multiplication_5 = Multiplication(A=list_length_17, B=Slider(0.123, range=0..1))
random = Random(Range=construct_domain_2, Number=multiplication_5, Seed=2)
round_9 = Round(Number=random)  # -> Nearest, Floor, Ceiling
sort_list_5 = SortList(Keys=round_9.Nearest)  # -> Keys, ValuesValuesA
delete_consecutive = DeleteConsecutive(Set=sort_list_5.Keys, Wrap=False)  # -> Set, Count
list_item_67 = ListItem(List=tree_statistics_65.Paths, Index=delete_consecutive.Set, Wrap=True)
tree_branch_13 = TreeBranch(Tree=isovist_n_circulation_performance, Path=list_item_67, MaintainPaths=True)
list_length_18 = ListLength(List=tree_branch_13)
panel_124 = Panel(tree_branch_13)
mass_addition_5 = MassAddition(Input=tree_branch_13)  # -> Result, PartialResults
division_22 = Division(A=mass_addition_5.Result, B=list_length_18)
neural_network_trainer = NeuralNetworkTrainer(TrainingInputs=tree_branch_13, TrainingOutputs=division_22, InputNeurons=2, HiddenNeurons=2, Alpha=2, Iterations=500)  # -> TrainedNueralNetwork, ErrorsDynamics
panel_125 = Panel(division_22)
neural_network_testing = NeuralNetworkTesting(TrainedNeuralNetwork=neural_network_trainer.TrainedNueralNetwork, TestInputData=isovist_n_circulation_performance)
smaller_than_3 = SmallerThan(FirstNumber=neural_network_testing, SecondNumber=Slider(0.1, range=0..0.1))  # -> SmallerThan, OrEqualTo
list_length_19 = ListLength(List=flatten(neural_network_testing))
series_32 = Series(Start=0, Step=1, Count=list_length_19)
dispatch_23 = Dispatch(List=flatten(series_32), DispatchPattern=flatten(smaller_than_3.SmallerThan))  # -> ListA, ListB
dispatch_24 = Dispatch(List=flatten(neural_network_testing), DispatchPattern=flatten(smaller_than_3.SmallerThan))  # -> ListA, ListB
sort_list_6 = SortList(Keys=flatten(dispatch_24.ListB))  # -> Keys, ValuesValuesA
list_item_68 = ListItem(List=sort_list_6.Keys, Index=0, Wrap=True)
replace_items_4 = ReplaceItems(List=flatten(neural_network_testing), Item=list_item_68, Indices=dispatch_23.ListA, Wrap=False)
bounds = Bounds(Numbers=replace_items_4)
remap_numbers_2 = RemapNumbers(Value=replace_items_4, Source=bounds, Target=Domain(0, 1))  # -> Mapped, Clipped
gradient_2 = Gradient(
    LowerLimit=0,
    UpperLimit=1,
    Parameter=remap_numbers_2.Mapped,
    stops=[0: RGB(243, 57, 0), 0.1: RGB(236, 27, 60), 0.2: RGB(210, 0, 118), 0.3: RGB(103, 0, 120), 0.4: RGB(39, 72, 161), 0.5: RGB(1, 192, 229), 0.6: RGB(18, 178, 90), 0.7: RGB(79, 186, 8), 0.8: RGB(220, 237, 32), 0.9: RGB(247, 159, 20), 1: RGB(243, 57, 0)])
create_material_2 = CreateMaterial(Diffuse=gradient_2, Specular=gradient_2, Emission=gradient_2, Transparency=0, Shine=0)
custom_preview_2 = CustomPreview(Geometry=flatten(path_mapper), Material=flatten(create_material_2))
