# Grasshopper definition 220104 Tier generation.gh (Grasshopper 1.0.7)
# plug-ins: PTComponentLibrary, Human, Sasquatch, HoopSnake, MeshEdit Components

data = Data(Tree({0;0;0;0}: [10], {0;0;0;1}: [11], {0;0;0;2}: [12], {0;0;0;3}: [13], {0;0;0;4}: [14], {0;0;0;5}: [15]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))
tstat = TreeStatistics(Tree=data)  # -> Paths, Length, Count
lng = ListLength(List=tstat.Paths)
panel = Panel("6001")  # disabled
panel_2 = Panel(lng)  # disabled
panel_3 = Panel("1032")
data_2 = Data(Tree({0;0;0;0;0;0;0;0;0}: ["8", "58", "7", "57", "3", "44", "94", "43", "93", "49", "99"], {0;0;0;0;0;1;0;0;0}: ["109", "159", "108", "158", "107", "144", "194", "143", "193", "199", "149"], {0;0;0;0;0;2;0;0;0}: ["265", "215", "260", "210", "264", "244", "294", "293", "243", "292", "242"], {0;0;0;0;0;3;0;0;0}: ["305", "355", "350", "395", "345", "387", "337", "382", "332", "348", "398"], {0;0;0;0;0;4;0;0;0}: ["431", "481", "492", "442", "426", "476", "495", "445", "437", "487", "432"], {0;0;0;0;0;5;0;0;0}: ["505", "555", "550", "595", "545", "587", "537", "548", "598", "532", "582"], {0;0;0;0;0;6;0;0;0}: ["670", "620", "616", "666", "619", "669", "687", "637", "640", "689", "639"], {0;0;0;0;0;7;0;0;0}: ["749", "799", "793", "743", "751", "723", "773", "789", "739", "720", "770"], {0;0;0;0;0;8;0;0;0}: ["837", "887", "845", "895", "843", "893", "890", "840", "882", "832"], {0;0;0;0;0;9;0;0;0}: ["905", "955", "965", "915", "987", "937", "945", "995", "940", "990", "943"]))
data_3 = Data(data_2)
panel_4 = Panel(data_3)
lng_2 = ListLength(List=flatten(data_3))
panel_5 = Panel(lng_2)
panel_6 = Panel("12")
panel_7 = Panel(panel_3)
panel_8 = Panel(panel_3)
panel_9 = Panel(panel_3)
item = ListItem(List=tstat.Paths, Index=panel_7, Wrap=True)
len = TextLength(Text=panel_9)
chars = Characters(Text=panel_9)  # -> Result, Unicode
branch = TreeBranch(Tree=data, Path=item, MaintainPaths=True)
item_2 = ListItem(List=chars.Result, Index=0, Wrap=True)
larger = LargerThan(FirstNumber=len, SecondNumber=Slider(3, range=0..10))  # -> LargerThan, OrEqualTo
panel_10 = Panel("""28
28
20""")
dispatch = Dispatch(List=item_2, DispatchPattern=larger.LargerThan)  # -> ListA, ListB
crv = Curve(<curve referenced from the Rhino model>)
panel_11 = Panel(panel_10)
dispatch_2 = Dispatch(List=Slider(0, range=0..100), DispatchPattern=larger.LargerThan)  # -> ListA, ListB
merge = Merge(Data1=dispatch_2.ListB, Data2=dispatch.ListA)
panel_12 = Panel(merge)
panel_13 = Panel("""0.5
2.5
2.5
2.5""")
panel_14 = Panel("""2
2
2
2""")
panel_15 = Panel("""0.12
0.12
0.12
0.12""")
item_3 = ListItem(List=flatten(merge), Index=larger.LargerThan, Wrap=True)
outline = Curve([<curve referenced from the Rhino model> x6])
repeat = RepeatData(Data="0.8", Length="4")
panel_16 = Panel(item_3)
item_4 = ListItem(List=outline, Index=panel_16, Wrap=True)
xz = XZPlane(Origin=Point(0, 0, 0))
pcx = CurvePlane(Curve=item_4, Plane=xz)  # -> Points, ParamsC, ParamsP
item_5 = ListItem(List=pcx.Points, Index=0, Wrap=True)  # -> Item, Item1
pull = PullPoint(Point=item_5.Item, Geometry=crv, ClosestOnly=True)  # -> ClosestPoint, Distance
bowl_section = BB_BowlSection(
    touchline=crv,
    outline=item_4,
    setDistance=pull.Distance,
    rows=panel_11,
    stepDepths=repeat,
    floorHeights=panel_13,
    cantilevers=panel_14,
    cValues=panel_15)  # -> section, sightlines, sectionInfo; inputs touchline: Curve, outline: list of Curve, rows: list of Int32, stepDepths: list, landingDepths: list, floorHeights: list, cantilevers: list, seatOffsets: list, cValues: list, stepHeights: list; plug-in component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
explode = Explode(Curve=bowl_section.section, Recursive=True)  # -> Segments, Vertices
len_2 = Length(Curve=explode.Segments)
item_6 = ListItem(List=panel_13, Index=2, Wrap=True)
similar = Similarity(FirstNumber=item_6, SecondNumber=len_2, Threshold=0.1)  # -> Similarity, AbsoluteDifference
dispatch_3 = Dispatch(List=explode.Segments, DispatchPattern=similar.Similarity)  # -> ListA, ListB
end = EndPoints(Curve=dispatch_3.ListA)  # -> Start, End
X = UnitX(Factor=0.01)
X_2 = UnitX(Factor=pull.Distance)
xz_2 = XZPlane(Origin=Point(0, 0, 0))
move = Move(Geometry=end.End, Motion=X)  # -> Geometry, Transform
weave = Weave(Pattern=[0, 1], Stream0=end.Start, Stream1=move.Geometry, NullGaps=False)
end_2 = EndPoints(Curve=bowl_section.section)  # -> Start, End
move_2 = Move(Geometry=xz_2, Motion=X_2)  # -> Geometry, Transform
pt = Point(flatten([end_2.Start, weave]))
pdecon = Deconstruct(Point=pt)  # -> XComponent, YComponent, ZComponent
panel_17 = Panel("""0
6
13.1
18
26
33.4
38
42""")
pt_2 = ConstructPoint(XCoordinate=0, YCoordinate=0, ZCoordinate=panel_17)
xy = XYPlane(Origin=pt_2)
pcx_2 = CurvePlane(Curve=bowl_section.section, Plane=xy)  # -> flatten(Points), ParamsC, ParamsP
project = Project(Geometry=pcx_2.Points, Plane=PlaneXY(0, 0, 0))  # -> Geometry, Transform
pline = PolyLine(Vertices=flatten(project.Geometry), Closed=False)
explode_2 = Explode(Curve=pline, Recursive=True)  # -> Segments, Vertices
len_3 = Length(Curve=explode_2.Segments)
ma = MassAddition(Input=len_3)  # -> Result, PartialResults
ins = InsertItems(List=ma.PartialResults, Item="0", Indices="0", Wrap=True)
Z = UnitZ(Factor=panel_17)
offset_l = OffsetCurveLoose(Curve=item_4, Distance=ins)
repeat_2 = RepeatData(Data="0", Length="500")
repeat_3 = RepeatData(Data="12", Length="500")
repeat_4 = RepeatData(Data="12", Length="500")
repeat_5 = RepeatData(Data="18", Length="500")
repeat_6 = RepeatData(Data="39", Length="500")
repeat_7 = RepeatData(Data="43", Length="500")
repeat_8 = RepeatData(Data="46", Length="500")
repeat_9 = RepeatData(Data="16", Length="500")
repeat_10 = RepeatData(Data="13", Length="500")
repeat_11 = RepeatData(Data="41", Length="500")
repeat_12 = RepeatData(Data="0", Length="500")
repeat_13 = RepeatData(Data="20", Length="500")
weave_2 = Weave(Pattern=[0, 1], Stream0=repeat_2, Stream1=repeat_3, NullGaps=False)
weave_3 = Weave(Pattern=[0, 1], Stream0=repeat_4, Stream1=repeat_5, NullGaps=False)
weave_4 = Weave(Pattern=[0, 1], Stream0=repeat_6, Stream1=repeat_8, NullGaps=False)
weave_5 = Weave(Pattern=[0, 1], Stream0=repeat_7, Stream1=repeat_9, NullGaps=False)
weave_6 = Weave(Pattern=[0, 1], Stream0=repeat_10, Stream1=repeat_11, NullGaps=False)
weave_7 = Weave(Pattern=[0, 1], Stream0=repeat_12, Stream1=repeat_13, NullGaps=False)
entwine = Entwine(
    Branch0X=weave_3,
    Branch1X=weave_2,
    Branch2X=weave_4,
    Branch3X=weave_5,
    Branch4X=weave_6,
    Branch5X=weave_7,
    FlattenInputs=False)
item_7 = ListItem(List=flatten(entwine), Index=panel_3, Wrap=True)
repeat_14 = RepeatData(Data="10", Length="500")
repeat_15 = RepeatData(Data="16", Length="500")
repeat_16 = RepeatData(Data="11", Length="500")
repeat_17 = RepeatData(Data="5", Length="500")
repeat_18 = RepeatData(Data="12", Length="500")
repeat_19 = RepeatData(Data="18", Length="500")
repeat_20 = RepeatData(Data="9", Length="500")
repeat_21 = RepeatData(Data="26", Length="500")
repeat_22 = RepeatData(Data="27", Length="500")
repeat_23 = RepeatData(Data="18", Length="500")
repeat_24 = RepeatData(Data="6", Length="500")
repeat_25 = RepeatData(Data="15", Length="500")
move_3 = Move(Geometry=graft(offset_l), Motion=graft(Z))  # -> flatten(Geometry), Transform
weave_8 = Weave(Pattern=[0, 1], Stream0=repeat_16, Stream1=repeat_14, NullGaps=False)
weave_9 = Weave(Pattern=[0, 1], Stream0=repeat_17, Stream1=repeat_15, NullGaps=False)
weave_10 = Weave(Pattern=[0, 1], Stream0=repeat_22, Stream1=repeat_18, NullGaps=False)
weave_11 = Weave(Pattern=[0, 1], Stream0=repeat_23, Stream1=repeat_19, NullGaps=False)
weave_12 = Weave(Pattern=[0, 1], Stream0=repeat_24, Stream1=repeat_20, NullGaps=False)
weave_13 = Weave(Pattern=[0, 1], Stream0=repeat_25, Stream1=repeat_21, NullGaps=False)
entwine_2 = Entwine(
    Branch0X=weave_9,
    Branch1X=weave_8,
    Branch2X=weave_12,
    Branch3X=weave_13,
    Branch4X=weave_10,
    Branch5X=weave_11,
    FlattenInputs=False)
Z_2 = UnitZ(Factor=Z)
item_8 = ListItem(List=flatten(entwine_2), Index=panel_3, Wrap=True)
Z_3 = UnitZ(Factor=-1)

# ---- group: top slab service v concourse control
panel_18 = Panel("""1
1""")
panel_19 = Panel("""0
0""")
panel_20 = Panel("""0
0""")
panel_21 = Panel("""1
1""")
repeat_26 = RepeatData(Data=panel_18, Length="200")
repeat_27 = RepeatData(Data=panel_19, Length="200")
repeat_28 = RepeatData(Data=panel_20, Length="200")
repeat_29 = RepeatData(Data=panel_21, Length="1400")
partition = PartitionList(List=repeat_27, Size=2)
partition_2 = PartitionList(List=repeat_26, Size=2)
partition_3 = PartitionList(List=repeat_28, Size=2)
partition_4 = PartitionList(List=repeat_29, Size=2)
entwine_3 = Entwine(Branch0X=partition_2, Branch1X=partition_3, Branch2X=partition, Branch3X=partition_4, FlattenInputs=False)
tstat_2 = TreeStatistics(Tree=entwine_3)  # -> Paths, Length, Count
item_9 = ListItem(List=tstat_2.Paths, Index=panel_8, Wrap=True)
branch_2 = TreeBranch(Tree=entwine_3, Path=item_9, MaintainPaths=True)

# ----
lng_3 = ListLength(List=tstat_2.Paths)
panel_22 = Panel(lng_3)
panel_23 = Panel("""4
5""")
panel_24 = Panel("""2
1""")
panel_25 = Panel("""0
4
5
3""")
lng_4 = ListLength(List=data_3)  # -> flatten(Length)
lng_5 = ListLength(List=lng_4)
series = Series(Start="-2000", Step="-150", Count=lng_4)
series_2 = Series(Start=Slider(809, range=0..1000), Step=Slider(200, range=0..1000), Count=lng_5)
pt_3 = ConstructPoint(XCoordinate=graft(series_2), YCoordinate=series, ZCoordinate=0)
X_3 = UnitX(Factor="-500")
X_4 = UnitX(Factor="20")
X_5 = UnitX(Factor="-20")
pt_4 = Point([<point referenced from the Rhino model> x4])
division = Division(A="360", B="8")
series_3 = Series(Start=0, Step=division, Count="8")
Y = UnitY(Factor=Slider(14, range=0..100))
panel_26 = Panel("""Programme
Circulation
Events
Sightlines
Commercial8frontage
Envelope8(Steel)
Bowl and slabs8(Concrete)
Additional8functions""")
Y_2 = UnitY(Factor=Slider(10, range=0..10))
rep = ReplaceText(Text=graft(panel_26), Find="8", RecursiveReplace=False)
repeat_30 = RepeatData(Data="1", Length="900")
repeat_31 = RepeatData(Data="0", Length="100")
entwine_4 = Entwine(Branch0X=graft(repeat_31), Branch1X=graft(repeat_30), FlattenInputs=False)
item_10 = ListItem(List=flatten(entwine_4), Index=panel_3, Wrap=True)
join = TextJoin(Text=panel_11, Join="   ")
series_4 = Series(Start=0, Step=1, Count=panel_2)
item_11 = ListItem(List=series_4, Index=panel_3, Wrap=True)
concat = Concatenate(FragmentA="Rows per tier: ", FragmentB=flatten(join))
concat_2 = Concatenate(FragmentA="Grid size: ", FragmentB="8.2")
concat_3 = Concatenate(FragmentA="Row depth: ", FragmentB="0.8")
panel_27 = Panel("""4
5""")
createatts = CreateAttributes(LayerName="indicator text", enableFullPath=False)
material = CreateMaterial(
    Diffuse=ColourSwatch(SwatchColor=RGB(0, 189, 9)),
    Specular=RGB(255, 255, 255),
    Emission=RGB(0, 0, 0),
    Transparency=0.9,
    Shine=0)
createatts_2 = CreateAttributes(LayerName="indicator grid", enableFullPath=False)
createatts_3 = CreateAttributes(LayerName="indicator grid 2", enableFullPath=False)
createatts_4 = CreateAttributes(LayerName="indicator polygon", enableFullPath=False)
pt_5 = ConstructPoint(XCoordinate=expr("x-10", 0), YCoordinate=0, ZCoordinate=0)
material_2 = CreateMaterial(
    Diffuse=ColourSwatch(SwatchColor=RGB(171, 171, 171)),
    Specular=RGB(255, 255, 255),
    Emission=RGB(0, 0, 0),
    Transparency=0.9,
    Shine=0)
panel_28 = Panel("1.037234")
dom = ConstructDomain(DomainStart=".9", DomainEnd="1.8")
dom_2 = ConstructDomain(DomainStart=".1", DomainEnd=".8")
xz_3 = XZPlane(Origin=Point(0, 0, 0))
dom_3 = ConstructDomain(DomainStart="0", DomainEnd=".9")
dom_4 = ConstructDomain(DomainStart="0", DomainEnd=".5")
Y_3 = UnitY(Factor="-2000")
addition = Addition(A=X_5, B=Y_3)
relay = Relay()
X_6 = UnitX(Factor="275")
clean = CleanTree(RemoveNulls=True, RemoveInvalid=True, RemoveEmpty=False, Tree=flatten(relay))
Y_4 = UnitY(Factor="-2000")
xy_2 = XYPlane(Origin=Point(0, 0, 0))
panel_29 = Panel("service slab")  # disabled
panel_30 = Panel("hospitality")  # disabled
panel_31 = Panel("cores")  # disabled
panel_32 = Panel("wc")  # disabled
panel_33 = Panel("podium")  # disabled
panel_34 = Panel("commercial")  # disabled
panel_35 = Panel("bowl")  # disabled
panel_36 = Panel("seats")  # disabled
panel_37 = Panel("roof")  # disabled
panel_38 = Panel("concourse")  # disabled
panel_39 = Panel("service")  # disabled
panel_40 = Panel("service 1")  # disabled
panel_41 = Panel("facade")  # disabled
runion = RegionUnion(Curves=clean)
panel_42 = Panel("service 2")  # disabled
relay_2 = Relay()
panel_43 = Panel("circulation hospitality")  # disabled
addition_2 = Addition(A=X_6, B=Y_4)
panel_44 = Panel("circulation ga")  # disabled
panel_45 = Panel("circulation other")  # disabled
clean_2 = CleanTree(RemoveNulls=True, RemoveInvalid=True, RemoveEmpty=False, Tree=flatten(relay_2))  # disabled
createatts_5 = CreateAttributes(LayerName=panel_32, enableFullPath=False)  # disabled
createatts_6 = CreateAttributes(LayerName=panel_30, enableFullPath=False)  # disabled
createatts_7 = CreateAttributes(LayerName=panel_34, enableFullPath=False)  # disabled
createatts_8 = CreateAttributes(LayerName=panel_38, enableFullPath=False)  # disabled
createatts_9 = CreateAttributes(LayerName=panel_39, enableFullPath=False)  # disabled
createatts_10 = CreateAttributes(LayerName=panel_40, enableFullPath=False)  # disabled
createatts_11 = CreateAttributes(LayerName=panel_29, enableFullPath=False)  # disabled
createatts_12 = CreateAttributes(LayerName=panel_31, enableFullPath=False)  # disabled
createatts_13 = CreateAttributes(LayerName=panel_33, enableFullPath=False)  # disabled
createatts_14 = CreateAttributes(LayerName=panel_35, enableFullPath=False)  # disabled
createatts_15 = CreateAttributes(LayerName=panel_37, enableFullPath=False)  # disabled
createatts_16 = CreateAttributes(LayerName=panel_42, enableFullPath=False)  # disabled
createatts_17 = CreateAttributes(LayerName=panel_41, enableFullPath=False)  # disabled
createatts_18 = CreateAttributes(LayerName=panel_43, enableFullPath=False)  # disabled
createatts_19 = CreateAttributes(LayerName=panel_44, enableFullPath=False)  # disabled
createatts_20 = CreateAttributes(LayerName=panel_45, enableFullPath=False)  # disabled
lng_6 = ListLength(List=panel_11)
multiplication = Multiplication(A=panel_11, B="2")
series_5 = Series(Start=0, Step=2, Count=lng_6)
ma_2 = MassAddition(Input=multiplication)  # -> Result, PartialResults
addition_3 = Addition(A=series_5, B=ma_2.PartialResults)
split = SplitList(List=reverse(addition_3), Index=1)  # -> ListA, reverse(ListB)
addition_4 = Addition(A=split.ListB, B=1)
fops = Curve([<curve referenced from the Rhino model> x4])
item_12 = ListItem(List=fops, Index=0, Wrap=True)  # -> Item, Item1, Item2, Item3
dom_5 = ConstructDomain(DomainStart="0.05", DomainEnd=".95")
dom_6 = ConstructDomain(DomainStart="0", DomainEnd=".4")
panel_46 = Panel("0.126354")
item_13 = ListItem(Index=0, Wrap=True)
dom_7 = ConstructDomain(DomainStart="0", DomainEnd=".9")
dom_8 = ConstructDomain(DomainStart="0", DomainEnd=".35")
panel_47 = Panel(item_13)
Z_4 = UnitZ(Factor=Slider(0.2, range=0..1))
Z_5 = UnitZ(Factor=Slider(0.2, range=0..1))
material_3 = CreateMaterial(
    Diffuse=ColourSwatch(SwatchColor=RGB(209, 191, 178)),
    Specular=RGB(255, 255, 255),
    Emission=RGB(0, 0, 0),
    Transparency=0.4,
    Shine=0)
swatch = ColourSwatch(SwatchColor=RGB(255, 0, 0))  # disabled
panel_48 = Panel("5")  # disabled
dom_9 = ConstructDomain(DomainStart=".1", DomainEnd=".9")
dom_10 = ConstructDomain(DomainStart=".01", DomainEnd=".22")
panel_49 = Panel("0.153456")
panel_50 = Panel("C:\Users\Yaquime\Desktop\PhD\210803 Pilot study\images\icons\210916 whole chamfer\88.png")
panel_51 = Panel("4000")
panel_52 = Panel("3000")
Z_6 = UnitZ(Factor="-100")
Z_7 = UnitZ(Factor="350")

# ---- group: radial grid split
project_2 = Project(Geometry=end_2.End, Plane=PlaneXY(0, 0, 0))  # -> Geometry, Transform
project_3 = Project(Geometry=end_2.Start, Plane=PlaneXY(0, 0, 0))  # -> Geometry, Transform
dist = Distance(PointA=project_3.Geometry, PointB=project_2.Geometry)
division_2 = Division(A=dist, B="8.2")
series_6 = Series(Start=0, Step="8.2", Count=expr("x+5", division_2))
offset_l_2 = OffsetCurveLoose(Curve=item_4, Distance=series_6)
item_14 = ListItem(List=offset_l_2, Index=4, Wrap=True)  # -> Item, Item1
item_15 = ListItem(List=offset_l_2, Index=0, Wrap=True)  # -> Item, Item1
explode_3 = Explode(Curve=item_14.Item, Recursive=True)  # -> reparameterize(Segments), Vertices
explode_4 = Explode(Curve=item_15.Item, Recursive=True)  # -> reparameterize(Segments), Vertices
len_4 = Length(Curve=explode_4.Segments)
len_5 = Length(Curve=explode_3.Segments)
division_3 = Division(A=len_4, B="8.2")  # -> graft(Result)
division_4 = Division(A=len_5, B="8.2")  # -> graft(Result)
round = Round(Number=division_3)  # -> Nearest, Floor, Ceiling
round_2 = Round(Number=division_4)  # -> Nearest, Floor, Ceiling
multiplication_2 = Multiplication(A=round.Nearest, B="3")
larger_2 = LargerThan(FirstNumber=multiplication_2, SecondNumber=round_2.Nearest)  # -> LargerThan, OrEqualTo
dispatch_4 = Dispatch(List=multiplication_2, DispatchPattern=larger_2.LargerThan)  # -> ListA, ListB
dispatch_5 = Dispatch(List=round_2.Nearest, DispatchPattern=larger_2.LargerThan)  # -> ListA, ListB
merge_2 = Merge(Data1=dispatch_4.ListB, Data2=dispatch_5.ListA)
divide = DivideCurve(Curve=graft(explode_4.Segments), Count=merge_2, Kinks=False)  # -> Points, Tangents, Parameters

# ----
item_16 = ListItem(List=reverse(offset_l_2), Index=0, Wrap=True)  # -> Item, Item1
explode_5 = Explode(Curve=item_16.Item, Recursive=True)  # -> reparameterize(Segments), Vertices
lng_7 = ListLength(List=explode_4.Segments)

# ---- group: radial grid split (continued)
divide_2 = DivideCurve(Curve=graft(explode_5.Segments), Count=merge_2, Kinks=False)  # -> Points, Tangents, Parameters
ln = Line(StartPoint=divide_2.Points, EndPoint=divide.Points)  # -> flatten(Line)

# ----
end_3 = EndPoints(Curve=ln)  # -> Start, End
move_4 = Move(Geometry=end_3.Start, Motion=Vector(0, 0, 10))  # -> Geometry, Transform
pl_3pt = Plane3Pt(PointA=graft(end_3.End), PointB=graft(end_3.Start), PointC=graft(move_4.Geometry))  # -> reverse(Plane)
pln = Plane(flatten(pl_3pt))
ptuvcrvs = IntersectCurves(CU=ln, CV=offset_l_2)
prot = RotatePlane(Plane=pln, Angle=degrees("0"))
ptborders = GenerateBorders(Grid=ptuvcrvs, PanelShape=0)
orient = Orient(Geometry=bowl_section.section, Source=xz_3, Target=prot)  # -> Geometry, Transform
end_4 = EndPoints(Curve=orient.Geometry)  # -> Start, End

# ---- group: grid max control
panel_53 = Panel("3")
lng_8 = ListLength(List=ptuvcrvs)
subtraction = Subtraction(A=lng_8, B=panel_53)
split_2 = SplitList(List=ptuvcrvs, Index=subtraction)  # -> ListA, ListB

# ---- group: top service
pdecon_2 = Deconstruct(Point=end_2.End)  # -> XComponent, YComponent, ZComponent
item_17 = ListItem(List=offset_l_2, Index=0, Wrap=True)
item_18 = ListItem(List=reverse(offset_l_2), Index=panel_53, Wrap=True)
offset = OffsetCurve(Curve=item_17, Distance=pdecon_2.XComponent, Corners=1)
Z_8 = UnitZ(Factor=pdecon_2.ZComponent)
move_5 = Move(Geometry=[offset, item_18], Motion=Z_8)  # -> Geometry, Transform

# ----
pline_2 = PolyLine(Vertices=end_4.End, Closed=True)
move_6 = Move(Geometry=flatten(split_2.ListA), Motion=graft(Z_2))  # -> Geometry, Transform
incurve = PointInCurve(Point=move_6.Geometry, Curve=graft(move_3.Geometry))  # -> Relationship, Point
item_19 = ListItem(List=reverse(offset_l_2), Index=0, Wrap=True)
dispatch_6 = Dispatch(List=move_6.Geometry, DispatchPattern=incurve.Relationship)  # -> ListA, ListB
move_7 = Move(Geometry=item_19, Motion=Z_3)  # -> Geometry, Transform

# ---- group: 3d section
runion_2 = RegionUnion(Curves=move_7.Geometry)
Z_9 = UnitZ(Factor=Slider(100, range=0..100))
Z_10 = UnitZ(Factor=-0.2)
extr = Extrude(Base=runion_2, Direction=Z_9)
move_8 = Move(Geometry=extr, Motion=Z_10)  # -> Geometry, Transform
cap = CapHoles(Brep=move_8.Geometry)

# ----
lng_9 = ListLength(List=dispatch_6.ListB)
lng_10 = ListLength(List=ln)
division_5 = Division(A=lng_9, B=lng_10)
area = Area(Geometry=runion_2)  # -> Area, Centroid
panel_54 = Panel(division_5)
partition_5 = PartitionList(List=dispatch_6.ListB, Size=division_5)

# ---- group: grid stretch to bowl
item_20 = ListItem(List=partition_5, Index=0, Wrap=True)  # -> Item, Item1, Item2
vec2pt = Vector2Pt(PointA=item_20.Item1, PointB=item_20.Item, Unitize=False)  # -> Vector, Length
project_4 = ProjectPoint(Point=item_20.Item, Direction=vec2pt.Vector, Geometry=move_3.Geometry)  # -> Point, Index
trim = TrimTree(Tree=project_4.Point, Depth=1)
trim_2 = TrimTree(Tree=item_20.Item, Depth=1)
lng_11 = ListLength(List=trim)
pdecon_3 = Deconstruct(Point=trim)  # -> XComponent, YComponent, ZComponent
series_7 = Series(Start=0, Step=1, Count=lng_11)
smaller = SmallerThan(FirstNumber=pdecon_3.ZComponent, SecondNumber="2.5")  # -> SmallerThan, OrEqualTo
dispatch_7 = Dispatch(List=series_7, DispatchPattern=smaller.SmallerThan)  # -> ListA, ListB
replace = ReplaceItems(List=trim, Item=trim_2, Indices=dispatch_7.ListA, Wrap=False)
replace_2 = ReplaceItems(List=partition_5, Item=graft(replace), Indices=0, Wrap=False)

# ---- group: add grid cells if too short
lng_12 = ListLength(List=ln)
lng_13 = ListLength(List=replace_2)  # -> flatten(Length)
pline_3 = PolyLine(Vertices=replace_2, Closed=False)  # -> flatten(Polyline)
smaller_2 = SmallerThan(FirstNumber=lng_13, SecondNumber=Slider(4, range=0..10))  # -> SmallerThan, OrEqualTo
partition_6 = PartitionList(List=lng_13, Size=lng_12)
partition_7 = PartitionList(List=pline_3, Size=lng_12)
partition_8 = PartitionList(List=smaller_2.SmallerThan, Size=lng_12)
item_21 = ListItem(List=partition_6, Index=0, Wrap=True)
dispatch_8 = Dispatch(List=partition_7, DispatchPattern=partition_8)  # -> ListA, ListB
dispatch_9 = Dispatch(List=partition_6, DispatchPattern=smaller_2.SmallerThan)  # -> ListA, ListB
panel_55 = Panel(item_21)
divide_3 = DivideCurve(Curve=dispatch_8.ListA, Count="4", Kinks=False)  # -> Points, Tangents, Parameters
divide_4 = DivideCurve(Curve=dispatch_8.ListB, Count=dispatch_9.ListB, Kinks=False)  # -> Points, Tangents, Parameters
merge_3 = Merge(Data1=divide_4.Points, Data2=divide_3.Points)

# ----
panel_56 = Panel(lng_12)
series_8 = Series(Start=item_7, Step=1, Count=panel_56)
panel_57 = Panel(series_8)
ptborders_2 = GenerateBorders(Grid=merge_3, PanelShape=0)
lng_14 = ListLength(List=ptborders_2)  # -> flatten(Length)
partition_9 = PartitionList(List=lng_14, Size=lng_12)

# ---- group: clean up
explode_6 = Explode(Curve=ptborders_2, Recursive=True)  # -> Segments, Vertices
len_6 = Length(Curve=explode_6.Segments)
tstat_3 = TreeStatistics(Tree=ptborders_2)  # -> Paths, Length, Count
sort = SortList(Keys=len_6)  # -> Keys, ValuesA
item_22 = ListItem(List=sort.Keys, Index=0, Wrap=True)
larger_3 = LargerThan(FirstNumber=item_22, SecondNumber="0.2")  # -> LargerThan, OrEqualTo
trim_3 = TrimTree(Tree=larger_3.LargerThan, Depth=1)
sort_2 = SortList(Keys=trim_3)  # -> Keys, ValuesA
item_23 = ListItem(List=sort_2.Keys, Index=0, Wrap=True)

# ----
item_24 = ListItem(List=partition_9, Index=0, Wrap=True)  # -> flatten(Item)
dispatch_10 = Dispatch(List=tstat_3.Paths, DispatchPattern=flatten(item_23))  # -> ListA, ListB
flatten = FlattenTree(Tree=merge_2, Path="{0}")
branch_3 = TreeBranch(Tree=ptborders_2, Path=dispatch_10.ListA, MaintainPaths=True)

# ---- group: slab functional split
trim_4 = TrimTree(Tree=branch_3, Depth=1)
panel_58 = Panel("""2
2
0
2
2
1
0""")
tstat_4 = TreeStatistics(Tree=trim_4)  # -> Paths, Length, Count

# ----
item_25 = ListItem(List=reverse(branch_3), Index=0, Wrap=True)
trim_5 = TrimTree(Tree=item_25, Depth=1)
previewlw = CustomPreviewLineweights(Geometry=branch_3, Shader=ColourSwatch(SwatchColor=RGB(204, 204, 204)), Absolute=False)

# ---- group: slab functional split / gate grid width
sift = SiftPattern(List=item_24, SiftPattern=panel_58)  # -> Output0, Output1, Output2, Output3
clean_3 = CleanTree(RemoveNulls=True, RemoveInvalid=True, RemoveEmpty=False, Tree=sift.Output0)
clean_4 = CleanTree(RemoveNulls=True, RemoveInvalid=True, RemoveEmpty=False, Tree=sift.Output1)
clean_5 = CleanTree(RemoveNulls=True, RemoveInvalid=True, RemoveEmpty=False, Tree=sift.Output2)

# ---- group: slab functional split / gate paths
sift_2 = SiftPattern(List=tstat_4.Paths, SiftPattern=panel_58)  # -> Output0, Output1, Output2
clean_6 = CleanTree(RemoveNulls=True, RemoveInvalid=True, RemoveEmpty=False, Tree=sift_2.Output0)
clean_7 = CleanTree(RemoveNulls=True, RemoveInvalid=True, RemoveEmpty=False, Tree=sift_2.Output1)
clean_8 = CleanTree(RemoveNulls=True, RemoveInvalid=True, RemoveEmpty=False, Tree=sift_2.Output2)

# ---- group: cores
partition_10 = PartitionList(List=trim_5, Size=flatten)
panel_59 = Panel("""0
0
1
1
0
0""")
lng_15 = ListLength(List=partition_10)  # -> flatten(Length)
series_9 = Series(Start=0, Step=1, Count=lng_15)
cull = CullPattern(List=series_9, CullPattern=panel_59)
lng_16 = ListLength(List=cull)
division_6 = Division(A=lng_16, B="2")
split_3 = TextSplit(Text=division_6, Separators=".")
lng_17 = ListLength(List=split_3)
tstat_5 = TreeStatistics(Tree=division_6)  # -> Paths, Length, Count
larger_4 = LargerThan(FirstNumber=lng_17, SecondNumber="1")  # -> LargerThan, OrEqualTo
panel_60 = Panel(division_6)
dispatch_11 = Dispatch(List=tstat_5.Paths, DispatchPattern=flatten(larger_4.LargerThan))  # -> ListA, ListB
branch_4 = TreeBranch(Tree=cull, Path=dispatch_11.ListA, MaintainPaths=True)
branch_5 = TreeBranch(Tree=cull, Path=dispatch_11.ListB, MaintainPaths=True)
split_4 = SplitList(List=reverse(branch_4), Index=1)  # -> ListA, reverse(ListB)
merge_4 = Merge(Data1=branch_5, Data2=split_4.ListB)

# ---- group: hospitality
branch_6 = TreeBranch(Tree=trim_4, Path=clean_7, MaintainPaths=True)
partition_11 = PartitionList(List=branch_6, Size=graft(clean_4))  # -> simplify(Chunks)
lng_18 = ListLength(List=partition_11)
larger_5 = LargerThan(FirstNumber=lng_18, SecondNumber=Slider(2, range=0..10))  # -> flatten(LargerThan), OrEqualTo
tstat_6 = TreeStatistics(Tree=partition_11)  # -> Paths, Length, Count
dispatch_12 = Dispatch(List=tstat_6.Paths, DispatchPattern=larger_5.LargerThan)  # -> ListA, ListB
branch_7 = TreeBranch(Tree=partition_11, Path=dispatch_12.ListB, MaintainPaths=True)
item_26 = ListItem(List=branch_7, Index=0, Wrap=True)  # -> Item, Item1
panel_61 = Panel(partition_11)
explode_7 = Explode(Curve=item_26.Item, Recursive=True)  # -> Segments, Vertices
item_27 = ListItem(List=explode_7.Segments, Index=0, Wrap=True)  # -> Item, Item1, Item2
branch_8 = TreeBranch(Tree=partition_11, Path=dispatch_12.ListA, MaintainPaths=True)
end_5 = EndPoints(Curve=item_27.Item)  # -> Start, End
end_6 = EndPoints(Curve=item_27.Item2)  # -> Start, End
curvepoint = PointOnCurve(item_27.Item, parameter=0.75)
curvepoint_2 = PointOnCurve(item_27.Item2, parameter=0.25)
weave_14 = Weave(Pattern=[0, 1, 2, 3], Stream0=curvepoint_2, Stream1=end_6.Start, Stream2=end_5.End, Stream3=curvepoint, NullGaps=False)
weave_15 = Weave(Pattern=[0, 1, 2, 3], Stream0=end_5.Start, Stream1=curvepoint, Stream2=curvepoint_2, Stream3=end_6.End, NullGaps=False)
pline_4 = PolyLine(Vertices=weave_15, Closed=True)
pline_5 = PolyLine(Vertices=weave_14, Closed=True)
weave_16 = Weave(Pattern=[0, 1, 2], Stream0=pline_4, Stream1=pline_5, Stream2=item_26.Item1, NullGaps=False)  # -> simplify(Weave)
entwine_5 = Entwine(Branch0X=weave_16, Branch1X=branch_8, FlattenInputs=False)
item_28 = ListItem(List=entwine_5, Index=0, Wrap=True)  # -> Item, Item1
clean_9 = CleanTree(RemoveNulls=True, RemoveInvalid=True, RemoveEmpty=True, Tree=entwine_5)
trim_6 = TrimTree(Tree=item_28.Item, Depth=1)  # -> flatten(Tree)
panel_62 = Panel("""0
0
0
0
0
0
0
0
1""")
dispatch_13 = Dispatch(List=trim_6, DispatchPattern=panel_62)  # -> ListA, ListB

# ----
branch_9 = TreeBranch(Tree=trim_4, Path=clean_6, MaintainPaths=True)
panel_63 = Panel(branch_9)
partition_12 = PartitionList(List=branch_9, Size=graft(clean_3))  # -> simplify(Chunks)

# ---- group: GA
lng_19 = ListLength(List=partition_12)
larger_6 = LargerThan(FirstNumber=lng_19, SecondNumber=Slider(2, range=0..10))  # -> flatten(LargerThan), OrEqualTo
tstat_7 = TreeStatistics(Tree=partition_12)  # -> Paths, Length, Count
dispatch_14 = Dispatch(List=tstat_7.Paths, DispatchPattern=larger_6.LargerThan)  # -> ListA, ListB
branch_10 = TreeBranch(Tree=partition_12, Path=dispatch_14.ListB, MaintainPaths=True)
item_29 = ListItem(List=branch_10, Index=0, Wrap=True)  # -> Item, Item1
branch_11 = TreeBranch(Tree=partition_12, Path=dispatch_14.ListA, MaintainPaths=True)
explode_8 = Explode(Curve=item_29.Item, Recursive=True)  # -> Segments, Vertices
item_30 = ListItem(List=explode_8.Segments, Index=0, Wrap=True)  # -> Item, Item1, Item2
end_7 = EndPoints(Curve=item_30.Item)  # -> Start, End
end_8 = EndPoints(Curve=item_30.Item2)  # -> Start, End
curvepoint_3 = PointOnCurve(item_30.Item, parameter=0.75)
curvepoint_4 = PointOnCurve(item_30.Item2, parameter=0.25)
weave_17 = Weave(Pattern=[0, 1, 2, 3], Stream0=curvepoint_4, Stream1=end_8.Start, Stream2=end_7.End, Stream3=curvepoint_3, NullGaps=False)
weave_18 = Weave(Pattern=[0, 1, 2, 3], Stream0=end_7.Start, Stream1=curvepoint_3, Stream2=curvepoint_4, Stream3=end_8.End, NullGaps=False)
pline_6 = PolyLine(Vertices=weave_18, Closed=True)
pline_7 = PolyLine(Vertices=weave_17, Closed=True)
weave_19 = Weave(Pattern=[0, 1, 2], Stream0=pline_6, Stream1=pline_7, Stream2=item_29.Item1, NullGaps=False)  # -> simplify(Weave)
entwine_6 = Entwine(Branch0X=weave_19, Branch1X=branch_11, FlattenInputs=False)
item_31 = ListItem(List=entwine_6, Index=0, Wrap=True)  # -> Item, Item1, Item2, Item3
panel_64 = Panel("""0
1""")
trim_7 = TrimTree(Tree=item_31.Item, Depth=1)
dispatch_15 = Dispatch(List=trim_7, DispatchPattern=panel_64)  # -> ListA, ListB
cp = ControlPoints(Curve=dispatch_15.ListB)  # -> Points, Weights, Knots
item_32 = ListItem(List=cp.Points, Index=0, Wrap=True)  # -> Item, Item1, Item2, Item3
vec2pt_2 = Vector2Pt(PointA=item_32.Item1, PointB=item_32.Item2, Unitize=False)  # -> Vector, Length
amp = Amplitude(Vector=vec2pt_2.Vector, Amplitude="1.6")
move_9 = Move(Geometry=item_32.Item, Motion=amp)  # -> Geometry, Transform
move_10 = Move(Geometry=item_32.Item1, Motion=amp)  # -> Geometry, Transform
replace_3 = ReplaceItems(List=cp.Points, Item=move_9.Geometry, Indices="0", Wrap=False)
replace_4 = ReplaceItems(List=replace_3, Item=move_10.Geometry, Indices="1", Wrap=False)
split_5 = SplitList(List=replace_4, Index="4")  # -> ListA, ListB
pline_8 = PolyLine(Vertices=split_5.ListA, Closed=True)
trim_8 = TrimTree(Tree=pline_8, Depth=4)
weave_20 = Weave(Pattern=[0, 1], Stream0=dispatch_15.ListA, Stream1=trim_8, NullGaps=False)
partition_13 = PartitionList(List=weave_20, Size=Slider(2, range=0..10))
item_33 = ListItem(List=partition_13, Index=0, Wrap=True)  # -> Item, Item1
cp_2 = ControlPoints(Curve=item_33.Item)  # -> Points, Weights, Knots
cp_3 = ControlPoints(Curve=item_33.Item1)  # -> Points, Weights, Knots
panel_65 = Panel("""3
2""")
panel_66 = Panel("""1
4""")
item_34 = ListItem(List=cp_2.Points, Index=panel_65, Wrap=True)
item_35 = ListItem(List=cp_3.Points, Index=panel_66, Wrap=True)
weave_21 = Weave(Pattern=[0, 0, 1, 1], Stream0=item_34, Stream1=item_35, NullGaps=False)
pline_9 = PolyLine(Vertices=weave_21, Closed=True)
explode_9 = Explode(Curve=pline_9, Recursive=True)  # -> Segments, Vertices
item_36 = ListItem(List=explode_9.Segments, Index=0, Wrap=True)  # -> Item, Item1, Item2, Item3
end_9 = EndPoints(Curve=item_36.Item3)  # -> Start, End
eval = EvaluateCurve(Curve=reparameterize(item_36.Item), Parameter=".6")  # -> Point, Tangent, Angle
eval_2 = EvaluateCurve(Curve=reparameterize(item_36.Item2), Parameter=".4")  # -> Point, Tangent, Angle
end_10 = EndPoints(Curve=item_36.Item1)  # -> Start, End
vec2pt_3 = Vector2Pt(PointA=end_9.Start, PointB=end_9.End, Unitize=False)  # -> Vector, Length
amp_2 = Amplitude(Vector=vec2pt_3.Vector, Amplitude="-1.2")
amp_3 = Amplitude(Vector=vec2pt_3.Vector, Amplitude="1.2")
amp_4 = Amplitude(Vector=vec2pt_3.Vector, Amplitude="-1.2")
amp_5 = Amplitude(Vector=vec2pt_3.Vector, Amplitude="1.2")
move_11 = Move(Geometry=eval_2.Point, Motion=amp_3)  # -> Geometry, Transform
move_12 = Move(Geometry=eval.Point, Motion=amp_2)  # -> Geometry, Transform
move_13 = Move(Geometry=end_10.Start, Motion=amp_4)  # -> Geometry, Transform
move_14 = Move(Geometry=end_10.End, Motion=amp_5)  # -> Geometry, Transform
weave_22 = Weave(
    Pattern=[0, 1, 3, 2],
    Stream0=move_11.Geometry,
    Stream1=move_12.Geometry,
    Stream2=move_13.Geometry,
    Stream3=move_14.Geometry,
    NullGaps=False)
panel_67 = Panel("3")

# ----
panel_68 = Panel(merge_4)
replace_5 = ReplaceItems(List=partition_10, Indices=merge_4, Wrap=False)

# ---- group: podium
item_37 = ListItem(List=reverse(branch_11), Index=0, Wrap=True)
trim_9 = TrimTree(Tree=item_37, Depth=1)
tstat_8 = TreeStatistics(Tree=trim_9)  # -> Paths, Length, Count
item_38 = ListItem(List=tstat_8.Paths, Index=0, Wrap=True)
branch_12 = TreeBranch(Tree=trim_9, Path=item_38, MaintainPaths=True)
explode_10 = Explode(Curve=branch_12, Recursive=True)  # -> Segments, Vertices
item_39 = ListItem(List=explode_10.Segments, Index=1, Wrap=True)
join_2 = JoinCurves(Curves=flatten(item_39), Preserve=True)
offset_2 = OffsetCurve(Curve=join_2, Distance=expr("x*2", "8.2"), Corners=1)
weave_23 = Weave(Pattern=[0, 1], Stream0=join_2, Stream1=offset_2, NullGaps=False)
boundary = BoundarySurfaces(Edges=weave_23)

# ----
item_40 = ListItem(List=partition_10, Index=merge_4, Wrap=True)
clean_10 = CleanTree(RemoveNulls=True, RemoveInvalid=True, RemoveEmpty=False, Tree=replace_5)
boundary_2 = BoundarySurfaces(Edges=item_40)
runion_3 = RegionUnion(Curves=item_40)
explode_11 = Explode(Curve=runion_3, Recursive=True)  # -> Segments, Vertices

# ---- group: circulation cores
trim_10 = TrimTree(Tree=item_40, Depth=1)
tstat_9 = TreeStatistics(Tree=trim_10)  # -> Paths, Length, Count
item_41 = ListItem(List=tstat_9.Paths, Index=0, Wrap=True)
branch_13 = TreeBranch(Tree=trim_10, Path=item_41, MaintainPaths=True)
Z_11 = UnitZ(Factor=pdecon_2.ZComponent)
extr_2 = Extrude(Base=branch_13, Direction=Z_11)
cap_2 = CapHoles(Brep=extr_2)

# ----
explode_12 = Explode(Curve=clean_10, Recursive=True)  # -> Segments, Vertices
area_2 = Area(Geometry=item_40)  # -> Area, Centroid

# ---- group: service slab
branch_14 = TreeBranch(Tree=trim_4, Path=clean_8, MaintainPaths=True)
boundary_3 = BoundarySurfaces(Edges=branch_14)

# ----
item_42 = ListItem(List=explode_11.Segments, Index=panel_23, Wrap=True)
cp_4 = ControlPoints(Curve=dispatch_13.ListA)  # -> Points, Weights, Knots
cp_5 = ControlPoints(Curve=dispatch_13.ListB)  # -> Points, Weights, Knots
end_11 = EndPoints(Curve=join_2)  # -> Start, End
item_43 = ListItem(List=cp_4.Points, Index=0, Wrap=True)  # -> Item, Item1, Item2, Item3
item_44 = ListItem(List=cp_5.Points, Index=0, Wrap=True)  # -> Item, Item1, Item2, Item3
item_45 = ListItem(List=explode_11.Segments, Index=panel_24, Wrap=True)
curvepoint_5 = PointOnCurve(item_42, parameter=0.5)
item_46 = ListItem(List=explode_11.Segments, Index=panel_25, Wrap=True)
item_47 = ListItem(List=explode_12.Segments, Index=1, Wrap=True)
frompoints = MeshFromPoints(Points=[item_43.Item, item_43.Item1, item_43.Item3, item_43.Item2], UDirection=2, VDirection=2, Colour=RGB(23, 230, 230))
frompoints_2 = MeshFromPoints(Points=[item_44.Item, item_44.Item1, item_44.Item3, item_44.Item2], UDirection=2, VDirection=2, Colour=RGB(201, 0, 191))
curvepoint_6 = PointOnCurve(item_45, parameter=0.5)
pdecon_4 = Deconstruct(Point=end_11.End)  # -> XComponent, YComponent, ZComponent
preview = CustomPreview(Geometry=boundary_3, Material=ColourSwatch(SwatchColor=RGB(109, 0, 176)))
trim_11 = TrimTree(Tree=item_47, Depth=1)
trim_12 = TrimTree(Tree=item_46, Depth=3)
vec2pt_4 = Vector2Pt(PointA=curvepoint_6, PointB=curvepoint_5, Unitize=False)  # -> Vector, Length
ln_2 = Line(StartPoint=curvepoint_5, EndPoint=curvepoint_6)
volume = Volume(Geometry=cap_2)  # -> Volume, Centroid
curvepoint_7 = PointOnCurve(ln_2, parameter=0.5)
join_3 = JoinCurves(Curves=flatten([trim_11, trim_12]), Preserve=False)

# ---- group: hospitality circulation
item_48 = ListItem(List=reverse(clean_9), Index=0, Wrap=True)
item_49 = ListItem(List=clean_9, Index=0, Wrap=True)  # -> Item, Item1, Item2, Item3
item_50 = ListItem(List=clean_9, Index=0, Wrap=True)
debrep = DeconstructBrep(Brep=item_50)  # -> Faces, Edges, Vertices
area_3 = Area(Geometry=item_48)  # -> Area, Centroid
item_51 = ListItem(List=debrep.Edges, Index=3, Wrap=True)
area_4 = Area(Geometry=item_49.Item1)  # -> Area, Centroid
curvepoint_8 = PointOnCurve(item_51, parameter=0.5)
trim_13 = TrimTree(Tree=area_4.Centroid, Depth=1)
ln_3 = Line(StartPoint=curvepoint_8, EndPoint=area_3.Centroid)
pline_10 = PolyLine(Vertices=trim_13, Closed=True)  # -> flatten(Polyline)
trim_14 = TrimTree(Tree=ln_3, Depth=2)
ccx = CurveCurve(CurveA=trim_14, CurveB=graft(pline_10))  # -> Points, ParamsA, ParamsB
lng_20 = ListLength(List=flatten)
shatter = Shatter(Curve=graft(trim_14), Parameters=ccx.ParamsA)
series_10 = Series(Start=0, Step=1, Count=lng_20)
tstat_10 = TreeStatistics(Tree=merge_4)  # -> Paths, Length, Count
item_52 = ListItem(List=shatter, Index=0, Wrap=True)  # -> Item, Item1
trim_15 = TrimTree(Tree=item_52.Item1, Depth=2)
item_53 = ListItem(List=tstat_10.Paths, Index=series_10, Wrap=True)
branch_15 = TreeBranch(Tree=merge_4, Path=item_53, MaintainPaths=True)
partition_14 = PartitionList(List=trim_15, Size=flatten)
item_54 = ListItem(List=partition_14, Index=branch_15, Wrap=True)
crv_2 = Curve(flatten([item_52.Item, item_54, pline_10]))
previewlw_2 = CustomPreviewLineweights(
    Geometry=crv_2,
    Shader={diffuse=RGB(255, 105, 180), emission=RGB(76, 32, 54), shine=0.5, specular=RGB(255, 255, 255), transparency=0},
    Absolute=False)

# ----
brepinc = PointInBrep(Brep=cap, Point=volume.Centroid, Strict=False)
dispatch_16 = Dispatch(List=cap_2, DispatchPattern=brepinc)  # -> ListA, ListB

# ---- group: Gate outer concourse line
sift_3 = SiftPattern(List=join_3, SiftPattern=panel_58)  # -> Output0, Output1, Output2
clean_11 = CleanTree(RemoveNulls=True, RemoveInvalid=True, RemoveEmpty=False, Tree=sift_3.Output1)
clean_12 = CleanTree(RemoveNulls=True, RemoveInvalid=True, RemoveEmpty=False, Tree=sift_3.Output0)
clean_13 = CleanTree(RemoveNulls=True, RemoveInvalid=True, RemoveEmpty=False, Tree=sift_3.Output2)

# ---- group: hospitality slabs
explode_13 = Explode(Curve=trim_6, Recursive=True)  # -> Segments, Vertices
item_55 = ListItem(List=explode_13.Segments, Index=1, Wrap=True)
join_4 = JoinCurves(Curves=flatten(item_55), Preserve=True)
area_5 = Area(Geometry=clean_11)  # -> Area, Centroid
area_6 = Area(Geometry=join_4)  # -> Area, Centroid
pdecon_5 = Deconstruct(Point=area_5.Centroid)  # -> XComponent, YComponent, ZComponent
pdecon_6 = Deconstruct(Point=area_6.Centroid)  # -> XComponent, YComponent, ZComponent
sort_3 = SortList(Keys=pdecon_5.ZComponent, ValuesA=clean_11)  # -> Keys, ValuesA
sort_4 = SortList(Keys=pdecon_6.ZComponent, ValuesA=join_4)  # -> Keys, ValuesA
weave_24 = Weave(Pattern=[0, 1], Stream0=graft(sort_3.ValuesA), Stream1=graft(sort_4.ValuesA), NullGaps=False)
boundary_4 = BoundarySurfaces(Edges=weave_24)

# ----
frompoints_3 = MeshFromPoints(Points=[eval.Point, end_9.End, eval_2.Point, end_9.Start], UDirection=2, VDirection=2, Colour=RGB(82, 227, 220))
frompoints_4 = MeshFromPoints(Points=weave_22, UDirection=2, VDirection=2, Colour=RGB(255, 0, 0))

# ---- group: GA concourses
weave_25 = Weave(
    Pattern=[0, 1, 2, 3, 4, 5, 6, 7],
    Stream0=end_9.End,
    Stream1=eval.Point,
    Stream2=move_12.Geometry,
    Stream3=move_13.Geometry,
    Stream4=move_14.Geometry,
    Stream5=move_11.Geometry,
    Stream6=eval_2.Point,
    Stream7=end_9.Start,
    NullGaps=False)  # -> reverse(Weave)
trim_16 = TrimTree(Tree=weave_25, Depth=3)
pline_11 = PolyLine(Vertices=trim_16, Closed=True)
area_7 = Area(Geometry=flatten(clean_12))  # -> Area, Centroid
pdecon_7 = Deconstruct(Point=area_7.Centroid)  # -> XComponent, YComponent, ZComponent
area_8 = Area(Geometry=flatten(pline_11))  # -> Area, Centroid
sort_5 = SortList(Keys=pdecon_7.ZComponent, ValuesA=flatten(clean_12))  # -> Keys, ValuesA
pdecon_8 = Deconstruct(Point=area_8.Centroid)  # -> XComponent, YComponent, ZComponent
sort_6 = SortList(Keys=pdecon_8.ZComponent, ValuesA=flatten(pline_11))  # -> Keys, ValuesA
weave_26 = Weave(Pattern=[0, 1], Stream0=graft(sort_5.ValuesA), Stream1=graft(sort_6.ValuesA), NullGaps=False)

# ----
item_56 = ListItem(List=flatten(move_5.Geometry), Index=0, Wrap=True)
cls = Closed(Curve=weave_26)  # -> Closed, Periodic
panel_69 = Panel(cls.Closed)
crv_3 = Curve([pline_2, item_56])
trimcrv = FastTrimCurveWithBreps(Curve=crv_3, Brep=cap, Tolerance=0.01, AngleTolerance=0.01745329252)  # -> CurvesInside, CurveOutside
boundary_5 = BoundarySurfaces(Edges=weave_26)
dispatch_17 = Dispatch(List=trimcrv.CurvesInside, DispatchPattern=branch_2)  # -> ListA, ListB
volume_2 = Volume(Geometry=cap)  # -> Volume, Centroid
area_9 = Area(Geometry=frompoints_3)  # -> Area, Centroid
trim_17 = TrimTree(Tree=ptborders, Depth=1)
scale = Scale(Geometry=cap, Center=volume_2.Centroid, Factor=1.05)  # -> Geometry, Transform
lng_21 = ListLength(List=ptborders)
loft = Loft(
    Curves=flatten(dispatch_17.ListA),
    Options={Adjust=False, Closed=False, LoftEnds=0, LoftSimp=0, LoftType=3, Rebuild=10, Refit=0.01})
tstat_11 = TreeStatistics(Tree=trim_17)  # -> Paths, Length, Count
item_57 = ListItem(List=flatten(lng_21), Index=0, Wrap=True)
area_10 = Area(Geometry=flatten(frompoints_4))  # -> Area, Centroid
item_58 = ListItem(List=tstat_11.Paths, Index=0, Wrap=True)
brepinc_2 = PointInBrep(Brep=scale.Geometry, Point=area_9.Centroid, Strict=False)
subtraction_2 = Subtraction(A=item_57, B=panel_53)
branch_16 = TreeBranch(Tree=trim_17, Path=item_58, MaintainPaths=True)
partition_15 = PartitionList(List=branch_16, Size=item_57)
brepinc_3 = PointInBrep(Brep=scale.Geometry, Point=area_10.Centroid, Strict=True)
split_6 = SplitBrep(Brep=boundary_4, Cutter=cap)
item_59 = ListItem(List=partition_15, Index=0, Wrap=True)
item_60 = ListItem(List=partition_15, Index=subtraction_2, Wrap=True)
item_61 = ListItem(List=split_6, Index=0, Wrap=True)
panel_70 = Panel(brepinc_3)
dispatch_18 = Dispatch(List=flatten(frompoints_3), DispatchPattern=flatten(brepinc_2))  # -> flatten(ListA), ListB
explode_14 = Explode(Curve=item_60, Recursive=True)  # -> Segments, Vertices
explode_15 = Explode(Curve=item_59, Recursive=True)  # -> Segments, Vertices
dispatch_19 = Dispatch(List=flatten(frompoints_4), DispatchPattern=brepinc_3)  # -> ListA, ListB
area_11 = Area(Geometry=dispatch_13.ListB)  # -> Area, Centroid
trimcrv_2 = FastTrimCurveWithBreps(Curve=weave_23, Brep=cap, Tolerance=0.01, AngleTolerance=0.01745329252)  # -> CurvesInside, CurveOutside
area_12 = Area(Geometry=dispatch_13.ListA)  # -> Area, Centroid
item_62 = ListItem(List=explode_14.Segments, Index=3, Wrap=True)
item_63 = ListItem(List=explode_15.Segments, Index=3, Wrap=True)
boundary_6 = BoundarySurfaces(Edges=dispatch_18.ListA)
trim_18 = TrimTree(Tree=trimcrv_2.CurvesInside, Depth=1)
boundary_7 = BoundarySurfaces(Edges=dispatch_19.ListA)  # -> flatten(Surfaces)
item_64 = ListItem(List=flatten(item_62), Index=series_8, Wrap=True)
item_65 = ListItem(List=flatten(item_63), Index=series_8, Wrap=True)
trimcrv_3 = FastTrimCurveWithBreps(Curve=flatten(crv_2), Brep=cap, Tolerance=0.01, AngleTolerance=0.01745329252)  # -> CurvesInside, CurveOutside
split_7 = SplitBrep(Brep=graft(boundary_6), Cutter=cap)
brepinc_4 = PointInBrep(Brep=cap, Point=area_11.Centroid, Strict=False)
item_66 = ListItem(List=trim_18, Index=0, Wrap=True)  # -> Item, Item1
brepinc_5 = PointInBrep(Brep=cap, Point=area_12.Centroid, Strict=False)
Z_12 = UnitZ(Factor=expr("X*-1", pdecon_4.ZComponent))
split_8 = SplitBrep(Brep=boundary_7, Cutter=cap)
join_5 = JoinCurves(Curves=item_65, Preserve=False)
join_6 = JoinCurves(Curves=item_64, Preserve=False)
item_67 = ListItem(List=split_7, Index=0, Wrap=True)  # -> flatten(Item)
split_9 = SplitBrep(Brep=boundary_5, Cutter=cap)
dispatch_20 = Dispatch(List=dispatch_13.ListA, DispatchPattern=brepinc_5)  # -> ListA, ListB
item_68 = ListItem(List=split_8, Index=0, Wrap=True)  # -> flatten(Item)
extr_3 = Extrude(Base=item_66.Item, Direction=Z_12)
end_12 = EndPoints(Curve=item_66.Item1)  # -> Start, End
end_13 = EndPoints(Curve=item_66.Item)  # -> Start, End
trim_19 = TrimTree(Tree=ptborders_2, Depth=1)
item_69 = ListItem(List=split_9, Index=0, Wrap=True)
dispatch_21 = Dispatch(List=dispatch_13.ListB, DispatchPattern=brepinc_4)  # -> ListA, ListB
boundary_8 = BoundarySurfaces(Edges=dispatch_20.ListA)
tstat_12 = TreeStatistics(Tree=trim_19)  # -> Paths, Length, Count
area_13 = Area(Geometry=boundary_3)  # -> Area, Centroid
ln_4 = Line(StartPoint=end_13.Start, EndPoint=end_12.Start)
ln_5 = Line(StartPoint=end_13.End, EndPoint=end_12.End)
boundary_9 = BoundarySurfaces(Edges=dispatch_21.ListA)
pdecon_9 = Deconstruct(Point=end_13.Start)  # -> XComponent, YComponent, ZComponent

# ---- group: Facade
panel_71 = Panel(item_10)
item_70 = ListItem(List=reverse(split_2.ListA), Index=0, Wrap=True)
item_71 = ListItem(List=flatten([pdecon_9.ZComponent, "0"]), Index=panel_71, Wrap=True)
pline_12 = PolyLine(Vertices=flatten(item_70), Closed=True)
pdecon_10 = Deconstruct(Point=end_2.End)  # -> XComponent, YComponent, ZComponent
trimcrv_4 = FastTrimCurveWithBreps(Curve=flatten(pline_12), Brep=cap, Tolerance=0.01, AngleTolerance=0.01745329252)  # -> flatten(CurvesInside), CurveOutside
addition_5 = Addition(A=pdecon_10.ZComponent, B="5")
Z_13 = UnitZ(Factor=item_71)
move_15 = Move(Geometry=trimcrv_4.CurvesInside, Motion=Z_13)  # -> Geometry, Transform
subtraction_3 = Subtraction(A=addition_5, B=item_71)
Z_14 = UnitZ(Factor=subtraction_3)
Z_15 = UnitZ(Factor=addition_5)
extr_4 = Extrude(Base=move_15.Geometry, Direction=Z_14)

# ----
item_72 = ListItem(List=tstat_12.Paths, Index=0, Wrap=True)
panel_72 = Panel(boundary_3)
move_16 = Move(Geometry=join_5, Motion=Z_15)  # -> Geometry, Transform
move_17 = Move(Geometry=join_6, Motion=Z_15)  # -> Geometry, Transform
brepinc_6 = PointInBrep(Brep=cap, Point=area_13.Centroid, Strict=False)
loft_2 = Loft(
    Curves=flatten(move_5.Geometry),
    Options={Adjust=False, Closed=False, LoftEnds=0, LoftSimp=0, LoftType=0, Rebuild=10, Refit=0.01})
weave_27 = Weave(Pattern=[0, 1, 2, 3], Stream0=item_66.Item, Stream1=ln_4, Stream2=item_66.Item1, Stream3=ln_5, NullGaps=False)
branch_17 = TreeBranch(Tree=trim_19, Path=item_72, MaintainPaths=True)
item_73 = ListItem(List=move_17.Geometry, Index=0, Wrap=True)
item_74 = ListItem(List=move_16.Geometry, Index=0, Wrap=True)
dispatch_22 = Dispatch(List=boundary_3, DispatchPattern=brepinc_6)  # -> ListA, ListB
boundary_10 = BoundarySurfaces(Edges=weave_27)
area_14 = Area(Geometry=dispatch_22.ListA)  # -> Area, Centroid
boundary_11 = BoundarySurfaces(Edges=[item_73, item_74])
area_15 = Area(Geometry=boundary_11)  # -> Area, Centroid
concat_4 = Concatenate(FragmentA="Roof area: ", FragmentB=area_15.Area)
split_10 = SplitBrep(Brep=loft_2, Cutter=cap)
dispatch_23 = Dispatch(List=boundary_10, DispatchPattern=panel_71)  # -> ListA, ListB
dispatch_24 = Dispatch(List=extr_3, DispatchPattern=panel_71)  # -> ListA, ListB
item_75 = ListItem(List=split_10, Index=0, Wrap=True)
area_16 = Area(Geometry=dispatch_23.ListA)  # -> Area, Centroid
item_76 = ListItem(List=reverse(join_5), Index=0, Wrap=True)
item_77 = ListItem(List=item_64, Index=0, Wrap=True)
move_18 = Move(Geometry=item_65, Motion=Vector(0, 0, 10))  # -> Geometry, Transform
end_14 = EndPoints(Curve=item_65)  # -> Start, End
move_19 = Move(Geometry=item_76, Motion=Vector(0, 0, 10))  # -> Geometry, Transform
end_15 = EndPoints(Curve=item_64)  # -> Start, End
end_16 = EndPoints(Curve=item_76)  # -> Start, End
end_17 = EndPoints(Curve=item_77)  # -> Start, End
end_18 = EndPoints(Curve=move_19.Geometry)  # -> Start, End
end_19 = EndPoints(Curve=move_18.Geometry)  # -> Start, End
pl_3pt_2 = Plane3Pt(PointA=graft(end_14.Start), PointB=graft(end_19.Start), PointC=graft(end_15.Start))  # -> reverse(Plane)
pl_3pt_3 = Plane3Pt(PointA=end_16.End, PointB=end_18.End, PointC=end_17.End)
clean_14 = CleanTree(RemoveNulls=True, RemoveInvalid=True, RemoveEmpty=False, Tree=dispatch_22.ListA)
pln_2 = Plane(flatten([pl_3pt_3, pl_3pt_2]))
prot_2 = RotatePlane(Plane=pln_2, Angle=degrees("90"))
orient_2 = Orient(Geometry=bowl_section.section, Source=xz_3, Target=prot_2)  # -> Geometry, Transform
clean_15 = CleanTree(RemoveNulls=True, RemoveInvalid=True, RemoveEmpty=False, Tree=orient_2.Geometry)
mirror = Mirror(Geometry=clean_15, Plane=xy_2)  # -> Geometry, Transform
explode_16 = Explode(Curve=mirror.Geometry, Recursive=True)  # -> Segments, Vertices
replace_6 = ReplaceItems(List=explode_16.Segments, Indices=[split.ListB, addition_4], Wrap=False)
clean_16 = CleanTree(RemoveNulls=True, RemoveInvalid=True, RemoveEmpty=False, Tree=mirror.Geometry)
explode_17 = Explode(Curve=replace_6, Recursive=True)  # -> Segments, Vertices
mloft = PythonicMeshLoftPlus(P=clean_16, C="0", A="0", E="0")  # -> L; inputs P: list of Polyline, C: Boolean, A: Boolean, E: Int32
# ---------- mloft: Python ----------
"""Create a lofted mesh through a set of section polylines.
    Inputs:
        P: Section polylines
        C: Closed loft
        A: Align section poylines
        E: End caps (0 = none, 1 = flat)
    Output:
        L: Resulting mesh loft"""

__author__ = "p1r4t3b0y"
__email__ = "p1r4t3b0y@gmail.com"
__version__ = "1.1.0"

ghenv.Component.Name = "Pythonic Mesh Loft Plus"
ghenv.Component.NickName = "MLoft+"
ghenv.Component.Category = "Mesh"
ghenv.Component.SubCategory = "Primitive"

import Rhino.Geometry as rg
import scriptcontext as sc
import Grasshopper as gh
import math


class MeshLoft:
    """Creates a lofted mesh through a set of section polylines.
    
    Attributes:
        polylines: A list of valid, closed or open polylines.
        close_loft: Optional, if True the loft will be closed.
        cap_loft: Optional, if True the loft will be capped.
    
    To use:
        >>> ml = MeshLoft(polylines)
        >>> loft = ml.mesh
    """
    def __init__(self, polylines, close_loft=None, cap_loft=None):
        """Inits this mesh loft."""
        self.polylines = polylines
        self.close_loft = close_loft
        self.cap_loft = cap_loft
        self.vertices = self.get_vertices()
        self.faces = self.construct_faces()
        self.mesh = self.construct_mesh()
        
        
    def get_vertices(self):
        """Gets the vertices for each polyline in self.polylines.
        
        Returns:
          The new nested list of vertices per polyline."""
        pline_vertices = []
        for pline in self.polylines:
            vertices = []
            for i in range(len(pline)):
                vertices.append(pline[i])
            pline_vertices.append(vertices)
        return pline_vertices
    
    
    def index_vertices(self):
        """Indexes the vertices of each polyline with integer numbers,
            that are necessary to later assign the vertices to mesh faces.
        
        Returns:
          The nested list of vertex indices (e.g. [[0,1,2], [3,4,5], ..])."""
        vtx_indices = [] 
        for i in range(len(self.vertices)):
            indices = []
            for j in range(len(self.vertices[i])):
                indices.append(i * len(self.vertices[i]) + j)
            vtx_indices.append(indices)
        return vtx_indices
    
    
    def construct_faces(self):
        """Constructs quad faces between all adjacent polyline pairs.       
        
        Returns:
          The nested list of face tuples (e.g. [(0,1,7,6), ...])."""
        vtx_indices = self.index_vertices()
        faces = []
        for i in range(len(vtx_indices)):
            if i < len(vtx_indices) - 1: 
                # Loop the polyline vertex indices up to the last curve
                for j in range(len(vtx_indices[i])-1): # vertices
                    v1 = j + (i * len(vtx_indices[i]))
                    v2 = j + (i * len(vtx_indices[i])) + 1
                    v3 = j + ((i + 1) * len(vtx_indices[i])) + 1
                    v4 = j + ((i + 1) * len(vtx_indices[i]))
                    faces.append((v1, v2, v3, v4))
            else:
                # Loop the polyline vertex indices of the last curve
                if self.close_loft:
                    for j in range(len(vtx_indices[i])-1): # vertices
                        v1 = j + (i * len(vtx_indices[i]))
                        v2 = j + (i * len(vtx_indices[i])) + 1
                        v3 = j + 1
                        v4 = j
                        faces.append((v1, v2, v3, v4))
        return faces
    
    
    def construct_mesh(self, angle_tolerance=-1):
        """Constructs a lofted mesh from self.vertices and self.faces
            and adds caps to it, if necessary.
        
        Args:
          angle_tol: An optional angle tolerance for vertex welding.
        
        Returns:
          The new mesh loft."""
        if angle_tolerance == None or angle_tolerance <= 0:
            angle_tol = sc.doc.ModelAngleToleranceRadians
        
        mesh = rg.Mesh()

        # Add the mesh loft vertices
        for pline_vertices in self.vertices:
            for vertex in pline_vertices:
                mesh.Vertices.Add(vertex)
        # Add the mesh loft faces
        for face in self.faces:
            v0, v1, v2, v3 = face
            mesh.Faces.AddFace(v0, v1, v2, v3)
        # Add the mesh caps
        if self.cap_loft != None and self.cap_loft > 0:
            end_curves = [self.polylines[0], self.polylines[-1]]
            if self.cap_loft == 1: # flat cap
                mesh_caps = [self.construct_flat_cap(c) for c in end_curves]
            cap_fails = 0    
            for cap in mesh_caps:
                if cap != None:
                    mesh.Append(cap)
                    mesh.Weld(angle_tolerance)
                    mesh.Vertices.CombineIdentical(False, False)
                else:
                    cap_fails += 1
            if cap_fails == len(end_curves):
                err = "Both caps failed."
                ghenv.Component.AddRuntimeMessage(\
                    gh.Kernel.GH_RuntimeMessageLevel.Error, err)
            if cap_fails == len(end_curves) - 1:
                err = "One cap failed."
                ghenv.Component.AddRuntimeMessage(\
                    gh.Kernel.GH_RuntimeMessageLevel.Error, err)
        # Compute the normals and compact the mesh
        mesh.Normals.ComputeNormals()
        mesh.Compact()
        return mesh
    
    
    def construct_flat_cap(self, edge, tolerance=None):
        """Constructs a flat mesh cap for a closed, naked mesh edge.
        
        Edge polylines with a count of 4 or 5 vertices produce single,
        triangular or quad faces. A count of more than 5 edge vertices
        results in a triangulated mesh. If these edge vertices share a
        center vertex contained inside the naked edge, the face count
        equals the number of edge segments, and the faces are radially
        oriented around this center vertex. If the center vertex lies 
        outside the closed mesh edge, the triangulated mesh is produced
        from the edge polyline itself.
        
        Args:
            edge: A polyline representing a closed, naked mesh edge.
            tolerance: An optional tolerance for planar projection.
        
        Returns:
            The new mesh cap on success, or None."""
        if tolerance == None or tolerance <= 0:
            tolerance = sc.doc.ModelAbsoluteTolerance
        
        mesh_cap = rg.Mesh()
        # Test for planarity of the mesh edge polyline
        pcurve = rg.PolylineCurve(edge)
        is_planar, plane = pcurve.TryGetPlane()
        if not is_planar:
            # Construct a planar test edge from the non-planar one
            rc, plane = rg.Plane.FitPlaneToPoints(edge)
            proj_pts = [plane.ClosestPoint(pt) for pt in edge]
            pcurve = rg.PolylineCurve(proj_pts)
        # Find the center vertex of the naked mesh edge
        center_vtx = edge.CenterPoint()
        # Test for center vertex mesh edge containment
        rc = pcurve.Contains(center_vtx, plane, tolerance)
        if rc == rg.PointContainment.Outside \
            or rc == rg.PointContainment.Coincident:
            # Mesh cap corresponds to a triangulated polyline
            mesh_cap = rg.Mesh.CreateFromClosedPolyline(edge)
        if rc == rg.PointContainment.Inside:
            if edge.Count - 1 == 3:
                # Mesh cap is composed of a single tri face
                for i in range(edge.Count - 1):
                    mesh_cap.Vertices.Add(edge[i])
                mesh_cap.Faces.AddFace(0, 1, 2) 
            if edge.Count - 1 == 4:
                # Mesh cap is composed of a single quad face
                for i in range(edge.Count - 1):
                    mesh_cap.Vertices.Add(edge[i])
                mesh_cap.Faces.AddFace(0, 1, 2, 3)
            if edge.Count > 5:
                # Mesh cap is radially triangulated around the center vertex
                for i in range(edge.Count):
                    mesh_cap.Vertices.Add(edge[i])
                mesh_cap.Vertices.Add(center_vtx)
                for i in range(edge.Count - 1):
                    v0 = i
                    v1 = i + 1
                    v2 = edge.Count
                    v3 = i
                    mesh_cap.Faces.AddFace(v0, v1, v2, v3)
        if rc == rg.PointContainment.Unset:
            err = "Open polylines can't produce capped mesh lofts."
            ghenv.Component.AddRuntimeMessage(\
                gh.Kernel.GH_RuntimeMessageLevel.Warning, err)
            return
        # Compute the normals and compact the mesh
        mesh_cap.Normals.ComputeNormals()
        mesh_cap.Compact()
        return mesh_cap


###############################################################################  


def align_polylines(polylines, guide_idx=None):
    """Aligns closed polylines so that their start/end vertices fall inline.
        If the optional guide index is not defined, the polylines align to 
        the start/end vertex of the first polyline. 
    
    Args:
      polylines: A list of closed polylines.
      guide_idx: An optional guide index for the polylines to align to.
    
    Returns:
      The list of aligned polylines on success, or the unaltered polylines."""
    if any([True for p in polylines if not p.IsClosed]):
        err = "Open polylines can't be aligned."
        ghenv.Component.AddRuntimeMessage(\
            gh.Kernel.GH_RuntimeMessageLevel.Warning, err)
        return polylines
    
    if guide_idx == None or guide_idx < 0:
        guide_idx = 0
    elif guide_idx > len(polylines[0]):
        guide_idx = 0
    
    aligned_polylines = [polylines[guide_idx]]
    for i in range(1, len(polylines)):
        # Get the guide vertex of the previous polyline
        guide_vtx = polylines[i-1][guide_idx]
        # Get the closest index of a vertex of the current polyline
        closest_idx = polylines[i].ClosestIndex(guide_vtx) # -1 on error
        if closest_idx < 0:
            return
        # Get a list of indices of the current polyline
        indices = range(len(polylines[i])-1)
        # Restructure the polyline indices to align them
        align_indices = indices[closest_idx:] + indices[:closest_idx]
        align_vertices = [polylines[i][j] for j in align_indices]
        align_vertices.append(align_vertices[0])
        aligned_polylines.append(rg.Polyline(align_vertices))
        # Update the guide index
        guide_idx = closest_idx
    return aligned_polylines


###############################################################################   


if __name__ == "__main__":
    if len(P) == 0:
        err = "Input parameter P failed to collect data"
        ghenv.Component.AddRuntimeMessage(\
            gh.Kernel.GH_RuntimeMessageLevel.Warning, err)
    
    if C == None: # closed loft
        C = False
    
    if E == None or E < 0 or E > 1: # capped loft
        E = 0
    
    if E and C:
        err = "Input parameter C (%s) and E (%s) don't work together." \
            %("Closed Loft", "End Caps")
        ghenv.Component.AddRuntimeMessage(\
            gh.Kernel.GH_RuntimeMessageLevel.Warning, err)
        C = False
        E = 0
    
    if A: # align sections
        if C and any([True for pline in P if pline.IsClosed]):
            err = "Aligning sections may produce weird results" + \
                " for closed, radial mesh lofts."
            ghenv.Component.AddRuntimeMessage(\
                gh.Kernel.GH_RuntimeMessageLevel.Remark, err)
        P = align_polylines(P)
    
    if len(P) > 1 and all([pline.IsValid for pline in P]):
        # Initialise this mesh loft
        ml = MeshLoft(P, C, E)
        # Outputs
        L = ml.mesh
    else:
        err = "Input parameter P data includes one or more invalid polylines"
        ghenv.Component.AddRuntimeMessage(\
            gh.Kernel.GH_RuntimeMessageLevel.Warning, err)
# ---------- end mloft ----------
trim_20 = TrimTree(Tree=explode_17.Segments, Depth=1)
end_20 = EndPoints(Curve=clean_16)  # -> Start, End
cull_2 = CullPattern(List=trim_20, CullPattern=[False, True])
pline_13 = PolyLine(Vertices=end_20.End, Closed=True)
curvepoint_9 = PointOnCurve(cull_2, parameter=0.5)
flip = FlipMatrix(Data=curvepoint_9)
split_11 = SplitList(List=flip, Index=1)  # -> ListA, ListB
pline_14 = PolyLine(Vertices=split_11.ListB, Closed=False)

# ---- group: gangways
cull_3 = CullPattern(List=flatten(clean_16), CullPattern=[False, True])
end_21 = EndPoints(Curve=cull_3)  # -> Start, End
pdecon_11 = Deconstruct(Point=end_21.Start)  # -> XComponent, YComponent, ZComponent
pdecon_12 = Deconstruct(Point=end_21.End)  # -> XComponent, YComponent, ZComponent
pt_6 = ConstructPoint(XCoordinate=pdecon_11.XComponent, YCoordinate=pdecon_11.YComponent, ZCoordinate=0)
pt_7 = ConstructPoint(XCoordinate=pdecon_12.XComponent, YCoordinate=pdecon_12.YComponent, ZCoordinate=0)
vec2pt_5 = Vector2Pt(PointA=pt_6, PointB=pt_7, Unitize=False)  # -> Vector, Length
amp_6 = Amplitude(Vector=vec2pt_5.Vector, Amplitude=5)
move_20 = Move(Geometry=pt_6, Motion=expr("x*-1", amp_6))  # -> Geometry, Transform
move_21 = Move(Geometry=pt_7, Motion=amp_6)  # -> Geometry, Transform
ln_6 = Line(StartPoint=move_20.Geometry, EndPoint=move_21.Geometry)
offset_3 = OffsetCurve(Curve=ln_6, Distance="1.4", Corners=1)
weave_28 = Weave(Pattern=[0, 1], Stream0=ln_6, Stream1=flatten(offset_3), NullGaps=False)
Z_16 = UnitZ(Factor="100")
extr_5 = Extrude(Base=weave_28, Direction=Z_16)
scx = SurfaceCurve(Surface=graft(extr_5), Curve=flatten(pline_14))  # -> Curves, Points, UVPoints, Normals, Parameters, Tangents

# ----
eval_3 = EvaluateLength(Curve=pline_14, Length="1.2", Normalized=False)  # -> Point, Tangent, Parameter
shatter_2 = Shatter(Curve=pline_14, Parameters=eval_3.Parameter)
item_78 = ListItem(List=shatter_2, Index=1, Wrap=True)
trim_21 = TrimTree(Tree=item_78, Depth=4)
len_7 = Length(Curve=trim_21)
division_7 = Division(A=len_7, B=".5")

# ---- group: gangways
trim_22 = TrimTree(Tree=scx.Parameters, Depth=1)
flip_2 = FlipMatrix(Data=trim_22)
shatter_3 = Shatter(Curve=pline_14, Parameters=flip_2)
cull_4 = CullPattern(List=shatter_3, CullPattern=[True, False])

# ----
divide_5 = DivideCurve(Curve=flatten(trim_21), Count=flatten(division_7), Kinks=False)  # -> Points, Tangents, Parameters
len_8 = Length(Curve=pline_14)
division_8 = Division(A=len_8, B=".5")
divide_6 = DivideCurve(Curve=pline_14, Count=division_8, Kinks=False)  # -> simplify(Points), Tangents, Parameters

# ---- group: cvalue
pdecon_13 = Deconstruct(Point=divide_6.Points)  # -> XComponent, YComponent, ZComponent
pull_2 = PullPoint(Point=divide_6.Points, Geometry=item_12.Item, ClosestOnly=True)  # -> ClosestPoint, Distance
pt_8 = ConstructPoint(XCoordinate=pdecon_13.XComponent, YCoordinate=pdecon_13.YComponent, ZCoordinate=0)
vec2pt_6 = Vector2Pt(PointA=pull_2.ClosestPoint, PointB=pt_8, Unitize=False)  # -> Vector, Length
vec2pt_7 = Vector2Pt(PointA=pull_2.ClosestPoint, PointB=divide_6.Points, Unitize=False)  # -> Vector, Length
item_79 = ListItem(List=pdecon_13.ZComponent, Index=0, Wrap=True)
dist_2 = Distance(PointA=pt_8, PointB=pull_2.ClosestPoint)
angle = Angle(VectorA=vec2pt_6.Vector, VectorB=vec2pt_7.Vector)  # -> Angle, Reflex
subtraction_4 = Subtraction(A=dist_2, B=0.8)
tan = Tangent(Value=angle.Angle)
ins_2 = InsertItems(List=flatten(item_79), Item="0", Indices=0, Wrap=True)
multiplication_3 = Multiplication(A=subtraction_4, B=tan)
split_12 = SplitList(List=reverse(ins_2), Index=1)  # -> ListA, reverse(ListB)
lng_22 = ListLength(List=multiplication_3)
repeat_32 = RepeatData(Data=graft(split_12.ListB), Length=lng_22)
subtraction_5 = Subtraction(A=multiplication_3, B=repeat_32)

# ---- group: Events
cv = BB_CValues(eyes=divide_5.Points, touchline=item_12.Item1)  # -> flatten(cValues); inputs eyes: tree of Point3d, touchline: Curve; disabled; plug-in component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
cv_2 = BB_CValues(eyes=divide_5.Points, touchline=item_12.Item2)  # -> flatten(cValues); inputs eyes: tree of Point3d, touchline: Curve; disabled; plug-in component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
cv_3 = BB_CValues(eyes=divide_5.Points, touchline=item_12.Item3)  # -> flatten(cValues); inputs eyes: tree of Point3d, touchline: Curve; disabled; plug-in component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
ma_3 = MassAddition(Input=flatten(subtraction_5))  # -> Result, PartialResults
ma_4 = MassAddition(Input=cv)  # -> Result, PartialResults
lng_23 = ListLength(List=flatten(subtraction_5))
lng_24 = ListLength(List=cv)
ma_5 = MassAddition(Input=cv_2)  # -> Result, PartialResults
lng_25 = ListLength(List=cv_2)
ma_6 = MassAddition(Input=cv_3)  # -> Result, PartialResults
lng_26 = ListLength(List=cv_3)
division_9 = Division(A=ma_4.Result, B=lng_24)
division_10 = Division(A=ma_3.Result, B=lng_23)
division_11 = Division(A=ma_5.Result, B=lng_25)
division_12 = Division(A=ma_6.Result, B=lng_26)
panel_73 = Panel(division_9)
panel_74 = Panel(division_11)
panel_75 = Panel(division_12)
panel_76 = Panel(division_10)
ma_7 = MassAddition(Input=[panel_76, panel_73, panel_74, panel_75])  # -> Result, PartialResults
division_13 = Division(A=ma_7.Result, B=Slider(4, range=0..10))

# ----
panel_77 = Panel(subtraction_5)
cv_4 = BB_CValues(eyes=divide_6.Points, touchline=item_12.Item)  # -> cValues; inputs eyes: tree of Point3d, touchline: Curve; disabled; plug-in component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
division_14 = Division(A=division_13, B="1.4")
sort_7 = SortList(Keys=flatten(subtraction_5))  # -> Keys, ValuesA
panel_78 = Panel(division_13)
lng_27 = ListLength(List=sort_7.Keys)
round_3 = Round(Number=lng_27)  # -> Nearest, Floor, Ceiling
concat_5 = Concatenate(FragmentA="Capacity: ", FragmentB=round_3.Nearest)
multiplication_4 = Multiplication(A=lng_27, B=".5")
item_80 = ListItem(List=sort_7.Keys, Index=multiplication_4, Wrap=True)
multiplication_5 = Multiplication(A=item_80, B=".1")
multiplication_6 = Multiplication(A=item_80, B="1.9")
panel_79 = Panel(cv_4)
dom_11 = ConstructDomain(DomainStart=multiplication_5, DomainEnd=multiplication_6)
inc = Includes(Value=subtraction_5, Domain=dom_11)  # -> Includes, Deviation
dispatch_25 = Dispatch(List=divide_5.Points, DispatchPattern=inc.Includes)  # -> ListA, ListB
dispatch_26 = Dispatch(List=subtraction_5, DispatchPattern=inc.Includes)  # -> ListA, ListB
item_81 = ListItem(List=subtraction_5, Index=0, Wrap=True)
panel_80 = Panel(item_81)
bnd = Bounds(Numbers=flatten(dispatch_26.ListA))
lng_28 = ListLength(List=sort_7.Keys)
remap = RemapNumbers(Value=dispatch_26.ListA, Source=bnd, Target=Domain(0, 1))  # -> Mapped, Clipped
multiplication_7 = Multiplication(A=lng_28, B=".5")
split_13 = SplitList(List=reverse(remap.Mapped), Index=3)  # -> ListA, ListB
item_82 = ListItem(List=sort_7.Keys, Index=multiplication_7, Wrap=True)
gradient = Gradient(
    LowerLimit=0,
    UpperLimit=1,
    Parameter=split_13.ListB,
    stops=[0: RGB(243, 57, 0), 0.1: RGB(236, 27, 60), 0.2: RGB(210, 0, 118), 0.3: RGB(103, 0, 120), 0.4: RGB(39, 72, 161), 0.5: RGB(1, 192, 229), 0.6: RGB(18, 178, 90), 0.7: RGB(79, 186, 8), 0.8: RGB(220, 237, 32), 1: RGB(247, 159, 20), 1: RGB(124, 252, 0)])
createatts_21 = CreateAttributes(LayerName=panel_36, Color=flatten(gradient), enableFullPath=False)  # disabled
multiplication_8 = Multiplication(A=item_82, B=".5")
multiplication_9 = Multiplication(A=item_82, B="1.5")
dom_12 = ConstructDomain(DomainStart=multiplication_8, DomainEnd=multiplication_9)
inc_2 = Includes(Value=subtraction_5, Domain=dom_12)  # -> Includes, Deviation
dispatch_27 = Dispatch(List=subtraction_5, DispatchPattern=inc_2.Includes)  # -> ListA, ListB
ma_8 = MassAddition(Input=flatten(dispatch_27.ListA))  # -> Result, PartialResults
lng_29 = ListLength(List=flatten(dispatch_27.ListA))
division_15 = Division(A=ma_8.Result, B=lng_29)
panel_81 = Panel(division_15)
area_17 = Area(Geometry=pline_13)  # -> Area, Centroid
remap_2 = RemapNumbers(Value=division_15, Source=dom_10, Target=dom_9)  # -> Mapped, Clipped

# ---- group: circulation ga
item_83 = ListItem(List=entwine_6, Index=0, Wrap=True)  # -> Item, Item1, Item2, Item3
panel_82 = Panel("""0
1""")
trim_23 = TrimTree(Tree=item_83.Item, Depth=1)
area_18 = Area(Geometry=item_83.Item1)  # -> Area, Centroid
dispatch_28 = Dispatch(List=trim_23, DispatchPattern=panel_82)  # -> ListA, ListB
trim_24 = TrimTree(Tree=area_18.Centroid, Depth=1)
cp_6 = ControlPoints(Curve=dispatch_28.ListB)  # -> Points, Weights, Knots
item_84 = ListItem(List=cp_6.Points, Index=0, Wrap=True)  # -> Item, Item1, Item2, Item3
trim_25 = TrimTree(Tree=item_84.Item, Depth=1)
pline_15 = PolyLine(Vertices=trim_24, Closed=True)  # -> flatten(Polyline)
pull_3 = PullPoint(Point=trim_25, Geometry=graft(pline_15), ClosestOnly=True)  # -> ClosestPoint, Distance
ln_7 = Line(StartPoint=pull_3.ClosestPoint, EndPoint=trim_25)

# ----
project_5 = ProjectPoint(Point=curvepoint_5, Direction=vec2pt_4.Vector, Geometry=pline_15)  # -> Point, Index

# ---- group: circulation ga (continued)
ln_8 = Line(StartPoint=curvepoint_7, EndPoint=project_5.Point)
previewlw_3 = CustomPreviewLineweights(Geometry=[ln_8, pline_15, ln_7], Shader=ColourSwatch(SwatchColor=RGB(64, 255, 0)), Absolute=False)

# ----
trimcrv_5 = FastTrimCurveWithBreps(Curve=flatten([ln_8, ln_7, pline_15]), Brep=cap, Tolerance=0.01, AngleTolerance=0.01745329252)  # -> flatten(CurvesInside), CurveOutside

# ---- group: grid print
lng_30 = ListLength(List=data_3)  # -> flatten(Length)
lng_31 = ListLength(List=lng_30)
series_11 = Series(Start=0, Step="-150", Count=lng_30)
series_12 = Series(Start="500", Step="200", Count=lng_31)
pt_9 = ConstructPoint(XCoordinate=graft(series_12), YCoordinate=series_11, ZCoordinate=0)
item_85 = ListItem(List=flatten(pt_9), Index="0", Wrap=True)
vec2pt_8 = Vector2Pt(PointA=area.Centroid, PointB=item_85, Unitize=False)  # -> Vector, Length
vec = Vector(vec2pt_8.Vector)

# ---- group: top concourse if necessary
panel_83 = Panel(""".4
.7""")  # disabled
item_86 = ListItem(List=flatten(dispatch_17.ListB), Index=0, Wrap=True)  # -> Item, Item1; disabled
tweencrv = TweenCurve(CurveA=item_86.Item1, CurveB=item_86.Item, Factor=panel_83, BlendType=0)  # disabled
weave_29 = Weave(Pattern=[0, 1, 1, 2], Stream0=item_86.Item1, Stream1=tweencrv, Stream2=item_86.Item, NullGaps=False)  # disabled
move_22 = Move(Geometry=weave_29, Motion=vec)  # -> Geometry, Transform; disabled
divide_7 = DivideCurve(Curve=move_22.Geometry, Count=panel_56, Kinks=False)  # -> Points, Tangents, Parameters; disabled
ptborders_3 = GenerateBorders(Grid=divide_7.Points, PanelShape=0)  # disabled
flip_3 = FlipMatrix(Data=ptborders_3)  # disabled
item_87 = ListItem(List=flip_3, Index=0, Wrap=True)  # -> Item, Item1, Item2; disabled
explode_18 = Explode(Curve=item_87.Item1, Recursive=True)  # -> Segments, Vertices; disabled
explode_19 = Explode(Curve=item_87.Item, Recursive=True)  # -> Segments, Vertices; disabled
item_88 = ListItem(List=explode_18.Segments, Index=0, Wrap=True)  # -> Item, Item1, Item2, Item3; disabled
item_89 = ListItem(List=explode_19.Segments, Index=0, Wrap=True)  # -> Item, Item1, Item2, Item3; disabled
end_22 = EndPoints(Curve=item_88.Item)  # -> Start, End; disabled
end_23 = EndPoints(Curve=item_89.Item)  # -> Start, End; disabled
end_24 = EndPoints(Curve=item_88.Item1)  # -> Start, End; disabled
end_25 = EndPoints(Curve=item_89.Item1)  # -> Start, End; disabled
panel_84 = Panel("1.2")  # disabled
vec2pt_9 = Vector2Pt(PointA=end_22.End, PointB=end_22.Start, Unitize=False)  # -> Vector, Length; disabled
vec2pt_10 = Vector2Pt(PointA=end_23.End, PointB=end_23.Start, Unitize=False)  # -> Vector, Length; disabled
panel_85 = Panel("2.2")  # disabled
amp_7 = Amplitude(Vector=vec2pt_9.Vector, Amplitude=panel_85)  # disabled
amp_8 = Amplitude(Vector=vec2pt_10.Vector, Amplitude=panel_84)  # disabled
end_26 = EndPoints(Curve=item_88.Item3)  # -> Start, End; disabled
move_23 = Move(Geometry=end_24.End, Motion=amp_7)  # -> Geometry, Transform; disabled
move_24 = Move(Geometry=end_24.Start, Motion=amp_7)  # -> Geometry, Transform; disabled
end_27 = EndPoints(Curve=item_89.Item3)  # -> Start, End; disabled
move_25 = Move(Geometry=end_25.End, Motion=amp_8)  # -> Geometry, Transform; disabled
move_26 = Move(Geometry=end_25.Start, Motion=amp_8)  # -> Geometry, Transform; disabled
weave_30 = Weave(
    Pattern=[0, 1, 2, 3],
    Stream0=move_24.Geometry,
    Stream1=end_26.End,
    Stream2=end_26.Start,
    Stream3=move_23.Geometry,
    NullGaps=False)  # disabled
weave_31 = Weave(
    Pattern=[0, 1, 2, 3],
    Stream0=move_26.Geometry,
    Stream1=end_27.End,
    Stream2=end_27.Start,
    Stream3=move_25.Geometry,
    NullGaps=False)  # disabled
pt_10 = Point([end_25.Start, move_26.Geometry, move_25.Geometry, move_24.Geometry, move_23.Geometry, end_24.End])  # disabled
flip_4 = FlipMatrix(Data=divide_7.Points)  # disabled
pline_16 = PolyLine(Vertices=weave_30, Closed=True)  # disabled
pline_17 = PolyLine(Vertices=weave_31, Closed=True)  # disabled
pline_18 = PolyLine(Vertices=pt_10, Closed=True)  # disabled
runion_4 = RegionUnion(Curves=flatten([item_87.Item2, pline_18]))  # disabled
pline_19 = PolyLine(Vertices=flip_4, Closed=False)  # disabled
boundary_12 = BoundarySurfaces(Edges=pline_16)  # disabled
boundary_13 = BoundarySurfaces(Edges=pline_17)  # disabled
boundary_14 = BoundarySurfaces(Edges=runion_4)  # disabled

# ----
move_27 = Move(Geometry=flatten(trimcrv_3.CurvesInside), Motion=vec)  # -> Geometry, Transform
move_28 = Move(Geometry=item_68, Motion=vec)  # -> Geometry, Transform
move_29 = Move(Geometry=item_67, Motion=vec)  # -> Geometry, Transform
flatten_2 = FlattenTree(Tree=[boundary_12, move_28.Geometry], Path="{0}")
move_30 = Move(Geometry=item_61, Motion=vec)  # -> Geometry, Transform
area_19 = Area(Geometry=flatten([item_69, boundary_14]))  # -> Area, Centroid
srf = Surface(flatten([move_29.Geometry, boundary_13]))
area_20 = Area(Geometry=move_30.Geometry)  # -> Area, Centroid
clean_17 = CleanTree(RemoveNulls=True, RemoveInvalid=True, RemoveEmpty=False, Tree=flatten_2)  # -> flatten(Tree)
move_31 = Move(Geometry=boundary_9, Motion=vec)  # -> Geometry, Transform
move_32 = Move(Geometry=boundary_8, Motion=vec)  # -> Geometry, Transform
area_21 = Area(Geometry=move_31.Geometry)  # -> Area, Centroid
preview_2 = CustomPreview(Geometry=flatten(flatten_2), Material=ColourSwatch(SwatchColor=RGB(255, 0, 0)))
area_22 = Area(Geometry=move_32.Geometry)  # -> Area, Centroid
move_33 = Move(Geometry=dispatch_16.ListA, Motion=vec)  # -> Geometry, Transform
area_23 = Area(Geometry=flatten(clean_17))  # -> Area, Centroid
preview_3 = CustomPreview(Geometry=srf, Material=ColourSwatch(SwatchColor=RGB(0, 255, 191)))
move_34 = Move(Geometry=extr_4, Motion=vec)  # -> Geometry, Transform
area_24 = Area(Geometry=move_34.Geometry)  # -> Area, Centroid
concat_6 = Concatenate(FragmentA="Facade area: ", FragmentB=area_24.Area)
move_35 = Move(Geometry=extr_4, Motion=vec)  # -> Geometry, Transform
area_25 = Area(Geometry=flatten([item_67, boundary_13]))  # -> Area, Centroid
preview_4 = CustomPreview(Geometry=move_31.Geometry, Material=ColourSwatch(SwatchColor=RGB(255, 0, 170)))
debrep_2 = DeconstructBrep(Brep=move_33.Geometry)  # -> Faces, Edges, Vertices
preview_5 = CustomPreview(Geometry=move_32.Geometry, Material=ColourSwatch(SwatchColor=RGB(0, 255, 191)))
move_36 = Move(Geometry=trimcrv_5.CurvesInside, Motion=vec)  # -> Geometry, Transform
move_37 = Move(Geometry=item_69, Motion=vec)  # -> Geometry, Transform
preview_6 = CustomPreview(Geometry=move_30.Geometry, Material=ColourSwatch(SwatchColor=RGB(57, 145, 227)))
area_26 = Area(Geometry=move_35.Geometry)  # -> Area, Centroid
move_38 = Move(Geometry=dispatch_22.ListA, Motion=vec)  # -> Geometry, Transform
debrep_3 = DeconstructBrep(Brep=move_38.Geometry)  # -> Faces, Edges, Vertices
panel_86 = Panel(clean_17)

# ---- group: commercial frontage
debrep_4 = DeconstructBrep(Brep=flatten(clean_17))  # -> Faces, Edges, Vertices
panel_87 = Panel("""0
1""")
item_90 = ListItem(List=debrep_4.Edges, Index=panel_87, Wrap=True)
len_9 = Length(Curve=flatten(item_90))
ma_9 = MassAddition(Input=len_9)  # -> Result, PartialResults
lng_32 = ListLength(List=flatten(subtraction_5))
division_16 = Division(A=ma_9.Result, B=lng_32)
entwine_7 = Entwine(Branch00=division_16, Branch01="0", FlattenInputs=True)
item_91 = ListItem(List=flatten(entwine_7), Index=0, Wrap=True)
multiplication_10 = Multiplication(A=item_91, B="10")

# ---- group: envelope
area_27 = Area(Geometry=extr_4)  # -> Area, Centroid
area_28 = Area(Geometry=boundary_11)  # -> Area, Centroid
ma_10 = MassAddition(Input=flatten([area_28.Area, area_27.Area]))  # -> Result, PartialResults
division_17 = Division(A=ma_10.Result, B=lng_32)

# ----
move_39 = Move(Geometry=boundary_11, Motion=vec)  # -> Geometry, Transform
move_40 = Move(Geometry=branch_17, Motion=vec)  # -> Geometry, Transform
item_92 = ListItem(List=debrep_2.Faces, Index=panel_27, Wrap=True)
preview_7 = CustomPreview(Geometry=move_27.Geometry, Material=ColourSwatch(SwatchColor=RGB(255, 0, 115)))
debrep_5 = DeconstructBrep(Brep=[move_30.Geometry, move_37.Geometry])  # -> Faces, Edges, Vertices
preview_8 = CustomPreview(Geometry=[move_36.Geometry, pline_19], Material=ColourSwatch(SwatchColor=RGB(209, 191, 178)))
move_41 = Move(Geometry=[dispatch_23.ListA, dispatch_24.ListA], Motion=vec)  # -> Geometry, Transform
area_29 = Area(Geometry=item_92)  # -> Area, Centroid
preview_9 = CustomPreview(Geometry=move_34.Geometry, Material=material)
move_42 = Move(Geometry=item_75, Motion=vec)  # -> Geometry, Transform
pline_20 = PolyLine(Vertices=area_29.Centroid, Closed=False)
previewlw_4 = CustomPreviewLineweights(Geometry=flatten(debrep_3.Edges), Shader=ColourSwatch(SwatchColor=RGB(219, 186, 255)), Thickness=2, Absolute=False)
preview_10 = CustomPreview(Geometry=[move_38.Geometry, move_42.Geometry], Material=ColourSwatch(SwatchColor=RGB(123, 0, 255)))
previewlw_5 = CustomPreviewLineweights(Geometry=flatten(debrep_5.Edges), Shader=ColourSwatch(SwatchColor=RGB(255, 255, 255)), Thickness=2, Absolute=False)
preview_11 = CustomPreview(Geometry=[move_37.Geometry, boundary_14], Material=ColourSwatch(SwatchColor=RGB(57, 145, 227)))
panel_88 = Panel(division_17)
preview_12 = CustomPreview(Geometry=move_39.Geometry, Material=material_2)
preview_13 = CustomPreview(Geometry=pline_20, Material=ColourSwatch(SwatchColor=RGB(166, 178, 189)))
preview_14 = CustomPreview(Geometry=move_41.Geometry, Material=ColourSwatch(SwatchColor=RGB(255, 174, 0)))
remap_3 = RemapNumbers(Value=division_17, Source=dom, Target=dom_2)  # -> Mapped, Clipped
bbox = BoundingBox(Content=flatten([move_39.Geometry, move_34.Geometry]), Plane=PlaneXY(0, 0, 0), UnionBox=True)  # -> Box, Box_2
flatten_3 = FlattenTree(Tree=clean_17, Path="{0}")
clean_18 = CleanTree(RemoveNulls=True, RemoveInvalid=True, RemoveEmpty=False, Tree=clean_17)
clean_19 = CleanTree(RemoveNulls=True, RemoveInvalid=True, RemoveEmpty=False, Tree=move_31.Geometry)
clean_20 = CleanTree(RemoveNulls=True, RemoveInvalid=True, RemoveEmpty=False, Tree=srf)
remap_4 = RemapNumbers(Value=multiplication_10, Source=dom_4, Target=dom_3)  # -> Mapped, Clipped
clean_21 = CleanTree(RemoveNulls=True, RemoveInvalid=True, RemoveEmpty=False, Tree=flatten_3)
flatten_4 = FlattenTree(Tree=[srf, move_32.Geometry], Path="{0}")
debrep_6 = DeconstructBrep(Brep=bbox.Box)  # -> Faces, Edges, Vertices
clean_22 = CleanTree(RemoveNulls=True, RemoveInvalid=True, RemoveEmpty=False, Tree=flatten(move_38.Geometry))
clean_23 = CleanTree(RemoveNulls=True, RemoveInvalid=True, RemoveEmpty=False, Tree=flatten_4)
item_93 = ListItem(List=debrep_6.Vertices, Index=1, Wrap=True)
debrep_7 = DeconstructBrep(Brep=move_39.Geometry)  # -> Faces, Edges, Vertices
runion_5 = RegionUnion(Curves=clean_22)  # disabled
join_7 = JoinCurves(Curves=debrep_7.Edges, Preserve=False)  # disabled
boundary_15 = BoundarySurfaces(Edges=runion_5)  # disabled
move_43 = Move(Geometry=item_93, Motion=addition_2)  # -> Geometry, Transform
ma_11 = MassAddition(Input=flatten([area_20.Area, area_23.Area, area_25.Area, area_21.Area, area_22.Area, area_19.Area, area_17.Area]))  # -> Result, PartialResults

# ---- group: circulation
len_10 = Length(Curve=flatten([move_27.Geometry, move_36.Geometry, pline_19]))
ma_12 = MassAddition(Input=len_10)  # -> Result, PartialResults
division_18 = Division(A=ma_12.Result, B=lng_32)

# ----
concat_7 = Concatenate(FragmentA="Circulation length: ", FragmentB=ma_12.Result)
txt = Text(flatten([concat_5, concat_2, concat_3, concat, concat_7, concat_4, concat_6]))
panel_89 = Panel(txt)
join_8 = TextJoin(Text=txt)
remap_5 = RemapNumbers(Value=division_18, Source=dom_6, Target=dom_5)  # -> Mapped, Clipped

# ---- group: slab for additional functions
subtraction_6 = Subtraction(A=ma_11.Result, B=lng_27)
dom_13 = ConstructDomain(DomainStart="0", DomainEnd="1")
dom_14 = ConstructDomain(DomainStart="0", DomainEnd="2500")
remap_6 = RemapNumbers(Value=subtraction_6, Source=dom_14, Target=dom_13)  # -> Mapped, Clipped

# ----
move_44 = Move(Geometry=dispatch_25.ListA, Motion=vec)  # -> Geometry, Transform
split_14 = SplitList(List=reverse(move_44.Geometry), Index=3)  # -> ListA, ListB
move_45 = Move(Geometry=split_14.ListA, Motion=Z_4)  # -> Geometry, Transform
move_46 = Move(Geometry=mloft, Motion=vec)  # -> Geometry, Transform
move_47 = Move(Geometry=split_14.ListB, Motion=Z_5)  # -> Geometry, Transform
ln_9 = Line(StartPoint=move_45.Geometry, EndPoint=split_14.ListA)
ln_10 = Line(StartPoint=move_47.Geometry, EndPoint=split_14.ListB)
preview_15 = CustomPreview(Geometry=move_46.Geometry, Material=material_3)
preview_16 = CustomPreview(Geometry=ln_9, Material=swatch)
previewlw_6 = CustomPreviewLineweights(Geometry=ln_9, Shader=swatch, Thickness=panel_48, Absolute=False)  # disabled
preview_17 = CustomPreview(Geometry=ln_10, Material=gradient)
brep_cp = BrepClosestPoint(Point=area_26.Centroid, Brep=move_35.Geometry)  # -> Point, Normal, Distance
amp_9 = Amplitude(Vector=brep_cp.Normal, Amplitude="600")
rotate = Rotate(Geometry=amp_9, Angle=degrees("90"), Plane=PlaneXY(0, 0, 0))  # -> Geometry, Transform
amp_10 = Amplitude(Vector=rotate.Geometry, Amplitude="-600")
amp_11 = Amplitude(Vector=rotate.Geometry, Amplitude="120")
addition_6 = Addition(A=amp_9, B=amp_10)
addition_7 = Addition(A=amp_11, B=Z_6)
addition_8 = Addition(A=addition_6, B=Z_7)
move_48 = Move(Geometry=area_26.Centroid, Motion=addition_8)  # -> Geometry, Transform
move_49 = Move(Geometry=brep_cp.Point, Motion=addition_7)  # -> Geometry, Transform
mod_viewport = ModifyViewport(
    ViewportName="view 02",
    NamedViewToRestore="view 02",
    CameraLocation=move_48.Geometry,
    CameraTarget=move_49.Geometry,
    CameraLensLength="76",
    AnimateRestore=False,
    RestoreFrames=10)

# ---- group: service slab
move_50 = Move(Geometry=loft, Motion=vec)  # -> Geometry, Transform
swatch_2 = ColourSwatch(SwatchColor=RGB(173, 173, 173))

# ----
material_4 = CreateMaterial(Diffuse=swatch_2, Specular=RGB(255, 255, 255), Emission=RGB(0, 0, 0), Transparency=0.9, Shine=0)

# ---- group: service slab (continued)
preview_18 = CustomPreview(Geometry=move_50.Geometry, Material=material_4)

# ----
area_30 = Area(Geometry=move_50.Geometry)  # -> Area, Centroid
clean_24 = CleanTree(RemoveNulls=True, RemoveInvalid=True, RemoveEmpty=False, Tree=move_50.Geometry)

# ---- group: programme
item_94 = ListItem(List=flatten(clean_24), Index=0, Wrap=True)
item_95 = ListItem(List=flatten(clean_18), Index=0, Wrap=True)
item_96 = ListItem(List=flatten(clean_14), Index=0, Wrap=True)
item_97 = ListItem(List=flatten(clean_20), Index=0, Wrap=True)
item_98 = ListItem(List=flatten(clean_19), Index=0, Wrap=True)
area_31 = Area(Geometry=item_94)  # -> Area, Centroid
area_32 = Area(Geometry=item_95)  # -> Area, Centroid
area_33 = Area(Geometry=item_97)  # -> Area, Centroid
area_34 = Area(Geometry=item_98)  # -> Area, Centroid
area_35 = Area(Geometry=item_96)  # -> Area, Centroid
larger_7 = LargerThan(FirstNumber=flatten(area_32.Area), SecondNumber="0")  # -> LargerThan, OrEqualTo
larger_8 = LargerThan(FirstNumber=area_31.Area, SecondNumber="0")  # -> LargerThan, OrEqualTo
larger_9 = LargerThan(FirstNumber=area_33.Area, SecondNumber="0")  # -> LargerThan, OrEqualTo
larger_10 = LargerThan(FirstNumber=area_34.Area, SecondNumber="0")  # -> LargerThan, OrEqualTo
larger_11 = LargerThan(FirstNumber=area_35.Area, SecondNumber="0")  # -> LargerThan, OrEqualTo
dispatch_29 = Dispatch(List="1", DispatchPattern=larger_8.LargerThan)  # -> ListA, ListB
dispatch_30 = Dispatch(List="1", DispatchPattern=larger_7.LargerThan)  # -> ListA, ListB
dispatch_31 = Dispatch(List="1", DispatchPattern=larger_9.LargerThan)  # -> ListA, ListB
dispatch_32 = Dispatch(List="1", DispatchPattern=larger_10.LargerThan)  # -> ListA, ListB
dispatch_33 = Dispatch(List="1", DispatchPattern=larger_11.LargerThan)  # -> ListA, ListB
ma_13 = MassAddition(Input=flatten([dispatch_29.ListA, dispatch_30.ListA, dispatch_31.ListA, dispatch_32.ListA, dispatch_33.ListA]))  # -> Result, PartialResults
division_19 = Division(A=ma_13.Result, B=Slider(5, range=0..10))

# ---- group: concrete
ma_14 = MassAddition(Input=flatten([area_20.Area, area_23.Area, area_25.Area, area_21.Area, area_22.Area, area_19.Area, area_14.Area, area_16.Area, area_30.Area, area_17.Area]))  # -> Result, PartialResults
division_20 = Division(A=ma_14.Result, B=lng_32)
division_21 = Division(A=division_20, B="10")

# ----
panel_90 = Panel(division_21)
remap_7 = RemapNumbers(Value=division_21, Source=dom_8, Target=dom_7)  # -> Mapped, Clipped
weave_32 = Weave(
    Pattern=[0, 1, 2, 3, 4, 5, 6],
    Stream0=division_19,
    Stream1=remap_5.Mapped,
    Stream2=division_14,
    Stream3=remap_2.Mapped,
    Stream4=remap_4.Mapped,
    Stream5=remap_3.Mapped,
    Stream6=remap_7.Mapped,
    NullGaps=False)
panel_91 = Panel(weave_32)

rec = DataRecorder(weave_32, DataLimit=-10, RecordData=True)
panel_92 = Panel(rec)

panel_93 = Panel(panel_92)
hs = HoopSnake(
    StartingData="0",
    TerminationCondition=smaller_3.SmallerThan,
    Hoopsnake_Data_autoUpdate=False,
    Hoopsnake_Data_dataLimit=2147483647,
    Hoopsnake_Data_delay=0,
    Hoopsnake_Data_resetCounter=True,
    Hoopsnake_Data_updateView=True)  # -> Feedback, FeedbackHistory, LoopsCounter, IterationsCounter; disabled
smaller_3 = SmallerThan(FirstNumber=hs.IterationsCounter, SecondNumber=panel)  # -> SmallerThan, OrEqualTo; disabled
panel_96 = Panel(subtraction_7)
panel_97 = Panel(hs_2.IterationsCounter)
smaller_4 = SmallerThan(FirstNumber=panel_97, SecondNumber=expr("x+1", panel_5))  # -> SmallerThan, OrEqualTo
hs_2 = HoopSnake(
    StartingData="0",
    TerminationCondition=smaller_4.SmallerThan,
    Hoopsnake_Data_autoUpdate=False,
    Hoopsnake_Data_dataLimit=2147483647,
    Hoopsnake_Data_delay=0,
    Hoopsnake_Data_resetCounter=True,
    Hoopsnake_Data_updateView=True)  # -> Feedback, FeedbackHistory, LoopsCounter, IterationsCounter
panel_98 = Panel(hs_2.IterationsCounter)
item_99 = ListItem(List=flatten(data_3), Index=panel_98, Wrap=True)
subtraction_7 = Subtraction(A=item_99, B="1")
item_100 = ListItem(List=flatten(pt_3), Index=panel_98, Wrap=True)

# ---- group: grid print (continued)
panel_99 = Panel(panel_98)

# ----
move_51 = Move(Geometry=item_100, Motion=X_4)  # -> Geometry, Transform
move_52 = Move(Geometry=move_51.Geometry, Motion=X_5)  # -> Geometry, Transform
pdecon_14 = Deconstruct(Point=move_52.Geometry)  # -> XComponent, YComponent, ZComponent
pt_11 = ConstructPoint(XCoordinate=pdecon_14.XComponent, YCoordinate=pdecon_14.YComponent, ZCoordinate=0)
move_53 = Move(Geometry=pt_11, Motion=Y)  # -> Geometry, Transform
rotate_2 = Rotate(Geometry=move_53.Geometry, Angle=degrees(series_3), Plane=pt_11)  # -> reverse(Geometry), Transform
move_54 = Move(Geometry=pt_11, Motion=Y_2)  # -> Geometry, Transform
rotate_3 = Rotate(Geometry=move_54.Geometry, Angle=degrees(series_3), Plane=pt_11)  # -> reverse(Geometry), Transform
ln_11 = Line(StartPoint=pt_11, EndPoint=rotate_3.Geometry)
divide_8 = DivideCurve(Curve=ln_11, Count="10", Kinks=False)  # -> Points, Tangents, Parameters
eval_4 = EvaluateCurve(Curve=reparameterize(ln_11), Parameter=weave_32)  # -> Point, Tangent, Angle
flip_5 = FlipMatrix(Data=divide_8.Points)
addition_9 = Addition(A=panel_99, B=1)
pline_21 = PolyLine(Vertices=eval_4.Point, Closed=True)
pline_22 = PolyLine(Vertices=flip_5, Closed=True)  # -> flatten(Polyline)
larger_12 = LargerThan(FirstNumber=addition_9, SecondNumber="0")  # -> LargerThan, OrEqualTo
boundary_16 = BoundarySurfaces(Edges=pline_21)
len_11 = Length(Curve=pline_22)
larger_13 = LargerThan(FirstNumber=len_11, SecondNumber="0.001")  # -> LargerThan, OrEqualTo
dispatch_34 = Dispatch(List=pline_22, DispatchPattern=larger_13.LargerThan)  # -> ListA, ListB
bake = BakeGeometry(
    Bake=larger_12.LargerThan,
    Geometry=dispatch_34.ListA,
    Attributes=createatts_2,
    DeleteOldBakes=False,
    PreserveTrees=False)
bake_2 = BakeGeometry(Bake=larger_12.LargerThan, Geometry=ln_11, Attributes=createatts_3, DeleteOldBakes=False, PreserveTrees=False)
bake_3 = BakeGeometry(Bake=larger_12.LargerThan, Geometry=pline_21, Attributes=createatts_4, DeleteOldBakes=False, PreserveTrees=False)
justified_text = JustifiedText3d(
    Location=graft(rotate_2.Geometry),
    Text=rep,
    Size=1,
    HorizontalAlignment=1,
    VerticalAlginment=0,
    Font="Calibri",
    UseMeshes=False,
    Attributes=createatts,
    Bake=larger_12.LargerThan)
justified_text_2 = JustifiedText3d(
    Location=graft(pt_5),
    Text=item_11,
    Size=1,
    HorizontalAlignment=1,
    VerticalAlginment=0,
    Font="Calibri",
    UseMeshes=False,
    Attributes=createatts,
    Bake=larger_12.LargerThan)
bake_4 = BakeGeometry(
    Bake=larger_12.LargerThan,
    Geometry=flatten(move_38.Geometry),
    Attributes=createatts_9,
    DeleteOldBakes=False,
    PreserveTrees=False)  # disabled
bake_5 = BakeGeometry(
    Bake=larger_12.LargerThan,
    Geometry=flatten(clean_21),
    Attributes=createatts_7,
    DeleteOldBakes=False,
    PreserveTrees=False)  # disabled
bake_6 = BakeGeometry(
    Bake=larger_12.LargerThan,
    Geometry=flatten(clean_23),
    Attributes=createatts_5,
    DeleteOldBakes=False,
    PreserveTrees=False)  # disabled
bake_7 = BakeGeometry(
    Bake=larger_12.LargerThan,
    Geometry=flatten(move_31.Geometry),
    Attributes=createatts_6,
    DeleteOldBakes=False,
    PreserveTrees=False)  # disabled
bake_8 = BakeGeometry(
    Bake=larger_12.LargerThan,
    Geometry=flatten([move_30.Geometry, boundary_14, move_37.Geometry]),
    Attributes=createatts_8,
    DeleteOldBakes=False,
    PreserveTrees=False)  # disabled
bake_9 = BakeGeometry(Bake=larger_12.LargerThan, Geometry=flatten(runion), Attributes=createatts_10, DeleteOldBakes=False, PreserveTrees=False)  # disabled
bake_10 = BakeGeometry(
    Bake=larger_12.LargerThan,
    Geometry=flatten(move_50.Geometry),
    Attributes=createatts_11,
    DeleteOldBakes=False,
    PreserveTrees=False)  # disabled
bake_11 = BakeGeometry(
    Bake=larger_12.LargerThan,
    Geometry=flatten(boundary_15),
    Attributes=createatts_16,
    DeleteOldBakes=False,
    PreserveTrees=False)  # disabled
bake_12 = BakeGeometry(
    Bake=larger_12.LargerThan,
    Geometry=flatten(pline_20),
    Attributes=createatts_12,
    DeleteOldBakes=False,
    PreserveTrees=False)  # disabled
bake_13 = BakeGeometry(
    Bake=larger_12.LargerThan,
    Geometry=flatten(move_41.Geometry),
    Attributes=createatts_13,
    DeleteOldBakes=False,
    PreserveTrees=False)  # disabled
bake_14 = BakeGeometry(
    Bake=larger_12.LargerThan,
    Geometry=flatten(move_46.Geometry),
    Attributes=createatts_14,
    DeleteOldBakes=False,
    PreserveTrees=False)  # disabled
bake_15 = BakeGeometry(Bake=larger_12.LargerThan, Geometry=flatten(ln_10), Attributes=createatts_21, DeleteOldBakes=False, PreserveTrees=False)  # disabled
bake_16 = BakeGeometry(Bake=larger_12.LargerThan, Geometry=flatten(join_7), Attributes=createatts_15, DeleteOldBakes=False, PreserveTrees=False)  # disabled
bake_17 = BakeGeometry(
    Bake=larger_12.LargerThan,
    Geometry=flatten(move_34.Geometry),
    Attributes=createatts_17,
    DeleteOldBakes=False,
    PreserveTrees=False)  # disabled
bake_18 = BakeGeometry(
    Bake=larger_12.LargerThan,
    Geometry=flatten(move_27.Geometry),
    Attributes=createatts_18,
    DeleteOldBakes=False,
    PreserveTrees=False)  # disabled
bake_19 = BakeGeometry(
    Bake=larger_12.LargerThan,
    Geometry=flatten(move_36.Geometry),
    Attributes=createatts_19,
    DeleteOldBakes=False,
    PreserveTrees=False)  # disabled
bake_20 = BakeGeometry(
    Bake=larger_12.LargerThan,
    Geometry=flatten(clean_2),
    Attributes=createatts_20,
    DeleteOldBakes=False,
    PreserveTrees=False)  # disabled
justified_text_3 = JustifiedText3d(
    Location=move_51.Geometry,
    Text=join_8,
    Size=1,
    HorizontalAlignment=0,
    VerticalAlginment=0,
    Font="Calibri",
    UseMeshes=False,
    Attributes=createatts,
    Bake=larger_12.LargerThan)
rep_2 = ReplaceText(Text=panel_50, Find="88", Replace=hs_2.IterationsCounter, RecursiveReplace=False)
saveview = SaveViewportToFile(Run=larger_12.OrEqualTo, ViewportName="view 02", Render=False, FilePath=rep_2, ScaleFactor=3)
